# Grasshopper definition NFP.gh (Grasshopper 1.0.7)

crv = Curve(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)
disc = Discontinuity(Curve=crv, Level=1)  # -> Points, Parameters
pt2num = PointsToNumbers(Points=disc.Points, Mask=2)
multiplication = Multiplication(A=pt2num, B=Slider(100, range=0..1000))
int = Integer(multiplication)
partition = PartitionList(List=int, Size=2)
join = TextJoin(Text=partition, Join=",")
concat = Concatenate(FragmentA="Clipper2Lib::Point64(", FragmentB=join, FragmentC=")")
trim = TrimTree(Tree=concat, Depth=1)
join_2 = TextJoin(Text=trim, Join=",")
concat_2 = Concatenate(FragmentA="{", FragmentB=join_2, FragmentC="},")  # -> flatten(Result)
join_3 = TextJoin(Text=flatten(concat_2), Join=",")  # -> flatten(Result)
concat_3 = Concatenate(FragmentA="{", FragmentB=join_3, FragmentC="}")
panel = Panel(concat_2)
