# Grasshopper definition butterflies.gh (Grasshopper 1.0.7)
# plug-ins: NGon

genes = GenePool(Decimals=2, Maximum=100, Minimum=0, Value=[2.93, 36.65, 57.88])
crv = Curve(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)
substrate = Substrate(Border=crv, Count=Slider(8, range=0..10), Angles=genes, Deviation=0, Seed=Slider(2, range=0..10))
boundary = BoundarySurfaces(Edges=crv)
srfsplit = SurfaceSplit(Surface=boundary, Curves=substrate)
crv_2 = Curve(simplify(graft(srfsplit)))
fromp = FromPolylines(Curves=flatten(crv_2), Min_Triangulation=True)
Z = UnitZ(Factor=Slider(2, range=0..3))
weld = WeldMesh(Mesh=fromp, Radius=Slider(1, range=0..1), Align=True, Use_RTree=True)
top = GetPolylines(Mesh=weld)  # -> simplify(graft(Polylines))
move = Move(Geometry=top, Motion=Z)  # -> simplify(Geometry), Transform
merge = Merge(Data1=top, Data2=move.Geometry)
qsph = QuadSphere(Base=PlaneXY(0, 0, 0), Radius=1)
brep = Brep(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)
bbox = BoundingBox(Content=brep, Plane=PlaneXY(0, 0, 0))  # -> Box, Box_2
crv_3 = Curve(merge)
area = Area(Geometry=bbox.Box)  # -> Area, Centroid
loft = Loft(Curves=crv_3, Options={Adjust=False, Closed=False, LoftEnds=0, LoftSimp=0, LoftType=0, Rebuild=10, Refit=0.01})
popgeo = PopulateGeometry(Geometry=brep, Count=Slider(30, range=0..30), Seed=Slider(5, range=0..10))
cap = CapHoles(Brep=loft)
scale = Scale(Geometry=bbox.Box, Center=area.Centroid, Factor=Slider(2, range=0..10))  # -> Geometry, Transform
voronoi³ = Voronoi3D(Points=popgeo, Box=scale.Geometry)  # -> Cells, Boundary
bbx = BrepBrep(BrepA=brep, BrepB=voronoi³.Cells)  # -> flatten(Curves), Points
crv_4 = Curve(crv_3)
srfsplit_2 = SurfaceSplit(Surface=brep, Curves=bbx.Curves)
disc = Discontinuity(Curve=srfsplit_2, Level=1)  # -> Points, Parameters
pline = PolyLine(Vertices=disc.Points, Closed=invert(False))  # -> flatten(Polyline)
number_slider = Slider(1, range=0..1)
fromp_2 = FromPolylines(Curves=pline, Min_Triangulation=True)
weld_2 = WeldMesh(Mesh=fromp_2, Radius=number_slider, Align=True, Use_RTree=True)
planar = PlanarFaces(Mesh=weld_2)  # -> Polylines, Lines
fromp_3 = FromPolylines(Curves=planar.Polylines, Min_Triangulation=True)
weld_3 = WeldMesh(Mesh=fromp_3, Radius=number_slider, Align=True, Use_RTree=True)
top_2 = GetPolylines(Mesh=weld_3)
boundary_2 = BoundarySurfaces(Edges=top_2)
offsetplanar = OffsetPlanar(Mesh=weld_3, Dist=Slider(2, range=0..100))
naked = NakedVertices(Mesh=fromp_3)  # -> Vertices, Status
merge_2 = Merge(Data1=flatten(crv_3), Data2=flatten(offsetplanar))
number_slider_2 = Slider(0.1, range=0..0.1)
number_slider_3 = Slider(100, range=0..100)
partition = PartitionList(List=merge_2, Size=Slider(2, range=0..10))
loft_2 = Loft(Curves=partition, Options={Adjust=False, Closed=False, LoftEnds=0, LoftSimp=0, LoftType=0, Rebuild=10, Refit=0.01})
cap_2 = CapHoles(Brep=loft_2)
crv_5 = Curve(partition)
path = FilePath("C:\IBOIS57\_Code\Software\Python\compas_wood\backend\src\wood\dataset\out.xml")
scale_2 = Scale(Geometry=crv_5, Center=Point(0, 0, 0), Factor=Slider(10, range=0..10))  # -> simplify(Geometry), Transform
number_slider_4 = Slider(26, range=0..40)
number_slider_5 = Slider(12, range=0..40)
number_slider_6 = Slider(17, range=0..40)
path_2 = FilePath("C:\IBOIS57\_Code\Software\Python\compas_wood\backend\src\wood\dataset\type_plates_name_side_to_side_edge_inplane_2_butterflies.xml")
xml_to_polylines_tree_type = XML_to_Polylines_Tree_Type(path=path)  # -> out, plines, types; inputs path: String
# ---------- xml_to_polylines_tree_type: C# usings ----------
using System.Linq;
using System.Xml;
# ---------- xml_to_polylines_tree_type: C# ----------
    this.Component.Message = "XML_to_Polylines_Tree \n Types";


    try{
      /////////////////////////////////////////////////////////////////////////////////////////////////////////////////////////////////////////////
      //Load document
      /////////////////////////////////////////////////////////////////////////////////////////////////////////////////////////////////////////////
      XmlDocument doc = new XmlDocument();
      doc.Load(path);
      /////////////////////////////////////////////////////////////////////////////////////////////////////////////////////////////////////////////
      //Start document
      /////////////////////////////////////////////////////////////////////////////////////////////////////////////////////////////////////////////
      var polylines_tree = new DataTree<Polyline>();
      var types_tree = new DataTree<string>();

      //Iterate polyline groups
      int group_count_a = 0;
      int group_count_b = 0;
      foreach(XmlNode node in doc.DocumentElement.ChildNodes){

        Print(node.Name);
        switch(node.Name){
          case("polyline_group"):

            //Iterate polylines
            foreach(XmlNode node_0 in node.ChildNodes){

              //Print(node.Name);
              var polyline = new Polyline();

              //Iterate points
              foreach(XmlNode node_1 in node_0.ChildNodes){
                //Print(node_0.Name);

                //Convert coordinates to points
                if(node_1.Name == "point"){
                  Point3d p = new Point3d(
                    double.Parse(node_1.ChildNodes[0].InnerText),
                    double.Parse(node_1.ChildNodes[1].InnerText),
                    double.Parse(node_1.ChildNodes[2].InnerText)
                    );
                  polyline.Add(p);
                }
              }
              polylines_tree.Add(polyline, new GH_Path(group_count_a));
            }
            group_count_a++;
            break;
          case("type_group"):

            foreach(XmlNode node_0 in node.ChildNodes){
              types_tree.Add((node_0.ChildNodes[0].InnerText), new GH_Path(group_count_b));
             //Print(node_0.ChildNodes[0].InnerText);
            }
            group_count_b++;
            break;
        }


      }

      /////////////////////////////////////////////////////////////////////////////////////////////////////////////////////////////////////////////
      //Close document
      /////////////////////////////////////////////////////////////////////////////////////////////////////////////////////////////////////////////
      plines = polylines_tree;
      types = types_tree;
    }catch(Exception e){
      Print(e.ToString());
    }
# ---------- xml_to_polylines_tree_type: C# additional code ----------
  public void xml_polyline(ref XmlWriter xmlWriter, Polyline pline, string name){
    xmlWriter.WriteStartElement(name);
    foreach(Point3d p in pline){

      xmlWriter.WriteStartElement("point");

      xmlWriter.WriteStartElement("x");
      xmlWriter.WriteString(p.X.ToString());
      xmlWriter.WriteEndElement();

      xmlWriter.WriteStartElement("y");
      xmlWriter.WriteString(p.Y.ToString());
      xmlWriter.WriteEndElement();

      xmlWriter.WriteStartElement("z");
      xmlWriter.WriteString(p.Z.ToString());
      xmlWriter.WriteEndElement();

      xmlWriter.WriteEndElement();
    }
    xmlWriter.WriteEndElement();
  }
# ---------- end xml_to_polylines_tree_type ----------
len = Length(Curve=scale_2.Geometry)
polylines_to_xml = Polylines_to_XML(plines=scale_2.Geometry, path=path_2)  # -> out, A; inputs plines: tree of Polyline, path: String
# ---------- polylines_to_xml: C# ----------
       this.Component.Message = "Polylines_to_XML";
   
    /////////////////////////////////////////////////////////////////////////////////////////////////////////////////////////////////////////////
    //Create document
    /////////////////////////////////////////////////////////////////////////////////////////////////////////////////////////////////////////////
    XmlWriter xmlWriter = XmlWriter.Create(path);
    xmlWriter.WriteStartDocument();
    xmlWriter.WriteStartElement("input_polylines");
    /////////////////////////////////////////////////////////////////////////////////////////////////////////////////////////////////////////////
    //Start document
    /////////////////////////////////////////////////////////////////////////////////////////////////////////////////////////////////////////////
    foreach(Polyline pline in plines.AllData()){
      xml_polyline(ref xmlWriter, pline, "Polyline");
    }

    /////////////////////////////////////////////////////////////////////////////////////////////////////////////////////////////////////////////
    //Close document
    /////////////////////////////////////////////////////////////////////////////////////////////////////////////////////////////////////////////
    xmlWriter.WriteEndDocument();
    xmlWriter.Close();
# ---------- polylines_to_xml: C# additional code ----------
  public void xml_polyline(ref XmlWriter xmlWriter, Polyline pline, string name){
    xmlWriter.WriteStartElement(name);
    foreach(Point3d p in pline){

      xmlWriter.WriteStartElement("point");

      xmlWriter.WriteStartElement("x");
      xmlWriter.WriteString(p.X.ToString());
      xmlWriter.WriteEndElement();

      xmlWriter.WriteStartElement("y");
      xmlWriter.WriteString(p.Y.ToString());
      xmlWriter.WriteEndElement();

      xmlWriter.WriteStartElement("z");
      xmlWriter.WriteString(p.Z.ToString());
      xmlWriter.WriteEndElement();

      xmlWriter.WriteEndElement();
    }
    xmlWriter.WriteEndElement();
  }
# ---------- end polylines_to_xml ----------
branch = TreeBranch(Tree=scale_2.Geometry, Path=[number_slider_5, number_slider_4, number_slider_6], MaintainPaths=True)
branch_2 = TreeBranch(Tree=xml_to_polylines_tree_type.plines, Path=[number_slider_5, number_slider_4, number_slider_6], MaintainPaths=True)
loft_3 = Loft(Curves=branch_2, Options={Adjust=False, Closed=False, LoftEnds=0, LoftSimp=0, LoftType=0, Rebuild=10, Refit=0.01})
cap_3 = CapHoles(Brep=loft_3)
curvepoint = PointOnCurve(branch_2, parameter=0.058)
partition_2 = PartitionList(List=branch_2, Size=Slider(2, range=0..10))
panel = Panel(len)
item = ListItem(List=partition_2, Index=0, Wrap=True)
cp = ControlPoints(Curve=flatten(item))  # -> flatten(Points), Weights, Knots
pline_2 = PolyLine(Vertices=cp.Points, Closed=False)
