# Grasshopper definition chapel.gh (Grasshopper 1.0.7)
# plug-ins: NGon, compas_wood

path = FilePath("C:\IBOIS57\_Code\Software\CPP\CMAKE\super_build\wood\src\wood\dataset\out.xml")
xml_to_polylines_tree_type = XML_to_Polylines_Tree_Type(path=path)  # -> out, plines, types; inputs path: String
# ---------- xml_to_polylines_tree_type: C# usings ----------
using System.Linq;
using System.Xml;
# ---------- xml_to_polylines_tree_type: C# ----------
    this.Component.Message = "XML_to_Polylines_Tree \n Types";


    try{
      /////////////////////////////////////////////////////////////////////////////////////////////////////////////////////////////////////////////
      //Load document
      /////////////////////////////////////////////////////////////////////////////////////////////////////////////////////////////////////////////
      XmlDocument doc = new XmlDocument();
      doc.Load(path);
      /////////////////////////////////////////////////////////////////////////////////////////////////////////////////////////////////////////////
      //Start document
      /////////////////////////////////////////////////////////////////////////////////////////////////////////////////////////////////////////////
      var polylines_tree = new DataTree<Polyline>();
      var types_tree = new DataTree<string>();

      //Iterate polyline groups
      int group_count_a = 0;
      int group_count_b = 0;
      foreach(XmlNode node in doc.DocumentElement.ChildNodes){

        Print(node.Name);
        switch(node.Name){
          case("polyline_group"):

            //Iterate polylines
            foreach(XmlNode node_0 in node.ChildNodes){

              //Print(node.Name);
              var polyline = new Polyline();

              //Iterate points
              foreach(XmlNode node_1 in node_0.ChildNodes){
                //Print(node_0.Name);

                //Convert coordinates to points
                if(node_1.Name == "point"){
                  Point3d p = new Point3d(
                    double.Parse(node_1.ChildNodes[0].InnerText),
                    double.Parse(node_1.ChildNodes[1].InnerText),
                    double.Parse(node_1.ChildNodes[2].InnerText)
                    );
                  polyline.Add(p);
                }
              }
              polylines_tree.Add(polyline, new GH_Path(group_count_a));
            }
            group_count_a++;
            break;
          case("type_group"):

            foreach(XmlNode node_0 in node.ChildNodes){
              types_tree.Add((node_0.ChildNodes[0].InnerText), new GH_Path(group_count_b));
             //Print(node_0.ChildNodes[0].InnerText);
            }
            group_count_b++;
            break;
        }


      }

      /////////////////////////////////////////////////////////////////////////////////////////////////////////////////////////////////////////////
      //Close document
      /////////////////////////////////////////////////////////////////////////////////////////////////////////////////////////////////////////////
      plines = polylines_tree;
      types = types_tree;
    }catch(Exception e){
      Print(e.ToString());
    }
# ---------- xml_to_polylines_tree_type: C# additional code ----------
  public void xml_polyline(ref XmlWriter xmlWriter, Polyline pline, string name){
    xmlWriter.WriteStartElement(name);
    foreach(Point3d p in pline){

      xmlWriter.WriteStartElement("point");

      xmlWriter.WriteStartElement("x");
      xmlWriter.WriteString(p.X.ToString());
      xmlWriter.WriteEndElement();

      xmlWriter.WriteStartElement("y");
      xmlWriter.WriteString(p.Y.ToString());
      xmlWriter.WriteEndElement();

      xmlWriter.WriteStartElement("z");
      xmlWriter.WriteString(p.Z.ToString());
      xmlWriter.WriteEndElement();

      xmlWriter.WriteEndElement();
    }
    xmlWriter.WriteEndElement();
  }
# ---------- end xml_to_polylines_tree_type ----------
loftholes = LoftHoles(Polylines1=xml_to_polylines_tree_type.plines)  # -> Mesh, Mesh_2
mesh = Mesh(loftholes.Mesh_2)

crv = Curve([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])
bbox = BoundingBox(Content=crv, Plane=PlaneXY(0, 0, 0), UnionBox=True)  # -> Box, Box_2
box = EvaluateBox(Box=bbox.Box, UParameter=0.5, VParameter=0.5, WParameter=0)  # -> Plane, Point, Include
move = Move(Geometry=crv, Motion=expr("-x", box.Point))  # -> Geometry, Transform
scale = Scale(Geometry=move.Geometry, Center=Point(0, 0, 0), Factor=Slider(1000, range=0..1000))  # -> Geometry, Transform

group = Group(Objects=xml_to_polylines_tree_type.plines)

# ---- group: connectors
number_slider = Slider(7, range=-10..20)
scale_2 = Scale(Geometry=move.Geometry, Center=Point(0, 0, 0), Factor=Slider(100, range=0..1000))  # -> Geometry, Transform
fromp = FromPolylines(Curves=scale_2.Geometry, Min_Triangulation=False)
clear = Clear(Mesh=fromp)
neg = Negative(Value=number_slider)
crv_2 = Curve([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])
connectors = Connectors(
    Mesh=clear,
    Face_positions=[neg, number_slider],
    Face_thickness=Slider(4, range=0..10),
    Divisions=Slider(2, range=1..10),
    Division_len=Slider(15, range=1..100),
    Rect_width=Slider(12, range=-20..20),
    Rect_height=Slider(12, range=-20..20),
    Rect_thickness=Slider(1, range=1..2),
    Chamfer=Slider(25, range=0..100),
    Cut=crv_2)  # -> flatten(F), F_pl, F_id, E, E_pl, E_id

# ----
fromp_2 = FromPolylines(Curves=scale.Geometry, Min_Triangulation=True)
c_script = CSharpScript(m=fromp_2, Reference="C:\USERS\PETRA\DESKTOP\ANNEN_V2\NGONS\NGonsCore.dll")  # -> out, A, B, C, D, E, F, G; inputs m: Mesh
# ---------- c_script: C# usings ----------
using NGonsCore;
using System.Linq;
# ---------- c_script: C# ----------
    /////////////////////////////////////////////////////////////////////////////////////////////////////////////////////////////////////////////
    //Main Properties
    /////////////////////////////////////////////////////////////////////////////////////////////////////////////////////////////////////////////
    Polyline[] plines = m._Polylines();
    Plane[] planes = m._FPlanes();
    List<List<int>> grouped_ngons = rows(m);
    double min_z = m.GetBoundingBox(true).Min.Z;

    double thickness = 60;
    double top_side_offset = thickness * 2;
    double chamfer_dist = 60;
    double retreate = 300;
    /////////////////////////////////////////////////////////////////////////////////////////////////////////////////////////////////////////////
    //Assign edge types, since the current origami is a simple grid these values stay constant
    /////////////////////////////////////////////////////////////////////////////////////////////////////////////////////////////////////////////
    Dictionary < sbyte, int> edge_plane_count = new Dictionary<sbyte,int>(){{-1,5},{0,1},{1,5}};

    sbyte[,] edge_offset_in_none_out = new sbyte[,] {
      { 0, 1, -1, 0 },
      { 1, 1, 1, 0 },
      { -1, 1, 0, 0 },//this
      { 0, 0, -1, -1 },
      { 1, 0, 1, -1 },
      { -1, 0, 0, -1 }
      };


    Vector3d a = Vector3d.Zero;
    Vector3d b = Vector3d.ZAxis;
    Vector3d[,] edge_insertion_vectors = new Vector3d[,] {
      { a, a, b, a },
      { b, a, b, a },
      { b, a, a, a },//this
      { a, a, b, a },
      { b, a, b, a },
      { b, a, a, a }
      };

    bool[,] chamfer = new bool[,] {
      { false, false, true, false },
      { false, true,true, false},
      { false, true,false, false },//this
      { false, false,false, true },
      { true, false,false, true },
      { true, false,false, false }
      };




    /////////////////////////////////////////////////////////////////////////////////////////////////////////////////////////////////////////////
    //Offset outlines
    //
    //base plane
    //
    //intersected with:
    //
    //4*one_edge_planes(type->edge_offset_in_none_out)
    /////////////////////////////////////////////////////////////////////////////////////////////////////////////////////////////////////////////
    Plane[][][] f_e_planes = new Plane[m.Ngons.Count][][];//list of faces, list of edges, list of planes per one edge
    List<Polyline> outlines = new List<Polyline>();
    List<List<Plane>> outlines_planes = new List<List<Plane>>();

    for(int i = 0; i < grouped_ngons.Count; i++){
      for(int j = 0; j < grouped_ngons[i].Count; j++){



        f_e_planes[grouped_ngons[i][j]] = new Plane[4][];//new Plane[4];
        //          {
        //          new Plane[edge_plane_count[edge_offset_in_none_out[j, 0]]],
        //          new Plane[edge_plane_count[edge_offset_in_none_out[j, 1]]],
        //          new Plane[edge_plane_count[edge_offset_in_none_out[j, 2]]],
        //          new Plane[edge_plane_count[edge_offset_in_none_out[j, 3]]]
        //          };



        Point3d ngon_center = NGonsCore.PolylineUtil.CenterPoint(plines[grouped_ngons[i][j]]);
        int side_plane_count = 0;
        for(int k = 0; k < 4; k++){

          bool border = grouped_ngons[i].Count == 3 && k % 2 == 1;
          int array_length = border ? 1 : edge_plane_count[edge_offset_in_none_out[j, k]];
          f_e_planes[grouped_ngons[i][j]][k] = new Plane[array_length];

          Print(grouped_ngons[i].Count.ToString());
          sbyte edge_type = grouped_ngons[i].Count == 3 && k % 2 == 1 ? (sbyte) 0 : edge_offset_in_none_out[j, k];


          Point3d edge_mid = plines[grouped_ngons[i][j]].SegmentAt(k).PointAt(0.5);
          Vector3d edge_insertion = edge_insertion_vectors[j, k] == Vector3d.Zero || edge_type == 0 ? (new Plane(edge_mid, plines[grouped_ngons[i][j]].SegmentAt(k).Direction)).XAxis : edge_insertion_vectors[j, k];
          //Vector3d edge_insertion = (new Plane(edge_mid, plines[grouped_ngons[i][j]].SegmentAt(k).Direction)).XAxis;
          Plane oriented_plane = new Plane(plines[grouped_ngons[i][j]].SegmentAt(k).PointAt(0.1), edge_insertion, Vector3d.CrossProduct(edge_insertion, plines[grouped_ngons[i][j]].SegmentAt(k).Direction));
          double retreate_t = retreate / plines[grouped_ngons[i][j]].SegmentAt(k).Length;

          switch(edge_type){


            /////////////////////////////////////////////////////////////////////////////////////////////////////////////////////////////////////////////
            //male top-side, neihgbor ngon plane
            /////////////////////////////////////////////////////////////////////////////////////////////////////////////////////////////////////////////
            case(-1)://boundary, edge is on the ground or on the vertical side
            {

              //              int[] neighbor_faces = m._ef(m._fe(grouped_ngons[i][j])[k]);
              //              Print("-1  " + k.ToString() + " " + neighbor_faces[1].ToString() + " " + neighbor_faces[0].ToString());
              //
              //              int opposite_face = neighbor_faces[0] == grouped_ngons[i][j] ? neighbor_faces[1] : neighbor_faces[0];
              //              //f_e_planes[grouped_ngons[i][j]][k][0] = new Plane(edge_mid, planes[opposite_face].ZAxis);
              //              f_e_planes[grouped_ngons[i][j]][k][0] = new Plane(edge_mid, PlaneUtil.BisectorPlane(planes[opposite_face], planes[grouped_ngons[i][j]]).ZAxis);
              //              side_plane_count+=5;

              int[] neighbor_faces = m._ef(m._fe(grouped_ngons[i][j])[k]);
              //Print("1  " + k.ToString() + " " + neighbor_faces[1].ToString() + " " + neighbor_faces[0].ToString());
              int opposite_face = neighbor_faces[0] == grouped_ngons[i][j] ? neighbor_faces[1] : neighbor_faces[0];
              //Print(opposite_face.ToString());

              //Plane0
              f_e_planes[grouped_ngons[i][j]][k][0] = new Plane(plines[grouped_ngons[i][j]].SegmentAt(k).PointAt(0.05), PlaneUtil.BisectorPlane(planes[opposite_face], planes[grouped_ngons[i][j]]).ZAxis);

              //Plane1
              f_e_planes[grouped_ngons[i][j]][k][1] = new Plane(plines[grouped_ngons[i][j]].SegmentAt(k).PointAt(retreate_t), oriented_plane.ZAxis);
              //Plane2
              f_e_planes[grouped_ngons[i][j]][k][2] = new Plane(edge_mid, planes[opposite_face].ZAxis);
              if(    f_e_planes[grouped_ngons[i][j]][k][2].DistanceTo(ngon_center) > 0)
                f_e_planes[grouped_ngons[i][j]][k][2] = PlaneUtil.FlipAndRotate(f_e_planes[grouped_ngons[i][j]][k][2]);

              double offset = DihedralAngle(planes[neighbor_faces[0]], planes[neighbor_faces[1]]) > 90 ? 0.01 : -1 - thickness;
              //Print(DihedralAngle(planes[neighbor_faces[0]], planes[neighbor_faces[1]]).ToString());
              f_e_planes[grouped_ngons[i][j]][k][2] = PlaneUtil.MovePlanebyAxis(f_e_planes[grouped_ngons[i][j]][k][2], offset);

              //Plane3
              f_e_planes[grouped_ngons[i][j]][k][3] = new Plane(plines[grouped_ngons[i][j]].SegmentAt(k).PointAt(1 - retreate_t), oriented_plane.ZAxis);

              //Plane4
              f_e_planes[grouped_ngons[i][j]][k][4] = new Plane(plines[grouped_ngons[i][j]].SegmentAt(k).PointAt(1 - 0.05), PlaneUtil.BisectorPlane(planes[opposite_face], planes[grouped_ngons[i][j]]).ZAxis);

              side_plane_count += 5;


            }
          break;

          /////////////////////////////////////////////////////////////////////////////////////////////////////////////////////////////////////////////
          //boundary
          /////////////////////////////////////////////////////////////////////////////////////////////////////////////////////////////////////////////
          case(0)://one inside plane

          if(Math.Abs(min_z - edge_mid.Z) < 0.01)
            f_e_planes[grouped_ngons[i][j]][k][0] = new Plane(edge_mid, -Vector3d.ZAxis);
          else
            f_e_planes[grouped_ngons[i][j]][k][0] = new Plane(edge_mid, Vector3d.CrossProduct(plines[grouped_ngons[i][j]].SegmentAt(k).Direction, Vector3d.ZAxis));

          side_plane_count++;
          break;

          /////////////////////////////////////////////////////////////////////////////////////////////////////////////////////////////////////////////
          //female top-side
          /////////////////////////////////////////////////////////////////////////////////////////////////////////////////////////////////////////////
          case(1)://5 planes
          {


            int[] neighbor_faces = m._ef(m._fe(grouped_ngons[i][j])[k]);
            //Print("1  " + k.ToString() + " " + neighbor_faces[1].ToString() + " " + neighbor_faces[0].ToString());
            int opposite_face = neighbor_faces[0] == grouped_ngons[i][j] ? neighbor_faces[1] : neighbor_faces[0];
            //Print(opposite_face.ToString());

            //Plane0
            f_e_planes[grouped_ngons[i][j]][k][0] = new Plane(plines[grouped_ngons[i][j]].SegmentAt(k).PointAt(0.05), PlaneUtil.BisectorPlane(planes[opposite_face], planes[grouped_ngons[i][j]]).ZAxis);

            //Plane1
            f_e_planes[grouped_ngons[i][j]][k][1] = new Plane(plines[grouped_ngons[i][j]].SegmentAt(k).PointAt(retreate_t), oriented_plane.ZAxis);

            //Plane2
            f_e_planes[grouped_ngons[i][j]][k][2] = new Plane(edge_mid, planes[opposite_face].ZAxis);
            if(    f_e_planes[grouped_ngons[i][j]][k][2].DistanceTo(ngon_center) > 0)
              f_e_planes[grouped_ngons[i][j]][k][2] = PlaneUtil.FlipAndRotate(f_e_planes[grouped_ngons[i][j]][k][2]);
            double offset = DihedralAngle(planes[neighbor_faces[0]], planes[neighbor_faces[1]]) > 90 ? top_side_offset : top_side_offset * 0.5;
            f_e_planes[grouped_ngons[i][j]][k][2] = PlaneUtil.MovePlanebyAxis(f_e_planes[grouped_ngons[i][j]][k][2], offset);
            //Plane3
            f_e_planes[grouped_ngons[i][j]][k][3] = new Plane(plines[grouped_ngons[i][j]].SegmentAt(k).PointAt(1 - retreate_t), oriented_plane.ZAxis);
            //Plane4
            f_e_planes[grouped_ngons[i][j]][k][4] = new Plane(plines[grouped_ngons[i][j]].SegmentAt(k).PointAt(1 - 0.05), PlaneUtil.BisectorPlane(planes[opposite_face], planes[grouped_ngons[i][j]]).ZAxis);

            side_plane_count += 5;
          }
          break;
        }

      }
      // break;
      /////////////////////////////////////////////////////////////////////////////////////////////////////////////////////////////////////////////
      //Perform intersection
      /////////////////////////////////////////////////////////////////////////////////////////////////////////////////////////////////////////////
      List<Plane> side_planes = new List<Plane>(side_plane_count);
      // side_planes.Add(planes[grouped_ngons[i][j]]);



      List<int> chamfer_ids = new List<int>();
      int last_count = 0;
      for(int k = 0; k < 4; k++){


        //orient outwards
        for(int l = 0; l < f_e_planes[grouped_ngons[i][j]][k].Length;l++){
          if(  f_e_planes[grouped_ngons[i][j]][k][l].DistanceTo(ngon_center) > 0)
            f_e_planes[grouped_ngons[i][j]][k][l] = PlaneUtil.FlipAndRotate(f_e_planes[grouped_ngons[i][j]][k][l]);
        }

        side_planes.AddRange(f_e_planes[grouped_ngons[i][j]][k]);

        if(grouped_ngons[i].Count == 6){
          if(chamfer[j, k]){
            chamfer_ids.Add(last_count);
          }

          last_count += f_e_planes[grouped_ngons[i][j]][k].Length;
        }


      }

      /////////////////////////////////////////////////////////////////////////////////////////////////////////////////////////////////////////////
      //Get Polylines
      /////////////////////////////////////////////////////////////////////////////////////////////////////////////////////////////////////////////

      Polyline[] plate_plines = new Polyline[]{

        PolylineUtil.PolylineFromPlanes(planes[grouped_ngons[i][j]], side_planes, true),
        PolylineUtil.PolylineFromPlanes(planes[grouped_ngons[i][j]].MovePlanebyAxis(thickness), side_planes, true)
        };

      for(int k = 0; k < plate_plines.Length;k++)
        plate_plines[k].ShiftPolyline(1);


      /////////////////////////////////////////////////////////////////////////////////////////////////////////////////////////////////////////////
      //Chamfer
      /////////////////////////////////////////////////////////////////////////////////////////////////////////////////////////////////////////////
            foreach(Polyline plate_pline in plate_plines){
              plate_pline.RemoveAt(plate_pline.Count - 1);
      
              int inserted_point_count = 0;
              for(int k = 0; k < chamfer_ids.Count; k++ ){
                int id = chamfer_ids[k] + inserted_point_count;
                int prev = NGonsCore.MathUtil.Wrap(id - 1, plate_pline.Count);
                int next = NGonsCore.MathUtil.Wrap(id + 1, plate_pline.Count);
                Vector3d v0 = plate_pline[next] - plate_pline[id];
                Vector3d v1 = plate_pline[prev] - plate_pline[id];
                v0.Unitize();
                v1.Unitize();
                v0 *= chamfer_dist;
                v1 *= chamfer_dist;
      
      
                Point3d p = plate_pline[id];
      
                plate_pline[id] += v0;
                plate_pline.Insert(id, p + v1);
      
                inserted_point_count++;
      
              }
              plate_pline.Add(plate_pline[0]);
            }


      /////////////////////////////////////////////////////////////////////////////////////////////////////////////////////////////////////////////
      //output
      /////////////////////////////////////////////////////////////////////////////////////////////////////////////////////////////////////////////

      outlines_planes.Add(side_planes);
      outlines.AddRange(plate_plines);



    }
    //break;
  }



  /////////////////////////////////////////////////////////////////////////////////////////////////////////////////////////////////////////////
  //Output
  /////////////////////////////////////////////////////////////////////////////////////////////////////////////////////////////////////////////

  A = plines;
  B = planes;
  C = NGonsCore.GrasshopperUtil.IE2(grouped_ngons);
  D = edge_offset_in_none_out;
  E = NGonsCore.GrasshopperUtil.IE3(f_e_planes);
  F =  NGonsCore.GrasshopperUtil.IE2(outlines_planes);
  G =  (outlines);
# ---------- c_script: C# additional code ----------
public List<List<int>> rows(Mesh m){

  List < List < int>> ids = new List<List<int>>{new List<int>{0,1,2}};

  List<int> id = new List<int>(6);
  for(int i = 0; i < m.Ngons.Count - 6; i++){

    if(i % 6 == 0 && id.Count == 6){
      ids.Add(new List<int>(id));
      id.Clear();
    }
    //Rhino.RhinoApp.WriteLine(i.ToString());
    id.Add(i + 3);
  }
  ids.Add(new List<int>(id));
  ids.Add(new List<int>{m.Ngons.Count - 3,m.Ngons.Count - 2,m.Ngons.Count - 1});
  return ids;
}

public double DihedralAngle(Plane plane0, Plane plane1) {


  //Calculate angle by line intersection
  Point3d mid = (plane0.Origin + plane1.Origin) * 0.5;

  //  Line angleLine0 = new Line(plane0.Origin, plane0.Origin + plane0.ZAxis);
  //  Line angleLine1 = new Line(plane1.Origin, plane1.Origin + plane1.ZAxis);
  //  double t0,t1;
  //  Rhino.Geometry.Intersect.Intersection.LineLine(angleLine0, angleLine1, out t0, out t1, 0.01, false);
  //  Print(t0.ToString());
  if(plane0.DistanceTo(mid) < 0)//t0 < 0
    return 91;
  else
    return 0;




  //  ////////////////////////////////////////////////////////////////////////////////////////////////////////
  //  //Plane cannot be anti/parallel and they must be apart from each other
  //  ////////////////////////////////////////////////////////////////////////////////////////////////////////
  //  if (plane0.ZAxis.IsParallelTo(plane1.ZAxis, 0.01) == 0 && plane0.Origin.DistanceToSquared(plane1.Origin) > 0.001) {
  //
  //    ////////////////////////////////////////////////////////////////////////////////////////////////////////
  //    //Intersect two lines to get center
  //    ////////////////////////////////////////////////////////////////////////////////////////////////////////
  //    double t0 ,t1;
  //    Rhino.Geometry.Intersect.Intersection.LineLine(angleLine0, angleLine1, out  t0, out  t1);
  //
  //
  //    ////////////////////////////////////////////////////////////////////////////////////////////////////////
  //    //Construct plane from LineLine center and plane origins
  //    ////////////////////////////////////////////////////////////////////////////////////////////////////////
  //    Point3d center = angleLine0.PointAt(t0);
  //    Vector3d v0 = (plane0.Origin - center).Unit();
  //    Vector3d v1 = (plane1.Origin - center).Unit();
  //    Plane dihedralPlane = new Plane(center, v0, v1);
  //
  //
  //    ////////////////////////////////////////////////////////////////////////////////////////////////////////
  //    //Compute angle
  //    ////////////////////////////////////////////////////////////////////////////////////////////////////////
  //    double dihedralAngle = Rhino.RhinoMath.ToDegrees(Vector3d.VectorAngle(v0, v1, dihedralPlane));
  //
  //    return dihedralAngle;
  //
  //  } else
  //    return 0;//Axes are paralell or anti-parallel |.| or _._ or planes are at the same location

}
# ---------- end c_script ----------
pln = Plane(c_script.F)

# ---- group: Adjacency
crv_3 = Curve([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])
crv_4 = Curve([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])
explode = Explode(Curve=crv_4, Recursive=True)  # -> Segments, Vertices
explode_2 = Explode(Curve=crv_3, Recursive=True)  # -> Segments, Vertices
crv_5 = Curve([explode_2.Segments, explode.Segments])
c_script_2 = CSharpScript(m=clear, l=flatten([explode_2.Segments, explode.Segments]))  # -> out, flatten(A); inputs m: Mesh, l: list of Line
# ---------- c_script_2: C# ----------
    List<string> neighbors = new List<string>();

    DataTree<int> pairs = new DataTree<int>();
    for(int i = 0; i < l.Count; i++){
      MeshPoint mp = m.ClosestMeshPoint(l[i].PointAt(0.5), Rhino.RhinoDoc.ActiveDoc.ModelAbsoluteTolerance);

      int f = mp.FaceIndex;
      int[] fe = m.TopologyEdges.GetEdgesForFace(f);
      int e = -1;
      for(int j = 0; j < fe.Length; j++){
        if(m.TopologyEdges.EdgeLine(fe[j]).ClosestPoint(l[i].PointAt(0.5), true).DistanceToSquared(l[i].PointAt(0.5)) < Rhino.RhinoDoc.ActiveDoc.ModelAbsoluteTolerance * Rhino.RhinoDoc.ActiveDoc.ModelAbsoluteTolerance){
          e = fe[j];
          break;
        }
      }



      int[] ef = m.TopologyEdges.GetConnectedFaces(e);
      pairs.AddRange(new int[]{ef[0] * 2 + 0,ef[1] * 2 + 0,-1,-1}, new GH_Path(i * 2 + 0));
      pairs.AddRange(new int[]{ef[0] * 2 + 1,ef[1] * 2 + 1,-1,-1}, new GH_Path(i * 2 + 1));

    }
    A = pairs;
# ---------- end c_script_2 ----------
midpt = CurveMiddle(Curve=crv_5)
item = ListItem(List=c_script_2.A, Index=0, Wrap=True)  # -> Item, Item1, Item2, Item3
join = TextJoin(Text=c_script_2.A, Join=",")

# ----
trim = TrimTree(Tree=c_script.E, Depth=1)
branch = TreeBranch(Tree=simplify(trim), Path=Slider(0, range=0..50), MaintainPaths=True)
pline = PolyLine(Vertices=branch, Closed=False)

crv_6 = Curve(c_script.G)
boundary = BoundarySurfaces(Edges=crv_6)
partition = PartitionList(List=crv_6, Size=2)
loft = Loft(Curves=partition, Options={Adjust=False, Closed=False, LoftEnds=0, LoftSimp=0, LoftType=0, Rebuild=10, Refit=0.01})
display = CurvePreview(Curve=partition)
cap = CapHoles(Brep=loft)

panel = Panel("""0
0
1
1""")
crv_7 = Curve(connectors.F)
cull = CullPattern(List=crv_7, CullPattern=panel)
path_2 = FilePath("C:\IBOIS57\_Code\Software\CPP\CMAKE\super_build\wood\src\wood\dataset\in_chapel_one_layer.xml")
polylines_to_xml = Polylines_to_XML(plines=cull, path=path_2)  # -> out, A; inputs plines: tree of Polyline, path: String
# ---------- polylines_to_xml: C# ----------
       this.Component.Message = "Polylines_to_XML";
   
    /////////////////////////////////////////////////////////////////////////////////////////////////////////////////////////////////////////////
    //Create document
    /////////////////////////////////////////////////////////////////////////////////////////////////////////////////////////////////////////////
    XmlWriter xmlWriter = XmlWriter.Create(path);
    xmlWriter.WriteStartDocument();
    xmlWriter.WriteStartElement("input_polylines");
    /////////////////////////////////////////////////////////////////////////////////////////////////////////////////////////////////////////////
    //Start document
    /////////////////////////////////////////////////////////////////////////////////////////////////////////////////////////////////////////////
    foreach(Polyline pline in plines.AllData()){
      xml_polyline(ref xmlWriter, pline, "Polyline");
    }

    /////////////////////////////////////////////////////////////////////////////////////////////////////////////////////////////////////////////
    //Close document
    /////////////////////////////////////////////////////////////////////////////////////////////////////////////////////////////////////////////
    xmlWriter.WriteEndDocument();
    xmlWriter.Close();
# ---------- polylines_to_xml: C# additional code ----------
  public void xml_polyline(ref XmlWriter xmlWriter, Polyline pline, string name){
    xmlWriter.WriteStartElement(name);
    foreach(Point3d p in pline){

      xmlWriter.WriteStartElement("point");

      xmlWriter.WriteStartElement("x");
      xmlWriter.WriteString(p.X.ToString());
      xmlWriter.WriteEndElement();

      xmlWriter.WriteStartElement("y");
      xmlWriter.WriteString(p.Y.ToString());
      xmlWriter.WriteEndElement();

      xmlWriter.WriteStartElement("z");
      xmlWriter.WriteString(p.Z.ToString());
      xmlWriter.WriteEndElement();

      xmlWriter.WriteEndElement();
    }
    xmlWriter.WriteEndElement();
  }
# ---------- end polylines_to_xml ----------
panel_2 = Panel(path_2)

crv_8 = Curve([<curve referenced from the Rhino model> x18])
crv_9 = Curve([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])
crv_10 = Curve(connectors.F)
partition_2 = PartitionList(List=connectors.F, Size=2)
path_3 = FilePath("C:\IBOIS57\_Code\Software\CPP\CMAKE\super_build\wood\src\wood\dataset\in_chapel.xml")
split = SplitList(List=connectors.F, Index="36")  # -> ListA, ListB
display_2 = CurvePreview(Curve=connectors.F)
polylines_to_xml_2 = Polylines_to_XML(plines=partition_2, path=path_3)  # -> out, A; inputs plines: tree of Polyline, path: String; same code as polylines_to_xml
loft_2 = Loft(Polylines0=partition_2)  # disabled
loft_3 = Loft(Curves=partition_2, Options={Adjust=False, Closed=False, LoftEnds=0, LoftSimp=0, LoftType=0, Rebuild=10, Refit=0.01})
partition_3 = PartitionList(List=split.ListA, Size=2)  # -> simplify(Chunks)
cap_2 = CapHoles(Brep=loft_3)  # -> flatten(Brep)

# ---- group: Intertion directions and joint types
pt = Point([Point(-91.81232423, 541.7427792, 386.5122655), Point(-93.84732885, 541.9748552, 409.1474066), Point(-60.58369023, 314.1992173, 392.2421002), Point(-61.19265374, 315.029935, 414.6385886), Point(-52.50377008, 89.16736821, 405.4995063), Point(-49.62144247, 90.45030549, 427.4164228)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])
pt_2 = Point([Point(481.2363385, 707.5750006, 344.6218181), Point(477.8605169, 698.0209638, 319.6608774), Point(-504.2042346, 688.8206048, 367.8319549), Point(-488.3289649, 688.6895137, 349.4191513), Point(-483.044312, 609.8491291, 354.0449534), Point(-498.6266985, 609.3930882, 372.6763694)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])
crv_11 = Curve([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])
entwine = Entwine(Branch00="16", Branch01="15", FlattenInputs=True)
entwine_2 = Entwine(Branch00=pt_2, Branch01=pt, FlattenInputs=True)
cp_lines = Closest_lines(Polylines=partition_2, Lines=crv_11)  # -> Polylines, Vectors
lng = ListLength(List=entwine_2)
repeat = RepeatData(Data=entwine, Length=lng)
cp_lines_2 = Closest_indexed_points(Polylines=partition_2, Points=entwine_2, Ints=repeat)  # -> Polylines, Ints

# ----
item_2 = ListItem(List=partition_3, Index=0, Wrap=True)
partition_4 = PartitionList(List=flatten(item_2), Size=2)  # -> simplify(Chunks)
area = Area(Geometry=partition_4)  # -> Area, flatten(Centroid)
partition_5 = PartitionList(List=flatten(area.Centroid), Size=2)  # -> simplify(Chunks)
avr = Average(Input=partition_5)
scale_3 = Scale(Geometry=partition_5, Center=avr, Factor=Slider(8, range=0..10))  # -> flatten(Geometry), Transform
points = PointList(Points=scale_3.Geometry, Size=Slider(22, range=0..100))

join_2 = TextJoin(Text=cp_lines_2.Ints, Join=",")
concat = Concatenate(FragmentA="{", FragmentB=join_2, FragmentC="}")
join_3 = TextJoin(Text=flatten(concat), Join=",")
panel_3 = Panel(join_3)

join_4 = TextJoin(Text=cp_lines.Vectors, Join=",")
concat_2 = Concatenate(FragmentA="{", FragmentB=join_4, FragmentC="}")
join_5 = TextJoin(Text=flatten(concat_2), Join=",")
panel_4 = Panel(join_5)

crv_12 = Curve([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])
lng_2 = ListLength(List=cap_2)
series = Series(Start=0, Step=1, Count=lng_2)
panel_5 = Panel("""-1
-1""")

crv_13 = Curve([crv_12, crv_9])

curvepoint = PointOnCurve(crv_13, parameter=0)
cp = ControlPoints(Curve=crv_13)  # -> Points, Weights, Knots
item_3 = ListItem(List=cp.Points, Index=0, Wrap=True)  # -> Item, Item1, Item2, Item3
pline_2 = PolyLine(Vertices=[item_3.Item, item_3.Item1, item_3.Item3, item_3.Item2], Closed=False)  # -> flatten(Polyline)
cp_2 = ControlPoints(Curve=pline_2)  # -> Points, Weights, Knots
brep_cp = BrepClosestPoint(Point=simplify(graft(cp_2.Points)), Brep=cap_2)  # -> Point, Normal, Distance
sort = SortList(Keys=brep_cp.Distance, ValuesA=series)  # -> Keys, ValuesA
item_4 = ListItem(List=sort.ValuesA, Index=0, Wrap=True)
trim_2 = TrimTree(Tree=item_4, Depth=1)
ins = InsertItems(List=trim_2, Item=panel_5, Indices=2, Wrap=True)
ins_2 = InsertItems(List=ins, Item=panel_5, Indices=6, Wrap=True)  # -> flatten(List)

cp_3 = ControlPoints(Curve=crv_13)  # -> Points, Weights, Knots
lng_3 = ListLength(List=cap_2)
brep_cp_2 = BrepClosestPoint(Point=simplify(graft(cp_3.Points)), Brep=cap_2)  # -> Point, Normal, Distance
series_2 = Series(Start=0, Step=1, Count=lng_3)
sort_2 = SortList(Keys=brep_cp_2.Distance, ValuesA=series_2)  # -> Keys, ValuesA
item_5 = ListItem(List=sort_2.ValuesA, Index=0, Wrap=True)
trim_3 = TrimTree(Tree=item_5, Depth=1)

join_6 = TextJoin(Text=ins_2, Join=",")
concat_3 = Concatenate(FragmentA="{", FragmentB=join_6, FragmentC="}")
join_7 = TextJoin(Text=flatten(concat_3), Join=",")
panel_6 = Panel(join_7)

join_8 = TextJoin(Text=trim_3, Join=",")
concat_4 = Concatenate(FragmentA="{", FragmentB=join_8, FragmentC="}")
join_9 = TextJoin(Text=flatten(concat_4), Join=",")
panel_7 = Panel(join_9)
