# Grasshopper definition top_to_top.gh (Grasshopper 1.0.7)

crv = Curve([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])
partition = PartitionList(List=crv, Size=Slider(2, range=0..10))
path = FilePath("C:\IBOIS57\_Code\Software\CPP\CMAKE\super_build\wood\src\wood\dataset\in_top_to_top_corner.xml")
polylines_to_xml = Polylines_to_XML(plines=partition, path=path)  # -> out, A; inputs plines: tree of Polyline, path: String
# ---------- polylines_to_xml: C# usings ----------
using System.Linq;
using System.Xml;
# ---------- polylines_to_xml: C# ----------
       this.Component.Message = "Polylines_to_XML";
   
    /////////////////////////////////////////////////////////////////////////////////////////////////////////////////////////////////////////////
    //Create document
    /////////////////////////////////////////////////////////////////////////////////////////////////////////////////////////////////////////////
    XmlWriter xmlWriter = XmlWriter.Create(path);
    xmlWriter.WriteStartDocument();
    xmlWriter.WriteStartElement("input_polylines");
    /////////////////////////////////////////////////////////////////////////////////////////////////////////////////////////////////////////////
    //Start document
    /////////////////////////////////////////////////////////////////////////////////////////////////////////////////////////////////////////////
    foreach(Polyline pline in plines.AllData()){
      xml_polyline(ref xmlWriter, pline, "Polyline");
    }

    /////////////////////////////////////////////////////////////////////////////////////////////////////////////////////////////////////////////
    //Close document
    /////////////////////////////////////////////////////////////////////////////////////////////////////////////////////////////////////////////
    xmlWriter.WriteEndDocument();
    xmlWriter.Close();
# ---------- polylines_to_xml: C# additional code ----------
  public void xml_polyline(ref XmlWriter xmlWriter, Polyline pline, string name){
    xmlWriter.WriteStartElement(name);
    foreach(Point3d p in pline){

      xmlWriter.WriteStartElement("point");

      xmlWriter.WriteStartElement("x");
      xmlWriter.WriteString(p.X.ToString());
      xmlWriter.WriteEndElement();

      xmlWriter.WriteStartElement("y");
      xmlWriter.WriteString(p.Y.ToString());
      xmlWriter.WriteEndElement();

      xmlWriter.WriteStartElement("z");
      xmlWriter.WriteString(p.Z.ToString());
      xmlWriter.WriteEndElement();

      xmlWriter.WriteEndElement();
    }
    xmlWriter.WriteEndElement();
  }
# ---------- end polylines_to_xml ----------
panel = Panel(path)
