# Grasshopper definition tenon_mortise_round_wood.gh (Grasshopper 1.0.7)

# ---- group: M
crv = Curve([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])
crv_2 = Curve([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])
merge = Merge(Data1=crv, Data2=crv_2)
partition = PartitionList(List=merge, Size=2)
item = ListItem(List=partition, Index=0, Wrap=True)  # -> flatten(Item), flatten(Item1)
weave = Weave(Pattern=[0, 1], Stream0=item.Item1, Stream1=item.Item1, NullGaps=False)
weave_2 = Weave(Pattern=[0, 1], Stream0=item.Item, Stream1=item.Item, NullGaps=False)
polyline_to_cgal_polylines = PolylineToCGAL_Polylines(x=flatten(weave_2))  # -> out, A; inputs x: list of Polyline
# ---------- polyline_to_cgal_polylines: C# ----------
    var txt = new List<string>(x.Count);


    int count = 0;
    foreach(Polyline pline in x){
      txt.Add(" ");
      txt.Add("{");

      foreach(Point3d p in pline)
        txt.Add(string.Format("IK::Point_3({0}, {1}, {2}),", Math.Round(p.X, 5), Math.Round(p.Y, 5), Math.Round(p.Z, 5)));

      txt.Add("},");
      count++;
    }

    txt.Add(" ");
    count = 0;
    foreach(Polyline pline in x){


      count++;
    }

    A = txt;
# ---------- end polyline_to_cgal_polylines ----------
polyline_to_cgal_polylines_2 = PolylineToCGAL_Polylines(x=flatten(weave))  # -> out, A; inputs x: list of Polyline; same code as polyline_to_cgal_polylines

# ---- group: F
crv_3 = Curve([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])
partition_2 = PartitionList(List=crv_3, Size=2)
item_2 = ListItem(List=partition_2, Index=0, Wrap=True)  # -> flatten(Item), flatten(Item1)
weave_3 = Weave(Pattern=[0, 1], Stream0=item_2.Item1, Stream1=item_2.Item1, NullGaps=False)
weave_4 = Weave(Pattern=[0, 1], Stream0=item_2.Item, Stream1=item_2.Item, NullGaps=False)
polyline_to_cgal_polylines_3 = PolylineToCGAL_Polylines(x=flatten(weave_4))  # -> out, A; inputs x: list of Polyline; same code as polyline_to_cgal_polylines
polyline_to_cgal_polylines_4 = PolylineToCGAL_Polylines(x=flatten(weave_3))  # -> out, A; inputs x: list of Polyline; same code as polyline_to_cgal_polylines

# ----
panel = Panel(polyline_to_cgal_polylines_3.A)
panel_2 = Panel(polyline_to_cgal_polylines_4.A)
