# Grasshopper definition xml_writer_reader.gh (Grasshopper 1.0.7)
# plug-ins: compas_wood

path = FilePath("C:\IBOIS57\_Code\Software\Python\compas_wood\net\data\input_polylines.xml")
crv = Curve([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])
path_2 = FilePath("C:\IBOIS57\_Code\Software\Python\compas_wood\net\data\output_polylines.xml")
c_script = CSharpScript(plines=crv, path=path)  # -> out, A; inputs plines: tree of Polyline, path: String
# ---------- c_script: C# usings ----------
using System.Linq;
using System.Xml;
# ---------- c_script: C# ----------
       this.Component.Message = "Polylines_to_XML";
   
    /////////////////////////////////////////////////////////////////////////////////////////////////////////////////////////////////////////////
    //Create document
    /////////////////////////////////////////////////////////////////////////////////////////////////////////////////////////////////////////////
    XmlWriter xmlWriter = XmlWriter.Create(path);
    xmlWriter.WriteStartDocument();
    xmlWriter.WriteStartElement("input_polylines");
    /////////////////////////////////////////////////////////////////////////////////////////////////////////////////////////////////////////////
    //Start document
    /////////////////////////////////////////////////////////////////////////////////////////////////////////////////////////////////////////////
    foreach(Polyline pline in plines.AllData()){
      xml_polyline(ref xmlWriter, pline, "Polyline");
    }

    /////////////////////////////////////////////////////////////////////////////////////////////////////////////////////////////////////////////
    //Close document
    /////////////////////////////////////////////////////////////////////////////////////////////////////////////////////////////////////////////
    xmlWriter.WriteEndDocument();
    xmlWriter.Close();
# ---------- c_script: C# additional code ----------
  public void xml_polyline(ref XmlWriter xmlWriter, Polyline pline, string name){
    xmlWriter.WriteStartElement(name);
    foreach(Point3d p in pline){

      xmlWriter.WriteStartElement("point");

      xmlWriter.WriteStartElement("x");
      xmlWriter.WriteString(p.X.ToString());
      xmlWriter.WriteEndElement();

      xmlWriter.WriteStartElement("y");
      xmlWriter.WriteString(p.Y.ToString());
      xmlWriter.WriteEndElement();

      xmlWriter.WriteStartElement("z");
      xmlWriter.WriteString(p.Z.ToString());
      xmlWriter.WriteEndElement();

      xmlWriter.WriteEndElement();
    }
    xmlWriter.WriteEndElement();
  }
# ---------- end c_script ----------
c_script_2 = CSharpScript(path=path_2)  # -> out, A; inputs path: String
# ---------- c_script_2: C# ----------
    this.Component.Message = "XML_to_Polylines_Tree";

    /////////////////////////////////////////////////////////////////////////////////////////////////////////////////////////////////////////////
    //Load document
    /////////////////////////////////////////////////////////////////////////////////////////////////////////////////////////////////////////////
    XmlDocument doc = new XmlDocument();
    doc.Load(path);

    /////////////////////////////////////////////////////////////////////////////////////////////////////////////////////////////////////////////
    //Start document
    /////////////////////////////////////////////////////////////////////////////////////////////////////////////////////////////////////////////
    var polylines_tree = new DataTree<Polyline>();

    //Iterate polyline groups
    int group_count = 0;
    foreach(XmlNode node in doc.DocumentElement.ChildNodes){

      //Iterate polylines
      foreach(XmlNode node_0 in node.ChildNodes){

        //Print(node.Name);
        var polyline = new Polyline();

        //Iterate points
        foreach(XmlNode node_1 in node_0.ChildNodes){
          //Print(node_0.Name);

          //Convert coordinates to points
          if(node_1.Name == "point"){
            Point3d p = new Point3d(
              double.Parse(node_1.ChildNodes[0].InnerText),
              double.Parse(node_1.ChildNodes[1].InnerText),
              double.Parse(node_1.ChildNodes[2].InnerText)
              );
            polyline.Add(p);
          }
        }
        polylines_tree.Add(polyline, new GH_Path(group_count));
      }
      group_count++;
    }

    /////////////////////////////////////////////////////////////////////////////////////////////////////////////////////////////////////////////
    //Close document
    /////////////////////////////////////////////////////////////////////////////////////////////////////////////////////////////////////////////
    A = polylines_tree;
# ---------- c_script_2: C# additional code ----------
  public void xml_polyline(ref XmlWriter xmlWriter, Polyline pline, string name){
    xmlWriter.WriteStartElement(name);
    foreach(Point3d p in pline){

      xmlWriter.WriteStartElement("point");

      xmlWriter.WriteStartElement("x");
      xmlWriter.WriteString(p.X.ToString());
      xmlWriter.WriteEndElement();

      xmlWriter.WriteStartElement("y");
      xmlWriter.WriteString(p.Y.ToString());
      xmlWriter.WriteEndElement();

      xmlWriter.WriteStartElement("z");
      xmlWriter.WriteString(p.Z.ToString());
      xmlWriter.WriteEndElement();

      xmlWriter.WriteEndElement();
    }
    xmlWriter.WriteEndElement();
  }
# ---------- end c_script_2 ----------
loft = Loft(Polylines1=c_script_2.A)
