# Grasshopper definition chevron.gh (Grasshopper 1.0.7)
# plug-ins: compas_wood

# ----
# To-Do
# Insertion Vectors Per Panel
arch_number = Slider(23, range=1..23)
chevron_surfaces = Chevron_surfaces([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])
item = ListItem(List=chevron_surfaces, Index=expr("x-1", arch_number), Wrap=True)

# ----
# Insertion Direction
# a) per edge
# b) per element
crv = Curve([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])
c_script = CSharpScript()  # -> Out, A
partition = PartitionList(List=crv, Size=2)
input_set = Input_set(Plines=partition)

# ---- group: chevron
chevron = Chevron(
    Surface=item,
    U_divisions=Slider(4, range=1..20),
    V_division_dist=Slider(900, range=900..1000),
    Shift=Slider(0.5, range=0.5..1),
    Scale=Slider(0.05799, range=0.05..0.06))

# ----
solver = Solver(Data=input_set)
input_get = Input_get(Data=solver)  # -> Plines, Insertion_vectors, Joints_per_face, Three_valence, Adjacency
loft = Loft(Polylines1=input_get.Plines)

# ---- group: chevron_plates
chevron_plates = Chevron_plates(
    Mesh=chevron,
    Edge_rotation=Slider(1, range=0..10),
    Edge_offset=Slider(0.5, range=0..2.5),
    Box_height=Slider(760, range=100..1000),
    Top_plate_inlet=Slider(80, range=0..100),
    Plate_thickness=Slider(40, range=1..40),
    Ortho=True)  # -> Data, Dir

# ---- group: joints_params
joints_params = Joints_params(
    ss_e_ip_len=Slider(300, range=30..3000),
    ss_e_ip_shift=Slider(0.5, range=0..1),
    ss_e_ip_type=Slider(9, range=1..9),
    ss_e_op_len=Slider(450, range=30..3000),
    ss_e_op_shift=Slider(0.65, range=0..1),
    ss_e_op_type=Slider(10, range=10..19),
    ts_e_p_len=Slider(450, range=30..3000),
    ts_e_p_shift=Slider(0.5, range=0..1),
    ts_e_p_type=Slider(21, range=20..29),
    cr_c_ip_len=Slider(300, range=30..3000),
    cr_c_ip_shift=Slider(0.5, range=0..1),
    cr_c_ip_type=Slider(30, range=30..39),
    tt_e_p_len=Slider(300, range=30..3000),
    tt_e_p_shift=Slider(0.5, range=0..1),
    tt_e_p_type=Slider(40, range=40..49),
    ss_e_r_len=Slider(300, range=30..3000),
    ss_e_r_shift=Slider(0.5, range=0..1),
    ss_e_r_type=Slider(50, range=50..59))

# ----
number_slider = Slider(300, range=30..3000)

assembly = Assembly(Data=chevron_plates.Data, Lines=chevron_plates.Dir, N=4, T=Slider(31.17, range=0..50))

solver_2 = Solver(Data=chevron_plates.Data, Join=joints_params)
input_get_2 = Input_get(Data=solver_2)  # -> simplify(Plines), Insertion_vectors, Joints_per_face, Three_valence, Adjacency; disabled
loft_2 = Loft(Polylines1=input_get_2.Plines)  # disabled
