# Grasshopper definition chevron_end.gh (Grasshopper 1.0.7)
# plug-ins: compas_wood

arch_number = Slider(23, range=1..23)
chevron_surfaces = Chevron_surfaces([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])
item = ListItem(List=chevron_surfaces, Index=expr("x-1", arch_number), Wrap=True)

# ---- group: Input
crv = Curve([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])
crv_2 = Curve([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])
pt = Point(Point(-15.95577545, -146.9068279, 47.36189679))
pt_2 = Point([Point(-78.55497782, -142.9068279, 57.21722225), Point(-23.20359916, -142.9068279, 90.14100906), Point(35.9403107, -116.8646479, 57.0608065), Point(-3.437238191, -100.4885806, 19.63133686)])
entwine = Entwine(Branch00=pt, Branch01=pt_2, FlattenInputs=True)
entwine_2 = Entwine(Branch00="10", Branch01="21", FlattenInputs=True)
lng = ListLength(List=entwine)
repeat = RepeatData(Data=entwine_2, Length=lng)
cp_lines = Closest_indexed_points(Polylines=crv_2, Points=entwine, Ints=repeat)  # -> Polylines, Ints
cp_lines_2 = Closest_lines(Polylines=crv_2, Lines=crv)  # -> Polylines, Vectors

crv_3 = Curve([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])
crv_4 = Curve([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])
pt_3 = Point(Point(66.54180289, -67.76869473, 25.90170739))
pt_4 = Point([Point(-12.48673366, -66.5369766, 91.98009472), Point(-15.95577545, -146.9068279, 47.36189679)])
pt_5 = Point([Point(-23.20359916, -142.9068279, 90.14100906), Point(-78.55497782, -142.9068279, 57.21722225), Point(35.9403107, -116.8646479, 57.0608065), Point(-3.437238191, -100.4885806, 19.63133686), Point(-3.429887815, -35.47802532, 131.1152912), Point(-30.86663423, -18.51036677, 84.15627084), Point(-11.87968433, -49.29797263, 51.01550833), Point(12.69802542, -72.50533185, 102.0418385), Point(-2.720821949, -75.58486061, 111.711162), Point(-33.80333849, -52.18888495, 65.85015224)])
entwine_3 = Entwine(Branch00=pt_3, Branch01=pt_4, Branch02=pt_5, FlattenInputs=True)
entwine_4 = Entwine(Branch00="0", Branch01="10", Branch02="20", FlattenInputs=True)
lng_2 = ListLength(List=entwine_3)
repeat_2 = RepeatData(Data=entwine_4, Length=lng_2)
panel = Panel("""0-7-4-7
1-7-5-7""")
split = TextSplit(Text=panel, Separators="-")
cp_lines_3 = Closest_lines(Polylines=crv_3, Lines=crv_4)  # -> Polylines, Vectors
cp_lines_4 = Closest_indexed_points(Polylines=crv_3, Points=entwine_3, Ints=repeat_2)  # -> Polylines, Ints

# ----
crv_5 = Curve([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])
crv_6 = Curve([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])

crv_7 = Curve([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])
crv_8 = Curve([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])

# ---- group: chevron
chevron = Chevron(
    Surface=item,
    U_divisions=Slider(4, range=1..20),
    V_division_dist=Slider(900, range=900..1000),
    Shift=Slider(0.5, range=0.5..1),
    Scale=Slider(0.05799, range=0.05..0.06))

# ----
cp_lines_5 = Closest_lines(Polylines=crv_5, Lines=crv_6)  # -> Polylines, Vectors
input_set = Input_set(Plines=cp_lines_5.Polylines)
solver = Solver(Data=input_set, Find=0, Get=4)
input_get = Input_get(Data=solver)  # -> Plines, Insertion_vectors, Joints_per_face, Three_valence, Adjacency
loft = Loft(Polylines1=input_get.Plines)  # disabled
preview = CustomPreview(Geometry=input_get.Plines, Material=ColourSwatch(SwatchColor=RGB(0, 0, 0)))

# ---- group: chevron_plates
chevron_plates = Chevron_plates(
    Mesh=chevron,
    Edge_rotation=Slider(1, range=0..10),
    Edge_offset=Slider(0.5, range=0..2.5),
    Box_height=Slider(760, range=100..1000),
    Top_plate_inlet=Slider(80, range=0..100),
    Plate_thickness=Slider(40, range=1..40),
    Ortho=True)  # -> Data, Dir

# ---- group: joints_params
joints_params = Joints_params(
    ss_e_ip_len=Slider(300, range=30..3000),
    ss_e_ip_shift=Slider(0.5, range=0..1),
    ss_e_ip_type=Slider(9, range=1..9),
    ss_e_op_len=Slider(45, range=30..3000),
    ss_e_op_shift=Slider(0.65, range=0..1),
    ss_e_op_type=Slider(10, range=10..19),
    ts_e_p_len=Slider(45, range=30..3000),
    ts_e_p_shift=Slider(0.5, range=0..1),
    ts_e_p_type=Slider(21, range=20..29),
    cr_c_ip_len=Slider(300, range=30..3000),
    cr_c_ip_shift=Slider(0.5, range=0..1),
    cr_c_ip_type=Slider(30, range=30..39),
    tt_e_p_len=Slider(300, range=30..3000),
    tt_e_p_shift=Slider(0.5, range=0..1),
    tt_e_p_type=Slider(40, range=40..49),
    ss_e_r_len=Slider(300, range=30..3000),
    ss_e_r_shift=Slider(0.5, range=0..1),
    ss_e_r_type=Slider(50, range=50..59))

# ----
input_set_2 = Input_set(Plines=cp_lines_2.Polylines, Insertion_vectors=cp_lines_2.Vectors, Joints_per_face=cp_lines.Ints)
solver_2 = Solver(Data=input_set_2, Join=joints_params, Find=0, Get=4)

# ---- group: joints_params
joints_params_2 = Joints_params(
    ss_e_ip_len=Slider(300, range=30..3000),
    ss_e_ip_shift=Slider(0.5, range=0..1),
    ss_e_ip_type=Slider(9, range=1..9),
    ss_e_op_len=Slider(450, range=30..3000),
    ss_e_op_shift=Slider(0.65, range=0..1),
    ss_e_op_type=Slider(10, range=10..19),
    ts_e_p_len=Slider(450, range=30..3000),
    ts_e_p_shift=Slider(0.5, range=0..1),
    ts_e_p_type=Slider(21, range=20..29),
    cr_c_ip_len=Slider(300, range=30..3000),
    cr_c_ip_shift=Slider(0.5, range=0..1),
    cr_c_ip_type=Slider(30, range=30..39),
    tt_e_p_len=Slider(300, range=30..3000),
    tt_e_p_shift=Slider(0.5, range=0..1),
    tt_e_p_type=Slider(40, range=40..49),
    ss_e_r_len=Slider(300, range=30..3000),
    ss_e_r_shift=Slider(0.5, range=0..1),
    ss_e_r_type=Slider(50, range=50..59))

joints_params_3 = Joints_params(
    ss_e_ip_len=Slider(300, range=30..3000),
    ss_e_ip_shift=Slider(0.5, range=0..1),
    ss_e_ip_type=Slider(9, range=1..9),
    ss_e_op_len=Slider(45, range=30..3000),
    ss_e_op_shift=Slider(0.65, range=0..1),
    ss_e_op_type=Slider(10, range=10..19),
    ts_e_p_len=Slider(45, range=30..3000),
    ts_e_p_shift=Slider(0.5, range=0..1),
    ts_e_p_type=Slider(21, range=20..29),
    cr_c_ip_len=Slider(300, range=30..3000),
    cr_c_ip_shift=Slider(0.5, range=0..1),
    cr_c_ip_type=Slider(30, range=30..39),
    tt_e_p_len=Slider(300, range=30..3000),
    tt_e_p_shift=Slider(0.5, range=0..1),
    tt_e_p_type=Slider(40, range=40..49),
    ss_e_r_len=Slider(300, range=30..3000),
    ss_e_r_shift=Slider(0.5, range=0..1),
    ss_e_r_type=Slider(50, range=50..59))

# ----
input_set_3 = Input_set(Plines=cp_lines_3.Polylines, Insertion_vectors=cp_lines_3.Vectors, Joints_per_face=cp_lines_4.Ints, Three_valence=split)
solver_3 = Solver(Data=input_set_3, Join=joints_params_3, Find=0, Get=4)

number_slider = Slider(300, range=30..3000)
solver_4 = Solver(Data=chevron_plates.Data, Join=joints_params_2, Find=0, Get=4)
input_get_2 = Input_get(Data=solver_4)  # -> simplify(Plines), Insertion_vectors, Joints_per_face, Three_valence, Adjacency
loft_2 = Loft(Polylines1=input_get_2.Plines)  # disabled
preview_2 = CustomPreview(Geometry=input_get_2.Plines, Material=ColourSwatch(SwatchColor=RGB(0, 0, 0)))

input_get_3 = Input_get(Data=solver_2)  # -> Plines, Insertion_vectors, Joints_per_face, Three_valence, Adjacency
loft_3 = Loft(Polylines1=input_get_3.Plines)
preview_3 = CustomPreview(Geometry=input_get_3.Plines, Material=ColourSwatch(SwatchColor=RGB(0, 0, 0)))

input_get_4 = Input_get(Data=solver_3)  # -> Plines, Insertion_vectors, Joints_per_face, Three_valence, Adjacency
loft_4 = Loft(Polylines1=input_get_4.Plines)
preview_4 = CustomPreview(Geometry=input_get_4.Plines, Material=ColourSwatch(SwatchColor=RGB(0, 0, 0)))

assembly = Assembly(Data=chevron_plates.Data, Lines=chevron_plates.Dir, N=4, T=Slider(31.17, range=0..50))
