# Grasshopper definition chevron_start.gh (Grasshopper 1.0.7)

arch_number = Slider(23, range=1..23)
chevron_surfaces = Chevron_surfaces([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])
item = ListItem(List=chevron_surfaces, Index=expr("x-1", arch_number), Wrap=True)

# ---- group: Input
crv = Curve([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])
crv_2 = Curve([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])
pt = Point(Point(-15.95577545, -146.9068279, 47.36189679))
pt_2 = Point([Point(-78.55497782, -142.9068279, 57.21722225), Point(-23.20359916, -142.9068279, 90.14100906), Point(35.9403107, -116.8646479, 57.0608065), Point(-3.437238191, -100.4885806, 19.63133686)])
entwine = Entwine(Branch00=pt, Branch01=pt_2, FlattenInputs=True)
entwine_2 = Entwine(Branch00="10", Branch01="21", FlattenInputs=True)

crv_3 = Curve([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])
crv_4 = Curve([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])
pt_3 = Point(Point(66.54180289, -67.76869473, 25.90170739))
pt_4 = Point([Point(-12.48673366, -66.5369766, 91.98009472), Point(-15.95577545, -146.9068279, 47.36189679)])
pt_5 = Point([Point(-23.20359916, -142.9068279, 90.14100906), Point(-78.55497782, -142.9068279, 57.21722225), Point(35.9403107, -116.8646479, 57.0608065), Point(-3.437238191, -100.4885806, 19.63133686), Point(-3.429887815, -35.47802532, 131.1152912), Point(-30.86663423, -18.51036677, 84.15627084), Point(-11.87968433, -49.29797263, 51.01550833), Point(12.69802542, -72.50533185, 102.0418385), Point(-2.720821949, -75.58486061, 111.711162), Point(-33.80333849, -52.18888495, 65.85015224)])
entwine_3 = Entwine(Branch00=pt_3, Branch01=pt_4, Branch02=pt_5, FlattenInputs=True)
entwine_4 = Entwine(Branch00="0", Branch01="10", Branch02="20", FlattenInputs=True)

# ----
crv_5 = Curve([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])
crv_6 = Curve([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])

crv_7 = Curve([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])
crv_8 = Curve([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])
