# Grasshopper definition cross.gh (Grasshopper 1.0.7)
# plug-ins: compas_wood, ghgl, NGon

crv = Curve([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])
end = EndPoints(Curve=crv)  # -> Start, End
end_2 = EndPoints(Curve=crv)  # -> Start, End
ln = Line(StartPoint=end_2.Start, EndPoint=end_2.End)
ln_2 = Line(StartPoint=end.Start, EndPoint=end.End)
merge = Merge(Data1=crv, Data2=ln)
merge_2 = Merge(Data1=crv, Data2=ln_2)

mesh = Mesh(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)  # disabled
panel = Panel("0")  # disabled
number_slider = Slider(4, range=0..10)  # disabled
number_slider_2 = Slider(2, range=0..10)  # disabled
number_slider_3 = Slider(-1, range=-10..10)  # disabled
number_slider_4 = Slider(-12, range=-20..10)  # disabled
brep = Brep([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])  # disabled
number_slider_5 = Slider(15, range=0..170)  # disabled
crv_2 = Curve([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])  # disabled
rect_thickness = Slider(1, range=0..10)  # disabled
c_script = CSharpScript(
    m=mesh,
    face_positions=panel,
    face_thickness=number_slider,
    divisions=number_slider_2,
    division_len=number_slider_5,
    edge_vectors=crv_2,
    rect_width=number_slider_3,
    rect_height=number_slider_4,
    rect_thickness=rect_thickness,
    projection=brep,
    Reference="C:\Users\petra\AppData\Roaming\Grasshopper\Libraries\compas_wood\rhino_util.dll")  # -> out, f, f_pl, f_id, e, e_pl, e_id; inputs m: Mesh, face_positions: list of Double, face_thickness: Double, divisions: list of Int32, division_len: list of Double, edge_vectors: list of Line, rect_width: Double, rect_height: Double, rect_thickness: Double, projection: list of Brep; disabled
# ---------- c_script: C# usings ----------
using rhino_util;
using System.Linq;
# ---------- c_script: C# ----------
    try{
      vda vda = new vda(
        m, null,
        face_thickness, face_positions,
        divisions, division_len,
        edge_vectors, rect_width, rect_height, rect_thickness, projection);

      //A = rhino_util.GrasshopperUtil.IE2(vda.fe_planes);
      //C = vda.f_planes;

      //E = vda.e90_planes;
      //F = rhino_util.GrasshopperUtil.IE2(vda.e90_multiple_planes);
      //G = rhino_util.GrasshopperUtil.IE2(vda.e_polylines);
      //E = vda.e90_planes;_


      f = rhino_util.GrasshopperUtil.IE2(vda.f_polylines);
      f_pl = rhino_util.GrasshopperUtil.IE2(vda.f_polylines_planes);
      f_id = rhino_util.GrasshopperUtil.IE2(vda.f_polylines_index);
      e = rhino_util.GrasshopperUtil.IE2(vda.e_polylines);
      e_pl = rhino_util.GrasshopperUtil.IE2(vda.e_polylines_planes);
      e_id = rhino_util.GrasshopperUtil.IE2(vda.e_polylines_index);

    }catch(Exception ee){
      Print(ee.ToString());
    }
# ---------- c_script: C# additional code ----------
  public class vda{

    //input
    public Mesh m = null;
    public Surface s = null;
    public double face_thickness = 1;
    public List<double> face_positions = new List<double>();
    public List<Brep> projection_breps = new List<Brep>();
    public List<int> edge_divisions = new List<int>();
    public List<double> edge_division_len = new List<double>();
    public Vector3d[] insertion_vectors = new Vector3d[0];

    //indices
    bool has_ngons = false;
    public int f;
    public int e;
    public int[][] f_v;
    public int[][] f_e;
    public int[][] e_f;
    public Dictionary<int,int> e_ngon_e;
    double rect_width = 1;
    double rect_height = 1;
    double rect_thickness = 1;
    //planes
    public Plane[] f_planes = new Plane[0];
    public Plane[][] fe_planes = new Plane[0][];
    public Plane[][] bi_planes = new Plane[0][];
    public Plane[] e90_planes = new Plane[0];
    public Plane[][] e90_multiple_planes = new Plane[0][];
    public Line[] e_lines = new Line[0];

    //output
    //polylines
    public string[][] f_polylines_index = new string[0][];
    public Plane[][] f_polylines_planes = new Plane[0][];
    public Polyline[][] f_polylines = new Polyline[0][];


    public string[][] e_polylines_index = new string[0][];
    public Plane[][] e_polylines_planes = new Plane[0][];
    public Polyline[][] e_polylines = new Polyline[0][];






    //Division per edge
    //Number of layers
    //Length of joint
    //Rotate or insertion direction per each edge

    public vda(Mesh m, Surface s,
      double face_thickness, List<double> face_positions, List<int> edge_divisions,
      List<double> edge_division_len, List<Line> insertion_vectors,
    double rect_width, double rect_height, double rect_thickness, List<Brep> projection_breps){
      if(m == null) return;
      if(!m.IsValid) return;
      m.Weld(0.01);
      m.RebuildNormals();
      this.m = m.DuplicateMesh();
      this.s = s;
      this.face_thickness = face_thickness;
      this.face_positions = face_positions;
      this.face_positions.Sort();

      if(this.face_positions.Count == 0)
        this.face_positions = new List<double>{0};


      this.projection_breps = projection_breps;
      this.edge_divisions = edge_divisions;
      this.edge_division_len = edge_division_len;
      this.edge_division_len = edge_division_len;
      this.has_ngons = m.Ngons.Count > 0;
      this.rect_width = rect_width;
      this.rect_height = rect_height;
      this.rect_thickness = rect_thickness;
      //run methods in constructor
      get_face_vertices();
      get_faces_planes();
      get_face_edge_planes();
      get_bisector_planes();
      get_face_polylines();
      get_edges();
      get_edge_faces();
      get_edge_vectors(insertion_vectors);
      get_edge_planes();
      get_connectors();
    }

    //Compute mesh properties

    public void get_face_vertices(){
      if(has_ngons){
        this.f = this.m.Ngons.Count;
        f_v = m.GetNGonsTopoBoundaries();
      }else
      {
        this.f = this.m.Faces.Count;
        f_v = new int[this.m.Faces.Count][];
        for(int i = 0; i < this.m.Faces.Count;i++ )

          f_v[i] = this.m.Faces[i].IsQuad ? new int[] { this.m.Faces[i][0], this.m.Faces[i][1], this.m.Faces[i][2], this.m.Faces[i][3] } : new int[] { this.m.Faces[i][0], this.m.Faces[i][1], this.m.Faces[i][2] };
      }
    }

    public void get_faces_planes(){

      if(has_ngons){
        f_planes = m._FPlanes();
      }else{
        f_planes = new Plane[m.Faces.Count];
        for(int i = 0; i < m.Faces.Count; i++)
          f_planes[i] = new Plane(m.MeshFaceCenter(i), m.FaceNormals[i]);
      }

      //Adjust to surface
      if(s != null){
        for(int i = 0; i < f_planes.Length; i++){
          double u, v;
          s.ClosestPoint(f_planes[i].Origin, out u, out v);
          Vector3d normal = s.NormalAt(u, v);
          Vector3d xaxis = Vector3d.CrossProduct(normal, f_planes[i].YAxis);
          Vector3d yaxis = Vector3d.CrossProduct(normal, xaxis);
          //f_planes[i] = new Plane(s.PointAt(u, v), xaxis, yaxis);
          f_planes[i] = new Plane(f_planes[i].Origin, xaxis, yaxis);
        }
      }

    }

    public void get_face_edge_planes()
    {

      fe_planes = new Plane[f][];


      for (int i = 0; i < f; i++)
      {
        int n = f_v[i].Length;
        fe_planes[i] = new Plane[n];

        for (int j = 0; j < f_v[i].Length; j++)
        {
          int v1 = f_v[i][(j + 0) % n];
          int v2 = f_v[i][(j + 1) % n];

          int e = this.m.TopologyEdges.GetEdgeIndex(v1, v2);
          int[] cf = this.m.TopologyEdges.GetConnectedFaces(e);



          Vector3d sum = Vector3d.Zero;
          for (int k = 0; k < cf.Length; k++)
            sum += this.m.FaceNormals[cf[k]];
          sum /= cf.Length;

          Plane edgePlane = new Plane((Point3d) (this.m.Vertices[v1] + this.m.Vertices[v2]) * 0.5, this.m.Vertices[v1] - this.m.Vertices[v2], sum);
          fe_planes[i][j] = edgePlane;

          //Adjust to surface
          if(s != null){

            double u, v;
            s.ClosestPoint(fe_planes[i][j].Origin, out u, out v);
            Vector3d normal = s.NormalAt(u, v);
            //Vector3d xaxis = Vector3d.CrossProduct(normal, e_planes[i][j].YAxis);
            //Vector3d yaxis = Vector3d.CrossProduct(normal, xaxis);
            //s.PointAt(u, v)
            fe_planes[i][j] = new Plane(fe_planes[i][j].Origin, Vector3d.CrossProduct(normal, fe_planes[i][j].ZAxis), normal);

          }

          foreach(Brep brep in this.projection_breps){
            if(brep.IsPointInside(fe_planes[i][j].Origin, 0.01, false)){
              Transform xform = Rhino.Geometry.Transform.PlanarProjection(Plane.WorldXY);
              fe_planes[i][j].Transform(xform);
            }
          }


        }//for j
      }//for i
    }

    public void get_bisector_planes()
    {
      bi_planes = new Plane[f][];

      for (int i = 0; i < f; i++)
      {
        int n = f_v[i].Length;
        bi_planes[i] = new Plane[n];
        for (int j = 0; j < n; j++)
        {
          var pl1 = fe_planes[i][j];
          var pl0 = fe_planes[i][MathUtil.Wrap(j + 1, n)];
          bi_planes[i][j] = PlaneUtil.DihedralPlane(pl0, pl1);
        }
      }//for i
    }

    public void get_edges(){


      if(this.has_ngons) {
        e_ngon_e = this.m._EAll();
        this.e = e_ngon_e.Count;
      }else{

        e_ngon_e = new Dictionary< int,int>();
        for(int i = 0; i < this.m.TopologyEdges.Count; i++ ){
          e_ngon_e.Add(i, i);
        }

      }
      this.e = e_ngon_e.Count;

    }

    public void get_edge_faces(){

      if(this.has_ngons){
        this.e_f = this.m._EF();

      }else{
        this.e_f = new int[this.m.TopologyEdges.Count][];
        for(int i = 0; i < this.m.TopologyEdges.Count;i++)
          this.e_f[i] = this.m.TopologyEdges.GetConnectedFaces(i);
      }
    }


    List<int> found_ids = new List<int>();
    public void get_edge_vectors(List<Line> lines){

      //Init empty vectors
      this.insertion_vectors = new Vector3d[this.e];


      //Get edge lines including naked
      this.e_lines = new Line[this.e];
      foreach(var pair in this.e_ngon_e){
        this.e_lines[pair.Value] = this.m.TopologyEdges.EdgeLine(pair.Key);
        //RhinoDoc.ActiveDoc.Objects.AddLine(this.e_lines[pair.Value]);
        //RhinoApp.WriteLine(string.Format("{0} {1}",pair.Key,pair.Value));
      }



      //Create rtree and add lines
      RTree rTree = new RTree();
      for (int i = 0; i < this.e_lines.Length; i++)
        rTree.Insert(this.e_lines[i].BoundingBox, i);

      //Search tree
      for(int i = 0; i < lines.Count;i++ ){
        BoundingBox bbox = lines[i].BoundingBox;
        bbox.Inflate(Rhino.RhinoDoc.ActiveDoc.ModelAbsoluteTolerance);
        bbox.Inflate(1);
        rTree.Search(lines[i].BoundingBox, BoundingBoxCallback);

        //iterate through found ids and check if end point lies on a mesh edge
        foreach(var  id in found_ids ){
          //RhinoDoc.ActiveDoc.Objects.AddLine(lines[i]);
          //RhinoDoc.ActiveDoc.Objects.AddLine(e_lines[id]);
          //break;
          if( this.e_lines[id].ClosestPoint(lines[i].From, true).DistanceToSquared(lines[i].From) < Rhino.RhinoDoc.ActiveDoc.ModelAbsoluteTolerance){
            this.insertion_vectors[id] = lines[i].Direction.UnitVector();
            //RhinoApp.WriteLine("Hi");
          }else if( this.e_lines[id].ClosestPoint(lines[i].To, true).DistanceToSquared(lines[i].To) < Rhino.RhinoDoc.ActiveDoc.ModelAbsoluteTolerance){
            this.insertion_vectors[id] = lines[i].Direction.UnitVector();
            // RhinoApp.WriteLine("Hi");
          }
        }
        //break;
        // RhinoApp.WriteLine(found_ids.Count.ToString());
        found_ids = new List<int>();

      }

    }

    void BoundingBoxCallback(object sender, RTreeEventArgs e)
    {
      //var boxSearchData = e.ToString();
      // RhinoApp.WriteLine(string.Format("{0} {1}",e.Id,e.IdB));
      found_ids.Add(e.Id);
    }

    //todo
    public void get_edge_planes(){

      e90_planes = new Plane[e_ngon_e.Count];
      e90_multiple_planes = new Plane[e_ngon_e.Count][];
      for (int i = 0; i < e_ngon_e.Count; i++)
      {




        int id = e_ngon_e.ElementAt(i).Key;

        if(this.m.TopologyEdges.GetConnectedFaces(id).Length == 1){
          e90_planes[i] = Plane.Unset;
          e90_multiple_planes[i] = new Plane[]{Plane.Unset};
          continue;
        }

        Line edge_line = this.m.TopologyEdges.EdgeLine(id);
        Point3d origin = edge_line.Mid();
        Vector3d zaxis = edge_line.Direction.UnitVector();
        IndexPair pair = this.m.TopologyEdges.GetTopologyVertices(id);
        //edge vertex normals
        Vector3d yaxis = ((Vector3d) (this.m.Normals[pair.I] + this.m.Normals[pair.J])) * 0.5;
        //or face normals
        yaxis = (this.f_planes[this.e_f[i][0]].ZAxis + this.f_planes[this.e_f[i][1]].ZAxis) * 0.5;

        //this.f_planes[]

        if(this.s != null){
          double u, v;
          this.s.ClosestPoint(origin, out u, out v);
          yaxis = this.s.NormalAt(u, v);
        }

        Vector3d xaxis = Vector3d.CrossProduct(zaxis, yaxis);

        //orient x-axis towards first edge index
        if((origin + xaxis).DistanceToSquared(this.f_planes[this.e_f[i][0]].Origin) <
          (origin - xaxis).DistanceToSquared(this.f_planes[this.e_f[i][0]].Origin))
          xaxis *= -1;

        //Incase insertion vectors are given
        if( !(insertion_vectors[i].X == 0 && insertion_vectors[i].Y == 0 && insertion_vectors[i].Z == 0)  ){


          //Project given vector to a plane
          Plane edge_plane = new Plane(this.e_lines[i].Mid(), yaxis);
          Transform xform = Transform.PlanarProjection(edge_plane);
          Vector3d xaxis_ = insertion_vectors[i];
          xaxis_.Transform(xform);

          if((Point3d.Origin + xaxis_).DistanceToSquared(Point3d.Origin + xaxis) >
            (Point3d.Origin - xaxis_).DistanceToSquared(Point3d.Origin + xaxis))
            xaxis_ *= -1;
          xaxis = xaxis_;


          //orient x-axis towards first edge index


        }



        //set plane
        e90_planes[i] = new Plane(origin, xaxis, yaxis);



        //1) By N 2) by division length 3) in both cases consider lists
        //Skip emppty

        int divisions = 1;


        if(this.edge_division_len.Count > 0){

          if(this.edge_division_len.Count == this.e){
            divisions = (int) rhino_util.MathUtil.Constrain((int) Math.Ceiling(edge_line.Length / this.edge_division_len[i]), 1, 10);
          }else{
            divisions = (int) rhino_util.MathUtil.Constrain((int) Math.Ceiling(edge_line.Length / this.edge_division_len[0]), 1, 10);
          }




        }else if(this.edge_divisions.Count > 0){

          if(this.edge_divisions.Count == this.e){
            divisions = this.edge_divisions[0];
          }else{
            divisions = this.edge_divisions[i];
          }


        }





        Point3d[] pts = edge_line.InterpolateLine(divisions, false);
        e90_multiple_planes[i] = new Plane[pts.Length];

        for(int j = 0; j < pts.Length; j++){
          e90_multiple_planes[i][j] = PlaneUtil.ChangeOrigin(e90_planes[i], pts[j]);
        }





      }







    }


    public void get_connectors(){


      this.e_polylines = new Polyline[e90_multiple_planes.Length][];
      this.e_polylines_planes = new Plane[e90_multiple_planes.Length][];
      this.e_polylines_index = new string[e90_multiple_planes.Length][];



      for(int i = 0; i < e90_multiple_planes.Length; i++ ){

        this.e_polylines[i] = new Polyline[e90_multiple_planes[i].Length * 2];
        this.e_polylines_planes[i] = new Plane[e90_multiple_planes[i].Length];
        this.e_polylines_index[i] = new string[e90_multiple_planes[i].Length];


        for(int j = 0; j < e90_multiple_planes[i].Length;j++){
          if(e90_multiple_planes[i][j] == Plane.Unset){
            this.e_polylines[i] = new Polyline[0];
          }else{

            if(this.rect_height > 0 && this.rect_width > 0){

              //type0


              Rectangle3d rect0 = new Rectangle3d(
                e90_multiple_planes[i][j].MovePlanebyAxis(this.rect_thickness * 0.5),
                new Interval(-rect_width * 0.5, rect_width * 0.5),
                new Interval(-rect_height * 0.5, rect_height * 0.5));
              Rectangle3d rect1 = new Rectangle3d(
                e90_multiple_planes[i][j].MovePlanebyAxis(this.rect_thickness * -0.5),
                new Interval(-rect_width * 0.5, rect_width * 0.5),
                new Interval(-rect_height * 0.5, rect_height * 0.5));
              this.e_polylines[i][j * 2 + 0] = rect0.ToPolyline();
              this.e_polylines[i][j * 2 + 1] = rect1.ToPolyline();
            }else if(this.rect_height <= 0 && this.rect_width <= 0){

              double w = Math.Abs(this.rect_height);
              double h = Math.Abs(this.rect_width);

              //type1
              Plane e_plane = new Plane(e90_multiple_planes[i][j]);
              e_plane.Rotate(Math.PI * 0.5, e_plane.YAxis);
              Plane top_plane_0 = this.f_planes[this.e_f[i][0]].MovePlanebyAxis(this.face_positions.Last()).MovePlanebyAxis(this.face_thickness * 0.5 + h);
              Plane top_plane_1 = this.f_planes[this.e_f[i][1]].MovePlanebyAxis(this.face_positions.Last()).MovePlanebyAxis(this.face_thickness * 0.5 + h);
              Plane bot_plane_0 = this.f_planes[this.e_f[i][0]].MovePlanebyAxis(this.face_positions.First()).MovePlanebyAxis(this.face_thickness * -0.5 - h);
              Plane bot_plane_1 = this.f_planes[this.e_f[i][1]].MovePlanebyAxis(this.face_positions.First()).MovePlanebyAxis(this.face_thickness * -0.5 - h);


              Plane e_plane_ = new Plane(this.e90_planes[i]);
              e_plane_.Rotate(Math.PI * 0.5, e_plane_.YAxis);


              //            if((e_plane_.Origin + e_plane_.ZAxis).DistanceToSquared(this.f_planes[this.e_f[i][0]].Origin) >
              //              (e_plane_.Origin - e_plane_.ZAxis).DistanceToSquared(this.f_planes[this.e_f[i][0]].Origin))
              //              e_plane.Flip();

              Plane[] side_planes = new Plane[]{

                top_plane_0,
                e_plane,
                top_plane_1,
                e_plane.MovePlanebyAxis(w * 0.5),
                bot_plane_1,
                e_plane,
                bot_plane_0,
                e_plane.MovePlanebyAxis(w * -0.5),

                };

              Polyline type1_0 = rhino_util.PolylineUtil.PolylineFromPlanes(e90_multiple_planes[i][j].MovePlanebyAxis(-this.rect_thickness * 0.5), side_planes.ToList());
              Polyline type1_1 = type1_0.Translate(e90_multiple_planes[i][j].ZAxis * this.rect_thickness);
              this.e_polylines[i][j * 2 + 0] = type1_0;
              this.e_polylines[i][j * 2 + 1] = type1_1;
              this.e_polylines_planes[i][j] = e90_multiple_planes[i][j].MovePlanebyAxis(this.rect_thickness * 0.5);
              this.e_polylines_index[i][j] = string.Format("{0}-{1}_{2}", this.e_f[i][0], this.e_f[i][1], j);

            }
          }
        }
      }

    }

    //Compute geometry
    public void get_face_polylines(){




      bool zero_layer = this.face_positions.Count == 0;

      this.f_polylines_index = new string[f][];
      this.f_polylines_planes = new Plane[f][];
      this.f_polylines = new Polyline[f][];

      for(int i = 0; i < f; i++){

        if(this.face_positions.Count == 0){

          f_polylines[i] = new Polyline[2];

          f_polylines[i][0] = PolylineUtil.OutlineFromFaceEdgeCorner(f_planes[i].MovePlanebyAxis(this.face_thickness * -0.5), fe_planes[i], bi_planes[i], 2);
          f_polylines[i][1] = PolylineUtil.OutlineFromFaceEdgeCorner(f_planes[i].MovePlanebyAxis(this.face_thickness * 0.5), fe_planes[i], bi_planes[i], 2);

          f_polylines_planes[i] = new Plane[1]{
            f_planes[i].MovePlanebyAxis(this.face_thickness * 0.5)
            };

          f_polylines_index[i] = new string[1]{
            i.ToString()
            };


        }else{

          f_polylines[i] = new Polyline[this.face_positions.Count * 2];
          f_polylines_planes[i] = new Plane[this.face_positions.Count];
          f_polylines_index[i] = new string[this.face_positions.Count];

          for(int j = 0; j < this.face_positions.Count ; j++){
            Polyline pline0 = PolylineUtil.OutlineFromFaceEdgeCorner(f_planes[i].MovePlanebyAxis(this.face_positions[j] + this.face_thickness * -0.5), fe_planes[i], bi_planes[i], 2);
            Polyline pline1 = PolylineUtil.OutlineFromFaceEdgeCorner(f_planes[i].MovePlanebyAxis(this.face_positions[j] + this.face_thickness * 0.5), fe_planes[i], bi_planes[i], 2);
            //f_polylines[i][j] = rhino_util.PolylineUtil.PolylineFromPlanes(f_planes[i].MovePlanebyAxis(this.face_thickness[j]), e_planes[i].ToList());
            f_polylines[i][j * 2 + 0] = pline0;
            f_polylines[i][j * 2 + 1] = pline1;
            f_polylines_planes[i][j] = f_planes[i].MovePlanebyAxis(this.face_positions[j] + this.face_thickness * 0.5);

            f_polylines_index[i][j] = this.face_positions.Count == 1 ? i.ToString() : string.Format("{0}-{1}", i, j);
          }

        }




      }

    }






  }
# ---------- end c_script ----------

# ---- group: connectors
mesh_2 = Mesh(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)
crv_3 = Curve([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])
brep_2 = Brep([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])
connectors = Connectors(
    Mesh=mesh_2,
    Face_positions=Slider(0, range=-10..10),
    Face_thickness=Slider(4, range=0..10),
    Divisions=Slider(2, range=1..10),
    Division_len=Slider(15, range=1..100),
    Edge_vectors=crv_3,
    Rect_width=Slider(-2, range=-20..20),
    Rect_height=Slider(-9, range=-20..20),
    Rect_thickness=Slider(1, range=1..2),
    Projection=brep_2)  # -> F, F_pl, F_id, E, E_pl, E_id

# ----
crv_4 = Curve([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])  # disabled

brep_3 = Brep(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)
crv_5 = Curve([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])
crv_6 = Curve()
c_script_2 = CSharpScript(
    surface=brep_3,
    u_divisions=Slider(2, range=0..10),
    v_divisions=Slider(3, range=0..10),
    base_planes=crv_5,
    thickness=Slider(1, range=0..10),
    chamfer=Slider(0.01, range=0.01..1),
    extend=Slider(0.1, range=0.1..1),
    face_positions=Slider(0, range=0..100),
    insertion=crv_6,
    Reference="C:\Users\petra\AppData\Roaming\Grasshopper\Libraries\compas_wood\rhino_util.dll")  # -> out, m, f; inputs surface: Surface, u_divisions: Int32, v_divisions: Int32, base_planes: list of Plane, thickness: Double, chamfer: Double, extend: Double, face_positions: list of Double, insertion: list of Line
# ---------- c_script_2: C# usings ----------
using System.Linq;
using rhino_util;
# ---------- c_script_2: C# ----------
    
    case_3_mtsj mtsj = new case_3_mtsj(surface,u_divisions,v_divisions,base_planes,thickness,chamfer,extend,insertion,face_positions);
  
    m = mtsj.m;
    f = rhino_util.GrasshopperUtil.IE2(mtsj.f_polylines);
# ---------- c_script_2: C# additional code ----------
  public class case_3_mtsj{
    
    //Diamond Subdivision
    public Mesh m = null;
    Surface s = null;
    int u_divisions = 1;
    int v_divisions = 1;
    List<Plane> base_planes = new List<Plane>();
    
    //Properties for plates
    bool has_ngons = false;
    double face_thickness = 1;
    double chamfer = 0.01;
    double extend = 1;
    List<double> face_positions = new List<double>();
   
    public int f;
    public int e;
    public int[][] f_v;
    public int[][] f_e;
    public int[][] e_f;
    public Dictionary<int,int> e_ngon_e;
    public Plane[] f_planes = new Plane[0];
    public Plane[][] fe_planes = new Plane[0][];
    public Plane[][] bi_planes = new Plane[0][];
    public Plane[] e_planes = new Plane[0];
    public Line[] e_lines = new Line[0];
    public Vector3d[] insertion_vectors = new Vector3d[0];
    
    //Output
    public string[][] f_polylines_index = new string[0][];
    public Plane[][] f_polylines_planes = new Plane[0][];
    public Polyline[][] f_polylines = new Polyline[0][];

    
    public case_3_mtsj(Surface s, int u_divisions, int v_divisions, List<Plane> base_planes, double thickness, double chamfer, double extend, List<Line> insertion_vectors, List<double> face_positions ){
      this.s = s;
      this.u_divisions = u_divisions;
      this.v_divisions = v_divisions;
      this.base_planes = base_planes;
      
      //Run 
      m = diamond_subdivision();
      this.has_ngons = m.Ngons.Count > 0;
      this.face_thickness = thickness;
      this.chamfer = chamfer;
      this.extend = extend;
      this.face_positions = face_positions;
      
      //Properties for plates
      get_face_vertices();
      get_faces_planes();
      get_face_edge_planes();
      get_bisector_planes();
      //get_face_polylines();
      get_edges();
      get_edge_faces();
      get_edge_vectors(insertion_vectors);
      get_edge_planes();
      
      //Compute plate geometry
      get_face_polylines();

    }
    
    public  Mesh diamond_subdivision()
    {

      Mesh m = new Mesh();

      if (u_divisions < 1)
        u_divisions = 1;

      if (v_divisions < 1)
        v_divisions = 1;

      int v = 0;
      List<MeshFace> face = new List<MeshFace>();
      List<Point3d> pts = new List<Point3d>();
      Interval interval = s.Domain(0);
      Interval interval1 = s.Domain(1);
      double step_u = (interval.T1 - interval.T0) / (double) u_divisions;
      double step_v = (interval1.T1 - interval1.T0) / (double) v_divisions;


      double sum_step_u = 0;

      for (int i = 0; i < u_divisions; i++)  {

        double sum_step_v = 0;
        for (int j = 0; j < v_divisions; j++)   {

          Point3d p0 = s.PointAt(sum_step_u, sum_step_v);
          Point3d p1 = s.PointAt(sum_step_u + step_u, sum_step_v);

          s.PointAt(sum_step_u, sum_step_v + step_v * 0.5);
          s.NormalAt(sum_step_u, sum_step_v + step_v * 0.5);
          s.PointAt(sum_step_u + step_u, sum_step_v + step_v * 0.5);
          s.NormalAt(sum_step_u + step_u, sum_step_v + step_v * 0.5);

          Point3d p2 = s.PointAt(sum_step_u, sum_step_v + step_v);
          Point3d p3 = s.PointAt(sum_step_u + step_u, sum_step_v + step_v);
          Point3d p4 = s.PointAt(sum_step_u + step_u * 0.5, sum_step_v + step_v * 1.5);
          Point3d p5 = s.PointAt(sum_step_u + step_u * 0.5, sum_step_v + step_v * 0.5);
          Point3d p6 = s.PointAt(sum_step_u + step_u * 0.5, sum_step_v - step_v * 0.5);
          Point3d p7 = (p5 + p6) / 2;
          Point3d p8 = (p4 + p5) / 2;

          if (j == 0)
          {
            ///////////////////////////////////////
            //start triangles
            ///////////////////////////////////////
            Point3d p9 = s.PointAt(sum_step_u + step_u * 0.5, interval1.T0);
            Line line = new Line(p5, p6);
            Point3d cp = line.ClosestPoint(p9, false);

            if(base_planes.Count > 0){
              if(Math.Abs(base_planes.First().ZAxis.X) + Math.Abs(base_planes.First().ZAxis.Y) + Math.Abs(base_planes.First().ZAxis.Z) > 0.01){
                double t;
                Rhino.Geometry.Intersect.Intersection.LinePlane(line, base_planes.First(), out t);
                cp = line.PointAt(t);
              }
            }

            pts.AddRange(new Point3d[] { p1, p5, cp });
            face.Add(new MeshFace(v, v + 1, v + 2));
            v += 3;
            pts.AddRange(new Point3d[] { cp, p5, p0 });
            face.Add(new MeshFace(v, v + 1, v + 2));
            v += 3;
          }

          pts.AddRange(new Point3d[] { p1, p3, p5 });
          face.Add(new MeshFace(v, v + 1, v + 2));
          v += 3;
          pts.AddRange(new Point3d[] { p0, p5, p2 });
          face.Add(new MeshFace(v, v + 1, v + 2));
          v += 3;

          if (j != v_divisions - 1)  {
            pts.AddRange(new Point3d[] { p3, p4, p5 });
            face.Add(new MeshFace(v, v + 1, v + 2));
            v += 3;
            pts.AddRange(new Point3d[] { p4, p2, p5 });
            face.Add(new MeshFace(v, v + 1, v + 2));
            v += 3;

          } else {
            ///////////////////////////////////////
            //end triangles
            ///////////////////////////////////////
            Point3d p9 = s.PointAt(sum_step_u + step_u * 0.5, interval1.T1);
            Line line = new Line(p4, p5);
            Point3d cp = line.ClosestPoint(p9, false);

            if(base_planes.Count > 0){
              if(Math.Abs(base_planes.Last().ZAxis.X) + Math.Abs(base_planes.Last().ZAxis.Y) + Math.Abs(base_planes.Last().ZAxis.Z) > 0.01){
                double t;
                Rhino.Geometry.Intersect.Intersection.LinePlane(line, base_planes.Last(), out t);
                cp = line.PointAt(t);
              }

            }
            pts.AddRange(new Point3d[] { p3, cp, p5 });
            face.Add(new MeshFace(v, v + 1, v + 2));
            v += 3;
            pts.AddRange(new Point3d[] { cp, p2, p5 });
            face.Add(new MeshFace(v, v + 1, v + 2));
            v += 3;

          }
          sum_step_v += step_v;
        }
        sum_step_u += step_u;
      }
      m.Vertices.AddVertices(pts);
      m.Faces.AddFaces(face);
      m.Weld(3.14159);
      m.RebuildNormals();
      return m;
    }
    

    
    //Compute mesh properties

    public void get_face_vertices(){
      if(has_ngons){
        this.f = this.m.Ngons.Count;
        f_v = m.GetNGonsTopoBoundaries();
      }else
      {
        this.f = this.m.Faces.Count;
        f_v = new int[this.m.Faces.Count][];
        for(int i = 0; i < this.m.Faces.Count;i++ )

          f_v[i] = this.m.Faces[i].IsQuad ? new int[] { this.m.Faces[i][0], this.m.Faces[i][1], this.m.Faces[i][2], this.m.Faces[i][3] } : new int[] { this.m.Faces[i][0], this.m.Faces[i][1], this.m.Faces[i][2] };
      }
    }

    public void get_faces_planes(){

      if(has_ngons){
        f_planes = m._FPlanes();
      }else{
        f_planes = new Plane[m.Faces.Count];
        for(int i = 0; i < m.Faces.Count; i++)
          f_planes[i] = new Plane(m.MeshFaceCenter(i), m.FaceNormals[i]);
      }



    }

    public void get_face_edge_planes()
    {

      fe_planes = new Plane[f][];


      for (int i = 0; i < f; i++)
      {
        int n = f_v[i].Length;
        fe_planes[i] = new Plane[n];

        for (int j = 0; j < f_v[i].Length; j++)
        {
          int v1 = f_v[i][(j + 0) % n];
          int v2 = f_v[i][(j + 1) % n];

          int e = this.m.TopologyEdges.GetEdgeIndex(v1, v2);
          int[] cf = this.m.TopologyEdges.GetConnectedFaces(e);



          Vector3d sum = Vector3d.Zero;
          for (int k = 0; k < cf.Length; k++)
            sum += this.m.FaceNormals[cf[k]];
          sum /= cf.Length;

          Plane edgePlane = new Plane((Point3d) (this.m.Vertices[v1] + this.m.Vertices[v2]) * 0.5, this.m.Vertices[v1] - this.m.Vertices[v2], sum);
          fe_planes[i][j] = edgePlane;

          //Adjust to surface
          if(s != null){

            double u, v;
            s.ClosestPoint(fe_planes[i][j].Origin, out u, out v);
            Vector3d normal = s.NormalAt(u, v);
            //Vector3d xaxis = Vector3d.CrossProduct(normal, e_planes[i][j].YAxis);
            //Vector3d yaxis = Vector3d.CrossProduct(normal, xaxis);
            //s.PointAt(u, v)
            fe_planes[i][j] = new Plane(fe_planes[i][j].Origin, Vector3d.CrossProduct(normal, fe_planes[i][j].ZAxis), normal);

          }




        }//for j
      }//for i
    }

    public void get_bisector_planes()
    {
      bi_planes = new Plane[f][];

      for (int i = 0; i < f; i++)
      {
        int n = f_v[i].Length;
        bi_planes[i] = new Plane[n];
        for (int j = 0; j < n; j++)
        {
          var pl1 = fe_planes[i][j];
          var pl0 = fe_planes[i][MathUtil.Wrap(j + 1, n)];
          bi_planes[i][j] = PlaneUtil.DihedralPlane(pl0, pl1);
        }
      }//for i
    }

    public void get_edges(){


      if(this.has_ngons) {
        e_ngon_e = this.m._EAll();
        this.e = e_ngon_e.Count;
      }else{

        e_ngon_e = new Dictionary< int,int>();
        for(int i = 0; i < this.m.TopologyEdges.Count; i++ ){
          e_ngon_e.Add(i, i);
        }

      }
      this.e = e_ngon_e.Count;

    }

    public void get_edge_faces(){

      if(this.has_ngons){
        this.e_f = this.m._EF();

      }else{
        this.e_f = new int[this.m.TopologyEdges.Count][];
        for(int i = 0; i < this.m.TopologyEdges.Count;i++)
          this.e_f[i] = this.m.TopologyEdges.GetConnectedFaces(i);
      }
    }


    List<int> found_ids = new List<int>();
    public void get_edge_vectors(List<Line> lines){

      //Init empty vectors
      this.insertion_vectors = new Vector3d[this.e];


      //Get edge lines including naked
      this.e_lines = new Line[this.e];
      foreach(var pair in this.e_ngon_e){
        this.e_lines[pair.Value] = this.m.TopologyEdges.EdgeLine(pair.Key);
        //RhinoDoc.ActiveDoc.Objects.AddLine(this.e_lines[pair.Value]);
        //RhinoApp.WriteLine(string.Format("{0} {1}",pair.Key,pair.Value));
      }



      //Create rtree and add lines
      RTree rTree = new RTree();
      for (int i = 0; i < this.e_lines.Length; i++)
        rTree.Insert(this.e_lines[i].BoundingBox, i);

      //Search tree
      for(int i = 0; i < lines.Count;i++ ){
        BoundingBox bbox = lines[i].BoundingBox;
        bbox.Inflate(Rhino.RhinoDoc.ActiveDoc.ModelAbsoluteTolerance);
        bbox.Inflate(1);
        rTree.Search(lines[i].BoundingBox, BoundingBoxCallback);

        //iterate through found ids and check if end point lies on a mesh edge
        foreach(var  id in found_ids ){
          //RhinoDoc.ActiveDoc.Objects.AddLine(lines[i]);
          //RhinoDoc.ActiveDoc.Objects.AddLine(e_lines[id]);
          //break;
          if( this.e_lines[id].ClosestPoint(lines[i].From, true).DistanceToSquared(lines[i].From) < Rhino.RhinoDoc.ActiveDoc.ModelAbsoluteTolerance){
            this.insertion_vectors[id] = lines[i].Direction.UnitVector();
            //RhinoApp.WriteLine("Hi");
          }else if( this.e_lines[id].ClosestPoint(lines[i].To, true).DistanceToSquared(lines[i].To) < Rhino.RhinoDoc.ActiveDoc.ModelAbsoluteTolerance){
            this.insertion_vectors[id] = lines[i].Direction.UnitVector();
            // RhinoApp.WriteLine("Hi");
          }
        }
        //break;
        // RhinoApp.WriteLine(found_ids.Count.ToString());
        found_ids = new List<int>();

      }

    }

    void BoundingBoxCallback(object sender, RTreeEventArgs e)
    {
      found_ids.Add(e.Id);
    }


    public void get_edge_planes(){

      e_planes = new Plane[e_ngon_e.Count];
      for (int i = 0; i < e_ngon_e.Count; i++)
      {




        int id = e_ngon_e.ElementAt(i).Key;

        if(this.m.TopologyEdges.GetConnectedFaces(id).Length == 1){
          e_planes[i] = Plane.Unset;
          continue;
        }

        Line edge_line = this.m.TopologyEdges.EdgeLine(id);
        Point3d origin = edge_line.Mid();
        Vector3d xaxis = edge_line.Direction.UnitVector();
        IndexPair pair = this.m.TopologyEdges.GetTopologyVertices(id);
        //edge vertex normals
        Vector3d yaxis = ((Vector3d) (this.m.Normals[pair.I] + this.m.Normals[pair.J])) * 0.5;
        //or face normals
        yaxis = (this.f_planes[this.e_f[i][0]].ZAxis + this.f_planes[this.e_f[i][1]].ZAxis) * 0.5;
        //set plane
        e_planes[i] = new Plane(origin, xaxis, yaxis);
        

      }
    }


    //Compute geometry
    public void get_face_polylines(){




      bool zero_layer = this.face_positions.Count == 0;

      this.f_polylines_index = new string[f][];
      this.f_polylines_planes = new Plane[f][];
      this.f_polylines = new Polyline[f][];

      for(int i = 0; i < f; i++){

        if(this.face_positions.Count == 0){

          f_polylines[i] = new Polyline[2];

          f_polylines[i][0] = PolylineUtil.OutlineFromFaceEdgeCorner(f_planes[i].MovePlanebyAxis(this.face_thickness * -0.5), fe_planes[i], bi_planes[i], 2);
          f_polylines[i][1] = PolylineUtil.OutlineFromFaceEdgeCorner(f_planes[i].MovePlanebyAxis(this.face_thickness * 0.5), fe_planes[i], bi_planes[i], 2);

          f_polylines_planes[i] = new Plane[1]{
            f_planes[i].MovePlanebyAxis(this.face_thickness * 0.5)
            };

          f_polylines_index[i] = new string[1]{
            i.ToString()
            };


        }else{

          f_polylines[i] = new Polyline[this.face_positions.Count * 2];
          f_polylines_planes[i] = new Plane[this.face_positions.Count];
          f_polylines_index[i] = new string[this.face_positions.Count];

          for(int j = 0; j < this.face_positions.Count ; j++){
            Polyline pline0 = PolylineUtil.OutlineFromFaceEdgeCorner(f_planes[i].MovePlanebyAxis(this.face_positions[j] + this.face_thickness * -0.5), fe_planes[i], bi_planes[i], 2);
            Polyline pline1 = PolylineUtil.OutlineFromFaceEdgeCorner(f_planes[i].MovePlanebyAxis(this.face_positions[j] + this.face_thickness * 0.5), fe_planes[i], bi_planes[i], 2);
            //f_polylines[i][j] = rhino_util.PolylineUtil.PolylineFromPlanes(f_planes[i].MovePlanebyAxis(this.face_thickness[j]), e_planes[i].ToList());
            f_polylines[i][j * 2 + 0] = pline0;
            f_polylines[i][j * 2 + 1] = pline1;
            f_polylines_planes[i][j] = f_planes[i].MovePlanebyAxis(this.face_positions[j] + this.face_thickness * 0.5);

            f_polylines_index[i][j] = this.face_positions.Count == 1 ? i.ToString() : string.Format("{0}-{1}", i, j);
          }

        }




      }

    }







   

    
  }
# ---------- end c_script_2 ----------

# ---- group: Butterfly Key Plates
crv_7 = Curve([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])
crv_8 = Curve([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])
end_3 = EndPoints(Curve=crv_7)  # -> Start, End
end_4 = EndPoints(Curve=crv_8)  # -> Start, End
ln_3 = Line(StartPoint=end_3.Start, EndPoint=end_3.End)
ln_4 = Line(StartPoint=end_4.Start, EndPoint=end_4.End)
crv_9 = Curve([crv_7, ln_3])
crv_10 = Curve([crv_8, ln_4])
cp = ControlPoints(Curve=crv_9)  # -> Points, Weights, Knots
cp_2 = ControlPoints(Curve=crv_10)  # -> Points, Weights, Knots
pline = PolyLine(Vertices=cp.Points, Closed=False)  # -> flatten(Polyline)
pline_2 = PolyLine(Vertices=cp_2.Points, Closed=False)  # -> flatten(Polyline)
panel_2 = Panel("""1
1""")
panel_3 = Panel("""1
1""")
c_script_3 = CSharpScript(type="0", plines0=pline, plines1=pline_2, bool0=panel_3, bool1=panel_2, unit_scale=Toggle(True))  # -> out, joint; inputs type: Int32, plines0: list, plines1: list, bool0: list of Int32, bool1: list of Int32, unit_scale: Int32
# ---------- c_script_3: C# ----------
    joint = new Grasshopper.Kernel.Types.GH_ObjectWrapper (new List < object > {type, plines0, plines1, bool0, bool1,unit_scale});
    this.Component.Message = " Plines order \n Top,Bottom,Top,Bottom ";
# ---------- end c_script_3 ----------

# ----
rotate = Rotate(Geometry=merge, Angle=degrees(Slider(90, range=0..100)), Plane=PlaneXY(0, 0, 0))  # -> Geometry, Transform

panel_4 = Panel("""0
0""")
panel_5 = Panel("""0
0""")
crv_11 = Curve([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])
panel_6 = Panel("""2
1""")
entwine = Entwine(Branch00=crv_11, Branch01=crv_11, FlattenInputs=True)
entwine_2 = Entwine(Branch00=panel_4, Branch01=panel_4, FlattenInputs=True)
entwine_3 = Entwine(Branch00=panel_5, Branch01=panel_5, FlattenInputs=True)
c_script_4 = CSharpScript(type=panel_6, plines0=entwine, plines1=entwine, bool0=entwine_2, bool1=entwine_3)  # -> out, A; inputs type: list of Int32, plines0: tree of Polyline, plines1: tree of Polyline, bool0: tree of Int32, bool1: tree of Int32
# ---------- c_script_4: C# ----------
    XmlWriter xmlWriter = XmlWriter.Create("C:\\Users\\petra\\Desktop\\New folder\\joint_library.xml");
    xmlWriter.WriteStartDocument();


    /////////////////////////////////////////////////////////////////////////////////////////////////////////////////////////////////////////////
    //Start document
    /////////////////////////////////////////////////////////////////////////////////////////////////////////////////////////////////////////////
    xmlWriter.WriteStartElement("custom_joints");
    for(int i = 0; i < type.Count;i++){
      write_joint(ref xmlWriter, type[i], plines0.Branch(i), plines1.Branch(i), bool0.Branch(i), bool1.Branch(i));
      Print("hi");
    }

    /////////////////////////////////////////////////////////////////////////////////////////////////////////////////////////////////////////////
    //End document
    /////////////////////////////////////////////////////////////////////////////////////////////////////////////////////////////////////////////
    xmlWriter.WriteEndDocument();
    xmlWriter.Close();
# ---------- c_script_4: C# additional code ----------
  public void write_joint(ref XmlWriter xmlWriter, int type, List<Polyline> plines0, List<Polyline> plines1, List<int> bool0, List<int> bool1){

    string joint_name = "";
    switch (type) {
      case(0):
      case(12):
        joint_name = "ss_e_ip_9";
        break;
      case(1):
      case(11):
        joint_name = "ss_e_op_9";
        break;
      case(2):
      case(20):
        joint_name = "ts_e_p_9";
        break;
      case(3):
      case(30):
        joint_name = "cr_c_ip_9";
        break;
      case(4):
      case(40):
        joint_name = "tt_e_p_9";
        break;
      case(5):
      case(50):
        joint_name = "ss_e_r_9";
        break;
    }

    /////////////////////////////////////////////////////////////////////////////////////////////////////////////////////////////////////////////
    //Start document
    /////////////////////////////////////////////////////////////////////////////////////////////////////////////////////////////////////////////
    xmlWriter.WriteStartElement(joint_name);

    for(int i = 0; i < plines0.Count; i++){
      string name = i % 2 == 0 ? "f0" : "f1";
      xml_polyline(ref xmlWriter, plines0[i], name);
    }

    for(int i = 0; i < plines1.Count; i++){
      string name = i % 2 == 0 ? "m0" : "m1";
      xml_polyline(ref xmlWriter, plines0[i], name);
    }

    xml_int_list(ref xmlWriter, bool0, "f_boolean_type");
    xml_int_list(ref xmlWriter, bool1, "m_boolean_type");

    xmlWriter.WriteEndElement();
    /////////////////////////////////////////////////////////////////////////////////////////////////////////////////////////////////////////////
    //End document
    /////////////////////////////////////////////////////////////////////////////////////////////////////////////////////////////////////////////


  }

  public void xml_int_list(ref XmlWriter xmlWriter, List<int> numbers, string name){
    xmlWriter.WriteStartElement(name);
    foreach(int n in numbers){

      xmlWriter.WriteStartElement("char");
      xmlWriter.WriteString(n.ToString());
      xmlWriter.WriteEndElement();

    }
    xmlWriter.WriteEndElement();
  }

  public void xml_polyline(ref XmlWriter xmlWriter, Polyline pline, string name){
    xmlWriter.WriteStartElement(name);
    foreach(Point3d p in pline){

      xmlWriter.WriteStartElement("point");

      xmlWriter.WriteStartElement("x");
      xmlWriter.WriteString(p.X.ToString());
      xmlWriter.WriteEndElement();

      xmlWriter.WriteStartElement("y");
      xmlWriter.WriteString(p.Y.ToString());
      xmlWriter.WriteEndElement();

      xmlWriter.WriteStartElement("z");
      xmlWriter.WriteString(p.Z.ToString());
      xmlWriter.WriteEndElement();

      xmlWriter.WriteEndElement();
    }
    xmlWriter.WriteEndElement();
  }
# ---------- end c_script_4 ----------

xz = XZPlane(Origin=Point(0, 0, 0))
crv_12 = Curve([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])
crv_13 = Curve([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])
crv_14 = Curve([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])
crv_15 = Curve([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])
crv_16 = Curve([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])
crv_17 = Curve([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])
crv_18 = Curve([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])
crv_19 = Curve([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])
merge_3 = Merge(Data1=crv_12, Data2=crv_13, Data3=crv_14, Data4=crv_19)
merge_4 = Merge(Data1=crv_15, Data2=crv_16, Data3=crv_17, Data4=crv_18)
crv_20 = Curve([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])  # disabled
# New Joint: Distort center joint
brep_4 = Brep([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])  # disabled
mirror = Mirror(Geometry=rotate.Geometry, Plane=xz)  # -> Geometry, Transform

# ---- group: Butterfly Key Plates
crv_21 = Curve(merge_2)
cp_3 = ControlPoints(Curve=crv_21)  # -> Points, Weights, Knots
cp_4 = ControlPoints(Curve=mirror.Geometry)  # -> Points, Weights, Knots
pline_3 = PolyLine(Vertices=cp_3.Points, Closed=False)  # -> flatten(Polyline)
pline_4 = PolyLine(Vertices=cp_4.Points, Closed=False)  # -> flatten(Polyline)
panel_7 = Panel("""3
3""")
panel_8 = Panel("""3
3""")
c_script_5 = CSharpScript(type="1", plines0=pline_4, plines1=pline_3, bool0=panel_7, bool1=panel_8, unit_scale=Toggle(False))  # -> out, joint; inputs type: Int32, plines0: list, plines1: list, bool0: list of Int32, bool1: list of Int32, unit_scale: Int32; same code as c_script_3

# ----
panel_9 = Panel("""6
6
6
6""")

# ---- group: joints_params
number_slider_6 = Slider(300, range=30..3000)  # disabled
number_slider_7 = Slider(0.5, range=0..1)  # disabled
number_slider_8 = Slider(9, range=1..9)  # disabled
number_slider_9 = Slider(261, range=30..3000)  # disabled
number_slider_10 = Slider(0.55, range=0..1)  # disabled
number_slider_11 = Slider(11, range=10..19)  # disabled
number_slider_12 = Slider(450, range=30..3000)  # disabled
number_slider_13 = Slider(0.5, range=0..1)  # disabled
number_slider_14 = Slider(21, range=20..29)  # disabled
number_slider_15 = Slider(300, range=30..3000)  # disabled
number_slider_16 = Slider(0.5, range=0..1)  # disabled
number_slider_17 = Slider(30, range=30..39)  # disabled
number_slider_18 = Slider(300, range=30..3000)  # disabled
number_slider_19 = Slider(0.5, range=0..1)  # disabled
number_slider_20 = Slider(40, range=40..49)  # disabled
number_slider_21 = Slider(300, range=30..3000)  # disabled
number_slider_22 = Slider(0.5, range=0..1)  # disabled
number_slider_23 = Slider(50, range=50..59)  # disabled
joints_params = Joints_params(
    ss_e_ip_len=number_slider_6,
    ss_e_ip_shift=number_slider_7,
    ss_e_ip_type=number_slider_8,
    ss_e_op_len=number_slider_9,
    ss_e_op_shift=number_slider_10,
    ss_e_op_type=number_slider_11,
    ts_e_p_len=number_slider_12,
    ts_e_p_shift=number_slider_13,
    ts_e_p_type=number_slider_14,
    cr_c_ip_len=number_slider_15,
    cr_c_ip_shift=number_slider_16,
    cr_c_ip_type=number_slider_17,
    tt_e_p_len=number_slider_18,
    tt_e_p_shift=number_slider_19,
    tt_e_p_type=number_slider_20,
    ss_e_r_len=number_slider_21,
    ss_e_r_shift=number_slider_22,
    ss_e_r_type=number_slider_23)  # disabled

# ----
partition = PartitionList(List=crv_20, Size=2)  # disabled
Z = UnitZ(Factor=-1)
move = Move(Geometry=merge_4, Motion=Z)  # -> Geometry, Transform
move_2 = Move(Geometry=merge_3, Motion=Z)  # -> Geometry, Transform

tag = TextTag()  # disabled
tag_2 = TextTag3D(Size=25, Justification=2)  # disabled
crv_22 = Curve()  # disabled
crv_23 = Curve()  # disabled
crv_24 = Curve(flatten([crv_22, crv_23]))  # disabled
partition_2 = PartitionList(List=crv_24, Size=2)  # disabled
input_set = Input_set(Plines=partition_2)  # disabled
loft = Loft(Polylines1=partition_2)  # disabled
number_slider_24 = Slider(1, range=0..1)  # disabled
solver = Solver(Data=input_set, Find=number_slider_24, Get=4)  # disabled
input_get = Input_get(Data=solver)  # -> Plines, Insertion_vectors, Joints_per_face, Three_valence, Adjacency; disabled
loft_2 = Loft(Polylines1=input_get.Plines)  # disabled

input_set_2 = Input_set(Plines=partition)  # disabled
xz_2 = XZPlane(Origin=Point(0, 0, 0))
panel_10 = Panel("""1
1""")
crv_25 = Curve([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])
chamfer = Chamfer(Poly=c_script_2.f, Chamfer=Slider(-0.8067, range=-10..1))
rotate_2 = Rotate(Geometry=move.Geometry, Angle=degrees(180), Plane=xz_2)  # -> Geometry, Transform
# 1. Create In-Plane Tile tenon-mortise that ends with miter.
# 2. Mofigy to create through-tenon
crv_26 = Curve([<curve referenced from the Rhino model> x4])
rotate_3 = Rotate(Geometry=move_2.Geometry, Angle=degrees(180), Plane=xz_2)  # -> Geometry, Transform

# ---- group: joints_params
joints_params_2 = Joints_params(
    ss_e_ip_len=Slider(300, range=30..3000),
    ss_e_ip_shift=Slider(0.5, range=0..1),
    ss_e_ip_type=Slider(9, range=1..9),
    ss_e_op_len=Slider(450, range=30..3000),
    ss_e_op_shift=Slider(0.5, range=0..1),
    ss_e_op_type=Slider(19, range=10..19),
    ts_e_p_len=Slider(450, range=30..3000),
    ts_e_p_shift=Slider(0.5, range=0..1),
    ts_e_p_type=Slider(29, range=20..29),
    cr_c_ip_len=Slider(300, range=30..3000),
    cr_c_ip_shift=Slider(0.5, range=0..1),
    cr_c_ip_type=Slider(30, range=30..39),
    tt_e_p_len=Slider(300, range=30..3000),
    tt_e_p_shift=Slider(0.5, range=0..1),
    tt_e_p_type=Slider(40, range=40..49),
    ss_e_r_len=Slider(300, range=30..3000),
    ss_e_r_shift=Slider(0.5, range=0..1),
    ss_e_r_type=Slider(50, range=50..59))

# ----
panel_11 = Panel(c_script.e_id)  # disabled
panel_12 = Panel("""CPP Vector 7.6665944653762805 -9.3361544498517421 -2.3958820402971281 
CPP Vector 9.8776300030372042 -2.2767710672633292 -3.9440657910168686
CPP Vector 9.8775863430510995 -2.2767506882333119 -3.9440352199654805
CPP Vector 11.945561489907952 4.3257104062775316 -5.392047006624983 
CPP Vector 10.199162045741815 5.140871606937738 -4.1692049510946045
CPP Vector 12.267093532612563 11.743353080478601 -5.6171861667027176
CPP Vector 14.0134929767787 10.928191879818394 -6.8400282222330961 
CPP Vector 16.081380803663343 17.530693732389274 -8.2879788667898229
CPP Vector 16.081424463649448 17.530673353359255 -8.288009437841211
CPP Vector 17.696932891652104 22.688660711237013 -9.4192006171699916 
CPP Vector 17.6969328916521 -31 -9.4192006171699898
CPP Vector 7.6665944653762805 -9.3361544498517421 -2.3958820402971281
CPP int 0
CPP Vector 8.1951091885973106 -7.9999999999999982 -0.32440285602840113
CPP Vector 10.11993703898888 -1.8544191126965757 -1.6721818266285742
CPP Vector 11.866336483155017 -2.6695803133567821 -2.8950238821589527 
CPP Vector 13.934267970025765 3.9329011601840791 -4.3430050977670671
CPP Vector 12.187868525859628 4.7480623608442851 -3.1201630422366882
CPP Vector 14.255800012730376 11.350543834385148 -4.5681442578448017 
CPP Vector 16.002199456896513 10.535382633724941 -5.7909863133751802
CPP Vector 18.070130943767261 17.137864107265802 -7.2389675289832951 
CPP Vector 16.323731499601124 17.953025307926008 -6.0161254734529166
CPP Vector 18.844085764354205 26.000000000000039 -7.7808965285920149 
CPP Vector 18.844085764354201 -31 -7.7808965285920104
CPP Vector 8.1951091885973106 -7.9999999999999982 -0.32440285602840113
CPP int 0""")
input_set_3 = Input_set(Plines=crv_26)
yz = YZPlane(Origin=Point(0, 0, 0))
xz_3 = XZPlane(Origin=Point(0, 0, 0))
plinestocompas = PlinesToCompas(plines=flatten(chamfer))  # -> out, A; inputs plines: list of Polyline
# ---------- plinestocompas: C# ----------
    string output = "[";

    for(int i = 0; i < plines.Count;i++){
      string pline_string = "Polyline([";

      for(int j = 0; j < plines[i].Count; j++){
        pline_string += "Point(";
        double x = Math.Abs(plines[i][j].X) < 0.001 ? 0 : plines[i][j].X;
        double y = Math.Abs(plines[i][j].Y) < 0.001? 0 : plines[i][j].Y;
        double z = Math.Abs(plines[i][j].Z) < 0.001? 0 : plines[i][j].Z;
        pline_string += x.ToString();
        pline_string += ",";
        pline_string += y.ToString();
        pline_string += ",";
        pline_string += z.ToString();
        pline_string += ")";
        if(j != plines[i].Count - 1)
          pline_string += ",";
      }

      pline_string += "])";
      if(i != plines.Count - 1)
        pline_string += ",";

      // pline_string += "])";
      output += pline_string;

    }

    output += "]";

    A = output;
# ---------- end plinestocompas ----------
panel_13 = Panel("""CPP Vector 7.6665944653762823 -9.3361544498517368 -2.3958820402971299
CPP Vector -13.6801683469258 -20.852333034366101 -7.9591764818525998
CPP Vector 17.696932891652096 22.688660711236995 -9.4192006171699898 
CPP Vector 16.081424463649448 17.530673353359255 -8.288009437841211
CPP Vector 18.070130943767261 17.137864107265802 -7.2389675289832951
CPP Vector 16.002199456896513 10.535382633724941 -5.7909863133751802 
CPP Vector 14.0134929767787 10.928191879818394 -6.8400282222330961
CPP Vector 11.945561489907952 4.3257104062775316 -5.392047006624983
CPP Vector 13.934267970025765 3.9329011601840791 -4.3430050977670671 
CPP Vector 11.866336483155017 -2.6695803133567821 -2.8950238821589527
CPP Vector 9.8776300030372042 -2.2767710672633292 -3.9440657910168686
CPP Vector 7.6665944653762823 -9.3361544498517368 -2.3958820402971299 
CPP int 0
CPP Vector 8.1951091885973106 -7.9999999999999956 -0.32440285602840468
CPP Vector -14.4682514574348 -20.2264584480486 -6.2308229262591999
CPP Vector 18.844085764354187 25.999999999999982 -7.7808965285920078 
CPP Vector 16.323731499601124 17.953025307926008 -6.0161254734529166
CPP Vector 16.323681781939122 17.953035128157161 -6.0161516995006377
CPP Vector 14.255800012730376 11.350543834385148 -4.5681442578448017 
CPP Vector 12.267093532612563 11.743353080478601 -5.6171861667027176
CPP Vector 10.199162045741815 5.140871606937738 -4.1692049510946045
CPP Vector 12.187868525859628 4.7480623608442851 -3.1201630422366882
CPP Vector 10.119887321326878 -1.854409292465423 -1.6722080526762957
CPP Vector 10.11993703898888 -1.8544191126965757 -1.6721818266285742
CPP Vector 8.1951091885973106 -7.9999999999999956 -0.32440285602840468 
CPP int 0""")
solver_2 = Solver(Data=input_set_2, Join=joints_params, Find=0, Get=4)  # disabled
cluster = Cluster(data=input_set_3)
rotate_4 = Rotate(Geometry=rotate_2.Geometry, Angle=degrees(90), Plane=yz)  # -> Geometry, Transform
rotate_5 = Rotate(Geometry=rotate_3.Geometry, Angle=degrees(90), Plane=yz)  # -> Geometry, Transform

tag_3 = TextTag3D(
    Location=[connectors.E_pl, connectors.F_pl],
    Text=[connectors.E_id, connectors.F_id],
    Size=4,
    Colour=RGB(255, 0, 77),
    Justification=2)
crv_27 = Curve(flatten(connectors.E))
crv_28 = Curve(flatten(connectors.F))
crv_29 = Curve(flatten([crv_28, crv_27]))
partition_3 = PartitionList(List=crv_29, Size=2)
input_set_4 = Input_set(Plines=partition_3)
loft_3 = Loft(Polylines1=partition_3)
solver_3 = Solver(Data=input_set_4, Find=Slider(1, range=0..1), Get=Slider(4, range=0..4))
input_get_2 = Input_get(Data=solver_3)  # -> Plines, Insertion_vectors, Joints_per_face, Three_valence, Adjacency
loft_4 = Loft(Polylines1=input_get_2.Plines)  # disabled

panel_14 = Panel(plinestocompas.A)
loft_5 = Loft(Curves=partition, Options={Adjust=False, Closed=False, LoftEnds=0, LoftSimp=0, LoftType=0, Rebuild=10, Refit=0.01})  # disabled
c_script_6 = CSharpScript(type="2", plines0=rotate_5.Geometry, plines1=rotate_4.Geometry, bool0=panel_9, bool1=panel_9, unit_scale=Toggle(True))  # -> out, joint; inputs type: Int32, plines0: list, plines1: list, bool0: list of Int32, bool1: list of Int32, unit_scale: Int32; same code as c_script_3
input_get_3 = Input_get(Data=solver_2)  # -> Plines, Insertion_vectors, Joints_per_face, Three_valence, Adjacency; disabled
solver_4 = Solver(Data=input_set_3, Join=joints_params_2, Find=0, Get=Slider(3, range=0..4))
input_get_4 = Input_get(Data=solver_4)  # -> Plines, Insertion_vectors, Joints_per_face, Three_valence, Adjacency
path = FilePath("C:\IBOIS57\_Code\Software\Python\compas_wood\src\compas_wood\joinery_library.xml")

# ---- group: write_xml
merge_5 = Merge(Data1=c_script_3.joint, Data2=c_script_5.joint, Data3=c_script_6.joint)
path_2 = FilePath("C:\Users\petra\AppData\Roaming\Grasshopper\Libraries\compas_wood\joinery_library.xml")
c_script_7 = CSharpScript(path=path, tiles=merge_5)  # -> out, A; inputs path: String, tiles: list
# ---------- c_script_7: C# ----------
    try{
      //Print(joint.GetType().ToString());
      //Tuple<int,List<Polyline>,List<Polyline>,List<int>,List<int>> joint_params = (Tuple<int,List<Polyline>,List<Polyline>,List<int>,List<int>> )joint;

      XmlWriter xmlWriter = XmlWriter.Create(path);
      xmlWriter.WriteStartDocument();

      /////////////////////////////////////////////////////////////////////////////////////////////////////////////////////////////////////////////
      //Start document
      /////////////////////////////////////////////////////////////////////////////////////////////////////////////////////////////////////////////
      xmlWriter.WriteStartElement("custom_joints");
      for(int i = 0; i < tiles.Count;i++){
        var list = ((List < object >) tiles[i]);

        var type = (int) (Object) list[0];
        Print(type.ToString());
        var plines0 = new List<Polyline>();
        var plines1 = new List<Polyline>();
        var bool0 = (List<int>) list[3];
        var bool1 = (List<int>) list[4];
        var unit_scale = (int) (Object) list[5];

        foreach(var o in (List<Object>) list[1]){
          PolylineCurve pcurve = (PolylineCurve) o;
          Polyline pline;
          pcurve.TryGetPolyline(out pline);
          plines0.Add(pline);
        }


        foreach(var o in (List<Object>) list[2]){
          PolylineCurve pcurve = (PolylineCurve) o;
          Polyline pline;
          pcurve.TryGetPolyline(out pline);
          plines1.Add(pline);
        }



        if(plines0.Count == bool0.Count * 2 && plines1.Count == bool1.Count * 2)
          write_joint(ref xmlWriter, type, plines0, plines1, bool0, bool1, unit_scale);
        else{
          this.Component.AddRuntimeMessage(GH_RuntimeMessageLevel.Error,
            String.Format("Number of polylines must be equal to (number of booleans)*2 \n plines0 - {0}, bool0 - {1}, plines1 - {2}, bool1 - {3}", plines0.Count, bool0.Count, plines1.Count, bool1.Count));
        }

      }

      /////////////////////////////////////////////////////////////////////////////////////////////////////////////////////////////////////////////
      //End document
      /////////////////////////////////////////////////////////////////////////////////////////////////////////////////////////////////////////////
      xmlWriter.WriteEndDocument();
      xmlWriter.Close();
    }catch(Exception e){
      Rhino.RhinoApp.WriteLine(e.ToString());
    }
# ---------- c_script_7: C# additional code ----------
  public void write_joint(ref XmlWriter xmlWriter, int type, List<Polyline> plines0, List<Polyline> plines1, List<int> bool0, List<int> bool1, int unit_scale){

    string joint_name = "";
    switch (type) {
      case(0):
      case(12):
        joint_name = "ss_e_ip_9";
        break;
      case(1):
      case(11):
        joint_name = "ss_e_op_9";
        break;
      case(2):
      case(20):
        joint_name = "ts_e_p_9";
        break;
      case(3):
      case(30):
        joint_name = "cr_c_ip_9";
        break;
      case(4):
      case(40):
        joint_name = "tt_e_p_9";
        break;
      case(5):
      case(50):
        joint_name = "ss_e_r_9";
        break;
    }

    /////////////////////////////////////////////////////////////////////////////////////////////////////////////////////////////////////////////
    //Start document
    /////////////////////////////////////////////////////////////////////////////////////////////////////////////////////////////////////////////
    xmlWriter.WriteStartElement(joint_name);

    for(int i = 0; i < plines0.Count; i++){
      string name = i % 2 == 0 ? "f0" : "f1";
      xml_polyline(ref xmlWriter, plines0[i], name);
    }

    for(int i = 0; i < plines1.Count; i++){
      string name = i % 2 == 0 ? "m0" : "m1";
      xml_polyline(ref xmlWriter, plines1[i], name);
    }

    xml_int_list(ref xmlWriter, bool0, "f_boolean_type");
    xml_int_list(ref xmlWriter, bool1, "m_boolean_type");
    xml_int_list(ref xmlWriter, new List<int>{unit_scale}, "properties");

    xmlWriter.WriteEndElement();
    /////////////////////////////////////////////////////////////////////////////////////////////////////////////////////////////////////////////
    //End document
    /////////////////////////////////////////////////////////////////////////////////////////////////////////////////////////////////////////////


  }

  public void xml_int_list(ref XmlWriter xmlWriter, List<int> numbers, string name){
    xmlWriter.WriteStartElement(name);
    foreach(int n in numbers){

      xmlWriter.WriteStartElement("id");
      xmlWriter.WriteString(n.ToString());
      xmlWriter.WriteEndElement();

    }
    xmlWriter.WriteEndElement();
  }

  public void xml_polyline(ref XmlWriter xmlWriter, Polyline pline, string name){
    xmlWriter.WriteStartElement(name);
    foreach(Point3d p in pline){

      xmlWriter.WriteStartElement("point");

      xmlWriter.WriteStartElement("x");
      xmlWriter.WriteString(Math.Round(p.X,10).ToString());
      xmlWriter.WriteEndElement();

      xmlWriter.WriteStartElement("y");
      xmlWriter.WriteString(Math.Round(p.Y,10).ToString());
      xmlWriter.WriteEndElement();

      xmlWriter.WriteStartElement("z");
      xmlWriter.WriteString(Math.Round(p.Z,10).ToString());
      xmlWriter.WriteEndElement();

      xmlWriter.WriteEndElement();
    }
    xmlWriter.WriteEndElement();
  }
# ---------- end c_script_7 ----------

# ----
texttopoints = TextToPoints(x=panel_12)  # -> out, A; inputs x: list of String
# ---------- texttopoints: C# usings ----------
using System.Linq;
# ---------- texttopoints: C# ----------
    var r = new DataTree<Point3d>();
    var l = new List<string>();
    int count = 0;
    for(int i = 0; i < x.Count; i++){
      if(!x[i].Contains("CPP Vector")){
        
        if(l.Count > 0){
          
          
          foreach(var line_string in l){
            string[] words = line_string.Split();
          
      
            var coord = new List<double>();
            foreach(var word in words){
              double result;
              if(double.TryParse(word, out result)){
                coord.Add(result);
              }
            }

            Point3d point = new Point3d(coord[0], coord[1], coord[2]);
            r.Add(point,new GH_Path(count)); 
          }
          
          
          l.Clear();
            count++;
        }
        
      }else{
        l.Add(x[i]);
      }
    }
    
    A = r;
# ---------- end texttopoints ----------
loft_6 = Loft(Polylines1=input_get_3.Plines)  # disabled
xml_tree = Xml_tree()
flip = FlipMatrix(Data=texttopoints.A)
pline_5 = PolyLine(Vertices=texttopoints.A, Closed=False)  # -> flatten(Polyline)
item = ListItem(List=flatten(input_get_4.Plines), Index=Slider(8, range=0..10), Wrap=True)  # -> Item, Item1
item_2 = ListItem(List=flatten(input_get_4.Plines), Index=Slider(2, range=0..10), Wrap=True)  # -> Item, Item1
texttopoints_2 = TextToPoints(x=panel_13)  # -> out, A; inputs x: list of String; same code as texttopoints
loft_7 = LoftPolylines(Curve0=pline_5, Fast=True)
crv_30 = Curve(input_get_2.Plines)
gl_shader = GLShader(
    Vertex=[Point(-1, -1, -1), Point(1, -1, -1), Point(1, 1, -1), Point(-1, 1, -1)],
    Color=RGB(0, 0, 0),
    Thickness=5,
    Res=15,
    DepthTestingEnabled=False,
    DepthWritingEnabled=False,
    DrawMode=6,
    FragmentShader="""#version 330 core
uniform sampler2D _depthBuffer;
uniform sampler2D _colorBuffer;

uniform vec2 _viewportSize;
uniform vec4 color;
uniform float thickness;
uniform float res;

void main() 
{
  vec2 uv = gl_FragCoord.xy / _viewportSize;

  vec4 buffer = texture(_depthBuffer, uv);
  float val = step(0.9999, buffer.x);
  float col = 1.0;
  float div = res;
  float stepang = 360.0 / div;
  for(float i = 0; i<div; i++){
    vec4 bufferP = texture(_depthBuffer, (gl_FragCoord.xy + vec2(cos(radians(stepang*i)), sin(radians(stepang*i)))*thickness) / _viewportSize);
    float valP = step(0.9999, bufferP.x);
    if(val - valP > 0.0){
      col *= 0.0;
    }
  }
  
  vec3 col3 = mix(color.xyz, texture(_colorBuffer, uv).xyz, col);
  
  gl_FragColor = vec4(vec3(col3), 1.0);
 
}""",
    GLShader=(0, 1, 0),
    PreviewSortOrder=5,
    VertexShader="""#version 330

layout(location = 0) in vec3 vertex;



out vec3 normal;

void main() {
  gl_Position = vec4(vertex,1.0);
}""",
    glLineWidth=1,
    glPointSize=8)  # disabled
brep_5 = Brep()  # disabled
pline_6 = PolyLine(Vertices=flip, Closed=False)
panel_15 = Panel(c_script_7.out)
panel_16 = Panel(merge_5)
panel_17 = Panel(path_2)
loft_8 = Loft(Curves=pline_5, Options={Adjust=False, Closed=False, LoftEnds=0, LoftSimp=0, LoftType=0, Rebuild=10, Refit=0.01})
flip_2 = FlipMatrix(Data=texttopoints_2.A)
pline_7 = PolyLine(Vertices=texttopoints_2.A, Closed=False)  # -> flatten(Polyline)
display = CurvePreview(Curve=[item_2.Item, item_2.Item1], Width=10)
display_2 = CurvePreview(Curve=[item.Item, item.Item1], Width=10)
gl_shader_2 = GLShader(
    DepthTestingEnabled=True,
    DepthWritingEnabled=True,
    DrawMode=0,
    FragmentShader="""#version 330

in vec4 vertex_color;
out vec4 fragment_color;

void main() {
  fragment_color = vertex_color;
}""",
    GLShader=(0, 2, 0),
    PreviewSortOrder=5,
    VertexShader="""#version 330

layout(location = 0) in vec3 vertex;
layout(location = 1) in vec4 vcolor;

uniform mat4 _worldToClip;
out vec4 vertex_color;

void main() {
  vertex_color = vcolor;
  gl_Position = _worldToClip * vec4(vertex, 1.0);
}""",
    glLineWidth=3,
    glPointSize=8)  # -> Color, Depth; disabled
loft_9 = LoftPolylines(Curve0=pline_7, Fast=True)
previewedges = PreviewEdges(Mesh=mesh_2, Tolerance=0.44)  # disabled
swatch = ColourSwatch(SwatchColor=RGB(168, 168, 168))  # disabled
panel_18 = Panel(c_script_2.out)  # disabled
pline_8 = PolyLine(Vertices=flip_2, Closed=False)
loft_10 = Loft(Curves=pline_7, Options={Adjust=False, Closed=False, LoftEnds=0, LoftSimp=0, LoftType=0, Rebuild=10, Refit=0.01})
preview = CustomPreview(Geometry=mesh_2, Material=swatch)  # disabled
display_3 = CurvePreview(Curve=previewedges)  # disabled
cap = CapHoles(Brep=loft_8)
cap_2 = CapHoles(Brep=loft_10)

# ==== cluster Cluster
data = ClusterInput()
solver = Solver(Data=data, Find=0, Get=2)
input_get = Input_get(Data=solver)  # -> Plines, Insertion_vectors, Joints_per_face, Three_valence, Adjacency
item = ListItem(List=input_get.Plines, Index=2, Wrap=True)  # -> Item, Item1
display = CurvePreview(Curve=[item.Item, item.Item1], Width=Slider(9, range=0..10))

# ==== cluster Xml_tree: xml_tree

panel = Panel("""0
0""")
panel_2 = Panel("""0
0""")
crv = Curve([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])
panel_3 = Panel("""2
1""")
entwine = Entwine(Branch00=crv, Branch01=crv, FlattenInputs=True)
entwine_2 = Entwine(Branch00=panel, Branch01=panel, FlattenInputs=True)
entwine_3 = Entwine(Branch00=panel_2, Branch01=panel_2, FlattenInputs=True)
c_script = CSharpScript(type=panel_3, plines0=entwine, plines1=entwine, bool0=entwine_2, bool1=entwine_3)  # -> out, A; inputs type: list of Int32, plines0: tree of Polyline, plines1: tree of Polyline, bool0: tree of Int32, bool1: tree of Int32
# ---------- c_script: C# usings ----------
using System.Xml;
# ---------- c_script: C# ----------
    XmlWriter xmlWriter = XmlWriter.Create("C:\\Users\\petra\\Desktop\\New folder\\joint_library.xml");
    xmlWriter.WriteStartDocument();


    /////////////////////////////////////////////////////////////////////////////////////////////////////////////////////////////////////////////
    //Start document
    /////////////////////////////////////////////////////////////////////////////////////////////////////////////////////////////////////////////
    xmlWriter.WriteStartElement("custom_joints");
    for(int i = 0; i < type.Count;i++){
      write_joint(ref xmlWriter, type[i], plines0.Branch(i), plines1.Branch(i), bool0.Branch(i), bool1.Branch(i));
      Print("hi");
    }

    /////////////////////////////////////////////////////////////////////////////////////////////////////////////////////////////////////////////
    //End document
    /////////////////////////////////////////////////////////////////////////////////////////////////////////////////////////////////////////////
    xmlWriter.WriteEndDocument();
    xmlWriter.Close();
# ---------- c_script: C# additional code ----------
  public void write_joint(ref XmlWriter xmlWriter, int type, List<Polyline> plines0, List<Polyline> plines1, List<int> bool0, List<int> bool1){

    string joint_name = "";
    switch (type) {
      case(0):
      case(12):
        joint_name = "ss_e_ip_9";
        break;
      case(1):
      case(11):
        joint_name = "ss_e_op_9";
        break;
      case(2):
      case(20):
        joint_name = "ts_e_p_9";
        break;
      case(3):
      case(30):
        joint_name = "cr_c_ip_9";
        break;
      case(4):
      case(40):
        joint_name = "tt_e_p_9";
        break;
      case(5):
      case(50):
        joint_name = "ss_e_r_9";
        break;
    }

    /////////////////////////////////////////////////////////////////////////////////////////////////////////////////////////////////////////////
    //Start document
    /////////////////////////////////////////////////////////////////////////////////////////////////////////////////////////////////////////////
    xmlWriter.WriteStartElement(joint_name);

    for(int i = 0; i < plines0.Count; i++){
      string name = i % 2 == 0 ? "f0" : "f1";
      xml_polyline(ref xmlWriter, plines0[i], name);
    }

    for(int i = 0; i < plines1.Count; i++){
      string name = i % 2 == 0 ? "m0" : "m1";
      xml_polyline(ref xmlWriter, plines0[i], name);
    }

    xml_int_list(ref xmlWriter, bool0, "f_boolean_type");
    xml_int_list(ref xmlWriter, bool1, "m_boolean_type");

xmlWriter.WriteEndElement();
    /////////////////////////////////////////////////////////////////////////////////////////////////////////////////////////////////////////////
    //End document
    /////////////////////////////////////////////////////////////////////////////////////////////////////////////////////////////////////////////


  }

  public void xml_int_list(ref XmlWriter xmlWriter, List<int> numbers, string name){
    xmlWriter.WriteStartElement(name);
    foreach(int n in numbers){

      xmlWriter.WriteStartElement("char");
      xmlWriter.WriteString(n.ToString());
      xmlWriter.WriteEndElement();

    }
    xmlWriter.WriteEndElement();
  }

  public void xml_polyline(ref XmlWriter xmlWriter, Polyline pline, string name){
    xmlWriter.WriteStartElement(name);
    foreach(Point3d p in pline){

      xmlWriter.WriteStartElement("point");

      xmlWriter.WriteStartElement("x");
      xmlWriter.WriteString(p.X.ToString());
      xmlWriter.WriteEndElement();

      xmlWriter.WriteStartElement("y");
      xmlWriter.WriteString(p.Y.ToString());
      xmlWriter.WriteEndElement();

      xmlWriter.WriteStartElement("z");
      xmlWriter.WriteString(p.Z.ToString());
      xmlWriter.WriteEndElement();

      xmlWriter.WriteEndElement();
    }
    xmlWriter.WriteEndElement();
  }
# ---------- end c_script ----------

out = ClusterOutput(c_script.out)
