# Grasshopper definition cross_end.gh (Grasshopper 1.0.7)
# plug-ins: compas_wood, NGon

crv = Curve([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])
brep = Brep([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])
mesh = Mesh(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)
connectors = Connectors(
    Mesh=mesh,
    Face_positions=Slider(0, range=-10..10),
    Face_thickness=Slider(4, range=0..10),
    Divisions=Slider(2, range=1..10),
    Division_len=Slider(15, range=1..100),
    Edge_vectors=crv,
    Rect_width=Slider(-2, range=-20..20),
    Rect_height=Slider(-9, range=-20..20),
    Rect_thickness=Slider(1, range=1..2),
    Projection=brep)  # -> F, F_pl, F_id, E, E_pl, E_id
crv_2 = Curve(flatten(connectors.F))
crv_3 = Curve(flatten(connectors.E))
tag = TextTag3D(
    Location=[connectors.E_pl, connectors.F_pl],
    Text=[connectors.E_id, connectors.F_id],
    Size=4,
    Colour=RGB(255, 0, 77),
    Justification=2)
crv_4 = Curve(flatten([crv_2, crv_3]))
partition = PartitionList(List=crv_4, Size=2)
loft = Loft(Polylines1=partition)
input_set = Input_set(Plines=partition)
solver = Solver(Data=input_set, Find=Slider(1, range=0..1), Get=Slider(4, range=0..4))
input_get = Input_get(Data=solver)  # -> Plines, Insertion_vectors, Joints_per_face, Three_valence, Adjacency
crv_5 = Curve(input_get.Plines)
loft_2 = Loft(Polylines1=input_get.Plines)
previewedges = PreviewEdges(Mesh=mesh, Tolerance=0.44)
preview = CustomPreview(Geometry=mesh, Material=ColourSwatch(SwatchColor=RGB(168, 168, 168)))
display = CurvePreview(Curve=previewedges)
