# Grasshopper definition ss_out_of_plane_miter.gh (Grasshopper 1.0.7)
# plug-ins: NGon, compas_wood

brep = Brep(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)

crv = Curve()
brep_2 = Brep(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)
crv_2 = Curve([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])
c_script = CSharpScript(
    surface=brep,
    u_divisions=Slider(4, range=0..10),
    v_divisions=Slider(3, range=0..10),
    base_planes=crv_2,
    thickness=Slider(1, range=0..10),
    chamfer=Slider(0.01, range=0.01..1),
    extend=Slider(0.1, range=0.1..1),
    face_positions=Slider(0, range=0..100),
    insertion=crv,
    Reference="C:\Users\petra\AppData\Roaming\Grasshopper\Libraries\compas_wood\rhino_util.dll")  # -> out, m, f, flags, adj; inputs surface: Surface, u_divisions: Int32, v_divisions: Int32, base_planes: list of Plane, thickness: Double, chamfer: Double, extend: Double, face_positions: list of Double, insertion: list of Line
# ---------- c_script: C# usings ----------
using System.Linq;
using rhino_util;
# ---------- c_script: C# ----------
    case_3_mtsj mtsj = new case_3_mtsj(surface, u_divisions, v_divisions, base_planes, thickness, chamfer, extend, insertion, face_positions);

    m = mtsj.m;
    f = rhino_util.GrasshopperUtil.IE2(mtsj.f_polylines);
    flags = rhino_util.GrasshopperUtil.IE2(mtsj.adjacency);
    adj = mtsj.flags;
# ---------- c_script: C# additional code ----------
  public class case_3_mtsj{

    //Diamond Subdivision
    public Mesh m = null;
    public List<bool> flags = new List<bool>();
    public bool[][] edge_joints = new bool[0][];
    public List<int[]> adjacency = new List<int[]>();
    Surface s = null;
    int u_divisions = 1;
    int v_divisions = 1;
    List<Plane> base_planes = new List<Plane>();


    //Properties for plates
    bool has_ngons = false;
    double face_thickness = 1;
    double chamfer = 0.01;
    double extend = 1;
    List<double> face_positions = new List<double>();

    public int f;
    public int e;
    public int[][] f_v;
    public int[][] f_e;
    public int[][] e_f;
    public Dictionary<int,int> e_ngon_e;
    public Plane[] f_planes = new Plane[0];
    public Plane[][] fe_planes = new Plane[0][];
    public Plane[][] bi_planes = new Plane[0][];
    public Plane[] e_planes = new Plane[0];
    public Line[] e_lines = new Line[0];
    public Vector3d[] insertion_vectors = new Vector3d[0];

    //Output
    public string[][] f_polylines_index = new string[0][];
    public Plane[][] f_polylines_planes = new Plane[0][];
    public Polyline[][] f_polylines = new Polyline[0][];


    public case_3_mtsj(Surface s, int u_divisions, int v_divisions, List<Plane> base_planes, double thickness, double chamfer, double extend, List<Line> insertion_vectors, List<double> face_positions){
      this.s = s;
      this.u_divisions = u_divisions;
      this.v_divisions = v_divisions;
      this.base_planes = base_planes;

      //Run
      m = diamond_subdivision();
      this.has_ngons = m.Ngons.Count > 0;
      this.face_thickness = thickness;
      this.chamfer = chamfer;
      this.extend = extend;
      this.face_positions = face_positions;

      //Properties for plates
      get_face_vertices();
      get_faces_planes();
      get_face_edge_planes();
      get_bisector_planes();
      //get_face_polylines();
      get_edges();
      get_edge_faces();
      get_edge_vectors(insertion_vectors);
      get_edge_planes();

      //Compute plate geometry
      get_face_polylines();

    }

    public  Mesh diamond_subdivision()
    {

      Mesh m = new Mesh();
      flags = new List<bool>();

      if (u_divisions < 1)
        u_divisions = 1;

      if (v_divisions < 1)
        v_divisions = 1;

      int v = 0;
      List<MeshFace> face = new List<MeshFace>();
      List<Point3d> pts = new List<Point3d>();
      Interval interval = s.Domain(0);
      Interval interval1 = s.Domain(1);
      double step_u = (interval.T1 - interval.T0) / (double) u_divisions;
      double step_v = (interval1.T1 - interval1.T0) / (double) v_divisions;


      double sum_step_u = 0;

      for (int i = 0; i < u_divisions; i++)  {

        int a = i % 2 == 0 ? 1 : 0;
        int b = i % 2 == 0 ? 2 : 3;

        double sum_step_v = 0;
        for (int j = 0; j < v_divisions; j++)   {

          Point3d p0 = s.PointAt(sum_step_u, sum_step_v);
          Point3d p1 = s.PointAt(sum_step_u + step_u, sum_step_v);

          s.PointAt(sum_step_u, sum_step_v + step_v * 0.5);
          s.NormalAt(sum_step_u, sum_step_v + step_v * 0.5);
          s.PointAt(sum_step_u + step_u, sum_step_v + step_v * 0.5);
          s.NormalAt(sum_step_u + step_u, sum_step_v + step_v * 0.5);

          Point3d p2 = s.PointAt(sum_step_u, sum_step_v + step_v);
          Point3d p3 = s.PointAt(sum_step_u + step_u, sum_step_v + step_v);
          Point3d p4 = s.PointAt(sum_step_u + step_u * 0.5, sum_step_v + step_v * 1.5);
          Point3d p5 = s.PointAt(sum_step_u + step_u * 0.5, sum_step_v + step_v * 0.5);
          Point3d p6 = s.PointAt(sum_step_u + step_u * 0.5, sum_step_v - step_v * 0.5);
          Point3d p7 = (p5 + p6) / 2;
          Point3d p8 = (p4 + p5) / 2;

          if (j == 0)
          {
            ///////////////////////////////////////
            //start triangles
            ///////////////////////////////////////
            Point3d p9 = s.PointAt(sum_step_u + step_u * 0.5, interval1.T0);
            Line line = new Line(p5, p6);
            Point3d cp = line.ClosestPoint(p9, false);

            if(base_planes.Count > 0){
              if(Math.Abs(base_planes.First().ZAxis.X) + Math.Abs(base_planes.First().ZAxis.Y) + Math.Abs(base_planes.First().ZAxis.Z) > 0.01){
                double t;
                Rhino.Geometry.Intersect.Intersection.LinePlane(line, base_planes.First(), out t);
                cp = line.PointAt(t);
              }
            }

            pts.AddRange(new Point3d[] { p1, p5, cp });
            this.flags.Add(face.Count % 4 == a || face.Count % 4 == b);
            face.Add(new MeshFace(v, v + 1, v + 2));

            v += 3;
            pts.AddRange(new Point3d[] { cp, p5, p0 });
            this.flags.Add(face.Count % 4 == a || face.Count % 4 == b);
            face.Add(new MeshFace(v, v + 1, v + 2));
            v += 3;
          }

          pts.AddRange(new Point3d[] { p1, p3, p5 });
          this.flags.Add(face.Count % 4 == a || face.Count % 4 == b);
          face.Add(new MeshFace(v, v + 1, v + 2));
          v += 3;
          pts.AddRange(new Point3d[] { p0, p5, p2 });
          this.flags.Add(face.Count % 4 == a || face.Count % 4 == b);
          face.Add(new MeshFace(v, v + 1, v + 2));
          v += 3;

          if (j != v_divisions - 1)  {
            pts.AddRange(new Point3d[] { p3, p4, p5 });
            this.flags.Add(face.Count % 4 == a || face.Count % 4 == b);
            face.Add(new MeshFace(v, v + 1, v + 2));
            v += 3;
            pts.AddRange(new Point3d[] { p4, p2, p5 });
            this.flags.Add(face.Count % 4 == a || face.Count % 4 == b);
            face.Add(new MeshFace(v, v + 1, v + 2));
            v += 3;

          } else {
            ///////////////////////////////////////
            //end triangles
            ///////////////////////////////////////
            Point3d p9 = s.PointAt(sum_step_u + step_u * 0.5, interval1.T1);
            Line line = new Line(p4, p5);
            Point3d cp = line.ClosestPoint(p9, false);

            if(base_planes.Count > 0){
              if(Math.Abs(base_planes.Last().ZAxis.X) + Math.Abs(base_planes.Last().ZAxis.Y) + Math.Abs(base_planes.Last().ZAxis.Z) > 0.01){
                double t;
                Rhino.Geometry.Intersect.Intersection.LinePlane(line, base_planes.Last(), out t);
                cp = line.PointAt(t);
              }

            }
            pts.AddRange(new Point3d[] { p3, cp, p5 });
            this.flags.Add(face.Count % 4 == a || face.Count % 4 == b);
            face.Add(new MeshFace(v, v + 1, v + 2));
            v += 3;
            pts.AddRange(new Point3d[] { cp, p2, p5 });
            this.flags.Add(face.Count % 4 == a || face.Count % 4 == b);
            face.Add(new MeshFace(v, v + 1, v + 2));

            v += 3;

          }
          sum_step_v += step_v;
        }
        sum_step_u += step_u;
      }

      m.Vertices.AddVertices(pts);

      m.Faces.AddFaces(face);
      m.Weld(3.14159);
      m.RebuildNormals();


      edge_joints = new bool[face.Count][];
      this.adjacency = new List<int[]>();
      //RhinoApp.WriteLine(face.Count.ToString());
      // RhinoApp.WriteLine(m.Faces.Count.ToString()) ;
      for(int i = 0; i < this.flags.Count; i++ ){

        if(this.flags[i]){
          int[] nei = m.Faces.AdjacentFaces(i);

          foreach(int j in nei)
            this.adjacency.Add(new int[2]{i,j});
        }



        edge_joints[i] = Enumerable.Repeat(this.flags[i], 9).ToArray();
      }





      return m;
    }



    //Compute mesh properties

    public void get_face_vertices(){
      if(has_ngons){
        this.f = this.m.Ngons.Count;
        f_v = m.GetNGonsTopoBoundaries();
      }else
      {
        this.f = this.m.Faces.Count;
        f_v = new int[this.m.Faces.Count][];
        for(int i = 0; i < this.m.Faces.Count;i++ )

          f_v[i] = this.m.Faces[i].IsQuad ? new int[] { this.m.Faces[i][0], this.m.Faces[i][1], this.m.Faces[i][2], this.m.Faces[i][3] } : new int[] { this.m.Faces[i][0], this.m.Faces[i][1], this.m.Faces[i][2] };
      }
    }

    public void get_faces_planes(){

      if(has_ngons){
        f_planes = m._FPlanes();
      }else{
        f_planes = new Plane[m.Faces.Count];
        for(int i = 0; i < m.Faces.Count; i++)
          f_planes[i] = new Plane(m.MeshFaceCenter(i), m.FaceNormals[i]);
      }



    }

    public void get_face_edge_planes()
    {

      fe_planes = new Plane[f][];


      for (int i = 0; i < f; i++)
      {
        int n = f_v[i].Length;
        fe_planes[i] = new Plane[n];

        for (int j = 0; j < f_v[i].Length; j++)
        {
          int v1 = f_v[i][(j + 0) % n];
          int v2 = f_v[i][(j + 1) % n];

          int e = this.m.TopologyEdges.GetEdgeIndex(v1, v2);
          int[] cf = this.m.TopologyEdges.GetConnectedFaces(e);



          Vector3d sum = Vector3d.Zero;
          for (int k = 0; k < cf.Length; k++)
            sum += this.m.FaceNormals[cf[k]];
          sum /= cf.Length;

          Plane edgePlane = new Plane((Point3d) (this.m.Vertices[v1] + this.m.Vertices[v2]) * 0.5, this.m.Vertices[v1] - this.m.Vertices[v2], sum);
          fe_planes[i][j] = edgePlane;

          //Adjust to surface
          if(s != null){

            double u, v;
            s.ClosestPoint(fe_planes[i][j].Origin, out u, out v);
            Vector3d normal = s.NormalAt(u, v);
            //Vector3d xaxis = Vector3d.CrossProduct(normal, e_planes[i][j].YAxis);
            //Vector3d yaxis = Vector3d.CrossProduct(normal, xaxis);
            //s.PointAt(u, v)
            fe_planes[i][j] = new Plane(fe_planes[i][j].Origin, Vector3d.CrossProduct(normal, fe_planes[i][j].ZAxis), normal);

          }




        }//for j
      }//for i
    }

    public void get_bisector_planes()
    {
      bi_planes = new Plane[f][];

      for (int i = 0; i < f; i++)
      {
        int n = f_v[i].Length;
        bi_planes[i] = new Plane[n];
        for (int j = 0; j < n; j++)
        {
          var pl1 = fe_planes[i][j];
          var pl0 = fe_planes[i][MathUtil.Wrap(j + 1, n)];
          bi_planes[i][j] = PlaneUtil.DihedralPlane(pl0, pl1);
        }
      }//for i
    }

    public void get_edges(){


      if(this.has_ngons) {
        e_ngon_e = this.m._EAll();
        this.e = e_ngon_e.Count;
      }else{

        e_ngon_e = new Dictionary< int,int>();
        for(int i = 0; i < this.m.TopologyEdges.Count; i++ ){
          e_ngon_e.Add(i, i);
        }

      }
      this.e = e_ngon_e.Count;

    }

    public void get_edge_faces(){

      if(this.has_ngons){
        this.e_f = this.m._EF();

      }else{
        this.e_f = new int[this.m.TopologyEdges.Count][];
        for(int i = 0; i < this.m.TopologyEdges.Count;i++)
          this.e_f[i] = this.m.TopologyEdges.GetConnectedFaces(i);
      }
    }


    List<int> found_ids = new List<int>();
    public void get_edge_vectors(List<Line> lines){

      //Init empty vectors
      this.insertion_vectors = new Vector3d[this.e];


      //Get edge lines including naked
      this.e_lines = new Line[this.e];
      foreach(var pair in this.e_ngon_e){
        this.e_lines[pair.Value] = this.m.TopologyEdges.EdgeLine(pair.Key);
        //RhinoDoc.ActiveDoc.Objects.AddLine(this.e_lines[pair.Value]);
        //RhinoApp.WriteLine(string.Format("{0} {1}",pair.Key,pair.Value));
      }



      //Create rtree and add lines
      RTree rTree = new RTree();
      for (int i = 0; i < this.e_lines.Length; i++)
        rTree.Insert(this.e_lines[i].BoundingBox, i);

      //Search tree
      for(int i = 0; i < lines.Count;i++ ){
        BoundingBox bbox = lines[i].BoundingBox;
        bbox.Inflate(Rhino.RhinoDoc.ActiveDoc.ModelAbsoluteTolerance);
        bbox.Inflate(1);
        rTree.Search(lines[i].BoundingBox, BoundingBoxCallback);

        //iterate through found ids and check if end point lies on a mesh edge
        foreach(var  id in found_ids ){
          //RhinoDoc.ActiveDoc.Objects.AddLine(lines[i]);
          //RhinoDoc.ActiveDoc.Objects.AddLine(e_lines[id]);
          //break;
          if( this.e_lines[id].ClosestPoint(lines[i].From, true).DistanceToSquared(lines[i].From) < Rhino.RhinoDoc.ActiveDoc.ModelAbsoluteTolerance){
            this.insertion_vectors[id] = lines[i].Direction.UnitVector();
            //RhinoApp.WriteLine("Hi");
          }else if( this.e_lines[id].ClosestPoint(lines[i].To, true).DistanceToSquared(lines[i].To) < Rhino.RhinoDoc.ActiveDoc.ModelAbsoluteTolerance){
            this.insertion_vectors[id] = lines[i].Direction.UnitVector();
            // RhinoApp.WriteLine("Hi");
          }
        }
        //break;
        // RhinoApp.WriteLine(found_ids.Count.ToString());
        found_ids = new List<int>();

      }

    }

    void BoundingBoxCallback(object sender, RTreeEventArgs e)
    {
      found_ids.Add(e.Id);
    }


    public void get_edge_planes(){

      e_planes = new Plane[e_ngon_e.Count];
      for (int i = 0; i < e_ngon_e.Count; i++)
      {




        int id = e_ngon_e.ElementAt(i).Key;

        if(this.m.TopologyEdges.GetConnectedFaces(id).Length == 1){
          e_planes[i] = Plane.Unset;
          continue;
        }

        Line edge_line = this.m.TopologyEdges.EdgeLine(id);
        Point3d origin = edge_line.Mid();
        Vector3d xaxis = edge_line.Direction.UnitVector();
        IndexPair pair = this.m.TopologyEdges.GetTopologyVertices(id);
        //edge vertex normals
        Vector3d yaxis = ((Vector3d) (this.m.Normals[pair.I] + this.m.Normals[pair.J])) * 0.5;
        //or face normals
        yaxis = (this.f_planes[this.e_f[i][0]].ZAxis + this.f_planes[this.e_f[i][1]].ZAxis) * 0.5;
        //set plane
        e_planes[i] = new Plane(origin, xaxis, yaxis);


      }
    }


    //Compute geometry
    public void get_face_polylines(){




      bool zero_layer = this.face_positions.Count == 0;

      this.f_polylines_index = new string[f][];
      this.f_polylines_planes = new Plane[f][];
      this.f_polylines = new Polyline[f][];

      for(int i = 0; i < f; i++){

        if(this.face_positions.Count == 0){

          f_polylines[i] = new Polyline[2];

          f_polylines[i][0] = PolylineUtil.OutlineFromFaceEdgeCorner(f_planes[i].MovePlanebyAxis(this.face_thickness * -0.5), fe_planes[i], bi_planes[i], 2);
          f_polylines[i][1] = PolylineUtil.OutlineFromFaceEdgeCorner(f_planes[i].MovePlanebyAxis(this.face_thickness * 0.5), fe_planes[i], bi_planes[i], 2);

          f_polylines_planes[i] = new Plane[1]{
            f_planes[i].MovePlanebyAxis(this.face_thickness * 0.5)
            };

          f_polylines_index[i] = new string[1]{
            i.ToString()
            };


        }else{

          f_polylines[i] = new Polyline[this.face_positions.Count * 2];
          f_polylines_planes[i] = new Plane[this.face_positions.Count];
          f_polylines_index[i] = new string[this.face_positions.Count];

          for(int j = 0; j < this.face_positions.Count ; j++){
            Polyline pline0 = PolylineUtil.OutlineFromFaceEdgeCorner(f_planes[i].MovePlanebyAxis(this.face_positions[j] + this.face_thickness * -0.5), fe_planes[i], bi_planes[i], 2);
            Polyline pline1 = PolylineUtil.OutlineFromFaceEdgeCorner(f_planes[i].MovePlanebyAxis(this.face_positions[j] + this.face_thickness * 0.5), fe_planes[i], bi_planes[i], 2);
            //f_polylines[i][j] = rhino_util.PolylineUtil.PolylineFromPlanes(f_planes[i].MovePlanebyAxis(this.face_thickness[j]), e_planes[i].ToList());
            f_polylines[i][j * 2 + 0] = pline0;
            f_polylines[i][j * 2 + 1] = pline1;
            f_polylines_planes[i][j] = f_planes[i].MovePlanebyAxis(this.face_positions[j] + this.face_thickness * 0.5);

            f_polylines_index[i][j] = this.face_positions.Count == 1 ? i.ToString() : string.Format("{0}-{1}", i, j);
          }

        }




      }

    }










  }
# ---------- end c_script ----------

panel = Panel("""False
True""")
panel_2 = Panel("""-19
19""")
bool = Boolean(panel)

# ---- group: Butterfly Key Plates
crv_3 = Curve([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])
end = EndPoints(Curve=crv_3)  # -> Start, End
end_2 = EndPoints(Curve=crv_3)  # -> Start, End
ln = Line(StartPoint=end.Start, EndPoint=end.End)
ln_2 = Line(StartPoint=end_2.Start, EndPoint=end_2.End)
merge = Merge(Data1=crv_3, Data2=ln_2)
merge_2 = Merge(Data1=crv_3, Data2=ln)
rotate = Rotate(Geometry=merge_2, Angle=degrees(Slider(90, range=0..100)), Plane=PlaneXY(0, 0, 0))  # -> Geometry, Transform
xz = XZPlane(Origin=Point(0, 0, 0))
crv_4 = Curve(merge)
mirror = Mirror(Geometry=rotate.Geometry, Plane=xz)  # -> Geometry, Transform
cp = ControlPoints(Curve=crv_4)  # -> Points, Weights, Knots
cp_2 = ControlPoints(Curve=mirror.Geometry)  # -> Points, Weights, Knots
pline = PolyLine(Vertices=cp.Points, Closed=False)  # -> flatten(Polyline)
pline_2 = PolyLine(Vertices=cp_2.Points, Closed=False)  # -> flatten(Polyline)
panel_3 = Panel("""3
3""")
panel_4 = Panel("""3
3""")
c_script_2 = CSharpScript(type="1", plines0=pline_2, plines1=pline, bool0=panel_3, bool1=panel_4, unit_scale=Toggle(False))  # -> out, joint; inputs type: Int32, plines0: list, plines1: list, bool0: list of Int32, bool1: list of Int32, unit_scale: Int32
# ---------- c_script_2: C# ----------
    joint = new Grasshopper.Kernel.Types.GH_ObjectWrapper (new List < object > {type, plines0, plines1, bool0, bool1,unit_scale});
    this.Component.Message = " Plines order \n Top,Bottom,Top,Bottom ";
# ---------- end c_script_2 ----------

# ----
panel_5 = Panel(c_script.flags)
chamfer = Chamfer(Poly=c_script.f, Chamfer=Slider(-0.8067, range=-10..1))
crv_5 = Curve([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])
replace = ReplaceMembers(Set=c_script.flags, Find=graft(bool), Replace=graft(panel_2))
panel_6 = Panel(replace)
crv_6 = Curve(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)
crv_7 = Curve(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)
crv_8 = Curve([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])
crv_9 = Curve([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])
crv_10 = Curve([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])
crv_11 = Curve([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])
item = ListItem(List=crv_8, Index=0, Wrap=True)
item_2 = ListItem(List=crv_11, Index=0, Wrap=True)
crv_12 = Curve(chamfer)
crv_13 = Curve([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])
end_3 = EndPoints(Curve=crv_5)  # -> Start, End
merge_3 = Merge(Data1=crv_7, Data2=crv_6)
entwine = Entwine(Branch00=crv_8, FlattenInputs=True)
entwine_2 = Entwine(Branch00=crv_11, FlattenInputs=True)
# 1. Create In-Plane Tile tenon-mortise that ends with miter.
# 2. Mofigy to create through-tenon
top = GetPolylines(Mesh=c_script.m)
ln_3 = Line(StartPoint=end_3.Start, EndPoint=end_3.End)
partition = PartitionList(List=crv_13, Size=2)
panel_7 = Panel("""0
1""")
display = CurvePreview(Curve=[item, item_2], Width=10)

# ---- group: joints_params
joints_params = Joints_params(
    ss_e_ip_len=Slider(300, range=30..3000),
    ss_e_ip_shift=Slider(0.5, range=0..1),
    ss_e_ip_type=Slider(9, range=1..9),
    ss_e_op_len=Slider(450, range=30..3000),
    ss_e_op_shift=Slider(0.5, range=0..1),
    ss_e_op_type=Slider(19, range=10..19),
    ts_e_p_len=Slider(450, range=30..3000),
    ts_e_p_shift=Slider(0.5, range=0..1),
    ts_e_p_type=Slider(29, range=20..29),
    cr_c_ip_len=Slider(300, range=30..3000),
    cr_c_ip_shift=Slider(0.5, range=0..1),
    cr_c_ip_type=Slider(30, range=30..39),
    tt_e_p_len=Slider(300, range=30..3000),
    tt_e_p_shift=Slider(0.5, range=0..1),
    tt_e_p_type=Slider(40, range=40..49),
    ss_e_r_len=Slider(300, range=30..3000),
    ss_e_r_shift=Slider(0.5, range=0..1),
    ss_e_r_type=Slider(50, range=50..59))

# ----
bbox = BoundingBox(Content=entwine, Plane=PlaneXY(0, 0, 0), UnionBox=True)  # -> Box, Box_2
bbox_2 = BoundingBox(Content=entwine_2, Plane=PlaneXY(0, 0, 0), UnionBox=True)  # -> Box, Box_2
dispatch = Dispatch(List=top, DispatchPattern=c_script.flags)  # -> ListA, ListB
panel_8 = Panel("""CPP Vector -0.087185763149553175 2.2126940028706401 5.5356298398806931
CPP Vector 0.70776317647095022 1.9302525496178604 4.9292831975813547
CPP Vector -0.69153811801048448 -2.3271622848737068 5.0778737158426308
CPP Vector -1.4864870576309879 -2.0447208316209271 5.6842203581419692
CPP Vector -0.087185763149553175 2.2126940028706401 5.5356298398806931
CPP int 0
CPP int 0
CPP Vector -0.087185763149553175 2.2126940028706401 5.5356298398806931 
CPP Vector 0.70776317647095022 1.9302525496178604 4.9292831975813547
CPP Vector -0.69153811801048448 -2.3271622848737068 5.0778737158426308
CPP Vector -1.4864870576309879 -2.0447208316209271 5.6842203581419692
CPP Vector -0.087185763149553175 2.2126940028706401 5.5356298398806931 
CPP int 0""")
merge_4 = Merge(Data1=crv_5, Data2=ln_3, Data3=merge_3, Data4=merge_3)

# ---- group: Butterfly Key Plates
crv_14 = Curve([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])
end_4 = EndPoints(Curve=crv_14)  # -> Start, End
end_5 = EndPoints(Curve=crv_14)  # -> Start, End
ln_4 = Line(StartPoint=end_5.Start, EndPoint=end_5.End)
ln_5 = Line(StartPoint=end_4.Start, EndPoint=end_4.End)
merge_5 = Merge(Data1=crv_14, Data2=ln_4)
merge_6 = Merge(Data1=crv_14, Data2=ln_5)
rotate_2 = Rotate(Geometry=merge_5, Angle=degrees(Slider(90, range=0..100)), Plane=PlaneXY(0, 0, 0))  # -> Geometry, Transform
xz_2 = XZPlane(Origin=Point(0, 0, 0))
crv_15 = Curve(merge_6)
mirror_2 = Mirror(Geometry=rotate_2.Geometry, Plane=xz_2)  # -> Geometry, Transform
cp_3 = ControlPoints(Curve=crv_15)  # -> Points, Weights, Knots
cp_4 = ControlPoints(Curve=merge_4)  # -> Points, Weights, Knots
pline_3 = PolyLine(Vertices=cp_3.Points, Closed=False)  # -> flatten(Polyline)
pline_4 = PolyLine(Vertices=cp_4.Points, Closed=False)  # -> flatten(Polyline)
panel_9 = Panel("""3
3
2
2""")
panel_10 = Panel("""3
3""")
c_script_3 = CSharpScript(type="1", plines0=pline_4, plines1=pline_3, bool0=panel_9, bool1=panel_10, unit_scale=Toggle(False))  # -> out, joint; inputs type: Int32, plines0: list, plines1: list, bool0: list of Int32, bool1: list of Int32, unit_scale: Int32; same code as c_script_2

# ----
item_3 = ListItem(List=crv_14, Index=0, Wrap=True)
area = Area(Geometry=bbox.Box)  # -> Area, Centroid
input_set = Input_set(Plines=crv_12, Adjacency=c_script.flags)
input_set_2 = Input_set(Plines=entwine)
area_2 = Area(Geometry=bbox_2.Box)  # -> Area, Centroid
input_set_3 = Input_set(Plines=entwine_2)
boundary = BoundarySurfaces(Edges=dispatch.ListA)

# ---- group: Butterfly Key Plates
crv_16 = Curve([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])
crv_17 = Curve([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])
end_6 = EndPoints(Curve=crv_16)  # -> Start, End
end_7 = EndPoints(Curve=crv_17)  # -> Start, End
ln_6 = Line(StartPoint=end_6.Start, EndPoint=end_6.End)
ln_7 = Line(StartPoint=end_7.Start, EndPoint=end_7.End)
crv_18 = Curve([crv_16, ln_6])
crv_19 = Curve([crv_17, ln_7])
cp_5 = ControlPoints(Curve=crv_18)  # -> Points, Weights, Knots
cp_6 = ControlPoints(Curve=crv_19)  # -> Points, Weights, Knots
pline_5 = PolyLine(Vertices=cp_5.Points, Closed=False)  # -> flatten(Polyline)
pline_6 = PolyLine(Vertices=cp_6.Points, Closed=False)  # -> flatten(Polyline)
panel_11 = Panel("""1
1""")
panel_12 = Panel("""1
1""")
c_script_4 = CSharpScript(type="0", plines0=pline_5, plines1=pline_6, bool0=panel_12, bool1=panel_11, unit_scale=Toggle(True))  # -> out, joint; inputs type: Int32, plines0: list, plines1: list, bool0: list of Int32, bool1: list of Int32, unit_scale: Int32; same code as c_script_2

# ----
panel_13 = Panel("""0
0""")
panel_14 = Panel("""0
0""")
crv_20 = Curve([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])
panel_15 = Panel("""2
1""")
entwine_3 = Entwine(Branch00=crv_20, Branch01=crv_20, FlattenInputs=True)
entwine_4 = Entwine(Branch00=panel_13, Branch01=panel_13, FlattenInputs=True)
entwine_5 = Entwine(Branch00=panel_14, Branch01=panel_14, FlattenInputs=True)
c_script_5 = CSharpScript(type=panel_15, plines0=entwine_3, plines1=entwine_3, bool0=entwine_4, bool1=entwine_5)  # -> out, A; inputs type: list of Int32, plines0: tree of Polyline, plines1: tree of Polyline, bool0: tree of Int32, bool1: tree of Int32
# ---------- c_script_5: C# ----------
    XmlWriter xmlWriter = XmlWriter.Create("C:\\Users\\petra\\Desktop\\New folder\\joint_library.xml");
    xmlWriter.WriteStartDocument();


    /////////////////////////////////////////////////////////////////////////////////////////////////////////////////////////////////////////////
    //Start document
    /////////////////////////////////////////////////////////////////////////////////////////////////////////////////////////////////////////////
    xmlWriter.WriteStartElement("custom_joints");
    for(int i = 0; i < type.Count;i++){
      write_joint(ref xmlWriter, type[i], plines0.Branch(i), plines1.Branch(i), bool0.Branch(i), bool1.Branch(i));
      Print("hi");
    }

    /////////////////////////////////////////////////////////////////////////////////////////////////////////////////////////////////////////////
    //End document
    /////////////////////////////////////////////////////////////////////////////////////////////////////////////////////////////////////////////
    xmlWriter.WriteEndDocument();
    xmlWriter.Close();
# ---------- c_script_5: C# additional code ----------
  public void write_joint(ref XmlWriter xmlWriter, int type, List<Polyline> plines0, List<Polyline> plines1, List<int> bool0, List<int> bool1){

    string joint_name = "";
    switch (type) {
      case(0):
      case(12):
        joint_name = "ss_e_ip_9";
        break;
      case(1):
      case(11):
        joint_name = "ss_e_op_9";
        break;
      case(2):
      case(20):
        joint_name = "ts_e_p_9";
        break;
      case(3):
      case(30):
        joint_name = "cr_c_ip_9";
        break;
      case(4):
      case(40):
        joint_name = "tt_e_p_9";
        break;
      case(5):
      case(50):
        joint_name = "ss_e_r_9";
        break;
    }

    /////////////////////////////////////////////////////////////////////////////////////////////////////////////////////////////////////////////
    //Start document
    /////////////////////////////////////////////////////////////////////////////////////////////////////////////////////////////////////////////
    xmlWriter.WriteStartElement(joint_name);

    for(int i = 0; i < plines0.Count; i++){
      string name = i % 2 == 0 ? "f0" : "f1";
      xml_polyline(ref xmlWriter, plines0[i], name);
    }

    for(int i = 0; i < plines1.Count; i++){
      string name = i % 2 == 0 ? "m0" : "m1";
      xml_polyline(ref xmlWriter, plines0[i], name);
    }

    xml_int_list(ref xmlWriter, bool0, "f_boolean_type");
    xml_int_list(ref xmlWriter, bool1, "m_boolean_type");

    xmlWriter.WriteEndElement();
    /////////////////////////////////////////////////////////////////////////////////////////////////////////////////////////////////////////////
    //End document
    /////////////////////////////////////////////////////////////////////////////////////////////////////////////////////////////////////////////


  }

  public void xml_int_list(ref XmlWriter xmlWriter, List<int> numbers, string name){
    xmlWriter.WriteStartElement(name);
    foreach(int n in numbers){

      xmlWriter.WriteStartElement("char");
      xmlWriter.WriteString(n.ToString());
      xmlWriter.WriteEndElement();

    }
    xmlWriter.WriteEndElement();
  }

  public void xml_polyline(ref XmlWriter xmlWriter, Polyline pline, string name){
    xmlWriter.WriteStartElement(name);
    foreach(Point3d p in pline){

      xmlWriter.WriteStartElement("point");

      xmlWriter.WriteStartElement("x");
      xmlWriter.WriteString(p.X.ToString());
      xmlWriter.WriteEndElement();

      xmlWriter.WriteStartElement("y");
      xmlWriter.WriteString(p.Y.ToString());
      xmlWriter.WriteEndElement();

      xmlWriter.WriteStartElement("z");
      xmlWriter.WriteString(p.Z.ToString());
      xmlWriter.WriteEndElement();

      xmlWriter.WriteEndElement();
    }
    xmlWriter.WriteEndElement();
  }
# ---------- end c_script_5 ----------

move = Move(Geometry=entwine, Motion=expr("-x", area.Centroid))  # -> Geometry, Transform

crv_21 = Curve([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])
crv_22 = Curve([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])
crv_23 = Curve([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])
crv_24 = Curve([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])
crv_25 = Curve([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])
crv_26 = Curve([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])
crv_27 = Curve([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])
crv_28 = Curve([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])
merge_7 = Merge(Data1=crv_25, Data2=crv_24, Data3=crv_27, Data4=crv_26)
merge_8 = Merge(Data1=crv_21, Data2=crv_23, Data3=crv_22, Data4=crv_28)
Z = UnitZ(Factor=-1)
move_2 = Move(Geometry=merge_8, Motion=Z)  # -> Geometry, Transform
move_3 = Move(Geometry=merge_7, Motion=Z)  # -> Geometry, Transform
xz_3 = XZPlane(Origin=Point(0, 0, 0))
rotate_3 = Rotate(Geometry=move_2.Geometry, Angle=degrees(180), Plane=xz_3)  # -> Geometry, Transform
rotate_4 = Rotate(Geometry=move_3.Geometry, Angle=degrees(180), Plane=xz_3)  # -> Geometry, Transform
yz = YZPlane(Origin=Point(0, 0, 0))
panel_16 = Panel("""6
6
6
6""")
rotate_5 = Rotate(Geometry=rotate_4.Geometry, Angle=degrees(90), Plane=yz)  # -> Geometry, Transform
rotate_6 = Rotate(Geometry=rotate_3.Geometry, Angle=degrees(90), Plane=yz)  # -> Geometry, Transform
c_script_6 = CSharpScript(type="2", plines0=rotate_5.Geometry, plines1=rotate_6.Geometry, bool0=panel_16, bool1=panel_16, unit_scale=Toggle(True))  # -> out, joint; inputs type: Int32, plines0: list, plines1: list, bool0: list of Int32, bool1: list of Int32, unit_scale: Int32; same code as c_script_2

move_4 = Move(Geometry=entwine_2, Motion=expr("-x", area_2.Centroid))  # -> Geometry, Transform
boundary_2 = BoundarySurfaces(Edges=dispatch.ListB)
preview = CustomPreview(
    Geometry=boundary_2,
    Material={diffuse=RGB(221, 160, 221), emission=RGB(66, 48, 66), shine=0.5, specular=RGB(255, 255, 255), transparency=0})
solver = Solver(Data=input_set, Join=joints_params, Find=0, Get=Slider(4, range=0..4))
cluster = Cluster(data=input_set)
plinestocompas = PlinesToCompas(plines=flatten(move.Geometry))  # -> out, A; inputs plines: list of Polyline
# ---------- plinestocompas: C# ----------
    string output = "[";

    for(int i = 0; i < plines.Count;i++){
      string pline_string = "Polyline([";

      for(int j = 0; j < plines[i].Count; j++){
        pline_string += "Point(";
        double x = Math.Abs(plines[i][j].X) < 0.001 ? 0 : plines[i][j].X;
        double y = Math.Abs(plines[i][j].Y) < 0.001? 0 : plines[i][j].Y;
        double z = Math.Abs(plines[i][j].Z) < 0.001? 0 : plines[i][j].Z;
        pline_string += x.ToString();
        pline_string += ",";
        pline_string += y.ToString();
        pline_string += ",";
        pline_string += z.ToString();
        pline_string += ")";
        if(j != plines[i].Count - 1)
          pline_string += ",";
      }

      pline_string += "])";
      if(i != plines.Count - 1)
        pline_string += ",";

      // pline_string += "])";
      output += pline_string;

    }

    output += "]";

    A = output;
# ---------- end plinestocompas ----------
cluster_2 = Cluster(data=input_set_2)
panel_17 = Panel("""CPP Vector 7.6665944653762823 -9.3361544498517368 -2.3958820402971299
CPP Vector -13.6801683469258 -20.852333034366101 -7.9591764818525998
CPP Vector 17.696932891652096 22.688660711236995 -9.4192006171699898 
CPP Vector 16.081424463649448 17.530673353359255 -8.288009437841211
CPP Vector 18.070130943767261 17.137864107265802 -7.2389675289832951
CPP Vector 16.002199456896513 10.535382633724941 -5.7909863133751802 
CPP Vector 14.0134929767787 10.928191879818394 -6.8400282222330961
CPP Vector 11.945561489907952 4.3257104062775316 -5.392047006624983
CPP Vector 13.934267970025765 3.9329011601840791 -4.3430050977670671 
CPP Vector 11.866336483155017 -2.6695803133567821 -2.8950238821589527
CPP Vector 9.8776300030372042 -2.2767710672633292 -3.9440657910168686
CPP Vector 7.6665944653762823 -9.3361544498517368 -2.3958820402971299 
CPP int 0
CPP Vector 8.1951091885973106 -7.9999999999999956 -0.32440285602840468
CPP Vector -14.4682514574348 -20.2264584480486 -6.2308229262591999
CPP Vector 18.844085764354187 25.999999999999982 -7.7808965285920078 
CPP Vector 16.323731499601124 17.953025307926008 -6.0161254734529166
CPP Vector 16.323681781939122 17.953035128157161 -6.0161516995006377
CPP Vector 14.255800012730376 11.350543834385148 -4.5681442578448017 
CPP Vector 12.267093532612563 11.743353080478601 -5.6171861667027176
CPP Vector 10.199162045741815 5.140871606937738 -4.1692049510946045
CPP Vector 12.187868525859628 4.7480623608442851 -3.1201630422366882
CPP Vector 10.119887321326878 -1.854409292465423 -1.6722080526762957
CPP Vector 10.11993703898888 -1.8544191126965757 -1.6721818266285742
CPP Vector 8.1951091885973106 -7.9999999999999956 -0.32440285602840468 
CPP int 0""")
plinestocompas_2 = PlinesToCompas(plines=flatten(move_4.Geometry))  # -> out, A; inputs plines: list of Polyline; same code as plinestocompas
cluster_3 = Cluster(data=input_set_3)
input_get = Input_get(Data=solver)  # -> Plines, Insertion_vectors, Joints_per_face, Three_valence, Adjacency
panel_18 = Panel(plinestocompas.A)
panel_19 = Panel(plinestocompas_2.A)
cp_7 = ControlPoints(Curve=cluster_2)  # -> Points, Weights, Knots
branch = TreeBranch(Tree=simplify(input_get.Plines), Path=Slider(10, range=0..10), MaintainPaths=True)
item_4 = ListItem(List=branch, Index=0, Wrap=True)  # -> Item, Item1, Item2, Item3, Item4, Item5
cp_8 = ControlPoints(Curve=cluster_3)  # -> Points, Weights, Knots
item_5 = ListItem(List=cp_7.Points, Index=0, Wrap=True)  # -> Item, Item1
item_6 = ListItem(List=cp_8.Points, Index=0, Wrap=True)  # -> Item, Item1
crv_29 = Curve(reverse(input_get.Plines))
item_7 = ListItem(List=flatten(input_get.Plines), Index=Slider(8, range=0..10), Wrap=True)  # -> Item, Item1
partition_2 = PartitionList(List=branch, Size=2)  # -> simplify(Chunks)
item_8 = ListItem(List=flatten(input_get.Plines), Index=Slider(2, range=0..10), Wrap=True)  # -> Item, Item1
split = SplitList(List=crv_29, Index=2)  # -> ListA, ListB
texttopoints = TextToPoints(x=panel_8)  # -> out, A; inputs x: list of String
# ---------- texttopoints: C# usings ----------
using System.Linq;
# ---------- texttopoints: C# ----------
    var r = new DataTree<Point3d>();
    var l = new List<string>();
    int count = 0;
    for(int i = 0; i < x.Count; i++){
      if(!x[i].Contains("CPP Vector")){
        
        if(l.Count > 0){
          
          
          foreach(var line_string in l){
            string[] words = line_string.Split();
          
      
            var coord = new List<double>();
            foreach(var word in words){
              double result;
              if(double.TryParse(word, out result)){
                coord.Add(result);
              }
            }

            Point3d point = new Point3d(coord[0], coord[1], coord[2]);
            r.Add(point,new GH_Path(count)); 
          }
          
          
          l.Clear();
            count++;
        }
        
      }else{
        l.Add(x[i]);
      }
    }
    
    A = r;
# ---------- end texttopoints ----------
dots = DotDisplay(Point=item_5.Item1, Colour=ColourSwatch(SwatchColor=RGB(255, 0, 0)), Size=0.25)
dots_2 = DotDisplay(Point=[item_5.Item, item_5.Item1], Colour=RGB(0, 0, 0), Size=0.25)
dots_3 = DotDisplay(Point=item_6.Item1, Colour=ColourSwatch(SwatchColor=RGB(255, 0, 0)), Size=0.25)
dots_4 = DotDisplay(Point=[item_6.Item, item_6.Item1], Colour=RGB(0, 0, 0), Size=0.25)
display_2 = CurvePreview(Curve=[item_8.Item, item_8.Item1], Width=10)
display_3 = CurvePreview(Curve=[item_7.Item, item_7.Item1], Width=10)
flip = FlipMatrix(Data=texttopoints.A)
pline_7 = PolyLine(Vertices=texttopoints.A, Closed=False)  # -> flatten(Polyline)
texttopoints_2 = TextToPoints(x=panel_17)  # -> out, A; inputs x: list of String; same code as texttopoints
loft = LoftPolylines(Curve0=pline_7, Fast=True)
pline_8 = PolyLine(Vertices=flip, Closed=False)
loft_2 = Loft(Curves=pline_7, Options={Adjust=False, Closed=False, LoftEnds=0, LoftSimp=0, LoftType=0, Rebuild=10, Refit=0.01})
flip_2 = FlipMatrix(Data=texttopoints_2.A)
pline_9 = PolyLine(Vertices=texttopoints_2.A, Closed=False)  # -> flatten(Polyline)
panel_20 = Panel(c_script.out)  # disabled
loft_3 = LoftPolylines(Curve0=pline_9, Fast=True)
curveloft = CurveLoft(Curves=split.ListA, DivisionsU=1, DivisionsV=0, Cap=True)  # -> Mesh, D
pline_10 = PolyLine(Vertices=flip_2, Closed=False)
loft_4 = Loft(Curves=pline_9, Options={Adjust=False, Closed=False, LoftEnds=0, LoftSimp=0, LoftType=0, Rebuild=10, Refit=0.01})
dispatch_2 = Dispatch(List=flatten(curveloft.Mesh), DispatchPattern=c_script.adj)  # -> ListA, ListB
cap = CapHoles(Brep=loft_2)
cap_2 = CapHoles(Brep=loft_4)
preview_2 = CustomPreview(Geometry=dispatch_2.ListB, Material=ColourSwatch(SwatchColor=RGB(191, 0, 96)))
preview_3 = CustomPreview(Geometry=dispatch_2.ListA, Material=ColourSwatch(SwatchColor=RGB(196, 196, 196)))

# ---- group: write_xml
merge_9 = Merge(Data1=c_script_4.joint, Data2=c_script_3.joint, Data3=c_script_6.joint)
path = FilePath("C:\Users\petra\AppData\Roaming\Grasshopper\Libraries\compas_wood\joinery_library.xml")
c_script_7 = CSharpScript(path=path, tiles=merge_9)  # -> out, A; inputs path: String, tiles: list
# ---------- c_script_7: C# ----------
    try{
      //Print(joint.GetType().ToString());
      //Tuple<int,List<Polyline>,List<Polyline>,List<int>,List<int>> joint_params = (Tuple<int,List<Polyline>,List<Polyline>,List<int>,List<int>> )joint;

      XmlWriter xmlWriter = XmlWriter.Create(path);
      xmlWriter.WriteStartDocument();

      /////////////////////////////////////////////////////////////////////////////////////////////////////////////////////////////////////////////
      //Start document
      /////////////////////////////////////////////////////////////////////////////////////////////////////////////////////////////////////////////
      xmlWriter.WriteStartElement("custom_joints");
      for(int i = 0; i < tiles.Count;i++){
        var list = ((List < object >) tiles[i]);

        var type = (int) (Object) list[0];
        Print(type.ToString());
        var plines0 = new List<Polyline>();
        var plines1 = new List<Polyline>();
        var bool0 = (List<int>) list[3];
        var bool1 = (List<int>) list[4];
        var unit_scale = (int) (Object) list[5];

        foreach(var o in (List<Object>) list[1]){
          PolylineCurve pcurve = (PolylineCurve) o;
          Polyline pline;
          pcurve.TryGetPolyline(out pline);
          plines0.Add(pline);
        }


        foreach(var o in (List<Object>) list[2]){
          PolylineCurve pcurve = (PolylineCurve) o;
          Polyline pline;
          pcurve.TryGetPolyline(out pline);
          plines1.Add(pline);
        }



        if(plines0.Count == bool0.Count * 2 && plines1.Count == bool1.Count * 2)
          write_joint(ref xmlWriter, type, plines0, plines1, bool0, bool1, unit_scale);
        else{
          this.Component.AddRuntimeMessage(GH_RuntimeMessageLevel.Error,
            String.Format("Number of polylines must be equal to (number of booleans)*2 \n plines0 - {0}, bool0 - {1}, plines1 - {2}, bool1 - {3}", plines0.Count, bool0.Count, plines1.Count, bool1.Count));
        }

      }

      /////////////////////////////////////////////////////////////////////////////////////////////////////////////////////////////////////////////
      //End document
      /////////////////////////////////////////////////////////////////////////////////////////////////////////////////////////////////////////////
      xmlWriter.WriteEndDocument();
      xmlWriter.Close();
    }catch(Exception e){
      Rhino.RhinoApp.WriteLine(e.ToString());
    }
# ---------- c_script_7: C# additional code ----------
  public void write_joint(ref XmlWriter xmlWriter, int type, List<Polyline> plines0, List<Polyline> plines1, List<int> bool0, List<int> bool1, int unit_scale){

    string joint_name = "";
    switch (type) {
      case(0):
      case(12):
        joint_name = "ss_e_ip_9";
        break;
      case(1):
      case(11):
        joint_name = "ss_e_op_9";
        break;
      case(2):
      case(20):
        joint_name = "ts_e_p_9";
        break;
      case(3):
      case(30):
        joint_name = "cr_c_ip_9";
        break;
      case(4):
      case(40):
        joint_name = "tt_e_p_9";
        break;
      case(5):
      case(50):
        joint_name = "ss_e_r_9";
        break;
    }

    /////////////////////////////////////////////////////////////////////////////////////////////////////////////////////////////////////////////
    //Start document
    /////////////////////////////////////////////////////////////////////////////////////////////////////////////////////////////////////////////
    xmlWriter.WriteStartElement(joint_name);

    for(int i = 0; i < plines0.Count; i++){
      string name = i % 2 == 0 ? "f0" : "f1";
      xml_polyline(ref xmlWriter, plines0[i], name);
    }

    for(int i = 0; i < plines1.Count; i++){
      string name = i % 2 == 0 ? "m0" : "m1";
      xml_polyline(ref xmlWriter, plines1[i], name);
    }

    xml_int_list(ref xmlWriter, bool0, "f_boolean_type");
    xml_int_list(ref xmlWriter, bool1, "m_boolean_type");
    xml_int_list(ref xmlWriter, new List<int>{unit_scale}, "properties");

    xmlWriter.WriteEndElement();
    /////////////////////////////////////////////////////////////////////////////////////////////////////////////////////////////////////////////
    //End document
    /////////////////////////////////////////////////////////////////////////////////////////////////////////////////////////////////////////////


  }

  public void xml_int_list(ref XmlWriter xmlWriter, List<int> numbers, string name){
    xmlWriter.WriteStartElement(name);
    foreach(int n in numbers){

      xmlWriter.WriteStartElement("id");
      xmlWriter.WriteString(n.ToString());
      xmlWriter.WriteEndElement();

    }
    xmlWriter.WriteEndElement();
  }

  public void xml_polyline(ref XmlWriter xmlWriter, Polyline pline, string name){
    xmlWriter.WriteStartElement(name);
    foreach(Point3d p in pline){

      xmlWriter.WriteStartElement("point");

      xmlWriter.WriteStartElement("x");
      xmlWriter.WriteString(Math.Round(p.X,10).ToString());
      xmlWriter.WriteEndElement();

      xmlWriter.WriteStartElement("y");
      xmlWriter.WriteString(Math.Round(p.Y,10).ToString());
      xmlWriter.WriteEndElement();

      xmlWriter.WriteStartElement("z");
      xmlWriter.WriteString(Math.Round(p.Z,10).ToString());
      xmlWriter.WriteEndElement();

      xmlWriter.WriteEndElement();
    }
    xmlWriter.WriteEndElement();
  }
# ---------- end c_script_7 ----------

# ----
path_2 = FilePath("C:\IBOIS57\_Code\Software\Python\compas_wood\src\compas_wood\joinery_library.xml")
panel_21 = Panel(path_2)
xml_tree = Xml_tree()
panel_22 = Panel(c_script_7.out)
panel_23 = Panel(merge_9)

# ==== cluster Cluster
data = ClusterInput()
solver = Solver(Data=data, Find=0, Get=2)
input_get = Input_get(Data=solver)  # -> Plines, Insertion_vectors, Joints_per_face, Three_valence, Adjacency
item = ListItem(List=input_get.Plines, Index=2, Wrap=True)  # -> Item, Item1
i = ClusterOutput([item.Item, item.Item1])
display = CurvePreview(Curve=[item.Item, item.Item1], Width=Slider(9, range=0..10))

# ==== cluster Xml_tree: xml_tree

panel = Panel("""0
0""")
panel_2 = Panel("""0
0""")
crv = Curve([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])
panel_3 = Panel("""2
1""")
entwine = Entwine(Branch00=crv, Branch01=crv, FlattenInputs=True)
entwine_2 = Entwine(Branch00=panel, Branch01=panel, FlattenInputs=True)
entwine_3 = Entwine(Branch00=panel_2, Branch01=panel_2, FlattenInputs=True)
c_script = CSharpScript(type=panel_3, plines0=entwine, plines1=entwine, bool0=entwine_2, bool1=entwine_3)  # -> out, A; inputs type: list of Int32, plines0: tree of Polyline, plines1: tree of Polyline, bool0: tree of Int32, bool1: tree of Int32
# ---------- c_script: C# usings ----------
using System.Xml;
# ---------- c_script: C# ----------
    XmlWriter xmlWriter = XmlWriter.Create("C:\\Users\\petra\\Desktop\\New folder\\joint_library.xml");
    xmlWriter.WriteStartDocument();


    /////////////////////////////////////////////////////////////////////////////////////////////////////////////////////////////////////////////
    //Start document
    /////////////////////////////////////////////////////////////////////////////////////////////////////////////////////////////////////////////
    xmlWriter.WriteStartElement("custom_joints");
    for(int i = 0; i < type.Count;i++){
      write_joint(ref xmlWriter, type[i], plines0.Branch(i), plines1.Branch(i), bool0.Branch(i), bool1.Branch(i));
      Print("hi");
    }

    /////////////////////////////////////////////////////////////////////////////////////////////////////////////////////////////////////////////
    //End document
    /////////////////////////////////////////////////////////////////////////////////////////////////////////////////////////////////////////////
    xmlWriter.WriteEndDocument();
    xmlWriter.Close();
# ---------- c_script: C# additional code ----------
  public void write_joint(ref XmlWriter xmlWriter, int type, List<Polyline> plines0, List<Polyline> plines1, List<int> bool0, List<int> bool1){

    string joint_name = "";
    switch (type) {
      case(0):
      case(12):
        joint_name = "ss_e_ip_9";
        break;
      case(1):
      case(11):
        joint_name = "ss_e_op_9";
        break;
      case(2):
      case(20):
        joint_name = "ts_e_p_9";
        break;
      case(3):
      case(30):
        joint_name = "cr_c_ip_9";
        break;
      case(4):
      case(40):
        joint_name = "tt_e_p_9";
        break;
      case(5):
      case(50):
        joint_name = "ss_e_r_9";
        break;
    }

    /////////////////////////////////////////////////////////////////////////////////////////////////////////////////////////////////////////////
    //Start document
    /////////////////////////////////////////////////////////////////////////////////////////////////////////////////////////////////////////////
    xmlWriter.WriteStartElement(joint_name);

    for(int i = 0; i < plines0.Count; i++){
      string name = i % 2 == 0 ? "f0" : "f1";
      xml_polyline(ref xmlWriter, plines0[i], name);
    }

    for(int i = 0; i < plines1.Count; i++){
      string name = i % 2 == 0 ? "m0" : "m1";
      xml_polyline(ref xmlWriter, plines0[i], name);
    }

    xml_int_list(ref xmlWriter, bool0, "f_boolean_type");
    xml_int_list(ref xmlWriter, bool1, "m_boolean_type");

xmlWriter.WriteEndElement();
    /////////////////////////////////////////////////////////////////////////////////////////////////////////////////////////////////////////////
    //End document
    /////////////////////////////////////////////////////////////////////////////////////////////////////////////////////////////////////////////


  }

  public void xml_int_list(ref XmlWriter xmlWriter, List<int> numbers, string name){
    xmlWriter.WriteStartElement(name);
    foreach(int n in numbers){

      xmlWriter.WriteStartElement("char");
      xmlWriter.WriteString(n.ToString());
      xmlWriter.WriteEndElement();

    }
    xmlWriter.WriteEndElement();
  }

  public void xml_polyline(ref XmlWriter xmlWriter, Polyline pline, string name){
    xmlWriter.WriteStartElement(name);
    foreach(Point3d p in pline){

      xmlWriter.WriteStartElement("point");

      xmlWriter.WriteStartElement("x");
      xmlWriter.WriteString(p.X.ToString());
      xmlWriter.WriteEndElement();

      xmlWriter.WriteStartElement("y");
      xmlWriter.WriteString(p.Y.ToString());
      xmlWriter.WriteEndElement();

      xmlWriter.WriteStartElement("z");
      xmlWriter.WriteString(p.Z.ToString());
      xmlWriter.WriteEndElement();

      xmlWriter.WriteEndElement();
    }
    xmlWriter.WriteEndElement();
  }
# ---------- end c_script ----------

out = ClusterOutput(c_script.out)
