# Grasshopper definition chevron_insertion_vectors_end.gh (Grasshopper 1.0.7)
# plug-ins: compas_wood

crv = Curve([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])
crv_2 = Curve([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])

crv_3 = Curve([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])
crv_4 = Curve([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])

cp_lines = Closest_lines(Polylines=crv, Lines=crv_2)  # -> Polylines, Vectors
input_set = Input_set(Plines=cp_lines.Polylines, Insertion_vectors=cp_lines.Vectors)
solver = Solver(Data=input_set)
input_get = Input_get(Data=solver)  # -> Plines, Insertion_vectors, Joints_per_face, Three_valence, Adjacency
loft = Loft(Polylines1=input_get.Plines)
