# Grasshopper definition plate_joints_selection.gh (Grasshopper 1.0.7)
# plug-ins: compas_wood

crv = Curve([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])
pt = Point([Point(17.44636208, 31.03153187, 3.120164839), Point(-24.3746282, -25.63124244, 6.233312241), Point(-47.53555647, -11.85067581, 6.233312241)])
panel = Panel("""0
1
2""")
crv_2 = Curve(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)
cp_lines = Closest_indexed_points(Polylines=crv, Points=pt, Ints=panel)  # -> Polylines, Ints
cp_lines_2 = Closest_lines(Polylines=crv, Lines=crv_2)  # -> Polylines, Vectors
panel_2 = Panel(cp_lines.Ints)
panel_3 = Panel(cp_lines_2.Vectors)
