# Grasshopper definition chevron_insertion_vectors.gh (Grasshopper 1.0.7)
# plug-ins: compas_wood

# Insertion Direction
# a) per edge
# b) per element
crv = Curve([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])
c_script = CSharpScript()  # -> Out, A
partition = PartitionList(List=crv, Size=2)
input_set = Input_set(Plines=partition)
solver = Solver(Data=input_set)
input_get = Input_get(Data=solver)  # -> Plines, Insertion_vectors, Joints_per_face, Three_valence, Adjacency
loft = Loft(Polylines1=input_get.Plines)
