# Grasshopper definition joints_to_xml.gh (Grasshopper 1.0.7)
# plug-ins: NGon, compas_wood, ghgl

crv = Curve([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])  # disabled
crv_2 = Curve(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)  # disabled
crv_3 = Curve(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)  # disabled
crv_4 = Curve([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])  # disabled
end = EndPoints(Curve=crv_4)  # -> Start, End; disabled
merge = Merge(Data1=crv_3, Data2=crv_2)  # disabled
ln = Line(StartPoint=end.Start, EndPoint=end.End)  # disabled
merge_2 = Merge(Data1=crv_4, Data2=ln, Data3=merge, Data4=merge)  # disabled

# ---- group: Butterfly Key Plates
crv_5 = Curve(crv)  # disabled
end_2 = EndPoints(Curve=crv_5)  # -> Start, End; disabled
end_3 = EndPoints(Curve=crv_5)  # -> Start, End; disabled
ln_2 = Line(StartPoint=end_2.Start, EndPoint=end_2.End)  # disabled
number_slider = Slider(-90, range=-90..90)  # disabled
ln_3 = Line(StartPoint=end_3.Start, EndPoint=end_3.End)  # disabled
merge_3 = Merge(Data1=crv_5, Data2=ln_2)  # disabled
merge_4 = Merge(Data1=crv_5, Data2=ln_3)  # disabled
rotate = Rotate(Geometry=merge_3, Angle=expr("-X", degrees(number_slider)), Plane=PlaneXY(0, 0, 0))  # -> Geometry, Transform; disabled
cp = ControlPoints(Curve=merge_2)  # -> Points, Weights, Knots; disabled
crv_6 = Curve(merge_4)  # disabled
pline = PolyLine(Vertices=cp.Points, Closed=False)  # -> flatten(Polyline); disabled
mirror = Mirror(Geometry=rotate.Geometry, Plane=PlaneYZ(0, 0, 0))  # -> Geometry, Transform; disabled
cp_2 = ControlPoints(Curve=crv_6)  # -> Points, Weights, Knots; disabled
pline_2 = PolyLine(Vertices=cp_2.Points, Closed=False)  # -> flatten(Polyline); disabled
toggle = BooleanToggle(False)  # disabled
panel = Panel("""0
0""")  # disabled
panel_2 = Panel("""0
0""")  # disabled
panel_3 = Panel("1")  # disabled
c_script = CSharpScript(type=panel_3, plines0=pline_2, bool0=panel, unit_scale=toggle)  # -> out, joint; inputs type: Int32, plines0: list, plines1: list, bool0: list of Int32, bool1: list of Int32, unit_scale: Int32; disabled
# ---------- c_script: C# ----------
    joint = new Grasshopper.Kernel.Types.GH_ObjectWrapper (new List < object > {type, plines0, plines1, bool0, bool1,unit_scale});
    this.Component.Message = " Plines order \n Top,Bottom,Top,Bottom ";
# ---------- end c_script ----------

# ----
item = ListItem(List=crv_5, Index=0, Wrap=True)  # disabled
crv_7 = Curve(flatten([<curve referenced from the Rhino model> x2]))  # disabled

crv_8 = Curve([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])  # disabled
number_slider_2 = Slider(0, range=0..100)  # disabled
number_slider_3 = Slider(5, range=0..10)  # disabled
number_slider_4 = Slider(2, range=0..10)  # disabled
number_slider_5 = Slider(1, range=0..10)  # disabled
number_slider_6 = Slider(0.01, range=0.01..1)  # disabled
brep = Brep(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)  # disabled
c_script_2 = CSharpScript(
    surface=brep,
    u_divisions=number_slider_3,
    v_divisions=number_slider_4,
    thickness=number_slider_5,
    chamfer=number_slider_6,
    face_positions=number_slider_2,
    Reference="C:\Users\petra\AppData\Roaming\Grasshopper\Libraries\compas_wood\rhino_util.dll")  # -> out, m, f, flags, adj, P, E_P, L; inputs surface: Surface, u_divisions: Int32, v_divisions: Int32, base_planes: list of Plane, thickness: Double, chamfer: Double, face_positions: list of Double; disabled
# ---------- c_script_2: C# usings ----------
using System.Linq;
using rhino_util;
# ---------- c_script_2: C# ----------
    case_3_mtsj mtsj = new case_3_mtsj(surface, u_divisions, v_divisions, base_planes, thickness, chamfer,  face_positions);

    m = mtsj.m;
    f = rhino_util.GrasshopperUtil.IE2(mtsj.f_polylines);
    flags = rhino_util.GrasshopperUtil.IE2(mtsj.adjacency);
    adj = mtsj.flags;
    P = rhino_util.GrasshopperUtil.IE2(mtsj.fe_planes);
    E_P = mtsj.e_planes;
    L = mtsj.insertion_lines;
# ---------- c_script_2: C# additional code ----------
  public class case_3_mtsj{

    //Diamond Subdivision
    public Mesh m = null;
    public List<bool> flags = new List<bool>();
    public bool[][] edge_joints = new bool[0][];
    public List<int[]> adjacency = new List<int[]>();
    Surface s = null;
    int u_divisions = 1;
    int v_divisions = 1;
    List<Plane> base_planes = new List<Plane>();
    public List<Line> insertion_lines = new List<Line>();


    //Properties for plates
    bool has_ngons = false;
    double face_thickness = 1;
    double chamfer = 0.01;
    double extend = 1;
    List<double> face_positions = new List<double>();

    public int f;
    public int e;
    public int[][] f_v;
    public int[][] f_e;
    public int[][] e_f;
    public Dictionary<int,int> e_ngon_e;
    public Plane[] f_planes = new Plane[0];
    public Plane[][] fe_planes = new Plane[0][];
    public Plane[][] bi_planes = new Plane[0][];
    public Plane[] e_planes = new Plane[0];
    public Line[] e_lines = new Line[0];
    public Vector3d[] insertion_vectors = new Vector3d[0];

    //Output
    public string[][] f_polylines_index = new string[0][];
    public Plane[][] f_polylines_planes = new Plane[0][];
    public Polyline[][] f_polylines = new Polyline[0][];


    public case_3_mtsj(Surface s, int u_divisions, int v_divisions, List<Plane> base_planes, double thickness, double chamfer,List<double> face_positions){//List<Line> insertion_vectors,
      this.s = s;
      this.u_divisions = u_divisions;
      this.v_divisions = v_divisions;
      this.base_planes = base_planes;

      //Run
      m = diamond_subdivision();
      this.has_ngons = m.Ngons.Count > 0;
      this.face_thickness = thickness;
      this.chamfer = chamfer;
      this.extend = extend;
      this.face_positions = face_positions;

      //Properties for plates
      get_face_vertices();
      get_faces_planes();
      get_face_edge_planes();
      get_bisector_planes();
      get_edges();
      get_edge_faces();
      //get_edge_vectors(insertion_vectors);
      get_face_polylines();
      get_insertion_vectors();

    }

    public  Mesh diamond_subdivision()
    {

      Mesh m = new Mesh();
      flags = new List<bool>();

      if (u_divisions < 1)
        u_divisions = 1;

      if (v_divisions < 1)
        v_divisions = 1;

      int v = 0;
      List<MeshFace> face = new List<MeshFace>();
      List<Point3d> pts = new List<Point3d>();
      Interval interval = s.Domain(0);
      Interval interval1 = s.Domain(1);
      double step_u = (interval.T1 - interval.T0) / (double) u_divisions;
      double step_v = (interval1.T1 - interval1.T0) / (double) v_divisions;


      double sum_step_u = 0;

      for (int i = 0; i < u_divisions; i++)  {

        int a = i % 2 == 0 ? 1 : 0;
        int b = i % 2 == 0 ? 2 : 3;

        double sum_step_v = 0;
        for (int j = 0; j < v_divisions; j++)   {

          Point3d p0 = s.PointAt(sum_step_u, sum_step_v);
          Point3d p1 = s.PointAt(sum_step_u + step_u, sum_step_v);

          s.PointAt(sum_step_u, sum_step_v + step_v * 0.5);
          s.NormalAt(sum_step_u, sum_step_v + step_v * 0.5);
          s.PointAt(sum_step_u + step_u, sum_step_v + step_v * 0.5);
          s.NormalAt(sum_step_u + step_u, sum_step_v + step_v * 0.5);

          Point3d p2 = s.PointAt(sum_step_u, sum_step_v + step_v);
          Point3d p3 = s.PointAt(sum_step_u + step_u, sum_step_v + step_v);
          Point3d p4 = s.PointAt(sum_step_u + step_u * 0.5, sum_step_v + step_v * 1.5);
          Point3d p5 = s.PointAt(sum_step_u + step_u * 0.5, sum_step_v + step_v * 0.5);
          Point3d p6 = s.PointAt(sum_step_u + step_u * 0.5, sum_step_v - step_v * 0.5);
          Point3d p7 = (p5 + p6) / 2;
          Point3d p8 = (p4 + p5) / 2;

          if (j == 0)
          {
            ///////////////////////////////////////
            //start triangles
            ///////////////////////////////////////
            Point3d p9 = s.PointAt(sum_step_u + step_u * 0.5, interval1.T0);
            Line line = new Line(p5, p6);
            Point3d cp = line.ClosestPoint(p9, false);

            if(base_planes.Count > 0){
              if(Math.Abs(base_planes.First().ZAxis.X) + Math.Abs(base_planes.First().ZAxis.Y) + Math.Abs(base_planes.First().ZAxis.Z) > 0.01){
                double t;
                Rhino.Geometry.Intersect.Intersection.LinePlane(line, base_planes.First(), out t);
                cp = line.PointAt(t);
              }
            }
            // cp = p7;

            pts.AddRange(new Point3d[] { p5, cp,p1 });
            this.flags.Add(face.Count % 4 == a || face.Count % 4 == b);
            face.Add(new MeshFace(v, v + 1, v + 2));
            v += 3;

            pts.AddRange(new Point3d[] { cp, p5, p0 });
            this.flags.Add(face.Count % 4 == a || face.Count % 4 == b);
            face.Add(new MeshFace(v, v + 1, v + 2));
            v += 3;
          }

          pts.AddRange(new Point3d[] { p1, p3, p5 });
          this.flags.Add(face.Count % 4 == a || face.Count % 4 == b);
          face.Add(new MeshFace(v, v + 1, v + 2));
          v += 3;
          pts.AddRange(new Point3d[] {  p2,p0, p5 });
          this.flags.Add(face.Count % 4 == a || face.Count % 4 == b);
          face.Add(new MeshFace(v, v + 1, v + 2));
          v += 3;

          if (j != v_divisions - 1)  {
            pts.AddRange(new Point3d[] { p4, p5, p3 });
            this.flags.Add(face.Count % 4 == a || face.Count % 4 == b);
            face.Add(new MeshFace(v, v + 1, v + 2));
            v += 3;
            pts.AddRange(new Point3d[] {   p5,p4,p2 });
            this.flags.Add(face.Count % 4 == a || face.Count % 4 == b);
            face.Add(new MeshFace(v, v + 1, v + 2));
            v += 3;

          } else {
            ///////////////////////////////////////
            //end triangles
            ///////////////////////////////////////
            Point3d p9 = s.PointAt(sum_step_u + step_u * 0.5, interval1.T1);
            Line line = new Line(p4, p5);
            Point3d cp = line.ClosestPoint(p9, false);

            if(base_planes.Count > 0){
              if(Math.Abs(base_planes.Last().ZAxis.X) + Math.Abs(base_planes.Last().ZAxis.Y) + Math.Abs(base_planes.Last().ZAxis.Z) > 0.01){
                double t;
                Rhino.Geometry.Intersect.Intersection.LinePlane(line, base_planes.Last(), out t);
                cp = line.PointAt(t);
              }

            }
            //cp = p8;

            pts.AddRange(new Point3d[] {  cp, p5,p3 });
            this.flags.Add(face.Count % 4 == a || face.Count % 4 == b);
            face.Add(new MeshFace(v, v + 1, v + 2));
            v += 3;

            pts.AddRange(new Point3d[] { p5, cp, p2 });
            this.flags.Add(face.Count % 4 == a || face.Count % 4 == b);
            face.Add(new MeshFace(v, v + 1, v + 2));
            v += 3;

          }
          sum_step_v += step_v;
        }
        sum_step_u += step_u;
      }

      m.Vertices.AddVertices(pts);

      m.Faces.AddFaces(face);
      m.Weld(3.14159);
      m.RebuildNormals();


      edge_joints = new bool[face.Count][];
      this.adjacency = new List<int[]>();
      //RhinoApp.WriteLine(face.Count.ToString());
      // RhinoApp.WriteLine(m.Faces.Count.ToString()) ;
      for(int i = 0; i < this.flags.Count; i++ ){

        if(this.flags[i]){
          int[] nei = m.Faces.AdjacentFaces(i);

          foreach(int j in nei)
            this.adjacency.Add(new int[2]{i,j});
        }
        edge_joints[i] = Enumerable.Repeat(this.flags[i], 9).ToArray();
      }





      return m;
    }



    //Compute mesh properties

    public void get_face_vertices(){
      if(has_ngons){
        this.f = this.m.Ngons.Count;
        f_v = m.GetNGonsTopoBoundaries();
      }else
      {
        this.f = this.m.Faces.Count;
        f_v = new int[this.m.Faces.Count][];
        for(int i = 0; i < this.m.Faces.Count;i++ )

          f_v[i] = this.m.Faces[i].IsQuad ? new int[] { this.m.Faces[i][0], this.m.Faces[i][1], this.m.Faces[i][2], this.m.Faces[i][3] } : new int[] { this.m.Faces[i][0], this.m.Faces[i][1], this.m.Faces[i][2] };
      }
    }

    public void get_faces_planes(){

      if(has_ngons){
        f_planes = m._FPlanes();
      }else{
        f_planes = new Plane[m.Faces.Count];
        for(int i = 0; i < m.Faces.Count; i++)
          f_planes[i] = new Plane(m.MeshFaceCenter(i), m.FaceNormals[i]);
      }



    }


    public void set_edge_normals()
    {

      var topologyEdges = m.TopologyEdges;
      var faceNormals = m.FaceNormals;

      e_planes = new Plane[topologyEdges.Count];

      for (int i = 0; i < (int) topologyEdges.Count; i++)
      {
        Line line = topologyEdges.EdgeLine(i);
        int[] connectedFaces = topologyEdges.GetConnectedFaces(i);


        Vector3d xaxis = (line.To - line.From).UnitVector();
        //Vector3d item1 = new Vector3d();
        Vector3d zaxis = new Vector3d();

        if ((int) connectedFaces.Length != 2)//naked
          zaxis = Vector3d.CrossProduct(faceNormals[connectedFaces[0]], xaxis);
        else {//inner
          Vector3d zaxis_avg = ((faceNormals[connectedFaces[0]] + faceNormals[connectedFaces[1]]) / 2);
          zaxis_avg.Unitize();
          zaxis = Vector3d.CrossProduct(xaxis, zaxis_avg);
        }
        this.e_planes[i] = new Plane(line.PointAt(0.5), zaxis);
      }


    }


    public void get_face_edge_planes()
    {

      set_edge_normals();
      fe_planes = new Plane[f][];


      for (int i = 0; i < f; i++)
      {
        int n = f_v[i].Length;
        fe_planes[i] = new Plane[n];

        for (int j = 0; j < f_v[i].Length; j++)
        {
          int v1 = f_v[i][(j + 0) % n];
          int v2 = f_v[i][(j + 1) % n];

          int e = this.m.TopologyEdges.GetEdgeIndex(v1, v2);
          int[] cf = this.m.TopologyEdges.GetConnectedFaces(e);



          Vector3d sum = Vector3d.Zero;
          for (int k = 0; k < cf.Length; k++)
            sum += this.m.FaceNormals[cf[k]];
          sum /= cf.Length;

          //Plane edgePlane = new Plane((Point3d) (this.m.Vertices[v1] + this.m.Vertices[v2]) * 0.5, this.m.Vertices[v1] - this.m.Vertices[v2], sum);
          Plane edgePlane = Plane.Unset;

          //Error
          if(cf.Length == 2){

            //RhinoApp.WriteLine(this.m.MeshFaceCenter(cf[0]).ToString());

            edgePlane = PlaneUtil.DihedralPlane(
              new Plane(this.m.MeshFaceCenter(cf[0]), this.m.FaceNormals[cf[0]]),
              new Plane(this.m.MeshFaceCenter(cf[1]), this.m.FaceNormals[cf[1]])

              );


            edgePlane = this.e_planes[e];

          }else{
            edgePlane = new Plane((Point3d) (this.m.Vertices[v1] + this.m.Vertices[v2]) * 0.5, this.m.Vertices[v1] - this.m.Vertices[v2], sum);
          }

          fe_planes[i][j] = edgePlane;

          //Error Edge plane is not average but dihedral

          //Adjust to surface
          //          if(s != null){
          //
          //            double u, v;
          //            s.ClosestPoint(fe_planes[i][j].Origin, out u, out v);
          //            Vector3d normal = s.NormalAt(u, v);
          //            //Vector3d xaxis = Vector3d.CrossProduct(normal, e_planes[i][j].YAxis);
          //            //Vector3d yaxis = Vector3d.CrossProduct(normal, xaxis);
          //            //s.PointAt(u, v)
          //            fe_planes[i][j] = new Plane(fe_planes[i][j].Origin, Vector3d.CrossProduct(normal, fe_planes[i][j].ZAxis), normal);
          //
          //          }




        }//for j
      }//for i
    }

    public void get_bisector_planes()
    {
      bi_planes = new Plane[f][];

      for (int i = 0; i < f; i++)
      {
        int n = f_v[i].Length;
        bi_planes[i] = new Plane[n];
        for (int j = 0; j < n; j++)
        {
          var pl1 = fe_planes[i][j];
          var pl0 = fe_planes[i][MathUtil.Wrap(j + 1, n)];
          bi_planes[i][j] = PlaneUtil.DihedralPlane(pl0, pl1);
        }
      }//for i
    }

    public void get_edges(){


      if(this.has_ngons) {
        e_ngon_e = this.m._EAll();
        this.e = e_ngon_e.Count;
      }else{

        e_ngon_e = new Dictionary< int,int>();
        for(int i = 0; i < this.m.TopologyEdges.Count; i++ ){
          e_ngon_e.Add(i, i);
        }

      }
      this.e = e_ngon_e.Count;

    }

    public void get_edge_faces(){

      if(this.has_ngons){
        this.e_f = this.m._EF();

      }else{
        this.e_f = new int[this.m.TopologyEdges.Count][];
        for(int i = 0; i < this.m.TopologyEdges.Count;i++)
          this.e_f[i] = this.m.TopologyEdges.GetConnectedFaces(i);
      }
    }

    //
    //    List<int> found_ids = new List<int>();
    //    public void get_edge_vectors(List<Line> lines){
    //
    //      //Init empty vectors
    //      this.insertion_vectors = new Vector3d[this.e];
    //
    //
    //      //Get edge lines including naked
    //      this.e_lines = new Line[this.e];
    //      foreach(var pair in this.e_ngon_e){
    //        this.e_lines[pair.Value] = this.m.TopologyEdges.EdgeLine(pair.Key);
    //        //RhinoDoc.ActiveDoc.Objects.AddLine(this.e_lines[pair.Value]);
    //        //RhinoApp.WriteLine(string.Format("{0} {1}",pair.Key,pair.Value));
    //      }
    //
    //
    //
    //      //Create rtree and add lines
    //      RTree rTree = new RTree();
    //      for (int i = 0; i < this.e_lines.Length; i++)
    //        rTree.Insert(this.e_lines[i].BoundingBox, i);
    //
    //      //Search tree
    //      for(int i = 0; i < lines.Count;i++ ){
    //        BoundingBox bbox = lines[i].BoundingBox;
    //        bbox.Inflate(Rhino.RhinoDoc.ActiveDoc.ModelAbsoluteTolerance);
    //        bbox.Inflate(1);
    //        rTree.Search(lines[i].BoundingBox, BoundingBoxCallback);
    //
    //        //iterate through found ids and check if end point lies on a mesh edge
    //        foreach(var  id in found_ids ){
    //          //RhinoDoc.ActiveDoc.Objects.AddLine(lines[i]);
    //          //RhinoDoc.ActiveDoc.Objects.AddLine(e_lines[id]);
    //          //break;
    //          if( this.e_lines[id].ClosestPoint(lines[i].From, true).DistanceToSquared(lines[i].From) < Rhino.RhinoDoc.ActiveDoc.ModelAbsoluteTolerance){
    //            this.insertion_vectors[id] = lines[i].Direction.UnitVector();
    //            //RhinoApp.WriteLine("Hi");
    //          }else if( this.e_lines[id].ClosestPoint(lines[i].To, true).DistanceToSquared(lines[i].To) < Rhino.RhinoDoc.ActiveDoc.ModelAbsoluteTolerance){
    //            this.insertion_vectors[id] = lines[i].Direction.UnitVector();
    //            // RhinoApp.WriteLine("Hi");
    //          }
    //        }
    //        //break;
    //        // RhinoApp.WriteLine(found_ids.Count.ToString());
    //        found_ids = new List<int>();
    //
    //      }
    //
    //    }
    //
    //    void BoundingBoxCallback(object sender, RTreeEventArgs e)
    //    {
    //      found_ids.Add(e.Id);
    //    }
    //



    //Compute geometry
    public void get_face_polylines(){




      bool zero_layer = this.face_positions.Count == 0;

      this.f_polylines_index = new string[f][];
      this.f_polylines_planes = new Plane[f][];
      this.f_polylines = new Polyline[f][];

      for(int i = 0; i < f; i++){

        if(this.face_positions.Count == 0){

          f_polylines[i] = new Polyline[2];

          //f_polylines[i][0] = PolylineUtil.OutlineFromFaceEdgeCorner(f_planes[i].MovePlanebyAxis(this.face_thickness * -0.0), fe_planes[i], bi_planes[i], 2);
          //f_polylines[i][1] = PolylineUtil.OutlineFromFaceEdgeCorner(f_planes[i].MovePlanebyAxis(this.face_thickness * 1.0), fe_planes[i], bi_planes[i], 2);

          Polyline pline0 = PolylineUtil.PolylineFromPlanes(f_planes[i].MovePlanebyAxis(this.face_thickness * -0.0), fe_planes[i].ToList(), true);
          Polyline pline1 = PolylineUtil.PolylineFromPlanes(f_planes[i].MovePlanebyAxis(this.face_thickness * 1.0), fe_planes[i].ToList(), true);

          f_polylines_planes[i] = new Plane[1]{
            f_planes[i].MovePlanebyAxis(this.face_thickness * 1.0)
            };

          f_polylines_index[i] = new string[1]{
            i.ToString()
            };


        }else{

          f_polylines[i] = new Polyline[this.face_positions.Count * 2];
          f_polylines_planes[i] = new Plane[this.face_positions.Count];
          f_polylines_index[i] = new string[this.face_positions.Count];

          for(int j = 0; j < this.face_positions.Count ; j++){
            Polyline pline0 = PolylineUtil.PolylineFromPlanes(f_planes[i].MovePlanebyAxis(this.face_positions[j] + this.face_thickness * -0.0), fe_planes[i].ToList(), true);
            Polyline pline1 = PolylineUtil.PolylineFromPlanes(f_planes[i].MovePlanebyAxis(this.face_positions[j] + this.face_thickness * 1.0), fe_planes[i].ToList(), true);
            // Polyline pline0 = PolylineUtil.OutlineFromFaceEdgeCorner(f_planes[i].MovePlanebyAxis(this.face_positions[j] + this.face_thickness * -0.0), fe_planes[i], bi_planes[i], 2);
            // Polyline pline1 = PolylineUtil.OutlineFromFaceEdgeCorner(f_planes[i].MovePlanebyAxis(this.face_positions[j] + this.face_thickness * 1.0), fe_planes[i], bi_planes[i], 2);
            //f_polylines[i][j] = rhino_util.PolylineUtil.PolylineFromPlanes(f_planes[i].MovePlanebyAxis(this.face_thickness[j]), e_planes[i].ToList());
            f_polylines[i][j * 2 + 0] = pline0;
            f_polylines[i][j * 2 + 1] = pline1;
            f_polylines_planes[i][j] = f_planes[i].MovePlanebyAxis(this.face_positions[j] + this.face_thickness * 1.0);

            f_polylines_index[i][j] = this.face_positions.Count == 1 ? i.ToString() : string.Format("{0}-{1}", i, j);
          }

        }




      }


    }



    public void get_insertion_vectors(){

      for(int i = 0; i < f; i++){

        if(!this.flags[i]){

          Vector3d vec = f_polylines[i][0][2] - f_polylines[i][0][0];
          vec.Unitize();
          vec *= 10;

          for(int j = 0; j < 3; j++){
            Point3d mid = (f_polylines[i][0][j] + f_polylines[i][0][(j + 1) % 3]) * 0.5;
            Line l = new Line(mid, vec);
            insertion_lines.Add(l);
          }





        }


      }

    }

  }
# ---------- end c_script_2 ----------

brep_2 = Brep(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)  # disabled
brep_3 = Brep(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)  # disabled
number_slider_7 = Slider(-1, range=-10..1)  # disabled
crv_9 = Curve([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])
crv_10 = Curve([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])  # disabled
crv_11 = Curve(c_script_2.L)  # disabled
panel_4 = Panel(c_script_2.flags)  # disabled
crv_12 = Curve(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)  # disabled
crv_13 = Curve(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)  # disabled
pln = Plane(c_script_2.P)  # disabled

# ---- group: Butterfly Key Plates
crv_14 = Curve([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])  # disabled
end_4 = EndPoints(Curve=crv_14)  # -> Start, End; disabled
end_5 = EndPoints(Curve=crv_14)  # -> Start, End; disabled
ln_4 = Line(StartPoint=end_4.Start, EndPoint=end_4.End)  # disabled
ln_5 = Line(StartPoint=end_5.Start, EndPoint=end_5.End)  # disabled
number_slider_8 = Slider(90, range=0..100)  # disabled
merge_5 = Merge(Data1=crv_14, Data2=ln_5)  # disabled
merge_6 = Merge(Data1=crv_14, Data2=ln_4)  # disabled
xz = XZPlane(Origin=Point(0, 0, 0))  # disabled
rotate_2 = Rotate(Geometry=merge_6, Angle=degrees(number_slider_8), Plane=PlaneXY(0, 0, 0))  # -> Geometry, Transform; disabled
mirror_2 = Mirror(Geometry=rotate_2.Geometry, Plane=xz)  # -> Geometry, Transform; disabled
crv_15 = Curve(merge_5)  # disabled
cp_3 = ControlPoints(Curve=crv_15)  # -> Points, Weights, Knots; disabled
cp_4 = ControlPoints(Curve=mirror_2.Geometry)  # -> Points, Weights, Knots; disabled
pline_3 = PolyLine(Vertices=cp_3.Points, Closed=False)  # -> flatten(Polyline); disabled
pline_4 = PolyLine(Vertices=cp_4.Points, Closed=False)  # -> flatten(Polyline); disabled
panel_6 = Panel("""3
3""")
panel_7 = Panel("""3
3""")
c_script_3 = CSharpScript(type="1", plines0=pline_4, plines1=pline_3, bool0=panel_6, bool1=panel_7, unit_scale=Toggle(False))  # -> out, joint; inputs type: Int32, plines0: list, plines1: list, bool0: list of Int32, bool1: list of Int32, unit_scale: Int32; disabled; same code as c_script

# ----
crv_16 = Curve([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])  # disabled
crv_17 = Curve([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])  # disabled
crv_18 = Curve(c_script_2.L)  # disabled
mesh = Mesh(c_script_2.m)  # disabled
chamfer = Chamfer(Poly=c_script_2.f, Chamfer=number_slider_7)  # disabled
crv_19 = Curve([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])  # disabled
crv_20 = Curve([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])  # disabled
crv_21 = Curve([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])  # disabled
pln_2 = Plane(c_script_2.P)  # disabled
item_2 = ListItem(List=crv_16, Index=0, Wrap=True)  # disabled
item_3 = ListItem(List=crv_21, Index=0, Wrap=True)  # disabled
crv_22 = Curve(c_script_2.f)  # disabled
pln_3 = Plane(c_script_2.E_P)  # disabled
entwine = Entwine(Branch00=crv_16, FlattenInputs=True)  # disabled
crv_23 = Curve([<curve referenced from the Rhino model> x2])  # disabled
end_6 = EndPoints(Curve=crv_19)  # -> Start, End; disabled
faceb = FaceBoundaries(Mesh=mesh)  # disabled
entwine_2 = Entwine(Branch00=crv_21, FlattenInputs=True)  # disabled
# 1. Create In-Plane Tile tenon-mortise that ends with miter.
# 2. Mofigy to create through-tenon
top = GetPolylines(Mesh=c_script_2.m)  # disabled
crv_24 = Curve(flatten(chamfer))  # disabled
crv_25 = Curve([<curve referenced from the Rhino model> x2])  # disabled
merge_7 = Merge(Data1=crv_13, Data2=crv_12)  # disabled
panel_8 = Panel("""6
6
6
6
6
6
6""")

crv_26 = Curve([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])
crv_27 = Curve([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])
merge_8 = Merge(Data1=crv_27)
merge_9 = Merge(Data1=crv_26, Data2=crv_9)
Z = UnitZ(Factor=-0.5)
move = Move(Geometry=merge_9, Motion=Z)  # -> Geometry, Transform
move_2 = Move(Geometry=merge_8, Motion=Z)  # -> Geometry, Transform
xz_2 = XZPlane(Origin=Point(0, 0, 0))
panel_9 = Panel("""6
6
6
6""")
rotate_3 = Rotate(Geometry=move.Geometry, Angle=degrees(180), Plane=xz_2)  # -> Geometry, Transform
rotate_4 = Rotate(Geometry=move_2.Geometry, Angle=degrees(180), Plane=xz_2)  # -> Geometry, Transform
yz = YZPlane(Origin=Point(0, 0, 0))
rotate_5 = Rotate(Geometry=rotate_4.Geometry, Angle=degrees(90), Plane=yz)  # -> Geometry, Transform
rotate_6 = Rotate(Geometry=rotate_3.Geometry, Angle=degrees(90), Plane=yz)  # -> Geometry, Transform
c_script_4 = CSharpScript(type="2", plines0=merge_8, plines1=merge_9, bool0=panel_9, bool1=panel_8, unit_scale=Toggle(True))  # -> out, joint; inputs type: Int32, plines0: list, plines1: list, bool0: list of Int32, bool1: list of Int32, unit_scale: Int32; same code as c_script

partition = PartitionList(List=merge_9, Size=Slider(2, range=0..10))
loft = Loft(Curves=partition, Options={Adjust=False, Closed=False, LoftEnds=0, LoftSimp=0, LoftType=0, Rebuild=10, Refit=0.01})
cap = CapHoles(Brep=loft)
display = CurvePreview(Curve=[item_2, item_3], Width=10)  # disabled
bbox = BoundingBox(Content=entwine, Plane=PlaneXY(0, 0, 0), UnionBox=True)  # -> Box, Box_2; disabled
crv_28 = Curve([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])  # disabled
ln_6 = Line(StartPoint=end_6.Start, EndPoint=end_6.End)  # disabled
explode = Explode(Curve=faceb, Recursive=True)  # -> Segments, Vertices; disabled
bbox_2 = BoundingBox(Content=entwine_2, Plane=PlaneXY(0, 0, 0), UnionBox=True)  # -> Box, Box_2; disabled
dispatch = Dispatch(List=top, DispatchPattern=c_script_2.flags)  # -> ListA, ListB; disabled
panel_10 = Panel("""CPP Vector -0.087185763149553175 2.2126940028706401 5.5356298398806931
CPP Vector 0.70776317647095022 1.9302525496178604 4.9292831975813547
CPP Vector -0.69153811801048448 -2.3271622848737068 5.0778737158426308
CPP Vector -1.4864870576309879 -2.0447208316209271 5.6842203581419692
CPP Vector -0.087185763149553175 2.2126940028706401 5.5356298398806931
CPP int 0
CPP int 0
CPP Vector -0.087185763149553175 2.2126940028706401 5.5356298398806931 
CPP Vector 0.70776317647095022 1.9302525496178604 4.9292831975813547
CPP Vector -0.69153811801048448 -2.3271622848737068 5.0778737158426308
CPP Vector -1.4864870576309879 -2.0447208316209271 5.6842203581419692
CPP Vector -0.087185763149553175 2.2126940028706401 5.5356298398806931 
CPP int 0""")  # disabled
crv_29 = Curve(crv_28)  # disabled
area = Area(Geometry=bbox.Box)  # -> Area, Centroid; disabled
input_set = Input_set(Plines=entwine)  # disabled
area_2 = Area(Geometry=bbox_2.Box)  # -> Area, Centroid; disabled

# ---- group: joints_params
number_slider_9 = Slider(300, range=30..3000)  # disabled
number_slider_10 = Slider(0.5, range=0..1)  # disabled
number_slider_11 = Slider(9, range=1..9)  # disabled
number_slider_12 = Slider(450, range=30..3000)  # disabled
number_slider_13 = Slider(0.65, range=0..1)  # disabled
number_slider_14 = Slider(13, range=10..19)  # disabled
number_slider_15 = Slider(450, range=30..3000)  # disabled
number_slider_16 = Slider(0.5, range=0..1)  # disabled
number_slider_17 = Slider(21, range=20..29)  # disabled
number_slider_18 = Slider(300, range=30..3000)  # disabled
number_slider_19 = Slider(0.5, range=0..1)  # disabled
number_slider_20 = Slider(30, range=30..39)  # disabled
number_slider_21 = Slider(300, range=30..3000)  # disabled
number_slider_22 = Slider(0.5, range=0..1)  # disabled
number_slider_23 = Slider(40, range=40..49)  # disabled
number_slider_24 = Slider(300, range=30..3000)  # disabled
number_slider_25 = Slider(0.5, range=0..1)  # disabled
number_slider_26 = Slider(50, range=50..59)  # disabled
joints_params = Joints_params(
    ss_e_ip_len=number_slider_9,
    ss_e_ip_shift=number_slider_10,
    ss_e_ip_type=number_slider_11,
    ss_e_op_len=number_slider_12,
    ss_e_op_shift=number_slider_13,
    ss_e_op_type=number_slider_14,
    ts_e_p_len=number_slider_15,
    ts_e_p_shift=number_slider_16,
    ts_e_p_type=number_slider_17,
    cr_c_ip_len=number_slider_18,
    cr_c_ip_shift=number_slider_19,
    cr_c_ip_type=number_slider_20,
    tt_e_p_len=number_slider_21,
    tt_e_p_shift=number_slider_22,
    tt_e_p_type=number_slider_23,
    ss_e_r_len=number_slider_24,
    ss_e_r_shift=number_slider_25,
    ss_e_r_type=number_slider_26)  # disabled

# ----
number_slider_27 = Slider(5, range=1..10)  # disabled
number_slider_28 = Slider(2, range=1..10)  # disabled
number_slider_29 = Slider(1, range=0.1..10)  # disabled
number_slider_30 = Slider(0.5, range=0.01..1)  # disabled
number_slider_31 = Slider(0, range=-10..10)  # disabled
brep_4 = Brep(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)  # disabled
case_3 = Case_3_folded_plates_component(
    Surface=brep_3,
    U_divisions=number_slider_27,
    V_divisions=number_slider_28,
    Thickness=number_slider_29,
    Chamfer=number_slider_30,
    Face_positions=number_slider_31)  # -> Mesh, Plates, Insertion, Adjacency, Flags; disabled
cp_lines = Closest_lines(Polylines=simplify(flatten(case_3.Plates)), Lines=case_3.Insertion)  # -> Polylines, Vectors; disabled
input_set_2 = Input_set(Plines=cp_lines.Polylines, Adjacency=case_3.Adjacency)  # disabled
number_slider_32 = Slider(4, range=0..4)  # disabled
data = Data(joints_params)  # disabled
solver = Solver(Data=input_set_2, Join=data, Get=number_slider_32, Get_2=4)  # disabled
cluster = Cluster(data=input_set_2)  # disabled
input_get = Input_get(Data=solver)  # -> Plines, Insertion_vectors, Joints_per_face, Three_valence, Adjacency; disabled
crv_30 = Curve(reverse(input_get.Plines))  # disabled
loft_2 = Loft(Polylines1=crv_30)  # disabled
dispatch_2 = Dispatch(List=flatten(loft_2), DispatchPattern=case_3.Flags)  # -> ListA, ListB; disabled
swatch = ColourSwatch(SwatchColor=RGB(122, 122, 122))  # disabled
swatch_2 = ColourSwatch(SwatchColor=RGB(196, 196, 196))  # disabled
preview = CustomPreview(Geometry=dispatch_2.ListB, Material=swatch)  # disabled
preview_2 = CustomPreview(Geometry=dispatch_2.ListA, Material=swatch_2)  # disabled

input_set_3 = Input_set(Plines=entwine_2)  # disabled
item_4 = ListItem(List=explode.Segments, Index=0, Wrap=True)  # disabled
boundary = BoundarySurfaces(Edges=dispatch.ListA)  # disabled
merge_10 = Merge(Data1=crv_19, Data2=ln_6, Data3=merge_7, Data4=merge_7)  # disabled

# ---- group: Butterfly Key Plates
crv_31 = Curve(crv_10)  # disabled
end_7 = EndPoints(Curve=crv_31)  # -> Start, End; disabled
end_8 = EndPoints(Curve=crv_31)  # -> Start, End; disabled
ln_7 = Line(StartPoint=end_8.Start, EndPoint=end_8.End)  # disabled
ln_8 = Line(StartPoint=end_7.Start, EndPoint=end_7.End)  # disabled
number_slider_33 = Slider(90, range=0..100)  # disabled
merge_11 = Merge(Data1=crv_31, Data2=ln_7)  # disabled
merge_12 = Merge(Data1=crv_31, Data2=ln_8)  # disabled
rotate_7 = Rotate(Geometry=merge_11, Angle=degrees(number_slider_33), Plane=PlaneXY(0, 0, 0))  # -> Geometry, Transform; disabled
xz_3 = XZPlane(Origin=Point(0, 0, 0))  # disabled
crv_32 = Curve(merge_12)  # disabled
mirror_3 = Mirror(Geometry=rotate_7.Geometry, Plane=xz_3)  # -> Geometry, Transform; disabled
cp_5 = ControlPoints(Curve=crv_32)  # -> Points, Weights, Knots; disabled
cp_6 = ControlPoints(Curve=merge_10)  # -> Points, Weights, Knots; disabled
pline_5 = PolyLine(Vertices=cp_5.Points, Closed=False)  # -> flatten(Polyline); disabled
pline_6 = PolyLine(Vertices=cp_6.Points, Closed=False)  # -> flatten(Polyline); disabled
toggle_2 = BooleanToggle(False)  # disabled
panel_11 = Panel("""3
3
2
2""")  # disabled
panel_12 = Panel("""3
3""")  # disabled
panel_13 = Panel("1")  # disabled
c_script_5 = CSharpScript(type=panel_13, plines0=pline_6, plines1=pline_5, bool0=panel_11, bool1=panel_12, unit_scale=toggle_2)  # -> out, joint; inputs type: Int32, plines0: list, plines1: list, bool0: list of Int32, bool1: list of Int32, unit_scale: Int32; disabled; same code as c_script

# ----
item_5 = ListItem(List=crv_31, Index=0, Wrap=True)  # disabled
cp_lines_2 = Closest_lines(Polylines=simplify(flatten(crv_24)), Lines=crv_18)  # -> Polylines, Vectors; disabled
crv_33 = Curve(crv_29)  # disabled
end_9 = EndPoints(Curve=crv_33)  # -> Start, End; disabled

panel_14 = Panel("""0
0""")  # disabled
panel_15 = Panel("""0
0""")  # disabled
crv_34 = Curve([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])  # disabled
panel_16 = Panel("""2
1""")  # disabled
entwine_3 = Entwine(Branch00=crv_34, Branch01=crv_34, FlattenInputs=True)  # disabled
entwine_4 = Entwine(Branch00=panel_14, Branch01=panel_14, FlattenInputs=True)  # disabled
entwine_5 = Entwine(Branch00=panel_15, Branch01=panel_15, FlattenInputs=True)  # disabled
c_script_6 = CSharpScript(type=panel_16, plines0=entwine_3, plines1=entwine_3, bool0=entwine_4, bool1=entwine_5)  # -> out, A; inputs type: list of Int32, plines0: tree of Polyline, plines1: tree of Polyline, bool0: tree of Int32, bool1: tree of Int32; disabled
# ---------- c_script_6: C# ----------
    XmlWriter xmlWriter = XmlWriter.Create("C:\\Users\\petra\\Desktop\\New folder\\joint_library.xml");
    xmlWriter.WriteStartDocument();


    /////////////////////////////////////////////////////////////////////////////////////////////////////////////////////////////////////////////
    //Start document
    /////////////////////////////////////////////////////////////////////////////////////////////////////////////////////////////////////////////
    xmlWriter.WriteStartElement("custom_joints");
    for(int i = 0; i < type.Count;i++){
      write_joint(ref xmlWriter, type[i], plines0.Branch(i), plines1.Branch(i), bool0.Branch(i), bool1.Branch(i));
      Print("hi");
    }

    /////////////////////////////////////////////////////////////////////////////////////////////////////////////////////////////////////////////
    //End document
    /////////////////////////////////////////////////////////////////////////////////////////////////////////////////////////////////////////////
    xmlWriter.WriteEndDocument();
    xmlWriter.Close();
# ---------- c_script_6: C# additional code ----------
  public void write_joint(ref XmlWriter xmlWriter, int type, List<Polyline> plines0, List<Polyline> plines1, List<int> bool0, List<int> bool1){

    string joint_name = "";
    switch (type) {
      case(0):
      case(12):
        joint_name = "ss_e_ip_9";
        break;
      case(1):
      case(11):
        joint_name = "ss_e_op_9";
        break;
      case(2):
      case(20):
        joint_name = "ts_e_p_9";
        break;
      case(3):
      case(30):
        joint_name = "cr_c_ip_9";
        break;
      case(4):
      case(40):
        joint_name = "tt_e_p_9";
        break;
      case(5):
      case(50):
        joint_name = "ss_e_r_9";
        break;
    }

    /////////////////////////////////////////////////////////////////////////////////////////////////////////////////////////////////////////////
    //Start document
    /////////////////////////////////////////////////////////////////////////////////////////////////////////////////////////////////////////////
    xmlWriter.WriteStartElement(joint_name);

    for(int i = 0; i < plines0.Count; i++){
      string name = i % 2 == 0 ? "f0" : "f1";
      xml_polyline(ref xmlWriter, plines0[i], name);
    }

    for(int i = 0; i < plines1.Count; i++){
      string name = i % 2 == 0 ? "m0" : "m1";
      xml_polyline(ref xmlWriter, plines0[i], name);
    }

    xml_int_list(ref xmlWriter, bool0, "f_boolean_type");
    xml_int_list(ref xmlWriter, bool1, "m_boolean_type");

    xmlWriter.WriteEndElement();
    /////////////////////////////////////////////////////////////////////////////////////////////////////////////////////////////////////////////
    //End document
    /////////////////////////////////////////////////////////////////////////////////////////////////////////////////////////////////////////////


  }

  public void xml_int_list(ref XmlWriter xmlWriter, List<int> numbers, string name){
    xmlWriter.WriteStartElement(name);
    foreach(int n in numbers){

      xmlWriter.WriteStartElement("char");
      xmlWriter.WriteString(n.ToString());
      xmlWriter.WriteEndElement();

    }
    xmlWriter.WriteEndElement();
  }

  public void xml_polyline(ref XmlWriter xmlWriter, Polyline pline, string name){
    xmlWriter.WriteStartElement(name);
    foreach(Point3d p in pline){

      xmlWriter.WriteStartElement("point");

      xmlWriter.WriteStartElement("x");
      xmlWriter.WriteString(p.X.ToString());
      xmlWriter.WriteEndElement();

      xmlWriter.WriteStartElement("y");
      xmlWriter.WriteString(p.Y.ToString());
      xmlWriter.WriteEndElement();

      xmlWriter.WriteStartElement("z");
      xmlWriter.WriteString(p.Z.ToString());
      xmlWriter.WriteEndElement();

      xmlWriter.WriteEndElement();
    }
    xmlWriter.WriteEndElement();
  }
# ---------- end c_script_6 ----------

move_3 = Move(Geometry=entwine, Motion=expr("-x", area.Centroid))  # -> Geometry, Transform; disabled

# ---- group: Butterfly Key Plates
crv_35 = Curve([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])  # disabled
crv_36 = Curve([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])  # disabled
end_10 = EndPoints(Curve=crv_35)  # -> Start, End; disabled
end_11 = EndPoints(Curve=crv_36)  # -> Start, End; disabled
ln_9 = Line(StartPoint=end_10.Start, EndPoint=end_10.End)  # disabled
ln_10 = Line(StartPoint=end_11.Start, EndPoint=end_11.End)  # disabled
crv_37 = Curve([crv_35, ln_9])  # disabled
crv_38 = Curve([crv_36, ln_10])  # disabled
cp_7 = ControlPoints(Curve=crv_37)  # -> Points, Weights, Knots; disabled
cp_8 = ControlPoints(Curve=crv_38)  # -> Points, Weights, Knots; disabled
pline_7 = PolyLine(Vertices=cp_7.Points, Closed=False)  # -> flatten(Polyline); disabled
pline_8 = PolyLine(Vertices=cp_8.Points, Closed=False)  # -> flatten(Polyline); disabled
panel_17 = Panel("""1
1""")
panel_18 = Panel("""1
1""")
c_script_7 = CSharpScript(type="0", plines0=pline_7, plines1=pline_8, bool0=panel_18, bool1=panel_17, unit_scale=Toggle(True))  # -> out, joint; inputs type: Int32, plines0: list, plines1: list, bool0: list of Int32, bool1: list of Int32, unit_scale: Int32; disabled; same code as c_script

# ----
move_4 = Move(Geometry=entwine_2, Motion=expr("-x", area_2.Centroid))  # -> Geometry, Transform; disabled
end_12 = EndPoints(Curve=crv_33)  # -> Start, End; disabled
ln_11 = Line(StartPoint=end_9.Start, EndPoint=end_9.End)  # disabled

crv_39 = Curve([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])  # disabled
crv_40 = Curve([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])  # disabled
crv_41 = Curve([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])  # disabled
crv_42 = Curve([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])  # disabled
crv_43 = Curve([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])  # disabled
crv_44 = Curve([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])  # disabled
crv_45 = Curve([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])  # disabled
crv_46 = Curve([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])  # disabled
merge_13 = Merge(Data1=crv_43, Data2=crv_44, Data3=crv_45, Data4=crv_46)  # disabled
merge_14 = Merge(Data1=crv_39, Data2=crv_40, Data3=crv_41, Data4=crv_42)  # disabled
Z_2 = UnitZ(Factor=-1)  # disabled
move_5 = Move(Geometry=merge_13, Motion=Z_2)  # -> Geometry, Transform; disabled
move_6 = Move(Geometry=merge_14, Motion=Z_2)  # -> Geometry, Transform; disabled
xz_4 = XZPlane(Origin=Point(0, 0, 0))  # disabled
rotate_8 = Rotate(Geometry=move_5.Geometry, Angle=degrees(180), Plane=xz_4)  # -> Geometry, Transform; disabled
rotate_9 = Rotate(Geometry=move_6.Geometry, Angle=degrees(180), Plane=xz_4)  # -> Geometry, Transform; disabled
panel_19 = Panel("""6
6
6
6""")
yz_2 = YZPlane(Origin=Point(0, 0, 0))  # disabled
rotate_10 = Rotate(Geometry=rotate_9.Geometry, Angle=degrees(90), Plane=yz_2)  # -> Geometry, Transform; disabled
panel_20 = Panel("2")  # disabled
rotate_11 = Rotate(Geometry=rotate_8.Geometry, Angle=degrees(90), Plane=yz_2)  # -> Geometry, Transform; disabled
toggle_3 = BooleanToggle(True)  # disabled
c_script_8 = CSharpScript(
    type=panel_20,
    plines0=rotate_10.Geometry,
    plines1=rotate_11.Geometry,
    bool0=panel_19,
    bool1=panel_19,
    unit_scale=toggle_3)  # -> out, joint; inputs type: Int32, plines0: list, plines1: list, bool0: list of Int32, bool1: list of Int32, unit_scale: Int32; same code as c_script

boundary_2 = BoundarySurfaces(Edges=dispatch.ListB)  # disabled
number_slider_34 = Slider(90, range=0..100)  # disabled
preview_3 = CustomPreview(
    Geometry=boundary_2,
    Material={diffuse=RGB(221, 160, 221), emission=RGB(66, 48, 66), shine=0.5, specular=RGB(255, 255, 255), transparency=0})  # disabled
merge_15 = Merge(Data1=crv_33, Data2=ln_11)  # disabled
ln_12 = Line(StartPoint=end_12.Start, EndPoint=end_12.End)  # disabled
input_set_4 = Input_set(Plines=cp_lines_2.Polylines, Insertion_vectors=cp_lines_2.Vectors, Adjacency=c_script_2.flags)  # disabled
number_slider_35 = Slider(4, range=0..4)  # disabled
plinestocompas = PlinesToCompas(plines=flatten(move_3.Geometry))  # -> out, A; inputs plines: list of Polyline; disabled
# ---------- plinestocompas: C# ----------
    string output = "[";

    for(int i = 0; i < plines.Count;i++){
      string pline_string = "Polyline([";

      for(int j = 0; j < plines[i].Count; j++){
        pline_string += "Point(";
        double x = Math.Abs(plines[i][j].X) < 0.001 ? 0 : plines[i][j].X;
        double y = Math.Abs(plines[i][j].Y) < 0.001? 0 : plines[i][j].Y;
        double z = Math.Abs(plines[i][j].Z) < 0.001? 0 : plines[i][j].Z;
        pline_string += x.ToString();
        pline_string += ",";
        pline_string += y.ToString();
        pline_string += ",";
        pline_string += z.ToString();
        pline_string += ")";
        if(j != plines[i].Count - 1)
          pline_string += ",";
      }

      pline_string += "])";
      if(i != plines.Count - 1)
        pline_string += ",";

      // pline_string += "])";
      output += pline_string;

    }

    output += "]";

    A = output;
# ---------- end plinestocompas ----------
cluster_2 = Cluster(data=input_set)  # disabled
panel_21 = Panel("""CPP Vector 7.6665944653762823 -9.3361544498517368 -2.3958820402971299
CPP Vector -13.6801683469258 -20.852333034366101 -7.9591764818525998
CPP Vector 17.696932891652096 22.688660711236995 -9.4192006171699898 
CPP Vector 16.081424463649448 17.530673353359255 -8.288009437841211
CPP Vector 18.070130943767261 17.137864107265802 -7.2389675289832951
CPP Vector 16.002199456896513 10.535382633724941 -5.7909863133751802 
CPP Vector 14.0134929767787 10.928191879818394 -6.8400282222330961
CPP Vector 11.945561489907952 4.3257104062775316 -5.392047006624983
CPP Vector 13.934267970025765 3.9329011601840791 -4.3430050977670671 
CPP Vector 11.866336483155017 -2.6695803133567821 -2.8950238821589527
CPP Vector 9.8776300030372042 -2.2767710672633292 -3.9440657910168686
CPP Vector 7.6665944653762823 -9.3361544498517368 -2.3958820402971299 
CPP int 0
CPP Vector 8.1951091885973106 -7.9999999999999956 -0.32440285602840468
CPP Vector -14.4682514574348 -20.2264584480486 -6.2308229262591999
CPP Vector 18.844085764354187 25.999999999999982 -7.7808965285920078 
CPP Vector 16.323731499601124 17.953025307926008 -6.0161254734529166
CPP Vector 16.323681781939122 17.953035128157161 -6.0161516995006377
CPP Vector 14.255800012730376 11.350543834385148 -4.5681442578448017 
CPP Vector 12.267093532612563 11.743353080478601 -5.6171861667027176
CPP Vector 10.199162045741815 5.140871606937738 -4.1692049510946045
CPP Vector 12.187868525859628 4.7480623608442851 -3.1201630422366882
CPP Vector 10.119887321326878 -1.854409292465423 -1.6722080526762957
CPP Vector 10.11993703898888 -1.8544191126965757 -1.6721818266285742
CPP Vector 8.1951091885973106 -7.9999999999999956 -0.32440285602840468 
CPP int 0""")  # disabled
plinestocompas_2 = PlinesToCompas(plines=flatten(move_4.Geometry))  # -> out, A; inputs plines: list of Polyline; disabled; same code as plinestocompas
cluster_3 = Cluster(data=input_set_3)  # disabled
merge_16 = Merge(Data1=crv_33, Data2=ln_12)  # disabled
data_2 = Data([300, 0.5, 9, 450, 0.5, 19, 450, 0.5, 29, 300, 0.5, 30, 300, 0.5, 40, 300, 0.5, 50])  # disabled

crv_47 = Curve([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])  # disabled
c_script_9 = CSharpScript(rect_pair=crv_47)  # -> out, A, B, C; inputs rect_pair: list of Polyline; disabled
# ---------- c_script_9: C# ----------
    this.Component.Message = "ss_e_ip_2 Japanese Dovetail";
    ////////////////////////////////////////////////////////////////////
    //Number of divisions
    //Input joint line (its lengths)
    //Input distance for division
    ////////////////////////////////////////////////////////////////////
    double joint_length = Math.Abs(500);
    double division_distance = Math.Abs(60);
    int divisions = (int) Math.Ceiling(joint_length / division_distance);
    divisions = (int) Math.Max(2, Math.Min(20, divisions));
    divisions += divisions % 2;
    ////////////////////////////////////////////////////////////////////
    //Interpolate points
    ////////////////////////////////////////////////////////////////////
    Point3d[][] arrays = new Point3d[4][];
    for(int i = 0; i < 4; i++)
      arrays[i] = InterpolatePoints(rect_pair[0][i], rect_pair[1][i], divisions, false);

    ////////////////////////////////////////////////////////////////////
    //Move segments
    ////////////////////////////////////////////////////////////////////
    int start = 0;
    double t = 0.1;
    Vector3d v = t == 0 ? Vector3d.Zero : new Vector3d(0, 0, t / (divisions + 2));

    Vector3d translation = new Vector3d(0, 0, t);
    for(int i = start; i < 4; i++){

      int mid = (int) (arrays[i].Length * 0.5);

      for(int j = 0; j < arrays[i].Length; j++){

        int flip = (j % 2 == 0) ? 1 : -1;
        flip = i < 2 ? flip : flip * -1;

        arrays[i][j] += v * flip;



        if(i == 0 || i == 3){
          int flip_t = (j >= mid) ? 1 : -1;
          arrays[i][j] += translation * flip_t * 0.125;
        }

      }
    }


    ////////////////////////////////////////////////////////////////////
    //Create Polylines
    ////////////////////////////////////////////////////////////////////
    Polyline[] m_0 = new Polyline[2];
    Polyline[] m_1 = new Polyline[2];
    Polyline[] f_0 = new Polyline[2];
    Polyline[] f_1 = new Polyline[2];


    for(int i = 0; i < 4;i += 2){
      Polyline pline = new Polyline();
      for(int j = 0; j < arrays[0].Length; j++){

        bool flip = j % 2 < 1;
        flip = i < 2 ? flip : !flip;

        if(flip){
          pline.Add(arrays[i + 0][j]);
          pline.Add(arrays[i + 1][j]);
        } else{
          pline.Add(arrays[i + 1][j]);
          pline.Add(arrays[i + 0][j]);
        }

      }




      if(i < 2){
        m_1[0] = pline;

        m_1[1] = new Polyline(){pline[0],pline[pline.Count - 1]};
      }else{
        m_0[0] = pline;
        m_0[1] = new Polyline(){pline[0],pline[pline.Count - 1]};
      }
    }



    for(int i = 1; i < 4;i += 2){
      Polyline pline = new Polyline();
      for(int j = 0; j < arrays[0].Length; j++){

        bool flip = j % 2 == 0;
        flip = i < 2 ? flip : !flip;

        if(flip){
          pline.Add(arrays[i + 0][j]);
          pline.Add(arrays[(i + 1) % 4][j]);
        } else{
          pline.Add(arrays[(i + 1) % 4][j]);
          pline.Add(arrays[i + 0][j]);
        }

      }

      if(i < 2){
        f_0[0] = pline;
        f_0[1] = new Polyline(){pline[0],pline[pline.Count - 1]};
      }else{
        f_1[0] = pline;
        f_1[1] = new Polyline(){pline[0],pline[pline.Count - 1]};
      }
    }

    ////////////////////////////////////////////////////////////////////
    //Create bisectors by mobing end point to corners
    ////////////////////////////////////////////////////////////////////
    f_0[0][0] = f_0[0][1];
    f_0[0][1] += new Vector3d(0.005, 0, 0);

    f_0[0][f_0[0].Count - 1] = f_0[0][f_0[0].Count - 2];
    f_0[0][f_0[0].Count - 2] += new Vector3d(0.005, 0, 0);

    //Line
    f_0[1] = new Polyline(){f_0[0][0],f_0[0][f_0[0].Count - 1]};

    m_0[0][0] = m_0[0][1];
    m_0[0][1] += new Vector3d(0.005, 0, 0);

    m_0[0][m_0[0].Count - 1] = m_0[0][m_0[0].Count - 2];
    m_0[0][m_0[0].Count - 2] += new Vector3d(0.005, 0, 0);

    //Line
    m_0[1] = new Polyline(){m_0[0][0],m_0[0][m_0[0].Count - 1]};


    ////////////////////////////////////////////////////////////////////
    //Output
    ////////////////////////////////////////////////////////////////////

    var dt0 = new DataTree<Polyline>();
    dt0.AddRange(m_0, new GH_Path(0));
    dt0.AddRange(m_1, new GH_Path(0));
    
    var dt1 = new DataTree<Polyline>();
    dt1.AddRange(f_0, new GH_Path(0));
    dt1.AddRange(f_1, new GH_Path(0));
    A = dt0;
    B = dt1;
    //B = arrays;
  //  C = "ss_e_op_0_" + divisions.ToString();
# ---------- c_script_9: C# additional code ----------
  public  Point3d[] InterpolatePoints(Point3d from, Point3d to, int Steps, bool includeEnds = true) {
    Point3d[] point3DArray;

    if (includeEnds) {
      point3DArray = new Point3d[Steps + 2];
      point3DArray[0] = from;

      for (int i = 1; i < Steps + 1; i++) {
        double num = i / (double) (1 + Steps);

        point3DArray[i] = new Point3d(
          Lerp(from.X, to.X, num),
          Lerp(from.Y, to.Y, num),
          Lerp(from.Z, to.Z, num)
          );
      }

      point3DArray[point3DArray.Length - 1] = to;
    } else {

      point3DArray = new Point3d[Steps];

      for (int i = 1; i < Steps + 1; i++) {
        double num = i / (double) (1 + Steps);

        point3DArray[i - 1] = new Point3d(
          Lerp(from.X, to.X, num),
          Lerp(from.Y, to.Y, num),
          Lerp(from.Z, to.Z, num)
          );
      }
    }

    return point3DArray;


  }

  public double Lerp(double value1, double value2, double amount) {
    return value1 + (value2 - value1) * amount;
  }

  /// <summary>
  /// This method will be called once every solution, before any calls to RunScript.
  /// </summary>
  public override void BeforeRunScript()
  { }
  /// <summary>
  /// This method will be called once every solution, after any calls to RunScript.
  /// </summary>
  public override void AfterRunScript()
  { }
# ---------- end c_script_9 ----------

panel_22 = Panel(plinestocompas.A)  # disabled
rotate_12 = Rotate(Geometry=merge_15, Angle=degrees(number_slider_34), Plane=PlaneXY(0, 0, 0))  # -> Geometry, Transform; disabled
panel_23 = Panel(plinestocompas_2.A)  # disabled
cp_9 = ControlPoints(Curve=cluster_2)  # -> Points, Weights, Knots; disabled
crv_48 = Curve(merge_16)  # disabled
xz_5 = XZPlane(Origin=Point(0, 0, 0))  # disabled
solver_2 = Solver(Data=input_set_4, Join=data_2, Get=number_slider_35, Get_2=4)  # disabled
cluster_4 = Cluster(data=input_set_4)  # disabled
cp_10 = ControlPoints(Curve=cluster_3)  # -> Points, Weights, Knots; disabled
cp_11 = ControlPoints(Curve=crv_48)  # -> Points, Weights, Knots; disabled

panel_24 = Panel("""3
3""")
panel_25 = Panel("""3
3""")
c_script_10 = CSharpScript(type="1", plines0=c_script_9.A, plines1=c_script_9.B, bool0=panel_25, bool1=panel_24, unit_scale=Toggle(False))  # -> out, joint; inputs type: Int32, plines0: list, plines1: list, bool0: list of Int32, bool1: list of Int32, unit_scale: Int32; same code as c_script

mirror_4 = Mirror(Geometry=rotate_12.Geometry, Plane=xz_5)  # -> Geometry, Transform; disabled
cp_12 = ControlPoints(Curve=mirror_4.Geometry)  # -> Points, Weights, Knots; disabled
item_6 = ListItem(List=cp_9.Points, Index=0, Wrap=True)  # -> Item, Item1; disabled
input_get_2 = Input_get(Data=solver_2)  # -> Plines, Insertion_vectors, Joints_per_face, Three_valence, Adjacency; disabled
item_7 = ListItem(List=pline_6, Index=0, Wrap=True)  # -> Item, Item1, Item2, Item3; disabled
item_8 = ListItem(List=cp_10.Points, Index=0, Wrap=True)  # -> Item, Item1; disabled
swatch_3 = ColourSwatch(SwatchColor=RGB(255, 0, 0))  # disabled
pline_9 = PolyLine(Vertices=cp_11.Points, Closed=False)  # -> flatten(Polyline)
swatch_4 = ColourSwatch(SwatchColor=RGB(255, 0, 0))  # disabled
pline_10 = PolyLine(Vertices=cp_12.Points, Closed=False)  # -> flatten(Polyline)
crv_49 = Curve([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])
item_9 = ListItem(List=pline_6, Index=0, Wrap=True)  # -> Item, Item1, Item2, Item3, Item4, Item5; disabled
gl_shader = GLShader(
    Vertex=[Point(-1, -1, -1), Point(1, -1, -1), Point(1, 1, -1), Point(-1, 1, -1)],
    Color=RGB(0, 0, 0),
    Thickness=3,
    Res=15,
    DepthTestingEnabled=False,
    DepthWritingEnabled=False,
    DrawMode=6,
    FragmentShader="""#version 330 core
uniform sampler2D _depthBuffer;
uniform sampler2D _colorBuffer;

uniform vec2 _viewportSize;
uniform vec4 color;
uniform float thickness;
uniform float res;

void main() 
{
  vec2 uv = gl_FragCoord.xy / _viewportSize;

  vec4 buffer = texture(_depthBuffer, uv);
  float val = step(0.9999, buffer.x);
  float col = 1.0;
  float div = res;
  float stepang = 360.0 / div;
  for(float i = 0; i<div; i++){
    vec4 bufferP = texture(_depthBuffer, (gl_FragCoord.xy + vec2(cos(radians(stepang*i)), sin(radians(stepang*i)))*thickness) / _viewportSize);
    float valP = step(0.9999, bufferP.x);
    if(val - valP > 0.0){
      col *= 0.0;
    }
  }
  
  vec3 col3 = mix(color.xyz, texture(_colorBuffer, uv).xyz, col);
  
  gl_FragColor = vec4(vec3(col3), 1.0);
 
}""",
    GLShader=(0, 1, 0),
    PreviewSortOrder=5,
    VertexShader="""#version 330

layout(location = 0) in vec3 vertex;



out vec3 normal;

void main() {
  gl_Position = vec4(vertex,1.0);
}""",
    glLineWidth=1,
    glPointSize=8)  # disabled
texttopoints = TextToPoints(x=panel_10)  # -> out, A; inputs x: list of String; disabled
# ---------- texttopoints: C# usings ----------
using System.Linq;
# ---------- texttopoints: C# ----------
    var r = new DataTree<Point3d>();
    var l = new List<string>();
    int count = 0;
    for(int i = 0; i < x.Count; i++){
      if(!x[i].Contains("CPP Vector")){
        
        if(l.Count > 0){
          
          
          foreach(var line_string in l){
            string[] words = line_string.Split();
          
      
            var coord = new List<double>();
            foreach(var word in words){
              double result;
              if(double.TryParse(word, out result)){
                coord.Add(result);
              }
            }

            Point3d point = new Point3d(coord[0], coord[1], coord[2]);
            r.Add(point,new GH_Path(count)); 
          }
          
          
          l.Clear();
            count++;
        }
        
      }else{
        l.Add(x[i]);
      }
    }
    
    A = r;
# ---------- end texttopoints ----------
dots = DotDisplay(Point=item_6.Item1, Colour=swatch_3, Size=0.25)  # disabled
dots_2 = DotDisplay(Point=[item_6.Item, item_6.Item1], Colour=RGB(0, 0, 0), Size=0.25)  # disabled
panel_26 = Panel("""3
3""")
dots_3 = DotDisplay(Point=item_8.Item1, Colour=swatch_4, Size=0.25)  # disabled
panel_27 = Panel("""3
3""")
dots_4 = DotDisplay(Point=[item_8.Item, item_8.Item1], Colour=RGB(0, 0, 0), Size=0.25)  # disabled
loft_3 = Loft(
    Curves=[item_9.Item2, item_9.Item3],
    Options={Adjust=False, Closed=False, LoftEnds=0, LoftSimp=0, LoftType=0, Rebuild=10, Refit=0.01})  # disabled
loft_4 = Loft(
    Curves=[item_9.Item4, item_9.Item5],
    Options={Adjust=False, Closed=False, LoftEnds=0, LoftSimp=0, LoftType=0, Rebuild=10, Refit=0.01})  # disabled
loft_5 = Loft(
    Curves=[item_9.Item, item_9.Item1],
    Options={Adjust=False, Closed=False, LoftEnds=0, LoftSimp=0, LoftType=0, Rebuild=10, Refit=0.01})  # disabled
crv_50 = Curve(reverse(input_get_2.Plines))  # disabled
display_2 = CurvePreview(Curve=crv_30)  # disabled
crv_51 = Curve([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])
crv_52 = Curve([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])
flip = FlipMatrix(Data=texttopoints.A)  # disabled
pline_11 = PolyLine(Vertices=texttopoints.A, Closed=False)  # -> flatten(Polyline); disabled
split = SplitList(List=crv_50, Index=2)  # -> ListA, ListB; disabled
texttopoints_2 = TextToPoints(x=panel_21)  # -> out, A; inputs x: list of String; disabled; same code as texttopoints
loft_6 = LoftPolylines(Curve0=pline_11, Fast=True)  # disabled
c_script_11 = CSharpScript(p=flatten(crv_52), b=flatten(crv_52))  # -> out, A; inputs p: list of Polyline, b: list of Polyline
# ---------- c_script_11: C# ----------
    List<Polyline> plines = new List<Polyline>();

    for(int i = 0; i < p.Count; i += 2){
      plines.Add(p[i + 0]);
      plines.Add(p[i + 1]);
      if(b.Count == 0){
        plines.Add(new Polyline(new Point3d[]{p[i + 0][0],p[i + 0][p[i + 0].Count - 1]}));
        plines.Add(new Polyline(new Point3d[]{p[i + 1][0],p[i + 1][p[i + 1].Count - 1]}));
      }else{
        plines.Add(b[i+0]); 
        plines.Add(b[i+1]); 
      }
    }

    A = plines;
# ---------- end c_script_11 ----------
panel_28 = Panel("""1
1""")

# ---- group: Butterfly Key Plates
crv_53 = Curve([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])
crv_54 = Curve([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])
c_script_12 = CSharpScript(p=flatten(crv_51), b=flatten(crv_51))  # -> out, A; inputs p: list of Polyline, b: list of Polyline
# ---------- c_script_12: C# ----------
    List<Polyline> plines = new List<Polyline>();

    for(int i = 0; i < p.Count; i += 2){
      plines.Add(p[i + 0]);
      plines.Add(p[i + 1]);
      if(b.Count == 0){
        plines.Add(new Polyline(new Point3d[]{p[i + 0][0],p[i + 0][p[i + 0].Count - 1]}));
        plines.Add(new Polyline(new Point3d[]{p[i + 1][0],p[i + 1][p[i + 1].Count - 1]}));
      }else{
        plines.Add(b[i + 0]);
        plines.Add(b[i + 1]);
      }
    }

    A = plines;
# ---------- end c_script_12 ----------
panel_29 = Panel("""1
1""")
c_script_13 = CSharpScript(type="5", plines0=c_script_12.A, plines1=c_script_11.A, bool0=panel_29, bool1=panel_28, unit_scale=Toggle(False))  # -> out, joint; inputs type: Int32, plines0: list, plines1: list, bool0: list of Int32, bool1: list of Int32, unit_scale: Int32; disabled; same code as c_script

# ----
pline_12 = PolyLine(Vertices=flip, Closed=False)  # disabled
loft_7 = Loft(Polylines1=crv_50)  # disabled
swatch_5 = ColourSwatch(SwatchColor=RGB(191, 0, 96))  # disabled
curveloft = CurveLoft(Curves=split.ListA, DivisionsU=1, DivisionsV=0, Cap=True)  # -> Mesh, D; disabled
loft_8 = Loft(Curves=pline_11, Options={Adjust=False, Closed=False, LoftEnds=0, LoftSimp=0, LoftType=0, Rebuild=10, Refit=0.01})  # disabled
flip_2 = FlipMatrix(Data=texttopoints_2.A)  # disabled
pline_13 = PolyLine(Vertices=texttopoints_2.A, Closed=False)  # -> flatten(Polyline); disabled
toggle_4 = BooleanToggle(False)  # disabled
panel_30 = Panel("1")  # disabled
polyline_to_cgal_polylines = PolylineToCGAL_Polylines(x=flatten(pline_5))  # -> out, A; inputs x: list of Polyline; disabled
# ---------- polyline_to_cgal_polylines: C# ----------
    var txt = new List<string>(x.Count);
    txt.Add("std::vector<CGAL_Polyline> polylines;");

    int count = 0;
    foreach(Polyline pline in x){
      txt.Add(" ");
      txt.Add(string.Format("CGAL_Polyline p{0} ", count) + "{");

      foreach(Point3d p in pline)
        txt.Add(string.Format("IK::Point_3({0}, {1}, {2}),", Math.Round(p.X,10), Math.Round(p.Y,10), Math.Round(p.Z,10)));

      txt.Add("};");
      count++;
    }

    txt.Add(" ");
    count = 0;
    foreach(Polyline pline in x){

      txt.Add(string.Format("polylines.push_back (p{0});", count));
      count++;
    }

    A = txt;
# ---------- end polyline_to_cgal_polylines ----------
loft_9 = LoftPolylines(Curve0=pline_13, Fast=True)  # disabled
dispatch_3 = Dispatch(List=flatten(loft_7), DispatchPattern=c_script_2.adj)  # -> ListA, ListB; disabled
crv_55 = Curve(c_script_11.A)  # disabled
crv_56 = Curve(c_script_12.A)  # disabled
pline_14 = PolyLine(Vertices=flip_2, Closed=False)  # disabled
c_script_14 = CSharpScript(type=panel_30, plines0=pline_9, plines1=crv_49, bool0=panel_26, bool1=panel_27, unit_scale=toggle_4)  # -> out, joint; inputs type: Int32, plines0: list, plines1: list, bool0: list of Int32, bool1: list of Int32, unit_scale: Int32; disabled; same code as c_script
loft_10 = Loft(Curves=pline_13, Options={Adjust=False, Closed=False, LoftEnds=0, LoftSimp=0, LoftType=0, Rebuild=10, Refit=0.01})  # disabled
swatch_6 = ColourSwatch(SwatchColor=RGB(191, 0, 96))  # disabled
swatch_7 = ColourSwatch(SwatchColor=RGB(196, 196, 196))  # disabled
preview_4 = CustomPreview(Geometry=dispatch_3.ListB, Material=swatch_6)  # disabled
preview_5 = CustomPreview(Geometry=dispatch_3.ListA, Material=swatch_7)  # disabled
cap_2 = CapHoles(Brep=loft_8)  # disabled
cap_3 = CapHoles(Brep=loft_10)  # disabled
cp_13 = ControlPoints(Curve=c_script_12.A)  # -> Points, Weights, Knots; disabled
cp_14 = ControlPoints(Curve=pline_7)  # -> Points, Weights, Knots; disabled
panel_31 = Panel(c_script_13.joint)  # disabled
panel_32 = Panel(cp_13.Points)  # disabled
panel_33 = Panel(cp_14.Points)  # disabled
cp_15 = ControlPoints(Curve=c_script_11.A)  # -> Points, Weights, Knots; disabled
cp_16 = ControlPoints(Curve=pline_8)  # -> Points, Weights, Knots; disabled
panel_34 = Panel(cp_15.Points)  # disabled
panel_35 = Panel(cp_16.Points)  # disabled
path = FilePath("C:\IBOIS57\_Code\Software\Python\compas_wood\src\compas_wood\joinery_library.xml")  # disabled

# ---- group: write_xml
merge_17 = Merge(Data1=c_script_7.joint, Data2=c_script_10.joint, Data3=c_script_4.joint, Data4=c_script_13.joint)  # disabled
path_2 = FilePath("C:\Users\petra\AppData\Roaming\Grasshopper\Libraries\compas_wood\joinery_library.xml")  # disabled
c_script_15 = CSharpScript(path=[path_2, path], tiles=merge_17)  # -> out, A; inputs path: String, tiles: list; disabled
# ---------- c_script_15: C# ----------
    try{
      //Print(joint.GetType().ToString());
      //Tuple<int,List<Polyline>,List<Polyline>,List<int>,List<int>> joint_params = (Tuple<int,List<Polyline>,List<Polyline>,List<int>,List<int>> )joint;

      XmlWriter xmlWriter = XmlWriter.Create(path);
      xmlWriter.WriteStartDocument();

      /////////////////////////////////////////////////////////////////////////////////////////////////////////////////////////////////////////////
      //Start document
      /////////////////////////////////////////////////////////////////////////////////////////////////////////////////////////////////////////////
      xmlWriter.WriteStartElement("custom_joints");
      for(int i = 0; i < tiles.Count;i++){
        var list = ((List < object >) tiles[i]);

        var type = (int) (Object) list[0];
        Print(type.ToString());
        var plines0 = new List<Polyline>();
        var plines1 = new List<Polyline>();
        var bool0 = (List<int>) list[3];
        var bool1 = (List<int>) list[4];
        var unit_scale = (int) (Object) list[5];



        foreach(var o in (List<Object>) list[1]){
          
          
          //Print(o.GetType().ToString());
          var pcurve = (Curve) o;
          Polyline pline;
          pcurve.TryGetPolyline(out pline);
          plines0.Add(pline);
        }


        foreach(var o in (List<Object>) list[2]){
          var pcurve = (Curve) o;
          Polyline pline;
          pcurve.TryGetPolyline(out pline);
          plines1.Add(pline);
        }



        if(plines0.Count == bool0.Count * 2 && plines1.Count == bool1.Count * 2)
          write_joint(ref xmlWriter, type, plines0, plines1, bool0, bool1, unit_scale);
        else{
          this.Component.AddRuntimeMessage(GH_RuntimeMessageLevel.Error,
            String.Format("Number of polylines must be equal to (number of booleans)*2 \n plines0 - {0}, bool0 - {1}, plines1 - {2}, bool1 - {3}", plines0.Count, bool0.Count, plines1.Count, bool1.Count));
        }

      }

      /////////////////////////////////////////////////////////////////////////////////////////////////////////////////////////////////////////////
      //End document
      /////////////////////////////////////////////////////////////////////////////////////////////////////////////////////////////////////////////
      xmlWriter.WriteEndDocument();
      xmlWriter.Close();
    }catch(Exception e){
      Rhino.RhinoApp.WriteLine(e.ToString());
    }
# ---------- c_script_15: C# additional code ----------
  public void write_joint(ref XmlWriter xmlWriter, int type, List<Polyline> plines0, List<Polyline> plines1, List<int> bool0, List<int> bool1, int unit_scale){

    string joint_name = "";
    switch (type) {
      case(0):
      case(12):
        joint_name = "ss_e_ip_9";
        break;
      case(1):
      case(11):
        joint_name = "ss_e_op_9";
        break;
      case(2):
      case(20):
        joint_name = "ts_e_p_9";
        break;
      case(3):
      case(30):
        joint_name = "cr_c_ip_9";
        break;
      case(4):
      case(40):
        joint_name = "tt_e_p_9";
        break;
      case(5):
      case(50):
        joint_name = "ss_e_r_9";
        break;
    }

    /////////////////////////////////////////////////////////////////////////////////////////////////////////////////////////////////////////////
    //Start document
    /////////////////////////////////////////////////////////////////////////////////////////////////////////////////////////////////////////////
    xmlWriter.WriteStartElement(joint_name);

    for(int i = 0; i < plines0.Count; i++){
      string name = i % 2 == 0 ? "f0" : "f1";
      xml_polyline(ref xmlWriter, plines0[i], name);
    }

    for(int i = 0; i < plines1.Count; i++){
      string name = i % 2 == 0 ? "m0" : "m1";
      xml_polyline(ref xmlWriter, plines1[i], name);
    }

    xml_int_list(ref xmlWriter, bool0, "f_boolean_type");
    xml_int_list(ref xmlWriter, bool1, "m_boolean_type");
    xml_int_list(ref xmlWriter, new List<int>{unit_scale}, "properties");

    xmlWriter.WriteEndElement();
    /////////////////////////////////////////////////////////////////////////////////////////////////////////////////////////////////////////////
    //End document
    /////////////////////////////////////////////////////////////////////////////////////////////////////////////////////////////////////////////


  }

  public void xml_int_list(ref XmlWriter xmlWriter, List<int> numbers, string name){
    xmlWriter.WriteStartElement(name);
    foreach(int n in numbers){

      xmlWriter.WriteStartElement("id");
      xmlWriter.WriteString(n.ToString());
      xmlWriter.WriteEndElement();

    }
    xmlWriter.WriteEndElement();
  }

  public void xml_polyline(ref XmlWriter xmlWriter, Polyline pline, string name){
    xmlWriter.WriteStartElement(name);
    foreach(Point3d p in pline){

      xmlWriter.WriteStartElement("point");

      xmlWriter.WriteStartElement("x");
      xmlWriter.WriteString(Math.Round(p.X, 10).ToString());
      xmlWriter.WriteEndElement();

      xmlWriter.WriteStartElement("y");
      xmlWriter.WriteString(Math.Round(p.Y, 10).ToString());
      xmlWriter.WriteEndElement();

      xmlWriter.WriteStartElement("z");
      xmlWriter.WriteString(Math.Round(p.Z, 10).ToString());
      xmlWriter.WriteEndElement();

      xmlWriter.WriteEndElement();
    }
    xmlWriter.WriteEndElement();
  }
# ---------- end c_script_15 ----------

# ----
xml_tree = Xml_tree()  # disabled
panel_36 = Panel(path_2)  # disabled
panel_37 = Panel(c_script_15.out)  # disabled
crv_57 = Curve([<curve referenced from the Rhino model> x4])
cp_17 = ControlPoints(Curve=crv_57)  # -> Points, Weights, Knots
number_slider_36 = Slider(19, range=10..19)
pline_15 = PolyLine(Vertices=cp_17.Points, Closed=False)
number_slider_37 = Slider(0.2, range=0..1.001)

crv_58 = Curve([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])
c_script_16 = CSharpScript(rect_pair=crv_58)  # -> out, A, B, C; inputs rect_pair: list of Polyline
# ---------- c_script_16: C# ----------
    this.Component.Message = "ss_e_ip_2 Japanese Dovetail";
    ////////////////////////////////////////////////////////////////////
    //Number of divisions
    //Input joint line (its lengths)
    //Input distance for division
    ////////////////////////////////////////////////////////////////////
    double joint_length = Math.Abs(500);
    double division_distance = Math.Abs(60);
    int divisions = (int) Math.Ceiling(joint_length / division_distance);
    divisions = (int) Math.Max(2, Math.Min(20, divisions));
    divisions += divisions % 2;
    ////////////////////////////////////////////////////////////////////
    //Interpolate points
    ////////////////////////////////////////////////////////////////////
    Point3d[][] arrays = new Point3d[4][];
    for(int i = 0; i < 4; i++)
      arrays[i] = InterpolatePoints(rect_pair[0][i], rect_pair[1][i], divisions, false);

    ////////////////////////////////////////////////////////////////////
    //Move segments
    ////////////////////////////////////////////////////////////////////
    int start = 0;
    double t = 0.1;
    Vector3d v = t == 0 ? Vector3d.Zero : new Vector3d(0, 0, t / (divisions + 2));

    Vector3d translation = new Vector3d(0, 0, 0.025);
    for(int i = start; i < 4; i++){

      int mid = (int) (arrays[i].Length * 0.5);

      for(int j = 0; j < arrays[i].Length; j++){

        int flip = (j % 2 == 0) ? 1 : -1;
        flip = i < 2 ? flip : flip * -1;

        if(j == mid || j == (mid - 1) ){
          arrays[i][j] -= v * flip;
        }else{
          int flip_ = (i % 4 == 0 || i % 4 == 1) ? 1 : -1;
          int mirror_flip = j > mid ? 1 : -1;
          arrays[i][j] += v * flip_ * mirror_flip;
        }



        if(i == 0 || i == 3){
          int flip_t = (j >= mid) ? 1 : -1;
           arrays[i][j] += flip_t * translation;
        }

      }
    }


    ////////////////////////////////////////////////////////////////////
    //Create Polylines
    ////////////////////////////////////////////////////////////////////
    Polyline[] m_0 = new Polyline[2];
    Polyline[] m_1 = new Polyline[2];
    Polyline[] f_0 = new Polyline[2];
    Polyline[] f_1 = new Polyline[2];


    for(int i = 0; i < 4;i += 2){
      Polyline pline = new Polyline();
      for(int j = 0; j < arrays[0].Length; j++){

        bool flip = j % 2 < 1;
        flip = i < 2 ? flip : !flip;

        if(flip){
          pline.Add(arrays[i + 0][j]);
          pline.Add(arrays[i + 1][j]);
        } else{
          pline.Add(arrays[i + 1][j]);
          pline.Add(arrays[i + 0][j]);
        }

      }




      if(i < 2){
        m_1[0] = pline;

        m_1[1] = new Polyline(){pline[0],pline[pline.Count - 1]};
      }else{
        m_0[0] = pline;
        m_0[1] = new Polyline(){pline[0],pline[pline.Count - 1]};
      }
    }



    for(int i = 1; i < 4;i += 2){
      Polyline pline = new Polyline();
      for(int j = 0; j < arrays[0].Length; j++){

        bool flip = j % 2 == 0;
        flip = i < 2 ? flip : !flip;

        if(!flip){
          pline.Add(arrays[i + 0][j]);
          pline.Add(arrays[(i + 1) % 4][j]);
        } else{
          pline.Add(arrays[(i + 1) % 4][j]);
          pline.Add(arrays[i + 0][j]);
        }

      }

      if(i < 2){
        f_0[0] = pline;
        f_0[1] = new Polyline(){pline[0],pline[pline.Count - 1]};
      }else{
        f_1[0] = pline;
        f_1[1] = new Polyline(){pline[0],pline[pline.Count - 1]};
      }
    }

    ////////////////////////////////////////////////////////////////////
    //Create bisectors by mobing end point to corners
    ////////////////////////////////////////////////////////////////////
    double mismatch = 0.01;
    f_1[0][0] = f_1[0][1];
    f_1[0][1] += new Vector3d(mismatch, 0, 0);

    f_1[0][f_1[0].Count - 1] = f_1[0][f_1[0].Count - 2];
    f_1[0][f_1[0].Count - 2] += new Vector3d(mismatch, 0, 0);

    //Line
    f_1[1] = new Polyline(){f_1[0][0],f_1[0][f_1[0].Count - 1]};


    m_0[0][0] = m_0[0][1];
    m_0[0][1] += new Vector3d(mismatch, 0, 0);

    m_0[0][m_0[0].Count - 1] = m_0[0][m_0[0].Count - 2];
    m_0[0][m_0[0].Count - 2] += new Vector3d(mismatch, 0, 0);

    //Line
    m_0[1] = new Polyline(){m_0[0][0],m_0[0][m_0[0].Count - 1]};


    ////////////////////////////////////////////////////////////////////
    //Output
    ////////////////////////////////////////////////////////////////////

    var dt0 = new DataTree<Polyline>();
    dt0.AddRange(m_0, new GH_Path(0));
    dt0.AddRange(m_1, new GH_Path(0));

    var dt1 = new DataTree<Polyline>();
    dt1.AddRange(f_0, new GH_Path(0));
    dt1.AddRange(f_1, new GH_Path(0));
    A = dt0;
    B = dt1;
# ---------- c_script_16: C# additional code ----------
  public  Point3d[] InterpolatePoints(Point3d from, Point3d to, int Steps, bool includeEnds = true) {
    Point3d[] point3DArray;

    if (includeEnds) {
      point3DArray = new Point3d[Steps + 2];
      point3DArray[0] = from;

      for (int i = 1; i < Steps + 1; i++) {
        double num = i / (double) (1 + Steps);

        point3DArray[i] = new Point3d(
          Lerp(from.X, to.X, num),
          Lerp(from.Y, to.Y, num),
          Lerp(from.Z, to.Z, num)
          );
      }

      point3DArray[point3DArray.Length - 1] = to;
    } else {

      point3DArray = new Point3d[Steps];

      for (int i = 1; i < Steps + 1; i++) {
        double num = i / (double) (1 + Steps);

        point3DArray[i - 1] = new Point3d(
          Lerp(from.X, to.X, num),
          Lerp(from.Y, to.Y, num),
          Lerp(from.Z, to.Z, num)
          );
      }
    }

    return point3DArray;


  }

  public double Lerp(double value1, double value2, double amount) {
    return value1 + (value2 - value1) * amount;
  }
# ---------- end c_script_16 ----------

crv_59 = Curve([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])
c_script_17 = CSharpScript(rect_pair=crv_59)  # -> out, A, B, C; inputs rect_pair: list of Polyline
# ---------- c_script_17: C# ----------
    this.Component.Message = "ss_e_op_2 Dovetail";
    ////////////////////////////////////////////////////////////////////
    //Number of divisions
    //Input joint line (its lengths)
    //Input distance for division
    ////////////////////////////////////////////////////////////////////
    double joint_length = Math.Abs(500);
    double division_distance = Math.Abs(60);
    int divisions = (int) Math.Ceiling(joint_length / division_distance);
    divisions = (int) Math.Max(2, Math.Min(20, divisions));
    divisions += divisions % 2;
    ////////////////////////////////////////////////////////////////////
    //Interpolate points
    ////////////////////////////////////////////////////////////////////
    Point3d[][] arrays = new Point3d[4][];
    for(int i = 0; i < 4; i++)
      arrays[i] = InterpolatePoints(rect_pair[0][i], rect_pair[1][i], divisions, false);

    ////////////////////////////////////////////////////////////////////
    //Move segments
    ////////////////////////////////////////////////////////////////////
    int start = 0;
    double t = 0.1;
    Vector3d v = t == 0 ? Vector3d.Zero : new Vector3d(0, 0, t / (divisions + 2));
    for(int i = start; i < 4; i++){

      int mid = (int) (arrays[i].Length * 0.5);

      for(int j = 0; j < arrays[i].Length; j++){

        int flip = (j % 2 == 0) ? 1 : -1;
        flip = i < 2 ? flip : flip * -1;

        arrays[i][j] += v * flip;



      }
    }

    ////////////////////////////////////////////////////////////////////
    //Create Polylines
    ////////////////////////////////////////////////////////////////////
    Polyline[] m_0 = new Polyline[2];
    Polyline[] m_1 = new Polyline[2];
    Polyline[] f_0 = new Polyline[2];
    Polyline[] f_1 = new Polyline[2];


    for(int i = 0; i < 4;i += 2){
      Polyline pline = new Polyline();
      for(int j = 0; j < arrays[0].Length; j++){

        bool flip = j % 2 < 1;
        flip = i < 2 ? flip : !flip;

        if(!flip){
          pline.Add(arrays[i + 0][j]);
          pline.Add(arrays[i + 1][j]);
        } else{
          pline.Add(arrays[i + 1][j]);
          pline.Add(arrays[i + 0][j]);
        }

      }

      if(i < 2){
        m_1[0] = pline;
        m_1[1] = new Polyline(){pline[0],pline[pline.Count - 1]};
      }else{
        m_0[0] = pline;
        m_0[1] = new Polyline(){pline[0],pline[pline.Count - 1]};
      }
    }

    
    
    
    
    
    
    
    
    for(int i = 1; i < 4;i += 2){
      Polyline pline = new Polyline();
      for(int j = 0; j < arrays[0].Length; j++){

        bool flip = j % 2 == 0;
        flip = i < 2 ? flip : !flip;

        if(flip){
          pline.Add(arrays[i + 0][j]);
          pline.Add(arrays[(i + 1) % 4][j]);
        } else{
          pline.Add(arrays[(i + 1) % 4][j]);
          pline.Add(arrays[i + 0][j]);
        }

      }

      if(i < 2){
        f_0[0] = pline;
        f_0[1] = new Polyline(){pline[0],pline[pline.Count - 1]};
      }else{
        f_1[0] = pline;
        f_1[1] = new Polyline(){pline[0],pline[pline.Count - 1]};
      }
    }



    ////////////////////////////////////////////////////////////////////
    //Output
    ////////////////////////////////////////////////////////////////////

    var dt0 = new DataTree<Polyline>();
    var dt1 = new DataTree<Polyline>();
    dt0.AddRange(m_0, new GH_Path(0));
    dt0.AddRange(m_1, new GH_Path(0));
    dt1.AddRange(f_0, new GH_Path(0));
    dt1.AddRange(f_1, new GH_Path(0));
    A = dt0;
    B = dt1;
    // B = arrays;
    // C = "ss_e_op_0_" + divisions.ToString();
# ---------- c_script_17: C# additional code ----------
  public  Point3d[] InterpolatePoints(Point3d from, Point3d to, int Steps, bool includeEnds = true) {
    Point3d[] point3DArray;

    if (includeEnds) {
      point3DArray = new Point3d[Steps + 2];
      point3DArray[0] = from;

      for (int i = 1; i < Steps + 1; i++) {
        double num = i / (double) (1 + Steps);

        point3DArray[i] = new Point3d(
          Lerp(from.X, to.X, num),
          Lerp(from.Y, to.Y, num),
          Lerp(from.Z, to.Z, num)
          );
      }

      point3DArray[point3DArray.Length - 1] = to;
    } else {

      point3DArray = new Point3d[Steps];

      for (int i = 1; i < Steps + 1; i++) {
        double num = i / (double) (1 + Steps);

        point3DArray[i - 1] = new Point3d(
          Lerp(from.X, to.X, num),
          Lerp(from.Y, to.Y, num),
          Lerp(from.Z, to.Z, num)
          );
      }
    }

    return point3DArray;


  }

  public double Lerp(double value1, double value2, double amount) {
    return value1 + (value2 - value1) * amount;
  }
# ---------- end c_script_17 ----------
clean = CleanTree(RemoveNulls=True, RemoveInvalid=True, RemoveEmpty=invert(False), Tree=c_script_17.A)
item_10 = ListItem(List=clean, Index=0, Wrap=True)  # -> Item, Item1, Item2, Item3, Item4, Item5, Item6, Item7
crv_60 = Curve([item_10.Item4, item_10.Item6])
crv_61 = Curve([item_10.Item, item_10.Item2])
loft_11 = Loft(Curves=crv_61, Options={Adjust=False, Closed=False, LoftEnds=0, LoftSimp=0, LoftType=0, Rebuild=10, Refit=0.01})
loft_12 = Loft(Curves=crv_60, Options={Adjust=False, Closed=False, LoftEnds=0, LoftSimp=0, LoftType=0, Rebuild=10, Refit=0.01})

crv_62 = Curve(<curve referenced from the Rhino model>)
crv_63 = Curve(Tree({0;0}: [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], {0;1}: [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], {0;2}: [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], {0;3}: [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]))

crv_64 = Curve([<curve referenced from the Rhino model> x4])
panel_38 = Panel("""6
6""")
panel_39 = Panel("""6
6""")
c_script_18 = CSharpScript(type="5", plines0=flatten(crv_63), plines1=flatten(crv_63), bool0=panel_39, bool1=panel_38, unit_scale=Toggle(False))  # -> out, joint; inputs type: Int32, plines0: list of Polyline, plines1: list of Polyline, bool0: list of Int32, bool1: list of Int32, unit_scale: Int32
# ---------- c_script_18: C# ----------
    joint = new Grasshopper.Kernel.Types.GH_ObjectWrapper (new List < object > {type, (object)plines0, (object)plines1, bool0, bool1,unit_scale});
    this.Component.Message = " Plines order \n Top,Bottom,Top,Bottom ";
# ---------- end c_script_18 ----------

divlength = DivideLength()  # -> Points, Tangents, Parameters

# ---- group: joints_params
joints_params_2 = Joints_params(
    ss_e_ip_len=Slider(300, range=30..3000),
    ss_e_ip_shift=Slider(0.5, range=0..1),
    ss_e_ip_type=Slider(9, range=1..9),
    ss_e_op_len=Slider(4, range=1..100),
    ss_e_op_shift=Slider(0.75, range=0..1),
    ss_e_op_type=Slider(19, range=10..19),
    ts_e_p_len=Slider(315, range=30..3000),
    ts_e_p_shift=Slider(0.5, range=0..1),
    ts_e_p_type=Slider(21, range=20..29),
    cr_c_ip_len=Slider(300, range=30..3000),
    cr_c_ip_shift=Slider(0.5, range=0..1),
    cr_c_ip_type=Slider(30, range=30..39),
    tt_e_p_len=Slider(300, range=30..3000),
    tt_e_p_shift=Slider(0.5, range=0..1),
    tt_e_p_type=Slider(40, range=40..49),
    ss_e_r_len=Slider(300, range=30..3000),
    ss_e_r_shift=Slider(0.5, range=0..1),
    ss_e_r_type=Slider(50, range=50..59))

# ----
crv_65 = Curve([<curve referenced from the Rhino model> x4])
input_set_5 = Input_set(Plines=crv_65)
solver_3 = Solver(Data=input_set_5, Join=joints_params_2, Find=0, Get=Slider(4, range=0..10))
solver_4 = Solver(Data=input_set_5, Join=joints_params_2, Find=0, Get=Slider(3, range=0..10))
input_get_3 = Input_get(Data=solver_4)  # -> Plines, Insertion_vectors, Joints_per_face, Three_valence, Adjacency
input_get_4 = Input_get(Data=solver_3)  # -> Plines, Insertion_vectors, Joints_per_face, Three_valence, Adjacency

crv_66 = Curve([<curve referenced from the Rhino model> x4])
divide = DivideCurve(Curve=crv_62, Count=10, Kinks=invert(False))  # -> Points, Tangents, Parameters

panel_40 = Panel("""1
1""")
panel_41 = Panel("""1
1""")
c_script_19 = CSharpScript(type="1", plines0=c_script_16.A, plines1=c_script_16.B, bool0=panel_40, bool1=panel_41, unit_scale=Toggle(False))  # -> out, joint; inputs type: Int32, plines0: list of Polyline, plines1: list of Polyline, bool0: list of Int32, bool1: list of Int32, unit_scale: Int32; same code as c_script

topoly = CurveToPolyline(Curve=crv_62, ToleranceDistance=number_slider_37, ToleranceAngle=number_slider_37)  # -> Polyline, Segments
cp_18 = ControlPoints(Curve=topoly.Polyline)  # -> Points, Weights, Knots
pline_16 = PolyLine(Vertices=cp_18.Points, Closed=False)

# ---- group: write_xml
path_3 = FilePath("C:\IBOIS57\_Code\Software\Python\compas_wood\src\compas_wood\joinery_library.xml")
path_4 = FilePath("C:\Users\petra\AppData\Roaming\Grasshopper\Libraries\compas_wood\joinery_library.xml")
merge_18 = Merge(Data1=c_script_19.joint, Data2=c_script_18.joint)
c_script_20 = CSharpScript(path=path_3, tiles=merge_18)  # -> out, A; inputs path: String, tiles: list
# ---------- c_script_20: C# ----------
    try{
      //Print(joint.GetType().ToString());
      //Tuple<int,List<Polyline>,List<Polyline>,List<int>,List<int>> joint_params = (Tuple<int,List<Polyline>,List<Polyline>,List<int>,List<int>> )joint;

      XmlWriter xmlWriter = XmlWriter.Create(path);
      xmlWriter.WriteStartDocument();

      /////////////////////////////////////////////////////////////////////////////////////////////////////////////////////////////////////////////
      //Start document
      /////////////////////////////////////////////////////////////////////////////////////////////////////////////////////////////////////////////
      xmlWriter.WriteStartElement("custom_joints");
      for(int i = 0; i < tiles.Count;i++){
        var list = ((List < object >) tiles[i]);

        var type = (int) (Object) list[0];
        Print(type.ToString());
        var plines0 = new List<Polyline>();
        var plines1 = new List<Polyline>();
        var plines0_ = new List<Polyline>();
        var plines1_ = new List<Polyline>();
        var bool0 = (List<int>) list[3];
        var bool1 = (List<int>) list[4];
        var unit_scale = (int) (Object) list[5];


        int count = 0;
        foreach(var pline in (List<Polyline>) list[1]){
          //Print(o.GetType().ToString());
         // var pcurve = (Curve) o;
          //Polyline pline;
          //pcurve.TryGetPolyline(out pline);
          if(count % 2 == 0)
            plines0.Add(pline);
          else
            plines0_.Add(pline);
          count++;
        }
        plines0.AddRange(plines0_);

        count = 0;
        foreach(var pline in (List<Polyline>) list[2]){
//          var pcurve = (Curve) o;
//          Polyline pline;
//          pcurve.TryGetPolyline(out pline);
          if(count % 2 == 0)
            plines1.Add(pline);
          else
            plines1_.Add(pline);
          count++;
        }
        plines1.AddRange(plines1_);


        if(plines0.Count == bool0.Count * 2 && plines1.Count == bool1.Count * 2)
          write_joint(ref xmlWriter, type, plines0, plines1, bool0, bool1, unit_scale);
        else{
          this.Component.AddRuntimeMessage(GH_RuntimeMessageLevel.Error,
            String.Format("Number of polylines must be equal to (number of booleans)*2 \n plines0 - {0}, bool0 - {1}, plines1 - {2}, bool1 - {3}", plines0.Count, bool0.Count, plines1.Count, bool1.Count));
        }

      }

      /////////////////////////////////////////////////////////////////////////////////////////////////////////////////////////////////////////////
      //End document
      /////////////////////////////////////////////////////////////////////////////////////////////////////////////////////////////////////////////
      xmlWriter.WriteEndDocument();
      xmlWriter.Close();
    }catch(Exception e){
      Rhino.RhinoApp.WriteLine(e.ToString());
    }
# ---------- c_script_20: C# additional code ----------
  public void write_joint(ref XmlWriter xmlWriter, int type, List<Polyline> plines0, List<Polyline> plines1, List<int> bool0, List<int> bool1, int unit_scale){

    string joint_name = "";
    switch (type) {
      case(0):
      case(12):
        joint_name = "ss_e_ip_9";
        break;
      case(1):
      case(11):
        joint_name = "ss_e_op_9";
        break;
      case(2):
      case(20):
        joint_name = "ts_e_p_9";
        break;
      case(3):
      case(30):
        joint_name = "cr_c_ip_9";
        break;
      case(4):
      case(40):
        joint_name = "tt_e_p_9";
        break;
      case(5):
      case(50):
        joint_name = "ss_e_r_9";
        break;
    }

    /////////////////////////////////////////////////////////////////////////////////////////////////////////////////////////////////////////////
    //Start document
    /////////////////////////////////////////////////////////////////////////////////////////////////////////////////////////////////////////////
    xmlWriter.WriteStartElement(joint_name);

    for(int i = 0; i < plines0.Count; i++){
      string name = i % 2 == 0 ? "f0" : "f1";
      xml_polyline(ref xmlWriter, plines0[i], name);
    }

    for(int i = 0; i < plines1.Count; i++){
      string name = i % 2 == 0 ? "m0" : "m1";
      xml_polyline(ref xmlWriter, plines1[i], name);
    }

    xml_int_list(ref xmlWriter, bool0, "f_boolean_type");
    xml_int_list(ref xmlWriter, bool1, "m_boolean_type");
    xml_int_list(ref xmlWriter, new List<int>{unit_scale}, "properties");

    xmlWriter.WriteEndElement();
    /////////////////////////////////////////////////////////////////////////////////////////////////////////////////////////////////////////////
    //End document
    /////////////////////////////////////////////////////////////////////////////////////////////////////////////////////////////////////////////


  }

  public void xml_int_list(ref XmlWriter xmlWriter, List<int> numbers, string name){
    xmlWriter.WriteStartElement(name);
    foreach(int n in numbers){

      xmlWriter.WriteStartElement("id");
      xmlWriter.WriteString(n.ToString());
      xmlWriter.WriteEndElement();

    }
    xmlWriter.WriteEndElement();
  }

  public void xml_polyline(ref XmlWriter xmlWriter, Polyline pline, string name){
    xmlWriter.WriteStartElement(name);
    foreach(Point3d p in pline){

      xmlWriter.WriteStartElement("point");

      xmlWriter.WriteStartElement("x");
      xmlWriter.WriteString(Math.Round(p.X, 10).ToString());
      xmlWriter.WriteEndElement();

      xmlWriter.WriteStartElement("y");
      xmlWriter.WriteString(Math.Round(p.Y, 10).ToString());
      xmlWriter.WriteEndElement();

      xmlWriter.WriteStartElement("z");
      xmlWriter.WriteString(Math.Round(p.Z, 10).ToString());
      xmlWriter.WriteEndElement();

      xmlWriter.WriteEndElement();
    }
    xmlWriter.WriteEndElement();
  }
# ---------- end c_script_20 ----------
panel_42 = Panel(c_script_20.out)
panel_43 = Panel(path_4)

# ----
number_slider_38 = Slider(1, range=0..100)
crv_67 = Curve(input_get_3.Plines)
branch = TreeBranch(Tree=simplify(input_get_4.Plines), Path=number_slider_38, MaintainPaths=True)
branch_2 = TreeBranch(Tree=simplify(input_get_3.Plines), Path=number_slider_38, MaintainPaths=True)
loft_13 = Loft(
    Curves=input_get_4.Plines,
    Options={Adjust=False, Closed=False, LoftEnds=0, LoftSimp=0, LoftType=0, Rebuild=10, Refit=0.01})
loft_14 = Loft(Polylines1=input_get_4.Plines)  # -> flatten(Mesh)
cap_4 = CapHoles(Brep=loft_13)
item_11 = ListItem(List=loft_14, Index=0, Wrap=True)  # -> Item, Item1
partition_2 = PartitionList(List=branch_2, Size=2)
preview_6 = CustomPreview(
    Geometry=item_11.Item,
    Material={diffuse=RGB(221, 160, 221), emission=RGB(66, 48, 66), shine=0.5, specular=RGB(255, 255, 255), transparency=0})
preview_7 = CustomPreview(Geometry=item_11.Item1, Material=ColourSwatch(SwatchColor=RGB(255, 0, 0)))
item_12 = ListItem(List=partition_2, Index=1, Wrap=True)

# ==== cluster Cluster
data = ClusterInput()
solver = Solver(Data=data, Get=2, Get_2=4)
input_get = Input_get(Data=solver)  # -> Plines, Insertion_vectors, Joints_per_face, Three_valence, Adjacency
item = ListItem(List=input_get.Plines, Index=2, Wrap=True)  # -> Item, Item1
i = ClusterOutput([item.Item, item.Item1])
display = CurvePreview(Curve=[item.Item, item.Item1], Width=Slider(9, range=0..10))

# ==== cluster Xml_tree: xml_tree

panel = Panel("""0
0""")
panel_2 = Panel("""0
0""")
crv = Curve([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])
panel_3 = Panel("""2
1""")
entwine = Entwine(Branch00=crv, Branch01=crv, FlattenInputs=True)
entwine_2 = Entwine(Branch00=panel, Branch01=panel, FlattenInputs=True)
entwine_3 = Entwine(Branch00=panel_2, Branch01=panel_2, FlattenInputs=True)
c_script = CSharpScript(type=panel_3, plines0=entwine, plines1=entwine, bool0=entwine_2, bool1=entwine_3)  # -> out, A; inputs type: list of Int32, plines0: tree of Polyline, plines1: tree of Polyline, bool0: tree of Int32, bool1: tree of Int32
# ---------- c_script: C# usings ----------
using System.Xml;
# ---------- c_script: C# ----------
    XmlWriter xmlWriter = XmlWriter.Create("C:\\Users\\petra\\Desktop\\New folder\\joint_library.xml");
    xmlWriter.WriteStartDocument();


    /////////////////////////////////////////////////////////////////////////////////////////////////////////////////////////////////////////////
    //Start document
    /////////////////////////////////////////////////////////////////////////////////////////////////////////////////////////////////////////////
    xmlWriter.WriteStartElement("custom_joints");
    for(int i = 0; i < type.Count;i++){
      write_joint(ref xmlWriter, type[i], plines0.Branch(i), plines1.Branch(i), bool0.Branch(i), bool1.Branch(i));
      Print("hi");
    }

    /////////////////////////////////////////////////////////////////////////////////////////////////////////////////////////////////////////////
    //End document
    /////////////////////////////////////////////////////////////////////////////////////////////////////////////////////////////////////////////
    xmlWriter.WriteEndDocument();
    xmlWriter.Close();
# ---------- c_script: C# additional code ----------
  public void write_joint(ref XmlWriter xmlWriter, int type, List<Polyline> plines0, List<Polyline> plines1, List<int> bool0, List<int> bool1){

    string joint_name = "";
    switch (type) {
      case(0):
      case(12):
        joint_name = "ss_e_ip_9";
        break;
      case(1):
      case(11):
        joint_name = "ss_e_op_9";
        break;
      case(2):
      case(20):
        joint_name = "ts_e_p_9";
        break;
      case(3):
      case(30):
        joint_name = "cr_c_ip_9";
        break;
      case(4):
      case(40):
        joint_name = "tt_e_p_9";
        break;
      case(5):
      case(50):
        joint_name = "ss_e_r_9";
        break;
    }

    /////////////////////////////////////////////////////////////////////////////////////////////////////////////////////////////////////////////
    //Start document
    /////////////////////////////////////////////////////////////////////////////////////////////////////////////////////////////////////////////
    xmlWriter.WriteStartElement(joint_name);

    for(int i = 0; i < plines0.Count; i++){
      string name = i % 2 == 0 ? "f0" : "f1";
      xml_polyline(ref xmlWriter, plines0[i], name);
    }

    for(int i = 0; i < plines1.Count; i++){
      string name = i % 2 == 0 ? "m0" : "m1";
      xml_polyline(ref xmlWriter, plines0[i], name);
    }

    xml_int_list(ref xmlWriter, bool0, "f_boolean_type");
    xml_int_list(ref xmlWriter, bool1, "m_boolean_type");

xmlWriter.WriteEndElement();
    /////////////////////////////////////////////////////////////////////////////////////////////////////////////////////////////////////////////
    //End document
    /////////////////////////////////////////////////////////////////////////////////////////////////////////////////////////////////////////////


  }

  public void xml_int_list(ref XmlWriter xmlWriter, List<int> numbers, string name){
    xmlWriter.WriteStartElement(name);
    foreach(int n in numbers){

      xmlWriter.WriteStartElement("char");
      xmlWriter.WriteString(n.ToString());
      xmlWriter.WriteEndElement();

    }
    xmlWriter.WriteEndElement();
  }

  public void xml_polyline(ref XmlWriter xmlWriter, Polyline pline, string name){
    xmlWriter.WriteStartElement(name);
    foreach(Point3d p in pline){

      xmlWriter.WriteStartElement("point");

      xmlWriter.WriteStartElement("x");
      xmlWriter.WriteString(p.X.ToString());
      xmlWriter.WriteEndElement();

      xmlWriter.WriteStartElement("y");
      xmlWriter.WriteString(p.Y.ToString());
      xmlWriter.WriteEndElement();

      xmlWriter.WriteStartElement("z");
      xmlWriter.WriteString(p.Z.ToString());
      xmlWriter.WriteEndElement();

      xmlWriter.WriteEndElement();
    }
    xmlWriter.WriteEndElement();
  }
# ---------- end c_script ----------

out = ClusterOutput(c_script.out)
