# Grasshopper definition data_sets_cross_side_side.gh (Grasshopper 1.0.7)
# plug-ins: compas_wood

data = Data(Tree({0}: [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], {1}: [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]))
data_2 = Data(Tree({0;0}: [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], {0;1}: [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], {0;2}: [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], {0;3}: [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]))
data_3 = Data(Tree({0}: [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], {1}: [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], {2}: [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], {3}: [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], {4}: [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], {5}: [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]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))
data_4 = Data(Tree({0}: [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], {1}: [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]))
data_5 = Data(Tree({0}: [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], {1}: [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], {2}: [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], {3}: [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], {4}: [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], {5}: [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], {6}: [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], {7}: [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], {8}: [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]))
data_6 = Data(Tree({0}: [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], {1}: [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]))
data_7 = Data(Tree({0}: [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], {1}: [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], {2}: [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], {3}: [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]))
data_8 = Data(Tree({0}: [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], {1}: [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], {2}: [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], {3}: [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], {4}: [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], {5}: [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]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))
data_9 = Data(Tree({0}: [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], {1}: [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], {2}: [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], {3}: [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], {4}: [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], {5}: [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]))
data_10 = Data(Tree({0}: [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], {1}: [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], {2}: [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], {3}: [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], {4}: [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], {5}: [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]))
data_11 = Data(Tree({0}: [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], {1}: [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], {2}: [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], {3}: [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]))
data_12 = Data(Tree({0}: [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], {1}: [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], {2}: [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], {3}: [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]))
data_13 = Data(Tree({0}: [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], {1}: [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], {2}: [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], {3}: [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], {4}: [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], {5}: [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], {6}: [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], {7}: [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], {8}: [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], {9}: [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], {10}: [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], {11}: [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]))
data_14 = Data(Tree({0}: [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], {1}: [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], {2}: [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], {3}: [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], {4}: [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], {5}: [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]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))
data_15 = Data(Tree({0}: [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], {1}: [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], {2}: [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], {3}: [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], {4}: [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], {5}: [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], {6}: [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], {7}: [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]))
data_16 = Data(Tree({0}: [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], {1}: [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], {2}: [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], {3}: [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], {4}: [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], {5}: [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], {6}: [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], {7}: [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], {8}: [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], {9}: [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], {10}: [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], {11}: [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]))
data_17 = Data(Tree({0}: [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], {1}: [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], {2}: [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], {3}: [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], {4}: [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], {5}: [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], {6}: [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], {7}: [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], {8}: [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], {9}: [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], {10}: [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], {11}: [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]))
data_18 = Data(Tree({0}: [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], {1}: [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], {2}: [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], {3}: [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], {4}: [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], {5}: [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], {6}: [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], {7}: [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], {8}: [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], {9}: [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], {10}: [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]))
data_19 = Data(Tree({0}: [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], {1}: [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], {2}: [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], {3}: [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], {4}: [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], {5}: [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]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))
data_20 = Data([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])
data_21 = Data([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])
data_22 = Data(Tree({0}: [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], {1}: [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], {2}: [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], {3}: [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], {4}: [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], {5}: [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]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))
data_23 = Data(Tree({0}: [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], {1}: [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], {2}: [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], {3}: [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], {4}: [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], {5}: [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]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))

# ---- group: Cross
data_24 = Data(Tree({0;0}: [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], {0;1}: [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], {0;2}: [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], {0;3}: [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], {0;4}: [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], {0;5}: [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], {0;6}: [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], {0;7}: [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], {0;8}: [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], {0;9}: [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], {0;10}: [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]))
data_25 = Data(Tree({0}: [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], {1}: [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]))
data_26 = Data(Tree({0}: [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], {1}: [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], {2}: [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], {3}: [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], {4}: [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], {5}: [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], {6}: [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], {7}: [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], {8}: [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]))
data_27 = Data(Tree({0}: [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], {1}: [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], {2}: [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]))
data_28 = Data(Tree({0}: [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], {1}: [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]))
data_29 = Data(Tree({0}: [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], {1}: [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]))
data_30 = Data(Tree({0;0}: [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], {0;1}: [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], {0;2}: [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], {0;3}: [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], {0;4}: [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], {0;5}: [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]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))
data_31 = Data(Tree({0;0;0;0}: [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], {0;0;0;1}: [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], {0;0;0;2}: [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], {0;0;0;3}: [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], {0;0;0;4}: [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], {0;0;0;5}: [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]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))
data_32 = Data(Tree({0}: [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], {1}: [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], {2}: [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], {3}: [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], {4}: [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], {5}: [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]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))
data_33 = Data(Tree({0;0;0;0}: [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], {0;0;0;1}: [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], {0;0;0;2}: [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], {0;0;0;3}: [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], {0;0;0;4}: [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], {0;0;0;5}: [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]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))
data_34 = Data(Tree({0;0}: [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], {0;1}: [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], {0;2}: [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], {0;3}: [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], {0;4}: [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], {0;5}: [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]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))

# ----
input_set = Input_set(Plines=data_8)
input_set_2 = Input_set(Plines=data_34)

# ---- group: joints_params
joints_params = Joints_params(
    ss_e_ip_len=Slider(0, range=0..3000),
    ss_e_ip_shift=Slider(0.3, range=0..1),
    ss_e_ip_type=Slider(6, range=1..9),
    ss_e_op_len=Slider(450, range=30..3000),
    ss_e_op_shift=Slider(0.65, range=0..1),
    ss_e_op_type=Slider(10, range=10..19),
    ts_e_p_len=Slider(450, range=30..3000),
    ts_e_p_shift=Slider(0.5, range=0..1),
    ts_e_p_type=Slider(21, range=20..29),
    cr_c_ip_len=Slider(300, range=30..3000),
    cr_c_ip_shift=Slider(0.5, range=0..1),
    cr_c_ip_type=Slider(30, range=30..39),
    tt_e_p_len=Slider(300, range=30..3000),
    tt_e_p_shift=Slider(0.5, range=0..1),
    tt_e_p_type=Slider(40, range=40..49),
    ss_e_r_len=Slider(300, range=30..3000),
    ss_e_r_shift=Slider(0.5, range=0..1),
    ss_e_r_type=Slider(50, range=50..59))

# ----
solver = Solver(Data=input_set, Join=joints_params, Find=Slider(0, range=0..10), Get=4)
solver_2 = Solver(Data=input_set_2, Find=Slider(1, range=0..10), Get=4)
input_get = Input_get(Data=solver)  # -> Plines, Insertion_vectors, Joints_per_face, Three_valence, Adjacency
input_get_2 = Input_get(Data=solver_2)  # -> Plines, Insertion_vectors, Joints_per_face, Three_valence, Adjacency
loft = Loft(Polylines1=input_get.Plines)
loft_2 = Loft(Polylines1=input_get_2.Plines)
