# Grasshopper definition folded_plates.gh (Grasshopper 1.0.7)
# plug-ins: compas_wood, NGon

brep = Brep(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)

# ---- group: joints_params
joints_params = Joints_params(
    ss_e_ip_len=Slider(300, range=30..3000),
    ss_e_ip_shift=Slider(0.5, range=0..1),
    ss_e_ip_type=Slider(9, range=1..9),
    ss_e_op_len=Slider(450, range=30..3000),
    ss_e_op_shift=Slider(0.65, range=0..1),
    ss_e_op_type=Slider(13, range=10..19),
    ts_e_p_len=Slider(450, range=30..3000),
    ts_e_p_shift=Slider(0.5, range=0..1),
    ts_e_p_type=Slider(21, range=20..29),
    cr_c_ip_len=Slider(300, range=30..3000),
    cr_c_ip_shift=Slider(0.5, range=0..1),
    cr_c_ip_type=Slider(30, range=30..39),
    tt_e_p_len=Slider(300, range=30..3000),
    tt_e_p_shift=Slider(0.5, range=0..1),
    tt_e_p_type=Slider(40, range=40..49),
    ss_e_r_len=Slider(300, range=30..3000),
    ss_e_r_shift=Slider(0.5, range=0..1),
    ss_e_r_type=Slider(50, range=50..59))

# ----
case_3 = Case_3_folded_plates_component(
    Surface=brep,
    U_divisions=Slider(5, range=1..10),
    V_divisions=Slider(2, range=1..10),
    Thickness=Slider(1, range=0.1..10),
    Chamfer=Slider(0.5, range=0.01..1),
    Face_positions=Slider(0, range=-10..10))  # -> Mesh, Plates, Insertion, Adjacency, Flags
cp_lines = Closest_lines(Polylines=simplify(flatten(case_3.Plates)), Lines=case_3.Insertion)  # -> Polylines, Vectors
input_set = Input_set(Plines=cp_lines.Polylines, Adjacency=case_3.Adjacency)
data = Data(joints_params)
solver = Solver(Data=input_set, Join=data, Find=0, Get=Slider(4, range=0..4))
cluster = Cluster(data=input_set)
input_get = Input_get(Data=solver)  # -> Plines, Insertion_vectors, Joints_per_face, Three_valence, Adjacency
crv = Curve(reverse(input_get.Plines))
loft = Loft(Polylines1=crv)
dispatch = Dispatch(List=flatten(loft), DispatchPattern=case_3.Flags)  # -> ListA, ListB
preview = CustomPreview(Geometry=dispatch.ListB, Material=ColourSwatch(SwatchColor=RGB(122, 122, 122)))
preview_2 = CustomPreview(Geometry=dispatch.ListA, Material=ColourSwatch(SwatchColor=RGB(196, 196, 196)))

display = CurvePreview(Curve=crv)
swatch = ColourSwatch(SwatchColor=RGB(191, 0, 96))

# ==== cluster Cluster
data = ClusterInput()
solver = Solver(Data=data, Find=0, Get=2)
input_get = Input_get(Data=solver)  # -> Plines, Insertion_vectors, Joints_per_face, Three_valence, Adjacency
item = ListItem(List=input_get.Plines, Index=2, Wrap=True)  # -> Item, Item1
i = ClusterOutput([item.Item, item.Item1])
display = CurvePreview(Curve=[item.Item, item.Item1], Width=Slider(9, range=0..10))
