# Grasshopper definition ss_out_of_plane_simple_corner_joint_topologies.gh (Grasshopper 1.0.7)
# plug-ins: compas_wood

# ---- group: joints_params
joints_params = Joints_params(
    ss_e_ip_len=Slider(300, range=30..3000),
    ss_e_ip_shift=Slider(0.5, range=0..1),
    ss_e_ip_type=Slider(9, range=1..9),
    ss_e_op_len=Slider(261, range=30..3000),
    ss_e_op_shift=Slider(0.55, range=0..1),
    ss_e_op_type=Slider(11, range=10..19),
    ts_e_p_len=Slider(450, range=30..3000),
    ts_e_p_shift=Slider(0.5, range=0..1),
    ts_e_p_type=Slider(21, range=20..29),
    cr_c_ip_len=Slider(300, range=30..3000),
    cr_c_ip_shift=Slider(0.5, range=0..1),
    cr_c_ip_type=Slider(30, range=30..39),
    tt_e_p_len=Slider(300, range=30..3000),
    tt_e_p_shift=Slider(0.5, range=0..1),
    tt_e_p_type=Slider(40, range=40..49),
    ss_e_r_len=Slider(300, range=30..3000),
    ss_e_r_shift=Slider(0.5, range=0..1),
    ss_e_r_type=Slider(50, range=50..59))

# ----
# New Joint: Distort center joint
brep = Brep([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])
crv = Curve([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])
crv_2 = Curve([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])
partition = PartitionList(List=crv, Size=2)
input_set = Input_set(Plines=partition)
solver = Solver(Data=input_set, Join=joints_params, Find=0, Get=4)
loft = Loft(Curves=partition, Options={Adjust=False, Closed=False, LoftEnds=0, LoftSimp=0, LoftType=0, Rebuild=10, Refit=0.01})
input_get = Input_get(Data=solver)  # -> Plines, Insertion_vectors, Joints_per_face, Three_valence, Adjacency
loft_2 = Loft(Polylines1=input_get.Plines)
