# Grasshopper definition chapel_offset.gh (Grasshopper 1.0.7)
# plug-ins: NGon

brep = Brep(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)
genes = GenePool(Decimals=2, Maximum=1, Minimum=0, Value=[0, 0.04])
genes_2 = GenePool(Decimals=2, Maximum=1, Minimum=0, Value=[0.07, 0.09])
from_brep = FromBrep(Brep=brep, Weld=-1)  # -> Mesh, Polylines
c_script = CSharpScript(x=from_brep.Mesh, Reference="C:\USERS\PETRA\DESKTOP\ANNEN_V2\NGONS\NGonsCore.dll")  # -> out, A, B, graft(C); inputs x: Mesh
# ---------- c_script: C# usings ----------
using NGonsCore;
# ---------- c_script: C# ----------
    Plane[][] bisePlanes;
    Plane[][] edgePlanes;

    x.GetEdgeAndBisectorPlanes(out bisePlanes, out edgePlanes);

    A = NGonsCore.GrasshopperUtil.IE2(bisePlanes);
    B = NGonsCore.GrasshopperUtil.IE2(edgePlanes);

  C =     x._FPlanes();
# ---------- end c_script ----------
pl_offset = PlaneOffset(BasePlane=c_script.C, Offset=genes)  # -> simplify(Plane)
pl_offset_2 = PlaneOffset(BasePlane=c_script.C, Offset=genes_2)  # -> simplify(Plane)
pln = Plane(c_script.B)
offsetmesh = OffsetMesh(Mesh=from_brep.Mesh, Dist=1, Solid=False)
plreg = PlaneRegion(Plane=pl_offset, Bounds=c_script.B)
plreg_2 = PlaneRegion(Plane=pl_offset_2, Bounds=c_script.B)
brep_2 = Brep([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])
brep_3 = Brep([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])
edges = BrepEdges(Brep=brep_3)  # -> Naked, Interior, NonManifold
