# Grasshopper definition 10_offset_boxes_2.gh (Grasshopper 1.0.7)
# plug-ins: NGon

# ---- group: Input Geoemtry
# SLAB MADE OUT OF BOXES
number_slider = Slider(10, range=0..10)
crv = Curve([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])
xml_recenter = Xml_recenter(geo=crv, scale=number_slider)  # -> output, xform; inputs geo: tree of Curve
#   port geo: geometry to recenter
# ---------- xml_recenter: Python ----------
__author__ = "petras vestartas"
__version__ = "2023.03.22"

"""
Move curves to to the origin
"""

from ghpythonlib.componentbase import executingcomponent as component

import Rhino.Geometry as RhinoGeometry
import Grasshopper
class xml_recenter_component(component):
    def RunScript(self, _geo, _scale):
        
        scale = _scale if _scale != None else 1
        
        if(_geo.AllData().Count == 0):
            return
        
        # get bounding box
        bbox = _geo.AllData()[0].GetBoundingBox(True)
        for g in _geo.AllData():
            bbox.Union(g.GetBoundingBox(True))
        
        # Transformation matrix
        translation = -RhinoGeometry.Vector3d(bbox.Center)
        move_to_center = RhinoGeometry.Transform.Translation(translation)
        scale_xform = RhinoGeometry.Transform.Scale(RhinoGeometry.Point3d.Origin, scale)
        combined = scale_xform * move_to_center
        
        # Apply transformation
        geo_transformed = Grasshopper.DataTree[RhinoGeometry.GeometryBase]()
        for i in range(_geo.BranchCount):
            for j in range(_geo.Branch(i).Count):
                geo_copy = _geo.Branch(i)[j].Duplicate()
                geo_copy.Transform(combined)
                geo_transformed.Add(geo_copy, _geo.Paths[i])
        
        # Output
        return geo_transformed, combined
# ---------- end xml_recenter ----------
partition = PartitionList(List=xml_recenter.output, Size=Slider(2, range=0..10))
panel = Panel("""4
4
4
4
4
4
 
 
 
 
 
 """)
item = ListItem(List=partition, Index=0, Wrap=True)  # -> Item, Item1
int = Integer(simplify(graft(panel)))
loft_m = Loft_mesh(p0=item.Item, p1=item.Item1)  # -> mesh; inputs p0: list of Curve, p1: list of Curve
#   port p0: polylines with holes, bottom
#   port p1: polylines with holes, top
#   port mesh: lofted and capped mesh with holes
# ---------- loft_m: Python ----------
"""get joints ids and connections areas between elements"""

__author__ = "petras vestartas"
__version__ = "2023.03.31"

from ghpythonlib.componentbase import executingcomponent as component
import Rhino.RhinoDoc
import Rhino.Geometry
import System
from System.Drawing import Color

class connections_zones(component):


    def to_polyline_from_cp(self, curve):
        
        polyline = Rhino.Geometry.Polyline() 
        result, polyline1 = curve.TryGetPolyline()
        
        if (result == False):
            
            nurbsCurve = curve.ToNurbsCurve()  
            point3dArray = []
            
            for i in range(nurbsCurve.Points.Count):
                result, pt = nurbsCurve.Points.GetPoint(i)
                point3dArray.append(pt)
            
            polyline1 = Rhino.Geometry.Polyline(point3dArray)  
            nurbsCurve = polyline1.ToNurbsCurve()  
            result, polyline1 = nurbsCurve.TryGetPolyline()  
            
            polyline1.CollapseShortSegments(0.01) 
            
            polyline1 = Rhino.Geometry.Polyline(polyline1)  
            
            polyline = polyline1  
            
        else:
            polyline1.CollapseShortSegments(0.01)  
            polyline = polyline1  
        
        return polyline  

    def loft_polylines_with_holes(self, curves0, curves1):
        """Loft polylines with holes
        
        Parameters
        ----------
        curves0 : list[rg.Polyline]
        curves1 : list[rg.Polyline]
        
        Returns
        -------
        rg.Mesh
            mesh as lofted polylines and cap them
        """
        
        ###############################################################################
        # user input
        ###############################################################################
        
        flag = len(curves0) is not 0 if True else len(curves1) != 0
        if (flag):
            
            curves = []
            curves2 = []
            
            flag0 = len(curves1) == 0
            flag1 = len(curves0) == 0 and len(curves1) != 0
            flag2 = len(curves0) and len(curves1)
            
            if (flag0):
                for i in range(len(curves0)):
                    if (float(i) >= float(len(curves0)) * 0.5):
                        curves2.Add(curves0[i])
                    else:
                        curves.Add(curves0[i])
            elif (flag1):
                for i in range(0, len(curves1), 2):
                    curves.Add(curves1[i])
                    curves2.Add(curves1[i + 1])
            elif (flag2):
                curves = curves0
                curves2 = curves1
            
            curves0 = curves
            curves1 = curves2
        
        ###############################################################################
        # sort curves which one is border and which ones are holes
        ###############################################################################
        length = -1.0
        border_id = -1
        count = 0
        numArray = []
        for curve in curves0:
            diagonal = curve.GetBoundingBox(True).Diagonal
            temp_length = diagonal.Length
            if temp_length > length:
                length = temp_length
                border_id = count
            count=count+1
        
        
        border0 = self.to_polyline_from_cp(curves0[border_id])
        border1 = self.to_polyline_from_cp(curves1[border_id])
        holes0 = []
        holes1 = []
        for i in range(curves0.Count):
            if (i != border_id):
                holes0.Add(curves0[i])
                holes1.Add(curves1[i])
        
        ###############################################################################
        # Create mesh of the bottom face
        ###############################################################################
        
        mesh_bottom = Rhino.Geometry.Mesh.CreatePatch(border0, Rhino.RhinoDoc.ActiveDoc.ModelAngleToleranceRadians, None, holes0, None, None, True, 1)
        if(border0.Count == 5):
            mesh_bottom = Rhino.Geometry.Mesh()
            mesh_bottom.Vertices.Add(border0[0])
            mesh_bottom.Vertices.Add(border0[1])
            mesh_bottom.Vertices.Add(border0[2])
            mesh_bottom.Vertices.Add(border0[3])
            mesh_bottom.Faces.AddFace(0,1,2,3)
        ###############################################################################
        # Convert closed polylines to open ones
        ###############################################################################
        
        point_3d_array = []
        for i in range(len(mesh_bottom.Vertices)):
            point_3d_array.append(mesh_bottom.Vertices.Point3dAt(i))
        
        open_curve_points_0 = []
        open_curve_points_1 = []
        
        for i in range(border0.Count-1):
            open_curve_points_0.append( border0[i])
            open_curve_points_1.append( border1[i])
        
        for i in range(holes0.Count):
            holes0_polyline = self.to_polyline_from_cp(holes0[i]) 
            holes1_polyline = self.to_polyline_from_cp(holes1[i]) 
            for j in range(len(holes0_polyline)-1):
                open_curve_points_0.append(holes0_polyline[j])
                open_curve_points_1.append(holes1_polyline[j])
        
        ###############################################################################
        # Using the bottom mesh vertices create the top mesh f
        ###############################################################################
        points_to_sort_new = self.sort_set_of_points(open_curve_points_0, point_3d_array)
        mesh_top = mesh_bottom.DuplicateMesh()
        
        for i in range(len(points_to_sort_new)):
            mesh_top.Vertices.SetVertex(i, open_curve_points_1[points_to_sort_new[i]])
        
        ###############################################################################
        # Merge the top and bottom mesh into one and add sides
        ###############################################################################
        mesh = Rhino.Geometry.Mesh()
        mesh.Append(mesh_bottom)
        mesh.Append(mesh_top)
        
        count = mesh_bottom.Vertices.Count
        for p in range (mesh_bottom.TopologyEdges.Count):
            
            if (mesh_bottom.TopologyEdges.GetConnectedFaces(p).Length == 1):
                topologyVertices = mesh_bottom.TopologyEdges.GetTopologyVertices(p)
                mesh.Faces.AddFace(topologyVertices.I, topologyVertices.J, topologyVertices.J + count, topologyVertices.I + count)
        
        mesh.UnifyNormals()
        mesh.Ngons.AddPlanarNgons(Rhino.RhinoDoc.ActiveDoc.ModelAbsoluteTolerance * 1, 3, 1, True)
        
        ###############################################################################
        # Unweld ngons meshes
        ###############################################################################
        unwelded_ngon_mesh = Rhino.Geometry.Mesh()
        count = 0
        for ngonAndFacesEnumerable in mesh.GetNgonAndFacesEnumerable():
            
            faces = []
            for j in ngonAndFacesEnumerable.FaceIndexList():
                faces.append(System.Int32(j))
            
            temp_ngon_mesh = mesh.DuplicateMesh().Faces.ExtractFaces(faces)
            
            #add colors
            if(count<2):
                temp_ngon_mesh.VertexColors.CreateMonotoneMesh(Color.DeepPink)
            else:
                temp_ngon_mesh.VertexColors.CreateMonotoneMesh(Color.LightGray)
            
            unwelded_ngon_mesh.Append(temp_ngon_mesh)
            count = count + 1
        
        ###############################################################################
        # Output
        ###############################################################################
        unwelded_ngon_mesh.RebuildNormals()
        return unwelded_ngon_mesh




    def sort_set_of_points(self, points_to_sort, guide_points):
        """Sort one array of point by an another point array
        
        use it like this: 
        #points_to_sort_new = []
        #for i in points_to_sort_ids:
        #    points_to_sort_new.append(points_to_sort[i])
        
        Parameters
        ----------
        points_to_sort : list[rg.Point3d]
        guide_points : list[rg.Point3d]
        
        Returns
        -------
        list[int]
            the list of indices of the sorted array
        """
        
        # create a copy
        points_to_sort_copy = []
        for i in points_to_sort:
            points_to_sort_copy.append(Rhino.Geometry.Point3d(i))
        
        guide_points_copy = []
        for i in guide_points:
            guide_points_copy.append(Rhino.Geometry.Point3d(i))
        
        # make indices of points
        points_to_sort_ids = list(range(0,len(points_to_sort_copy)))
        guide_points_ids = list(range(0,len(guide_points_copy)))
        
        # sort both lists by xyz coordinates together with indices
        
        points_to_sort_copy, points_to_sort_ids = zip(*sorted(zip(points_to_sort_copy, points_to_sort_ids)))
        guide_points_copy, guide_points_ids = zip(*sorted(zip(guide_points_copy, guide_points_ids)))
        
        # sort guide points indices and order the points to sort indec
        guide_points_ids, points_to_sort_ids = zip(*sorted(zip(guide_points_ids, points_to_sort_ids)))
        
        # can be used like this:
        #points_to_sort_new = []
        #for i in points_to_sort_ids:
        #    points_to_sort_new.append(points_to_sort[i])
        
        return points_to_sort_ids

    def RunScript(self, _p0, _p1):
        if _p0 and _p1:
            return self.loft_polylines_with_holes(_p0, _p1)
# ---------- end loft_m ----------
clean = CleanTree(RemoveNulls=True, RemoveInvalid=True, RemoveEmpty=False, Tree=int)
box_wall = Box_wall(mesh=loft_m, offset="18", inlay_0=Toggle(True), inlay_1=Toggle(False), skipped=clean)  # -> polylines_0, polylines_1; inputs mesh: Mesh, inlay_0: Boolean, inlay_1: Boolean, skipped: list of Int32
# ---------- box_wall: Python ----------
from ghpythonlib.componentbase import executingcomponent as component
import Grasshopper, GhPython
import System
import Rhino
import rhinoscriptsyntax as rs
from Rhino.Geometry import Plane, Mesh, Vector3d, Polyline
from Rhino.Geometry.Intersect.Intersection import PlanePlanePlane


class MyComponent(component):
    def RunScript(self, _mesh, _offset, _inlay_0, _inlay_1, _skipped):
        if _mesh == None:
            return
        if _offset == None:
            _offset = 1

        def get_ngon_polylines(mesh):
            polylines = []

            for i in range(mesh.Ngons.Count):
                vertices = mesh.Ngons.GetNgon(i).BoundaryVertexIndexList()

                outline = Polyline()
                for v in vertices:
                    outline.Add(mesh.Vertices[v])
                outline.Add(outline[0])

                polylines.append(outline)

            return polylines

        def get_ngon_center(mesh, ngon):
            vertices = mesh.Ngons.GetNgon(ngon).BoundaryVertexIndexList()

            outline = Polyline()
            for v in vertices:
                outline.Add(mesh.Vertices[v])

            return outline.CenterPoint()

        def get_ngon_normal(mesh, n):
            vector3d = Vector3d.Zero

            faces = mesh.Ngons[n].FaceIndexList()

            for i in range(len(faces)):
                vector3d += Vector3d(mesh.FaceNormals[int(faces[i])])

            vector3d.Unitize()

            return vector3d

        def get_ngons_boundaries(mesh):
            boundaries = [[] for _ in range(mesh.Ngons.Count)]

            for i in range(mesh.Ngons.Count):
                boundaries[i] = mesh.Ngons[i].BoundaryVertexIndexList()

            return boundaries

        def get_ngons_boundaries_point3d(mesh, verticesIDs):
            pts = [[] for _ in range(len(verticesIDs))]

            for i in range(len(verticesIDs)):
                pts[i] = [mesh.Vertices[int(v)] for v in verticesIDs[i]]

            return pts

        def get_ngon_planes(mesh):
            p = [None] * mesh.Ngons.Count

            b = get_ngons_boundaries(mesh)
            pts = get_ngons_boundaries_point3d(mesh, b)

            for i in range(mesh.Ngons.Count):
                p[i] = Plane(get_ngon_center(mesh, i), get_ngon_normal(mesh, i))
            return p

        def get_ngon_face_adjacency(mesh):
            faceAdj = [None] * mesh.Ngons.Count

            for i in range(mesh.Ngons.Count):
                faceAdjTemp = []
                meshFaceIdInCurrentNGon = mesh.Ngons[i].FaceIndexList()

                for j in range(len(meshFaceIdInCurrentNGon)):
                    id = mesh.Faces.AdjacentFaces(meshFaceIdInCurrentNGon[j])

                    for k in range(len(id)):
                        ngonID = mesh.Ngons.NgonIndexFromFaceIndex(id[k])

                        if ngonID != i and ngonID not in faceAdjTemp:
                            faceAdjTemp.append(ngonID)

                faceAdj[i] = faceAdjTemp
            return faceAdj

        def move_plane_by_axis(plane, dist, axis=2):
            plane1 = Plane(plane)
            if axis == 0:
                plane1.Translate(plane1.XAxis * dist)
            elif axis == 1:
                plane1.Translate(plane1.YAxis * dist)
            else:
                plane1.Translate(plane1.Normal * dist)
            return plane1

        def polyline_from_planes(basePlane, sidePlanes, close=True):
            polyline = Polyline()

            for i in range(len(sidePlanes) - 1):
                result, pt = PlanePlanePlane(
                    basePlane, sidePlanes[i], sidePlanes[i + 1]
                )
                polyline.Add(pt)

            result, pt1 = PlanePlanePlane(
                basePlane, sidePlanes[len(sidePlanes) - 1], sidePlanes[0]
            )
            polyline.Add(pt1)

            if close:
                polyline.Add(polyline[0])

            return polyline

        def get_intersection_between_current_and_neihgbor_planes(
            planes, adjacent_faces, offset, inlay_0=False, inlay_1=False, skipped=[]
        ):
            planes_offset = []
            
            not_skipped_faces = []
            for i in range(len(planes)):
                not_skipped_faces.append(True)
                for j in skipped:
                    if(j == i):
                        not_skipped_faces[i]=False
                        break

            for i in range(len(planes)):
                if(not_skipped_faces[i]):
                    
                    if inlay_0 and i == 0:
                        planes_offset.append(move_plane_by_axis(planes[i], 0))
                    elif inlay_1 and i == 1:
                        planes_offset.append(move_plane_by_axis(planes[i], 0))
                    else:
                        planes_offset.append(move_plane_by_axis(planes[i], -offset))
                else:
                    planes_offset.append(planes[i])

            polylines_no_offset = []
            polylines_offset = []

            for i in range(len(adjacent_faces)):  # iterate through nested list
            
            
                # base planes
                base_plane = planes[i]
                base_plane_offset = planes_offset[i]

                # get neighbor planes
                adjacent_planes_offset = []
                adjacent_planes_no_offset = []
                for j in range(len(adjacent_faces[i])):
                    adjacent_planes_offset.append(planes_offset[adjacent_faces[i][j]])
                    adjacent_planes_no_offset.append(planes[adjacent_faces[i][j]])

                    if inlay_0 and i == 0:
                        adjacent_planes_no_offset[j] = adjacent_planes_offset[j]

                    if inlay_1 and i == 1:
                        adjacent_planes_no_offset[j] = adjacent_planes_offset[j]

                if inlay_0 and i == 0:
                    base_plane = move_plane_by_axis(base_plane, -offset * 2)
                    base_plane_offset = move_plane_by_axis(
                        base_plane_offset, -offset * 2
                    )

                if inlay_1 and i == 1:
                    base_plane = move_plane_by_axis(base_plane, -offset * 2)
                    base_plane_offset = move_plane_by_axis(
                        base_plane_offset, -offset * 2
                    )

                # shift to right
                # adjacent_planes_offset.insert(0, adjacent_planes_offset.pop())#adjacent_planes_offset.append(adjacent_planes_offset.pop(0))
                # adjacent_planes_offset.insert(0, adjacent_planes_offset.pop())#adjacent_planes_offset.append(adjacent_planes_offset.pop(0))

                # perform intersection
                if(not_skipped_faces[i]):
                    polylines_no_offset.append(
                        polyline_from_planes(base_plane, adjacent_planes_no_offset)
                    )
                    polylines_offset.append(
                        polyline_from_planes(base_plane_offset, adjacent_planes_offset)
                    )

            return polylines_no_offset, polylines_offset

        # get planes from polylines
        polylines0 = get_ngon_polylines(_mesh)
        planes = get_ngon_planes(_mesh)
        adjacent_faces = get_ngon_face_adjacency(_mesh)
        _p0, _p1 = get_intersection_between_current_and_neihgbor_planes(
            planes, adjacent_faces, _offset, _inlay_0, _inlay_1, _skipped
        )

        # offset all polylines inside to get bisector plates

        # create an inlay plate if user defines it

        # return outputs if you have them; here I try it for you:
        return (_p0, _p1)
# ---------- end box_wall ----------
cull_i = CullIndex(List=box_wall.polylines_0, Indices=0, Wrap=True)
cull_i_2 = CullIndex(List=box_wall.polylines_1, Indices=0, Wrap=True)
weave = Weave(Pattern=[0, 1], Stream0=cull_i, Stream1=cull_i_2, NullGaps=False)

# ----
brep = Brep([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])
brep_2 = Brep([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])
brep_3 = Brep([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])
brep_4 = Brep([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])
brep_5 = Brep([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])
# FOLDED SYSTEM
brep_6 = Brep([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])
brep_7 = Brep([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])
brep_8 = Brep([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])
brep_9 = Brep([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])
brep_10 = Brep([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])
brep_11 = Brep([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])
brep_12 = Brep([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])
crv_2 = Curve(graft([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]))
crv_3 = Curve(graft([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]))
crv_4 = Curve(graft([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]))
crv_5 = Curve(graft([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]))
crv_6 = Curve(graft([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]))
crv_7 = Curve(graft([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]))
crv_8 = Curve(graft([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]))
crv_9 = Curve(graft([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]))
crv_10 = Curve(graft([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]))
crv_11 = Curve(graft([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]))
crv_12 = Curve(graft([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]))
crv_13 = Curve(graft([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]))
cluster = Cluster_2(relay=brep_6, C=crv_7)
cluster_2 = Cluster_2(relay=brep, C=crv_2)
cluster_3 = Cluster_2(relay=brep_7, C=crv_3)
cluster_4 = Cluster_2(relay=brep_8, C=crv_4)
cluster_5 = Cluster_2(relay=brep_9, C=crv_5)
cluster_6 = Cluster_2(relay=brep_2, C=crv_8)
cluster_7 = Cluster_2(relay=brep_10, C=crv_9)
cluster_8 = Cluster_2(relay=brep_3, C=crv_10)
cluster_9 = Cluster_2(relay=brep_4, C=crv_11)
cluster_10 = Cluster_2(relay=brep_11, C=crv_6)
cluster_11 = Cluster_2(relay=brep_5, C=crv_12)
cluster_12 = Cluster_2(relay=brep_12, C=crv_13)
crv_14 = Curve(cluster_2)
crv_15 = Curve(cluster_4)
crv_16 = Curve(cluster_5)
crv_17 = Curve(cluster_7)
crv_18 = Curve(cluster)
crv_19 = Curve(cluster_3)
crv_20 = Curve(cluster_6)
crv_21 = Curve(cluster_8)
crv_22 = Curve(cluster_9)
crv_23 = Curve(cluster_10)
crv_24 = Curve(cluster_11)
crv_25 = Curve(cluster_12)
entwine = Entwine(
    Branch00=crv_18,
    Branch01=crv_14,
    Branch02=crv_19,
    Branch03=crv_15,
    Branch04=crv_16,
    Branch05=crv_20,
    Branch06=crv_17,
    Branch07=crv_21,
    Branch08=crv_22,
    Branch09=crv_23,
    Branch010=crv_24,
    Branch011=crv_25,
    FlattenInputs=True)

crv_26 = Curve([<curve referenced from the Rhino model> x42])
crv_27 = Curve([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])
crv_28 = Curve([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])
partition_2 = PartitionList(List=crv_26, Size=6)
fromp = FromPolylines(Curves=partition_2, Min_Triangulation=False)
partition_3 = PartitionList(List=crv_28, Size=5)
clear = Clear(Mesh=fromp)
fromp_2 = FromPolylines(Curves=partition_3, Min_Triangulation=False)
item_2 = ListItem(List=flatten(entwine), Index=0, Wrap=True)  # -> Item, Item1, Item2, Item3
xml_recenter_2 = Xml_recenter(geo=clear, scale=Slider(10, range=0..10))  # -> output; inputs geo: tree of GeometryBase
#   port geo: geometry to recenter
# ---------- xml_recenter_2: Python ----------
__author__ = "petras vestartas"
__version__ = "2023.03.22"

"""
Move curves to to the origin
"""

from ghpythonlib.componentbase import executingcomponent as component

import Rhino.Geometry as RhinoGeometry
import Grasshopper
class xml_recenter_component(component):
    def RunScript(self, _geo, _scale):
        
        scale = _scale if _scale != None else 1
        
        if(_geo.AllData().Count == 0):
            return
        
        # get bounding box
        bbox = _geo.AllData()[0].GetBoundingBox(True)
        for g in _geo.AllData():
            bbox.Union(g.GetBoundingBox(True))
        
        # Transformation matrix
        translation = -RhinoGeometry.Vector3d(bbox.Center)
        move_to_center = RhinoGeometry.Transform.Translation(translation)
        scale_xform = RhinoGeometry.Transform.Scale(RhinoGeometry.Point3d.Origin, scale)
        combined = scale_xform * move_to_center
        
        # Apply transformation
        geo_transformed = Grasshopper.DataTree[RhinoGeometry.GeometryBase]()
        for i in range(_geo.BranchCount):
            for j in range(_geo.Branch(i).Count):
                geo_copy = _geo.Branch(i)[j].Duplicate()
                geo_copy.Transform(combined)
                geo_transformed.Add(geo_copy, _geo.Paths[i])
        
        # Output
        return geo_transformed
# ---------- end xml_recenter_2 ----------
clear_2 = Clear(Mesh=fromp_2)
number_slider_2 = Slider(100, range=0..100)
number_slider_3 = Slider(1.01, range=0..1.01)
number_slider_4 = Slider(10, range=0..10)
python = GhPythonScript(mesh=clear_2, offset="4")  # -> a; inputs mesh: Mesh
# ---------- python: Python ----------
from Rhino.Geometry import Mesh, Vector3d, Point3d, Plane
from ghpythonlib.componentbase import executingcomponent as component
import Rhino.Geometry as RhinoGeometry
import math
from ghpythonlib import treehelpers
import Grasshopper

class MyComponent(component):
    
    # Properties for plates
    _has_ngons = False  # bool

    _face_thickness = 1  # double
    _chamfer = 0.01  # double
    _extend = 1  # double
    _face_positions = []  # List<double>

    _f = -1  # int
    _e = -1  # int
    _f_v = []  # int[][]
    _f_e = []  # int[][]
    _e_f = []  # int[][]
    _e_ngon_e = {}  # Dictionary<int, int>
    _f_planes = []  # Plane[]
    _fe_planes = []  # Plane[][]
    _bi_planes = []  # Plane[][]
    _e_planes = []  # Plane[]
    _e_lines = []  # Line[]
    _insertion_vectors = []  # Vector3d[]

    # Output
    _f_polylines_index = []  # string[][]

    _f_polylines_planes = []  # Plane[][]
    _f_polylines = []  # Polyline[][]
    
    def RunScript(self, _mesh, _offset, _chamfer = 0.05, _face_positions = [-12,12.0]):
        
        
        if _mesh == None:
            return
        else:
            self._mesh = _mesh
        if _offset == None:
            self._offset = 1
        else:
            self._offset = _offset
        
        # Run
        self._has_ngons = self._mesh.Ngons.Count > 0
        self._face_thickness = _offset if _offset != None else 1.4
        self._chamfer = _chamfer
        self._face_positions = [0] if len(_face_positions) == 0 else _face_positions

        # Properties for plates
        self.get_face_vertices()
        self.get_faces_planes()
        self.get_face_edge_planes()
        self.get_bisector_planes()
        self.get_edges()
        self.get_edge_faces()
        self.get_face_polylines()
        
        polylines_tree = Grasshopper.DataTree[RhinoGeometry.Polyline]()
        for i in range(0, len(self._f_polylines)):
            for j in range(0, len(self._f_polylines[i])):
                self._f_polylines[i][j] = self.chamfer_polyline(self._f_polylines[i][j], _chamfer)
                polylines_tree.Add(
                    self._f_polylines[i][j], Grasshopper.Kernel.Data.GH_Path(i)
                )
        return polylines_tree

        
    def center_point(self, polyline):
        Count = len(polyline)
    
        if Count == 0:
            return RhinoGeometry.Point3d.Unset
    
        if Count == 1:
            return polyline[0]
    
        center = RhinoGeometry.Point3d.Origin
        weight = 0.0
    
        stop = Count - 1
        if polyline[0].DistanceToSquared(polyline[-1]) > 0.001:
            stop = stop + 1
    
        for i in range(stop):
            A = RhinoGeometry.Point3d(polyline[i])
            B = RhinoGeometry.Point3d(polyline[(i + 1) % Count])
            d = A.DistanceTo(B)
            center = center + d * 0.5 * (A + B)
            weight = weight + d
    
        center /= weight
    
        return center
        
    def mesh_face_center(self, mesh, i):
        center = RhinoGeometry.Point3d(0, 0, 0)
    
        if mesh.Faces[i].IsQuad:
            pts = [
                mesh.Vertices[mesh.Faces[i].A],
                mesh.Vertices[mesh.Faces[i].B],
                mesh.Vertices[mesh.Faces[i].C],
                mesh.Vertices[mesh.Faces[i].D],
            ]
            center = self.center_point(pts)
        else:
            pts = [
                mesh.Vertices[mesh.Faces[i].A],
                mesh.Vertices[mesh.Faces[i].B],
                mesh.Vertices[mesh.Faces[i].C],
            ]
            center = self.center_point(pts)
    
        return center
    
    def get_face_vertices(self):
        if self._has_ngons:
            self._f = self._mesh.Ngons.Count
            # f_v = self._mesh.GetNGonsTopoBoundaries()
        else:
            self._f = self._mesh.Faces.Count
    
            empty_list = []
            self._f_v = []
            for i in range(self._mesh.Faces.Count):
                self._f_v.append([])
            
            # f_v = [] #new int[this.m.Faces.Count][]
            for i in range(self._mesh.Faces.Count):
                self._f_v[i] = (
                    [
                        self._mesh.Faces[i][0],
                        self._mesh.Faces[i][1],
                        self._mesh.Faces[i][2],
                        self._mesh.Faces[i][3],
                    ]
                    if self._mesh.Faces[i].IsQuad
                    else [
                        self._mesh.Faces[i][0],
                        self._mesh.Faces[i][1],
                        self._mesh.Faces[i][2],
                    ]
                )
    
    def get_faces_planes(self):
        if self._has_ngons:
            pass
            # f_planes = self._mesh._FPlanes()
        else:
            self._f_planes = []  # self._fe_planes
            for i in range(self._mesh.Faces.Count):
                self._f_planes.append(
                    RhinoGeometry.Plane(
                        self.mesh_face_center(self._mesh, i), self._mesh.FaceNormals[i]
                    )
                )
    
    def set_edge_normals(self):
        topologyEdges = self._mesh.TopologyEdges
        faceNormals = self._mesh.FaceNormals
    
        self.e_planes = []  # new Plane[topologyEdges.Count]
    
        for i in range(topologyEdges.Count):
            line = topologyEdges.EdgeLine(i)
            connectedFaces = topologyEdges.GetConnectedFaces(i)  # int[]
    
            xaxis = line.To - line.From
            xaxis.Unitize()
            zaxis = RhinoGeometry.Vector3d(0, 0, 1)
    
            if connectedFaces.Length != 2:  # naked
                
                zaxis = RhinoGeometry.Vector3d.CrossProduct(
                    faceNormals[connectedFaces[0]], xaxis
                )
                
            else:  # inner
                zaxis_avg = (
                    faceNormals[connectedFaces[0]] + faceNormals[connectedFaces[1]]
                ) / 2
                zaxis_avg.Unitize()
                zaxis = RhinoGeometry.Vector3d.CrossProduct(xaxis, zaxis_avg)
            self._e_planes.append(RhinoGeometry.Plane(line.PointAt(0.5), zaxis))
    
    def dihedral_plane(self, plane0, plane1):
        ####################################################################################################
        # Plane between two Planes
        ####################################################################################################
        result, l = RhinoGeometry.Intersect.Intersection.PlanePlane(plane0, plane1)
        result, t = RhinoGeometry.Intersect.Intersection.LinePlane(l, plane0)
        centerDihedral = l.PointAt(t)
    
        ####################################################################################################
        # Convert ZAxis to lines, cant it be done on origin
        ####################################################################################################
        angleLine0 = RhinoGeometry.Line(plane0.Origin, plane0.Origin + plane0.ZAxis)
        angleLine1 = RhinoGeometry.Line(plane1.Origin, plane1.Origin + plane1.ZAxis)
    
        ####################################################################################################
        # Plane cannot be anti/parallel and they must be apart from each other
        ####################################################################################################
        if (
            plane0.ZAxis.IsParallelTo(plane1.ZAxis, 0.01) == 0
            and plane0.Origin.DistanceToSquared(plane1.Origin) > 0.001
        ):
            ##########################################################################################3##########
            # Intersect two lines to get center
            ####################################################################################################
            result, t0, t1 = RhinoGeometry.Intersect.Intersection.LineLine(
                angleLine0, angleLine1
            )
    
            ####################################################################################################
            # Construct plane from LineLine center and plane origins
            ####################################################################################################
            center = angleLine0.PointAt(t0)
            v0 = plane0.Origin - center
            v1 = plane1.Origin - center
            v0.Unitize()
            v1.Unitize()
    
            ####################################################################################################
            # Compute Plane
            ####################################################################################################
            dihedralPlane = RhinoGeometry.Plane(centerDihedral, l.Direction, v0 + v1)
    
            return dihedralPlane
        else:
            return (
                RhinoGeometry.Plane.Unset
            )  # Axes are paralell or anti-parallel |.| or _._ or planes are at the same location
    
    def get_face_edge_planes(self):
        self._e_planes = []
        self.set_edge_normals()
        self._fe_planes = []  # new Plane[f][]
        
        
        for i in range(self._f):
            n = len(self._f_v[i])
            
            self._fe_planes.append([])
            
            for j in range(len(self._f_v[i])):
                v1 = self._f_v[i][(j + 0) % n]
                v2 = self._f_v[i][(j + 1) % n]
                
                e = self._mesh.TopologyEdges.GetEdgeIndex(v1, v2)  # int e =
                cf = self._mesh.TopologyEdges.GetConnectedFaces(e)  # int[]
                
                sum = RhinoGeometry.Vector3d.Zero
                for k in range(len(cf)):
                    sum += RhinoGeometry.Vector3d(self._mesh.FaceNormals[cf[k]])
                sum = sum / cf.Length
                
                edgePlane = RhinoGeometry.Plane.Unset
                
                if cf.Length == 2:
                    edgePlane = self.dihedral_plane(
                        RhinoGeometry.Plane(
                            self.mesh_face_center(self._mesh, cf[0]),
                            self._mesh.FaceNormals[cf[0]],
                        ),
                        RhinoGeometry.Plane(
                            self.mesh_face_center(self._mesh, cf[1]),
                            self._mesh.FaceNormals[cf[1]],
                        ),
                    )
                    edgePlane = self._e_planes[e]
                else:
                    sum = Vector3d.ZAxis 
                    
                    edgePlane = RhinoGeometry.Plane(
                        (RhinoGeometry.Point3d)(
                            self._mesh.Vertices[v1] + self._mesh.Vertices[v2]
                        )
                        * 0.5,
                        self._mesh.Vertices[v1] - self._mesh.Vertices[v2],
                        sum,
                    )
                
                self._fe_planes[i].append(edgePlane)
    
    def get_bisector_planes(self):
        self._bi_planes = []  # new Plane[f][]
    
        for i in range(self._f):
            n = len(self._f_v[i])
            self._bi_planes.append([])
            for j in range(n):
                pl1 = self._fe_planes[i][j]
                pl0 = self._fe_planes[i][(j + 1) % n]
                self._bi_planes[-1].append(self.dihedral_plane(pl0, pl1))
    
    def get_edges(self):
        if self._has_ngons:
            pass
            # e_ngon_e = self._mesh._EAll()
            # this.e = e_ngon_e.Count
        else:
            self._e_ngon_e = {}
            for i in range(self._mesh.TopologyEdges.Count):
                # {'Germany' : 49}
                self._e_ngon_e.update({i: i})
        self._e = self._e_ngon_e.Count
    
    def get_edge_faces(self):
        if self._has_ngons:
            pass
            # this.e_f = self._mesh._EF()
        else:
            self._e_f = []
            for i in range(self._mesh.TopologyEdges.Count):
                self._e_f.append(self._mesh.TopologyEdges.GetConnectedFaces(i))
    
    def polyline_from_planes(self, basePlane, sidePlanes, close=True):
        polyline = RhinoGeometry.Polyline()
        for i in range(sidePlanes.Count - 1):
            result, pt = RhinoGeometry.Intersect.Intersection.PlanePlanePlane(
                basePlane, sidePlanes[i], sidePlanes[i + 1]
            )
            polyline.Add(pt)
    
        result, pt1 = RhinoGeometry.Intersect.Intersection.PlanePlanePlane(
            basePlane, sidePlanes[sidePlanes.Count - 1], sidePlanes[0]
        )
        polyline.Add(pt1)
    
        if close:
            polyline.Add(polyline[0])
    
        return polyline
    
    def move_plane_by_axis(self, plane, distance):
        return RhinoGeometry.Plane(
            plane.Origin + plane.ZAxis * distance, plane.XAxis, plane.YAxis
        )
    
    def get_face_polylines(self):
        zero_layer = self._face_positions.Count == 0
    
        self._f_polylines_index = []  # new string[f][]
        self._f_polylines_planes = []  # new Plane[f][]
        self._f_polylines = []  # new Polyline[f][]
    
        for i in range(self._f):  # (int i = 0  i < f  i++)
            if self._face_positions.Count == 0:
                self._f_polylines.append([])  # new Polyline[2]
                pline0 = self.polyline_from_planes(
                    self.move_plane_by_axis(
                        self._f_planes[i], self._face_thickness * -0.0
                    ),
                    self._fe_planes[i],
                    True,
                )
                pline1 = self.polyline_from_planes(
                    self.move_plane_by_axis(
                        self._f_planes[i], self._face_thickness * 1.0
                    ),
                    self._fe_planes[i],
                    True,
                )
                self._f_polylines_planes.append(
                    [
                        self.move_plane_by_axis(
                            self._f_planes[i], self._face_thickness * 1.0
                        )
                    ]
                )
                self._f_polylines_index.append([str(i)])
            else:
                self._f_polylines.append(
                    []
                )  # new Polyline[self._face_positions.Count * 2]
                self._f_polylines_planes.append(
                    []
                )  # new Plane[self._face_positions.Count]
                self._f_polylines_index.append(
                    []
                )  # new string[self._face_positions.Count]
    
                for j in range(
                    self._face_positions.Count
                ):  # (int j = 0  j < self._face_positions.Count  j++):
                    pline0 = self.polyline_from_planes(
                        self.move_plane_by_axis(
                            self._f_planes[i],
                            self._face_positions[j] + self._face_thickness * -0.0,
                        ),
                        self._fe_planes[i],
                        True,
                    )
                    pline1 = self.polyline_from_planes(
                        self.move_plane_by_axis(
                            self._f_planes[i],
                            self._face_positions[j] + self._face_thickness * 1.0,
                        ),
                        self._fe_planes[i],
                        True,
                    )
                    self._f_polylines[i].append(pline0)
                    self._f_polylines[i].append(pline1)
                    self._f_polylines_planes[i].append(
                        self.move_plane_by_axis(
                            self._f_planes[i],
                            self._face_positions[j] + self._face_thickness * 1.0,
                        )
                    )
    
                    temp_flag = (
                        str(i)
                        if len(self._face_positions) == 1
                        else str(i) + " " + str(j)
                    )
                    self._f_polylines_index[i].append(temp_flag)
    
    def chamfer_polyline(self, polyline, value=0.001):
        lines = polyline.GetSegments()
        
        if value == 0:
            return polyline
        
        p = RhinoGeometry.Polyline()
        
        if value < 0:
            
            for l in lines:
                l_ = RhinoGeometry.Line(l.From, l.To)
                p.Add(lShorter.From)
                p.Add(lShorter.To)
                counter = counter + 1
        else:
            
            counter = 0
            print(lines.Count)
            for l in lines:
                
                
                
                # get angle
                v0 = l.From-l.To
                v_prev = lines[(counter-1+lines.Count)%lines.Count].To-lines[(counter-1+lines.Count)%lines.Count].From
                
                angle = Vector3d.VectorAngle(v0,v_prev)
                t = math.pi*0.15
                if(angle  <math.pi*t):
                    p.Add(l.PointAt(value))
                else:
                    p.Add(l.From)
                print(angle, (counter-1+lines.Count)%lines.Count, t)
                v0 = l.To-l.From
                v_next = lines[(counter+1)%lines.Count].From-lines[(counter+1)%lines.Count].To
                angle = Vector3d.VectorAngle(v0,v_next)
                
                if(angle < math.pi*t):
                    p.Add(l.PointAt(1 - value))
                else:
                    p.Add(l.To)
                print(angle, counter+1%lines.Count)
                counter = counter + 1
    
        p.Add(p[0])
        print(" ")
        return p
# ---------- end python ----------
item_3 = ListItem(List=flatten(xml_recenter_2), Index=Slider(5, range=0..10), Wrap=True)
python_2 = GhPythonScript(mesh=item_3, offset="45")  # -> a; inputs mesh: Mesh
# ---------- python_2: Python ----------
from Rhino.Geometry import Mesh, Vector3d, Point3d, Plane
from ghpythonlib.componentbase import executingcomponent as component
import Rhino.Geometry as RhinoGeometry
import math
from ghpythonlib import treehelpers
import Grasshopper

class MyComponent(component):
    
    # Properties for plates
    _has_ngons = False  # bool

    _face_thickness = 1  # double
    _chamfer = 0.01  # double
    _extend = 1  # double
    _face_positions = []  # List<double>

    _f = -1  # int
    _e = -1  # int
    _f_v = []  # int[][]
    _f_e = []  # int[][]
    _e_f = []  # int[][]
    _e_ngon_e = {}  # Dictionary<int, int>
    _f_planes = []  # Plane[]
    _fe_planes = []  # Plane[][]
    _bi_planes = []  # Plane[][]
    _e_planes = []  # Plane[]
    _e_lines = []  # Line[]
    _insertion_vectors = []  # Vector3d[]

    # Output
    _f_polylines_index = []  # string[][]

    _f_polylines_planes = []  # Plane[][]
    _f_polylines = []  # Polyline[][]
    
    def RunScript(self, _mesh, _offset, _chamfer = 0.075, _face_positions = [120,-120]):
        
        
        if _mesh == None:
            return
        else:
            self._mesh = _mesh
        if _offset == None:
            self._offset = 1
        else:
            self._offset = _offset
        
        # Run
        self._has_ngons = self._mesh.Ngons.Count > 0
        self._face_thickness = _offset if _offset != None else 1.4
        self._chamfer = _chamfer
        self._face_positions = [0] if len(_face_positions) == 0 else _face_positions

        # Properties for plates
        self.get_face_vertices()
        self.get_faces_planes()
        self.get_face_edge_planes()
        self.get_bisector_planes()
        self.get_edges()
        self.get_edge_faces()
        self.get_face_polylines()
        
        polylines_tree = Grasshopper.DataTree[RhinoGeometry.Polyline]()
        for i in range(0, len(self._f_polylines)):
            for j in range(0, len(self._f_polylines[i])):
                self._f_polylines[i][j] = self.chamfer_polyline(self._f_polylines[i][j], _chamfer)
                polylines_tree.Add(
                    self._f_polylines[i][j], Grasshopper.Kernel.Data.GH_Path(i)
                )
        return polylines_tree

        
    def center_point(self, polyline):
        Count = len(polyline)
    
        if Count == 0:
            return RhinoGeometry.Point3d.Unset
    
        if Count == 1:
            return polyline[0]
    
        center = RhinoGeometry.Point3d.Origin
        weight = 0.0
    
        stop = Count - 1
        if polyline[0].DistanceToSquared(polyline[-1]) > 0.001:
            stop = stop + 1
    
        for i in range(stop):
            A = RhinoGeometry.Point3d(polyline[i])
            B = RhinoGeometry.Point3d(polyline[(i + 1) % Count])
            d = A.DistanceTo(B)
            center = center + d * 0.5 * (A + B)
            weight = weight + d
    
        center /= weight
    
        return center
        
    def mesh_face_center(self, mesh, i):
        center = RhinoGeometry.Point3d(0, 0, 0)
    
        if mesh.Faces[i].IsQuad:
            pts = [
                mesh.Vertices[mesh.Faces[i].A],
                mesh.Vertices[mesh.Faces[i].B],
                mesh.Vertices[mesh.Faces[i].C],
                mesh.Vertices[mesh.Faces[i].D],
            ]
            center = self.center_point(pts)
        else:
            pts = [
                mesh.Vertices[mesh.Faces[i].A],
                mesh.Vertices[mesh.Faces[i].B],
                mesh.Vertices[mesh.Faces[i].C],
            ]
            center = self.center_point(pts)
    
        return center
    
    def get_face_vertices(self):
        if self._has_ngons:
            self._f = self._mesh.Ngons.Count
            # f_v = self._mesh.GetNGonsTopoBoundaries()
        else:
            self._f = self._mesh.Faces.Count
    
            empty_list = []
            self._f_v = []
            for i in range(self._mesh.Faces.Count):
                self._f_v.append([])
            
            # f_v = [] #new int[this.m.Faces.Count][]
            for i in range(self._mesh.Faces.Count):
                self._f_v[i] = (
                    [
                        self._mesh.Faces[i][0],
                        self._mesh.Faces[i][1],
                        self._mesh.Faces[i][2],
                        self._mesh.Faces[i][3],
                    ]
                    if self._mesh.Faces[i].IsQuad
                    else [
                        self._mesh.Faces[i][0],
                        self._mesh.Faces[i][1],
                        self._mesh.Faces[i][2],
                    ]
                )
    
    def get_faces_planes(self):
        if self._has_ngons:
            pass
            # f_planes = self._mesh._FPlanes()
        else:
            self._f_planes = []  # self._fe_planes
            for i in range(self._mesh.Faces.Count):
                self._f_planes.append(
                    RhinoGeometry.Plane(
                        self.mesh_face_center(self._mesh, i), self._mesh.FaceNormals[i]
                    )
                )
    
    def set_edge_normals(self):
        topologyEdges = self._mesh.TopologyEdges
        faceNormals = self._mesh.FaceNormals
    
        self.e_planes = []  # new Plane[topologyEdges.Count]
    
        for i in range(topologyEdges.Count):
            line = topologyEdges.EdgeLine(i)
            connectedFaces = topologyEdges.GetConnectedFaces(i)  # int[]
    
            xaxis = line.To - line.From
            xaxis.Unitize()
            zaxis = RhinoGeometry.Vector3d(0, 0, 1)
    
            if connectedFaces.Length != 2:  # naked
                
                zaxis = RhinoGeometry.Vector3d.CrossProduct(
                    faceNormals[connectedFaces[0]], xaxis
                )
                
            else:  # inner
                zaxis_avg = (
                    faceNormals[connectedFaces[0]] + faceNormals[connectedFaces[1]]
                ) / 2
                zaxis_avg.Unitize()
                zaxis = RhinoGeometry.Vector3d.CrossProduct(xaxis, zaxis_avg)
            self._e_planes.append(RhinoGeometry.Plane(line.PointAt(0.5), zaxis))
    
    def dihedral_plane(self, plane0, plane1):
        ####################################################################################################
        # Plane between two Planes
        ####################################################################################################
        result, l = RhinoGeometry.Intersect.Intersection.PlanePlane(plane0, plane1)
        result, t = RhinoGeometry.Intersect.Intersection.LinePlane(l, plane0)
        centerDihedral = l.PointAt(t)
    
        ####################################################################################################
        # Convert ZAxis to lines, cant it be done on origin
        ####################################################################################################
        angleLine0 = RhinoGeometry.Line(plane0.Origin, plane0.Origin + plane0.ZAxis)
        angleLine1 = RhinoGeometry.Line(plane1.Origin, plane1.Origin + plane1.ZAxis)
    
        ####################################################################################################
        # Plane cannot be anti/parallel and they must be apart from each other
        ####################################################################################################
        if (
            plane0.ZAxis.IsParallelTo(plane1.ZAxis, 0.01) == 0
            and plane0.Origin.DistanceToSquared(plane1.Origin) > 0.001
        ):
            ##########################################################################################3##########
            # Intersect two lines to get center
            ####################################################################################################
            result, t0, t1 = RhinoGeometry.Intersect.Intersection.LineLine(
                angleLine0, angleLine1
            )
    
            ####################################################################################################
            # Construct plane from LineLine center and plane origins
            ####################################################################################################
            center = angleLine0.PointAt(t0)
            v0 = plane0.Origin - center
            v1 = plane1.Origin - center
            v0.Unitize()
            v1.Unitize()
    
            ####################################################################################################
            # Compute Plane
            ####################################################################################################
            dihedralPlane = RhinoGeometry.Plane(centerDihedral, l.Direction, v0 + v1)
    
            return dihedralPlane
        else:
            return (
                RhinoGeometry.Plane.Unset
            )  # Axes are paralell or anti-parallel |.| or _._ or planes are at the same location
    
    def get_face_edge_planes(self):
        self._e_planes = []
        self.set_edge_normals()
        self._fe_planes = []  # new Plane[f][]
        
        
        for i in range(self._f):
            n = len(self._f_v[i])
            
            self._fe_planes.append([])
            
            for j in range(len(self._f_v[i])):
                v1 = self._f_v[i][(j + 0) % n]
                v2 = self._f_v[i][(j + 1) % n]
                
                e = self._mesh.TopologyEdges.GetEdgeIndex(v1, v2)  # int e =
                cf = self._mesh.TopologyEdges.GetConnectedFaces(e)  # int[]
                
                sum = RhinoGeometry.Vector3d.Zero
                for k in range(len(cf)):
                    sum += RhinoGeometry.Vector3d(self._mesh.FaceNormals[cf[k]])
                sum = sum / cf.Length
                
                edgePlane = RhinoGeometry.Plane.Unset
                
                if cf.Length == 2:
                    edgePlane = self.dihedral_plane(
                        RhinoGeometry.Plane(
                            self.mesh_face_center(self._mesh, cf[0]),
                            self._mesh.FaceNormals[cf[0]],
                        ),
                        RhinoGeometry.Plane(
                            self.mesh_face_center(self._mesh, cf[1]),
                            self._mesh.FaceNormals[cf[1]],
                        ),
                    )
                    edgePlane = self._e_planes[e]
                else:
                    sum = Vector3d.ZAxis 
                    
                    edgePlane = RhinoGeometry.Plane(
                        (RhinoGeometry.Point3d)(
                            self._mesh.Vertices[v1] + self._mesh.Vertices[v2]
                        )
                        * 0.5,
                        self._mesh.Vertices[v1] - self._mesh.Vertices[v2],
                        sum,
                    )
                
                self._fe_planes[i].append(edgePlane)
    
    def get_bisector_planes(self):
        self._bi_planes = []  # new Plane[f][]
    
        for i in range(self._f):
            n = len(self._f_v[i])
            self._bi_planes.append([])
            for j in range(n):
                pl1 = self._fe_planes[i][j]
                pl0 = self._fe_planes[i][(j + 1) % n]
                self._bi_planes[-1].append(self.dihedral_plane(pl0, pl1))
    
    def get_edges(self):
        if self._has_ngons:
            pass
            # e_ngon_e = self._mesh._EAll()
            # this.e = e_ngon_e.Count
        else:
            self._e_ngon_e = {}
            for i in range(self._mesh.TopologyEdges.Count):
                # {'Germany' : 49}
                self._e_ngon_e.update({i: i})
        self._e = self._e_ngon_e.Count
    
    def get_edge_faces(self):
        if self._has_ngons:
            pass
            # this.e_f = self._mesh._EF()
        else:
            self._e_f = []
            for i in range(self._mesh.TopologyEdges.Count):
                self._e_f.append(self._mesh.TopologyEdges.GetConnectedFaces(i))
    
    def polyline_from_planes(self, basePlane, sidePlanes, close=True):
        polyline = RhinoGeometry.Polyline()
        for i in range(sidePlanes.Count - 1):
            result, pt = RhinoGeometry.Intersect.Intersection.PlanePlanePlane(
                basePlane, sidePlanes[i], sidePlanes[i + 1]
            )
            polyline.Add(pt)
    
        result, pt1 = RhinoGeometry.Intersect.Intersection.PlanePlanePlane(
            basePlane, sidePlanes[sidePlanes.Count - 1], sidePlanes[0]
        )
        polyline.Add(pt1)
    
        if close:
            polyline.Add(polyline[0])
    
        return polyline
    
    def move_plane_by_axis(self, plane, distance):
        return RhinoGeometry.Plane(
            plane.Origin + plane.ZAxis * distance, plane.XAxis, plane.YAxis
        )
    
    def get_face_polylines(self):
        zero_layer = self._face_positions.Count == 0
    
        self._f_polylines_index = []  # new string[f][]
        self._f_polylines_planes = []  # new Plane[f][]
        self._f_polylines = []  # new Polyline[f][]
    
        for i in range(self._f):  # (int i = 0  i < f  i++)
            if self._face_positions.Count == 0:
                self._f_polylines.append([])  # new Polyline[2]
                pline0 = self.polyline_from_planes(
                    self.move_plane_by_axis(
                        self._f_planes[i], self._face_thickness * -0.0
                    ),
                    self._fe_planes[i],
                    True,
                )
                pline1 = self.polyline_from_planes(
                    self.move_plane_by_axis(
                        self._f_planes[i], self._face_thickness * 1.0
                    ),
                    self._fe_planes[i],
                    True,
                )
                self._f_polylines_planes.append(
                    [
                        self.move_plane_by_axis(
                            self._f_planes[i], self._face_thickness * 1.0
                        )
                    ]
                )
                self._f_polylines_index.append([str(i)])
            else:
                self._f_polylines.append(
                    []
                )  # new Polyline[self._face_positions.Count * 2]
                self._f_polylines_planes.append(
                    []
                )  # new Plane[self._face_positions.Count]
                self._f_polylines_index.append(
                    []
                )  # new string[self._face_positions.Count]
    
                for j in range(
                    self._face_positions.Count
                ):  # (int j = 0  j < self._face_positions.Count  j++):
                    pline0 = self.polyline_from_planes(
                        self.move_plane_by_axis(
                            self._f_planes[i],
                            self._face_positions[j] + self._face_thickness * -0.0,
                        ),
                        self._fe_planes[i],
                        True,
                    )
                    pline1 = self.polyline_from_planes(
                        self.move_plane_by_axis(
                            self._f_planes[i],
                            self._face_positions[j] + self._face_thickness * 1.0,
                        ),
                        self._fe_planes[i],
                        True,
                    )
                    self._f_polylines[i].append(pline0)
                    self._f_polylines[i].append(pline1)
                    self._f_polylines_planes[i].append(
                        self.move_plane_by_axis(
                            self._f_planes[i],
                            self._face_positions[j] + self._face_thickness * 1.0,
                        )
                    )
    
                    temp_flag = (
                        str(i)
                        if len(self._face_positions) == 1
                        else str(i) + " " + str(j)
                    )
                    self._f_polylines_index[i].append(temp_flag)
    
    def chamfer_polyline(self, polyline, value=0.001):
        lines = polyline.GetSegments()
        
        if value == 0:
            return polyline
        
        p = RhinoGeometry.Polyline()
        
        if value < 0:
            
            for l in lines:
                l_ = RhinoGeometry.Line(l.From, l.To)
                p.Add(lShorter.From)
                p.Add(lShorter.To)
                counter = counter + 1
        else:
            
            counter = 0
            print(lines.Count)
            for l in lines:
                
                
                
                # get angle
                v0 = l.From-l.To
                v_prev = lines[(counter-1+lines.Count)%lines.Count].To-lines[(counter-1+lines.Count)%lines.Count].From
                
                angle = Vector3d.VectorAngle(v0,v_prev)
                t = math.pi*0.2
                if(angle  <math.pi*t):
                    p.Add(l.PointAt(value))
                else:
                    p.Add(l.From)
                print(angle, (counter-1+lines.Count)%lines.Count, t)
                v0 = l.To-l.From
                v_next = lines[(counter+1)%lines.Count].From-lines[(counter+1)%lines.Count].To
                angle = Vector3d.VectorAngle(v0,v_next)
                
                if(angle < math.pi*t):
                    p.Add(l.PointAt(1 - value))
                else:
                    p.Add(l.To)
                print(angle, counter+1%lines.Count)
                counter = counter + 1
    
        p.Add(p[0])
        print(" ")
        return p
# ---------- end python_2 ----------
pcol = PolylineCollapse(Polyline=python_2, Tolerance=number_slider_3)  # -> Polyline, Count

# ----
# When this is blocked, crash,
crv_29 = Curve(flatten(python_2))
partition_4 = PartitionList(List=crv_29, Size=Slider(2, range=0..10))  # -> simplify(Chunks)

partition_5 = PartitionList(List=python, Size=2)
item_4 = ListItem(List=flatten(pcol.Polyline), Index=Slider(6, range=0..100), Wrap=True)  # -> Item, Item1
item_5 = ListItem(List=flatten(pcol.Polyline), Index=Slider(14, range=0..100), Wrap=True)  # -> Item, Item1
dovetails = Point([Point(304.5856944, 487.9573976, 232.6731415), Point(446.940918, 302.5870358, 232.6731415), Point(222.027954, 278.2435907, 232.6731415), Point(45.4472038, 448.597412, 232.6731415), Point(364.383178, 92.87323008, 232.6731415), Point(446.940918, -73.20294209, 232.6731415)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])
item_6 = ListItem(List=partition_5, Index=0, Wrap=True)  # -> Item, Item1
fingers = Point([Point(428.940918, 120.0485087, 77.99850406), Point(185.8839735, 459.1840705, 126.2741608), Point(-43.2894632, 409.9822766, 137.5218099), Point(260.3469971, 90.14179162, 87.96007592), Point(-215.4671134, 265.2875302, 140.4765773), Point(144.0423163, 22.08113133, 93.32304722), Point(-354.9668926, 81.31932942, 138.6999059), Point(41.73694092, -75.63874241, 94.36067479), Point(-407.2402772, -171.261727, 127.7854233), Point(-39.7041194, -195.22601, 89.27120108), Point(-427.8176953, -482.789978, 109.2839804), Point(-79.55827896, -325.4667004, 85.11432133)])
simplify = SimplifyCurve(Curve=python_2, Tolerance=number_slider_3, AngleTolerance=number_slider_3)  # -> Curve, Simplified
entwine_2 = Entwine(Branch00=dovetails, Branch01=fingers, FlattenInputs=True)
merge = Merge(Data1=Slider(100, range=0..550), Data2=Slider(0.66, range=0..1), Data3=Slider(10, range=10..20))
panel_2 = Panel("""10
12""")
panel_3 = Panel("""100
45
43""")
loft_m_2 = Loft_mesh(p0=item_6.Item, p1=item_6.Item1)  # -> mesh; inputs p0: list of Curve, p1: list of Curve
#   port p0: polylines with holes, bottom
#   port p1: polylines with holes, top
#   port mesh: lofted and capped mesh with holes
# ---------- loft_m_2: Python ----------
"""get joints ids and connections areas between elements"""

__author__ = "petras vestartas"
__version__ = "2023.03.31"

from ghpythonlib.componentbase import executingcomponent as component
import Rhino.RhinoDoc
import Rhino.Geometry
import System
from System.Drawing import Color

class connections_zones(component):


    def to_polyline_from_cp(self, curve):
        
        polyline = Rhino.Geometry.Polyline() 
        result, polyline1 = curve.TryGetPolyline()
        
        if (result == False):
            
            nurbsCurve = curve.ToNurbsCurve()  
            point3dArray = []
            
            for i in range(nurbsCurve.Points.Count):
                result, pt = nurbsCurve.Points.GetPoint(i)
                point3dArray.append(pt)
            
            polyline1 = Rhino.Geometry.Polyline(point3dArray)  
            nurbsCurve = polyline1.ToNurbsCurve()  
            result, polyline1 = nurbsCurve.TryGetPolyline()  
            
            polyline1.CollapseShortSegments(0.01) 
            
            polyline1 = Rhino.Geometry.Polyline(polyline1)  
            polyline = polyline1  
            
        else:
            polyline1.CollapseShortSegments(0.01)  
            polyline = polyline1  
        
        return polyline  

    def loft_polylines_with_holes(self, curves0, curves1):
        """Loft polylines with holes
        
        Parameters
        ----------
        curves0 : list[rg.Polyline]
        curves1 : list[rg.Polyline]
        
        Returns
        -------
        rg.Mesh
            mesh as lofted polylines and cap them
        """
        
        ###############################################################################
        # user input
        ###############################################################################
        
        flag = len(curves0) is not 0 if True else len(curves1) != 0
        if (flag):
            
            curves = []
            curves2 = []
            
            flag0 = len(curves1) == 0
            flag1 = len(curves0) == 0 and len(curves1) != 0
            flag2 = len(curves0) and len(curves1)
            
            if (flag0):
                for i in range(len(curves0)):
                    if (float(i) >= float(len(curves0)) * 0.5):
                        curves2.Add(curves0[i])
                    else:
                        curves.Add(curves0[i])
            elif (flag1):
                for i in range(0, len(curves1), 2):
                    curves.Add(curves1[i])
                    curves2.Add(curves1[i + 1])
            elif (flag2):
                curves = curves0
                curves2 = curves1
            
            curves0 = curves
            curves1 = curves2
        
        ###############################################################################
        # sort curves which one is border and which ones are holes
        ###############################################################################
        length = -1.0
        border_id = -1
        count = 0
        numArray = []
        for curve in curves0:
            diagonal = curve.GetBoundingBox(True).Diagonal
            temp_length = diagonal.Length
            if temp_length > length:
                length = temp_length
                border_id = count
            count=count+1
        
        
        border0 = self.to_polyline_from_cp(curves0[border_id])
        border1 = self.to_polyline_from_cp(curves1[border_id])
        holes0 = []
        holes1 = []
        for i in range(curves0.Count):
            if (i != border_id):
                holes0.Add(curves0[i])
                holes1.Add(curves1[i])
        
        ###############################################################################
        # Create mesh of the bottom face
        ###############################################################################
        mesh_bottom = Rhino.Geometry.Mesh.CreatePatch(border0, Rhino.RhinoDoc.ActiveDoc.ModelAngleToleranceRadians, None, holes0, None, None, True, 1)
        
        ###############################################################################
        # Convert closed polylines to open ones
        ###############################################################################
        
        point_3d_array = []
        for i in range(len(mesh_bottom.Vertices)):
            point_3d_array.append(mesh_bottom.Vertices.Point3dAt(i))
        
        open_curve_points_0 = []
        open_curve_points_1 = []
        
        for i in range(border0.Count-1):
            open_curve_points_0.append( border0[i])
            open_curve_points_1.append( border1[i])
        
        for i in range(holes0.Count):
            holes0_polyline = self.to_polyline_from_cp(holes0[i]) 
            holes1_polyline = self.to_polyline_from_cp(holes1[i]) 
            for j in range(len(holes0_polyline)-1):
                open_curve_points_0.append(holes0_polyline[j])
                open_curve_points_1.append(holes1_polyline[j])
        
        ###############################################################################
        # Using the bottom mesh vertices create the top mesh f
        ###############################################################################
        points_to_sort_new = self.sort_set_of_points(open_curve_points_0, point_3d_array)
        mesh_top = mesh_bottom.DuplicateMesh()
        
        for i in range(len(points_to_sort_new)):
            mesh_top.Vertices.SetVertex(i, open_curve_points_1[points_to_sort_new[i]])
        
        ###############################################################################
        # Merge the top and bottom mesh into one and add sides
        ###############################################################################
        mesh = Rhino.Geometry.Mesh()
        mesh.Append(mesh_bottom)
        mesh.Append(mesh_top)
        
        count = mesh_bottom.Vertices.Count
        for p in range (mesh_bottom.TopologyEdges.Count):
            
            if (mesh_bottom.TopologyEdges.GetConnectedFaces(p).Length == 1):
                topologyVertices = mesh_bottom.TopologyEdges.GetTopologyVertices(p)
                mesh.Faces.AddFace(topologyVertices.I, topologyVertices.J, topologyVertices.J + count, topologyVertices.I + count)
        
        mesh.UnifyNormals()
        mesh.Ngons.AddPlanarNgons(Rhino.RhinoDoc.ActiveDoc.ModelAbsoluteTolerance * 1, 3, 1, True)
        
        ###############################################################################
        # Unweld ngons meshes
        ###############################################################################
        unwelded_ngon_mesh = Rhino.Geometry.Mesh()
        count = 0
        for ngonAndFacesEnumerable in mesh.GetNgonAndFacesEnumerable():
            
            faces = []
            for j in ngonAndFacesEnumerable.FaceIndexList():
                faces.append(System.Int32(j))
            
            temp_ngon_mesh = mesh.DuplicateMesh().Faces.ExtractFaces(faces)
            
            #add colors
            if(count<2):
                temp_ngon_mesh.VertexColors.CreateMonotoneMesh(Color.LightGray)
                
            else:
                temp_ngon_mesh.VertexColors.CreateMonotoneMesh(Color.DeepPink)
            
            unwelded_ngon_mesh.Append(temp_ngon_mesh)
            count = count + 1
        
        ###############################################################################
        # Output
        ###############################################################################
        unwelded_ngon_mesh.RebuildNormals()
        return unwelded_ngon_mesh




    def sort_set_of_points(self, points_to_sort, guide_points):
        """Sort one array of point by an another point array
        
        use it like this: 
        #points_to_sort_new = []
        #for i in points_to_sort_ids:
        #    points_to_sort_new.append(points_to_sort[i])
        
        Parameters
        ----------
        points_to_sort : list[rg.Point3d]
        guide_points : list[rg.Point3d]
        
        Returns
        -------
        list[int]
            the list of indices of the sorted array
        """
        
        # create a copy
        points_to_sort_copy = []
        for i in points_to_sort:
            points_to_sort_copy.append(Rhino.Geometry.Point3d(i))
        
        guide_points_copy = []
        for i in guide_points:
            guide_points_copy.append(Rhino.Geometry.Point3d(i))
        
        # make indices of points
        points_to_sort_ids = list(range(0,len(points_to_sort_copy)))
        guide_points_ids = list(range(0,len(guide_points_copy)))
        
        # sort both lists by xyz coordinates together with indices
        points_to_sort_copy, points_to_sort_ids = zip(*sorted(zip(points_to_sort_copy, points_to_sort_ids)))
        guide_points_copy, guide_points_ids = zip(*sorted(zip(guide_points_copy, guide_points_ids)))
        
        # sort guide points indices and order the points to sort indec
        guide_points_ids, points_to_sort_ids = zip(*sorted(zip(guide_points_ids, points_to_sort_ids)))
        
        # can be used like this:
        #points_to_sort_new = []
        #for i in points_to_sort_ids:
        #    points_to_sort_new.append(points_to_sort[i])
        
        return points_to_sort_ids

    def RunScript(self, _p0, _p1):
        if _p0 and _p1:
            return self.loft_polylines_with_holes(_p0, _p1)
# ---------- end loft_m_2 ----------
crv_30 = Curve([item_4.Item, item_4.Item1, item_5.Item, item_5.Item1])
loft_m_3 = Loft_mesh()  # -> mesh; inputs p0: list of Curve, p1: list of Curve; same code as loft_m_2
joint_parameters = Joint_parameters(ss_e_op=merge, tt_e_p=panel_3)  # -> p; inputs ss_e_ip: list, ss_e_op: list, ts_e_p: list, cr_c_ip: list, tt_e_p: list, ss_e_r: list, b: list
#   port ss_e_ip: side-to-side in-plane joint parameters
# ---------- joint_parameters: Python ----------
__author__ = "petras vestartas"
__version__ = "2023.03.29"

"""
Output joint parameters in one list
"""
from ghpythonlib.componentbase import executingcomponent as component


class joint_parameters_component(component):
    def RunScript(
        self,
        _ss_e_ip,
        _ss_e_op,
        _ts_e_p,
        _cr_c_ip,
        _tt_e_p,
        _ss_e_r,
        _b

    ):
        
        joint_parameters = [
            300, 0.5, 3,   # 1-9 ss_e_ip (side-to-side edge in-plane)
            50, 0.64, 15,  # 10-19 ss_e_op (side-to-side edge out-of-plane)
            450, 0.5, 20,  # 20-29 ts_e_p (top-to-side edge plane)
            300, 0.5, 30,  # 30-39 cr_c_ip (cross cutting in-plane)
            6, 0.95, 40,   # 40-49 tt_e_p  (top-to-top edge plane)
            300, 0.5, 58,  # 50-59 ss_e_r (side-to-side edge rotated)
            300, 1.0, 60   # 60-69 b (boundary)
        ]

        for i in range(len(_ss_e_ip)):
            joint_parameters[0*3+i] = _ss_e_ip[i]

        for i in range(len(_ss_e_op)):
            joint_parameters[1*3+i] = _ss_e_op[i]

        for i in range(len(_ts_e_p)):
            joint_parameters[2*3+i] = _ts_e_p[i]

        for i in range(len(_cr_c_ip)):
            joint_parameters[3*3+i] = _cr_c_ip[i]

        for i in range(len(_tt_e_p)):
            joint_parameters[4*3+i] = _tt_e_p[i]

        for i in range(len(_ss_e_r)):
            joint_parameters[5*3+i] = _ss_e_r[i]

        for i in range(len(_b)):
            joint_parameters[6*3+i] = _b[i]

        _joint_p = joint_parameters

        return _joint_p
# ---------- end joint_parameters ----------
closest_indexed_points = ClosestIndexedPoints(polylines=weave, points=entwine_2, joint_types=graft(panel_2))  # -> flatten(polylines_out), joint_types_out; inputs polylines: tree of Curve, points: tree of Point3d, joint_types: tree of Int32
#   port polylines: polylines tree branch order does not matter it is flatenned inside the component
# ---------- closest_indexed_points: Python ----------
from ghpythonlib.componentbase import executingcomponent as component
import Grasshopper, GhPython
import System
import Rhino
import rhinoscriptsyntax as rs

"""Provides a scripting component.
    Inputs:
        x: The x script variable
        y: The y script variable
    Output:
        a: The a output variable"""

__author__ = "petra"
__version__ = "2023.04.04"

import Rhino.Geometry
from Rhino.Geometry import RTree
from Rhino.Geometry import BoundingBox
from Rhino.Geometry import Sphere
from Rhino.Geometry import Vector3d
from Rhino.Geometry import Point3d
from Rhino.Geometry import Polyline
from Rhino.Geometry import Line
import Grasshopper
import ghpythonlib.treehelpers as th


class MyComponent(component):
    def RunScript(self, _polylines, _points, _joint_types):
        ###############################################################################
        # Input
        ###############################################################################
        polylines = []
        polylines_out = Grasshopper.DataTree[Polyline]()
        pts = []
        ids = []

        ###############################################################################
        # Conversion
        ###############################################################################
        count = 0
        for curve in _polylines.AllData():
            result, polyline = curve.TryGetPolyline()
            polylines_out.Add(
                polyline, Grasshopper.Kernel.Data.GH_Path(int(count * 0.5))
            )
            if count % 2 == 0:
                polylines.append([polyline])
            else:
                polylines[-1].append(polyline)
            count = count + 1

        if _points.DataCount > 0 and _joint_types.DataCount > 0:
            for i in range(_points.BranchCount):
                for j in range(_points.Branch(i).Count):
                    pts.append(_points.Branch(i)[j])
                    ids.append(_joint_types.Branch(i)[j % _joint_types.Branch(i).Count])
        # pts = _points.AllData()
        # ids = _joint_types.AllData()

        ###############################################################################
        # Run the closest point search
        ###############################################################################

        # convert element polylines to a flattened dictionary:
        segments_dictionary = (
            {}
        )  # stores ids e.g. int , [element_int,bottom_or_top_polyline_int,edge,int, bounding_box, hit_count, point_id]
        joint_types = []
        count = 0
        for i in range(len(polylines)):
            joint_types.append([-1] * (polylines[i][0].SegmentCount + 2))
            for j in range(len(polylines[i])):
                for k in range(polylines[i][j].SegmentCount):
                    bbox = polylines[i][j].SegmentAt(k).BoundingBox
                    bbox.Inflate(0.2)
                    segments_dictionary.Add(
                        count, [i, j, k, bbox, polylines[i][j].SegmentAt(k)]
                    )
                    count = count + 1

        # create a tree
        rtree = Rhino.Geometry.RTree()

        # fill the tree
        for i in segments_dictionary:
            rtree.Insert(segments_dictionary[i][3], i)

        # call_backs of rtree
        hit_count = 0

        def search_callback(sender, rtree_event_args):
            data_by_reference.append(rtree_event_args.Id)

        # perform search
        for i in range(len(pts)):
            data_by_reference = []
            if rtree.Search(Sphere(pts[i], 0), search_callback, data_by_reference):
                for j in data_by_reference:
                    if (
                        pts[i].DistanceToSquared(
                            segments_dictionary[j][4].ClosestPoint(pts[i], True)
                        )
                        < 0.01
                    ):
                        joint_types[segments_dictionary[j][0]][
                            segments_dictionary[j][2] + 2
                        ] = ids[i]

        ###############################################################################
        # Output
        ###############################################################################
        _polylines_out = polylines_out
        _joints_types_out = th.list_to_tree(joint_types)

        # return outputs if you have them; here I try it for you:
        return (_polylines_out, _joints_types_out)
# ---------- end closest_indexed_points ----------
item_7 = ListItem(List=panel_3, Index=2, Wrap=True)
panel_4 = Panel("""10
12""")
panel_5 = Panel("""0
8
9
1""")
panel_6 = Panel("""6
8
9
7""")
panel_7 = Panel("""2
10
11
3""")
panel_8 = Panel("""4
10
11
5""")
panel_9 = Panel("""8
10
11
9""")
replace = ReplaceItems(List=closest_indexed_points.joint_types_out, Item=item_7, Indices=[0, 1], Wrap=False)  # -> simplify(flatten(List))
closest_indexed_points_2 = ClosestIndexedPoints(polylines=partition_4, joint_types=graft(panel_4))  # -> flatten(polylines_out), joint_types_out; inputs polylines: tree of Curve, points: tree of Point3d, joint_types: tree of Int32; disabled; same code as closest_indexed_points
panel_10 = Panel(joint_parameters)
panel_11 = Panel("""100
45
43""")
merge_2 = Merge(Data1=Slider(503, range=0..10550), Data2=Slider(0.63, range=0..1), Data3=Slider(16, range=10..30))
unflatten = UnflattenTree(Tree=replace, Guide=closest_indexed_points.joint_types_out)
joint_parameters_2 = Joint_parameters(ss_e_op=merge_2)  # -> p; inputs ss_e_ip: list, ss_e_op: list, ts_e_p: list, cr_c_ip: list, tt_e_p: list, ss_e_r: list, b: list; same code as joint_parameters
entwine_3 = Entwine(
    Branch00="1",
    Branch01=panel_5,
    Branch02=panel_6,
    Branch03=panel_7,
    Branch04=panel_8,
    Branch05=panel_9,
    FlattenInputs=True)
input_set = Input_set(polylines=closest_indexed_points.polylines_out, joint_types=unflatten)  # -> data; inputs polylines: tree of Polyline, vectors: tree of Vector3d, joint_types: tree of Int32, three_valence: tree of Int32, adjacency: tree of Int32
#   port polylines: a data-tree of polyline pairs
# ---------- input_set: Python ----------
from ghpythonlib.componentbase import executingcomponent as component
import Grasshopper, GhPython
__author__ = "petras"
__version__ = "2023.04.02"


import System
import Rhino
import rhinoscriptsyntax as rs
import ghpythonlib.treehelpers as th
from Rhino.Geometry import Polyline
from Rhino.Geometry import Vector3d
from Rhino.Geometry import Plane

class MyComponent(component):
    
    def get_plane(self, _polyline, _orientation_point):
        
        len = _polyline.Count - 1
        normal = Vector3d(0,0,0)
        
        for i in range((_polyline.Count - 1)):
            num = ((i - 1) + len) % len
            item1 = ((i + 1) + len) % len
            point3d =_polyline[num]
            point3d1 =_polyline[item1]
            item2 = _polyline[i]
            normal = normal + Vector3d.CrossProduct(Vector3d(item2 - point3d), Vector3d(point3d1 - item2))
        
        normal.Unitize()
        plane = Plane(_polyline.CenterPoint(), normal)
        if(plane.DistanceTo(_orientation_point)<0):
            plane.Flip()
        
        return plane
    
    
    
    def RunScript(self, _plines, _insertion_vectors, _joints_per_face, _three_valence, _adjacency):
        
        
        
        plines = []
        planes = []
        if( _plines.DataCount > 0):
            for i in range(_plines.BranchCount):
                plines.append(_plines.Branch(i))
                # create planes for orientation
                
                planes.append(self.get_plane(_plines.Branch(i)[0],_plines.Branch(i)[1][0]))
        
        insertion_vectors =  th.tree_to_list(_insertion_vectors) if _insertion_vectors.DataCount > 0 else []
        joints_per_face =  th.tree_to_list(_joints_per_face) if _joints_per_face.DataCount > 0 else []
        three_valence =  th.tree_to_list(_three_valence) if _three_valence.DataCount > 0 else []
        adjacency = th.tree_to_list(_adjacency) if _adjacency.DataCount > 0 else []
        
        # output
        _data = [[plines,insertion_vectors,joints_per_face,three_valence,adjacency, planes]]
        
        
        # return outputs if you have them; here I try it for you:
        return _data
# ---------- end input_set ----------
panel_12 = Panel("""0
8
-1
-1
9
1
-1
-1
6
8
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""")
solver = Solver(data=input_set, joint_p=joint_parameters, scale=[1, 1, 1], extension=[0, 0, 0], get=Slider(4, range=0..10))  # -> data; inputs joint_p: list, scale: list of Int32, extension: list of Int32, find: Int32, get: Int32
#   port data: collection of inputs that represent the elements, insertion vectors, joint types and adjacency, use input_set commonent to group these inputs
# ---------- solver: Python ----------
from ghpythonlib.componentbase import executingcomponent as component
import Grasshopper, GhPython
import Rhino
from Rhino.Geometry import Polyline
from compas_rhino import conversions

import time
from ctypes import *
import compas_wood
from compas_wood.ctypes_conversion import *




class connections_zones(component):
    
    bbox = Rhino.Geometry.BoundingBox.Unset
    lines = []
    insertion_vectors_current = []
    joint_per_face_current_text_entity = []
    polylines = []
    
    def DrawViewportWires(self, args):
        #GrasshopperDocument = Grasshopper.Instances.ActiveCanvas.Document
        #is_selected = False
        """
        for _ in GrasshopperDocument.Objects:
            is_selected = _.Attributes.Selected
        """
        #col = args.WireColour_Selected if is_selected else args.WireColour;
        col =  args.WireColour
        line_weight = args.DefaultCurveThickness;
        try:
            for polyline in self.polylines:
                args.Display.DrawPolyline(polyline,  col, line_weight)
            """
            plane = Plane.WorldXY
            for line in self.lines:
                args.Display.DrawLineArrow(line, Color.FromArgb(207, 0, 90), 2, 100)
            for insertionVectorsCurrent in self.insertion_vectors_current:
                if(insertionVectorsCurrent.Length<0.05):
                    continue
                args.Display.DrawLine(insertionVectorsCurrent, Color.FromArgb(0, 0, 0), 5)
            for jointPerFaceCurrent in self.joint_per_face_current_text_entity:
                result, plane = Rhino.RhinoDoc.ActiveDoc.Views.ActiveView.ActiveViewport.GetCameraFrame()
                plane.Origin=(jointPerFaceCurrent.Plane.Origin)
                args.Display.Draw3dText(jointPerFaceCurrent.PlainText, jointPerFaceCurrent.MaskColor, plane, jointPerFaceCurrent.TextHeight, "Arial", False, False,Rhino.DocObjects.TextHorizontalAlignment.Center, Rhino.DocObjects.TextVerticalAlignment.BottomOfTop)
            """
        except Exception, e:
            System.Windows.Forms.MessageBox.Show(str(e), "script error")
    
    def get_ClippingBox(self):
        return self.bbox
    
    def RunScript(self, _data, _join_p, _scale, _extension, _find, _get):
        # ==============================================================================
        # clear input
        # ==============================================================================
        self.bbox = Rhino.Geometry.BoundingBox.Unset
        self.lines = []
        self.insertion_vectors_current = []
        self.joint_per_face_current_text_entity = []
        self.polylines = []
        # ==============================================================================
        # input
        # ==============================================================================
        if(_data is None):
            return
        
        input_polylines = []
        if( _data[0] != 0):
            #convert to compas polylines
            for i in _data[0]:
                for j in i:
                    input_polylines.append(conversions.polyline_to_compas(j))
        
        input_vectors = []
        if(_data[1] != None):
            for i in _data[1]:
                list = []
                for j in i:
                    list.append(conversions.vector_to_compas(j))
                input_vectors.append(list)
        
        joint_parameters = [
            300, 0.5, 3,   # 1-9 ss_e_ip (side-to-side edge in-plane)
            50, 0.64, 15,  # 10-19 ss_e_op (side-to-side edge out-of-plane)
            450, 0.5, 20,  # 20-29 ts_e_p (top-to-side edge plane)
            300, 0.5, 30,  # 30-39 cr_c_ip (cross cutting in-plane)
            6, 0.95, 40,   # 40-49 tt_e_p  (top-to-top edge plane)
            300, 0.5, 58,  # 50-59 ss_e_r (side-to-side edge rotated)
            300, 1.0, 60   # 60-69 b (boundary)
        ]
        
        for i in range(0, len(_join_p)):
            joint_parameters[i] = _join_p[i]
        
        search = id = max(min(2, _find), 0)
        
        scale = [1,1,1]
        for i in range(0, len(_scale)):
            scale[i] = _scale[i]
        
        output_type = _get if _get != None else 4
        
        extension = [0,0,0]
        
        if(len(_extension)>2):
            extension = _extension
        
        
        input_adjacency = []
        if(len(_data[4])>0):
            for i in _data[4]:
                for j in i:
                    input_adjacency.append(j)
        input_adjacency = []
        ############################################################################################################
        # Load inputs and perform conversion
        ############################################################################################################
    
        # input geometry
        # input_polylines = data_set_plates.annen_small_polylines()
        # print(len(input_polylines))
        (
            in_polyline_pairs_f,
            in_polyline_pairs_f_s,
            in_polyline_pairs_v,
            in_polyline_pairs_v_s,
        ) = list_polylines_coord(input_polylines)
        
    
        #input_vectors = data_set_plates.annen_small_edge_directions()
    
        (
            in_vectors_f,
            in_vectors_f_s,
            in_vectors_v,
            in_vectors_v_s,
        ) = lists_vectors_coord(input_vectors)
        
        
        
        input_joints = _data[2]#data_set_plates.annen_small_edge_joints()
        # print(len(input_joints))
        (
            in_joints_f,
            in_joints_f_s,
            in_joints_v,
            in_joints_v_s,
        ) = lists_numbers_coord(input_joints)
    
        input_three_valence =_data[3]#(data_set_plates.annen_small_three_valance_element_indices_and_instruction()   )
        
        # print(len(input_three_valence))
    
        (
            in_three_valence_f,
            in_three_valence_f_s,
            in_three_valence_v,
            in_three_valence_v_s,
        ) = lists_numbers_coord(input_three_valence)
    
        #input_adjacency = []
        
        (
            in_adjancency_v,
            in_adjancency_v_s,
        ) = list_ints_coord(input_adjacency)
    
        # input parameters
        (
            in_joint_parameters_v,
            in_joint_parameters_v_s,
        ) = list_numbers_coord(joint_parameters)
    
        in_search_type = c_int(search)
        (
            in_scale_v,
            in_scale_v_s,
        ) = list_numbers_coord(scale)
    
        in_output_type = c_int(output_type)
    
        # output
    
        # out polylines
        out_plines_groups_f = POINTER(c_size_t)()
        out_plines_groups_f_s = c_size_t()
        out_plines_out_f = POINTER(c_size_t)()
        out_plines_out_f_s = c_size_t()
        out_plines_out_v = POINTER(c_float)()
        out_plines_out_v_s = c_size_t()
    
        # out types
        out_types_f = POINTER(c_size_t)()
        out_types_f_s = c_size_t()
        out_types_v = POINTER(c_int)()
        out_types_v_s = c_size_t()
    
        # global_parameters
        (
            in_joint_volume_parameters_v,
            in_joint_volume_parameters_v_s,
        ) = list_numbers_coord(extension)
        
        face_to_face_side_to_side_joints_dihedral_angle = c_float(130.0)
        
        ############################################################################################################
        # Load library and declare function signature
        ############################################################################################################
        """
        lib_ = cdll.LoadLibrary(
        
            "C:/legion_pro_7_16IRX8H/software/python/compas_wood/src/frontend/build/Release/libgmp-10.dll"
        )
        lib = cdll.LoadLibrary(
            "C:/legion_pro_7_16IRX8H/software/python/compas_wood/src/frontend/build/Release/pinvoke_wood.dll"
        )
        """
        lib_ = cdll.LoadLibrary(
        
            "C:/IBOIS57/_Code/Software/Python/compas_wood/src/frontend/build/Release/libgmp-10.dll"
        )
        lib = cdll.LoadLibrary(
            "C:/IBOIS57/_Code/Software/Python/compas_wood/src/frontend/build/Release/pinvoke_wood.dll"
        )
        
        lib.ctypes_get_connection_zones.restype = None
        lib.ctypes_get_connection_zones.argtypes = [
            # input geometry
            # polylines
            POINTER(c_size_t),
            POINTER(c_size_t),  # if a value is passed by reference, it must be a pointer
            POINTER(c_float),
            POINTER(c_size_t),  # if a value is passed by reference, it must be a pointer
            # vectors
            POINTER(c_size_t),
            POINTER(c_size_t),
            POINTER(c_float),
            POINTER(c_size_t),
            # joints
            POINTER(c_size_t),
            POINTER(c_size_t),
            POINTER(c_int),
            POINTER(c_size_t),
            # three valence
            POINTER(c_size_t),
            POINTER(c_size_t),
            POINTER(c_int),
            POINTER(c_size_t),
            # adjacency
            POINTER(c_int),
            POINTER(c_size_t),
            # input parameters
            POINTER(c_float),
            POINTER(c_size_t),
            # search_type
            POINTER(c_int),
            # scale
            POINTER(c_float),
            POINTER(c_size_t),
            # output_type
            POINTER(c_int),
            # output
            # polylines
            POINTER(POINTER(c_size_t)),
            POINTER(c_size_t),
            POINTER(POINTER(c_size_t)),
            POINTER(c_size_t),
            POINTER(POINTER(c_float)),
            POINTER(c_size_t),
            # types
            POINTER(POINTER(c_size_t)),
            POINTER(c_size_t),
            POINTER(POINTER(c_int)),
            POINTER(c_size_t),
            # global_parameters
            POINTER(c_float), # joint volume
            POINTER(c_size_t), # joint volume
            POINTER(c_float) # dihedral angle to switch between in-plane and out-of-plane jointery default is 150 degrees
        ]
    
        # generate joints
        start_time = time.time()
        ############################################################################################################
        # Call the function
        # https://stackoverflow.com/questions/4145775/how-do-i-convert-a-python-list-into-a-c-array-by-using-ctypes
        # https://stackoverflow.com/questions/53265216/python-ctypes-type-conversion
        ############################################################################################################
        
        lib.ctypes_get_connection_zones(
            # input geometry
            # polylines
            in_polyline_pairs_f,
            byref(in_polyline_pairs_f_s),
            in_polyline_pairs_v,
            byref(in_polyline_pairs_v_s),
            # vectors
            in_vectors_f,
            byref(in_vectors_f_s),
            in_vectors_v,
            byref(in_vectors_v_s),
            # joints
            in_joints_f,
            byref(in_joints_f_s),
            in_joints_v,
            byref(in_joints_v_s),
            # three_valence
            in_three_valence_f,
            byref(in_three_valence_f_s),
            in_three_valence_v,
            byref(in_three_valence_v_s),
            # adjacency
            in_adjancency_v,
            byref(in_adjancency_v_s),
            # input parameters
            # joint_parameters
            in_joint_parameters_v,
            byref(in_joint_parameters_v_s),
            # search_type
            byref(in_search_type),
            # scale
            in_scale_v,
            byref(in_scale_v_s),
            # output_type
            byref(in_output_type),
            # output
            # polylines
            byref(out_plines_groups_f),
            byref(out_plines_groups_f_s),
            byref(out_plines_out_f),
            byref(out_plines_out_f_s),
            byref(out_plines_out_v),
            byref(out_plines_out_v_s),
            # types
            byref(out_types_f),
            byref(out_types_f_s),
            byref(out_types_v),
            byref(out_types_v_s),
            # global_parameters
            in_joint_volume_parameters_v,
            byref(in_joint_volume_parameters_v_s),
            byref(face_to_face_side_to_side_joints_dihedral_angle),
        )
    
        """
    
        print(out_plines_groups_f[0])
        out_polylines = []
        """
        out_polylines = coord_polylines_lists(
            out_plines_groups_f,
            out_plines_groups_f_s,
            out_plines_out_f,
            out_plines_out_f_s,
            out_plines_out_v,
            out_plines_out_v_s,
        )
    
        _cuts = coord_numbers_lists(
            out_types_f, out_types_f_s, out_types_v, out_types_v_s
        )
        
        
        print(
            "\n______________________________________ %s ms ______________________________________"
            % round((time.time() - start_time) * 1000.0, 2)
        )
        
    
    

        
        
        # ==============================================================================
        # output
        # ==============================================================================
        _plines = []
        self.bbox = Rhino.Geometry.BoundingBox.Unset
        # nest two times the result and add to the tree
        for i in range(0, len(out_polylines)):
            list = []
            for j in range(0, len(out_polylines[i])):
                    list.append(conversions.polyline_to_rhino(out_polylines[i][j]))
                    self.polylines.append(list[-1])
                    self.bbox.Union(list[-1].BoundingBox)
            _plines.append(list)
        
        _data = [[_plines,_data[1],_data[2],_data[3],_data[4],_data[5],_cuts]]
        
        
        ############################################################################################################
        # release the memory
        ############################################################################################################
    
        # release output of polylines
        
        
        lib.release_size_t(byref(out_plines_groups_f), True)
        lib.release_size_t(byref(out_plines_out_f), True)
        lib.release_float(byref(out_plines_out_v), True)
    
        # release output of types
        lib.release_size_t(byref(out_types_f), True)
        lib.release_int(byref(out_types_v), True)
        
        
        return _data
# ---------- end solver ----------
entwine_4 = Entwine(Branch00=panel_12, FlattenInputs=True)  # -> simplify(Result)
extensions_per_joint = Panel("""0
0
-400
0
0
-400
0
0
-400
0
0
-400
0
0
-400
0
0
-400
0
0
-400
0
0
-400
0
0
-50
0
0
-50""")
input_set_2 = Input_set(polylines=partition_4, three_valence=entwine_3, adjacency=entwine_4)  # -> data; inputs polylines: tree of Polyline, vectors: tree of Vector3d, joint_types: tree of Int32, three_valence: tree of Int32, adjacency: tree of Int32
#   port polylines: a data-tree of polyline pairs
# ---------- input_set_2: Python ----------
from ghpythonlib.componentbase import executingcomponent as component
import Grasshopper, GhPython
__author__ = "petras"
__version__ = "2023.04.02"


import System
import Rhino
import rhinoscriptsyntax as rs
import ghpythonlib.treehelpers as th
from Rhino.Geometry import Polyline
from Rhino.Geometry import Vector3d
from Rhino.Geometry import Plane

class MyComponent(component):
    
    def get_plane(self, _polyline, _orientation_point):
        
        len = _polyline.Count - 1
        normal = Vector3d(0,0,0)
        
        for i in range((_polyline.Count - 1)):
            num = ((i - 1) + len) % len
            item1 = ((i + 1) + len) % len
            point3d =_polyline[num]
            point3d1 =_polyline[item1]
            item2 = _polyline[i]
            normal = normal + Vector3d.CrossProduct(Vector3d(item2 - point3d), Vector3d(point3d1 - item2))
        
        normal.Unitize()
        plane = Plane(_polyline.CenterPoint(), normal)
        if(plane.DistanceTo(_orientation_point)<0):
            plane.Flip()
        
        return plane
    
    
    
    def RunScript(self, _plines, _insertion_vectors, _joints_per_face, _three_valence, _adjacency):
        
        
        
        plines = []
        planes = []
        if( _plines.DataCount > 0):
            for i in range(_plines.BranchCount):
                plines.append(_plines.Branch(i))
                # create planes for orientation
                
                planes.append(self.get_plane(_plines.Branch(i)[0],_plines.Branch(i)[1][0]))
        
        insertion_vectors =  th.tree_to_list(_insertion_vectors) if _insertion_vectors.DataCount > 0 else []
        joints_per_face =  th.tree_to_list(_joints_per_face) if _joints_per_face.DataCount > 0 else []
        three_valence =  th.tree_to_list(_three_valence) if _three_valence.DataCount > 0 else []
        adjacency = th.tree_to_list(_adjacency) if _adjacency.DataCount > 0 else []
        
        # output
        _data = [[plines,insertion_vectors,joints_per_face,three_valence,adjacency, planes]]
        print(three_valence)
        
        # return outputs if you have them; here I try it for you:
        return _data
# ---------- end input_set_2 ----------
crv_31 = Curve(crv_30)
solver_2 = Solver(
    data=input_set_2,
    joint_p=joint_parameters_2,
    scale=[1, 1, 1],
    extension=extensions_per_joint,
    get=Slider(4, range=0..10))  # -> data; inputs joint_p: list, scale: list, extension: list of Int32, find: Int32, get: Int32
#   port data: collection of inputs that represent the elements, insertion vectors, joint types and adjacency, use input_set commonent to group these inputs
# ---------- solver_2: Python ----------
from ghpythonlib.componentbase import executingcomponent as component
import Grasshopper, GhPython
import Rhino
from Rhino.Geometry import Polyline
from compas_rhino import conversions

import time
from ctypes import *
import compas_wood
from compas_wood.ctypes_conversion import *




class connections_zones(component):
    
    bbox = Rhino.Geometry.BoundingBox.Unset
    lines = []
    insertion_vectors_current = []
    joint_per_face_current_text_entity = []
    polylines = []
    
    def DrawViewportWires(self, args):
        #GrasshopperDocument = Grasshopper.Instances.ActiveCanvas.Document
        #is_selected = False
        """
        for _ in GrasshopperDocument.Objects:
            is_selected = _.Attributes.Selected
        """
        #col = args.WireColour_Selected if is_selected else args.WireColour;
        col =  args.WireColour
        line_weight = args.DefaultCurveThickness;
        try:
            for polyline in self.polylines:
                args.Display.DrawPolyline(polyline,  col, line_weight)
            """
            plane = Plane.WorldXY
            for line in self.lines:
                args.Display.DrawLineArrow(line, Color.FromArgb(207, 0, 90), 2, 100)
            for insertionVectorsCurrent in self.insertion_vectors_current:
                if(insertionVectorsCurrent.Length<0.05):
                    continue
                args.Display.DrawLine(insertionVectorsCurrent, Color.FromArgb(0, 0, 0), 5)
            for jointPerFaceCurrent in self.joint_per_face_current_text_entity:
                result, plane = Rhino.RhinoDoc.ActiveDoc.Views.ActiveView.ActiveViewport.GetCameraFrame()
                plane.Origin=(jointPerFaceCurrent.Plane.Origin)
                args.Display.Draw3dText(jointPerFaceCurrent.PlainText, jointPerFaceCurrent.MaskColor, plane, jointPerFaceCurrent.TextHeight, "Arial", False, False,Rhino.DocObjects.TextHorizontalAlignment.Center, Rhino.DocObjects.TextVerticalAlignment.BottomOfTop)
            """
        except Exception, e:
            System.Windows.Forms.MessageBox.Show(str(e), "script error")
    
    def get_ClippingBox(self):
        return self.bbox
    
    def RunScript(self, _data, _join_p, _scale, _extension, _find, _get):
        # ==============================================================================
        # clear input
        # ==============================================================================
        self.bbox = Rhino.Geometry.BoundingBox.Unset
        self.lines = []
        self.insertion_vectors_current = []
        self.joint_per_face_current_text_entity = []
        self.polylines = []
        # ==============================================================================
        # input
        # ==============================================================================
        if(_data is None):
            return
        
        input_polylines = []
        if( _data[0] != 0):
            #convert to compas polylines
            for i in _data[0]:
                for j in i:
                    input_polylines.append(conversions.polyline_to_compas(j))
        
        input_vectors = []
        if(_data[1] != None):
            for i in _data[1]:
                list = []
                for j in i:
                    list.append(conversions.vector_to_compas(j))
                input_vectors.append(list)
        
        joint_parameters = [
            300, 0.5, 3,   # 1-9 ss_e_ip (side-to-side edge in-plane)
            50, 0.64, 15,  # 10-19 ss_e_op (side-to-side edge out-of-plane)
            450, 0.5, 20,  # 20-29 ts_e_p (top-to-side edge plane)
            300, 0.5, 30,  # 30-39 cr_c_ip (cross cutting in-plane)
            6, 0.95, 40,   # 40-49 tt_e_p  (top-to-top edge plane)
            300, 0.5, 58,  # 50-59 ss_e_r (side-to-side edge rotated)
            300, 1.0, 60   # 60-69 b (boundary)
        ]
        
        for i in range(0, len(_join_p)):
            joint_parameters[i] = _join_p[i]
        
        search = id = max(min(2, _find), 0)
        
        scale = [1,1,1]
        for i in range(0, len(_scale)):
            scale[i] = _scale[i]
        
        output_type = _get if _get != None else 4
        
        extension = [0,0,0]
        
        if(len(_extension)>2):
            extension = _extension
        
        
        input_adjacency = []
        if(len(_data[4])>0):
            for i in _data[4]:
                for j in i:
                    input_adjacency.append(j)
        input_adjacency = []
        ############################################################################################################
        # Load inputs and perform conversion
        ############################################################################################################
    
        # input geometry
        # input_polylines = data_set_plates.annen_small_polylines()
        # print(len(input_polylines))
        (
            in_polyline_pairs_f,
            in_polyline_pairs_f_s,
            in_polyline_pairs_v,
            in_polyline_pairs_v_s,
        ) = list_polylines_coord(input_polylines)
        
    
        #input_vectors = data_set_plates.annen_small_edge_directions()
    
        (
            in_vectors_f,
            in_vectors_f_s,
            in_vectors_v,
            in_vectors_v_s,
        ) = lists_vectors_coord(input_vectors)
        
        
        
        input_joints = _data[2]#data_set_plates.annen_small_edge_joints()
        # print(len(input_joints))
        (
            in_joints_f,
            in_joints_f_s,
            in_joints_v,
            in_joints_v_s,
        ) = lists_numbers_coord(input_joints)
    
        input_three_valence =_data[3]#(data_set_plates.annen_small_three_valance_element_indices_and_instruction()   )
        
        # print(len(input_three_valence))
    
        (
            in_three_valence_f,
            in_three_valence_f_s,
            in_three_valence_v,
            in_three_valence_v_s,
        ) = lists_numbers_coord(input_three_valence)
    
        #input_adjacency = []
        
        (
            in_adjancency_v,
            in_adjancency_v_s,
        ) = list_ints_coord(input_adjacency)
    
        # input parameters
        (
            in_joint_parameters_v,
            in_joint_parameters_v_s,
        ) = list_numbers_coord(joint_parameters)
    
        in_search_type = c_int(search)
        (
            in_scale_v,
            in_scale_v_s,
        ) = list_numbers_coord(scale)
    
        in_output_type = c_int(output_type)
    
        # output
    
        # out polylines
        out_plines_groups_f = POINTER(c_size_t)()
        out_plines_groups_f_s = c_size_t()
        out_plines_out_f = POINTER(c_size_t)()
        out_plines_out_f_s = c_size_t()
        out_plines_out_v = POINTER(c_float)()
        out_plines_out_v_s = c_size_t()
    
        # out types
        out_types_f = POINTER(c_size_t)()
        out_types_f_s = c_size_t()
        out_types_v = POINTER(c_int)()
        out_types_v_s = c_size_t()
    
        # global_parameters
        (
            in_joint_volume_parameters_v,
            in_joint_volume_parameters_v_s,
        ) = list_numbers_coord(extension)
        
        face_to_face_side_to_side_joints_dihedral_angle = c_float(130.0)
        
        ############################################################################################################
        # Load library and declare function signature
        ############################################################################################################
        
        lib_ = cdll.LoadLibrary(
        
            "C:/legion_pro_7_16IRX8H/software/python/compas_wood/src/frontend/build/Release/libgmp-10.dll"
        )
        lib = cdll.LoadLibrary(
            "C:/legion_pro_7_16IRX8H/software/python/compas_wood/src/frontend/build/Release/pinvoke_wood.dll"
        )
        """
        lib_ = cdll.LoadLibrary(
        
            "C:/IBOIS57/_Code/Software/Python/compas_wood/src/frontend/build/Release/libgmp-10.dll"
        )
        lib = cdll.LoadLibrary(
            "C:/IBOIS57/_Code/Software/Python/compas_wood/src/frontend/build/Release/pinvoke_wood.dll"
        )
        """
        lib.ctypes_get_connection_zones.restype = None
        lib.ctypes_get_connection_zones.argtypes = [
            # input geometry
            # polylines
            POINTER(c_size_t),
            POINTER(c_size_t),  # if a value is passed by reference, it must be a pointer
            POINTER(c_float),
            POINTER(c_size_t),  # if a value is passed by reference, it must be a pointer
            # vectors
            POINTER(c_size_t),
            POINTER(c_size_t),
            POINTER(c_float),
            POINTER(c_size_t),
            # joints
            POINTER(c_size_t),
            POINTER(c_size_t),
            POINTER(c_int),
            POINTER(c_size_t),
            # three valence
            POINTER(c_size_t),
            POINTER(c_size_t),
            POINTER(c_int),
            POINTER(c_size_t),
            # adjacency
            POINTER(c_int),
            POINTER(c_size_t),
            # input parameters
            POINTER(c_float),
            POINTER(c_size_t),
            # search_type
            POINTER(c_int),
            # scale
            POINTER(c_float),
            POINTER(c_size_t),
            # output_type
            POINTER(c_int),
            # output
            # polylines
            POINTER(POINTER(c_size_t)),
            POINTER(c_size_t),
            POINTER(POINTER(c_size_t)),
            POINTER(c_size_t),
            POINTER(POINTER(c_float)),
            POINTER(c_size_t),
            # types
            POINTER(POINTER(c_size_t)),
            POINTER(c_size_t),
            POINTER(POINTER(c_int)),
            POINTER(c_size_t),
            # global_parameters
            POINTER(c_float), # joint volume
            POINTER(c_size_t), # joint volume
            POINTER(c_float) # dihedral angle to switch between in-plane and out-of-plane jointery default is 150 degrees
        ]
    
        # generate joints
        start_time = time.time()
        ############################################################################################################
        # Call the function
        # https://stackoverflow.com/questions/4145775/how-do-i-convert-a-python-list-into-a-c-array-by-using-ctypes
        # https://stackoverflow.com/questions/53265216/python-ctypes-type-conversion
        ############################################################################################################
        
        lib.ctypes_get_connection_zones(
            # input geometry
            # polylines
            in_polyline_pairs_f,
            byref(in_polyline_pairs_f_s),
            in_polyline_pairs_v,
            byref(in_polyline_pairs_v_s),
            # vectors
            in_vectors_f,
            byref(in_vectors_f_s),
            in_vectors_v,
            byref(in_vectors_v_s),
            # joints
            in_joints_f,
            byref(in_joints_f_s),
            in_joints_v,
            byref(in_joints_v_s),
            # three_valence
            in_three_valence_f,
            byref(in_three_valence_f_s),
            in_three_valence_v,
            byref(in_three_valence_v_s),
            # adjacency
            in_adjancency_v,
            byref(in_adjancency_v_s),
            # input parameters
            # joint_parameters
            in_joint_parameters_v,
            byref(in_joint_parameters_v_s),
            # search_type
            byref(in_search_type),
            # scale
            in_scale_v,
            byref(in_scale_v_s),
            # output_type
            byref(in_output_type),
            # output
            # polylines
            byref(out_plines_groups_f),
            byref(out_plines_groups_f_s),
            byref(out_plines_out_f),
            byref(out_plines_out_f_s),
            byref(out_plines_out_v),
            byref(out_plines_out_v_s),
            # types
            byref(out_types_f),
            byref(out_types_f_s),
            byref(out_types_v),
            byref(out_types_v_s),
            # global_parameters
            in_joint_volume_parameters_v,
            byref(in_joint_volume_parameters_v_s),
            byref(face_to_face_side_to_side_joints_dihedral_angle),
        )
    
        """
    
        print(out_plines_groups_f[0])
        out_polylines = []
        """
        out_polylines = coord_polylines_lists(
            out_plines_groups_f,
            out_plines_groups_f_s,
            out_plines_out_f,
            out_plines_out_f_s,
            out_plines_out_v,
            out_plines_out_v_s,
        )
    
        _cuts = coord_numbers_lists(
            out_types_f, out_types_f_s, out_types_v, out_types_v_s
        )
        
        
        print(
            "\n______________________________________ %s ms ______________________________________"
            % round((time.time() - start_time) * 1000.0, 2)
        )
        
    
    

        
        
        # ==============================================================================
        # output
        # ==============================================================================
        _plines = []
        self.bbox = Rhino.Geometry.BoundingBox.Unset
        # nest two times the result and add to the tree
        for i in range(0, len(out_polylines)):
            list = []
            for j in range(0, len(out_polylines[i])):
                    list.append(conversions.polyline_to_rhino(out_polylines[i][j]))
                    self.polylines.append(list[-1])
                    self.bbox.Union(list[-1].BoundingBox)
            _plines.append(list)
        
        _data = [[_plines,_data[1],_data[2],_data[3],_data[4],_data[5],_cuts]]
        
        
        ############################################################################################################
        # release the memory
        ############################################################################################################
    
        # release output of polylines
        
        
        lib.release_size_t(byref(out_plines_groups_f), True)
        lib.release_size_t(byref(out_plines_out_f), True)
        lib.release_float(byref(out_plines_out_v), True)
    
        # release output of types
        lib.release_size_t(byref(out_types_f), True)
        lib.release_int(byref(out_types_v), True)
        
        
        return _data
# ---------- end solver_2 ----------

# ---- group: Notches
dam = DataDam(DataA=solver, BufferDelay=10000000, BufferMode=0)
xy = XYPlane(Origin=Point(0, 0, 0))
orient_data = Orient_data(data=dam, planes=xy)  # -> plines_o; inputs planes: list of Plane, ids: list of Int32
#   port data: collection of inputs that represent the elements, insertion vectors, joint types and adjacency, use input_set commonent to group these inputs
#   port planes: target planes for orientation of elements
#   port ids: indices to orient only certain elements
#   port plines_o: oriented outlines using plane to plane transformation
# ---------- orient_data: Python ----------
__author__ = "petras"
__version__ = "2023.04.02"

import System
import Rhino
import rhinoscriptsyntax as rs
import ghpythonlib.treehelpers as th
from Rhino.Geometry import Polyline
from Rhino.Geometry import Transform
from Rhino.Geometry import Vector3d
#import Grasshopper
from Rhino.Geometry import Plane

from ghpythonlib.componentbase import executingcomponent as component
import Grasshopper, GhPython
import System
import Rhino
import rhinoscriptsyntax as rs

class MyComponent(component):
    
    def get_plane(self, _polyline, _orientation_point):
        
        len = _polyline.Count - 1
        normal = Vector3d(0,0,0)
        
        for i in range((_polyline.Count - 1)):
            num = ((i - 1) + len) % len
            item1 = ((i + 1) + len) % len
            point3d =_polyline[num]
            point3d1 =_polyline[item1]
            item2 = _polyline[i]
            normal = normal + Vector3d.CrossProduct(Vector3d(item2 - point3d), Vector3d(point3d1 - item2))
        
        normal.Unitize()
        plane = Plane(_polyline.CenterPoint(), normal)
        if(plane.DistanceTo(_orientation_point)<0):
            plane.Flip()
        
        return plane
    
    def RunScript(self, _data, _planes, _ids):
        
        if(_data is None):
            return
        
        target_planes = _planes if len(_planes) > 0 else [Plane.WorldXY]
        _plines =  Grasshopper.DataTree[Polyline]()
        print(len(_data[0][1]))
        
        if(len(_ids)==0 or len(_planes) != len(_ids)):
            
            for i in range(len(_data[0])):
                
                xform = Transform.PlaneToPlane(self.get_plane(_data[0][i][-1],_data[0][i][-2][0]),target_planes[i%len(target_planes)])
                
                for j in range(len(_data[0][i])):
                    polyline_copy = Polyline(_data[0][i][j])
                    polyline_copy.Transform(xform)
                    _plines.Add(polyline_copy,Grasshopper.Kernel.Data.GH_Path(i))
                print(len(_plines.Branch(i)))
        else:
            total_element_count = len(_data[0])
            for i in range(len(_ids)):
                local_id = _ids[i]
                if(local_id >= total_element_count or local_id < 0 ):
                    continue
                xform = Transform.PlaneToPlane(self.get_plane(_data[0][local_id][0],_data[0][local_id][1][0]),target_planes[i%len(target_planes)])
                for j in range(len(_data[0][local_id])):
                    polyline_copy = Polyline(_data[0][local_id][j])
                    polyline_copy.Transform(xform)
                    _plines.Add(polyline_copy,Grasshopper.Kernel.Data.GH_Path(i))
        
        _plines_oriented = _plines
        
        """
        _data_xform = _plines
        _insertion_vectors =  th.list_to_tree(_data[1])
        _joints_per_face =  th.list_to_tree(_data[2])
        _three_valence = th.list_to_tree(_data[3])
        _adjacency =th.list_to_tree(_data[4])
        """
        
        # return outputs if you have them; here I try it for you:
        return _plines_oriented
# ---------- end orient_data ----------
branch = TreeBranch(Tree=orient_data, Path=Slider(7, range=0..100), MaintainPaths=True)  # -> reverse(Branch)
split = SplitList(List=branch, Index=2)  # -> ListA, ListB
item_8 = ListItem(List=split.ListA, Index=0, Wrap=True)  # -> Item, Item1
ext = ExtendCurve(Curve=split.ListB, Type=0, Start=100, End=100)
loft_b = Loft_brep(p0=item_8.Item, p1=item_8.Item1)  # -> brep; inputs p0: list of Curve, p1: list of Curve
#   port p0: polylines with holes, bottom
#   port p1: polylines with holes, top
#   port brep: lofted and capped brep with holes
# ---------- loft_b: Python ----------
"""get joints ids and connections areas between elements"""

__author__ = "petras vestartas"
__version__ = "2023.03.31"


from ghpythonlib.componentbase import executingcomponent as component
import Rhino.RhinoDoc
import Rhino.Geometry
import Rhino.RhinoMath
from System.Drawing import Color


class connections_zones(component):
    def loft_polylines_with_holes(self, curves0, curves1):
        """Loft polylines with holes

        Parameters
        ----------
        curves0 : list[rg.Polyline]
        curves1 : list[rg.Polyline]

        Returns
        -------
        rg.Brep
            brep as lofted polylines and cap them
        """

        ###############################################################################
        # user input
        ###############################################################################

        flag = len(curves0) is not 0 if True else len(curves1) != 0
        if flag:
            curves = []
            curves2 = []

            flag0 = len(curves1) == 0
            flag1 = len(curves0) == 0 and len(curves1) != 0
            flag2 = len(curves0) and len(curves1)

            if flag0:
                for i in range(len(curves0)):
                    if float(i) >= float(len(curves0)) * 0.5:
                        curves2.Add(curves0[i])
                    else:
                        curves.Add(curves0[i])
            elif flag1:
                for i in range(0, len(curves1), 2):
                    curves.Add(curves1[i])
                    curves2.Add(curves1[i + 1])
            elif flag2:
                curves = curves0
                curves2 = curves1

            curves0 = curves
            curves1 = curves2

        ###############################################################################
        # Create mesh of the bottom face
        ###############################################################################
        brep_bottom = Rhino.Geometry.Brep.CreatePlanarBreps(
            curves0, Rhino.RhinoDoc.ActiveDoc.ModelAbsoluteTolerance * 1000
        )[0]
        brep_top = Rhino.Geometry.Brep.CreatePlanarBreps(
            curves1, Rhino.RhinoDoc.ActiveDoc.ModelAbsoluteTolerance * 1000
        )[0]

        ###############################################################################
        # Create lofts
        ###############################################################################
        breps_to_join = [brep_bottom, brep_top]
        for i in range(len(curves0)):
            wall = Rhino.Geometry.Brep.CreateFromLoft(
                [curves0[i], curves1[i]],
                Rhino.Geometry.Point3d.Unset,
                Rhino.Geometry.Point3d.Unset,
                Rhino.Geometry.LoftType.Normal,
                False,
            )[0]
            breps_to_join.append(wall)

        ###############################################################################
        # Join Brep
        ###############################################################################
        solid = Rhino.Geometry.Brep.JoinBreps(
            breps_to_join, Rhino.RhinoDoc.ActiveDoc.ModelAbsoluteTolerance
        )[0]

        ###############################################################################
        # Because kinked surface can cause problems down stream, Rhino
        # always splits kinked surfaces when adding Breps to the document. Since
        # we are not adding this Brep to the document, lets split the kinked
        # surfaces ourself.
        ###############################################################################
        solid.Faces.SplitKinkyFaces(Rhino.RhinoMath.DefaultAngleTolerance, True)

        ###############################################################################
        # The profile curve, created by the input points, is oriented clockwise.
        # Thus when the profile is extruded, the resulting surface will have its
        # normals pointed inwards. So lets check the orientation and, if inwards,
        # flip the face normals.
        ###############################################################################
        if Rhino.Geometry.BrepSolidOrientation.Inward == solid.SolidOrientation:
            solid.Flip()

        for i in range(solid.Faces.Count):
            if i < 2:
                solid.Faces[i].PerFaceColor = Color.DeepPink  # Color.LightGray
            else:
                solid.Faces[i].PerFaceColor = Color.LightGray

        return solid

    def RunScript(self, _p0, _p1):
        if _p0 and _p1:
            return self.loft_polylines_with_holes(_p0, _p1)
# ---------- end loft_b ----------
ears = Ears(p0=item_8.Item, p1=item_8.Item1, radius=Slider(4, range=0..10), notch_type=Slider(1, range=0..10), union=Toggle(True))  # -> lines, lines_corners, lines_horizontal, offset0, offset1, planes, cut_extrusions; inputs p0: tree of Curve, p1: tree of Curve, notch_type: Int32, union: Boolean
#   port p0: a data-tree of polyline pairs with holes
#   port p1: a data-tree of polyline pairs with holes
#   port radius: notch radius that is equal to cutting tool radius
#   port notch_type: 0 - none, 1 - diagonal, 2 - translation
#   port union: get cutting elements for boolean difference and union
#   port lines_corners: lines which shows the correners from where the notch starts
#   port lines_horizontal: notches are represented as horizontal lines that can be used for milling
#   port offset0: offset outrline for cutting without notches
#   port offset1: offset outrline for cutting without notches
#   port planes: element plane that can be used for orientation
#   port cut_extrusions: breps that can be used for boolean difference
# ---------- ears: Python ----------
"""get joints ids and connections areas between elements"""

__author__ = "petras vestartas"
__version__ = "2023.04.01"


from ghpythonlib.componentbase import executingcomponent as component

import Rhino.RhinoDoc
import Rhino.RhinoApp
from Rhino.Geometry import Polyline
from Rhino.Geometry import Plane
from Rhino.Geometry import Point3d
from Rhino.Geometry import Vector3d
from Rhino.Geometry import Line
from Rhino.Geometry import Transform
from Rhino.Geometry import Arc
from Rhino.Geometry import Brep
from Rhino.Geometry import Curve
import math
from Rhino.Geometry.Intersect.Intersection import PlanePlane
from Rhino.Geometry.Intersect.Intersection import LinePlane
from Rhino.Geometry.Intersect.Intersection import BrepPlane
import Grasshopper
from ghpythonlib import treehelpers


class ears(component):
            
    def to_polyline_from_cp(self, curve):
        
        polyline = Polyline() 
        result, polyline1 = curve.TryGetPolyline()
                
        if (result == False):
                    
            nurbsCurve = curve.ToNurbsCurve()  
            point3dArray = []
                    
            for i in range(nurbsCurve.Points.Count):
                result, pt = nurbsCurve.Points.GetPoint(i)
                point3dArray.append(pt)
                    
            polyline1 = Polyline(point3dArray)  
            nurbsCurve = polyline1.ToNurbsCurve()  
            result, polyline1 = nurbsCurve.TryGetPolyline()  
                    
            polyline1.CollapseShortSegments(0.01) 
                    
            polyline1 = Polyline(polyline1)  
            polyline = polyline1  
                    
        else:
            polyline1.CollapseShortSegments(0.01)  
            polyline = polyline1  
                
        return polyline


    def offset_parallelograms(self, x, y, radius) :
        """offset outlines by intersecting side planes
                
        Parameters
        ----------
        x : first closed outline
        y : second closed outline
        radius : offset distance that normally corresponds to the tool radius
                
        Returns
        -------
        tuple(polyline0, polyline1)
            two outlines
        bool
            if polylines are closed
        """
                
        if(x.Count < 2 or y.Count<2):
            print("WARNING empty polylines")
            return
        
        ###############################################################################
        # Get edge planes that are offseted
        ###############################################################################
        
        offset_planes = []
        for i in range(x.Count-1):
            c = (x[i] + x[i + 1]) * 0.5
            XAxis = y[i] - y[i + 1] if x[i].DistanceTo(x[i + 1]) < 0.01 else x[i] - x[i + 1]
            YAxis = x[i] - y[i]
            ZAxis = Vector3d.CrossProduct(XAxis, YAxis)
            ZAxis.Unitize()
            plane =  Plane(c + ZAxis * radius, XAxis, YAxis)
            offset_planes.Add(plane)
        
        
        ###############################################################################
        # Intersect planes one by one
        ###############################################################################
        
        result, fit_plane0 = Plane.FitPlaneToPoints(x)
        result, fit_plane1 = Plane.FitPlaneToPoints(y)
        offset_polyline0 = Polyline()
        offset_polyline1 = Polyline()
        
        
        closed = x[0].DistanceToSquared( x[x.Count-1]) < 0.0001
        for i in range(offset_planes.Count) :
            result, l = PlanePlane(offset_planes[(offset_planes.Count+(i-1))% offset_planes.Count], offset_planes[i])
            result, types_of_notches_per_point = LinePlane(l, fit_plane0)
            offset_polyline0.Add(l.PointAt(types_of_notches_per_point))
            result, types_of_notches_per_point = LinePlane(l, fit_plane1)
            offset_polyline1.Add(l.PointAt(types_of_notches_per_point))
        
        
        if (closed == False) :
            
            l = Line.Unset
            result, l = PlanePlane(fitPlane0, offset_planes[0])
            offset_polyline0.Insert(0, l.ClosestPoint(x[0], False))
            result, l = PlanePlane(fitPlane0, offset_planes[offset_planes.Count - 1])
            offset_polyline0.Add(l.ClosestPoint(x[x.Count - 1], False))
            
            result, l = PlanePlane(fitPlane1, offset_planes[0])
            offset_polyline1.Insert(0, l.ClosestPoint(y[0], False))
            result, l = PlanePlane(fitPlane1, offset_planes[offset_planes.Count - 1])
            offset_polyline1.Add(l.ClosestPoint(y[y.Count - 1], False))
        else :
            offset_polyline0.Add(offset_polyline0[0])
            offset_polyline1.Add(offset_polyline1[0])
        
        
        ###############################################################################
        # Output
        ###############################################################################
        return offset_polyline0, offset_polyline1, closed

    def align_plane(self, plane, v):
        
        p = Plane(plane)
        
        result, parameterAlongXDirection, parameterAlongYDirection = p.ClosestParameter(p.Origin + v)
        angle = math.atan2(parameterAlongXDirection, parameterAlongYDirection)
        p.Rotate(-angle + 1.5707963267949, p.ZAxis, p.Origin)
        
        return p

    def vector_projection(self,v0, v1, extendV1 = False) :
        
        v0L = v0.Length
        v1L = v1.Length
        v0.Unitize()
        v1.Unitize()
        dotProduct = v0 * v1
        v0ProjectionLen = v0L * dotProduct
        if (extendV1):
            return v1 * (v0ProjectionLen + v1L)
        return v1 * v0ProjectionLen

    def get_leveled_vector(self, vector, vertical_height):
        
        dir = Vector3d(vector)
        dir.Unitize()
        angle = Vector3d.VectorAngle(dir, Vector3d(0, 0, 1))
        inclined_offset_by_vertical_distance = vertical_height * math.tan(angle)
        dir = dir*inclined_offset_by_vertical_distance

        return dir;


    def notches_lines(self, plines0, plines1, plines0_offset, plines1_offset, _radius, types_of_notches_per_point, offset_distances, is_closed, border):
        """create drilling lines that represent notches
                
        Parameters
        ----------
        plines0_offset[i], plines1_offset[i], _radius, notch_types, offset_distances
        plines0 : bottom offseted outlines by plane to plane inersection
        plines1 : top offseted outlines by plane to plane inersection
        radius : offset distance
        types_of_notches_per_point : type of notch: bisector, translation u, trasnlation v, rounding, none
        offset_distances : perpendicular distance between corner lines and offset lines
        is_closed : check if the offseted outline is closed  
        border : bool if border or hole
        Returns
        -------
        list(Line)
            drilling lines
        list(Line)
            drilling lines of corners that notches belongs to
        """
        
        ###############################################################################
        # Copy the offset polylines
        # Remove end point if the polyline is closed
        ###############################################################################
        xA_ = Polyline(plines0)
        xB_ = Polyline(plines1)
        xA = Polyline(plines0_offset)
        xB = Polyline(plines1_offset)
        
        #Rhino.RhinoDoc.ActiveDoc.Objects.AddBox(Rhino.Geometry.Box(xA_.BoundingBox))
        #Rhino.RhinoDoc.ActiveDoc.Objects.AddPolyline(xA)
        #Rhino.RhinoDoc.ActiveDoc.Objects.AddBox(Rhino.Geometry.Box(xB_.BoundingBox))
        
        if(is_closed):
            xA_.RemoveAt(xA_.Count - 1)
            xB_.RemoveAt(xB_.Count - 1)
            xA.RemoveAt(xA.Count - 1)
            xB.RemoveAt(xB.Count - 1)
        
        ###############################################################################
        # Output lists
        ###############################################################################
        l0_corners =  [] # fillet
        l0 =  []
        l1 =  [] # fillet
        l2 =  [] # fillet
        plines = []
        planes = []
        
        ###############################################################################
        # create plane to plane transformation for geometry rotated in 3D
        ###############################################################################
        result, base_plane = Plane.FitPlaneToPoints(xA)
        if (base_plane.DistanceTo(xB[0]) < 0.0):
            base_plane.Flip()
        to_xy = Transform.PlaneToPlane(base_plane, Plane.WorldXY)
        
        ###############################################################################
        # For notches or fillet, if fillet twice bigger radius is needed
        # also see this if statement if (types_of_notches_per_point[0] == 4 && angle_ > 0) : because corner is  inversed
        ###############################################################################
        fillet = False
        R_ = _radius * 2 if types_of_notches_per_point[0] == 4 else _radius
        notchStart = True
        
        for i in range(0, xA.Count) :
            
            ###############################################################################
            # Get vertical lines
            ###############################################################################
            normal = Line(xA[i], xB[i])
            n = xA.Count
            next = (i + 1) % n
            nextNext = (i + 2) % n
            prev = (((i - 1) % n) + n) % n
            
            p0a = xA[i]
            p1a = xA[next]
            p2a = xA[prev]
            p3a = xA[nextNext]
            
            p0b = xB[i]
            p1b = xB[next]
            p2b = xB[prev]
            p3b = xB[nextNext]
            
            normal1 = Line(xA[next], xB[next])
            normal2 = Line(xA[prev], xB[prev])
            ###############################################################################
            # Measure Concavity
            ###############################################################################
            cornera =  Polyline( [ p2a, p0a, p1a ] )
            cornerb =  Polyline( [ p2b, p0b, p1b ] )
            
            cornera.Transform(Transform.PlaneToPlane( Plane(p0a, normal.Direction), Plane.WorldXY))
            nextEdge = cornera.SegmentAt(0).Direction
            previousEdge = cornera.SegmentAt(1).Direction
            
            angle_ = ((math.atan2(nextEdge.X, nextEdge.Y) - math.atan2(previousEdge.X, previousEdge.Y) + math.pi * 2) % (math.pi * 2)) -math.pi
            
            if (types_of_notches_per_point[0] == 4 and angle_ > 0):
                l0_corners.Add(Line.Unset)
                l0.Add(Line.Unset)
                l1.Add(Line.Unset)
                l2.Add(Line.Unset)
                continue
            
            elif (types_of_notches_per_point[0] != 4 and angle_ < 0) :
                l0_corners.Add(Line.Unset)
                l0.Add(Line.Unset)
                l1.Add(Line.Unset)
                l2.Add(Line.Unset)
                continue
            
            
            ###############################################################################
            # Get Perpependicular points
            # Intersect current and neighbor lines
            ###############################################################################
            
            
            
            # Create plane for intersection of neighbor lines
            result, fit_plane1 = Plane.FitPlaneToPoints( [normal.To, normal1.To, normal2.To] )
            normalPl =  Plane(normal.From, fit_plane1.ClosestPoint(normal.From) - normal.From)
            f0, t = LinePlane(normal, normalPl)
            p0a = normal.PointAt(t)
            f1, t = LinePlane(normal1, normalPl)
            p1a = normal1.PointAt(t)
            f2, t = LinePlane(normal2, normalPl)
            p2a = normal2.PointAt(t)
            
            
            ###############################################################################
            # Compute offset vectors on perpedicular points
            # Error here, with v0 and v1 orientaton, must be rotated  90 deg
            ###############################################################################
            v0 = p0a - p1a
            v1 = p0a - p2a
            
            v0.Unitize()
            v1.Unitize()
            
            ###############################################################################
            # Depending on angle the offset changes, sin gives this distance value
            ###############################################################################
            angle = Vector3d.VectorAngle(v0, v1,  Plane(p0a, v0, v1))
            radius = R_ * ((1 / math.atan(angle)) )
            radius = -offset_distances[i].Length
            # translation
            radius *= -1
            
            ###############################################################################
            # TYPE A Notch - Line Directions A-B
            ###############################################################################
            local_cornera_ =  Polyline( [ xA_[prev], xA_[i], xA_[next] ] )
            local_cornerb_ =  Polyline( [ xB_[prev], xB_[i], xB_[next] ] )
            local_cornera =  Polyline( [ xA[prev], xA[i], xA[next]  ] )
            local_cornerb =  Polyline( [ xB[prev], xB[i], xB[next] ] )
            pl0 = self.align_plane(normalPl, v0)
            pl1 = self.align_plane(normalPl, v1)
            extension0 = 0
            extension1 = 0
            # for sharp angles extension is needed
            """
            extension0 = self.vector_projection(v0 * radius, v1 * radius).Length if angle < (math.pi * 0.5) else 0
            extension1 = self.vector_projection(v1 * radius, v0 * radius).Length if angle < (math.pi * 0.5) else 0
            extension0 *= 1
            extension1 *= 1
            
            normalXAxis0 =  Line(xA[i] + pl0.XAxis * (radius + extension0), xB[i] + pl0.XAxis * (radius + extension0))
            normalXAxis1 =  Line(xA[i] + pl1.XAxis * (radius + extension1), xB[i] + pl1.XAxis * (radius + extension1))
            """
            #Rhino.RhinoDoc.ActiveDoc.Objects.AddPolyline(cornera) 
            normalXAxis0 = Line(local_cornera.SegmentAt(0).ClosestPoint(local_cornera_[1],False),local_cornerb.SegmentAt(0).ClosestPoint(local_cornerb_[1],False))
            normalXAxis1 = Line(local_cornera.SegmentAt(1).ClosestPoint(local_cornera_[1],False),local_cornerb.SegmentAt(1).ClosestPoint(local_cornerb_[1],False))
            dist0 = xA.ClosestPoint(normalXAxis0.From).DistanceTo(normalXAxis0.From)
            dist1 = xA.ClosestPoint(normalXAxis1.From).DistanceTo(normalXAxis1.From)
            border_or_hole = dist0<dist1 if border else dist0>dist1 
            if(border_or_hole):
                normalXAxis0 = normalXAxis1
            else:
                normalXAxis1 = normalXAxis0
            # Rhino.RhinoDoc.ActiveDoc.Objects.AddLine( normalXAxis0 )
            # Rhino.RhinoDoc.ActiveDoc.Objects.AddLine( normalXAxis1 )
            ###############################################################################
            # TYPE B Notch -  Diaognal
            ###############################################################################
            bisectorDir = offset_distances[i]
            
            pl2normalXAxis2Fillet = self.align_plane(normalPl, bisectorDir)
            length = bisectorDir.Length
            normalXAxis2 = Line(xA[i] + bisectorDir, xB[i] + bisectorDir)
            
            # Rhino.RhinoDoc.ActiveDoc.Objects.AddLine( normalXAxis2 )
            
            ###############################################################################
            # TYPE C Notch -  Fillet
            ###############################################################################
            bisectorDirFillet = (pl0.XAxis * radius + pl1.XAxis * radius)
            pl2 = self.align_plane(normalPl, bisectorDirFillet)
            lengthFillet = bisectorDir.Length
            bisectorDirFillet *= -(length) / length
            
            normalXAxis2Fillet = Line(xA[i] + bisectorDirFillet * ((length - R_) / length), xB[i] + bisectorDirFillet * ((length - R_) / length))
            normalXAxis2FilletCenter = Line(xA[i] + bisectorDirFillet, xB[i] + bisectorDirFillet)
            normalXAxis2Fillet0 = Line(normalXAxis2FilletCenter.From + pl0.XAxis * (radius + extension0), normalXAxis2FilletCenter.To + pl0.XAxis * (radius + extension0))
            normalXAxis2Fillet1 = Line(normalXAxis2FilletCenter.From + pl1.XAxis * (radius + extension0), normalXAxis2FilletCenter.To + pl1.XAxis * (radius + extension0))
            # Rhino.RhinoDoc.ActiveDoc.Objects.AddLine( normalXAxis2Fillet ) 
            # Rhino.RhinoDoc.ActiveDoc.Objects.AddLine( normalXAxis2FilletCenter ) 
            # Rhino.RhinoDoc.ActiveDoc.Objects.AddLine( normalXAxis2Fillet0 ) 
            # Rhino.RhinoDoc.ActiveDoc.Objects.AddLine( normalXAxis2Fillet1 ) 
            
            ###############################################################################
            # Output
            ###############################################################################
            planes.Add(pl0)
            planes.Add(pl1)
            planes.Add(pl2)
            
            lastFlag = False
            
            l0_corners.append(Line(xA[i],xB[i]))
            if (len(types_of_notches_per_point) == 1):
                if (types_of_notches_per_point[0]==2 or types_of_notches_per_point[0]==3) :
                    flag = p0.DistanceToSquared(p1) < p0.DistanceToSquared(p2) if types_of_notches_per_point[0] == 3 else  p0.DistanceToSquared(p1) > p0.DistanceToSquared(p2)
                    if (flag):
                        l0.Add(normalXAxis0)
                    else:
                        l0.Add(normalXAxis1)
                    
                elif (types_of_notches_per_point[0]==1) :
                    l0.Add(normalXAxis2)
                    
                elif (types_of_notches_per_point[0]==4) :
                    fillet = True
                    l0.Add(normalXAxis2Fillet0)
                    l1.Add(normalXAxis2Fillet)
                    l2.Add(normalXAxis2Fillet1)
                    
                elif (types_of_notches_per_point[0]==5 or types_of_notches_per_point[0]==6) :
                    if (i % 2 == 1):
                        lastFlag = not lastFlag
                    if (types_of_notches_per_point[0] == 6):
                        lastFlag = not lastFlag
                    
                    if (lastFlag):
                        l0.Add(normalXAxis0)
                    else:
                        l0.Add(normalXAxis1)
                    
                else:
                    l0.Add(Line.Unset)
                
            else:
                
                if (types_of_notches_per_point[i % len(types_of_notches_per_point)] == 2):
                    l0.Add(normalXAxis0)
                
                elif (types_of_notches_per_point[i % len(types_of_notches_per_point)] == 3):
                    l0.Add(normalXAxis1)
                
                elif (types_of_notches_per_point[i % len(types_of_notches_per_point)] == 4):
                    fillet = True
                    l0.Add(normalXAxis2Fillet0)
                    l1.Add(normalXAxis2Fillet)
                    l2.Add(normalXAxis2Fillet1)
                
                elif (types_of_notches_per_point[i % len(types_of_notches_per_point)] == 1):
                    l0.Add(normalXAxis2)
                
                else:
                    l0.Add(Line.Unset)
        
        # for i in l0: 
        #     Rhino.RhinoDoc.ActiveDoc.Objects.AddLine(i)
        
        ###############################################################################
        # Add Notches to a Pair of Polylines
        ###############################################################################
        lines = []
        lines_corners = []
        lines_horizontal = []
        result, fitPlane = Plane.FitPlaneToPoints(xA)
        result, fitPlaneB = Plane.FitPlaneToPoints(xB)
        # Rhino.RhinoDoc.ActiveDoc.Objects.AddPolyline(xA)
        # Rhino.RhinoDoc.ActiveDoc.Objects.AddPolyline(xB)
        
        xA_Notch = Polyline()
        xB_Notch = Polyline()
        
        extensions = []
        is_below = []
        
        for i in range(xA.Count):
            
            # Extend bottom line to compensate drilling bit thickness and angle
            extensionV = xA[i] - xB[i]
            extension = abs(math.tan(Vector3d.VectorAngle(extensionV, fitPlane.ZAxis)) * R_)
            extensionV.Unitize()
            
            # Move tool-path below surface
            extensionV = extensionV * extension
            extensions.append( extensionV )
            
            next = (i+1)%xA.Count
            prev = (xA.Count+(i-1))%xA.Count
            
            # Check direction of inclined cut, the check is made according to XY plane
            side_plane = Plane(xA[i], xB[i], xA[next])
            
            mid_0 = 0.5 * (xA[i] + xA[next])
            mid_1 = 0.5 * (xB[i] + xB[next])
            segment = Line(xB[i], xB[next])
            
            tool_direction =  Line(mid_0, segment.ClosestPoint(mid_0, False))
            #Rhino.RhinoDoc.ActiveDoc.Objects.AddLine(segment)
            # objects.Add(tool_direction)
            side_plane.Transform(to_xy)
            
            is_below.append(0)
            if (side_plane.Normal.Z < -0.01):
                is_below[i] = -1
            elif (side_plane.Normal.Z > 0.01):
                is_below[i] = 1
                extensions[i] *= -1
            else:
                extensions[i] *= 0
        
        count = 0
        
        # for i in l0: 
        #     Rhino.RhinoDoc.ActiveDoc.Objects.AddLine(i)
        
        for i in range (xA.Count) :
            
            # Extend bottom line to compensate drilling bit thickness and angle
            extensionV = extensions[i]
            next = (i+1)%xA.Count
            prev = (xA.Count+(i-1))%xA.Count
            # Rhino.RhinoDoc.ActiveDoc.Objects.AddLine(l0[count]) 
            # Fillet corner
            if (fillet):
                if (l0[count] != Line.Unset) :
                    # Rhino.RhinoDoc.ActiveDoc.Objects.AddLine(l0[count])    
                    # Rhino.RhinoDoc.ActiveDoc.Objects.AddLine(l1[count])  
                    # Rhino.RhinoDoc.ActiveDoc.Objects.AddLine(l2[count]) 
                    result, t = LinePlane(l0[count], fitPlane)
                    xA_Notch.Add(l0[count].PointAt(t) + extensionV*0)
                    # result, t = LinePlane(l1[count], fitPlane)
                    # xA_Notch.Add(l1[count].PointAt(t) + extensionV)
                    result, t = LinePlane(l2[count], fitPlane)
                    xA_Notch.Add(l2[count].PointAt(t) + extensionV*0)
                    
                    result, t = LinePlane(l0[count], fitPlaneB)
                    xB_Notch.Add(l0[count].PointAt(t))
                    # result, t = LinePlane(l1[count], fitPlaneB)
                    # xB_Notch.Add(l1[count].PointAt(t))
                    result, t = LinePlane(l2[count], fitPlaneB)
                    xB_Notch.Add(l2[count].PointAt(t))
                
                else: 
                    xA_Notch.Add(xA[i] + extensionV*0)
                    xB_Notch.Add(xB[i])
            
            
            # Notch corner
            else :
                if(l0[count] != Line.Unset):
                    lines.Add(l0[count])
                    lines_corners.Add(l0_corners[count])
            
            
            
            count = count + 1 
            
        ###############################################################################
        # Cut lines by bottom and top planes and extend by the radius
        ###############################################################################
            
        for i in range(len(lines)):
            #cut the lines by top and bottom planes
            result, t = LinePlane(lines[i], fitPlane)
            new_point_0 = lines[i].PointAt(t)
            result, t = LinePlane(lines[i], fitPlaneB)
            new_point_1 = lines[i].PointAt(t)
            
            # get extension direction
            l_temp = Line(new_point_0,new_point_1)
            extension_dir = new_point_1-new_point_0
            extension_dir.Unitize()
            l_temp.Transform(to_xy)
            extension_vector = self.get_leveled_vector(l_temp.Direction,_radius)
            extension_dir = extension_dir * extension_vector.Length
            
            # extend the line and update the line
            # lines[i] = Line(new_point_0,new_point_1)
            lines[i] = Line(new_point_0-extension_dir*1,new_point_1+extension_dir*1)
            
        for i in range(len(lines_corners)):
            #Rhino.RhinoDoc.ActiveDoc.Objects.AddLine(lines_corners[i])
            #cut the lines by top and bottom planes
            result, t = LinePlane(lines_corners[i], fitPlane)
            new_point_0 = lines_corners[i].PointAt(t)
            result, t = LinePlane(lines_corners[i], fitPlaneB)
            new_point_1 = lines_corners[i].PointAt(t)
            
            # get extension direction
            l_temp = Line(new_point_0,new_point_1)
            extension_dir = new_point_1-new_point_0
            extension_dir.Unitize()
            l_temp.Transform(to_xy)
            extension_vector = self.get_leveled_vector(l_temp.Direction,_radius)
            extension_dir = extension_dir * extension_vector.Length
            
            # extend the line and update the line
            # lines[i] = Line(new_point_0,new_point_1)
            lines_corners[i] = Line(new_point_0-extension_dir*1,new_point_1+extension_dir*1) 
            
        for i in range(len(lines_corners)):
            lines_horizontal.append(Line(lines[i].From,lines_corners[i].From))
            lines_horizontal.append(Line(lines[i].To,lines_corners[i].To))
        
        ###############################################################################
        # Output
        ###############################################################################
        # for i in lines:
        #     Rhino.RhinoDoc.ActiveDoc.Objects.AddLine(i)
        #Rhino.RhinoDoc.ActiveDoc.Objects.AddPolyline(xA_Notch)
        #Rhino.RhinoDoc.ActiveDoc.Objects.AddPolyline(xB_Notch)
        
        return lines, lines_corners,lines_horizontal, fitPlane, fitPlaneB


    def sort_by_size(self,_p0, _p1):
        sizes = []
        for i in range(len(_p0)):
            sizes.append(_p0[i].GetBoundingBox(True).Diagonal.Length)
        sizes, _c0, _c1 = zip(*sorted(zip(sizes, _p0, _p1), reverse=True))
        
        return _c0, _c1

    def get_ears(self, _c0, _c1, _radius, _notch_type, _union):
                
        ###############################################################################
        # User interface, convert curves toi polylines
        ###############################################################################
        plines0 = []
        plines1 = []
        plines0_offset = []
        plines1_offset = []
        planes0 = []
        planes1 = []
        are_closed = []
        for i in range(len(_c0)):
            plines0.append(self.to_polyline_from_cp(_c0[i]))
            plines1.append(self.to_polyline_from_cp( _c1[i]))
            plines0_offset.append(plines0[-1])
            plines1_offset.append(plines1[-1])
            are_closed.append(True)
        
        ###############################################################################
        # Offset otlines, faces must be planar
        ###############################################################################
        for i in range(len(_c0)):
            plines0_offset[i], plines1_offset[i], are_closed[i] = self.offset_parallelograms(plines0[i], plines1[i], _radius)
        
        ###############################################################################
        # Create notches
        ###############################################################################
        notch_lines_nested = []
        notch_lines_nested_corners = []
        notch_lines_horizontal_nested = []
        for i in range(len(plines0)):
            
            pline_length =  plines0[i].Length
            notch_types = [0]*(plines0[i].Count-1)
            offset_distances = [Vector3d(0,0,0)]*(plines0[i].Count-1)
            
            n = plines0[i].Count - 1
            for j in range( plines0[i].Count-1):
                
                l1 = Line( plines0_offset[i][j], plines1_offset[i][j])
                l2 = Line( plines0[i][j],  plines1[i][j])
                
                dist = l1.ClosestPoint( l2.From, False ).DistanceTo( l2.From ) - _radius
                bisector_dir =  l2.From - ( l1.ClosestPoint( l2.From, False))
                bisector_dir.Unitize()
                bisector_dir *= dist
                offset_distances[j] = bisector_dir
                
                #print(_notch_type)
                if(_notch_type > 1):
                    #print("Hi")
                    shift = 0 if j % 2 == 1 else 0
                    
                    if(pline_length < 300):
                        
                        shift = 0 if j % 2 == 0 else 1
                    
                    notch_types[j] = (3 - shift)
                else:
                    notch_types[j] = _notch_type
            #prarray
            #print(offset_distances)
            lines, lines_corners,lines_horizontal, plane0, plane1 = self.notches_lines(plines0[i], plines1[i],plines0_offset[i], plines1_offset[i], _radius, notch_types, offset_distances, are_closed[i],i==0)
            notch_lines_nested.append(lines)
            notch_lines_nested_corners.append(lines_corners)
            notch_lines_horizontal_nested.append(lines_horizontal)
            planes0.append(plane0)
            planes1.append(plane1)
            #notch_lines.AddRange(NotchesLines(plines0_offset[i], plines1_offset[i], _radius, notch_types, offset_distances, are_closed))
                
        ###############################################################################
        # Output
        ###############################################################################
        return plines0_offset, plines1_offset, planes0, planes1, are_closed, notch_lines_nested, notch_lines_nested_corners, notch_lines_horizontal_nested

    def get_notch_geometry(self, _c0, _c1, notch_lines_nested, notch_lines_nested_corner, planes0, planes1, radius):
        
        
        #geo = []
        cut_curves0 = []
        cut_curves1 = []
        cut_extrusions = []
        for i in range(len(notch_lines_nested)):
            
            cutter_curves0 = []
            cutter_curves1 = []
            for j in range(len(notch_lines_nested[i])):
                
                # get plane
                p0 = notch_lines_nested[i][j].PointAt(0.5)
                p1 = notch_lines_nested_corner[i][j].ClosestPoint(p0,False)
                xaxis = p0-p1
                zaxis = notch_lines_nested[i][j].Direction
                yaxis = Vector3d.CrossProduct(xaxis,zaxis)
                plane = Plane(p0,xaxis,yaxis)
                
                #construction 5 points for an arc and rectangle profile
                p0_profile = p0 + plane.YAxis*radius
                p1_profile = p1 + plane.YAxis*radius
                p2_profile = p1 - plane.YAxis*radius
                p3_profile = p0 - plane.YAxis*radius
                p4_profile = p0 + plane.XAxis*radius
                p5_profile = p1 - plane.XAxis*radius
                
                # construct PolyCurve
                arc0 = Arc(p0_profile,p4_profile,p3_profile)
                arc1 = Arc(p1_profile,p5_profile,p2_profile)
                polyline0 = Polyline([p0_profile,p1_profile]).ToNurbsCurve()
                polyline1 = Polyline([p2_profile,p3_profile]).ToNurbsCurve()
                
                # geo.append(arc)
                # geo.append(polyline)
                joined_curve = Rhino.Geometry.Curve.JoinCurves([arc0.ToNurbsCurve(),polyline0.ToNurbsCurve(),arc1.ToNurbsCurve(),polyline1.ToNurbsCurve()],0.01)[0]
                joined_curve.Transform(Transform.Translation(notch_lines_nested[i][j].Direction*1))
                
                
                # extrude
                extrusion = Rhino.Geometry.Extrusion.Create(joined_curve.ToNurbsCurve(),notch_lines_nested[i][j].Length*2, True).ToBrep()
                
                
                
                # brep plane
                result, curves0, points = BrepPlane(extrusion, planes0[i], 0.01)
                result, curves1, points = BrepPlane(extrusion, planes1[i], 0.01)
                cutter_curves0.append(curves0[0])
                cutter_curves1.append(curves1[0])
                
                #geo.append(curves0[0])
                #geo.append(curves1[0])
                
                cut_extrusions.append(extrusion)
                #bottom_and_top_cut_curves.append(curves0[0])
            # curve boolean difference
            # continue
            """
            if(i==0):
                crv_difference0 = Rhino.Geometry.Curve.CreateBooleanDifference(_c0[i],cutter_curves0)[0]
                crv_difference1 = Rhino.Geometry.Curve.CreateBooleanDifference(_c1[i],cutter_curves1)[0]
                cut_curves0.append(crv_difference0)
                cut_curves1.append(crv_difference1)
            else:
                cutter_curves0.append(_c0[i])
                cutter_curves1.append(_c1[i])
                crv_difference0 = Rhino.Geometry.Curve.CreateBooleanUnion(cutter_curves0)[0]
                crv_difference1 = Rhino.Geometry.Curve.CreateBooleanUnion(cutter_curves1)[0]
                cut_curves0.append(crv_difference0)
                cut_curves1.append(crv_difference1)
            """
            #align curves
            
        
        return cut_curves0, cut_curves1,cut_extrusions
    
    def RunScript(self, _p0, _p1, _radius,_notch_type, _union):
        
        ###############################################################################
        # Run
        ###############################################################################
        radius = _radius if _radius is not None else 1
        if _p0 and _p1:

            if _p0 == None:
                return
            
            if _p1 == None:
                return
            
            if _p0.DataCount is not _p1.DataCount:
                return
            
            lines =Grasshopper.DataTree[Line]()
            lines_corners = Grasshopper.DataTree[Line]()
            lines_horizontal = Grasshopper.DataTree[Line]()
            offset0 = Grasshopper.DataTree[Polyline]()
            offset1 = Grasshopper.DataTree[Polyline]()
            planes = Grasshopper.DataTree[Plane]()
            #cut_curves0 = Grasshopper.DataTree[Curve]()
            #cut_curves1 = Grasshopper.DataTree[Curve]()
            cut_extrusions = Grasshopper.DataTree[Brep]()
            for i in range(_p0.BranchCount):
                _c0, _c1 = self.sort_by_size(_p0.Branch(i), _p1.Branch(i))
                plines0, plines1, planes0, planes1, are_closed, notch_lines_nested, notch_lines_nested_corners, notch_lines_horizontal_nested = self.get_ears(_c0, _c1,radius,_notch_type, _union)
                lines.AddRange(treehelpers.list_to_tree(notch_lines_nested,i).AllData(),Grasshopper.Kernel.Data.GH_Path(i))
                lines_corners.AddRange(treehelpers.list_to_tree(notch_lines_nested,i).AllData(),Grasshopper.Kernel.Data.GH_Path(i))
                
                for j in range(len(notch_lines_horizontal_nested)):
                    for k in range(0,len(notch_lines_horizontal_nested[j]),2):
                        lines_horizontal.AddRange([notch_lines_horizontal_nested[j][k],notch_lines_horizontal_nested[j][k+1]],Grasshopper.Kernel.Data.GH_Path(i,j,k))
                
                #lines_horizontal.AddRange(treehelpers.list_to_tree(notch_lines_horizontal_nested,i).AllData(),Grasshopper.Kernel.Data.GH_Path(i))
                offset0.AddRange(plines0,Grasshopper.Kernel.Data.GH_Path(i))
                offset1.AddRange(plines1,Grasshopper.Kernel.Data.GH_Path(i))
                planes.Add(Plane(plines0[0][0],planes0[0].ZAxis),Grasshopper.Kernel.Data.GH_Path(i))
                notch_geo = []
                if(_union):
                    cut_curves0_temp, cut_curves1_temp, cut_extrusions_temp = self.get_notch_geometry(_c0, _c1, notch_lines_nested,notch_lines_nested_corners, planes0, planes1, radius+0.0001)
                    #cut_curves0.AddRange(cut_curves0_temp,Grasshopper.Kernel.Data.GH_Path(i))
                    #cut_curves1.AddRange(cut_curves1_temp,Grasshopper.Kernel.Data.GH_Path(i))
                    cut_extrusions.AddRange(cut_extrusions_temp,Grasshopper.Kernel.Data.GH_Path(i))

            # _lines = lines
            # _lines_corners = lines_corners
            # _lines_horizontal = lines_horizontal
            # _offset0 = offset0
            # _offset1 = offset1
            # _planes = planes
            # #_cut_curves0 = cut_curves0
            # #_cut_curves1 = cut_curves1
            # _cut_extrusions = cut_extrusions
            return lines, lines_corners, lines_horizontal, offset0, offset1, planes, cut_extrusions
# ---------- end ears ----------
line = Line(ext)
debrep = DeconstructBrep(Brep=loft_b)  # -> Faces, Edges, Vertices
pipe = Pipe(Curve=line, Radius=8, Caps=1)
join = BrepJoin(Breps=debrep.Faces)  # -> Breps, Closed
sdiff = SolidDifference(BrepsA=join.Breps, BrepsB=flatten([ears.cut_extrusions, pipe]))

# ----
crv_32 = Curve(partition_4)  # disabled
path = FilePath("C:\legion_pro_7_16IRX8H\software\python\compas_wood\backend\src\wood\dataset\type_plates_name_vda_floor_2.xml")  # disabled
xml_write_plines = Xml_write_plines(plines=crv_31, path=path)  # inputs plines: tree of Polyline, insertion_vectors: tree of Vector3d, joints_types: tree of Int32, type_of_three_valance: Int32, three_valence: tree of Int32, adjacency: tree of Int32; disabled
#   port plines: a data tree of polylines pairs
# ---------- xml_write_plines: Python ----------
__author__ = "petras vestartas"
__version__ = "2023.03.28"

"""
Write polylines with properties to xml file
"""

from ghpythonlib.componentbase import executingcomponent as component
import clr
clr.AddReference("System.Xml")
import System.Xml

class write_component(component):

    def xml_polyline(self, xmlWriter, pline, name):
        xmlWriter.WriteStartElement(name) 
        for p in pline:
            xmlWriter.WriteStartElement("point") 
            
            xmlWriter.WriteStartElement("x") 
            xmlWriter.WriteString(p.X.ToString()) 
            xmlWriter.WriteEndElement() 
            
            xmlWriter.WriteStartElement("y") 
            xmlWriter.WriteString(p.Y.ToString()) 
            xmlWriter.WriteEndElement() 
            
            xmlWriter.WriteStartElement("z") 
            xmlWriter.WriteString(p.Z.ToString()) 
            xmlWriter.WriteEndElement() 
            
            xmlWriter.WriteEndElement() 
        
        xmlWriter.WriteEndElement() 

    def xml_polyline_vectors(self, xmlWriter, vectors, name):
        
        xmlWriter.WriteStartElement(name)
        for v in vectors:
            xmlWriter.WriteStartElement("vector")
            
            xmlWriter.WriteStartElement("x")
            xmlWriter.WriteString(v.X.ToString())
            xmlWriter.WriteEndElement()
            
            xmlWriter.WriteStartElement("y")
            xmlWriter.WriteString(v.Y.ToString())
            xmlWriter.WriteEndElement()
            
            xmlWriter.WriteStartElement("z")
            xmlWriter.WriteString(v.Z.ToString())
            xmlWriter.WriteEndElement()
            
            xmlWriter.WriteEndElement()
        xmlWriter.WriteEndElement()

    def xml_polyline_ids(self, xmlWriter, ids, name):
        xmlWriter.WriteStartElement(name)
        for id in ids:
            xmlWriter.WriteStartElement("id")
            xmlWriter.WriteString(id.ToString())
            xmlWriter.WriteEndElement()
        xmlWriter.WriteEndElement()
    
    def RunScript(
        self,
        _plines,
        _insertion_vectors,
        _joints_types,
        _type_of_three_valence,
        _three_valence,
        _adjacency,
        _path
    ):
        
        if(_path == None or _plines.AllData().Count == 0):
            return False
        
        
        ##########################################################################
        # Create document
        ##########################################################################
        xmlWriter = System.Xml.XmlWriter.Create(_path) 
    
        ##########################################################################
        # Start document
        ##########################################################################
    
        xmlWriter.WriteStartDocument() 
        xmlWriter.WriteStartElement("input_polylines") 
        ##########################################################################
        # _plines
        ##########################################################################
    
        for pline in _plines.AllData():
            self.xml_polyline(xmlWriter, pline, "polyline") 
    
    
        ##########################################################################
        # _insertion_vectors
        ##########################################################################
        if(_insertion_vectors.AllData().Count != 0):
            for i in range(_insertion_vectors.BranchCount):
                self.xml_polyline_vectors(xmlWriter, _insertion_vectors.Branch(i), "insertion_vectors") 
    
    
        ##########################################################################
        # _joints_per_face
        ##########################################################################
        if(_joints_types.AllData().Count != 0):
            for i in range(_joints_types.BranchCount):
                self.xml_polyline_ids(xmlWriter, _joints_types.Branch(i), "joints_types") 
    
    
        ##########################################################################
        # _three_valence | we indicate which 3 valence it is -> 0 - Annen, 1 - Vidy
        ##########################################################################
        if(_three_valence.AllData().Count != 0):
            self.xml_polyline_ids(xmlWriter, [_type_of_three_valence], "three_valence")
            for i in range(_three_valence.BranchCount):
                self.xml_polyline_ids(xmlWriter, _three_valence.Branch(i), "three_valence") 
    
    
        ##########################################################################
        # _adjacency, sides are not given so set them to -1
        ##########################################################################
        if(_adjacency.AllData().Count != 0):
            adjacency_no_sides = _adjacency.AllData() 
            adjacency = []
    
            for i in range(0, adjacency_no_sides.Count, 2):
                adjacency.append(adjacency_no_sides[i + 0]) 
                adjacency.append(adjacency_no_sides[i + 1]) 
                adjacency.append(-1) 
                adjacency.append(-1) 
    
            self.xml_polyline_ids(xmlWriter, adjacency, "adjacency") 
    
    
    
        ##########################################################################
        # Close document
        ##########################################################################
        xmlWriter.WriteEndDocument() 
        xmlWriter.Close() 
        
        return True
# ---------- end xml_write_plines ----------

# ---- group: Loft
input_get = Input_get(data=solver)  # -> plines, insertion_vectors, joints_per_face, three_valence, adjacency
#   port data: collection of inputs that represent the elements, insertion vectors, joint types and adjacency, use input_set commonent to group these inputs
# ---------- input_get: Python ----------
from ghpythonlib.componentbase import executingcomponent as component
import Grasshopper, GhPython
import System

__author__ = "petras"
__version__ = "2023.04.02"

import ghpythonlib.treehelpers as th
from Rhino.Geometry import Polyline
import Rhino
import rhinoscriptsyntax as rs

class MyComponent(component):
    
    def RunScript(self, _data):
        
        if(_data is None):
            return
        
        _plines =  Grasshopper.DataTree[Polyline]()
        for i in range(len(_data[0])):
            _plines.AddRange(_data[0][i],Grasshopper.Kernel.Data.GH_Path(i))
        
        
        _insertion_vectors =  th.list_to_tree(_data[1])
        _joints_per_face =  th.list_to_tree(_data[2])
        _three_valence = th.list_to_tree(_data[3])
        _adjacency =th.list_to_tree(_data[4])
        
        # return outputs if you have them; here I try it for you:
        return (_plines, _insertion_vectors, _joints_per_face, _three_valence, _adjacency)
# ---------- end input_get ----------
dam_2 = DataDam(DataA=input_get.plines, BufferDelay=10000000, BufferMode=0)
display = CurvePreview(Curve=input_get.plines, Width=1)
cluster_13 = Cluster(relay=dam_2)
dispatch = Dispatch(List=cluster_13, DispatchPattern=[True, False])  # -> ListA, ListB
loft_b_2 = Loft_brep(p0=dispatch.ListA, p1=dispatch.ListB)  # -> brep; inputs p0: list of Curve, p1: list of Curve; same code as loft_b
debrep_2 = DeconstructBrep(Brep=loft_b_2)  # -> Faces, Edges, Vertices
join_2 = BrepJoin(Breps=debrep_2.Faces)  # -> Breps, Closed

# ----
input_get_2 = Input_get(data=solver_2)  # -> plines, insertion_vectors, joints_per_face, three_valence, adjacency; same code as input_get
boundary = BoundarySurfaces(Edges=input_get_2.plines)

# ---- group: Loft
dam_3 = DataDam(DataA=input_get_2.plines, BufferDelay=10000000, BufferMode=0)
cluster_14 = Cluster(relay=dam_3)
dispatch_2 = Dispatch(List=cluster_14, DispatchPattern=[True, False])  # -> ListA, ListB
loft_b_3 = Loft_brep(p0=dispatch_2.ListA, p1=dispatch_2.ListB)  # -> brep; inputs p0: list of Curve, p1: list of Curve
#   port p0: polylines with holes, bottom
#   port p1: polylines with holes, top
#   port brep: lofted and capped brep with holes
# ---------- loft_b_3: Python ----------
"""get joints ids and connections areas between elements"""

__author__ = "petras vestartas"
__version__ = "2023.03.31"


from ghpythonlib.componentbase import executingcomponent as component
import Rhino.RhinoDoc
import Rhino.Geometry
import Rhino.RhinoMath
from System.Drawing import Color


class connections_zones(component):
    def loft_polylines_with_holes(self, curves0, curves1):
        """Loft polylines with holes

        Parameters
        ----------
        curves0 : list[rg.Polyline]
        curves1 : list[rg.Polyline]

        Returns
        -------
        rg.Brep
            brep as lofted polylines and cap them
        """

        ###############################################################################
        # user input
        ###############################################################################

        flag = len(curves0) is not 0 if True else len(curves1) != 0
        if flag:
            curves = []
            curves2 = []

            flag0 = len(curves1) == 0
            flag1 = len(curves0) == 0 and len(curves1) != 0
            flag2 = len(curves0) and len(curves1)

            if flag0:
                for i in range(len(curves0)):
                    if float(i) >= float(len(curves0)) * 0.5:
                        curves2.Add(curves0[i])
                    else:
                        curves.Add(curves0[i])
            elif flag1:
                for i in range(0, len(curves1), 2):
                    curves.Add(curves1[i])
                    curves2.Add(curves1[i + 1])
            elif flag2:
                curves = curves0
                curves2 = curves1

            curves0 = curves
            curves1 = curves2

        ###############################################################################
        # Create mesh of the bottom face
        ###############################################################################
        brep_bottom = Rhino.Geometry.Brep.CreatePlanarBreps(
            curves0, Rhino.RhinoDoc.ActiveDoc.ModelAbsoluteTolerance * 1000
        )[0]
        brep_top = Rhino.Geometry.Brep.CreatePlanarBreps(
            curves1, Rhino.RhinoDoc.ActiveDoc.ModelAbsoluteTolerance * 1000
        )[0]

        ###############################################################################
        # Create lofts
        ###############################################################################
        breps_to_join = [brep_bottom, brep_top]
        for i in range(len(curves0)):
            wall = Rhino.Geometry.Brep.CreateFromLoft(
                [curves0[i], curves1[i]],
                Rhino.Geometry.Point3d.Unset,
                Rhino.Geometry.Point3d.Unset,
                Rhino.Geometry.LoftType.Normal,
                False,
            )[0]
            breps_to_join.append(wall)

        ###############################################################################
        # Join Brep
        ###############################################################################
        solid = Rhino.Geometry.Brep.JoinBreps(
            breps_to_join, Rhino.RhinoDoc.ActiveDoc.ModelAbsoluteTolerance
        )[0]

        ###############################################################################
        # Because kinked surface can cause problems down stream, Rhino
        # always splits kinked surfaces when adding Breps to the document. Since
        # we are not adding this Brep to the document, lets split the kinked
        # surfaces ourself.
        ###############################################################################
        solid.Faces.SplitKinkyFaces(Rhino.RhinoMath.DefaultAngleTolerance, True)

        ###############################################################################
        # The profile curve, created by the input points, is oriented clockwise.
        # Thus when the profile is extruded, the resulting surface will have its
        # normals pointed inwards. So lets check the orientation and, if inwards,
        # flip the face normals.
        ###############################################################################
        if Rhino.Geometry.BrepSolidOrientation.Inward == solid.SolidOrientation:
            solid.Flip()

        for i in range(solid.Faces.Count):
            if i < 2:
                solid.Faces[i].PerFaceColor = Color.LightGray  # Color.LightGray
            else:
                solid.Faces[i].PerFaceColor = Color.DeepPink

        return solid

    def RunScript(self, _p0, _p1):
        if _p0 and _p1:
            return self.loft_polylines_with_holes(_p0, _p1)
# ---------- end loft_b_3 ----------
debrep_3 = DeconstructBrep(Brep=loft_b_3)  # -> Faces, Edges, Vertices
join_3 = BrepJoin(Breps=debrep_3.Faces)  # -> Breps, Closed
area = Area(Geometry=join_3.Breps)  # -> Area, flatten(Centroid)
group = Group(Objects=flatten(join_3.Breps))
points = PointList(Points=area.Centroid, Size=Slider(100, range=0..100))

# ---- group: Notches
dam_4 = DataDam(DataA=input_get_2.plines, BufferDelay=10000000, BufferMode=0)  # disabled
xy_2 = XYPlane(Origin=Point(0, 0, 0))  # disabled
number_slider_5 = Slider(7, range=0..100)  # disabled
orient_data_2 = Orient_data(data=dam_4, planes=xy_2)  # -> plines_o; inputs planes: list of Plane, ids: list of Int32; disabled; same code as orient_data
branch_2 = TreeBranch(Tree=orient_data_2, Path=number_slider_5, MaintainPaths=True)  # -> reverse(Branch); disabled
split_2 = SplitList(List=branch_2, Index=2)  # -> ListA, ListB; disabled
item_9 = ListItem(List=split_2.ListA, Index=0, Wrap=True)  # -> Item, Item1; disabled
loft_b_4 = Loft_brep(p0=item_9.Item, p1=item_9.Item1)  # -> brep; inputs p0: list of Curve, p1: list of Curve; disabled; same code as loft_b
number_slider_6 = Slider(1, range=0..10)  # disabled
number_slider_7 = Slider(4, range=0..10)  # disabled
toggle = BooleanToggle(True)  # disabled
debrep_4 = DeconstructBrep(Brep=loft_b_4)  # -> Faces, Edges, Vertices; disabled
join_4 = BrepJoin(Breps=debrep_4.Faces)  # -> Breps, Closed; disabled
ears_2 = Ears(p0=item_9.Item, p1=item_9.Item1, radius=number_slider_7, notch_type=number_slider_6, union=toggle)  # -> lines, lines_corners, lines_horizontal, offset0, offset1, planes, cut_extrusions; inputs p0: tree of Curve, p1: tree of Curve, notch_type: Int32, union: Boolean; disabled; same code as ears
ext_2 = ExtendCurve(Curve=split_2.ListB, Type=0, Start=100, End=100)  # disabled
line_2 = Line(ext_2)  # disabled
pipe_2 = Pipe(Curve=line_2, Radius=8, Caps=1)  # disabled
crv_33 = Curve(ears_2.lines)  # disabled
brep_13 = Brep(ears_2.cut_extrusions)  # disabled
sdiff_2 = SolidDifference(BrepsA=join_4.Breps, BrepsB=flatten([ears_2.cut_extrusions, pipe_2]))  # disabled

# ==== cluster Cluster
relay = ClusterInput()
disc = Discontinuity(Curve=relay, Level=1)  # -> Points, Parameters
plfit = PlaneFit(Points=disc.Points)  # -> Plane, Deviation
trim = TrimTree(Tree=plfit.Plane, Depth=1)
project = Project(Geometry=relay, Plane=trim)  # -> Geometry, Transform
G = ClusterOutput(project.Geometry)

# ==== cluster Cluster_2
relay = ClusterInput()
C = ClusterInput()
shift = ShiftList(List=relay, Shift=1, Wrap=True)
data = Data(relay)
cp = ControlPoints(Curve=C)  # -> Points, Weights, Knots
plfit = PlaneFit(Points=cp.Points)  # -> Plane, Deviation
_3px = PlanePlanePlane(PlaneA=data, PlaneB=shift, PlaneC=plfit.Plane)  # -> Point, LineAB, LineAC, LineBC
pline = PolyLine(Vertices=_3px.Point, Closed=invert(False))
pl = ClusterOutput(pline)
