# Grasshopper definition 1_solver_joints___.gh (Grasshopper 1.0.7)

# ----
# SOLVER -> JOINTS
crv = Curve([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])
joints = Joints(polylines=crv)  # -> polylines_out, element_pairs, joint_areas, joint_areas_mesh, joint_types, element_neighbors; inputs polylines: tree of Polyline, id: Int32
#   port polylines: a data-tree of polyline pairs
# ---------- joints: Python ----------
"""get joints ids and connections areas between elements"""

__author__ = "petras vestartas"
__version__ = "2023.03.29"


from ghpythonlib.componentbase import executingcomponent as component
# STEP 0 - Installation, anaconda prompt:
# python -m compas_rhino.install
# python -m compas_rhino.install -p compas_wood
# STEP 1 - check the environment name
# import compas_bootstrapper
# print(compas_bootstrapper.ENVIRONMENT_NAME)
# STEP 2 - import proxy from compas.rpc
# https://compas.dev/compas/latest/tutorial/rpc.html#supported-data-types-1
from compas.rpc import Proxy # https://compas.dev/compas/latest/api/compas.rpc.html
proxy = Proxy('compas_wood.joinery') # import module
from compas_rhino import conversions
from ghpythonlib import treehelpers
import Rhino
import Grasshopper as gh

# STEP 3 - start server
#proxy.stop_server()
#proxy.start_server()

class joints(component):
    def RunScript(self, _polylines, _id):
        # ==============================================================================
        # input
        # ==============================================================================
        output_polylines = []
        if( _polylines.AllData().Count!= 0):
            print("user_input")
            #convert to compas polylines
            for i in _polylines.AllData():
                output_polylines.append(conversions.polyline_to_compas(i))
        else:
            print("xml_input")
            feasible_ids = [1,3,7,10,11,12,14,16,17,18,19,20,21,22,23,24,25,27,28,29,30,31,34,36,37]
            
            # read the xml file and get a data-set
            foldername = (
                proxy.get_cwd()+"/frontend/src/wood/dataset/" 
            )
            
            # read polylines from an xml files
            id = feasible_ids[max(min(24, _id), 0)]
            filename_of_dataset = proxy.get_filenames_of_datasets()[id]
            output_polylines = proxy.read_xml_polylines(foldername, filename_of_dataset)
        
        # ==============================================================================
        # get joints
        # ==============================================================================
        element_pairs_list, joint_areas_polylines, joint_types = proxy.joints(output_polylines, 2) 
        
        
        # ==============================================================================
        # output
        # ==============================================================================
        _element_pairs = treehelpers.list_to_tree(element_pairs_list)
        
        # iterate joints add neighbors to individual elements element
        _element_neighbors = gh.DataTree[int]()
        for i in element_pairs_list:
            _element_neighbors.Add(i[1],gh.Kernel.Data.GH_Path(i[0]))
            _element_neighbors.Add(i[0],gh.Kernel.Data.GH_Path(i[1]))
        
        
        _joint_areas = []
        _joint_areas_mesh = []
        for i in joint_areas_polylines:
            polyline = conversions.polyline_to_rhino(i)
            polyline.MergeColinearSegments(0.02, True)
            polyline.CollapseShortSegments(0.02)
            _joint_areas.append(polyline)
            _joint_areas_mesh.append(Rhino.Geometry.Mesh.CreateFromClosedPolyline(polyline))
        
        remap_joint_types = {11: 1, 12: 0, 13: 5, 20: 2, 30: 3, 40: 4}
        _joint_types = []
        for i in joint_types:
            _joint_types.append(remap_joint_types[i])
        
        _polylines_out = []
        for i in output_polylines:
            _polylines_out.append(conversions.polyline_to_rhino(i))
        
        return _polylines_out, _element_pairs, _joint_areas, _joint_areas_mesh, _joint_types, _element_neighbors
# ---------- end joints ----------
partition = PartitionList(List=joints.polylines_out, Size=2)  # -> simplify(Chunks)

# ---- group: Display Joint Types
ss_e_ip = ColourSwatch(SwatchColor=RGB(237, 213, 0))
ss_e_op = ColourSwatch(SwatchColor=RGB(255, 98, 0))
ts_e_p = ColourSwatch(SwatchColor=RGB(0, 191, 255))
tt_e_p = ColourSwatch(SwatchColor=RGB(207, 0, 114))
cr_c_ip = ColourSwatch(SwatchColor=RGB(27, 209, 151))
ss_e_r = ColourSwatch(SwatchColor=RGB(94, 15, 219))
b = ColourSwatch(SwatchColor=RGB(0, 0, 0))
merge = Merge(Data1=ss_e_ip, Data2=ss_e_op, Data3=ts_e_p, Data4=cr_c_ip, Data5=tt_e_p, Data6=ss_e_r, Data7=b)
item = ListItem(List=merge, Index=joints.joint_types, Wrap=True)
mcol = MeshColours(Mesh=graft(joints.joint_areas_mesh), Colours=graft(item))

# ---- group: Element Neighbors
number_slider = Slider(0, range=0..8)
branch = TreeBranch(Tree=partition, Path=number_slider, MaintainPaths=True)
branch_2 = TreeBranch(Tree=joints.element_neighbors, Path=number_slider, MaintainPaths=True)
branch_3 = TreeBranch(Tree=partition, Path=branch_2, MaintainPaths=True)
boundary = BoundarySurfaces(Edges=branch)
boundary_2 = BoundarySurfaces(Edges=branch_3)
mcol_2 = MeshColours(Mesh=boundary_2, Colours=ColourSwatch(SwatchColor=RGB(0, 170, 255)))
mcol_3 = MeshColours(Mesh=boundary, Colours=ColourSwatch(SwatchColor=RGB(255, 0, 161)))

# ---- group: Element Pairs
branch_4 = TreeBranch(Tree=simplify(joints.element_pairs), Path=Slider(5, range=0..8), MaintainPaths=True)
item_2 = ListItem(List=branch_4, Index=[0, 1], Wrap=True)
branch_5 = TreeBranch(Tree=partition, Path=item_2, MaintainPaths=True)
bang = ExplodeTree(Data=branch_5)  # -> Branch0, Branch1
boundary_3 = BoundarySurfaces(Edges=bang.Branch0)
boundary_4 = BoundarySurfaces(Edges=bang.Branch1)
mcol_4 = MeshColours(Mesh=boundary_3, Colours=ColourSwatch(SwatchColor=RGB(255, 0, 161)))
mcol_5 = MeshColours(Mesh=boundary_4, Colours=ColourSwatch(SwatchColor=RGB(0, 170, 255)))
