# Grasshopper definition 5_utilities_ears.gh (Grasshopper 1.0.7)

crv = Curve([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])
crv_2 = Curve(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)
crv_3 = Curve([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])
# UTILITIES -> EARS
crv_4 = Curve([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])
crv_5 = Curve(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)
crv_6 = Curve([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])
entwine = Entwine(Branch00=crv_4, Branch01=crv_5, Branch02=crv, FlattenInputs=True)
entwine_2 = Entwine(Branch00=crv_6, Branch01=crv_2, Branch02=crv_3, FlattenInputs=True)
ears = Ears(p0=entwine, p1=entwine_2, radius=Slider(4, range=0..1000), notch_type=Slider(2, range=0..4), union=Toggle(True))  # -> lines, lines_corners, lines_horizontal, offset0, offset1, planes, cut_extrusions; inputs p0: tree of Curve, p1: tree of Curve, notch_type: Int32, union: Boolean
#   port p0: a data-tree of polyline pairs with holes
#   port p1: a data-tree of polyline pairs with holes
#   port radius: notch radius that is equal to cutting tool radius
#   port notch_type: 0 - none, 1 - diagonal, 2 - translation
#   port union: get cutting elements for boolean difference and union
#   port lines_corners: lines which shows the correners from where the notch starts
#   port lines_horizontal: notches are represented as horizontal lines that can be used for milling
#   port offset0: offset outrline for cutting without notches
#   port offset1: offset outrline for cutting without notches
#   port planes: element plane that can be used for orientation
#   port cut_extrusions: breps that can be used for boolean difference
# ---------- ears: Python ----------
"""get joints ids and connections areas between elements"""

__author__ = "petras vestartas"
__version__ = "2023.04.01"


from ghpythonlib.componentbase import executingcomponent as component

import Rhino.RhinoDoc
import Rhino.RhinoApp
from Rhino.Geometry import Polyline
from Rhino.Geometry import Plane
from Rhino.Geometry import Point3d
from Rhino.Geometry import Vector3d
from Rhino.Geometry import Line
from Rhino.Geometry import Transform
from Rhino.Geometry import Arc
from Rhino.Geometry import Brep
from Rhino.Geometry import Curve
import math
from Rhino.Geometry.Intersect.Intersection import PlanePlane
from Rhino.Geometry.Intersect.Intersection import LinePlane
from Rhino.Geometry.Intersect.Intersection import BrepPlane
import Grasshopper
from ghpythonlib import treehelpers


class ears(component):
            
    def to_polyline_from_cp(self, curve):
        
        polyline = Polyline() 
        result, polyline1 = curve.TryGetPolyline()
                
        if (result == False):
                    
            nurbsCurve = curve.ToNurbsCurve()  
            point3dArray = []
                    
            for i in range(nurbsCurve.Points.Count):
                result, pt = nurbsCurve.Points.GetPoint(i)
                point3dArray.append(pt)
                    
            polyline1 = Polyline(point3dArray)  
            nurbsCurve = polyline1.ToNurbsCurve()  
            result, polyline1 = nurbsCurve.TryGetPolyline()  
                    
            polyline1.CollapseShortSegments(0.01) 
                    
            polyline1 = Polyline(polyline1)  
            polyline = polyline1  
                    
        else:
            polyline1.CollapseShortSegments(0.01)  
            polyline = polyline1  
                
        return polyline


    def offset_parallelograms(self, x, y, radius) :
        """offset outlines by intersecting side planes
                
        Parameters
        ----------
        x : first closed outline
        y : second closed outline
        radius : offset distance that normally corresponds to the tool radius
                
        Returns
        -------
        tuple(polyline0, polyline1)
            two outlines
        bool
            if polylines are closed
        """
                
        if(x.Count < 2 or y.Count<2):
            print("WARNING empty polylines")
            return
        
        ###############################################################################
        # Get edge planes that are offseted
        ###############################################################################
        
        offset_planes = []
        for i in range(x.Count-1):
            c = (x[i] + x[i + 1]) * 0.5
            XAxis = y[i] - y[i + 1] if x[i].DistanceTo(x[i + 1]) < 0.01 else x[i] - x[i + 1]
            YAxis = x[i] - y[i]
            ZAxis = Vector3d.CrossProduct(XAxis, YAxis)
            ZAxis.Unitize()
            plane =  Plane(c + ZAxis * radius, XAxis, YAxis)
            offset_planes.Add(plane)
        
        
        ###############################################################################
        # Intersect planes one by one
        ###############################################################################
        
        result, fit_plane0 = Plane.FitPlaneToPoints(x)
        result, fit_plane1 = Plane.FitPlaneToPoints(y)
        offset_polyline0 = Polyline()
        offset_polyline1 = Polyline()
        
        
        closed = x[0].DistanceToSquared( x[x.Count-1]) < 0.0001
        for i in range(offset_planes.Count) :
            result, l = PlanePlane(offset_planes[(offset_planes.Count+(i-1))% offset_planes.Count], offset_planes[i])
            result, types_of_notches_per_point = LinePlane(l, fit_plane0)
            offset_polyline0.Add(l.PointAt(types_of_notches_per_point))
            result, types_of_notches_per_point = LinePlane(l, fit_plane1)
            offset_polyline1.Add(l.PointAt(types_of_notches_per_point))
        
        
        if (closed == False) :
            
            l = Line.Unset
            result, l = PlanePlane(fitPlane0, offset_planes[0])
            offset_polyline0.Insert(0, l.ClosestPoint(x[0], False))
            result, l = PlanePlane(fitPlane0, offset_planes[offset_planes.Count - 1])
            offset_polyline0.Add(l.ClosestPoint(x[x.Count - 1], False))
            
            result, l = PlanePlane(fitPlane1, offset_planes[0])
            offset_polyline1.Insert(0, l.ClosestPoint(y[0], False))
            result, l = PlanePlane(fitPlane1, offset_planes[offset_planes.Count - 1])
            offset_polyline1.Add(l.ClosestPoint(y[y.Count - 1], False))
        else :
            offset_polyline0.Add(offset_polyline0[0])
            offset_polyline1.Add(offset_polyline1[0])
        
        
        ###############################################################################
        # Output
        ###############################################################################
        return offset_polyline0, offset_polyline1, closed

    def align_plane(self, plane, v):
        
        p = Plane(plane)
        
        result, parameterAlongXDirection, parameterAlongYDirection = p.ClosestParameter(p.Origin + v)
        angle = math.atan2(parameterAlongXDirection, parameterAlongYDirection)
        p.Rotate(-angle + 1.5707963267949, p.ZAxis, p.Origin)
        
        return p

    def vector_projection(self,v0, v1, extendV1 = False) :
        
        v0L = v0.Length
        v1L = v1.Length
        v0.Unitize()
        v1.Unitize()
        dotProduct = v0 * v1
        v0ProjectionLen = v0L * dotProduct
        if (extendV1):
            return v1 * (v0ProjectionLen + v1L)
        return v1 * v0ProjectionLen

    def get_leveled_vector(self, vector, vertical_height):
        
        dir = Vector3d(vector)
        dir.Unitize()
        angle = Vector3d.VectorAngle(dir, Vector3d(0, 0, 1))
        inclined_offset_by_vertical_distance = vertical_height * math.tan(angle)
        dir = dir*inclined_offset_by_vertical_distance

        return dir;


    def notches_lines(self, plines0, plines1, plines0_offset, plines1_offset, _radius, types_of_notches_per_point, offset_distances, is_closed, border):
        """create drilling lines that represent notches
                
        Parameters
        ----------
        plines0_offset[i], plines1_offset[i], _radius, notch_types, offset_distances
        plines0 : bottom offseted outlines by plane to plane inersection
        plines1 : top offseted outlines by plane to plane inersection
        radius : offset distance
        types_of_notches_per_point : type of notch: bisector, translation u, trasnlation v, rounding, none
        offset_distances : perpendicular distance between corner lines and offset lines
        is_closed : check if the offseted outline is closed  
        border : bool if border or hole
        Returns
        -------
        list(Line)
            drilling lines
        list(Line)
            drilling lines of corners that notches belongs to
        """
        
        ###############################################################################
        # Copy the offset polylines
        # Remove end point if the polyline is closed
        ###############################################################################
        xA_ = Polyline(plines0)
        xB_ = Polyline(plines1)
        xA = Polyline(plines0_offset)
        xB = Polyline(plines1_offset)
        
        #Rhino.RhinoDoc.ActiveDoc.Objects.AddBox(Rhino.Geometry.Box(xA_.BoundingBox))
        #Rhino.RhinoDoc.ActiveDoc.Objects.AddPolyline(xA)
        #Rhino.RhinoDoc.ActiveDoc.Objects.AddBox(Rhino.Geometry.Box(xB_.BoundingBox))
        
        if(is_closed):
            xA_.RemoveAt(xA_.Count - 1)
            xB_.RemoveAt(xB_.Count - 1)
            xA.RemoveAt(xA.Count - 1)
            xB.RemoveAt(xB.Count - 1)
        
        ###############################################################################
        # Output lists
        ###############################################################################
        l0_corners =  [] # fillet
        l0 =  []
        l1 =  [] # fillet
        l2 =  [] # fillet
        plines = []
        planes = []
        
        ###############################################################################
        # create plane to plane transformation for geometry rotated in 3D
        ###############################################################################
        result, base_plane = Plane.FitPlaneToPoints(xA)
        if (base_plane.DistanceTo(xB[0]) < 0.0):
            base_plane.Flip()
        to_xy = Transform.PlaneToPlane(base_plane, Plane.WorldXY)
        
        ###############################################################################
        # For notches or fillet, if fillet twice bigger radius is needed
        # also see this if statement if (types_of_notches_per_point[0] == 4 && angle_ > 0) : because corner is  inversed
        ###############################################################################
        fillet = False
        R_ = _radius * 2 if types_of_notches_per_point[0] == 4 else _radius
        notchStart = True
        
        for i in range(0, xA.Count) :
            
            ###############################################################################
            # Get vertical lines
            ###############################################################################
            normal = Line(xA[i], xB[i])
            n = xA.Count
            next = (i + 1) % n
            nextNext = (i + 2) % n
            prev = (((i - 1) % n) + n) % n
            
            p0a = xA[i]
            p1a = xA[next]
            p2a = xA[prev]
            p3a = xA[nextNext]
            
            p0b = xB[i]
            p1b = xB[next]
            p2b = xB[prev]
            p3b = xB[nextNext]
            
            normal1 = Line(xA[next], xB[next])
            normal2 = Line(xA[prev], xB[prev])
            ###############################################################################
            # Measure Concavity
            ###############################################################################
            cornera =  Polyline( [ p2a, p0a, p1a ] )
            cornerb =  Polyline( [ p2b, p0b, p1b ] )
            
            cornera.Transform(Transform.PlaneToPlane( Plane(p0a, normal.Direction), Plane.WorldXY))
            nextEdge = cornera.SegmentAt(0).Direction
            previousEdge = cornera.SegmentAt(1).Direction
            
            angle_ = ((math.atan2(nextEdge.X, nextEdge.Y) - math.atan2(previousEdge.X, previousEdge.Y) + math.pi * 2) % (math.pi * 2)) -math.pi
            
            if (types_of_notches_per_point[0] == 4 and angle_ > 0):
                l0_corners.Add(Line.Unset)
                l0.Add(Line.Unset)
                l1.Add(Line.Unset)
                l2.Add(Line.Unset)
                continue
            
            elif (types_of_notches_per_point[0] != 4 and angle_ < 0) :
                l0_corners.Add(Line.Unset)
                l0.Add(Line.Unset)
                l1.Add(Line.Unset)
                l2.Add(Line.Unset)
                continue
            
            
            ###############################################################################
            # Get Perpependicular points
            # Intersect current and neighbor lines
            ###############################################################################
            
            
            
            # Create plane for intersection of neighbor lines
            result, fit_plane1 = Plane.FitPlaneToPoints( [normal.To, normal1.To, normal2.To] )
            normalPl =  Plane(normal.From, fit_plane1.ClosestPoint(normal.From) - normal.From)
            f0, t = LinePlane(normal, normalPl)
            p0a = normal.PointAt(t)
            f1, t = LinePlane(normal1, normalPl)
            p1a = normal1.PointAt(t)
            f2, t = LinePlane(normal2, normalPl)
            p2a = normal2.PointAt(t)
            
            
            ###############################################################################
            # Compute offset vectors on perpedicular points
            # Error here, with v0 and v1 orientaton, must be rotated  90 deg
            ###############################################################################
            v0 = p0a - p1a
            v1 = p0a - p2a
            
            v0.Unitize()
            v1.Unitize()
            
            ###############################################################################
            # Depending on angle the offset changes, sin gives this distance value
            ###############################################################################
            angle = Vector3d.VectorAngle(v0, v1,  Plane(p0a, v0, v1))
            radius = R_ * ((1 / math.atan(angle)) )
            radius = -offset_distances[i].Length
            # translation
            radius *= -1
            
            ###############################################################################
            # TYPE A Notch - Line Directions A-B
            ###############################################################################
            local_cornera_ =  Polyline( [ xA_[prev], xA_[i], xA_[next] ] )
            local_cornerb_ =  Polyline( [ xB_[prev], xB_[i], xB_[next] ] )
            local_cornera =  Polyline( [ xA[prev], xA[i], xA[next]  ] )
            local_cornerb =  Polyline( [ xB[prev], xB[i], xB[next] ] )
            pl0 = self.align_plane(normalPl, v0)
            pl1 = self.align_plane(normalPl, v1)
            extension0 = 0
            extension1 = 0
            # for sharp angles extension is needed
            """
            extension0 = self.vector_projection(v0 * radius, v1 * radius).Length if angle < (math.pi * 0.5) else 0
            extension1 = self.vector_projection(v1 * radius, v0 * radius).Length if angle < (math.pi * 0.5) else 0
            extension0 *= 1
            extension1 *= 1
            
            normalXAxis0 =  Line(xA[i] + pl0.XAxis * (radius + extension0), xB[i] + pl0.XAxis * (radius + extension0))
            normalXAxis1 =  Line(xA[i] + pl1.XAxis * (radius + extension1), xB[i] + pl1.XAxis * (radius + extension1))
            """
            #Rhino.RhinoDoc.ActiveDoc.Objects.AddPolyline(cornera) 
            normalXAxis0 = Line(local_cornera.SegmentAt(0).ClosestPoint(local_cornera_[1],False),local_cornerb.SegmentAt(0).ClosestPoint(local_cornerb_[1],False))
            normalXAxis1 = Line(local_cornera.SegmentAt(1).ClosestPoint(local_cornera_[1],False),local_cornerb.SegmentAt(1).ClosestPoint(local_cornerb_[1],False))
            dist0 = xA.ClosestPoint(normalXAxis0.From).DistanceTo(normalXAxis0.From)
            dist1 = xA.ClosestPoint(normalXAxis1.From).DistanceTo(normalXAxis1.From)
            border_or_hole = dist0<dist1 if border else dist0>dist1 
            if(border_or_hole):
                normalXAxis0 = normalXAxis1
            else:
                normalXAxis1 = normalXAxis0
            # Rhino.RhinoDoc.ActiveDoc.Objects.AddLine( normalXAxis0 )
            # Rhino.RhinoDoc.ActiveDoc.Objects.AddLine( normalXAxis1 )
            ###############################################################################
            # TYPE B Notch -  Diaognal
            ###############################################################################
            bisectorDir = offset_distances[i]
            
            pl2normalXAxis2Fillet = self.align_plane(normalPl, bisectorDir)
            length = bisectorDir.Length
            normalXAxis2 = Line(xA[i] + bisectorDir, xB[i] + bisectorDir)
            
            # Rhino.RhinoDoc.ActiveDoc.Objects.AddLine( normalXAxis2 )
            
            ###############################################################################
            # TYPE C Notch -  Fillet
            ###############################################################################
            bisectorDirFillet = (pl0.XAxis * radius + pl1.XAxis * radius)
            pl2 = self.align_plane(normalPl, bisectorDirFillet)
            lengthFillet = bisectorDir.Length
            bisectorDirFillet *= -(length) / length
            
            normalXAxis2Fillet = Line(xA[i] + bisectorDirFillet * ((length - R_) / length), xB[i] + bisectorDirFillet * ((length - R_) / length))
            normalXAxis2FilletCenter = Line(xA[i] + bisectorDirFillet, xB[i] + bisectorDirFillet)
            normalXAxis2Fillet0 = Line(normalXAxis2FilletCenter.From + pl0.XAxis * (radius + extension0), normalXAxis2FilletCenter.To + pl0.XAxis * (radius + extension0))
            normalXAxis2Fillet1 = Line(normalXAxis2FilletCenter.From + pl1.XAxis * (radius + extension0), normalXAxis2FilletCenter.To + pl1.XAxis * (radius + extension0))
            # Rhino.RhinoDoc.ActiveDoc.Objects.AddLine( normalXAxis2Fillet ) 
            # Rhino.RhinoDoc.ActiveDoc.Objects.AddLine( normalXAxis2FilletCenter ) 
            # Rhino.RhinoDoc.ActiveDoc.Objects.AddLine( normalXAxis2Fillet0 ) 
            # Rhino.RhinoDoc.ActiveDoc.Objects.AddLine( normalXAxis2Fillet1 ) 
            
            ###############################################################################
            # Output
            ###############################################################################
            planes.Add(pl0)
            planes.Add(pl1)
            planes.Add(pl2)
            
            lastFlag = False
            
            l0_corners.append(Line(xA[i],xB[i]))
            if (len(types_of_notches_per_point) == 1):
                if (types_of_notches_per_point[0]==2 or types_of_notches_per_point[0]==3) :
                    flag = p0.DistanceToSquared(p1) < p0.DistanceToSquared(p2) if types_of_notches_per_point[0] == 3 else  p0.DistanceToSquared(p1) > p0.DistanceToSquared(p2)
                    if (flag):
                        l0.Add(normalXAxis0)
                    else:
                        l0.Add(normalXAxis1)
                    
                elif (types_of_notches_per_point[0]==1) :
                    l0.Add(normalXAxis2)
                    
                elif (types_of_notches_per_point[0]==4) :
                    fillet = True
                    l0.Add(normalXAxis2Fillet0)
                    l1.Add(normalXAxis2Fillet)
                    l2.Add(normalXAxis2Fillet1)
                    
                elif (types_of_notches_per_point[0]==5 or types_of_notches_per_point[0]==6) :
                    if (i % 2 == 1):
                        lastFlag = not lastFlag
                    if (types_of_notches_per_point[0] == 6):
                        lastFlag = not lastFlag
                    
                    if (lastFlag):
                        l0.Add(normalXAxis0)
                    else:
                        l0.Add(normalXAxis1)
                    
                else:
                    l0.Add(Line.Unset)
                
            else:
                
                if (types_of_notches_per_point[i % len(types_of_notches_per_point)] == 2):
                    l0.Add(normalXAxis0)
                
                elif (types_of_notches_per_point[i % len(types_of_notches_per_point)] == 3):
                    l0.Add(normalXAxis1)
                
                elif (types_of_notches_per_point[i % len(types_of_notches_per_point)] == 4):
                    fillet = True
                    l0.Add(normalXAxis2Fillet0)
                    l1.Add(normalXAxis2Fillet)
                    l2.Add(normalXAxis2Fillet1)
                
                elif (types_of_notches_per_point[i % len(types_of_notches_per_point)] == 1):
                    l0.Add(normalXAxis2)
                
                else:
                    l0.Add(Line.Unset)
        
        # for i in l0: 
        #     Rhino.RhinoDoc.ActiveDoc.Objects.AddLine(i)
        
        ###############################################################################
        # Add Notches to a Pair of Polylines
        ###############################################################################
        lines = []
        lines_corners = []
        lines_horizontal = []
        result, fitPlane = Plane.FitPlaneToPoints(xA)
        result, fitPlaneB = Plane.FitPlaneToPoints(xB)
        # Rhino.RhinoDoc.ActiveDoc.Objects.AddPolyline(xA)
        # Rhino.RhinoDoc.ActiveDoc.Objects.AddPolyline(xB)
        
        xA_Notch = Polyline()
        xB_Notch = Polyline()
        
        extensions = []
        is_below = []
        
        for i in range(xA.Count):
            
            # Extend bottom line to compensate drilling bit thickness and angle
            extensionV = xA[i] - xB[i]
            extension = abs(math.tan(Vector3d.VectorAngle(extensionV, fitPlane.ZAxis)) * R_)
            extensionV.Unitize()
            
            # Move tool-path below surface
            extensionV = extensionV * extension
            extensions.append( extensionV )
            
            next = (i+1)%xA.Count
            prev = (xA.Count+(i-1))%xA.Count
            
            # Check direction of inclined cut, the check is made according to XY plane
            side_plane = Plane(xA[i], xB[i], xA[next])
            
            mid_0 = 0.5 * (xA[i] + xA[next])
            mid_1 = 0.5 * (xB[i] + xB[next])
            segment = Line(xB[i], xB[next])
            
            tool_direction =  Line(mid_0, segment.ClosestPoint(mid_0, False))
            #Rhino.RhinoDoc.ActiveDoc.Objects.AddLine(segment)
            # objects.Add(tool_direction)
            side_plane.Transform(to_xy)
            
            is_below.append(0)
            if (side_plane.Normal.Z < -0.01):
                is_below[i] = -1
            elif (side_plane.Normal.Z > 0.01):
                is_below[i] = 1
                extensions[i] *= -1
            else:
                extensions[i] *= 0
        
        count = 0
        
        # for i in l0: 
        #     Rhino.RhinoDoc.ActiveDoc.Objects.AddLine(i)
        
        for i in range (xA.Count) :
            
            # Extend bottom line to compensate drilling bit thickness and angle
            extensionV = extensions[i]
            next = (i+1)%xA.Count
            prev = (xA.Count+(i-1))%xA.Count
            # Rhino.RhinoDoc.ActiveDoc.Objects.AddLine(l0[count]) 
            # Fillet corner
            if (fillet):
                if (l0[count] != Line.Unset) :
                    # Rhino.RhinoDoc.ActiveDoc.Objects.AddLine(l0[count])    
                    # Rhino.RhinoDoc.ActiveDoc.Objects.AddLine(l1[count])  
                    # Rhino.RhinoDoc.ActiveDoc.Objects.AddLine(l2[count]) 
                    result, t = LinePlane(l0[count], fitPlane)
                    xA_Notch.Add(l0[count].PointAt(t) + extensionV*0)
                    # result, t = LinePlane(l1[count], fitPlane)
                    # xA_Notch.Add(l1[count].PointAt(t) + extensionV)
                    result, t = LinePlane(l2[count], fitPlane)
                    xA_Notch.Add(l2[count].PointAt(t) + extensionV*0)
                    
                    result, t = LinePlane(l0[count], fitPlaneB)
                    xB_Notch.Add(l0[count].PointAt(t))
                    # result, t = LinePlane(l1[count], fitPlaneB)
                    # xB_Notch.Add(l1[count].PointAt(t))
                    result, t = LinePlane(l2[count], fitPlaneB)
                    xB_Notch.Add(l2[count].PointAt(t))
                
                else: 
                    xA_Notch.Add(xA[i] + extensionV*0)
                    xB_Notch.Add(xB[i])
            
            
            # Notch corner
            else :
                if(l0[count] != Line.Unset):
                    lines.Add(l0[count])
                    lines_corners.Add(l0_corners[count])
            
            
            
            count = count + 1 
            
        ###############################################################################
        # Cut lines by bottom and top planes and extend by the radius
        ###############################################################################
            
        for i in range(len(lines)):
            #cut the lines by top and bottom planes
            result, t = LinePlane(lines[i], fitPlane)
            new_point_0 = lines[i].PointAt(t)
            result, t = LinePlane(lines[i], fitPlaneB)
            new_point_1 = lines[i].PointAt(t)
            
            # get extension direction
            l_temp = Line(new_point_0,new_point_1)
            extension_dir = new_point_1-new_point_0
            extension_dir.Unitize()
            l_temp.Transform(to_xy)
            extension_vector = self.get_leveled_vector(l_temp.Direction,_radius)
            extension_dir = extension_dir * extension_vector.Length
            
            # extend the line and update the line
            # lines[i] = Line(new_point_0,new_point_1)
            lines[i] = Line(new_point_0-extension_dir*1,new_point_1+extension_dir*1)
            
        for i in range(len(lines_corners)):
            #Rhino.RhinoDoc.ActiveDoc.Objects.AddLine(lines_corners[i])
            #cut the lines by top and bottom planes
            result, t = LinePlane(lines_corners[i], fitPlane)
            new_point_0 = lines_corners[i].PointAt(t)
            result, t = LinePlane(lines_corners[i], fitPlaneB)
            new_point_1 = lines_corners[i].PointAt(t)
            
            # get extension direction
            l_temp = Line(new_point_0,new_point_1)
            extension_dir = new_point_1-new_point_0
            extension_dir.Unitize()
            l_temp.Transform(to_xy)
            extension_vector = self.get_leveled_vector(l_temp.Direction,_radius)
            extension_dir = extension_dir * extension_vector.Length
            
            # extend the line and update the line
            # lines[i] = Line(new_point_0,new_point_1)
            lines_corners[i] = Line(new_point_0-extension_dir*1,new_point_1+extension_dir*1) 
            
        for i in range(len(lines_corners)):
            lines_horizontal.append(Line(lines[i].From,lines_corners[i].From))
            lines_horizontal.append(Line(lines[i].To,lines_corners[i].To))
        
        ###############################################################################
        # Output
        ###############################################################################
        # for i in lines:
        #     Rhino.RhinoDoc.ActiveDoc.Objects.AddLine(i)
        #Rhino.RhinoDoc.ActiveDoc.Objects.AddPolyline(xA_Notch)
        #Rhino.RhinoDoc.ActiveDoc.Objects.AddPolyline(xB_Notch)
        
        return lines, lines_corners,lines_horizontal, fitPlane, fitPlaneB


    def sort_by_size(self,_p0, _p1):
        sizes = []
        for i in range(len(_p0)):
            sizes.append(_p0[i].GetBoundingBox(True).Diagonal.Length)
        sizes, _c0, _c1 = zip(*sorted(zip(sizes, _p0, _p1), reverse=True))
        
        return _c0, _c1

    def get_ears(self, _c0, _c1, _radius, _notch_type, _union):
                
        ###############################################################################
        # User interface, convert curves toi polylines
        ###############################################################################
        plines0 = []
        plines1 = []
        plines0_offset = []
        plines1_offset = []
        planes0 = []
        planes1 = []
        are_closed = []
        for i in range(len(_c0)):
            plines0.append(self.to_polyline_from_cp(_c0[i]))
            plines1.append(self.to_polyline_from_cp( _c1[i]))
            plines0_offset.append(plines0[-1])
            plines1_offset.append(plines1[-1])
            are_closed.append(True)
        
        ###############################################################################
        # Offset otlines, faces must be planar
        ###############################################################################
        for i in range(len(_c0)):
            plines0_offset[i], plines1_offset[i], are_closed[i] = self.offset_parallelograms(plines0[i], plines1[i], _radius)
        
        ###############################################################################
        # Create notches
        ###############################################################################
        notch_lines_nested = []
        notch_lines_nested_corners = []
        notch_lines_horizontal_nested = []
        for i in range(len(plines0)):
            
            pline_length =  plines0[i].Length
            notch_types = [0]*(plines0[i].Count-1)
            offset_distances = [Vector3d(0,0,0)]*(plines0[i].Count-1)
            
            n = plines0[i].Count - 1
            for j in range( plines0[i].Count-1):
                
                l1 = Line( plines0_offset[i][j], plines1_offset[i][j])
                l2 = Line( plines0[i][j],  plines1[i][j])
                
                dist = l1.ClosestPoint( l2.From, False ).DistanceTo( l2.From ) - _radius
                bisector_dir =  l2.From - ( l1.ClosestPoint( l2.From, False))
                bisector_dir.Unitize()
                bisector_dir *= dist
                offset_distances[j] = bisector_dir
                
                #print(_notch_type)
                if(_notch_type > 1):
                    #print("Hi")
                    shift = 0 if j % 2 == 1 else 0
                    
                    if(pline_length < 300):
                        
                        shift = 0 if j % 2 == 0 else 1
                    
                    notch_types[j] = (3 - shift)
                else:
                    notch_types[j] = _notch_type
                #notch_types[j] = 4
            #prarray
            #print(offset_distances)
            lines, lines_corners,lines_horizontal, plane0, plane1 = self.notches_lines(plines0[i], plines1[i],plines0_offset[i], plines1_offset[i], _radius, notch_types, offset_distances, are_closed[i],i==0)
            notch_lines_nested.append(lines)
            notch_lines_nested_corners.append(lines_corners)
            notch_lines_horizontal_nested.append(lines_horizontal)
            planes0.append(plane0)
            planes1.append(plane1)
            #notch_lines.AddRange(NotchesLines(plines0_offset[i], plines1_offset[i], _radius, notch_types, offset_distances, are_closed))
                
        ###############################################################################
        # Output
        ###############################################################################
        return plines0_offset, plines1_offset, planes0, planes1, are_closed, notch_lines_nested, notch_lines_nested_corners, notch_lines_horizontal_nested

    def get_notch_geometry(self, _c0, _c1, notch_lines_nested, notch_lines_nested_corner, planes0, planes1, radius):
        
        
        #geo = []
        cut_curves0 = []
        cut_curves1 = []
        cut_extrusions = []
        for i in range(len(notch_lines_nested)):
            
            cutter_curves0 = []
            cutter_curves1 = []
            for j in range(len(notch_lines_nested[i])):
                
                # get plane
                p0 = notch_lines_nested[i][j].PointAt(0.5)
                p1 = notch_lines_nested_corner[i][j].ClosestPoint(p0,False)
                xaxis = p0-p1
                zaxis = notch_lines_nested[i][j].Direction
                yaxis = Vector3d.CrossProduct(xaxis,zaxis)
                plane = Plane(p0,xaxis,yaxis)
                
                #construction 5 points for an arc and rectangle profile
                p0_profile = p0 + plane.YAxis*radius
                p1_profile = p1 + plane.YAxis*radius
                p2_profile = p1 - plane.YAxis*radius
                p3_profile = p0 - plane.YAxis*radius
                p4_profile = p0 + plane.XAxis*radius
                p5_profile = p1 - plane.XAxis*radius
                
                # construct PolyCurve
                arc0 = Arc(p0_profile,p4_profile,p3_profile)
                arc1 = Arc(p1_profile,p5_profile,p2_profile)
                polyline0 = Polyline([p0_profile,p1_profile]).ToNurbsCurve()
                polyline1 = Polyline([p2_profile,p3_profile]).ToNurbsCurve()
                
                # geo.append(arc)
                # geo.append(polyline)
                joined_curve = Rhino.Geometry.Curve.JoinCurves([arc0.ToNurbsCurve(),polyline0.ToNurbsCurve(),arc1.ToNurbsCurve(),polyline1.ToNurbsCurve()],0.01)[0]
                joined_curve.Transform(Transform.Translation(notch_lines_nested[i][j].Direction*1))
                
                
                # extrude
                extrusion = Rhino.Geometry.Extrusion.Create(joined_curve.ToNurbsCurve(),notch_lines_nested[i][j].Length*2, True).ToBrep()
                
                
                
                # brep plane
                result, curves0, points = BrepPlane(extrusion, planes0[i], 0.01)
                result, curves1, points = BrepPlane(extrusion, planes1[i], 0.01)
                cutter_curves0.append(curves0[0])
                cutter_curves1.append(curves1[0])
                
                #geo.append(curves0[0])
                #geo.append(curves1[0])
                
                cut_extrusions.append(extrusion)
                #bottom_and_top_cut_curves.append(curves0[0])
            # curve boolean difference
            # continue
            """
            if(i==0):
                crv_difference0 = Rhino.Geometry.Curve.CreateBooleanDifference(_c0[i],cutter_curves0)[0]
                crv_difference1 = Rhino.Geometry.Curve.CreateBooleanDifference(_c1[i],cutter_curves1)[0]
                cut_curves0.append(crv_difference0)
                cut_curves1.append(crv_difference1)
            else:
                cutter_curves0.append(_c0[i])
                cutter_curves1.append(_c1[i])
                crv_difference0 = Rhino.Geometry.Curve.CreateBooleanUnion(cutter_curves0)[0]
                crv_difference1 = Rhino.Geometry.Curve.CreateBooleanUnion(cutter_curves1)[0]
                cut_curves0.append(crv_difference0)
                cut_curves1.append(crv_difference1)
            """
            #align curves
            
        
        return cut_curves0, cut_curves1,cut_extrusions
    
    def RunScript(self, _p0, _p1, _radius,_notch_type, _union):
        
        ###############################################################################
        # Run
        ###############################################################################
        radius = _radius if _radius is not None else 1
        if _p0 and _p1:

            if _p0 == None:
                return
            
            if _p1 == None:
                return
            
            if _p0.DataCount is not _p1.DataCount:
                return
            
            lines =Grasshopper.DataTree[Line]()
            lines_corners = Grasshopper.DataTree[Line]()
            lines_horizontal = Grasshopper.DataTree[Line]()
            offset0 = Grasshopper.DataTree[Polyline]()
            offset1 = Grasshopper.DataTree[Polyline]()
            planes = Grasshopper.DataTree[Plane]()
            #cut_curves0 = Grasshopper.DataTree[Curve]()
            #cut_curves1 = Grasshopper.DataTree[Curve]()
            cut_extrusions = Grasshopper.DataTree[Brep]()
            for i in range(_p0.BranchCount):
                _c0, _c1 = self.sort_by_size(_p0.Branch(i), _p1.Branch(i))
                plines0, plines1, planes0, planes1, are_closed, notch_lines_nested, notch_lines_nested_corners, notch_lines_horizontal_nested = self.get_ears(_c0, _c1,radius,_notch_type, _union)
                lines.AddRange(treehelpers.list_to_tree(notch_lines_nested,i).AllData(),Grasshopper.Kernel.Data.GH_Path(i))
                lines_corners.AddRange(treehelpers.list_to_tree(notch_lines_nested,i).AllData(),Grasshopper.Kernel.Data.GH_Path(i))
                
                for j in range(len(notch_lines_horizontal_nested)):
                    for k in range(0,len(notch_lines_horizontal_nested[j]),2):
                        lines_horizontal.AddRange([notch_lines_horizontal_nested[j][k],notch_lines_horizontal_nested[j][k+1]],Grasshopper.Kernel.Data.GH_Path(i,j,k))
                
                #lines_horizontal.AddRange(treehelpers.list_to_tree(notch_lines_horizontal_nested,i).AllData(),Grasshopper.Kernel.Data.GH_Path(i))
                offset0.AddRange(plines0,Grasshopper.Kernel.Data.GH_Path(i))
                offset1.AddRange(plines1,Grasshopper.Kernel.Data.GH_Path(i))
                planes.Add(Plane(plines0[0][0],planes0[0].ZAxis),Grasshopper.Kernel.Data.GH_Path(i))
                notch_geo = []
                if(_union):
                    cut_curves0_temp, cut_curves1_temp, cut_extrusions_temp = self.get_notch_geometry(_c0, _c1, notch_lines_nested,notch_lines_nested_corners, planes0, planes1, radius+0.00)
                    #cut_curves0.AddRange(cut_curves0_temp,Grasshopper.Kernel.Data.GH_Path(i))
                    #cut_curves1.AddRange(cut_curves1_temp,Grasshopper.Kernel.Data.GH_Path(i))
                    cut_extrusions.AddRange(cut_extrusions_temp,Grasshopper.Kernel.Data.GH_Path(i))

            # _lines = lines
            # _lines_corners = lines_corners
            # _lines_horizontal = lines_horizontal
            # _offset0 = offset0
            # _offset1 = offset1
            # _planes = planes
            # #_cut_curves0 = cut_curves0
            # #_cut_curves1 = cut_curves1
            # _cut_extrusions = cut_extrusions
            return lines, lines_corners, lines_horizontal, offset0, offset1, planes, cut_extrusions
# ---------- end ears ----------
loft_b = Loft_brep(p0=entwine, p1=entwine_2)  # -> simplify(brep); inputs p0: list of Curve, p1: list of Curve
#   port p0: polylines with holes, bottom
#   port p1: polylines with holes, top
#   port brep: lofted and capped brep with holes
# ---------- loft_b: Python ----------
"""get joints ids and connections areas between elements"""

__author__ = "petras vestartas"
__version__ = "2023.03.31"


from ghpythonlib.componentbase import executingcomponent as component
import Rhino.RhinoDoc
import Rhino.Geometry
import Rhino.RhinoMath
from System.Drawing import Color


class connections_zones(component):

    def loft_polylines_with_holes(self, curves0, curves1):
        """Loft polylines with holes
        
        Parameters
        ----------
        curves0 : list[rg.Polyline]
        curves1 : list[rg.Polyline]
        
        Returns
        -------
        rg.Brep
            brep as lofted polylines and cap them
        """
        
        ###############################################################################
        # user input
        ###############################################################################
        
        flag = len(curves0) is not 0 if True else len(curves1) != 0
        if (flag):
            
            curves = []
            curves2 = []
            
            flag0 = len(curves1) == 0
            flag1 = len(curves0) == 0 and len(curves1) != 0
            flag2 = len(curves0) and len(curves1)
            
            if (flag0):
                for i in range(len(curves0)):
                    if (float(i) >= float(len(curves0)) * 0.5):
                        curves2.Add(curves0[i])
                    else:
                        curves.Add(curves0[i])
            elif (flag1):
                for i in range(0, len(curves1), 2):
                    curves.Add(curves1[i])
                    curves2.Add(curves1[i + 1])
            elif (flag2):
                curves = curves0
                curves2 = curves1
            
            curves0 = curves
            curves1 = curves2
        
        
        ###############################################################################
        # Create mesh of the bottom face
        ###############################################################################
        brep_bottom = Rhino.Geometry.Brep.CreatePlanarBreps(curves0, Rhino.RhinoDoc.ActiveDoc.ModelAbsoluteTolerance)[0]
        brep_top = Rhino.Geometry.Brep.CreatePlanarBreps(curves1, Rhino.RhinoDoc.ActiveDoc.ModelAbsoluteTolerance)[0]
        
        ###############################################################################
        # Create lofts
        ###############################################################################
        breps_to_join = [brep_bottom, brep_top]
        for i in range(len(curves0)):
            wall = Rhino.Geometry.Brep.CreateFromLoft([curves0[i],curves1[i]], Rhino.Geometry.Point3d.Unset, Rhino.Geometry.Point3d.Unset, Rhino.Geometry.LoftType.Normal,False)[0]
            breps_to_join.append(wall)
        
        ###############################################################################
        # Join Brep
        ###############################################################################
        solid = Rhino.Geometry.Brep.JoinBreps(breps_to_join, Rhino.RhinoDoc.ActiveDoc.ModelAbsoluteTolerance)[0]
        
        ###############################################################################
        # Because kinked surface can cause problems down stream, Rhino
        # always splits kinked surfaces when adding Breps to the document. Since
        # we are not adding this Brep to the document, lets split the kinked
        # surfaces ourself.
        ###############################################################################
        solid.Faces.SplitKinkyFaces(Rhino.RhinoMath.DefaultAngleTolerance, True)
        
        ###############################################################################
        # The profile curve, created by the input points, is oriented clockwise.
        # Thus when the profile is extruded, the resulting surface will have its
        # normals pointed inwards. So lets check the orientation and, if inwards,
        # flip the face normals.
        ###############################################################################
        if (Rhino.Geometry.BrepSolidOrientation.Inward == solid.SolidOrientation):
            solid.Flip()
        
        for i in range(solid.Faces.Count):
            if(i < 2):
                solid.Faces[i].PerFaceColor = Color.DeepPink#Color.LightGray
            else:
                solid.Faces[i].PerFaceColor = Color.LightGray
        
        return solid
    
    def RunScript(self, _p0, _p1):
        if _p0 and _p1:
            return self.loft_polylines_with_holes(_p0, _p1)
# ---------- end loft_b ----------
sdiff = SolidDifference(BrepsA=loft_b, BrepsB=ears.cut_extrusions)  # disabled

booleandifference = BooleanDifference(A=loft_b, B=ears.cut_extrusions)  # -> result; inputs A: list of Brep, B: list of Brep; disabled
# ---------- booleandifference: Python ----------
import Rhino
a=[]
tol = Rhino.RhinoDoc.ActiveDoc.ModelAbsoluteTolerance
breps = Rhino.Geometry.Brep.CreateBooleanDifference(A,B, tol)
result=[brep for brep in breps]
# ---------- end booleandifference ----------
