# Grasshopper definition 6_solver_solver___.gh (Grasshopper 1.0.7)
# plug-ins: compas_wood

arch_number = Slider(23, range=1..23)
chevron_surfaces = Chevron_surfaces([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])
item = ListItem(List=chevron_surfaces, Index=expr("x-1", arch_number), Wrap=True)

# ---- group: chevron
chevron = Chevron(
    Surface=item,
    U_divisions=Slider(4, range=1..20),
    V_division_dist=Slider(900, range=900..1000),
    Shift=Slider(0.5, range=0.5..1),
    Scale=Slider(0.05799, range=0.05..0.06))

# ---- group: chevron_plates
chevron_plates = Chevron_plates(
    Mesh=chevron,
    Edge_rotation=Slider(1, range=0..10),
    Edge_offset=Slider(0.5, range=0..2.5),
    Box_height=Slider(760, range=100..1000),
    Top_plate_inlet=Slider(80, range=0..100),
    Plate_thickness=Slider(40, range=1..40),
    Ortho=True)  # -> Data, Dir

# ---- group: joints_params
joints_params = Joints_params(
    ss_e_ip_len=Slider(300, range=30..3000),
    ss_e_ip_shift=Slider(0.5, range=0..1),
    ss_e_ip_type=Slider(9, range=1..9),
    ss_e_op_len=Slider(450, range=30..3000),
    ss_e_op_shift=Slider(0.65, range=0..1),
    ss_e_op_type=Slider(10, range=10..19),
    ts_e_p_len=Slider(450, range=30..3000),
    ts_e_p_shift=Slider(0.5, range=0..1),
    ts_e_p_type=Slider(21, range=20..29),
    cr_c_ip_len=Slider(300, range=30..3000),
    cr_c_ip_shift=Slider(0.5, range=0..1),
    cr_c_ip_type=Slider(30, range=30..39),
    tt_e_p_len=Slider(300, range=30..3000),
    tt_e_p_shift=Slider(0.5, range=0..1),
    tt_e_p_type=Slider(40, range=40..49),
    ss_e_r_len=Slider(300, range=30..3000),
    ss_e_r_shift=Slider(0.5, range=0..1),
    ss_e_r_type=Slider(50, range=50..59))

# ----
number_slider = Slider(300, range=30..3000)
solver = Solver(Data=chevron_plates.Data, Join_p=joints_params, Find=0, Get=4)
input_get = Input_get(Data=solver)  # -> simplify(Plines), Insertion_vectors, Joints_per_face, Three_valence, Adjacency

b = Panel("""300
1.0
60""")
ss_e_r = Panel("""300
0.5
58""")
tt_e_p = Panel("""6
0.95
40""")
# JOINT PARAMETERS
ss_e_ip = Panel("""300
0.5
9""")
cr_c_ip = Panel("""300
0.5
30""")
ss_e_op = Panel("""450
0.65
10""")
ts_e_p = Panel("""450
0.5
21""")
joint_parameters = Joint_parameters(ss_e_ip=ss_e_ip, ss_e_op=ss_e_op, ts_e_p=ts_e_p, cr_c_ip=cr_c_ip, tt_e_p=tt_e_p, ss_e_r=ss_e_r, b=b)  # -> joint_p; inputs ss_e_ip: list, ss_e_op: list, ts_e_p: list, cr_c_ip: list, tt_e_p: list, ss_e_r: list, b: list
#   port ss_e_ip: side-to-side in-plane joint parameters
# ---------- joint_parameters: Python ----------
__author__ = "petras vestartas"
__version__ = "2023.03.29"

"""
Output joint parameters in one list
"""
from ghpythonlib.componentbase import executingcomponent as component


class joint_parameters_component(component):
    def RunScript(
        self,
        _ss_e_ip,
        _ss_e_op,
        _ts_e_p,
        _cr_c_ip,
        _tt_e_p,
        _ss_e_r,
        _b

    ):
        
        joint_parameters = [
            300, 0.5, 3,   # 1-9 ss_e_ip (side-to-side edge in-plane)
            50, 0.64, 15,  # 10-19 ss_e_op (side-to-side edge out-of-plane)
            450, 0.5, 20,  # 20-29 ts_e_p (top-to-side edge plane)
            300, 0.5, 30,  # 30-39 cr_c_ip (cross cutting in-plane)
            6, 0.95, 40,   # 40-49 tt_e_p  (top-to-top edge plane)
            300, 0.5, 58,  # 50-59 ss_e_r (side-to-side edge rotated)
            300, 1.0, 60   # 60-69 b (boundary)
        ]

        for i in range(len(_ss_e_ip)):
            joint_parameters[0*3+i] = _ss_e_ip[i]

        for i in range(len(_ss_e_op)):
            joint_parameters[1*3+i] = _ss_e_op[i]

        for i in range(len(_ts_e_p)):
            joint_parameters[2*3+i] = _ts_e_p[i]

        for i in range(len(_cr_c_ip)):
            joint_parameters[3*3+i] = _cr_c_ip[i]

        for i in range(len(_tt_e_p)):
            joint_parameters[4*3+i] = _tt_e_p[i]

        for i in range(len(_ss_e_r)):
            joint_parameters[5*3+i] = _ss_e_r[i]

        for i in range(len(_b)):
            joint_parameters[6*3+i] = _b[i]

        _joint_p = joint_parameters

        return _joint_p
# ---------- end joint_parameters ----------
panel = Panel(joint_parameters)

input_get_2 = Input_get(Data=chevron_plates.Data)  # -> Plines, Insertion_vectors, Joints_per_face, Three_valence, Adjacency
input_set = Input_set(
    polylines=input_get_2.Plines,
    vectors=input_get_2.Insertion_vectors,
    joint_types=input_get_2.Joints_per_face,
    three_valence=input_get_2.Three_valence,
    adjacency=input_get_2.Adjacency)  # -> data; inputs polylines: tree of Polyline, vectors: tree of Vector3d, joint_types: tree of Int32, three_valence: tree of Int32, adjacency: tree of Int32
#   port polylines: a data-tree of polyline pairs
# ---------- input_set: Python ----------
from ghpythonlib.componentbase import executingcomponent as component
import Grasshopper, GhPython
__author__ = "petras"
__version__ = "2023.04.02"


import System
import Rhino
import rhinoscriptsyntax as rs
import ghpythonlib.treehelpers as th
from Rhino.Geometry import Polyline
from Rhino.Geometry import Vector3d
from Rhino.Geometry import Plane

class MyComponent(component):
    
    def get_plane(self, _polyline, _orientation_point):
        
        len = _polyline.Count - 1
        normal = Vector3d(0,0,0)
        
        for i in range((_polyline.Count - 1)):
            num = ((i - 1) + len) % len
            item1 = ((i + 1) + len) % len
            point3d =_polyline[num]
            point3d1 =_polyline[item1]
            item2 = _polyline[i]
            normal = normal + Vector3d.CrossProduct(Vector3d(item2 - point3d), Vector3d(point3d1 - item2))
        
        normal.Unitize()
        plane = Plane(_polyline.CenterPoint(), normal)
        if(plane.DistanceTo(_orientation_point)<0):
            plane.Flip()
        
        return plane
    
    
    
    def RunScript(self, _plines, _insertion_vectors, _joints_per_face, _three_valence, _adjacency):
        
        
        
        plines = []
        planes = []
        if( _plines.DataCount > 0):
            for i in range(_plines.BranchCount):
                plines.append(_plines.Branch(i))
                # create planes for orientation
                
                planes.append(self.get_plane(_plines.Branch(i)[0],_plines.Branch(i)[1][0]))
        
        insertion_vectors =  th.tree_to_list(_insertion_vectors) if _insertion_vectors.DataCount > 0 else []
        joints_per_face =  th.tree_to_list(_joints_per_face) if _joints_per_face.DataCount > 0 else []
        three_valence =  th.tree_to_list(_three_valence) if _three_valence.DataCount > 0 else []
        adjacency = th.tree_to_list(_adjacency) if _adjacency.DataCount > 0 else []
        
        # output
        _data = [[plines,insertion_vectors,joints_per_face,three_valence,adjacency, planes]]
        
        
        # return outputs if you have them; here I try it for you:
        return _data
# ---------- end input_set ----------
solver_2 = Solver(data=input_set, joint_p=joint_parameters)  # -> data; inputs joint_p: list, scale: list of Int32, extension: list of Int32, find: Int32, get: Int32
#   port data: collection of inputs that represent the elements, insertion vectors, joint types and adjacency, use input_set commonent to group these inputs
#   port joint_p: joint parameters
#   port scale: scale of joint, default is [1,1,1]
#   port extension: extension by distance, plates often has [0,0,10], whereas beams [10,10,10], default is [0,0,0]
#   port find: search_type search type 0 - side-to-side, 1 - cross, 2 - both
#   port get: output_type 0 - outlines | 1 - lines | 2 - areas | 3 - volumes | 4 - merged geometry of joints
#   port data: user input_get component to ungroup all the data to the individual data-trees
# ---------- solver_2: Python ----------
"""get joints ids and connections areas between elements"""

__author__ = "petras vestartas"
__version__ = "2023.04.03"
import time

from ghpythonlib.componentbase import executingcomponent as component
# STEP 0 - Installation, anaconda prompt:
# python -m compas_rhino.install
# python -m compas_rhino.install -p compas_wood
# STEP 1 - check the environment name
# import compas_bootstrapper
# print(compas_bootstrapper.ENVIRONMENT_NAME)
# STEP 2 - import proxy from compas.rpc
# https://compas.dev/compas/latest/tutorial/rpc.html#supported-data-types-1
from compas.rpc import Proxy # https://compas.dev/compas/latest/api/compas.rpc.html
proxy = Proxy('compas_wood.joinery') # import module
from compas_rhino import conversions
from ghpythonlib import treehelpers
import Rhino
import Grasshopper
from Rhino.Geometry import Polyline
# STEP 3 - start server
#proxy.stop_server()
#proxy.start_server()


class connections_zones(component):
    def RunScript(self, _data, _join_p, _scale, _extension, _find, _get):
        # ==============================================================================
        # input
        # ==============================================================================
        if(_data is None):
            return
        
        output_polylines = []
        if( _data[0] != 0):
            #convert to compas polylines
            for i in _data[0]:
                for j in i:
                    output_polylines.append(conversions.polyline_to_compas(j))
        
        vectors = []
        if(_data[1] != None):
            for i in _data[1]:
                list = []
                for j in i:
                    list.append(conversions.vector_to_compas(j))
                vectors.append(list)
        
        joint_parameters = [
            300, 0.5, 3,   # 1-9 ss_e_ip (side-to-side edge in-plane)
            50, 0.64, 15,  # 10-19 ss_e_op (side-to-side edge out-of-plane)
            450, 0.5, 20,  # 20-29 ts_e_p (top-to-side edge plane)
            300, 0.5, 30,  # 30-39 cr_c_ip (cross cutting in-plane)
            6, 0.95, 40,   # 40-49 tt_e_p  (top-to-top edge plane)
            300, 0.5, 58,  # 50-59 ss_e_r (side-to-side edge rotated)
            300, 1.0, 60   # 60-69 b (boundary)
        ]
        
        for i in range(0, len(_join_p)):
            joint_parameters[i] = _join_p[i]
        
        search = id = max(min(2, _find), 0)
        
        scale = [1,1,1]
        for i in range(0, len(_scale)):
            scale[i] = _scale[i]
        
        output_type = _get if _get != None else 4
        
        extension = [0,0,0]
        for i in range(0, len(_extension)):
            extension[i] = _extension[i]
        
        
        adjacency = []
        if(len(_data[4])>0):
            for i in _data[4]:
                for j in i:
                    adjacency.append(j)
        
        # ==============================================================================
        # get joints
        # ==============================================================================
        start_time = time.time()
        result = proxy.get_connection_zones(
        output_polylines,
        vectors, # output_vectors,
        _data[2], # output_joints_types,
        _data[3], # output_three_valence_element_indices_and_instruction,
        adjacency, # output_adjacency,
        joint_parameters,
        search,
        scale,
        output_type,
        False,
        extension)
        print(
             "\n______________________________________ %s ms ______________________________________"
            % round((time.time() - start_time) * 1000.0, 2)
        )
        
        
        
        # ==============================================================================
        # output
        # ==============================================================================
        _plines = []
        
        # nest two times the result and add to the tree
        for i in range(0, len(result)):
            list = []
            for j in range(0, len(result[i])):
                    list.append(conversions.polyline_to_rhino(result[i][j]))
            _plines.append(list)
        _cuts = []
        _data = [[_plines,_data[1],_data[2],_data[3],_data[4],_data[5],_cuts]]
        
        return _data
# ---------- end solver_2 ----------
input_get_3 = Input_get(data=solver_2)  # -> plines, insertion_vectors, joints_per_face, three_valence, adjacency
#   port data: collection of inputs that represent the elements, insertion vectors, joint types and adjacency, use input_set commonent to group these inputs
# ---------- input_get_3: Python ----------
from ghpythonlib.componentbase import executingcomponent as component
import Grasshopper, GhPython
import System

__author__ = "petras"
__version__ = "2023.04.02"

import ghpythonlib.treehelpers as th
from Rhino.Geometry import Polyline
import Rhino
import rhinoscriptsyntax as rs

class MyComponent(component):
    
    def RunScript(self, _data):
        
        if(_data is None):
            return
        
        _plines =  Grasshopper.DataTree[Polyline]()
        for i in range(len(_data[0])):
            _plines.AddRange(_data[0][i],Grasshopper.Kernel.Data.GH_Path(i))
        
        
        _insertion_vectors =  th.list_to_tree(_data[1])
        _joints_per_face =  th.list_to_tree(_data[2])
        _three_valence = th.list_to_tree(_data[3])
        _adjacency =th.list_to_tree(_data[4])
        
        # return outputs if you have them; here I try it for you:
        return (_plines, _insertion_vectors, _joints_per_face, _three_valence, _adjacency)
# ---------- end input_get_3 ----------

# ----
# SOLVER -> SOLVER
# C++ - PYBIND11 - COMPAS (RPC) - RHINO PYTHON - 1400 ms
# 
# MEASURE THE TIME FOR:
# compas_wood conversion 1
# c++ code execution for pybind11
# compas_wood conversion 2
# rpc transfer
# compas_wood to rhino conversion
# Add files for the full data-set and check again
# 
# VSCode does not have it now
# C++ - PINVOKE - .NET RHINO - 23 ms
# 
# MEASURE THE TIME FOR:
# compas_wood conversion 1
# c++ code execution for pybind11
# compas_wood conversion 2
# rpc transfer
# compas_wood to rhino conversion
crv = Curve(chevron_plates.Dir)
panel_2 = Panel(input_get_3.plines)

assembly = Assembly(data=input_set, dir=chevron_plates.Dir, t=Slider(3.1, range=0..50))  # inputs dir: list of Line, n: Int32
#   port data: collection of inputs that represent the elements, insertion vectors, joint types and adjacency, use input_set commonent to group these inputs
# ---------- assembly: Python ----------
__author__ = "petras"
__version__ = "2023.04.02"

from ghpythonlib.componentbase import executingcomponent as component
import Grasshopper, GhPython
import System
import Rhino
import rhinoscriptsyntax as rs


import rhinoscriptsyntax as rs
import Rhino.Geometry as rg
from Rhino.Geometry import BoundingBox
from Rhino.Geometry import Point3d
from Rhino.Geometry import Plane
from Rhino.Geometry import Polyline
from Rhino.Geometry import Vector3d
from Rhino.Geometry import Line
from Rhino.Geometry import TextEntity
from Rhino.Geometry import Transform
from System.Drawing import Color
import math

class MyComponent(component):
    
    bbox = BoundingBox.Unset
    lines = []
    insertion_vectors_current = []
    joint_per_face_current_text_entity = []
    polylines = []
    
    def DrawViewportWires(self, args):
        try:
            plane = Plane.WorldXY
            for line in self.lines:
                args.Display.DrawLineArrow(line, Color.FromArgb(207, 0, 90), 2, 100)
            for polyline in self.polylines:
                args.Display.DrawPolyline(polyline, Color.FromArgb(207, 0, 90), 2)
            for insertionVectorsCurrent in self.insertion_vectors_current:
                if(insertionVectorsCurrent.Length<0.05):
                    continue
                args.Display.DrawLine(insertionVectorsCurrent, Color.FromArgb(0, 0, 0), 5)
            for jointPerFaceCurrent in self.joint_per_face_current_text_entity:
                result, plane = Rhino.RhinoDoc.ActiveDoc.Views.ActiveView.ActiveViewport.GetCameraFrame()
                plane.Origin=(jointPerFaceCurrent.Plane.Origin)
                args.Display.Draw3dText(jointPerFaceCurrent.PlainText, jointPerFaceCurrent.MaskColor, plane, jointPerFaceCurrent.TextHeight, "Arial", False, False,Rhino.DocObjects.TextHorizontalAlignment.Center, Rhino.DocObjects.TextVerticalAlignment.BottomOfTop)
        except Exception, e:
            System.Windows.Forms.MessageBox.Show(str(e), "script error")
    
    def get_ClippingBox(self):
        return Rhino.Geometry.BoundingBox()
    
    
            
    def display_insersion_sequence(self, _data, _lines, _n, _t):
        
        text_size = 50
        line_scale = 300
        
        ###############################################################################
        # input
        ###############################################################################
        self.bbox = BoundingBox.Unset
        self.lines =  _lines if len(_lines) > 0 else [Line(Point3d(0,0,0),Point3d(0,0,1))]
        self.insertion_vectors_current =  []
        self.joint_per_face_current_text_entity = []
        self.polylines =  []
        
        group_count = _n if _n is not None else 4
        t = _t if _t is not None else 0.0
        item = self.lines[0]
        self.bbox = self.lines[0].BoundingBox
        
        ###############################################################################
        # process
        ###############################################################################
        for i in range(1,len(self.lines)) :
            self.bbox.Union(self.lines[i].BoundingBox)
        
        for i in range(0,int(math.floor(t)))  :
            for j in range(group_count) :
                for pline in _data[0][i * group_count + j]:
                    self.polylines.append(pline) 
        
        if (t % 1 > 0):
            
            id2 = int(math.floor(t))
            polylines_current = []
            
            for i in range(group_count):
                for pline in (_data[0][id2 * group_count + i]):
                    polylines_current.append(pline)
            
            for m in range(len(polylines_current)) :
                
                item = self.lines[id2]
                line_from = item.From
                item = self.lines[id2]
                to = line_from - item.To
                
                polyline = polylines_current[m].Duplicate()
                polyline.Transform(Transform.Translation(to * (1 - t % 1)))
                polylines_current[m] = polyline
            
            for i in polylines_current:
                self.polylines.append(i)
            
            for n in range(0,polylines_current.Count,2) :
                
                point3ds =  [polylines_current[n].CenterPoint(),  polylines_current[n + 1].CenterPoint()]
                
                for o in range(0, polylines_current[n].Count - 1):
                    p0 = (polylines_current[n][o] + polylines_current[n][o + 1]) * 0.5
                    p1 = (polylines_current[n + 1][o] + polylines_current[n + 1][o + 1]) * 0.5
                    pmid = (p0+p1)*0.5
                    point3ds.append(pmid)
                
                for p in range(len(point3ds)):
                    
                    face_vectors = _data[1][id2 * 4 + int(n * 0.5)][p]
                    
                    if (face_vectors == Vector3d.Zero)  :
                        face_vectors =  Vector3d(0, 0, 0.0001)
                    
                    self.insertion_vectors_current.Add( Line(point3ds[p]+ (face_vectors * line_scale*0.25), point3ds[p] + (face_vectors * line_scale)))
                    text = str(_data[2][int(n * 0.5)][p])
                    textEntity = TextEntity()
                    textEntity.Plane=( Plane(point3ds[p], Vector3d.ZAxis))
                    textEntity.PlainText=(text)
                    
                    
                    if(_data[2][int(n * 0.5)][p] > 0):
                        textEntity.MaskColor=(Color.FromArgb( 0,0,0))
                        textEntity.TextHeight=((float)(text_size))
                    else:
                        textEntity.MaskColor=(Color.FromArgb( 100,100,100))
                        textEntity.TextHeight=((float)(text_size*0.5))
                    self.joint_per_face_current_text_entity.Add(textEntity)

        # return outputs if you have them here I try it for you:
        return 
    
    def RunScript(self, _data, _dir, _n, _t):
        self.display_insersion_sequence(_data, _dir, _n, _t)
# ---------- end assembly ----------

xy = XYPlane(Origin=Point(0, 0, 0))
orient_data = Orient_data(data=solver_2, planes=xy, ids=Slider(517, range=0..1000))  # -> plines_o; inputs planes: list of Plane, ids: list of Int32
#   port data: collection of inputs that represent the elements, insertion vectors, joint types and adjacency, use input_set commonent to group these inputs
#   port planes: target planes for orientation of elements
#   port ids: indices to orient only certain elements
#   port plines_o: oriented outlines using plane to plane transformation
# ---------- orient_data: Python ----------
__author__ = "petras"
__version__ = "2023.04.02"

import System
import Rhino
import rhinoscriptsyntax as rs
import ghpythonlib.treehelpers as th
from Rhino.Geometry import Polyline
from Rhino.Geometry import Transform
from Rhino.Geometry import Vector3d
#import Grasshopper
from Rhino.Geometry import Plane

from ghpythonlib.componentbase import executingcomponent as component
import Grasshopper, GhPython
import System
import Rhino
import rhinoscriptsyntax as rs

class MyComponent(component):
    
    def get_plane(self, _polyline, _orientation_point):
        
        len = _polyline.Count - 1
        normal = Vector3d(0,0,0)
        
        for i in range((_polyline.Count - 1)):
            num = ((i - 1) + len) % len
            item1 = ((i + 1) + len) % len
            point3d =_polyline[num]
            point3d1 =_polyline[item1]
            item2 = _polyline[i]
            normal = normal + Vector3d.CrossProduct(Vector3d(item2 - point3d), Vector3d(point3d1 - item2))
        
        normal.Unitize()
        plane = Plane(_polyline.CenterPoint(), normal)
        if(plane.DistanceTo(_orientation_point)<0):
            plane.Flip()
        
        return plane
    
    def RunScript(self, _data, _planes, _ids):
        
        if(_data is None):
            return
        
        target_planes = _planes if len(_planes) > 0 else [Plane.WorldXY]
        _plines =  Grasshopper.DataTree[Polyline]()
        
        if(len(_ids)==0 or len(_planes) != len(_ids)):
            
            for i in range(len(_data[0])):
                xform = Transform.PlaneToPlane(self.get_plane(_data[0][i][0],_data[0][i][1][0]),target_planes[i%len(target_planes)])
                    
                for j in range(len(_data[0][i])):
                    polyline_copy = Polyline(_data[0][i][j])
                    polyline_copy.Transform(xform)
                    _plines.Add(polyline_copy,Grasshopper.Kernel.Data.GH_Path(i))
        else:
            total_element_count = len(_data[0])
            for i in range(len(_ids)):
                local_id = _ids[i]
                if(local_id >= total_element_count or local_id < 0 ):
                    continue
                xform = Transform.PlaneToPlane(self.get_plane(_data[0][local_id][0],_data[0][local_id][1][0]),target_planes[i%len(target_planes)])
                for j in range(len(_data[0][local_id])):
                    polyline_copy = Polyline(_data[0][local_id][j])
                    polyline_copy.Transform(xform)
                    _plines.Add(polyline_copy,Grasshopper.Kernel.Data.GH_Path(i))
        
        _plines_oriented = _plines
        
        """
        _data_xform = _plines
        _insertion_vectors =  th.list_to_tree(_data[1])
        _joints_per_face =  th.list_to_tree(_data[2])
        _three_valence = th.list_to_tree(_data[3])
        _adjacency =th.list_to_tree(_data[4])
        """
        
        # return outputs if you have them; here I try it for you:
        return _plines_oriented
# ---------- end orient_data ----------
