# Grasshopper definition 7_assign_directions_and_joint_types.gh (Grasshopper 1.0.7)

# ----
# DATA -> ASSIGN DIRECTIONS
# AND JOINT TYPES
# PER SIDES
crv = Curve([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])
crv_2 = Curve([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])
pt = Point(Point(66.54180289, -67.76869473, 25.90170739))
type_a = Panel("0")
type_c = Panel("20")
pt_2 = Point([Point(-12.48673366, -66.5369766, 91.98009472), Point(-15.95577545, -146.9068279, 47.36189679)])
pt_3 = Point([Point(-23.20359916, -142.9068279, 90.14100906), Point(-78.55497782, -142.9068279, 57.21722225), Point(35.9403107, -116.8646479, 57.0608065), Point(-3.437238191, -100.4885806, 19.63133686), Point(-3.429887815, -35.47802532, 131.1152912), Point(-30.86663423, -18.51036677, 84.15627084), Point(-11.87968433, -49.29797263, 51.01550833), Point(12.69802542, -72.50533185, 102.0418385), Point(-2.720821949, -75.58486061, 111.711162), Point(-33.80333849, -52.18888495, 65.85015224)])
type_b = Panel("10")
entwine = Entwine(Branch00=pt, Branch01=pt_2, Branch02=pt_3, FlattenInputs=True)
entwine_2 = Entwine(Branch00=type_a, Branch01=type_b, Branch02=type_c, FlattenInputs=True)
closest_indexed_points = ClosestIndexedPoints(polylines=crv, points=entwine, joint_types=entwine_2)  # -> polylines_out, joint_types_out; inputs polylines: tree of Curve, points: tree of Point3d, joint_types: tree of Int32
#   port polylines: polylines tree branch order does not matter it is flatenned inside the component
# ---------- closest_indexed_points: Python ----------
from ghpythonlib.componentbase import executingcomponent as component
import Grasshopper, GhPython
import System
import Rhino
import rhinoscriptsyntax as rs

"""Provides a scripting component.
    Inputs:
        x: The x script variable
        y: The y script variable
    Output:
        a: The a output variable"""

__author__ = "petra"
__version__ = "2023.04.04"

import Rhino.Geometry
from Rhino.Geometry import RTree
from Rhino.Geometry import BoundingBox
from Rhino.Geometry import Sphere
from Rhino.Geometry import Vector3d
from Rhino.Geometry import Point3d
from Rhino.Geometry import Polyline
from Rhino.Geometry import Line
import Grasshopper
import ghpythonlib.treehelpers as th


class MyComponent(component):
    def RunScript(self, _polylines, _points, _joint_types):
        ###############################################################################
        # Input
        ###############################################################################
        polylines = []
        polylines_out = Grasshopper.DataTree[Polyline]()
        pts = []
        ids = []

        ###############################################################################
        # Conversion
        ###############################################################################
        count = 0
        for curve in _polylines.AllData():
            result, polyline = curve.TryGetPolyline()
            polylines_out.Add(
                polyline, Grasshopper.Kernel.Data.GH_Path(int(count * 0.5))
            )
            if count % 2 == 0:
                polylines.append([polyline])
            else:
                polylines[-1].append(polyline)
            count = count + 1
        
        if(_points.DataCount > 0 and _joint_types.DataCount>0):
            for i in range(_points.BranchCount):
                for j in range(_points.Branch(i).Count):
                    pts.append(_points.Branch(i)[j])
                    ids.append(_joint_types.Branch(i)[j % _joint_types.Branch(i).Count])
        # pts = _points.AllData()
        # ids = _joint_types.AllData()

        ###############################################################################
        # Run the closest point search
        ###############################################################################

        # convert element polylines to a flattened dictionary:
        segments_dictionary = (
            {}
        )  # stores ids e.g. int , [element_int,bottom_or_top_polyline_int,edge,int, bounding_box, hit_count, point_id]
        joint_types = []
        count = 0
        for i in range(len(polylines)):
            joint_types.append([-1] * (polylines[i][0].SegmentCount + 2))
            for j in range(len(polylines[i])):
                for k in range(polylines[i][j].SegmentCount):
                    bbox = polylines[i][j].SegmentAt(k).BoundingBox
                    bbox.Inflate(0.02)
                    segments_dictionary.Add(
                        count, [i, j, k, bbox, polylines[i][j].SegmentAt(k)]
                    )
                    count = count + 1

        # create a tree
        rtree = Rhino.Geometry.RTree()

        # fill the tree
        for i in segments_dictionary:
            rtree.Insert(segments_dictionary[i][3], i)

        # call_backs of rtree
        hit_count = 0

        def search_callback(sender, rtree_event_args):
            data_by_reference.append(rtree_event_args.Id)

        # perform search
        for i in range(len(pts)):
            data_by_reference = []
            if rtree.Search(Sphere(pts[i], 0), search_callback, data_by_reference):
                for j in data_by_reference:
                    if (
                        pts[i].DistanceToSquared(
                            segments_dictionary[j][4].ClosestPoint(pts[i], True)
                        )
                        < 0.001
                    ):
                        joint_types[segments_dictionary[j][0]][
                            segments_dictionary[j][2] + 2
                        ] = ids[i]

        ###############################################################################
        # Output
        ###############################################################################
        _polylines_out = polylines_out
        _joints_types_out = th.list_to_tree(joint_types)

        # return outputs if you have them; here I try it for you:
        return (_polylines_out, _joints_types_out)
# ---------- end closest_indexed_points ----------
closest_lines = ClosestLines(polylines=crv, lines=crv_2)  # -> polylines_out, vectors; inputs polylines: tree of Curve, lines: tree of Line
#   port polylines: polylines tree branch order does not matter it is flatenned inside the component
# ---------- closest_lines: Python ----------
from ghpythonlib.componentbase import executingcomponent as component
import Grasshopper, GhPython
import System
import Rhino
import rhinoscriptsyntax as rs

__author__ = "petra"
__version__ = "2023.04.04"

import Rhino.Geometry
from Rhino.Geometry import RTree
from Rhino.Geometry import BoundingBox
from Rhino.Geometry import Sphere
from Rhino.Geometry import Vector3d
from Rhino.Geometry import Point3d
from Rhino.Geometry import Polyline
from Rhino.Geometry import Line
import Grasshopper
import ghpythonlib.treehelpers as th


class MyComponent(component):
    def RunScript(self, _polylines, _lines):
        """Provides a scripting component.
        Inputs:
            x: The x script variable
            y: The y script variable
        Output:
            a: The a output variable"""

        ###############################################################################
        # Input
        ###############################################################################
        polylines = []
        polylines_out = Grasshopper.DataTree[Polyline]()
        lines = []

        ###############################################################################
        # Conversion
        ###############################################################################
        count = 0
        for curve in _polylines.AllData():
            result, polyline = curve.TryGetPolyline()
            polylines_out.Add(
                polyline, Grasshopper.Kernel.Data.GH_Path(int(count * 0.5))
            )
            if count % 2 == 0:
                polylines.append([polyline])
            else:
                polylines[-1].append(polyline)
            count = count + 1

        lines = _lines.AllData()

        ###############################################################################
        # Run the closest point search
        ###############################################################################

        # convert element polylines to a flattened dictionary:
        segments_dictionary = (
            {}
        )  # stores ids e.g. int , [element_int,bottom_or_top_polyline_int,edge,int, bounding_box, hit_count, point_id]
        vectors = []
        count = 0
        for i in range(len(polylines)):
            vectors.append([Vector3d.Zero] * (polylines[i][0].SegmentCount + 2))
            for j in range(len(polylines[i])):
                for k in range(polylines[i][j].SegmentCount):
                    bbox = polylines[i][j].SegmentAt(k).BoundingBox
                    bbox.Inflate(0.02)
                    segments_dictionary.Add(
                        count, [i, j, k, bbox, polylines[i][j].SegmentAt(k)]
                    )
                    count = count + 1

        # create a tree
        rtree = Rhino.Geometry.RTree()

        # fill the tree
        for i in segments_dictionary:
            rtree.Insert(segments_dictionary[i][3], i)

        # call_backs of rtree
        hit_count = 0

        def search_callback(sender, rtree_event_args):
            data_by_reference.append(rtree_event_args.Id)

        # perform search, two times first for start points of a polyline, second for the end point
        for i in range(len(lines)):
            data_by_reference = []
            if rtree.Search(
                Sphere(lines[i].From, 0), search_callback, data_by_reference
            ):
                for j in data_by_reference:
                    if (
                        lines[i].From.DistanceToSquared(
                            segments_dictionary[j][4].ClosestPoint(lines[i].From, True)
                        )
                        < 0.001
                    ):
                        vectors[segments_dictionary[j][0]][
                            segments_dictionary[j][2] + 2
                        ] = lines[i].Direction
                        # vectors[segments_dictionary[j][0]][segments_dictionary[j][2]+2].Unitize()

        for i in range(len(lines)):
            data_by_reference = []
            if rtree.Search(Sphere(lines[i].To, 0), search_callback, data_by_reference):
                for j in data_by_reference:
                    if (
                        lines[i].To.DistanceToSquared(
                            segments_dictionary[j][4].ClosestPoint(lines[i].To, True)
                        )
                        < 0.001
                    ):
                        vectors[segments_dictionary[j][0]][
                            segments_dictionary[j][2] + 2
                        ] = -lines[i].Direction
                        # vectors[segments_dictionary[j][0]][segments_dictionary[j][2]+2].Unitize()

        ###############################################################################
        # Output
        ###############################################################################
        _polylines_out = polylines_out
        _vectors = th.list_to_tree(vectors)

        # return outputs if you have them; here I try it for you:
        return (_polylines_out, _vectors)
# ---------- end closest_lines ----------
