# Grasshopper definition chevron.ghx (Grasshopper 1.0.7)
# plug-ins: compas_wood, NGon

chevron_surfaces = Chevron_surfaces([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])
number_slider = Slider(2, range=0..10)
number_slider_2 = Slider(0.5, range=0..2.5)
number_slider_3 = Slider(713, range=100..1000)
item = ListItem(List=chevron_surfaces, Index=Slider(22, range=0..100), Wrap=True)
assembly = Assembly(surface=item)  # -> mesh; inputs surface: Surface
#   port surface: NURBS surfaces - use component -chevron-surfaces-
# ---------- assembly: Python ----------
from ghpythonlib.componentbase import executingcomponent as component
import Grasshopper, GhPython
import System
import rhinoscriptsyntax as rs
import Rhino
import Rhino.Geometry
from Rhino.Geometry import Surface, Mesh, MeshFace, Point3d, Point3f, Vector3d

class Chevron:
    # User inputs
    mesh = None
    edge_rotation = 0.0
    edge_offset = 0.0
    box_height = 0.0
    top_plate_inlet = 0.0
    plate_thickness = 0.0
    ortho = False

    # Class generated properties
    f_e = {}
    f_rotation_flip = {}
    bi_planes = []
    e_planes = []
    f_planes = []

    # Output
    f_v = []
    f_me = []
    plines = [] # pair of outlines
    insertion_vectors = [] # v0,v1,v2,v3,v4,v5
    adjacency = [] # v0,v1, f0, f1
    joints_per_face = [] # 0,0,1,1,2,2
    three_valence = [] # 43, 41, 45, 41

    # Display
    box_insertion_vectors = [] # v0,v1,v2,v3,v4,v5
    box_insertion_lines = [] # v0,v1,v2,v3,v4,v5
    
    def __init__(self, mesh, edge_rotation=1, edge_offset=0.5, box_height=760, top_plate_inlet=80, plate_thickness=40, ortho=True):
        if mesh == None:
            return
        self.mesh = mesh.DuplicateMesh() # assuming DuplicateMesh() is a method in Rhino or some other external library
        self.mesh.Flip(True, True, True)

        self.edge_rotation = max(min(edge_rotation, 30), -30) # constrain edge_rotation to -30 to 30
        self.edge_offset = max(min(edge_offset, 2), -2) # constrain edge_offset to -2 to 2

        self.box_height = max(min(box_height, math.inf), 1) # constrain box_height to 1 to infinity
        self.top_plate_inlet = max(min(top_plate_inlet, box_height * 0.333), 1) # constrain top_plate_inlet to 1 to box_height * 0.333
        self.plate_thickness = max(min(plate_thickness, box_height * 0.333), 1) # constrain plate_thickness to 1 to box_height * 0.333
        self.ortho = ortho

        # output
        self.plines = [] # list of Polyline objects
        self.insertion_vectors = [[] for _ in range(mesh.Faces.Count * 4)] # list of Vector3d arrays
        self.adjacency = [] # list of int arrays
        self.joints_per_face = [[] for _ in range(mesh.Faces.Count * 4)] # list of int arrays
        self.three_valence = [] # list of int arrays
        self.f_v = [[] for _ in range(mesh.Faces.Count)] # list of int arrays
        self.f_me = [[] for _ in range(mesh.Faces.Count)] # list of int arrays

        # display
        self.box_insertion_vectors = [None] * mesh.Faces.Count # list of Vector3d objects
        self.box_insertion_lines = [None] * mesh.Faces.Count # list of Line objects
    
    def chevron_grid(self, s, u_divisions=4, v_division_dist=900, shift=0.5, scale=0.05799):
        if(s is None):
            return
        # Python code
        # Inputs to construct mesh
        f = []
        v = []
        
        # Get Surface Interval, divisionStep, baseStep, maxStep, and Delta parameters
        DomU = s.Domain(0)
        DomV = s.Domain(1)
        half_v = DomV.T1 * 0.5
        StepU = (DomU.T1 - DomU.T0) / u_divisions
        baseStepV = v_division_dist
        maxStepV = 2500
        Delta = maxStepV - baseStepV
        
        totalV = DomV[1] - DomV[0]
        rem = (totalV / 2) - ((maxStepV / 2) + baseStepV + Delta)
        stepV = rem / baseStepV
        
        # Iterate number strips of the NURBS
        ctU = 0
#        print(s.Domain(0))
#        print(s.Domain(1))
#        print(u_divisions)
        for j in range(u_divisions):
#            print(j)
            ctV = 0
            thresh = totalV / 2
            StepV1 = baseStepV
            b = True
            ListV = []
        
            p0, p1, p2, p6, p7, p8 = None,None,None,None,None,None
            savept6 = Point3f.Unset
            savept7 = Point3f.Unset
            savept8 = Point3f.Unset
            iterations = 0

            while b and iterations < 1000:
                iterations += 1
                ListV.append(StepV1)
        
                # Get First Half of a Quads
                if ctV == 0:
                    
                    p0 = s.PointAt(ctU, ctV)
                    
                    p1 = s.PointAt(ctU + StepU * 0.5, ctV)
                    p2 = s.PointAt(ctU + StepU, ctV)
                    p6 = s.PointAt(ctU, ctV + StepV1 * (1 - shift / 2))
                    p7 = s.PointAt(ctU + StepU * 0.5, ctV + StepV1 * (1 + shift / 2))
                    p8 = s.PointAt(ctU + StepU, ctV + StepV1 * (1 - shift / 2))
                    savept6 = p6
                    savept7 = p7
                    savept8 = p8
                else:
                    p0 = savept6
                    p1 = savept7
                    p2 = savept8
                    p6 = s.PointAt(ctU, ctV + StepV1 * (1 - shift / 2))
                    p7 = s.PointAt(ctU + StepU * 0.5, ctV + StepV1 * (1 + shift / 2))
                    p8 = s.PointAt(ctU + StepU, ctV + StepV1 * (1 - shift / 2))
                    savept6 = p6
                    savept7 = p7
                    savept8 = p8
        
                # Add mesh faces
                f.append(MeshFace(len(v), len(v)+ 1, len(v) + 2, len(v) + 3))
                v.extend([p0, p6, p7, p1])
                f.append(MeshFace(len(v), len(v) + 1, len(v)+ 2, len(v) + 3))
                v.extend([p1, p7, p8, p2])
        
                # Increment V Parameter, and multiply by scale due to curvature change
                ctV += StepV1
                thresh -= StepV1
                StepV1 += StepV1 * scale
                
                # mirror side
                if ctV + StepV1 > half_v:
                    ListV.append(thresh)
                    ListV.reverse()
                    revCt = totalV / 2  # rev counter
                
                    for i in range(len(ListV) - 1):
                        revCt += ListV[i]
                
                        if i == 0:
                            p0 = s.PointAt(ctU, revCt - ListV[i + 1] * shift / 2)
                            #print(ctU, revCt - ListV[i + 1] * shift / 2)
                            p1 = s.PointAt(ctU + StepU * 0.5, revCt + ListV[i + 1] * shift / 2)
                            p2 = s.PointAt(ctU + StepU, revCt - ListV[i + 1] * shift / 2)
                
                            f.append(MeshFace(len(v), len(v) + 1, len(v) + 2, len(v) + 3))
                            v.extend([p6, p0, p1, p7])
                
                            f.append(MeshFace(len(v), len(v) + 1, len(v) + 2, len(v) + 3))
                            v.extend([p7, p1, p2, p8])
                
                            p6 = s.PointAt(ctU, revCt + ListV[i + 1] * (1 - shift / 2))
                            p7 = s.PointAt(ctU + StepU * 0.5, revCt + ListV[i + 1] * (1 + shift / 2))
                            p8 = s.PointAt(ctU + StepU, revCt + ListV[i + 1] * (1 - shift / 2))
                            savept6 = p6
                            savept7 = p7
                            savept8 = p8
                        elif i == (len(ListV) - 2):
                            p0 = savept6
                            p1 = savept7
                            p2 = savept8
                            p6 = s.PointAt(ctU, revCt + ListV[i + 1])
                            p7 = s.PointAt(ctU + StepU * 0.5, revCt + ListV[i + 1])
                            p8 = s.PointAt(ctU + StepU, revCt + ListV[i + 1])
                        else:
                            p0 = savept6
                            p1 = savept7
                            p2 = savept8
                            p6 = s.PointAt(ctU, revCt + ListV[i + 1] * (1 - shift / 2))
                            p7 = s.PointAt(ctU + StepU * 0.5, revCt + ListV[i + 1] * (1 + shift / 2))
                            p8 = s.PointAt(ctU + StepU, revCt + ListV[i + 1] * (1 - shift / 2))
                            savept6 = p6
                            savept7 = p7
                            savept8 = p8
                        
                        f.append(MeshFace(len(v), len(v) + 1, len(v) + 2, len(v) + 3))
                        v.extend([p1, p7, p8, p2])
                        f.append(MeshFace(len(v), len(v) + 1, len(v) + 2, len(v) + 3))
                        v.extend([p0, p6, p7, p1])
                        
                    b = False
                    
            ctU += StepU
            
        # Create Mesh
        #print(v)
        mesh = Mesh()
        for point in v:
            mesh.Vertices.Add(point)
        mesh.Faces.AddFaces(f)
        mesh.Weld(100)
        mesh.RebuildNormals()

        return mesh

class MyComponent(component):
    
    def RunScript(self, _surface, _u_divisions, _v_division_dist, _shift, _scale):
        
        
        
        
        
        chevron = Chevron(None)
        _mesh = chevron.chevron_grid(_surface)
        
        # return outputs if you have them; here I try it for you:
        return _mesh
# ---------- end assembly ----------
srf = Surface(item)
srfpt = SurfacePoints(Surface=item)  # -> Points, Weights, Greville, UCount, VCount
domain = Domain(srf)
# [  ] - 2 Components to rewrite
# [  ] - separate files into example files
# [  ] - document components on the github
# [  ] - add folding components: a) hex divide and profile extrude
# [  ]  - there is issue with planarity of polylines, maybe clipper tolerance is off
# [  ] - bst project is not computable
cp = ControlPoints(Curve=srf)  # -> Points, Weights, Knots
xml_recenter = Xml_recenter(geo=assembly)  # -> output; inputs geo: tree of GeometryBase
#   port geo: geometry to recenter
# ---------- xml_recenter: Python ----------
__author__ = "petras vestartas"
__version__ = "2023.03.22"

"""
Move curves to to the origin
"""

from ghpythonlib.componentbase import executingcomponent as component

import Rhino.Geometry as RhinoGeometry
import Grasshopper
class xml_recenter_component(component):
    def RunScript(self, _geo, _scale):
        
        scale = _scale if _scale != None else 1
        
        if(_geo.AllData().Count == 0):
            return
        
        # get bounding box
        bbox = _geo.AllData()[0].GetBoundingBox(True)
        for g in _geo.AllData():
            bbox.Union(g.GetBoundingBox(True))
        
        # Transformation matrix
        translation = -RhinoGeometry.Vector3d(bbox.Center)
        move_to_center = RhinoGeometry.Transform.Translation(translation)
        scale_xform = RhinoGeometry.Transform.Scale(RhinoGeometry.Point3d.Origin, scale)
        combined = scale_xform * move_to_center
        
        # Apply transformation
        geo_transformed = Grasshopper.DataTree[RhinoGeometry.GeometryBase]()
        for i in range(_geo.BranchCount):
            for j in range(_geo.Branch(i).Count):
                geo_copy = _geo.Branch(i)[j].Duplicate()
                geo_copy.Transform(combined)
                geo_transformed.Add(geo_copy, _geo.Paths[i])
        
        # Output
        return geo_transformed
# ---------- end xml_recenter ----------
srfgrid = SurfaceFromPoints(Points=srfpt.Points, UCount=srfpt.UCount, Interpolate=False)
number_slider_4 = Slider(8, range=0..10)
python = GhPythonScript(mesh=xml_recenter, top_plate_inlet=Slider(60, range=0..100), plate_thickness=Slider(40, range=1..40), ortho=Toggle(True))  # -> data, dir; inputs mesh: Mesh, ortho: Boolean
# ---------- python: Python ----------
from ghpythonlib.componentbase import executingcomponent as component
import Grasshopper, GhPython
import System
import Rhino
import rhinoscriptsyntax as rs
import Rhino
import Rhino.Geometry
from Rhino.Geometry import Surface, Mesh, MeshFace, Point3d, Point3f, Vector3d, Plane, Line, BoundingBox
import math
import System
from collections import OrderedDict
import Grasshopper
from System.Drawing import Color


class Chevron:
    # User inputs
    mesh = None
    edge_rotation = 0.0
    edge_offset = 0.0
    box_height = 0.0
    top_plate_inlet = 0.0
    plate_thickness = 0.0
    ortho = False

    # Class generated properties
    f_e = OrderedDict()
    f_rotation_flip = OrderedDict()
    bi_planes = []
    e_planes = []
    f_planes = []

    # Output
    f_v = []
    f_me = []
    plines = [] # pair of outlines
    insertion_vectors = [] # v0,v1,v2,v3,v4,v5
    adjacency = [] # v0,v1, f0, f1
    joints_per_face = [] # 0,0,1,1,2,2
    three_valence = [] # 43, 41, 45, 41

    # Display
    box_insertion_vectors = [] # v0,v1,v2,v3,v4,v5
    box_insertion_lines = [] # v0,v1,v2,v3,v4,v5
    
    def __init__(self, mesh, edge_rotation=1, edge_offset=0.5, box_height=760, top_plate_inlet=80, plate_thickness=40, ortho=True):

        if mesh == None:
            return
        self.mesh = mesh # assuming DuplicateMesh() is a method in Rhino or some other external library
        self.mesh.Flip(True, True, True)
        self.edge_rotation =  max(min(edge_rotation, 30), -30) if edge_rotation is not None else 1 # constrain self.edge_rotation to -30 to 
        self.edge_offset = max(min(edge_offset, 2), -2) if edge_offset is not None else 0.5 # constrain self.edge_offset to -2 to 2

        self.box_height = max(min(box_height, 100000000), 1) if box_height is not None else 760  # constrain box_height to 1 to infinity
        
        self.top_plate_inlet = max(min(top_plate_inlet, self.box_height * 0.333), 1) if top_plate_inlet is not None else 80 # constrain top_plate_inlet to 1 to box_height * 0.333
        #print(self.top_plate_inlet)
        self.plate_thickness = max(min(plate_thickness, self.box_height * 0.333), 1) if plate_thickness is not None else 40 # constrain self.plate_thickness to 1 to box_height * 0.333
        #print(self.plate_thickness)
        self.ortho = ortho if ortho is not None else True

        # output
        self.plines = [] # list of Polyline objects
        self.insertion_vectors = [[] for _ in range(self.mesh.Faces.Count * 4)] # list of Vector3d arrays
        self.adjacency = [] # list of int arrays
        self.joints_per_face = [[] for _ in range(self.mesh.Faces.Count * 4)] # list of int arrays
        self.three_valence = [] # list of int arrays
        self.f_v = [[] for _ in range(self.mesh.Faces.Count)] # list of int arrays
        self.f_me = [[] for _ in range(self.mesh.Faces.Count)] # list of int arrays

        # display
        self.box_insertion_vectors = [None] * self.mesh.Faces.Count # list of Vector3d objects
        self.box_insertion_lines = [None] * self.mesh.Faces.Count # list of Line objects
    
    def chevron_grid(self, s, u_divisions=4, v_division_dist=900, shift=0.5, scale=0.05799):
        
        # Python code
        # Inputs to construct self.mesh
        f = []
        v = []
        
        # Get Surface Interval, divisionStep, baseStep, maxStep, and Delta parameters
        DomU = s.Domain(0)
        DomV = s.Domain(1)
        half_v = DomV.T1 * 0.5
        StepU = (DomU.T1 - DomU.T0) / u_divisions
        baseStepV = v_division_dist
        maxStepV = 2500
        Delta = maxStepV - baseStepV
        
        totalV = DomV[1] - DomV[0]
        rem = (totalV / 2) - ((maxStepV / 2) + baseStepV + Delta)
        stepV = rem / baseStepV
        
        # Iterate number strips of the NURBS
        ctU = 0
        for j in range(u_divisions):
            ctV = 0
            thresh = totalV / 2
            StepV1 = baseStepV
            b = True
            ListV = []
        
            p0, p1, p2, p6, p7, p8 = None,None,None,None,None,None
            savept6 = Point3f.Unset
            savept7 = Point3f.Unset
            savept8 = Point3f.Unset
            iterations = 0

            while b and iterations < 1000:
                iterations += 1
                ListV.append(StepV1)
        
                # Get First Half of a Quads
                if ctV == 0:
                    
                    p0 = s.PointAt(ctU, ctV)
                    
                    p1 = s.PointAt(ctU + StepU * 0.5, ctV)
                    p2 = s.PointAt(ctU + StepU, ctV)
                    p6 = s.PointAt(ctU, ctV + StepV1 * (1 - shift / 2))
                    p7 = s.PointAt(ctU + StepU * 0.5, ctV + StepV1 * (1 + shift / 2))
                    p8 = s.PointAt(ctU + StepU, ctV + StepV1 * (1 - shift / 2))
                    savept6 = p6
                    savept7 = p7
                    savept8 = p8
                else:
                    p0 = savept6
                    p1 = savept7
                    p2 = savept8
                    p6 = s.PointAt(ctU, ctV + StepV1 * (1 - shift / 2))
                    p7 = s.PointAt(ctU + StepU * 0.5, ctV + StepV1 * (1 + shift / 2))
                    p8 = s.PointAt(ctU + StepU, ctV + StepV1 * (1 - shift / 2))
                    savept6 = p6
                    savept7 = p7
                    savept8 = p8
        
                # Add self.mesh faces
                f.append(MeshFace(len(v), len(v)+ 1, len(v) + 2, len(v) + 3))
                v.extend([p0, p6, p7, p1])
                f.append(MeshFace(len(v), len(v) + 1, len(v)+ 2, len(v) + 3))
                v.extend([p1, p7, p8, p2])
        
                # Increment V Parameter, and multiply by scale due to curvature change
                ctV += StepV1
                thresh -= StepV1
                StepV1 += StepV1 * scale
                
                # mirror side
                if ctV + StepV1 > half_v:
                    ListV.append(thresh)
                    ListV.reverse()
                    revCt = totalV / 2  # rev counter
                
                    for i in range(len(ListV) - 1):
                        revCt += ListV[i]
                
                        if i == 0:
                            p0 = s.PointAt(ctU, revCt - ListV[i + 1] * shift / 2)
                            #print(ctU, revCt - ListV[i + 1] * shift / 2)
                            p1 = s.PointAt(ctU + StepU * 0.5, revCt + ListV[i + 1] * shift / 2)
                            p2 = s.PointAt(ctU + StepU, revCt - ListV[i + 1] * shift / 2)
                
                            f.append(MeshFace(len(v), len(v) + 1, len(v) + 2, len(v) + 3))
                            v.extend([p6, p0, p1, p7])
                
                            f.append(MeshFace(len(v), len(v) + 1, len(v) + 2, len(v) + 3))
                            v.extend([p7, p1, p2, p8])
                
                            p6 = s.PointAt(ctU, revCt + ListV[i + 1] * (1 - shift / 2))
                            p7 = s.PointAt(ctU + StepU * 0.5, revCt + ListV[i + 1] * (1 + shift / 2))
                            p8 = s.PointAt(ctU + StepU, revCt + ListV[i + 1] * (1 - shift / 2))
                            savept6 = p6
                            savept7 = p7
                            savept8 = p8
                        elif i == (len(ListV) - 2):
                            p0 = savept6
                            p1 = savept7
                            p2 = savept8
                            p6 = s.PointAt(ctU, revCt + ListV[i + 1])
                            p7 = s.PointAt(ctU + StepU * 0.5, revCt + ListV[i + 1])
                            p8 = s.PointAt(ctU + StepU, revCt + ListV[i + 1])
                        else:
                            p0 = savept6
                            p1 = savept7
                            p2 = savept8
                            p6 = s.PointAt(ctU, revCt + ListV[i + 1] * (1 - shift / 2))
                            p7 = s.PointAt(ctU + StepU * 0.5, revCt + ListV[i + 1] * (1 + shift / 2))
                            p8 = s.PointAt(ctU + StepU, revCt + ListV[i + 1] * (1 - shift / 2))
                            savept6 = p6
                            savept7 = p7
                            savept8 = p8
                        
                        f.append(MeshFace(len(v), len(v) + 1, len(v) + 2, len(v) + 3))
                        v.extend([p1, p7, p8, p2])
                        f.append(MeshFace(len(v), len(v) + 1, len(v) + 2, len(v) + 3))
                        v.extend([p0, p6, p7, p1])
                        
                    b = False
                    
            ctU += StepU
            
        # Create Mesh
        #print(v)
        self.mesh = Mesh()
        for point in v:
            self.mesh.Vertices.Add(point)
        self.mesh.Faces.AddFaces(f)
        self.mesh.Weld(100)
        self.mesh.RebuildNormals()

        return self.mesh
        
    def get_mesh_face_edges(self, f, flag):
        edge_id = self.mesh.TopologyEdges.GetEdgesForFace(f)
        ids = [0, 1] if flag else [1, 2]
        return ids
    
    def stripper(self):
        self.f_e = OrderedDict()
        self.f_rotation_flip = OrderedDict()
        f_e_temp = OrderedDict()
        f_rotation_flip_temp = OrderedDict()
        flagArray = [False] * self.mesh.Faces.Count
        num = 0
    
        for i in range(self.mesh.Faces.Count):
            if(num>=self.mesh.Faces.Count):
                break
            
            face_1 = 0
            num2 = 0
            while num2 < self.mesh.Faces.Count:
                if flagArray[num2]:
                    num2 += 1
                else:
                    face_1 = num2
                    break
    
            self.mesh1 = Rhino.Geometry.Mesh()
            self.mesh1.Vertices.AddVertices(self.mesh.Vertices)
            self.mesh1.Faces.AddFace(self.mesh.Faces[face_1])
    
            f_e_temp[face_1] = self.get_mesh_face_edges( face_1, i % 2 == 0)
            f_rotation_flip_temp[face_1] = i % 2 == 0
    
            nums = [face_1]
            flagArray[face_1] = True
            num += 1
            flags = [False]
            flag = False
    
            while not flag:
                flag1 = False
                for j in range(self.mesh1.Faces.Count):
                    if not flags[j]:
                        f_n = self.mesh.Faces.AdjacentFaces(nums[j])
                        for k in range(len(f_n)):
                            if not flagArray[f_n[k]]:
                                f = self.mesh1.Faces[j]
                                a = f.A
                                b = f.B
                                c = f.C
                                d = f.D
                                f = self.mesh.Faces[f_n[k]]
                                a1 = f.A
                                b1 = f.B
                                c1 = f.C
                                d1 = f.D
                                if (a == b1 and b == a1) or (c == d1 and d == c1) or (c == b1 and d == a1) or (b == c1 and a == d1):
                                    f_e_temp[f_n[k]] = self.get_mesh_face_edges( f_n[k], i % 2 == 0)
                                    f_rotation_flip_temp[f_n[k]] = i % 2 == 0
    
                                    self.mesh1.Faces.AddFace(self.mesh.Faces[f_n[k]])
                                    nums.append(f_n[k])
                                    flags.append(False)
                                    flagArray[f_n[k]] = True
                                    num += 1
                                    flag1 = True
                        flags[j] = True
    
                if flag1:
                    continue
    
                flag = True
                self.mesh1.Vertices.CullUnused()
                # Rhino.RhinoDoc.ActiveDoc.Objects.AddMesh(self.mesh1)
    
            f_e_temp_keys = list(f_e_temp.keys())
            if i % 2 == 0:
                f_e_temp_keys.reverse()
            
            #print(len(f_e_temp_keys))
            for j in range(len(f_e_temp_keys)):
                
                self.f_e[f_e_temp_keys[j]] = f_e_temp[f_e_temp_keys[j]]
                
                self.f_rotation_flip[f_e_temp_keys[j]] = f_rotation_flip_temp[f_e_temp_keys[j]]
                #print(self.f_rotation_flip)
                
                #if(f_e_temp_keys == 10):
                    
                    #print(f_rotation_flip_temp[f_e_temp_keys[j]])
    
            f_e_temp = OrderedDict()
            f_rotation_flip_temp = OrderedDict()
        
        #print(self.f_rotation_flip )
        #print(self.f_rotation_flip)
#        for val in self.f_e:
#            print(val, self.f_e[val])
    
    def update_neighbour_plane(self, update_plane, curr_face, curr_edge):
        
        
        face_neighbors = self.mesh.TopologyEdges.GetConnectedFaces(curr_edge)
        if len(face_neighbors) == 1:
            return
        
        
        if face_neighbors[0] == curr_face:
            face_neighbors = [face_neighbors[1],face_neighbors[0]]
    
        neighbor_edges = [0, 0, 0, 0]
        for i in range(4):
            neighbor_edges[i] = self.mesh.TopologyEdges.GetEdgeIndex(
                self.f_v[face_neighbors[0]][i],
                self.f_v[face_neighbors[0]][(i + 1) % 4]
            )
    
        neighbor_edge = neighbor_edges.index( curr_edge )
        """
        if(curr_face == 139):
            print("Hi", face_neighbors, curr_edge, neighbor_edges)
            print(face_neighbors[0])
            print(curr_face)
            print(self.e_planes[face_neighbors[0]][neighbor_edge])
            Rhino.RhinoDoc.ActiveDoc.Objects.AddLine(self.mesh.TopologyEdges.EdgeLine(curr_edge))
        """
        self.e_planes[face_neighbors[0]][neighbor_edge] = Plane(
            update_plane.Origin,
            -update_plane.XAxis,
            update_plane.YAxis
        )
        
    
    def get_edge_planes(self):
        try:
            for i in range(len(self.mesh.Faces)):
                self.f_v[i] = [self.mesh.Faces[i][0], self.mesh.Faces[i][1], self.mesh.Faces[i][2], self.mesh.Faces[i][3]]
    
            self.e_planes = [None] * len(self.f_v)
            self.f_planes = [None] * len(self.f_v)
            self.f_me = [None] * len(self.f_v)
    
            for i in range(len(self.f_v)):
                n = len(self.f_v[i])
                self.e_planes[i] = [None] * n
                self.f_planes[i] = Plane(self.mesh.Faces.GetFaceCenter(i), Vector3d(self.mesh.FaceNormals[i]))
                self.f_me[i] = [None] * len(self.f_v[i])
    
                for j in range(len(self.f_v[i])):
                    v1 = self.f_v[i][(j + 0) % n]
                    v2 = self.f_v[i][(j + 1) % n]
    
                    e = self.mesh.TopologyEdges.GetEdgeIndex(v1, v2)
                    self.f_me[i][j] = e
                    cf = self.mesh.TopologyEdges.GetConnectedFaces(e)
    
                    sum = Vector3d.Zero
                    for k in range(len(cf)):
                        sum = sum + Vector3d(self.mesh.FaceNormals[cf[k]])
                    sum /= len(cf)
    
                    edgePlane = Plane(
                        (Point3d)(self.mesh.Vertices[v1] + self.mesh.Vertices[v2]) * 0.5,
                        self.mesh.Vertices[v1] - self.mesh.Vertices[v2], sum)
    
                    self.e_planes[i][j] = edgePlane
            
        except Exception as e:
            print(str(e))
    
    def orthogonalize_planes(self, plane):
        
        zaxis_coord_abs = [abs(plane.ZAxis.X), abs(plane.ZAxis.Y), abs(plane.ZAxis.Z)]
        zaxis_coord = [plane.ZAxis.X, plane.ZAxis.Y, plane.ZAxis.Z]
        id = [0, 1, 2]
    
        zaxis_coord_abs, id = (list(t) for t in zip(*sorted(zip(zaxis_coord_abs, id), key=lambda pair: pair[0])))
    
        coord = math.copysign(math.ceil(abs(zaxis_coord[id[2]])), zaxis_coord[id[2]])
    
        if id[2] == 0:
            plane0 = Plane(plane.Origin, Vector3d(coord, 0, 0))
            return plane0
        elif id[2] == 1:
            plane0 = Plane(plane.Origin, Vector3d(0, coord, 0))
            return plane0
        else:
            plane0 = Plane(plane.Origin, Vector3d(0, 0, coord))
            return plane0

    def move_plane_by_axis(self, plane, dist, axis=2):
        plane1 = Rhino.Geometry.Plane(plane)
        if axis == 0:
            plane1.Translate(plane1.XAxis * dist)
        elif axis == 1:
            plane1.Translate(plane1.YAxis * dist)
        else:
            plane1.Translate(plane1.Normal * dist)
        return plane1

    def rotate_planes(self):
        
        #print(self.f_e)
        
        for i in range(self.mesh.Faces.Count):
            for j in range(4):
                e = self.mesh.TopologyEdges.GetEdgeIndex(self.f_v[i][j], self.f_v[i][(j + 1) % 4])
                #print("___")

                if len(self.mesh.TopologyEdges.GetConnectedFaces(e)) == 2:
                    sign = -1 if self.f_rotation_flip[i] else 1
                    sign = sign * 1 if j % 2 == 0 else sign * -1
                    sign = 1
                    
                    #if(i == 162):
                        #print(j)
                    
                    if (j in self.f_e[i]):
                        
                        
                        if j % 2 == 0 and self.f_rotation_flip[i]:
                            self.e_planes[i][j] = self.move_plane_by_axis(self.e_planes[i][j], self.plate_thickness * self.edge_offset)
                            self.update_neighbour_plane(self.e_planes[i][j], i, e)
                        if j % 2 == 0 and not self.f_rotation_flip[i]: # this failing
                            
                            self.e_planes[i][j] = self.move_plane_by_axis(self.e_planes[i][j], self.plate_thickness * self.edge_offset)
                            self.update_neighbour_plane(self.e_planes[i][j], i, e)
                        if j % 2 == 1 and self.f_rotation_flip[i]:
                            self.e_planes[i][j].Rotate(math.radians(self.edge_rotation * sign * 1), self.e_planes[i][j].YAxis)
                            self.update_neighbour_plane(self.e_planes[i][j], i, e)
                            
                        if j % 2 == 1 and not self.f_rotation_flip[i]:
                            sign *= -1
                            self.e_planes[i][j].Rotate(math.radians(self.edge_rotation * sign * 1), self.e_planes[i][j].YAxis)
                            self.update_neighbour_plane(self.e_planes[i][j], i, e)
                            
                elif self.ortho:
                    self.e_planes[i][j] = self.orthogonalize_planes(self.e_planes[i][j])
    
    def to_line(self,  v, p, scale = 1):
        return Line(p, p + v * scale);
    
    def dihedral_plane(self, plane0, plane1):
         # Plane between two Planes
            result, l = Rhino.Geometry.Intersect.Intersection.PlanePlane(plane0, plane1)
            result, t = Rhino.Geometry.Intersect.Intersection.LinePlane(l, plane0)
            centerDihedral = l.PointAt(t)
        
            # Convert ZAxis to lines, cant it be done on origin
            angleLine0 = self.to_line(plane0.ZAxis,plane0.Origin) 
            angleLine1 = self.to_line(plane1.ZAxis,plane1.Origin) 
        
            # Plane cannot be anti/parallel and they must be apart from each other
            if not plane0.ZAxis.IsParallelTo(plane1.ZAxis, 0.01) and plane0.Origin.DistanceToSquared(plane1.Origin) > 0.001:
                # Intersect two lines to get center
                result, t0, t1 = Rhino.Geometry.Intersect.Intersection.LineLine(angleLine0, angleLine1,0.01,False)
                
                # Construct plane from LineLine center and plane origins
                center = angleLine0.PointAt(t0)
                v0 = (plane0.Origin - center)
                v1 = (plane1.Origin - center)
                v0.Unitize()
                v1.Unitize()
                
                # Compute Plane
                dihedralPlane = Rhino.Geometry.Plane(centerDihedral, l.Direction, v0 + v1)
        
                return dihedralPlane
            else:
                return Rhino.Geometry.Plane.Unset  # Axes are parallel or anti-parallel, or planes are at the same location
    
    def get_bisector_planes(self):
        self.bi_planes = []
    
        for i in range(self.mesh.Faces.Count):
            bi_planes_i = []
            for j in range(4):
                pl1 = self.e_planes[i][j]
                pl0 = self.e_planes[i][(j + 1) % 4]
                bi_planes_i.append(self.dihedral_plane(pl0, pl1))
            self.bi_planes.append(bi_planes_i)
    
    def polyline_from_planes(self, basePlane, sidePlanes, close=True):
        polyline = Rhino.Geometry.Polyline()
    
        for i in range(len(sidePlanes) - 1):
            result, pt = Rhino.Geometry.Intersect.Intersection.PlanePlanePlane(basePlane, sidePlanes[i], sidePlanes[i + 1])
            polyline.Add(pt)
    
        result, pt1 = Rhino.Geometry.Intersect.Intersection.PlanePlanePlane(basePlane, sidePlanes[len(sidePlanes) - 1], sidePlanes[0])
        polyline.Add(pt1)
    
        if close:
            polyline.Add(polyline[0])
    
        return polyline
    
    def get_plates(self):
        self.plines = []
        #print("________")
        for f, e in self.f_e.items():
            #print(f)
            # Offset Planes
            self.e_planes_local = []
            for j in range(4):
                pl = self.e_planes[f][j] if j not in e else self.move_plane_by_axis(self.e_planes[f][j], self.plate_thickness*1.0)
                self.e_planes_local.append(pl)
                #Rhino.RhinoDoc.ActiveDoc.Objects.AddPoint(self.e_planes[f][j].Origin)
    
            # Get Top Plates
            self.plines.append(self.polyline_from_planes(self.move_plane_by_axis(self.f_planes[f], self.box_height * 0.5 - self.top_plate_inlet - self.plate_thickness * 0.5), self.e_planes_local))
            self.plines.append(self.polyline_from_planes(self.move_plane_by_axis(self.f_planes[f], self.box_height * 0.5 - self.top_plate_inlet + self.plate_thickness * 0.5), self.e_planes_local))
            self.plines.append(self.polyline_from_planes(self.move_plane_by_axis(self.f_planes[f], -self.box_height * 0.5 + self.top_plate_inlet - self.plate_thickness * 0.5), self.e_planes_local))
            self.plines.append(self.polyline_from_planes(self.move_plane_by_axis(self.f_planes[f], -self.box_height * 0.5 + self.top_plate_inlet + self.plate_thickness * 0.5), self.e_planes_local))
    
            # Get Side Plates
            for j in range(len(e)):
                curr = e[j]
                prev = ((e[j] - 1)+4)%4# MathUtil.Wrap(e[j] - 1, 4)
                next = (e[j] + 1)%4
                # Side planes
                side_plane0 = self.move_plane_by_axis(self.f_planes[f], self.box_height * 0.5) # top plane
                side_plane1 = self.e_planes[f][prev] if j == 0 else self.bi_planes[f][prev]
                side_plane2 = self.move_plane_by_axis(self.f_planes[f], -self.box_height * 0.5) # bottom outline
                side_plane3 = self.e_planes[f][next] if j != 0 else self.bi_planes[f][curr]
                side_planes  = [side_plane0, side_plane1, side_plane2, side_plane3]
    
                # Top and bottom plane plane
                base_plane0 = self.e_planes[f][curr]
                base_plane1 = self.move_plane_by_axis(self.e_planes[f][curr], self.plate_thickness)
    
                self.plines.append(self.polyline_from_planes(base_plane0, side_planes))
                self.plines.append(self.polyline_from_planes(base_plane1, side_planes))

    
    def center_point(self, polyline):
        count = len(polyline)
    
        if count == 0:
            return Point3d.Unset
    
        if count == 1:
            return polyline[0]
    
        center = Point3d.Origin
        weight = 0.0
    
        stop = count - 1
        if polyline[0].DistanceToSquared(polyline[polyline.Count - 1]) > 0.001:
            stop += 1
    
        for i in range(stop):
            A = polyline[i]
            B = polyline[(i + 1) % count]
            d = A.DistanceTo(B)
            center += d * 0.5 * (A + B)
            weight += d
    
        center /= weight
    
        return center
    
    # output
    #    public List<Polyline> plines;//pair of outlines
    #    public Vector3d[][] insertion_vectors;//v0,v1,v2,v3,v4,v5
    #    public int[][] adjacency;//0,1
    #    public int[][] joints_per_face;//0,0,1,1,2,2
    #    public List<int[]> three_valence;//43, 41, 45, 41
    def get_joinery_solver_output(self):
        # Insertion vectors
        counter = 0
        
        for o in self.f_e.items():
            f = o[0]
            e = o[1]
            e.sort()
            if e[0] == 0 and e[1] == 3:
                e.reverse()
        
            # Get vertices to construct vectors
            v = [self.mesh.Faces[f].A, self.mesh.Faces[f].B, self.mesh.Faces[f].C, self.mesh.Faces[f].D]
            v0_0 = v[e[0]]
            v0_1 = v[(e[0] + 1) % 4]
            v1_0 = v[e[1]]
            v1_1 = v[(e[1] + 1) % 4]
        
            dir0 = self.mesh.Vertices[v0_1] - self.mesh.Vertices[v0_0]
            dir1 = self.mesh.Vertices[v0_1] - self.mesh.Vertices[v1_1]
            dir0.Unitize()
            dir1.Unitize()
            
            result, l0 = Rhino.Geometry.Intersect.Intersection.PlanePlane(self.f_planes[f], self.bi_planes[f][e[0]])
            bisector_dir0 = l0.To - l0.From
            bisector_dir0.Unitize()
            
            result, l1 = Rhino.Geometry.Intersect.Intersection.PlanePlane(self.f_planes[f], self.bi_planes[f][(e[1] + 1) % 4])
            bisector_dir1 = l1.To - l1.From
            bisector_dir1.Unitize()
        
            # Assign vectors per box
            self.box_insertion_vectors[counter] = bisector_dir1
            #print(self.box_insertion_lines)
            #print(counter)
            #print(self.plines)
            self.box_insertion_lines[counter] = Line(
                self.center_point(self.plines[counter * 8 + 1]),
                self.center_point(self.plines[counter * 8 + 1]) + bisector_dir1 * 300)
        
            # Assign vectors per face
        
            # Top and bottom plate
            insertions = [Vector3d.Zero, Vector3d.Zero, bisector_dir1, bisector_dir1, bisector_dir1, bisector_dir1]
            insertions[2 + ((e[1] + 2) % 4)] = bisector_dir0
            insertions[2 + ((e[1] + 3) % 4)] = bisector_dir0
            self.insertion_vectors[counter * 4 + 0] = insertions
            self.insertion_vectors[counter * 4 + 1] = insertions
        
            # Side plates
            self.insertion_vectors[counter * 4 + 2] = [Vector3d.Zero, Vector3d.Zero, Vector3d.Zero, Vector3d.Zero, Vector3d.Zero, Vector3d.Zero]
            self.insertion_vectors[counter * 4 + 3] = [Vector3d.Zero, Vector3d.Zero, Vector3d.Zero, Vector3d.Zero, Vector3d.Zero, Vector3d.Zero]
            counter += 1
        
        # Flatten ID Mapping
        counter = 0
        dict_plate_id_meshface_id = OrderedDict()
        for o in self.f_e.items():
            dict_plate_id_meshface_id[o[0]] = counter
            counter += 1
        
        ##############################################################################
        # Adjacency
        ##############################################################################
        unique_key = set()
        # Box adjacency
        counter = 0
        for o in self.f_e.items():
            f = o[0]
            e = o[1]
        
            # Current box
            self.adjacency.append([counter * 4 + 0, counter * 4 + 2, -1, -1])
            self.adjacency.append([counter * 4 + 0, counter * 4 + 3, -1, -1])
            self.adjacency.append([counter * 4 + 1, counter * 4 + 2, -1, -1])
            self.adjacency.append([counter * 4 + 1, counter * 4 + 3, -1, -1])
            self.adjacency.append([counter * 4 + 2, counter * 4 + 3, -1, -1])
            # Neighbors
            m_e_0 = self.f_me[f][e[0]]  # self.mesh.TopologyEdges.GetEdgeIndex(v[e[0]], v[(e[0] + 1) % 4])
            m_e_1 = self.f_me[f][e[1]]  # self.mesh.TopologyEdges.GetEdgeIndex(v[e[1]], v[(e[1] + 1) % 4])
        
            f0 = self.mesh.TopologyEdges.GetConnectedFaces(m_e_0)
            if len(f0) == 2:
                next_face = f0[0] if f0[0] != f else f0[1]
                self.adjacency.append([dict_plate_id_meshface_id[next_face] * 4 + 0, counter * 4 + 2, -1, -1])
                self.adjacency.append([dict_plate_id_meshface_id[next_face] * 4 + 1, counter * 4 + 2, -1, -1])
        
            f1 = self.mesh.TopologyEdges.GetConnectedFaces(m_e_1)
            if len(f1) == 2:
                next_face = f1[0] if f1[0] != f else f1[1]
                self.adjacency.append([dict_plate_id_meshface_id[next_face] * 4 + 0, counter * 4 + 3, -1, -1])
                self.adjacency.append([dict_plate_id_meshface_id[next_face] * 4 + 1, counter * 4 + 3, -1, -1])
        
            counter += 1
        
        ##############################################################################
        # Three valence
        ##############################################################################
        # Initialize counter variable
        counter = 0
        
        # Loop through key-value pairs
        for f, e in self.f_e.items():
            # Retrieve topology vertices of current face
            v = [self.mesh.Faces[f].A, self.mesh.Faces[f].B, self.mesh.Faces[f].C, self.mesh.Faces[f].D]
            
            # Retrieve topology edge indexes
            m_e_0 = self.f_me[f][e[0]]
            m_e_1 = self.f_me[f][e[1]]
            
            # Retrieve connected faces of topology edges
            e_f_0 = self.mesh.TopologyEdges.GetConnectedFaces(m_e_0)
            
            # Check if edge m_e_0 is shared by two faces
            if len(e_f_0) == 2:
                # Retrieve index of the other face connected to m_e_0
                
                f_0 = e_f_0[abs(System.Array.IndexOf(e_f_0, f) - 1)];
                
                
                # Retrieve index of neighboring face from dictionary
                nei0 = dict_plate_id_meshface_id[f_0]
                
                # Add connectivity information to three_valence list
                self.three_valence.append([counter * 4 + 0, counter * 4 + 2, nei0 * 4 + 0, counter * 4 + 2])
                self.three_valence.append([counter * 4 + 1, counter * 4 + 2, nei0 * 4 + 1, counter * 4 + 2])
            
            # Retrieve connected faces of topology edges
            e_f_1 = self.mesh.TopologyEdges.GetConnectedFaces(m_e_1)
            
            # Check if edge m_e_1 is shared by two faces
            if len(e_f_1) == 2:
                # Retrieve index of the other face connected to m_e_1
                f_1 = e_f_1[abs(System.Array.IndexOf(e_f_1, f) - 1)];
                
                # Retrieve index of neighboring face from dictionary
                nei1 = dict_plate_id_meshface_id[f_1]
                
                # Add connectivity information to three_valence list
                self.three_valence.append([counter * 4 + 0, counter * 4 + 3, nei1 * 4 + 0, counter * 4 + 3])
                self.three_valence.append([counter * 4 + 1, counter * 4 + 3, nei1 * 4 + 1, counter * 4 + 3])
            
            # Increment counter
            counter += 1
        
        ##############################################################################
        # Joints per face
        ##############################################################################
        # Initialize counter variable
        counter = 0
        
        # Loop through key-value pairs
        for f, e in self.f_e.items():
            # top-bottom
            self.joints_per_face[counter * 4 + 0] = [0, 0, 20, 20, 20, 20]
            self.joints_per_face[counter * 4 + 1] = [0, 0, 20, 20, 20, 20]
        
            # sides
            # set all to 0 except the dovetail
            a = 1 if e[0] == 3 and e[1] == 0 else 0
            b = 0 if e[0] == 3 and e[1] == 0 else 1
            self.joints_per_face[counter * 4 + 2 + a] = [0, 0, 0, 0, 10, 0]
            self.joints_per_face[counter * 4 + 2 + b] = [0, 0, 10, 0, 0, 0]
            counter += 1
        
    def run(self):
        if self.mesh == None:
            print("Mesh is not given")
            return
        self.stripper()
        self.get_edge_planes()
        self.rotate_planes()
        self.get_bisector_planes()
        self.get_plates()
        self.get_joinery_solver_output()

class MyComponent(component):
    
    
    bbox = BoundingBox.Unset
    lines = []
    insertion_vectors_current = []
    joint_per_face_current_text_entity = []
    polylines = []
    
    def DrawViewportWires(self, args):
        
        is_selected = False
        """
        for _ in GrasshopperDocument.Objects:
            is_selected = _.Attributes.Selected
        """
        #col = args.WireColour_Selected if is_selected else args.WireColour;
        col = args.WireColour
        line_weight = args.DefaultCurveThickness
        try:
            for polyline in self.polylines:
                args.Display.DrawPolyline(polyline,  col, line_weight)
            """
            plane = Plane.WorldXY
            for line in self.lines:
                args.Display.DrawLineArrow(line, Color.FromArgb(207, 0, 90), 2, 100)
            for insertionVectorsCurrent in self.insertion_vectors_current:
                if(insertionVectorsCurrent.Length<0.05):
                    continue
                args.Display.DrawLine(insertionVectorsCurrent, Color.FromArgb(0, 0, 0), 5)
            for jointPerFaceCurrent in self.joint_per_face_current_text_entity:
                result, plane = Rhino.RhinoDoc.ActiveDoc.Views.ActiveView.ActiveViewport.GetCameraFrame()
                plane.Origin=(jointPerFaceCurrent.Plane.Origin)
                args.Display.Draw3dText(jointPerFaceCurrent.PlainText, jointPerFaceCurrent.MaskColor, plane, jointPerFaceCurrent.TextHeight, "Arial", False, False,Rhino.DocObjects.TextHorizontalAlignment.Center, Rhino.DocObjects.TextVerticalAlignment.BottomOfTop)
            """
        except Exception, e:
            System.Windows.Forms.MessageBox.Show(str(e), "script error")
    
    def get_ClippingBox(self):
        return bbox
    
    
    def RunScript(self, _mesh, _edge_rotation, _edge_offset, _box_height, _top_plate_inlet, _plate_thickness, _ortho):
        

        if(_mesh == None):
            return
        ##############################################################################
        # Output
        ##############################################################################
        chevron = Chevron(_mesh, _edge_rotation, _edge_offset, _box_height, _top_plate_inlet, _plate_thickness, _ortho)
        chevron.run()
        
        self.polylines = chevron.plines
        planes = []
        _plines_partitioned =  [[] for _ in range(int(chevron.plines.Count*0.5))] # list of int arrays
        
        self.bbox = chevron.plines[0].BoundingBox
        
        for i in range(int(chevron.plines.Count*0.5)):
            _plines_partitioned[i] = [chevron.plines[i*2+0], chevron.plines[i*2+1]]
            self.bbox.Union(chevron.plines[i*2+0].BoundingBox)
            plane = Plane(chevron.plines[i*2+0][0],chevron.plines[i*2+0][1]-chevron.plines[i*2+0][0],chevron.plines[i*2+0][1]-chevron.plines[i*2+0][2]);
            planes.append(plane)
        _data = [[_plines_partitioned, chevron.insertion_vectors, chevron.joints_per_face, chevron.three_valence, chevron.adjacency,planes]]
        _dir = chevron.box_insertion_lines
        
        # return outputs if you have them; here I try it for you:
        return (_data, _dir)
# ---------- end python ----------
item_2 = ListItem(List=python.data, Index=0, Wrap=True)
domain_2 = Domain(srfgrid)
python_2 = GhPythonScript(surface=item)  # -> mesh; inputs surface: Surface, u_divisions: Int32
# ---------- python_2: Python ----------
from ghpythonlib.componentbase import executingcomponent as component
import Grasshopper, GhPython
import System
import Rhino
import rhinoscriptsyntax as rs
import Rhino
import Rhino.Geometry
from Rhino.Geometry import Surface, Mesh, MeshFace, Point3d, Point3f, Vector3d

class Chevron:
    # User inputs
    mesh = None
    edge_rotation = 0.0
    edge_offset = 0.0
    box_height = 0.0
    top_plate_inlet = 0.0
    plate_thickness = 0.0
    ortho = False

    # Class generated properties
    f_e = {}
    f_rotation_flip = {}
    bi_planes = []
    e_planes = []
    f_planes = []

    # Output
    f_v = []
    f_me = []
    plines = [] # pair of outlines
    insertion_vectors = [] # v0,v1,v2,v3,v4,v5
    adjacency = [] # v0,v1, f0, f1
    joints_per_face = [] # 0,0,1,1,2,2
    three_valence = [] # 43, 41, 45, 41

    # Display
    box_insertion_vectors = [] # v0,v1,v2,v3,v4,v5
    box_insertion_lines = [] # v0,v1,v2,v3,v4,v5
    
    def __init__(self, mesh, edge_rotation=1, edge_offset=0.5, box_height=760, top_plate_inlet=80, plate_thickness=40, ortho=True):
        if mesh == None:
            return
        self.mesh = mesh.DuplicateMesh() # assuming DuplicateMesh() is a method in Rhino or some other external library
        self.mesh.Flip(True, True, True)

        self.edge_rotation = max(min(edge_rotation, 30), -30) # constrain edge_rotation to -30 to 30
        self.edge_offset = max(min(edge_offset, 2), -2) # constrain edge_offset to -2 to 2

        self.box_height = max(min(box_height, math.inf), 1) # constrain box_height to 1 to infinity
        self.top_plate_inlet = max(min(top_plate_inlet, box_height * 0.333), 1) # constrain top_plate_inlet to 1 to box_height * 0.333
        self.plate_thickness = max(min(plate_thickness, box_height * 0.333), 1) # constrain plate_thickness to 1 to box_height * 0.333
        self.ortho = ortho

        # output
        self.plines = [] # list of Polyline objects
        self.insertion_vectors = [[] for _ in range(mesh.Faces.Count * 4)] # list of Vector3d arrays
        self.adjacency = [] # list of int arrays
        self.joints_per_face = [[] for _ in range(mesh.Faces.Count * 4)] # list of int arrays
        self.three_valence = [] # list of int arrays
        self.f_v = [[] for _ in range(mesh.Faces.Count)] # list of int arrays
        self.f_me = [[] for _ in range(mesh.Faces.Count)] # list of int arrays

        # display
        self.box_insertion_vectors = [None] * mesh.Faces.Count # list of Vector3d objects
        self.box_insertion_lines = [None] * mesh.Faces.Count # list of Line objects
    
    def chevron_grid(self, s, u_divisions=4, v_division_dist=900, shift=0.5, scale=0.05799):
        if(s is None):
            return
        # Python code
        # Inputs to construct mesh
        f = []
        v = []
        
        # Get Surface Interval, divisionStep, baseStep, maxStep, and Delta parameters
        DomU = s.Domain(0)
        DomV = s.Domain(1)
        half_v = DomV.T1 * 0.5
        StepU = (DomU.T1 - DomU.T0) / u_divisions
        baseStepV = v_division_dist
        maxStepV = 2500
        Delta = maxStepV - baseStepV
        
        totalV = DomV[1] - DomV[0]
        rem = (totalV / 2) - ((maxStepV / 2) + baseStepV + Delta)
        stepV = rem / baseStepV
        
        # Iterate number strips of the NURBS
        ctU = 0
#        print(s.Domain(0))
#        print(s.Domain(1))
#        print(u_divisions)
        for j in range(u_divisions):
#            print(j)
            ctV = 0
            thresh = totalV / 2
            StepV1 = baseStepV
            b = True
            ListV = []
        
            p0, p1, p2, p6, p7, p8 = None,None,None,None,None,None
            savept6 = Point3f.Unset
            savept7 = Point3f.Unset
            savept8 = Point3f.Unset
            iterations = 0

            while b and iterations < 1000:
                iterations += 1
                ListV.append(StepV1)
        
                # Get First Half of a Quads
                if ctV == 0:
                    
                    p0 = s.PointAt(ctU, ctV)
                    
                    p1 = s.PointAt(ctU + StepU * 0.5, ctV)
                    p2 = s.PointAt(ctU + StepU, ctV)
                    p6 = s.PointAt(ctU, ctV + StepV1 * (1 - shift / 2))
                    p7 = s.PointAt(ctU + StepU * 0.5, ctV + StepV1 * (1 + shift / 2))
                    p8 = s.PointAt(ctU + StepU, ctV + StepV1 * (1 - shift / 2))
                    savept6 = p6
                    savept7 = p7
                    savept8 = p8
                else:
                    p0 = savept6
                    p1 = savept7
                    p2 = savept8
                    p6 = s.PointAt(ctU, ctV + StepV1 * (1 - shift / 2))
                    p7 = s.PointAt(ctU + StepU * 0.5, ctV + StepV1 * (1 + shift / 2))
                    p8 = s.PointAt(ctU + StepU, ctV + StepV1 * (1 - shift / 2))
                    savept6 = p6
                    savept7 = p7
                    savept8 = p8
        
                # Add mesh faces
                f.append(MeshFace(len(v), len(v)+ 1, len(v) + 2, len(v) + 3))
                v.extend([p0, p6, p7, p1])
                f.append(MeshFace(len(v), len(v) + 1, len(v)+ 2, len(v) + 3))
                v.extend([p1, p7, p8, p2])
        
                # Increment V Parameter, and multiply by scale due to curvature change
                ctV += StepV1
                thresh -= StepV1
                StepV1 += StepV1 * scale
                
                # mirror side
                if ctV + StepV1 > half_v:
                    ListV.append(thresh)
                    ListV.reverse()
                    revCt = totalV / 2  # rev counter
                
                    for i in range(len(ListV) - 1):
                        revCt += ListV[i]
                
                        if i == 0:
                            p0 = s.PointAt(ctU, revCt - ListV[i + 1] * shift / 2)
                            #print(ctU, revCt - ListV[i + 1] * shift / 2)
                            p1 = s.PointAt(ctU + StepU * 0.5, revCt + ListV[i + 1] * shift / 2)
                            p2 = s.PointAt(ctU + StepU, revCt - ListV[i + 1] * shift / 2)
                
                            f.append(MeshFace(len(v), len(v) + 1, len(v) + 2, len(v) + 3))
                            v.extend([p6, p0, p1, p7])
                
                            f.append(MeshFace(len(v), len(v) + 1, len(v) + 2, len(v) + 3))
                            v.extend([p7, p1, p2, p8])
                
                            p6 = s.PointAt(ctU, revCt + ListV[i + 1] * (1 - shift / 2))
                            p7 = s.PointAt(ctU + StepU * 0.5, revCt + ListV[i + 1] * (1 + shift / 2))
                            p8 = s.PointAt(ctU + StepU, revCt + ListV[i + 1] * (1 - shift / 2))
                            savept6 = p6
                            savept7 = p7
                            savept8 = p8
                        elif i == (len(ListV) - 2):
                            p0 = savept6
                            p1 = savept7
                            p2 = savept8
                            p6 = s.PointAt(ctU, revCt + ListV[i + 1])
                            p7 = s.PointAt(ctU + StepU * 0.5, revCt + ListV[i + 1])
                            p8 = s.PointAt(ctU + StepU, revCt + ListV[i + 1])
                        else:
                            p0 = savept6
                            p1 = savept7
                            p2 = savept8
                            p6 = s.PointAt(ctU, revCt + ListV[i + 1] * (1 - shift / 2))
                            p7 = s.PointAt(ctU + StepU * 0.5, revCt + ListV[i + 1] * (1 + shift / 2))
                            p8 = s.PointAt(ctU + StepU, revCt + ListV[i + 1] * (1 - shift / 2))
                            savept6 = p6
                            savept7 = p7
                            savept8 = p8
                        
                        f.append(MeshFace(len(v), len(v) + 1, len(v) + 2, len(v) + 3))
                        v.extend([p1, p7, p8, p2])
                        f.append(MeshFace(len(v), len(v) + 1, len(v) + 2, len(v) + 3))
                        v.extend([p0, p6, p7, p1])
                        
                    b = False
                    
            ctU += StepU
            
        # Create Mesh
        #print(v)
        mesh = Mesh()
        for point in v:
            mesh.Vertices.Add(point)
        mesh.Faces.AddFaces(f)
        mesh.Weld(100)
        mesh.RebuildNormals()

        return mesh

class MyComponent(component):
    
    def RunScript(self, _surface, _u_divisions, _v_division_dist, _shift, _scale):
        
        
        
        
        
        chevron = Chevron(None)
        _mesh = chevron.chevron_grid(_surface)
        
        # return outputs if you have them; here I try it for you:
        return _mesh
# ---------- end python_2 ----------
meshedges = MeshEdges(Mesh=python_2)  # -> AllE, NakedE
midpt = CurveMiddle(Curve=meshedges.AllE)
points = PointList(Points=midpt, Size=Slider(41, range=0..150))
mesh = Mesh(python_2)
facen = FaceNormals(Mesh=mesh)  # -> Centers, Normals
panel = Panel(domain_2)
crv = Curve()
panel_2 = Panel(domain)
crv_2 = Curve(python.dir)

# ---- group: chevron
chevron = Chevron(
    Surface=srf,
    U_divisions=Slider(4, range=1..20),
    V_division_dist=Slider(900, range=900..1000),
    Shift=Slider(0.5, range=0.5..1),
    Scale=Slider(0.05799, range=0.05..0.06))

# ---- group: chevron_plates
chevron_plates = Chevron_plates(
    Mesh=python_2,
    Edge_rotation=Slider(1, range=0..10),
    Edge_offset=Slider(0.5, range=0..2.5),
    Box_height=Slider(760, range=100..1000),
    Top_plate_inlet=Slider(80, range=0..100),
    Plate_thickness=Slider(40, range=1..40),
    Ortho=True)  # -> Data, Dir

# ----
points_2 = PointList(Points=facen.Centers)
python_3 = GhPythonScript()  # -> out, a
# ---------- python_3: Python ----------
a = x
# ---------- end python_3 ----------
panel_3 = Panel(python_3.a)
cull_i = CullIndex(List=python_3.a, Indices=[2, 3], Wrap=True)
loft_b = Loft_brep()  # -> brep; inputs p0: list of Curve, p1: list of Curve; disabled
#   port p0: polylines with holes, bottom
#   port p1: polylines with holes, top
#   port brep: lofted and capped brep with holes
# ---------- loft_b: Python ----------
"""get joints ids and connections areas between elements"""

__author__ = "petras vestartas"
__version__ = "2023.03.31"


from ghpythonlib.componentbase import executingcomponent as component
import Rhino.RhinoDoc
import Rhino.Geometry
import Rhino.RhinoMath
from System.Drawing import Color


class connections_zones(component):

    def loft_polylines_with_holes(self, curves0, curves1):
        """Loft polylines with holes
        
        Parameters
        ----------
        curves0 : list[rg.Polyline]
        curves1 : list[rg.Polyline]
        
        Returns
        -------
        rg.Brep
            brep as lofted polylines and cap them
        """
        
        ###############################################################################
        # user input
        ###############################################################################
        
        flag = len(curves0) is not 0 if True else len(curves1) != 0
        if (flag):
            
            curves = []
            curves2 = []
            
            flag0 = len(curves1) == 0
            flag1 = len(curves0) == 0 and len(curves1) != 0
            flag2 = len(curves0) and len(curves1)
            
            if (flag0):
                for i in range(len(curves0)):
                    if (float(i) >= float(len(curves0)) * 0.5):
                        curves2.Add(curves0[i])
                    else:
                        curves.Add(curves0[i])
            elif (flag1):
                for i in range(0, len(curves1), 2):
                    curves.Add(curves1[i])
                    curves2.Add(curves1[i + 1])
            elif (flag2):
                curves = curves0
                curves2 = curves1
            
            curves0 = curves
            curves1 = curves2
        
        
        ###############################################################################
        # Create mesh of the bottom face
        ###############################################################################
        brep_bottom = Rhino.Geometry.Brep.CreatePlanarBreps(curves0, Rhino.RhinoDoc.ActiveDoc.ModelAbsoluteTolerance)[0]
        brep_top = Rhino.Geometry.Brep.CreatePlanarBreps(curves1, Rhino.RhinoDoc.ActiveDoc.ModelAbsoluteTolerance)[0]
        
        ###############################################################################
        # Create lofts
        ###############################################################################
        breps_to_join = [brep_bottom, brep_top]
        for i in range(len(curves0)):
            wall = Rhino.Geometry.Brep.CreateFromLoft([curves0[i],curves1[i]], Rhino.Geometry.Point3d.Unset, Rhino.Geometry.Point3d.Unset, Rhino.Geometry.LoftType.Normal,False)[0]
            breps_to_join.append(wall)
        
        ###############################################################################
        # Join Brep
        ###############################################################################
        solid = Rhino.Geometry.Brep.JoinBreps(breps_to_join, Rhino.RhinoDoc.ActiveDoc.ModelAbsoluteTolerance)[0]
        
        ###############################################################################
        # Because kinked surface can cause problems down stream, Rhino
        # always splits kinked surfaces when adding Breps to the document. Since
        # we are not adding this Brep to the document, lets split the kinked
        # surfaces ourself.
        ###############################################################################
        solid.Faces.SplitKinkyFaces(Rhino.RhinoMath.DefaultAngleTolerance, True)
        
        ###############################################################################
        # The profile curve, created by the input points, is oriented clockwise.
        # Thus when the profile is extruded, the resulting surface will have its
        # normals pointed inwards. So lets check the orientation and, if inwards,
        # flip the face normals.
        ###############################################################################
        if (Rhino.Geometry.BrepSolidOrientation.Inward == solid.SolidOrientation):
            solid.Flip()
        
        for i in range(solid.Faces.Count):
            if(i < 2):
                solid.Faces[i].PerFaceColor = Color.DeepPink#Color.LightGray
            else:
                solid.Faces[i].PerFaceColor = Color.LightGray
        
        return solid
    
    def RunScript(self, _p0, _p1):
        if _p0 and _p1:
            return self.loft_polylines_with_holes(_p0, _p1)
# ---------- end loft_b ----------
solver = Solver(data=python.data)  # -> data; inputs joint_p: list, scale: list of Int32, extension: list of Int32, find: Int32, get: Int32
#   port data: collection of inputs that represent the elements, insertion vectors, joint types and adjacency, use input_set commonent to group these inputs
#   port joint_p: joint parameters
#   port scale: scale of joint, default is [1,1,1]
#   port extension: extension by distance, plates often has [0,0,10], whereas beams [10,10,10], default is [0,0,0]
#   port find: search_type search type 0 - side-to-side, 1 - cross, 2 - both
#   port get: output_type 0 - outlines | 1 - lines | 2 - areas | 3 - volumes | 4 - merged geometry of joints
#   port data: user input_get component to ungroup all the data to the individual data-trees
# ---------- solver: Python ----------
"""get joints ids and connections areas between elements"""

__author__ = "petras vestartas"
__version__ = "2023.04.03"


from ghpythonlib.componentbase import executingcomponent as component
# STEP 0 - Installation, anaconda prompt:
# python -m compas_rhino.install
# python -m compas_rhino.install -p compas_wood
# STEP 1 - check the environment name
# import compas_bootstrapper
# print(compas_bootstrapper.ENVIRONMENT_NAME)
# STEP 2 - import proxy from compas.rpc
# https://compas.dev/compas/latest/tutorial/rpc.html#supported-data-types-1
from compas.rpc import Proxy # https://compas.dev/compas/latest/api/compas.rpc.html
proxy = Proxy('compas_wood.joinery') # import module
from compas_rhino import conversions
from ghpythonlib import treehelpers
import Rhino
import Grasshopper
from Rhino.Geometry import Polyline
# STEP 3 - start server
#proxy.stop_server()
#proxy.start_server()


class connections_zones(component):
    
    bbox = Rhino.Geometry.BoundingBox.Unset
    lines = []
    insertion_vectors_current = []
    joint_per_face_current_text_entity = []
    polylines = []
    
    def DrawViewportWires(self, args):
        #GrasshopperDocument = Grasshopper.Instances.ActiveCanvas.Document
        #is_selected = False
        """
        for _ in GrasshopperDocument.Objects:
            is_selected = _.Attributes.Selected
        """
        #col = args.WireColour_Selected if is_selected else args.WireColour;
        col =  args.WireColour
        line_weight = args.DefaultCurveThickness;
        try:
            for polyline in self.polylines:
                args.Display.DrawPolyline(polyline,  col, line_weight)
            """
            plane = Plane.WorldXY
            for line in self.lines:
                args.Display.DrawLineArrow(line, Color.FromArgb(207, 0, 90), 2, 100)
            for insertionVectorsCurrent in self.insertion_vectors_current:
                if(insertionVectorsCurrent.Length<0.05):
                    continue
                args.Display.DrawLine(insertionVectorsCurrent, Color.FromArgb(0, 0, 0), 5)
            for jointPerFaceCurrent in self.joint_per_face_current_text_entity:
                result, plane = Rhino.RhinoDoc.ActiveDoc.Views.ActiveView.ActiveViewport.GetCameraFrame()
                plane.Origin=(jointPerFaceCurrent.Plane.Origin)
                args.Display.Draw3dText(jointPerFaceCurrent.PlainText, jointPerFaceCurrent.MaskColor, plane, jointPerFaceCurrent.TextHeight, "Arial", False, False,Rhino.DocObjects.TextHorizontalAlignment.Center, Rhino.DocObjects.TextVerticalAlignment.BottomOfTop)
            """
        except Exception, e:
            System.Windows.Forms.MessageBox.Show(str(e), "script error")
    
    def get_ClippingBox(self):
        return self.bbox
    
    def RunScript(self, _data, _join_p, _scale, _extension, _find, _get):
        # ==============================================================================
        # input
        # ==============================================================================
        if(_data is None):
            return
        
        output_polylines = []
        if( _data[0] != 0):
            #convert to compas polylines
            for i in _data[0]:
                for j in i:
                    output_polylines.append(conversions.polyline_to_compas(j))
        
        vectors = []
        if(_data[1] != None):
            for i in _data[1]:
                list = []
                for j in i:
                    list.append(conversions.vector_to_compas(j))
                vectors.append(list)
        
        joint_parameters = [
            300, 0.5, 3,   # 1-9 ss_e_ip (side-to-side edge in-plane)
            50, 0.64, 15,  # 10-19 ss_e_op (side-to-side edge out-of-plane)
            450, 0.5, 20,  # 20-29 ts_e_p (top-to-side edge plane)
            300, 0.5, 30,  # 30-39 cr_c_ip (cross cutting in-plane)
            6, 0.95, 40,   # 40-49 tt_e_p  (top-to-top edge plane)
            300, 0.5, 58,  # 50-59 ss_e_r (side-to-side edge rotated)
            300, 1.0, 60   # 60-69 b (boundary)
        ]
        
        for i in range(0, len(_join_p)):
            joint_parameters[i] = _join_p[i]
        
        search = id = max(min(2, _find), 0)
        
        scale = [1,1,1]
        for i in range(0, len(_scale)):
            scale[i] = _scale[i]
        
        output_type = _get if _get != None else 4
        
        extension = [0,0,0]
        for i in range(0, len(_extension)):
            extension[i] = _extension[i]
        
        
        adjacency = []
        if(len(_data[4])>0):
            for i in _data[4]:
                for j in i:
                    adjacency.append(j)
        
        # ==============================================================================
        # get joints
        # ==============================================================================
        result = proxy.get_connection_zones(
        output_polylines,
        vectors, # output_vectors,
        _data[2], # output_joints_types,
        _data[3], # output_three_valence_element_indices_and_instruction,
        adjacency, # output_adjacency,
        joint_parameters,
        search,
        scale,
        output_type,
        False,
        extension)
        
        
        
        # ==============================================================================
        # output
        # ==============================================================================
        _plines = []
        self.bbox = Rhino.Geometry.BoundingBox.Unset
        # nest two times the result and add to the tree
        for i in range(0, len(result)):
            list = []
            for j in range(0, len(result[i])):
                    list.append(conversions.polyline_to_rhino(result[i][j]))
                    self.polylines.append(list[-1])
                    self.bbox.Union(list[-1].BoundingBox)
            _plines.append(list)
        _cuts = []
        _data = [[_plines,_data[1],_data[2],_data[3],_data[4],_data[5],_cuts]]
        
        return _data
# ---------- end solver ----------
number_slider_5 = Slider(1, range=0..100)
partition = PartitionList(Size=number_slider_4)
python_4 = GhPythonScript(x=solver)  # -> out, a; same code as python_3
item_3 = ListItem(List=python_4.a, Index=0, Wrap=True)
input_get = Input_get(Data=chevron_plates.Data)  # -> Plines, Insertion_vectors, Joints_per_face, Three_valence, Adjacency
panel_4 = Panel(input_get.Three_valence)
branch = TreeBranch(Tree=simplify(partition), Path=number_slider_5, MaintainPaths=True)
python_5 = GhPythonScript(x=item_3)  # -> out, a; same code as python_3
faceb = FaceBoundaries(Mesh=chevron)
loft_m = Loft_mesh()  # -> mesh; inputs p0: list of Curve, p1: list of Curve; disabled
#   port p0: polylines with holes, bottom
#   port p1: polylines with holes, top
#   port mesh: lofted and capped mesh with holes
# ---------- loft_m: Python ----------
"""get joints ids and connections areas between elements"""

__author__ = "petras vestartas"
__version__ = "2023.03.31"

from ghpythonlib.componentbase import executingcomponent as component
import Rhino.RhinoDoc
import Rhino.Geometry
import System
from System.Drawing import Color

class connections_zones(component):


    def to_polyline_from_cp(self, curve):
        
        polyline = Rhino.Geometry.Polyline() 
        result, polyline1 = curve.TryGetPolyline()
        
        if (result == False):
            
            nurbsCurve = curve.ToNurbsCurve()  
            point3dArray = []
            
            for i in range(nurbsCurve.Points.Count):
                result, pt = nurbsCurve.Points.GetPoint(i)
                point3dArray.append(pt)
            
            polyline1 = Rhino.Geometry.Polyline(point3dArray)  
            nurbsCurve = polyline1.ToNurbsCurve()  
            result, polyline1 = nurbsCurve.TryGetPolyline()  
            
            polyline1.CollapseShortSegments(0.01) 
            
            polyline1 = Rhino.Geometry.Polyline(polyline1)  
            polyline = polyline1  
            
        else:
            polyline1.CollapseShortSegments(0.01)  
            polyline = polyline1  
        
        return polyline  

    def loft_polylines_with_holes(self, curves0, curves1):
        """Loft polylines with holes
        
        Parameters
        ----------
        curves0 : list[rg.Polyline]
        curves1 : list[rg.Polyline]
        
        Returns
        -------
        rg.Mesh
            mesh as lofted polylines and cap them
        """
        
        ###############################################################################
        # user input
        ###############################################################################
        
        flag = len(curves0) is not 0 if True else len(curves1) != 0
        if (flag):
            
            curves = []
            curves2 = []
            
            flag0 = len(curves1) == 0
            flag1 = len(curves0) == 0 and len(curves1) != 0
            flag2 = len(curves0) and len(curves1)
            
            if (flag0):
                for i in range(len(curves0)):
                    if (float(i) >= float(len(curves0)) * 0.5):
                        curves2.Add(curves0[i])
                    else:
                        curves.Add(curves0[i])
            elif (flag1):
                for i in range(0, len(curves1), 2):
                    curves.Add(curves1[i])
                    curves2.Add(curves1[i + 1])
            elif (flag2):
                curves = curves0
                curves2 = curves1
            
            curves0 = curves
            curves1 = curves2
        
        ###############################################################################
        # sort curves which one is border and which ones are holes
        ###############################################################################
        length = -1.0
        border_id = -1
        count = 0
        numArray = []
        for curve in curves0:
            diagonal = curve.GetBoundingBox(True).Diagonal
            temp_length = diagonal.Length
            if temp_length > length:
                length = temp_length
                border_id = count
            count=count+1
        
        
        border0 = self.to_polyline_from_cp(curves0[border_id])
        border1 = self.to_polyline_from_cp(curves1[border_id])
        holes0 = []
        holes1 = []
        for i in range(curves0.Count):
            if (i != border_id):
                holes0.Add(curves0[i])
                holes1.Add(curves1[i])
        
        ###############################################################################
        # Create mesh of the bottom face
        ###############################################################################
        mesh_bottom = Rhino.Geometry.Mesh.CreatePatch(border0, Rhino.RhinoDoc.ActiveDoc.ModelAngleToleranceRadians, None, holes0, None, None, True, 1)
        
        ###############################################################################
        # Convert closed polylines to open ones
        ###############################################################################
        
        point_3d_array = []
        for i in range(len(mesh_bottom.Vertices)):
            point_3d_array.append(mesh_bottom.Vertices.Point3dAt(i))
        
        open_curve_points_0 = []
        open_curve_points_1 = []
        
        for i in range(border0.Count-1):
            open_curve_points_0.append( border0[i])
            open_curve_points_1.append( border1[i])
        
        for i in range(holes0.Count):
            holes0_polyline = self.to_polyline_from_cp(holes0[i]) 
            holes1_polyline = self.to_polyline_from_cp(holes1[i]) 
            for j in range(len(holes0_polyline)-1):
                open_curve_points_0.append(holes0_polyline[j])
                open_curve_points_1.append(holes1_polyline[j])
        
        ###############################################################################
        # Using the bottom mesh vertices create the top mesh f
        ###############################################################################
        points_to_sort_new = self.sort_set_of_points(open_curve_points_0, point_3d_array)
        mesh_top = mesh_bottom.DuplicateMesh()
        
        for i in range(len(points_to_sort_new)):
            mesh_top.Vertices.SetVertex(i, open_curve_points_1[points_to_sort_new[i]])
        
        ###############################################################################
        # Merge the top and bottom mesh into one and add sides
        ###############################################################################
        mesh = Rhino.Geometry.Mesh()
        mesh.Append(mesh_bottom)
        mesh.Append(mesh_top)
        
        count = mesh_bottom.Vertices.Count
        for p in range (mesh_bottom.TopologyEdges.Count):
            
            if (mesh_bottom.TopologyEdges.GetConnectedFaces(p).Length == 1):
                topologyVertices = mesh_bottom.TopologyEdges.GetTopologyVertices(p)
                mesh.Faces.AddFace(topologyVertices.I, topologyVertices.J, topologyVertices.J + count, topologyVertices.I + count)
        
        mesh.UnifyNormals()
        mesh.Ngons.AddPlanarNgons(Rhino.RhinoDoc.ActiveDoc.ModelAbsoluteTolerance * 1, 3, 1, True)
        
        ###############################################################################
        # Unweld ngons meshes
        ###############################################################################
        unwelded_ngon_mesh = Rhino.Geometry.Mesh()
        count = 0
        for ngonAndFacesEnumerable in mesh.GetNgonAndFacesEnumerable():
            
            faces = []
            for j in ngonAndFacesEnumerable.FaceIndexList():
                faces.append(System.Int32(j))
            
            temp_ngon_mesh = mesh.DuplicateMesh().Faces.ExtractFaces(faces)
            
            #add colors
            if(count<2):
                temp_ngon_mesh.VertexColors.CreateMonotoneMesh(Color.DeepPink)
            else:
                temp_ngon_mesh.VertexColors.CreateMonotoneMesh(Color.LightGray)
            
            unwelded_ngon_mesh.Append(temp_ngon_mesh)
            count = count + 1
        
        ###############################################################################
        # Output
        ###############################################################################
        unwelded_ngon_mesh.RebuildNormals()
        return unwelded_ngon_mesh




    def sort_set_of_points(self, points_to_sort, guide_points):
        """Sort one array of point by an another point array
        
        use it like this: 
        #points_to_sort_new = []
        #for i in points_to_sort_ids:
        #    points_to_sort_new.append(points_to_sort[i])
        
        Parameters
        ----------
        points_to_sort : list[rg.Point3d]
        guide_points : list[rg.Point3d]
        
        Returns
        -------
        list[int]
            the list of indices of the sorted array
        """
        
        # create a copy
        points_to_sort_copy = []
        for i in points_to_sort:
            points_to_sort_copy.append(Rhino.Geometry.Point3d(i))
        
        guide_points_copy = []
        for i in guide_points:
            guide_points_copy.append(Rhino.Geometry.Point3d(i))
        
        # make indices of points
        points_to_sort_ids = list(range(0,len(points_to_sort_copy)))
        guide_points_ids = list(range(0,len(guide_points_copy)))
        
        # sort both lists by xyz coordinates together with indices
        points_to_sort_copy, points_to_sort_ids = zip(*sorted(zip(points_to_sort_copy, points_to_sort_ids)))
        guide_points_copy, guide_points_ids = zip(*sorted(zip(guide_points_copy, guide_points_ids)))
        
        # sort guide points indices and order the points to sort indec
        guide_points_ids, points_to_sort_ids = zip(*sorted(zip(guide_points_ids, points_to_sort_ids)))
        
        # can be used like this:
        #points_to_sort_new = []
        #for i in points_to_sort_ids:
        #    points_to_sort_new.append(points_to_sort[i])
        
        return points_to_sort_ids

    def RunScript(self, _p0, _p1):
        if _p0 and _p1:
            return self.loft_polylines_with_holes(_p0, _p1)
# ---------- end loft_m ----------
faceb_2 = FaceBoundaries(Mesh=python_2)
crv_3 = Curve(branch)
python_6 = GhPythonScript(x=python_5.a)  # -> out, a; same code as python_3
xy = XYPlane(Origin=Point(0, 0, 0))
number_slider_6 = Slider(4, range=0..100)
crv_4 = Curve(input_get.Plines)
item_4 = ListItem(List=faceb_2, Index=0, Wrap=True)
item_5 = ListItem(List=faceb, Index=0, Wrap=True)
orient_data = Orient_data(data=solver, planes=xy, ids=Slider(1, range=0..1))  # -> plines_o; inputs planes: list of Plane, ids: list of Int32
#   port data: collection of inputs that represent the elements, insertion vectors, joint types and adjacency, use input_set commonent to group these inputs
#   port planes: target planes for orientation of elements
#   port ids: indices to orient only certain elements
#   port plines_o: oriented outlines using plane to plane transformation
# ---------- orient_data: Python ----------
__author__ = "petras"
__version__ = "2023.04.02"

import System
import Rhino
import rhinoscriptsyntax as rs
import ghpythonlib.treehelpers as th
from Rhino.Geometry import Polyline
from Rhino.Geometry import Transform
from Rhino.Geometry import Vector3d
#import Grasshopper
from Rhino.Geometry import Plane

from ghpythonlib.componentbase import executingcomponent as component
import Grasshopper, GhPython
import System
import Rhino
import rhinoscriptsyntax as rs

class MyComponent(component):
    
    def get_plane(self, _polyline, _orientation_point):
        
        len = _polyline.Count - 1
        normal = Vector3d(0,0,0)
        
        for i in range((_polyline.Count - 1)):
            num = ((i - 1) + len) % len
            item1 = ((i + 1) + len) % len
            point3d =_polyline[num]
            point3d1 =_polyline[item1]
            item2 = _polyline[i]
            normal = normal + Vector3d.CrossProduct(Vector3d(item2 - point3d), Vector3d(point3d1 - item2))
        
        normal.Unitize()
        plane = Plane(_polyline.CenterPoint(), normal)
        if(plane.DistanceTo(_orientation_point)<0):
            plane.Flip()
        
        return plane
    
    def RunScript(self, _data, _planes, _ids):
        
        if(_data is None):
            return
        
        target_planes = _planes if len(_planes) > 0 else [Plane.WorldXY]
        _plines =  Grasshopper.DataTree[Polyline]()
        
        if(len(_ids)==0 or len(_planes) != len(_ids)):
            
            for i in range(len(_data[0])):
                xform = Transform.PlaneToPlane(self.get_plane(_data[0][i][0],_data[0][i][1][0]),target_planes[i%len(target_planes)])
                    
                for j in range(len(_data[0][i])):
                    polyline_copy = Polyline(_data[0][i][j])
                    polyline_copy.Transform(xform)
                    _plines.Add(polyline_copy,Grasshopper.Kernel.Data.GH_Path(i))
        else:
            total_element_count = len(_data[0])
            for i in range(len(_ids)):
                local_id = _ids[i]
                if(local_id >= total_element_count or local_id < 0 ):
                    continue
                xform = Transform.PlaneToPlane(self.get_plane(_data[0][local_id][0],_data[0][local_id][1][0]),target_planes[i%len(target_planes)])
                for j in range(len(_data[0][local_id])):
                    polyline_copy = Polyline(_data[0][local_id][j])
                    polyline_copy.Transform(xform)
                    _plines.Add(polyline_copy,Grasshopper.Kernel.Data.GH_Path(i))
        
        _plines_oriented = _plines
        
        """
        _data_xform = _plines
        _insertion_vectors =  th.list_to_tree(_data[1])
        _joints_per_face =  th.list_to_tree(_data[2])
        _three_valence = th.list_to_tree(_data[3])
        _adjacency =th.list_to_tree(_data[4])
        """
        
        # return outputs if you have them; here I try it for you:
        return _plines_oriented
# ---------- end orient_data ----------
panel_5 = Panel(python_5.a)
partition_2 = PartitionList(List=flatten(input_get.Plines), Size=number_slider_4)
assembly_2 = Assembly()  # inputs dir: list of Line, n: Int32
#   port data: collection of inputs that represent the elements, insertion vectors, joint types and adjacency, use input_set commonent to group these inputs
# ---------- assembly_2: Python ----------
__author__ = "petras"
__version__ = "2023.04.02"

from ghpythonlib.componentbase import executingcomponent as component
import Grasshopper, GhPython
import System
import Rhino
import rhinoscriptsyntax as rs


import rhinoscriptsyntax as rs
import Rhino.Geometry as rg
from Rhino.Geometry import BoundingBox
from Rhino.Geometry import Point3d
from Rhino.Geometry import Plane
from Rhino.Geometry import Polyline
from Rhino.Geometry import Vector3d
from Rhino.Geometry import Line
from Rhino.Geometry import TextEntity
from Rhino.Geometry import Transform
from System.Drawing import Color
import math

class MyComponent(component):
    
    bbox = BoundingBox.Unset
    lines = []
    insertion_vectors_current = []
    joint_per_face_current_text_entity = []
    polylines = []
    
    def DrawViewportWires(self, args):
        try:
            plane = Plane.WorldXY
            for line in self.lines:
                args.Display.DrawLineArrow(line, Color.FromArgb(207, 0, 90), 2, 100)
            for polyline in self.polylines:
                args.Display.DrawPolyline(polyline, Color.FromArgb(207, 0, 90), 2)
            for insertionVectorsCurrent in self.insertion_vectors_current:
                if(insertionVectorsCurrent.Length<0.05):
                    continue
                args.Display.DrawLine(insertionVectorsCurrent, Color.FromArgb(0, 0, 0), 5)
            for jointPerFaceCurrent in self.joint_per_face_current_text_entity:
                result, plane = Rhino.RhinoDoc.ActiveDoc.Views.ActiveView.ActiveViewport.GetCameraFrame()
                plane.Origin=(jointPerFaceCurrent.Plane.Origin)
                args.Display.Draw3dText(jointPerFaceCurrent.PlainText, jointPerFaceCurrent.MaskColor, plane, jointPerFaceCurrent.TextHeight, "Arial", False, False,Rhino.DocObjects.TextHorizontalAlignment.Center, Rhino.DocObjects.TextVerticalAlignment.BottomOfTop)
        except Exception, e:
            System.Windows.Forms.MessageBox.Show(str(e), "script error")
    
    def get_ClippingBox(self):
        return Rhino.Geometry.BoundingBox()
    
    
            
    def display_insersion_sequence(self, _data, _lines, _n, _t):
        
        text_size = 50
        line_scale = 300
        
        ###############################################################################
        # input
        ###############################################################################
        self.bbox = BoundingBox.Unset
        self.lines =  _lines if len(_lines) > 0 else [Line(Point3d(0,0,0),Point3d(0,0,1))]
        self.insertion_vectors_current =  []
        self.joint_per_face_current_text_entity = []
        self.polylines =  []
        
        group_count = _n if _n is not None else 4
        t = _t if _t is not None else 0.0
        item = self.lines[0]
        self.bbox = self.lines[0].BoundingBox
        
        ###############################################################################
        # process
        ###############################################################################
        for i in range(1,len(self.lines)) :
            self.bbox.Union(self.lines[i].BoundingBox)
        
        for i in range(0,int(math.floor(t)))  :
            for j in range(group_count) :
                for pline in _data[0][i * group_count + j]:
                    self.polylines.append(pline) 
        
        if (t % 1 > 0):
            
            id2 = int(math.floor(t))
            polylines_current = []
            
            for i in range(group_count):
                for pline in (_data[0][id2 * group_count + i]):
                    polylines_current.append(pline)
            
            for m in range(len(polylines_current)) :
                
                item = self.lines[id2]
                line_from = item.From
                item = self.lines[id2]
                to = line_from - item.To
                
                polyline = polylines_current[m].Duplicate()
                polyline.Transform(Transform.Translation(to * (1 - t % 1)))
                polylines_current[m] = polyline
            
            for i in polylines_current:
                self.polylines.append(i)
            
            for n in range(0,polylines_current.Count,2) :
                
                point3ds =  [polylines_current[n].CenterPoint(),  polylines_current[n + 1].CenterPoint()]
                
                for o in range(0, polylines_current[n].Count - 1):
                    p0 = (polylines_current[n][o] + polylines_current[n][o + 1]) * 0.5
                    p1 = (polylines_current[n + 1][o] + polylines_current[n + 1][o + 1]) * 0.5
                    pmid = (p0+p1)*0.5
                    point3ds.append(pmid)
                
                for p in range(len(point3ds)):
                    
                    face_vectors = _data[1][id2 * 4 + int(n * 0.5)][p]
                    
                    if (face_vectors == Vector3d.Zero)  :
                        face_vectors =  Vector3d(0, 0, 0.0001)
                    
                    self.insertion_vectors_current.Add( Line(point3ds[p]+ (face_vectors * line_scale*0.25), point3ds[p] + (face_vectors * line_scale)))
                    text = str(_data[2][int(n * 0.5)][p])
                    textEntity = TextEntity()
                    textEntity.Plane=( Plane(point3ds[p], Vector3d.ZAxis))
                    textEntity.PlainText=(text)
                    
                    
                    if(_data[2][int(n * 0.5)][p] > 0):
                        textEntity.MaskColor=(Color.FromArgb( 0,0,0))
                        textEntity.TextHeight=((float)(text_size))
                    else:
                        textEntity.MaskColor=(Color.FromArgb( 100,100,100))
                        textEntity.TextHeight=((float)(text_size*0.5))
                    self.joint_per_face_current_text_entity.Add(textEntity)

        # return outputs if you have them here I try it for you:
        return 
    
    def RunScript(self, _data, _dir, _n, _t):
        self.display_insersion_sequence(_data, _dir, _n, _t)
# ---------- end assembly_2 ----------
branch_2 = TreeBranch(Tree=simplify(python_6.a), Path=Slider(3, range=0..100), MaintainPaths=True)
dispatch = Dispatch(List=python_6.a, DispatchPattern=[True, False])  # -> ListA, ListB
item_6 = ListItem(List=branch_2, Index=0, Wrap=True)  # -> Item, Item1
assembly_3 = Assembly(Data=chevron_plates.Data, Dir=chevron_plates.Dir, N=4, T=Slider(2, range=0..100))
branch_3 = TreeBranch(Tree=simplify(partition_2), Path=number_slider_5, MaintainPaths=True)
loft_m_2 = Loft_mesh(p0=dispatch.ListA, p1=dispatch.ListB)  # -> mesh; inputs p0: list of Curve, p1: list of Curve; same code as loft_m
crv_5 = Curve(branch_3)
python_7 = GhPythonScript()  # -> out, a
# ---------- python_7: Python ----------
from collections import OrderedDict

dict = OrderedDict()
dict[2] = "a"
dict[1] = "c"
dict[3] = "e"
print(dict)
# ---------- end python_7 ----------
assembly_4 = Assembly()  # inputs dir: list of Line, n: Int32; same code as assembly_2
