# Grasshopper definition cloud test.gh (Grasshopper 1.0.7)

python = GhPythonScript(y=Slider(3, range=0..10))  # -> out, a
# ---------- python: Python ----------
from compas_cloud import Proxy
from compas.geometry import Translation
import compas_wood

proxy = Proxy()
rpc_test = proxy.function('compas_wood.cpp.rpc_test')
a = rpc_test()
"""
transform_points_numpy = proxy.function('compas.geometry.transform_points_numpy')
# create a proxy funciton

pts = [[0,0,0], [1,0,0]]
T = Translation([100, 0, 0]).matrix
transform_points_numpy(pts, T) # call the function through proxy
print(result)
# will print: [[100.0, 0.0 ,0.0], [101.0, 0.0, 0.0]]
"""
# ---------- end python ----------
