# Grasshopper definition development.ghx (Grasshopper 1.0.7)
# plug-ins: compas_wood

crv = Curve([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])
# GET CONNECTION ZONES
crv_2 = Curve([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])
cp_lines = Closest_lines(Polylines=crv_2, Lines=crv)  # -> Polylines, Vectors
connection_zones = Connection_zones(polylines=crv_2, vectors=cp_lines.Vectors, output=Slider(2, range=0..10))  # -> polylines_out, cut_types; inputs polylines: tree of Polyline, id: Int32, vectors: tree of Vector3d, joint_types: tree of Int32, three_valence: tree of Int32, adjacency: list of Int32, params: list, scale: list of Int32, output: Int32, search: Int32, extension: list of Int32
#   port polylines: a data-tree of polyline pairs
#   port id: index of xml file, if _polylines are not given
#   port vectors: insertion direction
#   port joint_types: joint type per side, top, bottom, and sides
#   port three_valence: three valance joinery that starts 0 - Vidy, 1 - Annen, and 4 indices current, next, current-neighbor, next-neighbor
#   port adjacency: joint parameters
#   port params: joint parameters
#   port scale: scale of joint, default is [1,1,1]
#   port output: output_type 0 - outlines | 1 - lines | 2 - areas | 3 - volumes | 4 - merged geometry of joints
#   port search: search_type search type 0 - side-to-side, 1 - cross, 2 - both
#   port extension: extension by distance, plates often has [0,0,10], whereas beams [10,10,10], default is [0,0,0]
#   port polylines_out: polyline input
# ---------- connection_zones: Python ----------
"""get joints ids and connections areas between elements"""

__author__ = "petras vestartas"
__version__ = "2023.03.29"


from ghpythonlib.componentbase import executingcomponent as component
# STEP 0 - Installation, anaconda prompt:
# python -m compas_rhino.install
# python -m compas_rhino.install -p compas_wood
# STEP 1 - check the environment name
# import compas_bootstrapper
# print(compas_bootstrapper.ENVIRONMENT_NAME)
# STEP 2 - import proxy from compas.rpc
# https://compas.dev/compas/latest/tutorial/rpc.html#supported-data-types-1
from compas.rpc import Proxy # https://compas.dev/compas/latest/api/compas.rpc.html
proxy = Proxy('compas_wood.joinery') # import module
from compas_rhino import conversions
from ghpythonlib import treehelpers
import Rhino
import Grasshopper as gh

# STEP 3 - start server
#proxy.stop_server()
#proxy.start_server()


class connections_zones(component):
    def RunScript(self, _polylines, _id, _vectors, _joint_types, _three_valence, _adjacency, _params, _scale, _output, _search, _extension):
        # ==============================================================================
        # input
        # ==============================================================================
        output_polylines = []
        if( _polylines.AllData().Count!= 0):
            print("user_input")
            #convert to compas polylines
            for i in _polylines.AllData():
                output_polylines.append(conversions.polyline_to_compas(i))
        else:
            print("xml_input")
            feasible_ids = [1,3,7,10,11,12,14,16,17,18,19,20,21,22,23,24,25,27,28,29,30,31,34,36,37]
            
            # read the xml file and get a data-set
            foldername = (
                proxy.get_cwd()+"/frontend/src/wood/dataset/" 
            )
            
            # read polylines from an xml files
            id = feasible_ids[max(min(24, _id), 0)]
            filename_of_dataset = proxy.get_filenames_of_datasets()[id]
            output_polylines = proxy.read_xml_polylines(foldername, filename_of_dataset)
        
        vectors = []
        if(_vectors != None):
            for i in range (_vectors.BranchCount):
                list = []
                for j in _vectors.Branch(i):
                    list.append(conversions.vector_to_compas(j))
                vectors.append(list)
        
        
        joint_parameters = [
            300, 0.5, 3,   # 1-9 ss_e_ip (side-to-side edge in-plane)
            50, 0.64, 15,  # 10-19 ss_e_op (side-to-side edge out-of-plane)
            450, 0.5, 20,  # 20-29 ts_e_p (top-to-side edge plane)
            300, 0.5, 30,  # 30-39 cr_c_ip (cross cutting in-plane)
            6, 0.95, 40,   # 40-49 tt_e_p  (top-to-top edge plane)
            300, 0.5, 58,  # 50-59 ss_e_r (side-to-side edge rotated)
            300, 1.0, 60   # 60-69 b (boundary)
        ]
        
        for i in range(0, len(_params)):
            joint_parameters[i] = _params[i]
        print(joint_parameters)
        search = id = max(min(2, _search), 0)
        
        scale = [1,1,1]
        for i in range(0, len(_scale)):
            scale[i] = _scale[i]
        
        output_type = _output if _output != None else 4
        
        extension = [0,0,0]
        for i in range(0, len(_extension)):
            extension[i] = _extension[i]
        
        joint_types = []
        if(_joint_types.DataCount != 0):
            treehelpers.tree_to_list(_joint_types)
        
        three_valence = []
        if(_three_valence.DataCount != 0):
            three_valence = treehelpers.tree_to_list(_three_valence)
        
        # ==============================================================================
        # get joints
        # ==============================================================================
        result = proxy.get_connection_zones(
        output_polylines,
        vectors, # output_vectors,
        joint_types, # output_joints_types,
        three_valence, # output_three_valence_element_indices_and_instruction,
        _adjacency, # output_adjacency,
        joint_parameters,
        search,
        scale,
        output_type,
        False,
        extension)
        
        
        
        # ==============================================================================
        # output
        # ==============================================================================
        _polylines_out = gh.DataTree[Rhino.Geometry.Polyline]()
        
        # nest two times the result and add to the tree
        for i in range(0, len(result)):
            for j in range(0, len(result[i])):
                    _polylines_out.Add(conversions.polyline_to_rhino(result[i][j]), gh.Kernel.Data.GH_Path(i))
        
        _cut_type = []
        
        return _polylines_out, _cut_type
# ---------- end connection_zones ----------
boundary = BoundarySurfaces(Edges=connection_zones.polylines_out)
branch = TreeBranch(Tree=connection_zones.polylines_out, Path=Slider(2, range=0..2), MaintainPaths=True)

# ----
# JOINTS
crv_3 = Curve([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])
joints = Joints(polylines=crv_3)  # -> polylines_out, element_pairs, joint_areas, joint_areas_mesh, joint_types, element_neighbors; inputs polylines: tree of Polyline, id: Int32
#   port polylines: a data-tree of polyline pairs
# ---------- joints: Python ----------
"""get joints ids and connections areas between elements"""

__author__ = "petras vestartas"
__version__ = "2023.03.29"


from ghpythonlib.componentbase import executingcomponent as component
# STEP 0 - Installation, anaconda prompt:
# python -m compas_rhino.install
# python -m compas_rhino.install -p compas_wood
# STEP 1 - check the environment name
# import compas_bootstrapper
# print(compas_bootstrapper.ENVIRONMENT_NAME)
# STEP 2 - import proxy from compas.rpc
# https://compas.dev/compas/latest/tutorial/rpc.html#supported-data-types-1
from compas.rpc import Proxy # https://compas.dev/compas/latest/api/compas.rpc.html
proxy = Proxy('compas_wood.joinery') # import module
from compas_rhino import conversions
from ghpythonlib import treehelpers
import Rhino
import Grasshopper as gh

# STEP 3 - start server
#proxy.stop_server()
#proxy.start_server()

class joints(component):
    def RunScript(self, _polylines, _id):
        # ==============================================================================
        # input
        # ==============================================================================
        output_polylines = []
        if( _polylines.AllData().Count!= 0):
            print("user_input")
            #convert to compas polylines
            for i in _polylines.AllData():
                output_polylines.append(conversions.polyline_to_compas(i))
        else:
            print("xml_input")
            feasible_ids = [1,3,7,10,11,12,14,16,17,18,19,20,21,22,23,24,25,27,28,29,30,31,34,36,37]
            
            # read the xml file and get a data-set
            foldername = (
                proxy.get_cwd()+"/frontend/src/wood/dataset/" 
            )
            
            # read polylines from an xml files
            id = feasible_ids[max(min(24, _id), 0)]
            filename_of_dataset = proxy.get_filenames_of_datasets()[id]
            output_polylines = proxy.read_xml_polylines(foldername, filename_of_dataset)
        
        # ==============================================================================
        # get joints
        # ==============================================================================
        element_pairs_list, joint_areas_polylines, joint_types = proxy.joints(output_polylines, 2) 
        
        
        # ==============================================================================
        # output
        # ==============================================================================
        _element_pairs = treehelpers.list_to_tree(element_pairs_list)
        
        # iterate joints add neighbors to individual elements element
        _element_neighbors = gh.DataTree[int]()
        for i in element_pairs_list:
            _element_neighbors.Add(i[1],gh.Kernel.Data.GH_Path(i[0]))
            _element_neighbors.Add(i[0],gh.Kernel.Data.GH_Path(i[1]))
        
        
        _joint_areas = []
        _joint_areas_mesh = []
        for i in joint_areas_polylines:
            polyline = conversions.polyline_to_rhino(i)
            polyline.MergeColinearSegments(0.02, True)
            polyline.CollapseShortSegments(0.02)
            _joint_areas.append(polyline)
            _joint_areas_mesh.append(Rhino.Geometry.Mesh.CreateFromClosedPolyline(polyline))
        
        remap_joint_types = {11: 1, 12: 0, 13: 5, 20: 2, 30: 3, 40: 4}
        _joint_types = []
        for i in joint_types:
            _joint_types.append(remap_joint_types[i])
        
        _polylines_out = []
        for i in output_polylines:
            _polylines_out.append(conversions.polyline_to_rhino(i))
        
        return _polylines_out, _element_pairs, _joint_areas, _joint_areas_mesh, _joint_types, _element_neighbors
# ---------- end joints ----------
partition = PartitionList(List=joints.polylines_out, Size=2)  # -> simplify(Chunks)

# ---- group: Display Joint Types
ss_e_ip = ColourSwatch(SwatchColor=RGB(237, 213, 0))
ss_e_op = ColourSwatch(SwatchColor=RGB(255, 98, 0))
ts_e_p = ColourSwatch(SwatchColor=RGB(0, 191, 255))
cr_c_ip = ColourSwatch(SwatchColor=RGB(27, 209, 151))
tt_e_p = ColourSwatch(SwatchColor=RGB(207, 0, 114))
ss_e_r = ColourSwatch(SwatchColor=RGB(94, 15, 219))
b = ColourSwatch(SwatchColor=RGB(0, 0, 0))
merge = Merge(Data1=ss_e_ip, Data2=ss_e_op, Data3=ts_e_p, Data4=cr_c_ip, Data5=tt_e_p, Data6=ss_e_r, Data7=b)
item = ListItem(List=merge, Index=joints.joint_types, Wrap=True)
mcol = MeshColours(Mesh=graft(joints.joint_areas_mesh), Colours=graft(item))

# ----
# INTERNALIZED DATA
chevron_surfaces = Chevron_surfaces([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])

# ---- group: Element Neighbors
number_slider = Slider(0, range=0..8)
branch_2 = TreeBranch(Tree=partition, Path=number_slider, MaintainPaths=True)
branch_3 = TreeBranch(Tree=joints.element_neighbors, Path=number_slider, MaintainPaths=True)
branch_4 = TreeBranch(Tree=partition, Path=branch_3, MaintainPaths=True)
boundary_2 = BoundarySurfaces(Edges=branch_2)
boundary_3 = BoundarySurfaces(Edges=branch_4)
mcol_2 = MeshColours(Mesh=boundary_3, Colours=ColourSwatch(SwatchColor=RGB(0, 170, 255)))
mcol_3 = MeshColours(Mesh=boundary_2, Colours=ColourSwatch(SwatchColor=RGB(255, 0, 161)))

# ---- group: Element Pairs
branch_5 = TreeBranch(Tree=simplify(joints.element_pairs), Path=Slider(5, range=0..8), MaintainPaths=True)
item_2 = ListItem(List=branch_5, Index=[0, 1], Wrap=True)
branch_6 = TreeBranch(Tree=partition, Path=item_2, MaintainPaths=True)
bang = ExplodeTree(Data=branch_6)  # -> Branch0, Branch1
boundary_4 = BoundarySurfaces(Edges=bang.Branch0)
boundary_5 = BoundarySurfaces(Edges=bang.Branch1)
# [  ] - 10 Components to rewrite
# [  ] - separate files into example files
# [  ] - document components on the github
# [  ] - add folding components: a) hex divide and profile extrude
mcol_4 = MeshColours(Mesh=boundary_4, Colours=ColourSwatch(SwatchColor=RGB(255, 0, 161)))
mcol_5 = MeshColours(Mesh=boundary_5, Colours=ColourSwatch(SwatchColor=RGB(0, 170, 255)))

# ----
python = GhPythonScript()  # -> Out, _f, _f_pl, _f_id, _e, _e_pl, _e_id
python_2 = GhPythonScript()  # -> Out, _data, _dir
python_3 = GhPythonScript()  # -> Out, _mesh

# ---- group: chevron
chevron = Chevron(
    U_divisions=Slider(4, range=1..20),
    V_division_dist=Slider(900, range=900..1000),
    Shift=Slider(0.5, range=0.5..1),
    Scale=Slider(0.05799, range=0.05..0.06))

# ---- group: connectors
connectors = Connectors(
    Face_positions=Slider(0, range=-10..10),
    Face_thickness=Slider(4, range=0..10),
    Divisions=Slider(2, range=1..10),
    Division_len=Slider(15, range=1..100),
    Rect_width=Slider(12, range=-20..20),
    Rect_height=Slider(12, range=-20..20),
    Rect_thickness=Slider(1, range=1..2))  # -> F, F_pl, F_id, E, E_pl, E_id

# ---- group: chevron_plates
chevron_plates = Chevron_plates(
    Edge_rotation=Slider(1, range=0..10),
    Edge_offset=Slider(0.5, range=0..2.5),
    Box_height=Slider(760, range=100..1000),
    Top_plate_inlet=Slider(80, range=0..100),
    Plate_thickness=Slider(40, range=1..40),
    Ortho=True)  # -> Data, Dir

# ----
python_4 = GhPythonScript()  # -> Out, _polylines_out, _joints_types_out
python_5 = GhPythonScript()  # -> Out, _polylines_out, _vectors
cp_lines_2 = Closest_indexed_points()  # -> Polylines, Ints
cp_lines_3 = Closest_lines()  # -> Polylines, Vectors
input_get = Input_get()  # -> Plines, Insertion_vectors, Joints_per_face, Three_valence, Adjacency
input_set = Input_set()
solver = Solver(Find=0, Get=4)
python_6 = GhPythonScript()  # -> Out, _data_out
python_7 = GhPythonScript()  # -> Out, _plines, _insertion_vectors, _joints_per_face, _three_valence, _adjacency
python_8 = GhPythonScript()  # -> Out, _data
assembly = Assembly(N=4)
loft = Loft()
python_9 = GhPythonScript()
python_10 = GhPythonScript()

# ----
# JOINT PARAMETERS
ss_e_ip_2 = Panel("""300
0.5
3""")
ss_e_op_2 = Panel("""50
0.64
15""")
ts_e_p_2 = Panel("""450
0.5
20""")
cr_c_ip_2 = Panel("""300
0.5
30""")
tt_e_p_2 = Panel("""6
0.95
40""")
ss_e_r_2 = Panel("""300
0.5
58""")
b_2 = Panel("""300
1.0
60""")

joint_parameters = Joint_parameters(ss_e_ip=ss_e_ip_2, ss_e_op=ss_e_op_2, ts_e_p=ts_e_p_2, cr_c_ip=cr_c_ip_2, tt_e_p=tt_e_p_2, ss_e_r=ss_e_r_2, b=b_2)  # -> joint_p; inputs ss_e_ip: list, ss_e_op: list, ts_e_p: list, cr_c_ip: list, tt_e_p: list, ss_e_r: list, b: list
#   port ss_e_ip: side-to-side in-plane joint parameters
# ---------- joint_parameters: Python ----------
__author__ = "petras vestartas"
__version__ = "2023.03.29"

"""
Output joint parameters in one list
"""
from ghpythonlib.componentbase import executingcomponent as component


class joint_parameters_component(component):
    def RunScript(
        self,
        _ss_e_ip,
        _ss_e_op,
        _ts_e_p,
        _cr_c_ip,
        _tt_e_p,
        _ss_e_r,
        _b

    ):
        
        joint_parameters = [
            300, 0.5, 3,   # 1-9 ss_e_ip (side-to-side edge in-plane)
            50, 0.64, 15,  # 10-19 ss_e_op (side-to-side edge out-of-plane)
            450, 0.5, 20,  # 20-29 ts_e_p (top-to-side edge plane)
            300, 0.5, 30,  # 30-39 cr_c_ip (cross cutting in-plane)
            6, 0.95, 40,   # 40-49 tt_e_p  (top-to-top edge plane)
            300, 0.5, 58,  # 50-59 ss_e_r (side-to-side edge rotated)
            300, 1.0, 60   # 60-69 b (boundary)
        ]

        for i in range(len(_ss_e_ip)):
            joint_parameters[0*3+i] = _ss_e_ip[i]

        for i in range(len(_ss_e_op)):
            joint_parameters[1*3+i] = _ss_e_op[i]

        for i in range(len(_ts_e_p)):
            joint_parameters[2*3+i] = _ts_e_p[i]

        for i in range(len(_cr_c_ip)):
            joint_parameters[3*3+i] = _cr_c_ip[i]

        for i in range(len(_tt_e_p)):
            joint_parameters[4*3+i] = _tt_e_p[i]

        for i in range(len(_ss_e_r)):
            joint_parameters[5*3+i] = _ss_e_r[i]

        for i in range(len(_b)):
            joint_parameters[6*3+i] = _b[i]

        _joint_p = joint_parameters

        return _joint_p
# ---------- end joint_parameters ----------

panel = Panel(joint_parameters)
