# Grasshopper definition development_optimization_temp.gh (Grasshopper 1.0.7)
# plug-ins: compas_wood

python = GhPythonScript()  # -> out, f, f_pl, f_id, e, e_pl, e_id; inputs mesh: Mesh, divisions: Int32, edge_vectors: list of Line, projection: list of Brep
# ---------- python: Python ----------
__author__ = "petra"
__version__ = "2023.04.05"

class case_2_vda:
    
    self.m = None
    self.s = None
    self.face_thickness = 1
    self.face_positions = []
    self.projection_breps = []
    self.edge_divisions = []
    self.edge_division_len = []
    self.insertion_vectors = []

    # indices
    self.has_ngons = False
    self.f = 0
    self.e = 0
    self.f_v = [[]]
    self.f_e = [[]]
    self.e_f = [[]]
    self.e_ngon_e = {}
    self.rect_width = 1
    self.rect_height = 1
    self.rect_thickness = 1

    # planes
    self.f_planes = []
    self.fe_planes = [[]]
    self.bi_planes = [[]]
    self.e90_planes = []
    self.e90_multiple_planes = [[]]
    self.e_lines = []

    # output
    # polylines
    self.f_polylines_index = [[]]
    self.f_polylines_planes = [[]]
    self.f_polylines = [[]]
    self.e_polylines_index = [[]]
    self.e_polylines_planes = [[]]
    self.e_polylines = [[]]
    
    def __init__(self, m, s, face_thickness, face_positions, edge_divisions, edge_division_len, insertion_vectors, rect_width, rect_height,rect_thickness, chamfer, projection_breps):
        if m is None:
            return
        
        if not m.IsValid:
            return
        
        m.Weld(0.01)
        m.RebuildNormals()
        self.m = m.DuplicateMesh()
        self.s = s
        self.face_thickness = face_thickness
        self.face_positions = face_positions
        self.face_positions.sort()
        
        if len(self.face_positions) == 0:
            self.face_positions = [0]
        
        self.projection_breps = projection_breps
        self.edge_divisions = edge_divisions
        self.edge_division_len = edge_division_len
        self.edge_division_len = edge_division_len
        self.has_ngons = len(m.Ngons) > 0
        self.rect_width = rect_width
        self.rect_height = rect_height
        self.rect_thickness = rect_thickness
        
        # run methods in constructor
        self.get_face_vertices()
        self.get_faces_planes()
        self.get_face_edge_planes()
        self.get_bisector_planes()
        self.get_face_polylines(chamfer)
        self.get_edges()
        self.get_edge_faces()
        self.get_edge_vectors(insertion_vectors)
        self.get_edge_planes()
        self.get_connectors()
# ---------- end python ----------
python_2 = GhPythonScript()  # -> Out, _data, _dir
# [  ] - 3 Components to rewrite
# [  ] - separate files into example files
# [  ] - document components on the github
# [  ] - add folding components: a) hex divide and profile extrude
# [  ]  - there is issue with planarity of polylines, maybe clipper tolerance is off
# [  ] - bst project is not computable
python_3 = GhPythonScript()  # -> Out, _mesh

# ---- group: chevron
chevron = Chevron(
    U_divisions=Slider(4, range=1..20),
    V_division_dist=Slider(900, range=900..1000),
    Shift=Slider(0.5, range=0.5..1),
    Scale=Slider(0.05799, range=0.05..0.06))

# ---- group: connectors
connectors = Connectors(
    Face_positions=Slider(0, range=-10..10),
    Face_thickness=Slider(4, range=0..10),
    Divisions=Slider(2, range=1..10),
    Division_len=Slider(15, range=1..100),
    Rect_width=Slider(12, range=-20..20),
    Rect_height=Slider(12, range=-20..20),
    Rect_thickness=Slider(1, range=1..2))  # -> F, F_pl, F_id, E, E_pl, E_id

# ---- group: chevron_plates
chevron_plates = Chevron_plates(
    Edge_rotation=Slider(1, range=0..10),
    Edge_offset=Slider(0.5, range=0..2.5),
    Box_height=Slider(760, range=100..1000),
    Top_plate_inlet=Slider(80, range=0..100),
    Plate_thickness=Slider(40, range=1..40),
    Ortho=True)  # -> Data, Dir
