# Grasshopper definition hex_boxes_connection_area.ghx (Grasshopper 1.0.7)

crv = Curve(Tree({465}: [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], {495}: [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], {496}: [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], {524}: [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], {525}: [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], {526}: [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], {555}: [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], {556}: [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], {585}: [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]))
xml_recenter = Xml_recenter(geo=crv)  # -> output; inputs geo: tree of Curve
#   port geo: geometry to recenter
# ---------- xml_recenter: Python ----------
__author__ = "petras vestartas"
__version__ = "2023.03.22"

"""
Move curves to to the origin
"""

from ghpythonlib.componentbase import executingcomponent as component

import Rhino.Geometry as RhinoGeometry
import Grasshopper
class xml_recenter_component(component):
    def RunScript(self, _geo, _scale):
        
        scale = _scale if _scale != None else 1
        
        if(_geo.AllData().Count == 0):
            return
        
        # get bounding box
        bbox = _geo.AllData()[0].GetBoundingBox(True)
        for g in _geo.AllData():
            bbox.Union(g.GetBoundingBox(True))
        
        # Transformation matrix
        translation = -RhinoGeometry.Vector3d(bbox.Center)
        move_to_center = RhinoGeometry.Transform.Translation(translation)
        scale_xform = RhinoGeometry.Transform.Scale(RhinoGeometry.Point3d.Origin, scale)
        combined = scale_xform * move_to_center
        
        # Apply transformation
        geo_transformed = Grasshopper.DataTree[RhinoGeometry.GeometryBase]()
        for i in range(_geo.BranchCount):
            for j in range(_geo.Branch(i).Count):
                geo_copy = _geo.Branch(i)[j].Duplicate()
                geo_copy.Transform(combined)
                geo_transformed.Add(geo_copy, _geo.Paths[i])
        
        # Output
        return geo_transformed
# ---------- end xml_recenter ----------
panel = Panel("""300
0.5
2""")  # disabled
python = GhPythonScript(ss_e_ip=panel)  # -> out, params; inputs ss_e_ip: list, ss_e_op: list, ts_e_p: list, cr_c_ip: list, tt_e_p: list, ss_e_r: list, b: list; disabled
# ---------- python: Python ----------
joint_parameters = [
    300, 0.5, 3,   # 1-9 ss_e_ip (side-to-side edge in-plane)
    50, 0.64, 15,  # 10-19 ss_e_op (side-to-side edge out-of-plane)
    450, 0.5, 20,  # 20-29 ts_e_p (top-to-side edge plane)
    300, 0.5, 30,  # 30-39 cr_c_ip (cross cutting in-plane)
    6, 0.95, 40,   # 40-49 tt_e_p  (top-to-top edge plane)
    300, 0.5, 58,  # 50-59 ss_e_r (side-to-side edge rotated)
    300, 1.0, 60   # 60-69 b (boundary)
]

for i in range(len(_ss_e_ip)):
    joint_parameters[0*3+i] = _ss_e_ip[i]

for i in range(len(_ss_e_op)):
    joint_parameters[1*3+i] = _ss_e_op[i]

for i in range(len(_ts_e_p)):
    joint_parameters[2*3+i] = _ts_e_p[i]

for i in range(len(_cr_c_ip)):
    joint_parameters[3*3+i] = _cr_c_ip[i]

for i in range(len(_tt_e_p)):
    joint_parameters[4*3+i] = _tt_e_p[i]

for i in range(len(_ss_e_r)):
    joint_parameters[5*3+i] = _ss_e_r[i]

for i in range(len(_b)):
    joint_parameters[6*3+i] = _b[i]

_params = joint_parameters
# ---------- end python ----------
joints = Joints(polylines=xml_recenter)  # -> polylines_out, element_pairs, joint_areas, joint_areas_mesh, joint_types; inputs polylines: tree of Polyline, id: Int32
#   port polylines: a data-tree of polyline pairs
#   port id: index of xml file, if _polylines are not given
#   port polylines_out: polyline input
#   port element_pairs: indices of neighboring elements
#   port joint_areas: polylines that define the connection zones
#   port joint_areas_mesh: mesh that define the connection zones
#   port joint_types: type of connection zone
# ---------- joints: Python ----------
"""get joints ids and connections areas between elements"""

__author__ = "petras vestartas"
__version__ = "2023.03.29"


from ghpythonlib.componentbase import executingcomponent as component
# STEP 0 - Installation, anaconda prompt:
# python -m compas_rhino.install
# python -m compas_rhino.install -p compas_wood
# STEP 1 - check the environment name
# import compas_bootstrapper
# print(compas_bootstrapper.ENVIRONMENT_NAME)
# STEP 2 - import proxy from compas.rpc
# https://compas.dev/compas/latest/tutorial/rpc.html#supported-data-types-1
from compas.rpc import Proxy # https://compas.dev/compas/latest/api/compas.rpc.html
proxy = Proxy('compas_wood.joinery') # import module
from compas_rhino import conversions
from ghpythonlib import treehelpers
import Rhino

# STEP 3 - start server
#proxy.stop_server()
#proxy.start_server()

class joints(component):
    def RunScript(self, _polylines, _id):
        # ==============================================================================
        # input
        # ==============================================================================
        output_polylines = []
        if( _polylines.AllData().Count!= 0):
            print("user_input")
            #convert to compas polylines
            for i in _polylines.AllData():
                output_polylines.append(conversions.polyline_to_compas(i))
        else:
            print("xml_input")
            feasible_ids = [1,3,7,10,11,12,14,16,17,18,19,20,21,22,23,24,25,27,28,29,30,31,34,36,37]
            
            # read the xml file and get a data-set
            foldername = (
                proxy.get_cwd()+"/frontend/src/wood/dataset/" 
            )
            
            # read polylines from an xml files
            id = feasible_ids[max(min(24, _id), 0)]
            filename_of_dataset = proxy.get_filenames_of_datasets()[id]
            output_polylines = proxy.read_xml_polylines(foldername, filename_of_dataset)
        
        # ==============================================================================
        # get joints
        # ==============================================================================
        element_pairs_list, joint_areas_polylines, joint_types = proxy.joints(output_polylines, 0) 
        
        
        # ==============================================================================
        # output
        # ==============================================================================
        _element_pairs = treehelpers.list_to_tree(element_pairs_list)
        
        _joint_areas = []
        _joint_areas_mesh = []
        for i in joint_areas_polylines:
            polyline = conversions.polyline_to_rhino(i)
            polyline.MergeColinearSegments(0.02, True)
            polyline.CollapseShortSegments(0.02)
            _joint_areas.append(polyline)
            _joint_areas_mesh.append(Rhino.Geometry.Mesh.CreateFromClosedPolyline(polyline))
        
        _joint_types = joint_types
        
        _polylines_out = []
        for i in output_polylines:
            _polylines_out.append(conversions.polyline_to_rhino(i))
        
        return _polylines_out, _element_pairs, _joint_areas, _joint_areas_mesh, _joint_types
# ---------- end joints ----------
connection_zones = Connection_zones(polylines=xml_recenter, output=Slider(1, range=0..4))  # -> polylines_out, cut_types; inputs polylines: tree of Polyline, id: Int32, vectors: tree of Vector3d, joint_types: tree of Int32, three_valence: tree of Int32, adjacency: list of Int32, params: list, scale: list of Int32, output: Int32, search: Int32, extension: list of Int32
#   port polylines: a data-tree of polyline pairs
#   port id: index of xml file, if _polylines are not given
#   port vectors: insertion direction
#   port joint_types: joint type per side, top, bottom, and sides
#   port three_valence: three valance joinery that starts 0 - Vidy, 1 - Annen, and 4 indices current, next, current-neighbor, next-neighbor
#   port adjacency: joint parameters
#   port params: joint parameters
#   port scale: scale of joint, default is [1,1,1]
#   port output: output_type 0 - outlines | 1 - lines | 2 - areas | 3 - volumes | 4 - merged geometry of joints
#   port search: search_type search type 0 - side-to-side, 1 - cross, 2 - both
#   port extension: extension by distance, plates often has [0,0,10], whereas beams [10,10,10], default is [0,0,0]
#   port polylines_out: polyline input
# ---------- connection_zones: Python ----------
"""get joints ids and connections areas between elements"""

__author__ = "petras vestartas"
__version__ = "2023.03.29"


from ghpythonlib.componentbase import executingcomponent as component
# STEP 0 - Installation, anaconda prompt:
# python -m compas_rhino.install
# python -m compas_rhino.install -p compas_wood
# STEP 1 - check the environment name
# import compas_bootstrapper
# print(compas_bootstrapper.ENVIRONMENT_NAME)
# STEP 2 - import proxy from compas.rpc
# https://compas.dev/compas/latest/tutorial/rpc.html#supported-data-types-1
from compas.rpc import Proxy # https://compas.dev/compas/latest/api/compas.rpc.html
proxy = Proxy('compas_wood.joinery') # import module
from compas_rhino import conversions
from ghpythonlib import treehelpers
import Rhino
import Grasshopper as gh

# STEP 3 - start server
#proxy.stop_server()
#proxy.start_server()


class connections_zones(component):
    def RunScript(self, _polylines, _id, _vectors, _joint_types, _three_valence, _adjacency, _params, _scale, _output, _search, _extension):
        # ==============================================================================
        # input
        # ==============================================================================
        output_polylines = []
        if( _polylines.AllData().Count!= 0):
            print("user_input")
            #convert to compas polylines
            for i in _polylines.AllData():
                output_polylines.append(conversions.polyline_to_compas(i))
        else:
            print("xml_input")
            feasible_ids = [1,3,7,10,11,12,14,16,17,18,19,20,21,22,23,24,25,27,28,29,30,31,34,36,37]
            
            # read the xml file and get a data-set
            foldername = (
                proxy.get_cwd()+"/frontend/src/wood/dataset/" 
            )
            
            # read polylines from an xml files
            id = feasible_ids[max(min(24, _id), 0)]
            filename_of_dataset = proxy.get_filenames_of_datasets()[id]
            output_polylines = proxy.read_xml_polylines(foldername, filename_of_dataset)
        
        vectors = []
        if(_vectors != None):
            for i in range (_vectors.BranchCount):
                list = []
                for j in _vectors.Branch(i):
                    list.append(conversions.vector_to_compas(j))
                vectors.append(list)
        
        
        joint_parameters = [
            300, 0.5, 3,   # 1-9 ss_e_ip (side-to-side edge in-plane)
            50, 0.64, 15,  # 10-19 ss_e_op (side-to-side edge out-of-plane)
            450, 0.5, 20,  # 20-29 ts_e_p (top-to-side edge plane)
            300, 0.5, 30,  # 30-39 cr_c_ip (cross cutting in-plane)
            6, 0.95, 40,   # 40-49 tt_e_p  (top-to-top edge plane)
            300, 0.5, 58,  # 50-59 ss_e_r (side-to-side edge rotated)
            300, 1.0, 60   # 60-69 b (boundary)
        ]
        
        for i in range(0, len(_params)):
            joint_parameters[i] = _params[i]
        print(joint_parameters)
        search = id = max(min(2, _search), 0)
        
        scale = [1,1,1]
        for i in range(0, len(_scale)):
            scale[i] = _scale[i]
        
        output_type = _output if _output != None else 4
        
        extension = [0,0,0]
        for i in range(0, len(_extension)):
            extension[i] = _extension[i]
        
        joint_types = []
        if(_joint_types.DataCount != 0):
            treehelpers.tree_to_list(_joint_types)
        
        three_valence = []
        if(_three_valence.DataCount != 0):
            three_valence = treehelpers.tree_to_list(_three_valence)
        
        # ==============================================================================
        # get joints
        # ==============================================================================
        result = proxy.get_connection_zones(
        output_polylines,
        vectors, # output_vectors,
        joint_types, # output_joints_types,
        three_valence, # output_three_valence_element_indices_and_instruction,
        _adjacency, # output_adjacency,
        joint_parameters,
        search,
        scale,
        output_type,
        False,
        extension)
        
        
        
        # ==============================================================================
        # output
        # ==============================================================================
        _polylines_out = gh.DataTree[Rhino.Geometry.Polyline]()
        
        # nest two times the result and add to the tree
        for i in range(0, len(result)):
            for j in range(0, len(result[i])):
                    _polylines_out.Add(conversions.polyline_to_rhino(result[i][j]), gh.Kernel.Data.GH_Path(i))
        
        _cut_type = []
        
        return _polylines_out, _cut_type
# ---------- end connection_zones ----------
number_slider = Slider(9, range=0..9)
path_mapper = PathMapper(xml_recenter, source="{A}", target="{path_index}")
branch = TreeBranch(Tree=simplify(joints.element_pairs), Path=number_slider, MaintainPaths=True)
item = ListItem(List=joints.joint_areas_mesh, Index=number_slider, Wrap=True)
branch_2 = TreeBranch(Tree=simplify(path_mapper), Path=branch, MaintainPaths=True)
branch_3 = TreeBranch(Tree=connection_zones.polylines_out, Path=Slider(6, range=0..10), MaintainPaths=True)
preview = CustomPreview(Geometry=[branch_2, item], Material=ColourSwatch(SwatchColor=RGB(85, 0, 255)))
