# Grasshopper definition 11_vda_slab.gh (Grasshopper 1.0.8)
# plug-ins: RhinoCodePluginGH

panel = Panel("""4
4
4
4
4
4
 
 
 
 
 
 """)
dovetails = Point([Point(304.5856944, 487.9573976, 232.6731415), Point(446.940918, 302.5870358, 232.6731415), Point(222.027954, 278.2435907, 232.6731415), Point(45.4472038, 448.597412, 232.6731415), Point(364.383178, 92.87323008, 232.6731415), Point(446.940918, -73.20294209, 232.6731415)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])
fingers = Point([Point(428.940918, 120.0485087, 77.99850406), Point(185.8839735, 459.1840705, 126.2741608), Point(-43.2894632, 409.9822766, 137.5218099), Point(260.3469971, 90.14179162, 87.96007592), Point(-215.4671134, 265.2875302, 140.4765773), Point(144.0423163, 22.08113133, 93.32304722), Point(-354.9668926, 81.31932942, 138.6999059), Point(41.73694092, -75.63874241, 94.36067479), Point(-407.2402772, -171.261727, 127.7854233), Point(-39.7041194, -195.22601, 89.27120108), Point(-427.8176953, -482.789978, 109.2839804), Point(-79.55827896, -325.4667004, 85.11432133)])
entwine = Entwine(Branch00=dovetails, Branch01=fingers, FlattenInputs=True)
merge = Merge(Data1=Slider(100, range=0..550), Data2=Slider(0.66, range=0..1), Data3=Slider(10, range=10..20))
panel_2 = Panel("""10
12""")
panel_3 = Panel("""100
45
43""")
joint_parameters = Joint_parameters(ss_e_op=merge, tt_e_p=panel_3)  # -> p; inputs ss_e_ip: list of Double, ss_e_op: list of Double, ts_e_p: list of Double, cr_c_ip: list of Double, tt_e_p: list of Double, ss_e_r: list of Double, b: list of Double
#   port ss_e_ip: side-to-side in-plane joint parameters
#   port ss_e_op: side-to-side out-of-plane joint parameters
#   port ts_e_p: top-to-side joint parameters
#   port cr_c_ip: cross joint parameters
#   port tt_e_p: top-to-top joint parameters
#   port ss_e_r: side-to-side rotated joint parameters
#   port b: boundary joint parameters
#   port p: a list of joint parameters
# ---------- joint_parameters: Python ----------
"""
Do something silly in python3.

This component does nothing useful, it's only a kitchen sink (but in python3) example showing most available options.

    Args:
        x: X value
        y: Y value
        z: Z value
    Returns:
        result: The sum of all three values.
"""
from ghpythonlib.componentbase import executingcomponent as component

import System
import math


class joint_parameters_component(component):
    def RunScript(self,
            _ss_e_ip: System.Collections.Generic.List[float],
            _ss_e_op: System.Collections.Generic.List[float],
            _ts_e_p: System.Collections.Generic.List[float],
            _cr_c_ip: System.Collections.Generic.List[float],
            _tt_e_p: System.Collections.Generic.List[float],
            _ss_e_r: System.Collections.Generic.List[float],
            _b: System.Collections.Generic.List[float]):

        joint_parameters = [
            300,
            0.5,
            3,  # 1-9 ss_e_ip (side-to-side edge in-plane)
            50,
            0.64,
            15,  # 10-19 ss_e_op (side-to-side edge out-of-plane)
            450,
            0.5,
            20,  # 20-29 ts_e_p (top-to-side edge plane)
            300,
            0.5,
            30,  # 30-39 cr_c_ip (cross cutting in-plane)
            6,
            0.95,
            40,  # 40-49 tt_e_p  (top-to-top edge plane)
            300,
            0.5,
            58,  # 50-59 ss_e_r (side-to-side edge rotated)
            300,
            1.0,
            60,  # 60-69 b (boundary)
        ]

        if _ss_e_ip:
            for i in range(len(_ss_e_ip)):
                joint_parameters[0 * 3 + i] = _ss_e_ip[i]

        if _ss_e_op:
            for i in range(len(_ss_e_op)):
                joint_parameters[1 * 3 + i] = _ss_e_op[i]

        if _ts_e_p:
            for i in range(len(_ts_e_p)):
                joint_parameters[2 * 3 + i] = _ts_e_p[i]

        if _cr_c_ip:
            for i in range(len(_cr_c_ip)):
                joint_parameters[3 * 3 + i] = _cr_c_ip[i]

        if _tt_e_p:
            for i in range(len(_tt_e_p)):
                joint_parameters[4 * 3 + i] = _tt_e_p[i]

        if _ss_e_r:
            for i in range(len(_ss_e_r)):
                joint_parameters[5 * 3 + i] = _ss_e_r[i]

        if _b:
            for i in range(len(_b)):
                joint_parameters[6 * 3 + i] = _b[i]

        _joint_p = joint_parameters

        return _joint_p
# ---------- end joint_parameters ----------
item = ListItem(List=panel_3, Index=Slider(2, range=0..10), Wrap=True)

# ---- group: Input Geometry
# SLAB MADE OUT OF BOXES
number_slider = Slider(10, range=0..10)
crv = Curve([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])
recenter = Recenter(geo=crv, scale=number_slider)  # -> output; inputs geo: tree of GeometryBase, scale: Double
#   port geo: geometry to recenter
#   port scale: scale around center
#   port output: transformed geometry
# ---------- recenter: Python ----------
__author__ = "petras vestartas"
__version__ = "2023.03.22"

"""
Move curves to to the origin
"""

from ghpythonlib.componentbase import executingcomponent as component
import Rhino
import Grasshopper


class xml_recenter_component(component):
    def RunScript(self,
            _geo: Grasshopper.DataTree[Rhino.Geometry.GeometryBase],
            _scale: float):

        scale = _scale if _scale != None else 1

        if _geo.AllData().Count == 0:
            return

        # get bounding box
        bbox = _geo.AllData()[0].GetBoundingBox(True)
        for g in _geo.AllData():
            bbox.Union(g.GetBoundingBox(True))

        # Transformation matrix
        translation = -Rhino.Geometry.Vector3d(bbox.Center)
        move_to_center = Rhino.Geometry.Transform.Translation(translation)
        scale_xform = Rhino.Geometry.Transform.Scale(Rhino.Geometry.Point3d.Origin, scale)
        combined = scale_xform * move_to_center

        # Apply transformation
        geo_transformed = Grasshopper.DataTree[Rhino.Geometry.GeometryBase]()
        for i in range(_geo.BranchCount):
            for j in range(_geo.Branch(i).Count):
                geo_copy = _geo.Branch(i)[j].Duplicate()
                geo_copy.Transform(combined)
                geo_transformed.Add(geo_copy, _geo.Paths[i])

        # Output
        return geo_transformed
# ---------- end recenter ----------
partition = PartitionList(List=recenter, Size=Slider(2, range=0..10))
panel_4 = Panel("""4
4
4
4
4
4
 
 
 
 
 
 """)
item_2 = ListItem(List=partition, Index=0, Wrap=True)  # -> Item, Item1
int = Integer(simplify(graft(panel_4)))
clean = CleanTree(RemoveNulls=True, RemoveInvalid=True, RemoveEmpty=False, Tree=int)

# ----
loft_m = Loft_mesh(p0=item_2.Item, p1=item_2.Item1)  # -> mesh; inputs p0: list of Curve, p1: list of Curve
#   port p0: polylines with holes, bottom
#   port p1: polylines with holes, top
#   port mesh: lofted and capped mesh with holes
# ---------- loft_m: Python ----------
"""get joints ids and connections areas between elements"""

__author__ = "petras vestartas"
__version__ = "2024.04.25"

from ghpythonlib.componentbase import executingcomponent as component
import Rhino
import Rhino.Geometry
from System.Drawing import Color
import System


class connections_zones(component):
    def to_polyline_from_cp(self, curve):

        polyline = Rhino.Geometry.Polyline()
        result, polyline1 = curve.TryGetPolyline()

        if result == False:

            nurbsCurve = curve.ToNurbsCurve()
            point3dArray = []

            for i in range(len(nurbsCurve.Points)):
                result, pt = nurbsCurve.Points.GetPoint(i)
                point3dArray.append(pt)

            polyline1 = Rhino.Geometry.Polyline(point3dArray)
            nurbsCurve = polyline1.ToNurbsCurve()
            result, polyline1 = nurbsCurve.TryGetPolyline()

            polyline1.CollapseShortSegments(0.01)

            polyline1 = Rhino.Geometry.Polyline(polyline1)
            polyline = polyline1

        else:
            polyline1.CollapseShortSegments(0.01)
            polyline = polyline1

        return polyline

    def loft_polylines_with_holes(self, curves0, curves1):
        """Loft polylines with holes

        Parameters
        ----------
        curves0 : list[rg.Polyline]
        curves1 : list[rg.Polyline]

        Returns
        -------
        rg.Mesh
            mesh as lofted polylines and cap them
        """

        ###############################################################################
        # user input
        ###############################################################################

        flag = len(curves0) is not 0 if True else len(curves1) != 0
        if flag:

            curves = []
            curves2 = []

            flag0 = len(curves1) == 0
            flag1 = len(curves0) == 0 and len(curves1) != 0
            flag2 = len(curves0) and len(curves1)

            if flag0:
                for i in range(len(curves0)):
                    if float(i) >= float(len(curves0)) * 0.5:
                        curves2.append(curves0[i])
                    else:
                        curves.append(curves0[i])
            elif flag1:
                for i in range(0, len(curves1), 2):
                    curves.append(curves1[i])
                    curves2.append(curves1[i + 1])
            elif flag2:
                curves = curves0
                curves2 = curves1

            curves0 = curves
            curves1 = curves2

        ###############################################################################
        # sort curves which one is border and which ones are holes
        ###############################################################################
        length = -1.0
        border_id = -1
        count = 0
        numArray = []
        for curve in curves0:
            diagonal = curve.GetBoundingBox(True).Diagonal
            temp_length = diagonal.Length
            if temp_length > length:
                length = temp_length
                border_id = count
            count = count + 1

        border0 = self.to_polyline_from_cp(curves0[border_id])
        border1 = self.to_polyline_from_cp(curves1[border_id])
        holes0 = []
        holes1 = []
        for i in range(len(curves0)):
            if i != border_id:
                holes0.append(curves0[i])
                holes1.append(curves1[i])

        ###############################################################################
        # Create mesh of the bottom face
        ###############################################################################
        mesh_bottom = Rhino.Geometry.Mesh.CreatePatch(
            border0, Rhino.RhinoDoc.ActiveDoc.ModelAngleToleranceRadians, None, holes0, None, None, True, 1
        )

        ###############################################################################
        # Convert closed polylines to open ones
        ###############################################################################

        point_3d_array = []
        for i in range(len(mesh_bottom.Vertices)):
            point_3d_array.append(mesh_bottom.Vertices.Point3dAt(i))

        open_curve_points_0 = []
        open_curve_points_1 = []

        for i in range(len(border0) - 1):
            open_curve_points_0.append(border0[i])
            open_curve_points_1.append(border1[i])

        for i in range(len(holes0)):
            holes0_polyline = self.to_polyline_from_cp(holes0[i])
            holes1_polyline = self.to_polyline_from_cp(holes1[i])
            for j in range(len(holes0_polyline) - 1):
                open_curve_points_0.append(holes0_polyline[j])
                open_curve_points_1.append(holes1_polyline[j])

        ###############################################################################
        # Using the bottom mesh vertices create the top mesh f
        ###############################################################################
        points_to_sort_new = self.sort_set_of_points(open_curve_points_0, point_3d_array)
        mesh_top = mesh_bottom.DuplicateMesh()

        for i in range(len(points_to_sort_new)):
            mesh_top.Vertices.SetVertex(i, open_curve_points_1[points_to_sort_new[i]])

        ###############################################################################
        # Merge the top and bottom mesh into one and append sides
        ###############################################################################
        mesh = Rhino.Geometry.Mesh()
        mesh.Append(mesh_bottom)
        mesh.Append(mesh_top)

        count = len(mesh_bottom.Vertices)
        for p in range((mesh_bottom.TopologyEdges).Count):

            if mesh_bottom.TopologyEdges.GetConnectedFaces(p).Length == 1:
                topologyVertices = mesh_bottom.TopologyEdges.GetTopologyVertices(p)
                mesh.Faces.AddFace(
                    topologyVertices.I, topologyVertices.J, topologyVertices.J + count, topologyVertices.I + count
                )

        mesh.UnifyNormals()
        mesh.Ngons.AddPlanarNgons(Rhino.RhinoDoc.ActiveDoc.ModelAbsoluteTolerance * 1, 3, 1, True)
        # return mesh
        ###############################################################################
        # Unweld ngons meshes
        ###############################################################################
        return mesh
        unwelded_ngon_mesh = Rhino.Geometry.Mesh()

        count = 0
        for ngonAndFacesEnumerable in mesh.GetNgonAndFacesEnumerable():

            faces = []
            for j in ngonAndFacesEnumerable.FaceIndexList():
                faces.append(System.Int32(j))

            temp_ngon_mesh = mesh.DuplicateMesh().Faces.ExtractFaces(faces)
            temp_ngon_mesh.Ngons.Clear()

            # append colors
            if count < 2:
                temp_ngon_mesh.VertexColors.CreateMonotoneMesh(Color.LightGray)
            else:
                temp_ngon_mesh.VertexColors.CreateMonotoneMesh(Color.DeepPink)

            unwelded_ngon_mesh.Append(temp_ngon_mesh)
            count = count + 1

        ###############################################################################
        # Output
        ###############################################################################

        unwelded_ngon_mesh.RebuildNormals()
        # unwelded_ngon_mesh.Ngons.Clear()
        return unwelded_ngon_mesh

    def sort_set_of_points(self, points_to_sort, guide_points):
        """Sort one array of point by an another point array

        use it like this:
        #points_to_sort_new = []
        #for i in points_to_sort_ids:
        #    points_to_sort_new.append(points_to_sort[i])

        Parameters
        ----------
        points_to_sort : list[rg.Point3d]
        guide_points : list[rg.Point3d]

        Returns
        -------
        list[int]
            the list of indices of the sorted array
        """

        # create a copy
        points_to_sort_copy = []
        for i in points_to_sort:
            points_to_sort_copy.append(Rhino.Geometry.Point3d(i))

        guide_points_copy = []
        for i in guide_points:
            guide_points_copy.append(Rhino.Geometry.Point3d(i))

        # make indices of points
        points_to_sort_ids = list(range(0, len(points_to_sort_copy)))
        guide_points_ids = list(range(0, len(guide_points_copy)))

        # sort both lists by xyz coordinates together with indices
        points_to_sort_copy, points_to_sort_ids = zip(*sorted(zip(points_to_sort_copy, points_to_sort_ids)))
        guide_points_copy, guide_points_ids = zip(*sorted(zip(guide_points_copy, guide_points_ids)))

        # sort guide points indices and order the points to sort indec
        guide_points_ids, points_to_sort_ids = zip(*sorted(zip(guide_points_ids, points_to_sort_ids)))

        # can be used like this:
        # points_to_sort_new = []
        # for i in points_to_sort_ids:
        #    points_to_sort_new.append(points_to_sort[i])

        return points_to_sort_ids

    def RunScript(self,
            _p0: System.Collections.Generic.List[Rhino.Geometry.Curve],
            _p1: System.Collections.Generic.List[Rhino.Geometry.Curve]):
        if _p0 and _p1:
            return self.loft_polylines_with_holes(_p0, _p1)
# ---------- end loft_m ----------

# ---- group: Input Geometry (continued)
box_wall = Box_wall(mesh=loft_m, offset="18", inlay_0=Toggle(True), inlay_1=Toggle(False), skipped=clean)  # -> polylines_0, polylines_1; inputs mesh: Mesh, offset: Double, inlay_0: Boolean, inlay_1: Boolean, skipped: list of Int32
#   port offset: offset_distance
#   port inlay_0: offset the plate inwards
#   port inlay_1: offset the plate inwards
#   port skipped: skip offsets of plats
#   port polylines_1: bottom outline
# ---------- box_wall: Python ----------
"""create box wall by offset mesh planes and intersecting them"""
from ghpythonlib.componentbase import executingcomponent as component
import Rhino
import System


class MyComponent(component):
    def RunScript(self,
            _mesh: Rhino.Geometry.Mesh,
            _offset: float,
            _inlay_0: bool,
            _inlay_1: bool,
            _skipped: System.Collections.Generic.List[int]):
        if _mesh == None:
            return
        if _offset == None:
            _offset = 1

        def get_ngon_polylines(mesh):
            polylines = []

            for i in range(mesh.Ngons.Count):
                vertices = mesh.Ngons.GetNgon(i).BoundaryVertexIndexList()

                outline = Rhino.Geometry.Polyline()
                for v in vertices:
                    outline.Add(mesh.Vertices[v])
                outline.Add(outline[0])

                polylines.append(outline)

            return polylines

        def get_ngon_center(mesh, ngon):
            vertices = mesh.Ngons.GetNgon(ngon).BoundaryVertexIndexList()

            outline = Rhino.Geometry.Polyline()
            for v in vertices:
                outline.Add(mesh.Vertices[v])

            return outline.CenterPoint()

        def get_ngon_normal(mesh, n):
            vector3d = Rhino.Geometry.Vector3d.Zero

            faces = mesh.Ngons[n].FaceIndexList()

            for i in range(len(faces)):
                vector3d += Rhino.Geometry.Vector3d(mesh.FaceNormals[int(faces[i])])

            vector3d.Unitize()

            return vector3d

        def get_ngons_boundaries(mesh):
            boundaries = [[] for _ in range(mesh.Ngons.Count)]

            for i in range(mesh.Ngons.Count):
                boundaries[i] = mesh.Ngons[i].BoundaryVertexIndexList()

            return boundaries

        def get_ngons_boundaries_point3d(mesh, verticesIDs):
            pts = [[] for _ in range(len(verticesIDs))]

            for i in range(len(verticesIDs)):
                pts[i] = [mesh.Vertices[int(v)] for v in verticesIDs[i]]

            return pts

        def get_ngon_planes(mesh):
            p = [None] * mesh.Ngons.Count

            b = get_ngons_boundaries(mesh)
            pts = get_ngons_boundaries_point3d(mesh, b)

            for i in range(mesh.Ngons.Count):
                p[i] = Rhino.Geometry.Plane(get_ngon_center(mesh, i), get_ngon_normal(mesh, i))
            return p

        def get_ngon_face_adjacency(mesh):
            faceAdj = [None] * mesh.Ngons.Count

            for i in range(mesh.Ngons.Count):
                faceAdjTemp = []
                meshFaceIdInCurrentNGon = mesh.Ngons[i].FaceIndexList()

                for j in range(len(meshFaceIdInCurrentNGon)):
                    id = mesh.Faces.AdjacentFaces(meshFaceIdInCurrentNGon[j])

                    for k in range(len(id)):
                        ngonID = mesh.Ngons.NgonIndexFromFaceIndex(id[k])

                        if ngonID != i and ngonID not in faceAdjTemp:
                            faceAdjTemp.append(ngonID)

                faceAdj[i] = faceAdjTemp
            return faceAdj

        def move_plane_by_axis(plane, dist, axis=2):
            plane1 = Rhino.Geometry.Plane(plane)
            if axis == 0:
                plane1.Translate(plane1.XAxis * dist)
            elif axis == 1:
                plane1.Translate(plane1.YAxis * dist)
            else:
                plane1.Translate(plane1.Normal * dist)
            return plane1

        def polyline_from_planes(basePlane, sidePlanes, close=True):
            polyline = Rhino.Geometry.Polyline()

            for i in range(len(sidePlanes) - 1):
                result, pt = Rhino.Geometry.Intersect.Intersection.PlanePlanePlane(
                    basePlane, sidePlanes[i], sidePlanes[i + 1]
                )
                polyline.Add(pt)

            result, pt1 = Rhino.Geometry.Intersect.Intersection.PlanePlanePlane(
                basePlane, sidePlanes[len(sidePlanes) - 1], sidePlanes[0]
            )
            polyline.Add(pt1)

            if close:
                polyline.Add(polyline[0])

            return polyline

        def get_intersection_between_current_and_neihgbor_planes(
            planes, adjacent_faces, offset, inlay_0=False, inlay_1=False, skipped=[]
        ):
            planes_offset = []

            not_skipped_faces = []
            for i in range(len(planes)):
                not_skipped_faces.append(True)
                for j in skipped:
                    if j == i:
                        not_skipped_faces[i] = False
                        break

            for i in range(len(planes)):
                if not_skipped_faces[i]:

                    if inlay_0 and i == 0:
                        planes_offset.append(move_plane_by_axis(planes[i], 0))
                    elif inlay_1 and i == 1:
                        planes_offset.append(move_plane_by_axis(planes[i], 0))
                    else:
                        planes_offset.append(move_plane_by_axis(planes[i], -offset))
                else:
                    planes_offset.append(planes[i])

            polylines_no_offset = []
            polylines_offset = []

            for i in range(len(adjacent_faces)):  # iterate through nested list

                # base planes
                base_plane = planes[i]
                base_plane_offset = planes_offset[i]

                # get neighbor planes
                adjacent_planes_offset = []
                adjacent_planes_no_offset = []
                for j in range(len(adjacent_faces[i])):
                    adjacent_planes_offset.append(planes_offset[adjacent_faces[i][j]])
                    adjacent_planes_no_offset.append(planes[adjacent_faces[i][j]])

                    if inlay_0 and i == 0:
                        adjacent_planes_no_offset[j] = adjacent_planes_offset[j]

                    if inlay_1 and i == 1:
                        adjacent_planes_no_offset[j] = adjacent_planes_offset[j]

                if inlay_0 and i == 0:
                    base_plane = move_plane_by_axis(base_plane, -offset * 2)
                    base_plane_offset = move_plane_by_axis(base_plane_offset, -offset * 2)

                if inlay_1 and i == 1:
                    base_plane = move_plane_by_axis(base_plane, -offset * 2)
                    base_plane_offset = move_plane_by_axis(base_plane_offset, -offset * 2)

                # shift to right
                # adjacent_planes_offset.insert(0, adjacent_planes_offset.pop())#adjacent_planes_offset.append(adjacent_planes_offset.pop(0))
                # adjacent_planes_offset.insert(0, adjacent_planes_offset.pop())#adjacent_planes_offset.append(adjacent_planes_offset.pop(0))

                # perform intersection
                if not_skipped_faces[i]:
                    polylines_no_offset.append(polyline_from_planes(base_plane, adjacent_planes_no_offset))
                    polylines_offset.append(polyline_from_planes(base_plane_offset, adjacent_planes_offset))

            return polylines_no_offset, polylines_offset

        # get planes from polylines
        _mesh.RebuildNormals()
        polylines0 = get_ngon_polylines(_mesh)
        planes = get_ngon_planes(_mesh)
        adjacent_faces = get_ngon_face_adjacency(_mesh)
        skipped = _skipped if _skipped else []
        _p0, _p1 = get_intersection_between_current_and_neihgbor_planes(
            planes, adjacent_faces, _offset, _inlay_0, _inlay_1, skipped
        )

        # offset all polylines inside to get bisector plates

        # create an inlay plate if user defines it

        # return outputs if you have them; here I try it for you:
        return (_p0, _p1)
# ---------- end box_wall ----------
cull_i = CullIndex(List=box_wall.polylines_0, Indices=0, Wrap=True)
cull_i_2 = CullIndex(List=box_wall.polylines_1, Indices=0, Wrap=True)
weave = Weave(Pattern=[0, 1], Stream0=cull_i, Stream1=cull_i_2, NullGaps=False)

# ----
closest_indexed_points = ClosestIndexedPoints(polylines=weave, points=entwine, joint_types=graft(panel_2))  # -> polylines_out, joint_types_out; inputs polylines: tree of Curve, points: tree of Point3d, joint_types: tree of Int32
#   port polylines: polylines tree branch order does not matter it is flatenned inside the component
#   port points: a tree of points, the path id of the branch must match with _joint_types id, it is kind of a dictionary
#   port joint_types: a tree of integers, the path id of the branch must match with _points id, it is kind of a dictionary
#   port polylines_out: pairs of polylines, grouped two polylines per branch
#   port joint_types_out: a tree of int where each element contains top, bottom and side joint type assignments
# ---------- closest_indexed_points: Python ----------
from ghpythonlib.componentbase import executingcomponent as component
import Grasshopper, GhPython
import System
import Rhino
import rhinoscriptsyntax as rs

"""Provides a scripting component.
    Inputs:
        x: The x script variable
        y: The y script variable
    Output:
        a: The a output variable"""

__author__ = "petra"
__version__ = "2023.04.04"

import Rhino.Geometry
from Rhino.Geometry import RTree
from Rhino.Geometry import BoundingBox
from Rhino.Geometry import Sphere
from Rhino.Geometry import Vector3d
from Rhino.Geometry import Point3d
from Rhino.Geometry import Polyline
from Rhino.Geometry import Line
import Grasshopper
import ghpythonlib.treehelpers as th


class MyComponent(component):
    def RunScript(self,
            _polylines: Grasshopper.DataTree[Rhino.Geometry.Curve],
            _points: Grasshopper.DataTree[Rhino.Geometry.Point3d],
            _joint_types: Grasshopper.DataTree[int]):
        ###############################################################################
        # Input
        ###############################################################################
        polylines = []
        polylines_out = Grasshopper.DataTree[Polyline]()
        pts = []
        ids = []

        ###############################################################################
        # Conversion
        ###############################################################################
        count = 0
        for curve in _polylines.AllData():
            result, polyline = curve.TryGetPolyline()
            polylines_out.Add(polyline, Grasshopper.Kernel.Data.GH_Path(int(count * 0.5)))
            if count % 2 == 0:
                polylines.append([polyline])
            else:
                polylines[-1].append(polyline)
            count = count + 1

        if _points.DataCount > 0 and _joint_types.DataCount > 0:
            for i in range(_points.BranchCount):
                for j in range(_points.Branch(i).Count):
                    pts.append(_points.Branch(i)[j])
                    ids.append(_joint_types.Branch(i)[j % _joint_types.Branch(i).Count])
        # pts = _points.AllData()
        # ids = _joint_types.AllData()

        ###############################################################################
        # Run the closest point search
        ###############################################################################

        # convert element polylines to a flattened dictionary:
        segments_dictionary = {}
        # stores ids e.g. int , [element_int,bottom_or_top_polyline_int,edge,int, bounding_box, hit_count, point_id]
        joint_types = []
        count = 0
        for i in range(len(polylines)):
            joint_types.append([-1] * (polylines[i][0].SegmentCount + 2))
            for j in range(len(polylines[i])):
                for k in range(polylines[i][j].SegmentCount):
                    bbox = polylines[i][j].SegmentAt(k).BoundingBox
                    bbox.Inflate(0.02)
                    segments_dictionary[count] = [i, j, k, bbox, polylines[i][j].SegmentAt(k)]
                    count = count + 1

        # create a tree
        rtree = Rhino.Geometry.RTree()

        # fill the tree
        for i in segments_dictionary:
            rtree.Insert(segments_dictionary[i][3], i)

        # call_backs of rtree
        hit_count = 0

        def search_callback(sender, rtree_event_args):
            data_by_reference.append(rtree_event_args.Id)

        # perform search
        for i in range(len(pts)):
            data_by_reference = []
            if rtree.Search(Sphere(pts[i], 0), search_callback, data_by_reference):
                for j in data_by_reference:
                    if pts[i].DistanceToSquared(segments_dictionary[j][4].ClosestPoint(pts[i], True)) < 0.001:
                        joint_types[segments_dictionary[j][0]][segments_dictionary[j][2] + 2] = ids[i]

        ###############################################################################
        # Output
        ###############################################################################
        _polylines_out = polylines_out
        _joints_types_out = th.list_to_tree(joint_types)

        # return outputs if you have them; here I try it for you:
        return (_polylines_out, _joints_types_out)
# ---------- end closest_indexed_points ----------
replace = ReplaceItems(List=closest_indexed_points.joint_types_out, Item=item, Indices=[0, 1], Wrap=False)  # -> simplify(flatten(List))
unflatten = UnflattenTree(Tree=replace, Guide=closest_indexed_points.joint_types_out)
input_set = Input_set(polylines=closest_indexed_points.polylines_out, joint_types=unflatten)  # -> data; inputs polylines: tree of Polyline, vectors: tree of Vector3d, joint_types: tree of Int32, three_valence: tree of Int32, adjacency: tree of Int32
#   port polylines: a data-tree of polyline pairs
#   port vectors: insertion direction
#   port joint_types: joint type per side, top, bottom, and sides
#   port three_valence: three valance joinery that starts 0 - Vidy, 1 - Annen, and 4 indices current, next, current-neighbor, next-neighbor
#   port adjacency: joint parameters
#   port data: user input_get component to ungroup all the data to the individual data-trees
# ---------- input_set: Python ----------
"""combine different data sets into one list for a faster data transder between grasshopper wires"""
from ghpythonlib.componentbase import executingcomponent as component
import Grasshopper, GhPython

__author__ = "petras"
__version__ = "2023.04.02"


import System
import Rhino
import rhinoscriptsyntax as rs
import ghpythonlib.treehelpers as th
from Rhino.Geometry import Polyline
from Rhino.Geometry import Vector3d
from Rhino.Geometry import Plane
import compas_wood
from compas_wood.binding import test
from compas_wood.datastructures import WoodData

# r: compas


class MyComponent(component):
    def get_plane(self, _polyline, _orientation_point):

        len = _polyline.Count - 1
        normal = Vector3d(0, 0, 0)

        for i in range((_polyline.Count - 1)):
            num = ((i - 1) + len) % len
            item1 = ((i + 1) + len) % len
            point3d = _polyline[num]
            point3d1 = _polyline[item1]
            item2 = _polyline[i]
            normal = normal + Vector3d.CrossProduct(Vector3d(item2 - point3d), Vector3d(point3d1 - item2))

        normal.Unitize()
        plane = Plane(_polyline.CenterPoint(), normal)
        if plane.DistanceTo(_orientation_point) < 0:
            plane.Flip()

        return plane

    def RunScript(self,
            _polylines: Grasshopper.DataTree[Rhino.Geometry.Polyline],
            _vectors: Grasshopper.DataTree[Rhino.Geometry.Vector3d],
            _joint_types: Grasshopper.DataTree[int],
            _three_valence: Grasshopper.DataTree[int],
            _adjacency: Grasshopper.DataTree[int]):

        plines = []
        planes = []
        if _polylines.DataCount > 0:
            for i in range(_polylines.BranchCount):
                plines.extend(list(_polylines.Branch(i)))
                planes.append(self.get_plane(_polylines.Branch(i)[0], _polylines.Branch(i)[1][0]))

        insertion_vectors = th.tree_to_list(_vectors) if _vectors.DataCount > 0 else []
        joints_per_face = th.tree_to_list(_joint_types) if _joint_types.DataCount > 0 else []
        three_valence = th.tree_to_list(_three_valence) if _three_valence.DataCount > 0 else []
        adjacency = th.tree_to_list(_adjacency) if _adjacency.DataCount > 0 else []

        # output
        _data = WoodData(plines, insertion_vectors, joints_per_face, three_valence, adjacency, planes)

        # return outputs if you have them; here I try it for you:
        return _data
# ---------- end input_set ----------
solver = Solver(data=input_set, joint_p=joint_parameters, get=Slider(4, range=0..10))  # -> data; inputs joint_p: list of Double, scale: list of Double, extension: list of Double, find: Int32, get: Int32
#   port data: collection of inputs that represent the elements, insertion vectors, joint types and adjacency, use input_set commonent to group these inputs
#   port joint_p: joint parameters
#   port scale: scale of joint, default is [1,1,1]
#   port extension: extension by distance, plates often has [0,0,10], whereas beams [10,10,10], default is [0,0,0]
#   port find: search_type search type 0 - side-to-side, 1 - cross, 2 - both
#   port get: output_type 0 - outlines | 1 - lines | 2 - areas | 3 - volumes | 4 - merged geometry of joints
#   port data: user input_get component to ungroup all the data to the individual data-trees
# ---------- solver: Python ----------
__author__ = "petras"
__version__ = "2023.04.02"

# r: compas_wood

from ghpythonlib.componentbase import executingcomponent as component
import Rhino
import System
from wood_nano import get_connection_zones as wood_nano_get_connection_zones
from wood_nano import cut_type2 as wood_nano_cut_type2
from wood_nano import point3 as wood_nano_point3
from wood_nano.conversions_python import to_int2
from wood_nano.conversions_python import to_int1
from wood_nano.conversions_python import to_double1
from wood_nano.conversions_python import from_cut_type2
from compas_wood.conversions_rhino import to_point2
from compas_wood.conversions_rhino import to_vector2
from compas_wood.conversions_rhino import from_point3
from compas_wood.binding import wood_globals
from compas_wood.datastructures import WoodData
from math import floor


class connections_zones(component):
    def __init__(self):
        self.bbox = Rhino.Geometry.BoundingBox.Unset
        self.lines = []
        self.insertion_vectors_current = []
        self.joint_per_face_current_text_entity = []
        self.polylines = []

    def DrawViewportWires(self, args):
        col = args.WireColour
        line_weight = args.DefaultCurveThickness
        print(self.polylines)
        for polylines_list in self.polylines:
            for polyline in polylines_list:
                args.Display.DrawPolyline(polyline, col, line_weight)

    def get_ClippingBox(self):
        return self.bbox

    def RunScript(self,
            _data,
            _joint_p: System.Collections.Generic.List[float],
            _scale: System.Collections.Generic.List[float],
            _extension: System.Collections.Generic.List[float],
            _find: int,
            _get: int):

        # ==============================================================================
        # clear input
        # ==============================================================================
        self.bbox = Rhino.Geometry.BoundingBox.Unset
        self.lines = []
        self.insertion_vectors_current = []
        self.joint_per_face_current_text_entity = []
        self.polylines = []

        # ==============================================================================
        # input
        # ==============================================================================
        if _data is None:
            return

        input_polyline_pairs = _data.plines
        if input_polyline_pairs:
            if len(input_polyline_pairs) > 0:
                self.bbox = input_polyline_pairs[0].BoundingBox
                for pline in input_polyline_pairs:
                    self.bbox.Union(pline.BoundingBox)

        input_insertion_vectors = _data.insertion_vectors

        input_joint_types = _data.joints_per_face
        input_three_valence_element_indices_and_instruction = _data.three_valence

        input_search_type = max(min(2, _find), 0) if _find else 0

        input_scale = [1, 1, 1]
        if _scale:
            for i in range(0, len(_scale)):
                input_scale[i] = _scale[i]

        input_output_type = _get if _get != None else 4

        input_joint_volume_parameters = [0, 0, 0]

        if _extension:
            if len(_extension) > 2:
                input_joint_volume_parameters = []
                for i in _extension:
                    input_joint_volume_parameters.append(i * 10)

        input_adjacency = _data.adjacency

        joint_parameters = wood_globals.joints_parameters_and_types

        if _joint_p:
            for i in range(0, len(_joint_p), 3):
                insertion_id = floor(_joint_p[i + 2] / 10)
                joint_parameters[insertion_id * 3 + 0] = _joint_p[i + 0]
                joint_parameters[insertion_id * 3 + 1] = _joint_p[i + 1]
                joint_parameters[insertion_id * 3 + 2] = _joint_p[i + 2]
            print(joint_parameters)

        w_output_plines = wood_nano_point3()
        w_output_types = wood_nano_cut_type2()

        wood_nano_get_connection_zones(
            to_point2(input_polyline_pairs),
            to_vector2(input_insertion_vectors),
            to_int2(input_joint_types),
            to_int2(input_three_valence_element_indices_and_instruction),
            to_int1(input_adjacency),
            to_double1(joint_parameters),
            int(input_search_type),
            to_double1(input_scale),
            int(input_output_type),
            w_output_plines,
            w_output_types,
            to_double1(input_joint_volume_parameters),
            [],
            []
            # to_point2(input_custom_joints),
            # to_int1(input_custom_joints_types),
        )

        self.polylines = from_point3(w_output_plines)

        return WoodData(
            plines=_data.plines,
            insertion_vectors=_data.insertion_vectors,
            joints_per_face=_data.joints_per_face,
            three_valence=_data.three_valence,
            adjacency=_data.adjacency,
            planes=_data.planes,
            plines_with_joints=self.polylines,
            cut_types=from_cut_type2(w_output_types),
        )
# ---------- end solver ----------

# ---- group: Loft
input_get = Input_get(data=solver)  # -> plines_0, plines_1, lines, insertion_vectors, joints_per_face, three_valence, adjacency, cut_types; inputs split: Boolean
#   port data: collection of inputs that represent the elements, insertion vectors, joint types and adjacency, use input_set commonent to group these inputs
#   port split: split output into closed outlines and lines
#   port plines_0: polyline pairs
#   port plines_1: polyline pairs
#   port lines: polyline pairs
#   port insertion_vectors: insertion vectors per element top bottom and side faces
#   port joints_per_face: joinery types per element top bottom and side faces
#   port three_valence: three valence indices for special cases where one element is connected with two others
#   port adjacency: connectivity between elements and their faces
#   port cut_types: fabrication type
# ---------- input_get: Python ----------
"""unwrap element data to polylines, insertion vectors, joint types and etc"""
from ghpythonlib.componentbase import executingcomponent as component
import Grasshopper, GhPython
import System

__author__ = "petras"
__version__ = "2023.04.02"

import ghpythonlib.treehelpers as th
from Rhino.Geometry import Polyline
import Rhino
import rhinoscriptsyntax as rs


class MyComponent(component):
    def RunScript(self, _data, _split: bool):

        if _data is None:
            return

        split = True if _split is None else _split

        _plines_0 = Grasshopper.DataTree[Rhino.Geometry.Curve]()
        _plines_1 = Grasshopper.DataTree[Rhino.Geometry.Curve]()
        _lines = Grasshopper.DataTree[Rhino.Geometry.Curve]()
        if split == False:
            for i in range(len(_data.plines_with_joints)):
                for j in range(len(_data.plines_with_joints[i])):
                    _plines_0.Add(_data.plines_with_joints[i][j].ToNurbsCurve(), Grasshopper.Kernel.Data.GH_Path(i))
        else:
            for i in range(len(_data.plines_with_joints)):
                for j in range(len(_data.plines_with_joints[i])):
                    if _data.plines_with_joints[i][j].Count == 2:
                        _lines.Add(_data.plines_with_joints[i][j].ToNurbsCurve(), Grasshopper.Kernel.Data.GH_Path(i))
                    else:
                        if j % 2 == 0:
                            print(_data.plines_with_joints[i][j])
                            _plines_0.Add(
                                _data.plines_with_joints[i][j].ToNurbsCurve(), Grasshopper.Kernel.Data.GH_Path(i)
                            )
                        else:
                            _plines_1.Add(
                                _data.plines_with_joints[i][j].ToNurbsCurve(), Grasshopper.Kernel.Data.GH_Path(i)
                            )

        _insertion_vectors = th.list_to_tree(_data.insertion_vectors)
        _joints_per_face = th.list_to_tree(_data.joints_per_face)
        _three_valence = th.list_to_tree(_data.three_valence)
        _adjacency = th.list_to_tree(_data.adjacency)
        _cut_types = th.list_to_tree(_data.cut_types)

        # return outputs if you have them; here I try it for you:
        return (
            _plines_0,
            _plines_1,
            _lines,
            _insertion_vectors,
            _joints_per_face,
            _three_valence,
            _adjacency,
            _cut_types,
        )
# ---------- end input_get ----------
loft_b = Loft_brep(p0=input_get.plines_0, p1=input_get.plines_1)  # -> brep, npc; inputs p0: list of Curve, p1: list of Curve, c: Color
#   port p0: polylines with holes, bottom
#   port p1: polylines with holes, top
#   port c: color, if given all the brep is colorized else only the sides, this is useful for boolean difference
#   port brep: lofted and capped brep with holes
#   port npc: non planar curves, if not empty something is wrong with joinery algorithm
# ---------- loft_b: Python ----------
"""get joints ids and connections areas between elements"""

__author__ = "petras vestartas"
__version__ = "2023.03.31"


from ghpythonlib.componentbase import executingcomponent as component
import Rhino
from System.Drawing import Color
import System


class connections_zones(component):
    def project_curves_to_plane(self, curves):
        points = []
        for curve in curves:
            for point in curve.Points:
                points.append(point.Location)

        result, plane = Rhino.Geometry.Plane.FitPlaneToPoints(points)

        xform = Rhino.Geometry.Transform.PlanarProjection(plane)
        curves_projected = []
        for curve in curves:
            curve_projected = curve.DuplicateCurve()
            curve_projected.Transform(xform)
            curves_projected.append(curve_projected)
        return curves_projected

    def loft_polylines_with_holes(self, curves0, curves1, color):
        """Loft polylines with holes

        Parameters
        ----------
        curves0 : list[rg.Polyline]
        curves1 : list[rg.Polyline]

        Returns
        -------
        rg.Brep
            brep as lofted polylines and cap them
        """

        ###############################################################################
        # user input
        ###############################################################################

        if curves0 == [None]:
            return
        if curves1 == [None]:
            return

        if len(curves0) == 0:
            return
        if len(curves1) == 0:
            return

        flag = len(curves0) is not 0 if True else len(curves1) != 0
        if flag:
            curves = []
            curves2 = []

            flag0 = len(curves1) == 0
            flag1 = len(curves0) == 0 and len(curves1) != 0
            flag2 = len(curves0) and len(curves1)

            if flag0:
                for i in range(len(curves0)):
                    if float(i) >= float(len(curves0)) * 0.5:
                        curves2.Add(curves0[i])
                    else:
                        curves.Add(curves0[i])
            elif flag1:
                for i in range(0, len(curves1), 2):
                    curves.Add(curves1[i])
                    curves2.Add(curves1[i + 1])
            elif flag2:
                curves = curves0
                curves2 = curves1

            curves0 = curves
            curves1 = curves2

        ###############################################################################
        # Create mesh of the bottom face
        ###############################################################################
        non_planar_curves = []

        brep_0 = Rhino.Geometry.Brep.CreatePlanarBreps(curves0, Rhino.RhinoDoc.ActiveDoc.ModelAbsoluteTolerance)

        if brep_0 is None:
            for c in curves0:
                non_planar_curves.append(c.DuplicateCurve())
            curves0 = self.project_curves_to_plane(curves0)
            brep_0 = Rhino.Geometry.Brep.CreatePlanarBreps(curves0, Rhino.RhinoDoc.ActiveDoc.ModelAbsoluteTolerance)[0]
        else:
            brep_0 = brep_0[0]

        brep_1 = Rhino.Geometry.Brep.CreatePlanarBreps(curves1)

        if brep_1 is None:
            for c in curves1:
                non_planar_curves.append(c.DuplicateCurve())
            curves1 = self.project_curves_to_plane(curves1)
            brep_1 = Rhino.Geometry.Brep.CreatePlanarBreps(curves1, Rhino.RhinoDoc.ActiveDoc.ModelAbsoluteTolerance)[0]
        else:
            brep_1 = brep_1[0]

        ###############################################################################
        # Create lofts
        ###############################################################################
        breps_to_join = [brep_0, brep_1]
        for i in range(len(curves0)):
            wall = Rhino.Geometry.Brep.CreateFromLoft(
                [curves0[i], curves1[i]],
                Rhino.Geometry.Point3d.Unset,
                Rhino.Geometry.Point3d.Unset,
                Rhino.Geometry.LoftType.Normal,
                False,
            )[0]
            breps_to_join.append(wall)

        ###############################################################################
        # Join Brep
        ###############################################################################

        solid = Rhino.Geometry.Brep.JoinBreps(breps_to_join, Rhino.RhinoDoc.ActiveDoc.ModelAbsoluteTolerance)[0]

        faces = []
        for i in range(solid.Faces.Count):
            faces.append(solid.Faces[i].DuplicateFace(False))

        solid = Rhino.Geometry.Brep.JoinBreps(faces, Rhino.RhinoDoc.ActiveDoc.ModelAbsoluteTolerance)[0]

        if solid:
            solid.Faces.SplitKinkyFaces(Rhino.RhinoMath.DefaultAngleTolerance, True)

            if Rhino.Geometry.BrepSolidOrientation.Inward is solid.SolidOrientation:
                solid.Flip()

        if color is not None:
            for i in range(solid.Faces.Count):
                solid.Faces[i].PerFaceColor = color
        else:
            for i in range(solid.Faces.Count):
                if i < 2:
                    solid.Faces[i].PerFaceColor = Color.LightGray  # Color.LightGray
                else:
                    solid.Faces[i].PerFaceColor = Color.DeepPink

        return solid, non_planar_curves

    def RunScript(self,
            _p0: System.Collections.Generic.List[Rhino.Geometry.Curve],
            _p1: System.Collections.Generic.List[Rhino.Geometry.Curve],
            _c: System.Drawing.Color):
        if _p0 and _p1:
            return self.loft_polylines_with_holes(_p0, _p1, _c)
# ---------- end loft_b ----------

# ---- group: Notches
dam = DataDam(DataA=solver, BufferDelay=10000000, BufferMode=0)
xy = XYPlane(Origin=Point(0, 0, 0))
orient_data = Orient_data(data=dam, planes=xy)  # -> plines_o; inputs planes: list of Plane, ids: list of Int32
#   port data: collection of inputs that represent the elements, insertion vectors, joint types and adjacency, use input_set commonent to group these inputs
#   port planes: target planes for orientation of elements
#   port ids: indices to orient only certain elements
#   port plines_o: oriented outlines using plane to plane transformation
# ---------- orient_data: Python ----------
"""orient element polylines from their average plane to a user given target plane"""
from Rhino.Geometry import Polyline
from Rhino.Geometry import Transform
from Rhino.Geometry import Vector3d
from Rhino.Geometry import Plane
from ghpythonlib.componentbase import executingcomponent as component
import Grasshopper
import System
import Rhino


class MyComponent(component):
    def get_plane(self, _polyline, _orientation_point):

        len = _polyline.Count - 1
        normal = Vector3d(0, 0, 0)

        for i in range((_polyline.Count - 1)):
            num = ((i - 1) + len) % len
            item1 = ((i + 1) + len) % len
            point3d = _polyline[num]
            point3d1 = _polyline[item1]
            item2 = _polyline[i]
            normal = normal + Vector3d.CrossProduct(Vector3d(item2 - point3d), Vector3d(point3d1 - item2))

        normal.Unitize()
        plane = Plane(_polyline.CenterPoint(), normal)
        if plane.DistanceTo(_orientation_point) < 0:
            plane.Flip()

        return plane

    def RunScript(self,
            _data,
            _planes: System.Collections.Generic.List[Rhino.Geometry.Plane],
            _ids: System.Collections.Generic.List[int]):

        if _data is None:
            return

        target_planes = _planes if _planes else [Plane.WorldXY]
        _plines = Grasshopper.DataTree[Polyline]()

        if not _ids:
    
            for i in range(len(_data.plines_with_joints)):
                xform = Transform.PlaneToPlane(
                    self.get_plane(_data.plines_with_joints[i][-1], _data.plines_with_joints[i][-2][0]), target_planes[i % len(target_planes)]
                )

                for j in range(len(_data.plines_with_joints[i])):
                    polyline_copy = Polyline(_data.plines_with_joints[i][j])
                    polyline_copy.Transform(xform)
                    _plines.Add(polyline_copy, Grasshopper.Kernel.Data.GH_Path(i))
        else:
            total_element_count = len(_data.plines_with_joints)
            for i in range(len(_ids)):
                local_id = _ids[i]
                if local_id >= total_element_count or local_id < 0:
                    continue
                xform = Transform.PlaneToPlane(
                    self.get_plane(_data.plines_with_joints[local_id][0], _data.plines_with_joints[local_id][1][0]),
                    target_planes[i % len(target_planes)],
                )
                for j in range(len(_data.plines_with_joints[local_id])):
                    polyline_copy = Polyline(_data.plines_with_joints[local_id][j])
                    polyline_copy.Transform(xform)
                    _plines.Add(polyline_copy, Grasshopper.Kernel.Data.GH_Path(i))

        _plines_oriented = _plines


        # return outputs if you have them; here I try it for you:
        return _plines_oriented
# ---------- end orient_data ----------
branch = TreeBranch(Tree=orient_data, Path=Slider(7, range=0..100), MaintainPaths=True)  # -> reverse(Branch)
split = SplitList(List=branch, Index=2)  # -> ListA, ListB
item_3 = ListItem(List=split.ListA, Index=0, Wrap=True)  # -> Item, Item1
ext = ExtendCurve(Curve=split.ListB, Type=0, Start=100, End=100)
ears = Ears(p0=item_3.Item, p1=item_3.Item1, radius=Slider(4, range=0..10), notch_type=Slider(1, range=0..10), union=Toggle(True))  # -> lines, lines_corners, lines_horizontal, offset0, offset1, planes, cut_extrusions; inputs p0: tree of Curve, p1: tree of Curve, radius: Double, notch_type: Int32, union: Boolean
#   port p0: a data-tree of polyline pairs with holes
#   port p1: a data-tree of polyline pairs with holes
#   port radius: notch radius that is equal to cutting tool radius
#   port notch_type: 0 - none, 1 - diagonal, 2 - translation
#   port union: get cutting elements for boolean difference and union
#   port lines_corners: lines which shows the correners from where the notch starts
#   port lines_horizontal: notches are represented as horizontal lines that can be used for milling
#   port offset0: offset outrline for cutting without notches
#   port offset1: offset outrline for cutting without notches
#   port planes: element plane that can be used for orientation
#   port cut_extrusions: breps that can be used for boolean difference
# ---------- ears: Python ----------
"""get joints ids and connections areas between elements"""

__author__ = "petras vestartas"
__version__ = "2023.04.01"


from ghpythonlib.componentbase import executingcomponent as component

import System
import Rhino
from Rhino.Geometry import Polyline
from Rhino.Geometry import Plane
from Rhino.Geometry import Point3d
from Rhino.Geometry import Vector3d
from Rhino.Geometry import Line
from Rhino.Geometry import Transform
from Rhino.Geometry import Arc
from Rhino.Geometry import Brep
from Rhino.Geometry import Curve
import math
import Grasshopper
from ghpythonlib import treehelpers


class Ears(component):
    def to_polyline_from_control_points(self, curve):
        """
        Convert a given curve to a polyline. If the curve cannot be directly converted,
        it uses the NURBS curve points to approximate the polyline.

        Args:
        curve: A curve object that supports TryGetPolyline and ToNurbsCurve methods.

        Returns:
        Polyline object approximating the input curve.
        """
        result, polyline = curve.TryGetPolyline()

        if not result:
            nurbs_curve = curve.ToNurbsCurve()
            point3d_array = []

            for i in range(len(nurbs_curve.Points)):
                result, pt = nurbs_curve.Points.GetPoint(i)
                if result:
                    point3d_array.append(pt)

            polyline = Polyline(point3d_array)
            nurbs_curve = polyline.ToNurbsCurve()
            result, polyline = nurbs_curve.TryGetPolyline()

            if not result:
                raise ValueError("Failed to convert NURBS curve to polyline.")

            polyline.CollapseShortSegments(0.01)

        else:
            polyline.CollapseShortSegments(0.01)

        return polyline

    def offset_parallelograms(self, x, y, radius):
        """offset outlines by intersecting side planes

        Parameters
        ----------
        x : first closed outline
        y : second closed outline
        radius : offset distance that normally corresponds to the tool radius

        Returns
        -------
        tuple(polyline0, polyline1)
            two outlines
        bool
            if polylines are closed
        """

        if len(x) < 2 or len(y) < 2:
            print("WARNING empty polylines")
            return

        ###############################################################################
        # Get edge planes that are offseted
        ###############################################################################

        offset_planes = []
        for i in range(len(x) - 1):
            c = (x[i] + x[i + 1]) * 0.5
            XAxis = y[i] - y[i + 1] if x[i].DistanceTo(x[i + 1]) < 0.01 else x[i] - x[i + 1]
            YAxis = x[i] - y[i]
            ZAxis = Vector3d.CrossProduct(XAxis, YAxis)
            ZAxis.Unitize()
            plane = Plane(c + ZAxis * radius, XAxis, YAxis)
            offset_planes.append(plane)

        ###############################################################################
        # Intersect planes one by one
        ###############################################################################

        result, fit_plane0 = Plane.FitPlaneToPoints(x)
        result, fit_plane1 = Plane.FitPlaneToPoints(y)
        offset_polyline0 = Polyline()
        offset_polyline1 = Polyline()

        closed = x[0].DistanceToSquared(x[len(x) - 1]) < 0.0001

        for i in range(len(offset_planes)):
            result, l = Rhino.Geometry.Intersect.Intersection.PlanePlane(
                offset_planes[(len(offset_planes) + (i - 1)) % len(offset_planes)], offset_planes[i]
            )
            result, types_of_notches_per_point = Rhino.Geometry.Intersect.Intersection.LinePlane(l, fit_plane0)
            offset_polyline0.Add(l.PointAt(types_of_notches_per_point))
            result, types_of_notches_per_point = Rhino.Geometry.Intersect.Intersection.LinePlane(l, fit_plane1)
            offset_polyline1.Add(l.PointAt(types_of_notches_per_point))

        if closed == False:

            l = Line.Unset
            result, l = Rhino.Geometry.Intersect.Intersection.PlanePlane(fit_plane0, offset_planes[0])
            offset_polyline0.Insert(0, l.ClosestPoint(x[0], False))
            result, l = Rhino.Geometry.Intersect.Intersection.PlanePlane(
                fit_plane0, offset_planes[len(offset_planes) - 1]
            )
            offset_polyline0.Add(l.ClosestPoint(x[len(x) - 1], False))

            result, l = Rhino.Geometry.Intersect.Intersection.PlanePlane(fit_plane1, offset_planes[0])
            offset_polyline1.Insert(0, l.ClosestPoint(y[0], False))
            result, l = Rhino.Geometry.Intersect.Intersection.PlanePlane(
                fit_plane1, offset_planes[len(offset_planes) - 1]
            )
            offset_polyline1.Add(l.ClosestPoint(y[len(y) - 1], False))
        else:
            offset_polyline0.Add(offset_polyline0[0])
            offset_polyline1.Add(offset_polyline1[0])

        ###############################################################################
        # Output
        ###############################################################################
        return offset_polyline0, offset_polyline1, closed

    def align_plane(self, plane, v):

        p = Plane(plane)

        result, parameterAlongXDirection, parameterAlongYDirection = p.ClosestParameter(p.Origin + v)
        angle = math.atan2(parameterAlongXDirection, parameterAlongYDirection)
        p.Rotate(-angle + 1.5707963267949, p.ZAxis, p.Origin)

        return p

    def vector_projection(self, v0, v1, extendV1=False):

        v0L = v0.Length
        v1L = v1.Length
        v0.Unitize()
        v1.Unitize()
        dotProduct = v0 * v1
        v0ProjectionLen = v0L * dotProduct
        if extendV1:
            return v1 * (v0ProjectionLen + v1L)
        return v1 * v0ProjectionLen

    def get_leveled_vector(self, vector, vertical_height):

        dir = Vector3d(vector)
        dir.Unitize()
        angle = Vector3d.VectorAngle(dir, Vector3d(0, 0, 1))
        inclined_offset_by_vertical_distance = vertical_height * math.tan(angle)
        dir = dir * inclined_offset_by_vertical_distance

        return dir

    def notches_lines(
        self,
        plines0,
        plines1,
        plines0_offset,
        plines1_offset,
        _radius,
        types_of_notches_per_point,
        offset_distances,
        is_closed,
        border,
    ):
        """create drilling lines that represent notches

        Parameters
        ----------
        plines0_offset[i], plines1_offset[i], _radius, notch_types, offset_distances
        plines0 : bottom offseted outlines by plane to plane inersection
        plines1 : top offseted outlines by plane to plane inersection
        radius : offset distance
        types_of_notches_per_point : type of notch: bisector, translation u, trasnlation v, rounding, none
        offset_distances : perpendicular distance between corner lines and offset lines
        is_closed : check if the offseted outline is closed
        border : bool if border or hole
        Returns
        -------
        list(Line)
            drilling lines
        list(Line)
            drilling lines of corners that notches belongs to
        """

        ###############################################################################
        # Copy the offset polylines
        # Remove end point if the polyline is closed
        ###############################################################################
        xA_ = Polyline(plines0)
        xB_ = Polyline(plines1)
        xA = Polyline(plines0_offset)
        xB = Polyline(plines1_offset)

        if is_closed:
            xA_.RemoveAt(len(xA_) - 1)
            xB_.RemoveAt(len(xB_) - 1)
            xA.RemoveAt(len(xA) - 1)
            xB.RemoveAt(len(xB) - 1)

        ###############################################################################
        # Output lists
        ###############################################################################
        l0_corners = []  # fillet
        l0 = []
        l1 = []  # fillet
        l2 = []  # fillet
        plines = []
        planes = []

        ###############################################################################
        # create plane to plane transformation for geometry rotated in 3D
        ###############################################################################
        result, base_plane = Plane.FitPlaneToPoints(xA)
        if base_plane.DistanceTo(xB[0]) < 0.0:
            base_plane.Flip()
        to_xy = Transform.PlaneToPlane(base_plane, Plane.WorldXY)

        ###############################################################################
        # For notches or fillet, if fillet twice bigger radius is needed
        # also see this if statement if (types_of_notches_per_point[0] == 4 && angle_ > 0) : because corner is  inversed
        ###############################################################################
        fillet = False
        R_ = _radius * 2 if types_of_notches_per_point[0] == 4 else _radius
        notchStart = True

        for i in range(0, len(xA)):

            ###############################################################################
            # Get vertical lines
            ###############################################################################
            normal = Line(xA[i], xB[i])
            n = len(xA)
            next = (i + 1) % n
            nextNext = (i + 2) % n
            prev = (((i - 1) % n) + n) % n

            p0a = xA[i]
            p1a = xA[next]
            p2a = xA[prev]
            p3a = xA[nextNext]

            p0b = xB[i]
            p1b = xB[next]
            p2b = xB[prev]
            p3b = xB[nextNext]

            normal1 = Line(xA[next], xB[next])
            normal2 = Line(xA[prev], xB[prev])

            ###############################################################################
            # Measure Concavity
            ###############################################################################
            cornera = Polyline([p2a, p0a, p1a])
            cornerb = Polyline([p2b, p0b, p1b])

            cornera.Transform(Transform.PlaneToPlane(Plane(p0a, normal.Direction), Plane.WorldXY))
            nextEdge = cornera.SegmentAt(0).Direction
            previousEdge = cornera.SegmentAt(1).Direction

            angle_ = (
                (math.atan2(nextEdge.X, nextEdge.Y) - math.atan2(previousEdge.X, previousEdge.Y) + math.pi * 2)
                % (math.pi * 2)
            ) - math.pi

            if types_of_notches_per_point[0] == 4 and angle_ > 0:
                l0_corners.append(Line.Unset)
                l0.append(Line.Unset)
                l1.append(Line.Unset)
                l2.append(Line.Unset)
                continue

            elif types_of_notches_per_point[0] != 4 and angle_ < 0:
                l0_corners.append(Line.Unset)
                l0.append(Line.Unset)
                l1.append(Line.Unset)
                l2.append(Line.Unset)
                continue

            ###############################################################################
            # Get Perpependicular points
            # Intersect current and neighbor lines
            ###############################################################################

            result, fit_plane1 = Plane.FitPlaneToPoints([normal.To, normal1.To, normal2.To])
            normalPl = Plane(normal.From, fit_plane1.ClosestPoint(normal.From) - normal.From)
            f0, t = Rhino.Geometry.Intersect.Intersection.LinePlane(normal, normalPl)
            p0a = normal.PointAt(t)
            f1, t = Rhino.Geometry.Intersect.Intersection.LinePlane(normal1, normalPl)
            p1a = normal1.PointAt(t)
            f2, t = Rhino.Geometry.Intersect.Intersection.LinePlane(normal2, normalPl)
            p2a = normal2.PointAt(t)

            ###############################################################################
            # Compute offset vectors on perpedicular points
            # Error here, with v0 and v1 orientaton, must be rotated  90 deg
            ###############################################################################
            v0 = p0a - p1a
            v1 = p0a - p2a

            v0.Unitize()
            v1.Unitize()

            ###############################################################################
            # Depending on angle the offset changes, sin gives this distance value
            ###############################################################################
            angle = Vector3d.VectorAngle(v0, v1, Plane(p0a, v0, v1))
            radius = R_ * ((1 / math.atan(angle)))
            radius = -offset_distances[i].Length
            # translation
            radius *= -1

            ###############################################################################
            # TYPE A Notch - Line Directions A-B
            ###############################################################################
            local_cornera_ = Polyline([xA_[prev], xA_[i], xA_[next]])
            local_cornerb_ = Polyline([xB_[prev], xB_[i], xB_[next]])
            local_cornera = Polyline([xA[prev], xA[i], xA[next]])
            local_cornerb = Polyline([xB[prev], xB[i], xB[next]])
            pl0 = self.align_plane(normalPl, v0)
            pl1 = self.align_plane(normalPl, v1)
            extension0 = 0
            extension1 = 0
            normalXAxis0 = Line(
                local_cornera.SegmentAt(0).ClosestPoint(local_cornera_[1], False),
                local_cornerb.SegmentAt(0).ClosestPoint(local_cornerb_[1], False),
            )
            normalXAxis1 = Line(
                local_cornera.SegmentAt(1).ClosestPoint(local_cornera_[1], False),
                local_cornerb.SegmentAt(1).ClosestPoint(local_cornerb_[1], False),
            )
            dist0 = xA.ClosestPoint(normalXAxis0.From).DistanceTo(normalXAxis0.From)
            dist1 = xA.ClosestPoint(normalXAxis1.From).DistanceTo(normalXAxis1.From)
            border_or_hole = dist0 < dist1 if border else dist0 > dist1
            if border_or_hole:
                normalXAxis0 = normalXAxis1
            else:
                normalXAxis1 = normalXAxis0

            ###############################################################################
            # TYPE B Notch -  Diaognal
            ###############################################################################
            bisectorDir = offset_distances[i]

            pl2normalXAxis2Fillet = self.align_plane(normalPl, bisectorDir)
            length = bisectorDir.Length
            normalXAxis2 = Line(xA[i] + bisectorDir, xB[i] + bisectorDir)

            ###############################################################################
            # TYPE C Notch -  Fillet
            ###############################################################################
            bisectorDirFillet = pl0.XAxis * radius + pl1.XAxis * radius
            pl2 = self.align_plane(normalPl, bisectorDirFillet)
            lengthFillet = bisectorDir.Length
            bisectorDirFillet *= -(length) / length

            normalXAxis2Fillet = Line(
                xA[i] + bisectorDirFillet * ((length - R_) / length),
                xB[i] + bisectorDirFillet * ((length - R_) / length),
            )
            normalXAxis2FilletCenter = Line(xA[i] + bisectorDirFillet, xB[i] + bisectorDirFillet)
            normalXAxis2Fillet0 = Line(
                normalXAxis2FilletCenter.From + pl0.XAxis * (radius + extension0),
                normalXAxis2FilletCenter.To + pl0.XAxis * (radius + extension0),
            )
            normalXAxis2Fillet1 = Line(
                normalXAxis2FilletCenter.From + pl1.XAxis * (radius + extension0),
                normalXAxis2FilletCenter.To + pl1.XAxis * (radius + extension0),
            )

            ###############################################################################
            # Output
            ###############################################################################
            planes.append(pl0)
            planes.append(pl1)
            planes.append(pl2)

            lastFlag = False

            l0_corners.append(Line(xA[i], xB[i]))
            if len(types_of_notches_per_point) == 1:
                if types_of_notches_per_point[0] == 2 or types_of_notches_per_point[0] == 3:
                    flag = (
                        p0a.DistanceToSquared(p1a) < p0a.DistanceToSquared(p2a)
                        if types_of_notches_per_point[0] == 3
                        else p0a.DistanceToSquared(p1a) > p0a.DistanceToSquared(p2a)
                    )
                    if flag:
                        l0.append(normalXAxis0)
                    else:
                        l0.append(normalXAxis1)

                elif types_of_notches_per_point[0] == 1:
                    l0.append(normalXAxis2)

                elif types_of_notches_per_point[0] == 4:
                    fillet = True
                    l0.append(normalXAxis2Fillet0)
                    l1.append(normalXAxis2Fillet)
                    l2.append(normalXAxis2Fillet1)

                elif types_of_notches_per_point[0] == 5 or types_of_notches_per_point[0] == 6:
                    if i % 2 == 1:
                        lastFlag = not lastFlag
                    if types_of_notches_per_point[0] == 6:
                        lastFlag = not lastFlag

                    if lastFlag:
                        l0.append(normalXAxis0)
                    else:
                        l0.append(normalXAxis1)

                else:
                    l0.append(Line.Unset)

            else:

                if types_of_notches_per_point[i % len(types_of_notches_per_point)] == 2:
                    l0.append(normalXAxis0)

                elif types_of_notches_per_point[i % len(types_of_notches_per_point)] == 3:
                    l0.append(normalXAxis1)

                elif types_of_notches_per_point[i % len(types_of_notches_per_point)] == 4:
                    fillet = True
                    l0.append(normalXAxis2Fillet0)
                    l1.append(normalXAxis2Fillet)
                    l2.append(normalXAxis2Fillet1)

                elif types_of_notches_per_point[i % len(types_of_notches_per_point)] == 1:
                    l0.append(normalXAxis2)

                else:
                    l0.append(Line.Unset)

        ###############################################################################
        # append Notches to a Pair of Polylines
        ###############################################################################
        lines = []
        lines_corners = []
        lines_horizontal = []
        result, fitPlane = Plane.FitPlaneToPoints(xA)
        result, fitPlaneB = Plane.FitPlaneToPoints(xB)

        xA_Notch = Polyline()
        xB_Notch = Polyline()

        extensions = []
        is_below = []

        for i in range(len(xA)):

            # Extend bottom line to compensate drilling bit thickness and angle
            extensionV = xA[i] - xB[i]
            extension = abs(math.tan(Vector3d.VectorAngle(extensionV, fitPlane.ZAxis)) * R_)
            extensionV.Unitize()

            # Move tool-path below surface
            extensionV = extensionV * extension
            extensions.append(extensionV)

            next = (i + 1) % len(xA)
            prev = (len(xA) + (i - 1)) % len(xA)

            # Check direction of inclined cut, the check is made according to XY plane
            side_plane = Plane(xA[i], xB[i], xA[next])

            mid_0 = 0.5 * (xA[i] + xA[next])
            mid_1 = 0.5 * (xB[i] + xB[next])
            segment = Line(xB[i], xB[next])

            tool_direction = Line(mid_0, segment.ClosestPoint(mid_0, False))
            side_plane.Transform(to_xy)

            is_below.append(0)
            if side_plane.Normal.Z < -0.01:
                is_below[i] = -1
            elif side_plane.Normal.Z > 0.01:
                is_below[i] = 1
                extensions[i] *= -1
            else:
                extensions[i] *= 0

        count = 0

        for i in range(len(xA)):

            # Extend bottom line to compensate drilling bit thickness and angle
            extensionV = extensions[i]
            next = (i + 1) % len(xA)
            prev = (len(xA) + (i - 1)) % len(xA)
            # Fillet corner
            if fillet:
                if l0[count] != Line.Unset:

                    result, t = Rhino.Geometry.Intersect.Intersection.LinePlane(l0[count], fitPlane)
                    xA_Notch.append(l0[count].PointAt(t) + extensionV * 0)
                    result, t = Rhino.Geometry.Intersect.Intersection.LinePlane(l2[count], fitPlane)
                    xA_Notch.append(l2[count].PointAt(t) + extensionV * 0)

                    result, t = Rhino.Geometry.Intersect.Intersection.LinePlane(l0[count], fitPlaneB)
                    xB_Notch.append(l0[count].PointAt(t))
                    result, t = Rhino.Geometry.Intersect.Intersection.LinePlane(l2[count], fitPlaneB)
                    xB_Notch.append(l2[count].PointAt(t))

                else:
                    xA_Notch.append(xA[i] + extensionV * 0)
                    xB_Notch.append(xB[i])

            # Notch corner
            else:
                if l0[count] != Line.Unset:
                    lines.append(l0[count])
                    lines_corners.append(l0_corners[count])

            count = count + 1

        ###############################################################################
        # Cut lines by bottom and top planes and extend by the radius
        ###############################################################################

        for i in range(len(lines)):
            # cut the lines by top and bottom planes
            result, t = Rhino.Geometry.Intersect.Intersection.LinePlane(lines[i], fitPlane)
            new_point_0 = lines[i].PointAt(t)
            result, t = Rhino.Geometry.Intersect.Intersection.LinePlane(lines[i], fitPlaneB)
            new_point_1 = lines[i].PointAt(t)

            # get extension direction
            l_temp = Line(new_point_0, new_point_1)
            extension_dir = new_point_1 - new_point_0
            extension_dir.Unitize()
            l_temp.Transform(to_xy)
            extension_vector = self.get_leveled_vector(l_temp.Direction, _radius)
            extension_dir = extension_dir * extension_vector.Length

            # extend the line and update the line
            lines[i] = Line(new_point_0 - extension_dir * 1, new_point_1 + extension_dir * 1)

        for i in range(len(lines_corners)):
            result, t = Rhino.Geometry.Intersect.Intersection.LinePlane(lines_corners[i], fitPlane)
            new_point_0 = lines_corners[i].PointAt(t)
            result, t = Rhino.Geometry.Intersect.Intersection.LinePlane(lines_corners[i], fitPlaneB)
            new_point_1 = lines_corners[i].PointAt(t)

            # get extension direction
            l_temp = Line(new_point_0, new_point_1)
            extension_dir = new_point_1 - new_point_0
            extension_dir.Unitize()
            l_temp.Transform(to_xy)
            extension_vector = self.get_leveled_vector(l_temp.Direction, _radius)
            extension_dir = extension_dir * extension_vector.Length

            # extend the line and update the line
            lines_corners[i] = Line(new_point_0 - extension_dir * 1, new_point_1 + extension_dir * 1)

        for i in range(len(lines_corners)):
            lines_horizontal.append(Line(lines[i].From, lines_corners[i].From))
            lines_horizontal.append(Line(lines[i].To, lines_corners[i].To))

        ###############################################################################
        # Output
        ###############################################################################

        return lines, lines_corners, lines_horizontal, fitPlane, fitPlaneB

    def sort_by_size(self, _p0, _p1):
        # This function assumes _p0 and _p1 are lists of objects that have a method GetBoundingBox.
        # It sorts these objects by the diagonal length of their bounding boxes in descending order.

        try:
            # Creating a list of tuples, each containing the diagonal length and the corresponding objects from _p0 and _p1
            items_with_sizes = [(obj.GetBoundingBox(True).Diagonal.Length, obj, _p1[i]) for i, obj in enumerate(_p0)]
        except Exception as e:
            print(f"Error retrieving bounding box sizes: {str(e)}")
            return None

        # Sorting the list of tuples by the diagonal length, which is the first element of each tuple
        items_with_sizes.sort(reverse=True, key=lambda x: x[0])

        # Unzipping the sorted tuples into separate lists
        sizes, sorted_p0, sorted_p1 = zip(*items_with_sizes)

        return sorted_p0, sorted_p1

    def get_ears(self, _c0, _c1, _radius, _notch_type, _union):

        ###############################################################################
        # User interface, convert curves toi polylines
        ###############################################################################
        plines0 = []
        plines1 = []
        plines0_offset = []
        plines1_offset = []
        planes0 = []
        planes1 = []
        are_closed = []
        for i in range(len(_c0)):
            plines0.append(self.to_polyline_from_control_points(_c0[i]))
            plines1.append(self.to_polyline_from_control_points(_c1[i]))
            plines0_offset.append(plines0[-1])
            plines1_offset.append(plines1[-1])
            are_closed.append(True)

        ###############################################################################
        # Offset otlines, faces must be planar
        ###############################################################################
        for i in range(len(_c0)):
            plines0_offset[i], plines1_offset[i], are_closed[i] = self.offset_parallelograms(
                plines0[i], plines1[i], _radius
            )

        ###############################################################################
        # Create notches
        ###############################################################################

        notch_lines_nested = []
        notch_lines_nested_corners = []
        notch_lines_horizontal_nested = []
        for i in range(len(plines0)):

            pline_length = plines0[i].Length
            notch_types = [0] * (len(plines0[i]) - 1)
            offset_distances = [Vector3d(0, 0, 0)] * (len(plines0[i]) - 1)

            n = len(plines0[i]) - 1
            for j in range(len(plines0[i]) - 1):

                l1 = Line(plines0_offset[i][j], plines1_offset[i][j])
                l2 = Line(plines0[i][j], plines1[i][j])

                dist = l1.ClosestPoint(l2.From, False).DistanceTo(l2.From) - _radius
                bisector_dir = l2.From - (l1.ClosestPoint(l2.From, False))
                bisector_dir.Unitize()
                bisector_dir *= dist
                offset_distances[j] = bisector_dir

                if _notch_type > 1:

                    shift = 0 if j % 2 == 1 else 0

                    if pline_length < 300:

                        shift = 0 if j % 2 == 0 else 1

                    notch_types[j] = 3 - shift
                else:
                    notch_types[j] = _notch_type

            lines, lines_corners, lines_horizontal, plane0, plane1 = self.notches_lines(
                plines0[i],
                plines1[i],
                plines0_offset[i],
                plines1_offset[i],
                _radius,
                notch_types,
                offset_distances,
                are_closed[i],
                i == 0,
            )
            notch_lines_nested.append(lines)
            notch_lines_nested_corners.append(lines_corners)
            notch_lines_horizontal_nested.append(lines_horizontal)
            planes0.append(plane0)
            planes1.append(plane1)

        ###############################################################################
        # Output
        ###############################################################################
        return (
            plines0_offset,
            plines1_offset,
            planes0,
            planes1,
            are_closed,
            notch_lines_nested,
            notch_lines_nested_corners,
            notch_lines_horizontal_nested,
        )

    def get_notch_geometry(self, _c0, _c1, notch_lines_nested, notch_lines_nested_corner, planes0, planes1, radius):

        # geo = []
        cut_curves0 = []
        cut_curves1 = []
        cut_extrusions = []
        for i in range(len(notch_lines_nested)):

            cutter_curves0 = []
            cutter_curves1 = []
            for j in range(len(notch_lines_nested[i])):

                # get plane
                p0 = notch_lines_nested[i][j].PointAt(0.5)
                p1 = notch_lines_nested_corner[i][j].ClosestPoint(p0, False)
                xaxis = p0 - p1
                zaxis = notch_lines_nested[i][j].Direction
                yaxis = Vector3d.CrossProduct(xaxis, zaxis)
                plane = Plane(p0, xaxis, yaxis)

                # construction 5 points for an arc and rectangle profile
                p0_profile = p0 + plane.YAxis * radius
                p1_profile = p1 + plane.YAxis * radius
                p2_profile = p1 - plane.YAxis * radius
                p3_profile = p0 - plane.YAxis * radius
                p4_profile = p0 + plane.XAxis * radius
                p5_profile = p1 - plane.XAxis * radius

                # construct PolyCurve
                arc0 = Arc(p0_profile, p4_profile, p3_profile)
                arc1 = Arc(p1_profile, p5_profile, p2_profile)
                polyline0 = Polyline([p0_profile, p1_profile]).ToNurbsCurve()
                polyline1 = Polyline([p2_profile, p3_profile]).ToNurbsCurve()

                joined_curve = Rhino.Geometry.Curve.JoinCurves(
                    [arc0.ToNurbsCurve(), polyline0.ToNurbsCurve(), arc1.ToNurbsCurve(), polyline1.ToNurbsCurve()], 0.01
                )[0]
                joined_curve.Transform(Transform.Translation(notch_lines_nested[i][j].Direction * 1))

                # extrude
                extrusion = Rhino.Geometry.Extrusion.Create(
                    joined_curve.ToNurbsCurve(), notch_lines_nested[i][j].Length * 2, True
                ).ToBrep()

                # brep plane
                result, curves0, points = Rhino.Geometry.Intersect.Intersection.BrepPlane(extrusion, planes0[i], 0.01)
                result, curves1, points = Rhino.Geometry.Intersect.Intersection.BrepPlane(extrusion, planes1[i], 0.01)
                cutter_curves0.append(curves0[0])
                cutter_curves1.append(curves1[0])

                cut_extrusions.append(extrusion)

        return cut_curves0, cut_curves1, cut_extrusions

    def RunScript(self,
            _p0: Grasshopper.DataTree[Rhino.Geometry.Curve],
            _p1: Grasshopper.DataTree[Rhino.Geometry.Curve],
            _radius: float,
            _notch_type: int,
            _union: bool):

        ###############################################################################
        # Run
        ###############################################################################
        radius = _radius if _radius is not None else 1

        if _p0 and _p1:

            if _p0 == None:
                return

            if _p1 == None:
                return

            if _notch_type == None:
                return

            if _p0.DataCount is not _p1.DataCount:
                return

            lines = Grasshopper.DataTree[Line]()
            lines_corners = Grasshopper.DataTree[Line]()
            lines_horizontal = Grasshopper.DataTree[Line]()
            offset0 = Grasshopper.DataTree[Polyline]()
            offset1 = Grasshopper.DataTree[Polyline]()
            planes = Grasshopper.DataTree[Plane]()

            cut_extrusions = Grasshopper.DataTree[Brep]()
            for i in range(_p0.BranchCount):
                _c0, _c1 = self.sort_by_size(_p0.Branch(i), _p1.Branch(i))
                self.get_ears(_c0, _c1, radius, _notch_type, _union)
                (
                    plines0,
                    plines1,
                    planes0,
                    planes1,
                    are_closed,
                    notch_lines_nested,
                    notch_lines_nested_corners,
                    notch_lines_horizontal_nested,
                ) = self.get_ears(_c0, _c1, radius, _notch_type, _union)
                print(notch_lines_nested)
                for notch_lines in notch_lines_nested:
                    lines.AddRange(notch_lines, Grasshopper.Kernel.Data.GH_Path(i))

                for notch_lines in notch_lines_nested:
                    lines_corners.AddRange(notch_lines, Grasshopper.Kernel.Data.GH_Path(i))

                for j in range(len(notch_lines_horizontal_nested)):
                    for k in range(0, len(notch_lines_horizontal_nested[j]), 2):
                        lines_horizontal.AddRange(
                            [notch_lines_horizontal_nested[j][k], notch_lines_horizontal_nested[j][k + 1]],
                            Grasshopper.Kernel.Data.GH_Path(i, j, k),
                        )

                offset0.AddRange(plines0, Grasshopper.Kernel.Data.GH_Path(i))
                offset1.AddRange(plines1, Grasshopper.Kernel.Data.GH_Path(i))
                planes.Add(Plane(plines0[0][0], planes0[0].ZAxis), Grasshopper.Kernel.Data.GH_Path(i))
                notch_geo = []
                if _union:
                    cut_curves0_temp, cut_curves1_temp, cut_extrusions_temp = self.get_notch_geometry(
                        _c0, _c1, notch_lines_nested, notch_lines_nested_corners, planes0, planes1, radius + 0.0000
                    )
                    cut_extrusions.AddRange(cut_extrusions_temp, Grasshopper.Kernel.Data.GH_Path(i))
        return lines, lines_corners, lines_horizontal, offset0, offset1, planes, cut_extrusions
# ---------- end ears ----------
loft_b_2 = Loft_brep(p0=item_3.Item, p1=item_3.Item1)  # -> brep, npc; inputs p0: list of Curve, p1: list of Curve, c: Color; same code as loft_b
line = Line(ext)
pipe = Pipe(Curve=line, Radius=8, Caps=1)
brep = Brep(ears.cut_extrusions)
sdiff = SolidDifference(BrepsA=loft_b_2.brep, BrepsB=flatten([brep, pipe]))
