# Grasshopper definition 13_diamond_subdivision.gh (Grasshopper 1.0.8)
# plug-ins: RhinoCodePluginGH

brep = Brep(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)
xy = XYPlane(Origin=Point(0, 0, 0))
case_3_folded_plates = Case_3_folded_plates(
    surface=brep,
    u_divisions=Slider(3, range=0..10),
    v_divisions=Slider(2, range=0..10),
    base_planes=xy,
    thickness=Slider(1, range=0..10),
    chamfer=Slider(4.3, range=0..11),
    face_positions=Slider(0.15, range=0..1))  # -> mesh, plates, insertion, adjacency, flags; inputs surface: Surface, u_divisions: Int32, v_divisions: Int32, base_planes: list of Plane, thickness: Double, chamfer: Double, face_positions: list of Double
#   port surface: Surface to be divided into plates
#   port u_divisions: divisions in the first direction
#   port v_divisions: divisions in the second direction
#   port base_planes: planes to adjust the base of the mesh
#   port thickness: thickness of the plates
#   port chamfer: distance to chamfer the corners of the plates
#   port face_positions: offset of the plates
#   port mesh: triangulated mesh
#   port plates: pairs of polylines representing the plates
#   port insertion: lines representing inesertion vectors for the solver
#   port adjacency: adjacent faces, edges are marked as -1
#   port flags: boolean values for mesh faces indicating a checkerboard pattern
# ---------- case_3_folded_plates: Python ----------
"""Suface division into a diamon grid and giving thickness to each mesh face """
from ghpythonlib.componentbase import executingcomponent as component
import Rhino.Geometry as RhinoGeometry
import math
from ghpythonlib import treehelpers
import Grasshopper
import Rhino
import System
import math


class case_3_folded_plates:


    def __init__(
        self,
        surface,
        u_divisions,
        v_divisions,
        base_planes,
        thickness,
        chamfer,
        face_positions,
    ):

        # Diamond Subdivision
        self._mesh = RhinoGeometry.Mesh()  # type Mesh

        self._flags = []  # List<bool>
        self._edge_joints = []  # new bool[][]
        self._adjacency = []  # List<int[]>
        self._surface = None  # Surface
        self._u_divisions = 1  # int
        self._v_divisions = 1  # int
        self._base_planes = []  # List<Plane>
        self._insertion_lines = []  # List<Line>

        # Properties for plates
        self._has_ngons = False  # bool

        self._face_thickness = 1  # double
        self._chamfer = 0.01  # double
        self._extend = 1  # double
        self._face_positions = []  # List<double>

        self._f = -1  # int
        self._e = -1  # int
        self._f_v = []  # int[][]
        self._f_e = []  # int[][]
        self._e_f = []  # int[][]
        self._e_ngon_e = {}  # Dictionary<int, int>
        self._f_planes = []  # Plane[]
        self._fe_planes = []  # Plane[][]
        self._bi_planes = []  # Plane[][]
        self._e_planes = []  # Plane[]
        self._e_lines = []  # Line[]
        self._insertion_vectors = []  # Vector3d[]

        # Output
        self._f_polylines_index = []  # string[][]

        self._f_polylines_planes = []  # Plane[][]
        self._f_polylines = []  # Polyline[][]
            
        self._surface = surface
        

        if self._surface == None:
            crv = RhinoGeometry.Arc(
                RhinoGeometry.Point3d(-100, 0, 0),
                RhinoGeometry.Point3d(0, 0, 100),
                RhinoGeometry.Point3d(100, 0, 0),
            ).ToNurbsCurve()
            self._surface = RhinoGeometry.Extrusion.Create(crv, 300, False).ToNurbsSurface()
            self._surface = self._surface.Transpose()

        self._u_divisions = u_divisions if u_divisions != None else 5
        self._v_divisions = v_divisions if v_divisions != None else 2
        self._base_planes = list(base_planes) if base_planes else []
        

        # Run
        self.diamond_subdivision()
        
        self._has_ngons = self._mesh.Ngons.Count > 0
        self._face_thickness = thickness if thickness != None else 1.4
        self._chamfer = chamfer if chamfer else 0
        self._face_positions = [0] if not face_positions else face_positions
        
        # Properties for plates
        self.get_face_vertices()
        self.get_faces_planes()
        self.get_face_edge_planes()
        self.get_bisector_planes()
        self.get_edges()
        self.get_edge_faces()
        self.get_face_polylines()
        self.get_insertion_vectors()

    def diamond_subdivision(self):
        #####################################################################################
        # Main Parameters
        #####################################################################################
        self._mesh = RhinoGeometry.Mesh()
        flags = []

        if self._u_divisions < 1:
            self._u_divisions = 1

        if self._v_divisions < 1:
            self._v_divisions = 1

        v = 0
        face = []  # List<MeshFace>
        pts = []  # List<Point3d>
        interval = self._surface.Domain(0)  # Interval
        interval1 = self._surface.Domain(1)  # Interval
        step_u = (interval.T1 - interval.T0) / (float)(self._u_divisions)  # double
        step_v = (interval1.T1 - interval1.T0) / (float)(self._v_divisions)  # double

        sum_step_u = 0  # double

        #####################################################################################
        # Subdivision
        #####################################################################################
        for i in range(self._u_divisions):
            a = 1 if i % 2 == 0 else 0  # int variable =  1 if not True else 2
            b = 2 if i % 2 == 0 else 3  # int

            sum_step_v = 0  # double
            for j in range(self._v_divisions):
                p0 = self._surface.PointAt(sum_step_u, sum_step_v)
                p1 = self._surface.PointAt(sum_step_u + step_u, sum_step_v)

                self._surface.PointAt(sum_step_u, sum_step_v + step_v * 0.5)
                self._surface.NormalAt(sum_step_u, sum_step_v + step_v * 0.5)
                self._surface.PointAt(sum_step_u + step_u, sum_step_v + step_v * 0.5)
                self._surface.NormalAt(sum_step_u + step_u, sum_step_v + step_v * 0.5)

                p2 = self._surface.PointAt(sum_step_u, sum_step_v + step_v)
                p3 = self._surface.PointAt(sum_step_u + step_u, sum_step_v + step_v)
                p4 = self._surface.PointAt(sum_step_u + step_u * 0.5, sum_step_v + step_v * 1.5)
                p5 = self._surface.PointAt(sum_step_u + step_u * 0.5, sum_step_v + step_v * 0.5)
                p6 = self._surface.PointAt(sum_step_u + step_u * 0.5, sum_step_v - step_v * 0.5)
                p7 = (p5 + p6) / 2
                p8 = (p4 + p5) / 2

                if j == 0:
                    #####################################################################################
                    ## start triangles
                    #####################################################################################
                    p9 = self._surface.PointAt(sum_step_u + step_u * 0.5, interval1.T0)
                    line = RhinoGeometry.Line(p5, p6)
                    cp = line.ClosestPoint(p9, False)

                    if len(self._base_planes) > 0:
                        if (
                            abs(self._base_planes[0].ZAxis.X)
                            + abs(self._base_planes[0].ZAxis.Y)
                            + abs(self._base_planes[0].ZAxis.Z)
                            > 0.01
                        ):
                            result, t = Rhino.Geometry.Intersect.Intersection.LinePlane(line, self._base_planes[0])
                            cp = line.PointAt(t)

                    pts.extend([p5, cp, p1])
                    self._flags.append(len(face) % 4 == a or len(face) % 4 == b)
                    face.append(RhinoGeometry.MeshFace(v, v + 1, v + 2))
                    v += 3

                    pts.extend([cp, p5, p0])
                    self._flags.append(len(face) % 4 == a or len(face) % 4 == b)
                    face.append(RhinoGeometry.MeshFace(v, v + 1, v + 2))
                    v += 3

                pts.extend([p1, p3, p5])
                self._flags.append(len(face) % 4 == a or len(face) % 4 == b)
                face.append(RhinoGeometry.MeshFace(v, v + 1, v + 2))
                v += 3
                pts.extend([p2, p0, p5])
                self._flags.append(len(face) % 4 == a or len(face) % 4 == b)
                face.append(RhinoGeometry.MeshFace(v, v + 1, v + 2))
                v += 3

                if j != self._v_divisions - 1:
                    pts.extend([p4, p5, p3])
                    self._flags.append(len(face) % 4 == a or len(face) % 4 == b)
                    face.append(RhinoGeometry.MeshFace(v, v + 1, v + 2))
                    v += 3
                    pts.extend([p5, p4, p2])
                    self._flags.append(len(face) % 4 == a or len(face) % 4 == b)
                    face.append(RhinoGeometry.MeshFace(v, v + 1, v + 2))
                    v += 3
                else:
                    #####################################################################################
                    # end triangles
                    #####################################################################################
                    p9 = self._surface.PointAt(sum_step_u + step_u * 0.5, interval1.T1)  # Point3d
                    line = RhinoGeometry.Line(p4, p5)  # Line
                    cp = line.ClosestPoint(p9, False)  # Point3d

                    if len(self._base_planes) > 0:
                        if (
                            abs(self._base_planes[-1].ZAxis.X)
                            + abs(self._base_planes[-1].ZAxis.Y)
                            + abs(self._base_planes[-1].ZAxis.Z)
                            > 0.01
                        ):
                            result, t = Rhino.Geometry.Intersect.Intersection.LinePlane(line, self._base_planes[-1])
                            cp = line.PointAt(t)
                    pts.extend([cp, p5, p3])
                    self._flags.append(len(face) % 4 == a or len(face) % 4 == b)
                    face.append(RhinoGeometry.MeshFace(v, v + 1, v + 2))
                    v += 3

                    pts.extend([p5, cp, p2])
                    self._flags.append(len(face) % 4 == a or len(face) % 4 == b)
                    face.append(RhinoGeometry.MeshFace(v, v + 1, v + 2))
                    v += 3
                sum_step_v += step_v
            sum_step_u += step_u

        for i in pts:
            self._mesh.Vertices.Add(i)

        self._mesh.Faces.AddFaces(face)
        self._mesh.Weld(3.14159)
        self._mesh.RebuildNormals()

        edge_joints = []  # new bool[face.Count][]
        self._adjacency = []  # = new List<int[]>()

        for i in range(len(self._flags)):
            if self._flags[i]:
                nei = self._mesh.Faces.AdjacentFaces(i)  # int[]

                for j in nei:
                    self._adjacency.append([i, j, -1, -1])
            edge_joints.append([self._flags[i] for i in range(9)])  # Enumerable.Repeat(self._flags[i], 9).ToArray()

    def center_point(self, polyline):
        Count = len(polyline)

        if Count == 0:
            return RhinoGeometry.Point3d.Unset

        if Count == 1:
            return polyline[0]

        center = RhinoGeometry.Point3d.Origin
        weight = 0.0

        stop = Count - 1
        if polyline[0].DistanceToSquared(polyline[-1]) > 0.001:
            stop = stop + 1

        for i in range(stop):
            A = RhinoGeometry.Point3d(polyline[i])
            B = RhinoGeometry.Point3d(polyline[(i + 1) % Count])
            d = A.DistanceTo(B)
            center = center + d * 0.5 * (A + B)
            weight = weight + d

        center /= weight

        return center

    def mesh_face_center(self, mesh, i):
        center = RhinoGeometry.Point3d(0, 0, 0)

        if mesh.Faces[i].IsQuad:
            pts = [
                mesh.Vertices[mesh.Faces[i].A],
                mesh.Vertices[mesh.Faces[i].B],
                mesh.Vertices[mesh.Faces[i].C],
                mesh.Vertices[mesh.Faces[i].D],
            ]
            center = self.center_point(pts)
        else:
            pts = [
                mesh.Vertices[mesh.Faces[i].A],
                mesh.Vertices[mesh.Faces[i].B],
                mesh.Vertices[mesh.Faces[i].C],
            ]
            center = self.center_point(pts)

        return center

    def get_face_vertices(self):
        if self._has_ngons:
            self._f = self._mesh.Ngons.Count
            # f_v = self._mesh.GetNGonsTopoBoundaries()
        else:
            self._f = self._mesh.Faces.Count

            empty_list = []
            self._f_v = []
            for i in range(self._mesh.Faces.Count):
                self._f_v.append([])

            # f_v = [] #new int[this.m.Faces.Count][]
            for i in range(self._mesh.Faces.Count):
                self._f_v[i] = (
                    [
                        self._mesh.Faces[i][0],
                        self._mesh.Faces[i][1],
                        self._mesh.Faces[i][2],
                        self._mesh.Faces[i][3],
                    ]
                    if self._mesh.Faces[i].IsQuad
                    else [
                        self._mesh.Faces[i][0],
                        self._mesh.Faces[i][1],
                        self._mesh.Faces[i][2],
                    ]
                )

    def get_faces_planes(self):
        if self._has_ngons:
            pass
            # f_planes = self._mesh._FPlanes()
        else:
            self._f_planes = []  # new Plane[m.Faces.Count]
            for i in range(self._mesh.Faces.Count):
                self._f_planes.append(
                    RhinoGeometry.Plane(self.mesh_face_center(self._mesh, i), self._mesh.FaceNormals[i])
                )

    def set_edge_normals(self):
        topologyEdges = self._mesh.TopologyEdges
        faceNormals = self._mesh.FaceNormals

        self.e_planes = []  # new Plane[topologyEdges.Count]

        for i in range(topologyEdges.Count):
            line = topologyEdges.EdgeLine(i)
            connectedFaces = topologyEdges.GetConnectedFaces(i)  # int[]

            xaxis = line.To - line.From
            xaxis.Unitize()
            zaxis = RhinoGeometry.Vector3d(0, 0, 1)

            if connectedFaces.Length != 2:  # naked
                zaxis = RhinoGeometry.Vector3d.CrossProduct(faceNormals[connectedFaces[0]], xaxis)
            else:  # inner
                zaxis_avg = (faceNormals[connectedFaces[0]] + faceNormals[connectedFaces[1]]) / 2
                zaxis_avg.Unitize()
                zaxis = RhinoGeometry.Vector3d.CrossProduct(xaxis, zaxis_avg)
            self._e_planes.append(RhinoGeometry.Plane(line.PointAt(0.5), zaxis))

    def dihedral_plane(self, plane0, plane1):
        ####################################################################################################
        # Plane between two Planes
        ####################################################################################################
        result, l = RhinoGeometry.Intersect.Intersection.PlanePlane(plane0, plane1)
        result, t = RhinoGeometry.Intersect.Intersection.LinePlane(l, plane0)
        centerDihedral = l.PointAt(t)

        ####################################################################################################
        # Convert ZAxis to lines, cant it be done on origin
        ####################################################################################################
        angleLine0 = RhinoGeometry.Line(plane0.Origin, plane0.Origin + plane0.ZAxis)
        angleLine1 = RhinoGeometry.Line(plane1.Origin, plane1.Origin + plane1.ZAxis)

        ####################################################################################################
        # Plane cannot be anti/parallel and they must be apart from each other
        ####################################################################################################
        if (
            plane0.ZAxis.IsParallelTo(plane1.ZAxis, 0.01) == 0
            and plane0.Origin.DistanceToSquared(plane1.Origin) > 0.001
        ):
            ##########################################################################################3##########
            # Intersect two lines to get center
            ####################################################################################################
            result, t0, t1 = RhinoGeometry.Intersect.Intersection.LineLine(angleLine0, angleLine1)

            ####################################################################################################
            # Construct plane from LineLine center and plane origins
            ####################################################################################################
            center = angleLine0.PointAt(t0)
            v0 = plane0.Origin - center
            v1 = plane1.Origin - center
            v0.Unitize()
            v1.Unitize()

            ####################################################################################################
            # Compute Plane
            ####################################################################################################
            dihedralPlane = RhinoGeometry.Plane(centerDihedral, l.Direction, v0 + v1)

            return dihedralPlane
        else:
            return (
                RhinoGeometry.Plane.Unset
            )  # Axes are paralell or anti-parallel |.| or _._ or planes are at the same location

    def get_face_edge_planes(self):
        self.set_edge_normals()
        self._fe_planes = []  # new Plane[f][]

        for i in range(self._f):
            n = len(self._f_v[i])
            self._fe_planes.append([])

            for j in range(len(self._f_v[i])):
                v1 = self._f_v[i][(j + 0) % n]
                v2 = self._f_v[i][(j + 1) % n]

                e = self._mesh.TopologyEdges.GetEdgeIndex(v1, v2)  # int e =
                cf = self._mesh.TopologyEdges.GetConnectedFaces(e)  # int[]

                sum = RhinoGeometry.Vector3d.Zero
                for k in range(len(cf)):
                    sum += RhinoGeometry.Vector3d(self._mesh.FaceNormals[cf[k]])
                sum = sum / cf.Length

                edgePlane = RhinoGeometry.Plane.Unset

                if cf.Length == 2:
                    edgePlane = self.dihedral_plane(
                        RhinoGeometry.Plane(
                            self.mesh_face_center(self._mesh, cf[0]),
                            self._mesh.FaceNormals[cf[0]],
                        ),
                        RhinoGeometry.Plane(
                            self.mesh_face_center(self._mesh, cf[1]),
                            self._mesh.FaceNormals[cf[1]],
                        ),
                    )
                    edgePlane = self._e_planes[e]
                else:
                    edgePlane = RhinoGeometry.Plane(
                        (RhinoGeometry.Point3d)(self._mesh.Vertices[v1] + self._mesh.Vertices[v2]) * 0.5,
                        self._mesh.Vertices[v1] - self._mesh.Vertices[v2],
                        sum,
                    )

                self._fe_planes[i].append(edgePlane)

    def get_bisector_planes(self):
        self._bi_planes = []  # new Plane[f][]

        for i in range(self._f):
            n = len(self._f_v[i])
            self._bi_planes.append([])
            for j in range(n):
                pl1 = self._fe_planes[i][j]
                pl0 = self._fe_planes[i][(j + 1) % n]
                self._bi_planes[-1].append(self.dihedral_plane(pl0, pl1))

    def get_edges(self):
        if self._has_ngons:
            pass
            # e_ngon_e = self._mesh._EAll()
            # this.e = e_ngon_e.Count
        else:
            self._e_ngon_e = {}
            for i in range(self._mesh.TopologyEdges.Count):
                # {'Germany' : 49}
                self._e_ngon_e.update({i: i})
        self._e = len(self._e_ngon_e)

    def get_edge_faces(self):
        if self._has_ngons:
            pass
            # this.e_f = self._mesh._EF()
        else:
            self._e_f = []
            for i in range(self._mesh.TopologyEdges.Count):
                self._e_f.append(self._mesh.TopologyEdges.GetConnectedFaces(i))

    def polyline_from_planes(self, basePlane, sidePlanes, close=True):
        polyline = RhinoGeometry.Polyline()
        for i in range(len(sidePlanes) - 1):
            result, pt = RhinoGeometry.Intersect.Intersection.PlanePlanePlane(
                basePlane, sidePlanes[i], sidePlanes[i + 1]
            )
            polyline.Add(pt)

        result, pt1 = RhinoGeometry.Intersect.Intersection.PlanePlanePlane(
            basePlane, sidePlanes[len(sidePlanes) - 1], sidePlanes[0]
        )
        polyline.Add(pt1)

        if close:
            polyline.Add(polyline[0])

        return polyline

    def move_plane_by_axis(self, plane, distance):
        return RhinoGeometry.Plane(plane.Origin + plane.ZAxis * distance, plane.XAxis, plane.YAxis)

    def get_face_polylines(self):
        zero_layer = len(self._face_positions) == 0

        self._f_polylines_index = []  # new string[f][]
        self._f_polylines_planes = []  # new Plane[f][]
        self._f_polylines = []  # new Polyline[f][]

        for i in range(self._f):  # (int i = 0  i < f  i++)
            if len(self._face_positions) == 0:
                self._f_polylines.append([])  # new Polyline[2]
                pline0 = self.polyline_from_planes(
                    self.move_plane_by_axis(self._f_planes[i], self._face_thickness * -0.0),
                    self._fe_planes[i],
                    True,
                )
                pline1 = self.polyline_from_planes(
                    self.move_plane_by_axis(self._f_planes[i], self._face_thickness * 1.0),
                    self._fe_planes[i],
                    True,
                )
                self._f_polylines_planes.append(
                    [self.move_plane_by_axis(self._f_planes[i], self._face_thickness * 1.0)]
                )
                self._f_polylines_index.append([str(i)])
            else:
                self._f_polylines.append([])  # new Polyline[self._face_positions.Count * 2]
                self._f_polylines_planes.append([])  # new Plane[self._face_positions.Count]
                self._f_polylines_index.append([])  # new string[self._face_positions.Count]

                for j in range(len(self._face_positions)):  # (int j = 0  j < self._face_positions.Count  j++):
                    pline0 = self.polyline_from_planes(
                        self.move_plane_by_axis(
                            self._f_planes[i],
                            self._face_positions[j] + self._face_thickness * -0.0,
                        ),
                        self._fe_planes[i],
                        True,
                    )
                    pline1 = self.polyline_from_planes(
                        self.move_plane_by_axis(
                            self._f_planes[i],
                            self._face_positions[j] + self._face_thickness * 1.0,
                        ),
                        self._fe_planes[i],
                        True,
                    )
                    self._f_polylines[i].append(pline0)
                    self._f_polylines[i].append(pline1)
                    self._f_polylines_planes[i].append(
                        self.move_plane_by_axis(
                            self._f_planes[i],
                            self._face_positions[j] + self._face_thickness * 1.0,
                        )
                    )

                    temp_flag = str(i) if len(self._face_positions) == 1 else str(i) + " " + str(j)
                    self._f_polylines_index[i].append(temp_flag)

    def chamfer_polyline(self, polyline, value=0.001):
        lines = polyline.GetSegments()

        if value == 0:
            return polyline

        p = RhinoGeometry.Polyline()

        if value < 0:
            for l in lines:
                l_ = RhinoGeometry.Line(l.From, l.To)

                l_.Extend(-abs(value), -abs(value))
                lShorter = l_
                p.Add(lShorter.From)
                p.Add(lShorter.To)
        else:
            for l in lines:
                p.Add(l.PointAt(value))
                p.Add(l.PointAt(1 - value))

        p.Add(p[0])

        return p

    def get_insertion_vectors(self):
        for i in range(self._f):
            if self._flags[i] == False:
                vec = self._f_polylines[i][0][2] - self._f_polylines[i][0][0]
                vec.Unitize()
                vec *= 10

                for j in range(3):
                    mid = (self._f_polylines[i][0][j] + self._f_polylines[i][0][(j + 1) % 3]) * 0.5
                    l = RhinoGeometry.Line(mid, vec)
                    self._insertion_lines.append(l)

        # chamfer
        if self._chamfer > 0.000001:
            for i in range(self._f):
                for j in range(2):
                    self._f_polylines[i][j] = self.chamfer_polyline(self._f_polylines[i][j], -self._chamfer)


class case_3_folded_plates_component(component):
    def RunScript(self,
            surface: Rhino.Geometry.Surface,
            u_divisions: int,
            v_divisions: int,
            base_planes: System.Collections.Generic.List[Rhino.Geometry.Plane],
            thickness: float,
            chamfer: float,
            face_positions: System.Collections.Generic.List[float]):

        
        try:
       
            mtsj = case_3_folded_plates(
                surface,
                u_divisions,
                v_divisions,
                base_planes,
                thickness,
                chamfer,
                face_positions,
            )
            self.mesh = mtsj._mesh
            polylines_tree = Grasshopper.DataTree[RhinoGeometry.Polyline]()
            for i in range(0, len(mtsj._f_polylines)):
                for j in range(0, len(mtsj._f_polylines[i])):
                    polylines_tree.Add(mtsj._f_polylines[i][j], Grasshopper.Kernel.Data.GH_Path(i))
            self.plates = polylines_tree
            self.insertion = mtsj._insertion_lines
            self.adjacency = treehelpers.list_to_tree(mtsj._adjacency)
            self.flags = mtsj._flags
            return self.mesh, self.plates, self.insertion, self.adjacency, self.flags
        except Exception as e:
            import traceback
            # Catch any exception and print the traceback
            traceback.print_exc()
# ---------- end case_3_folded_plates ----------
panel = Panel("""50
0.64
12""")
closest_indexed_points = ClosestIndexedPoints()  # -> polylines_out, joint_types_out; inputs polylines: tree of Curve, points: tree of Point3d, joint_types: tree of Int32
#   port polylines: polylines tree branch order does not matter it is flatenned inside the component
#   port points: a tree of points, the path id of the branch must match with _joint_types id, it is kind of a dictionary
#   port joint_types: a tree of integers, the path id of the branch must match with _points id, it is kind of a dictionary
#   port polylines_out: pairs of polylines, grouped two polylines per branch
#   port joint_types_out: a tree of int where each element contains top, bottom and side joint type assignments
# ---------- closest_indexed_points: Python ----------
"""component iterates polyline edges and assigns index based on the point list and their type RTree search"""

from ghpythonlib.componentbase import executingcomponent as component
import Grasshopper
import Rhino
import Rhino.Geometry
from Rhino.Geometry import Sphere
from Rhino.Geometry import Polyline
import ghpythonlib.treehelpers as th
import System


class MyComponent(component):
    def RunScript(self,
            _polylines: Grasshopper.DataTree[Rhino.Geometry.Curve],
            _points: Grasshopper.DataTree[Rhino.Geometry.Point3d],
            _joint_types: Grasshopper.DataTree[int]):
        ###############################################################################
        # Input
        ###############################################################################
        polylines = []
        polylines_out = Grasshopper.DataTree[Polyline]()
        pts = []
        ids = []

        ###############################################################################
        # Conversion
        ###############################################################################
        count = 0
        for curve in _polylines.AllData():
            result, polyline = curve.TryGetPolyline()
            polylines_out.Add(polyline, Grasshopper.Kernel.Data.GH_Path(int(count * 0.5)))
            if count % 2 == 0:
                polylines.append([polyline])
            else:
                polylines[-1].append(polyline)
            count = count + 1

        if _points.DataCount > 0 and _joint_types.DataCount > 0:
            for i in range(_points.BranchCount):
                for j in range(_points.Branch(i).Count):
                    pts.append(_points.Branch(i)[j])
                    ids.append(_joint_types.Branch(i)[j % _joint_types.Branch(i).Count])
        # pts = _points.AllData()
        # ids = _joint_types.AllData()

        ###############################################################################
        # Run the closest point search
        ###############################################################################

        # convert element polylines to a flattened dictionary:
        segments_dictionary = {}
        # stores ids e.g. int , [element_int,bottom_or_top_polyline_int,edge,int, bounding_box, hit_count, point_id]
        joint_types = []
        count = 0
        for i in range(len(polylines)):
            joint_types.append([-1] * (polylines[i][0].SegmentCount + 2))
            for j in range(len(polylines[i])):
                for k in range(polylines[i][j].SegmentCount):
                    bbox = polylines[i][j].SegmentAt(k).BoundingBox
                    bbox.Inflate(0.02)
                    segments_dictionary[count] = [i, j, k, bbox, polylines[i][j].SegmentAt(k)]
                    count = count + 1

        # create a tree
        rtree = Rhino.Geometry.RTree()

        # fill the tree
        for i in segments_dictionary:
            rtree.Insert(segments_dictionary[i][3], i)

        # call_backs of rtree
        def search_callback(sender, rtree_event_args):
            data_by_reference.append(rtree_event_args.Id)

        # perform search
        for i in range(len(pts)):
            data_by_reference = []
            if rtree.Search(Sphere(pts[i], 0), search_callback, data_by_reference):
                for j in data_by_reference:
                    if pts[i].DistanceToSquared(segments_dictionary[j][4].ClosestPoint(pts[i], True)) < 0.001:
                        joint_types[segments_dictionary[j][0]][segments_dictionary[j][2] + 2] = ids[i]

        ###############################################################################
        # Output
        ###############################################################################
        _polylines_out = polylines_out
        _joints_types_out = th.list_to_tree(joint_types)

        # return outputs if you have them; here I try it for you:
        return (_polylines_out, _joints_types_out)
# ---------- end closest_indexed_points ----------
closest_lines = ClosestLines(polylines=case_3_folded_plates.plates, lines=case_3_folded_plates.insertion)  # -> polylines_out, vectors; inputs polylines: tree of Curve, lines: tree of Line
#   port polylines: polylines tree branch order does not matter it is flatenned inside the component
#   port lines: a tree of lines, the path id of the branch must match with _joint_types id, it is kind of a dictionary
#   port polylines_out: pairs of polylines, grouped two polylines per branch
#   port vectors: a tree of vectors where each element contains top, bottom and side vector assignments
# ---------- closest_lines: Python ----------
from ghpythonlib.componentbase import executingcomponent as component
import Grasshopper
import Rhino
import Rhino.Geometry
from Rhino.Geometry import Sphere
from Rhino.Geometry import Vector3d
from Rhino.Geometry import Polyline
import ghpythonlib.treehelpers as th
import System

class MyComponent(component):
    def RunScript(self,
            _polylines: Grasshopper.DataTree[Rhino.Geometry.Curve],
            _lines: Grasshopper.DataTree[Rhino.Geometry.Line]):
        """Provides a scripting component.
        Inputs:
            x: The x script variable
            y: The y script variable
        Output:
            a: The a output variable"""

        ###############################################################################
        # Input
        ###############################################################################
        polylines = []
        polylines_out = Grasshopper.DataTree[Polyline]()
        lines = []

        ###############################################################################
        # Conversion
        ###############################################################################
        count = 0
        for curve in _polylines.AllData():
            result, polyline = curve.TryGetPolyline()
            polylines_out.Add(polyline, Grasshopper.Kernel.Data.GH_Path(int(count * 0.5)))
            if count % 2 == 0:
                polylines.append([polyline])
            else:
                polylines[-1].append(polyline)
            count = count + 1

        lines = _lines.AllData()

        ###############################################################################
        # Run the closest point search
        ###############################################################################

        # convert element polylines to a flattened dictionary:
        segments_dictionary = {}
        # stores ids e.g. int , [element_int,bottom_or_top_polyline_int,edge,int, bounding_box, hit_count, point_id]
        vectors = []
        count = 0
        for i in range(len(polylines)):
            vectors.append([Vector3d.Zero] * (polylines[i][0].SegmentCount + 2))
            for j in range(len(polylines[i])):
                for k in range(polylines[i][j].SegmentCount):
                    bbox = polylines[i][j].SegmentAt(k).BoundingBox
                    bbox.Inflate(0.02)
                    segments_dictionary[count] = [i, j, k, bbox, polylines[i][j].SegmentAt(k)]

                    count = count + 1

        # create a tree
        rtree = Rhino.Geometry.RTree()

        # fill the tree
        for i in segments_dictionary:
            rtree.Insert(segments_dictionary[i][3], i)

        # call_backs of rtree search
        def search_callback(sender, rtree_event_args):
            data_by_reference.append(rtree_event_args.Id)

        # perform search, two times first for start points of a polyline, second for the end point
        for i in range(len(lines)):
            data_by_reference = []
            if rtree.Search(Sphere(lines[i].From, 0), search_callback, data_by_reference):
                for j in data_by_reference:
                    if (
                        lines[i].From.DistanceToSquared(segments_dictionary[j][4].ClosestPoint(lines[i].From, True))
                        < 0.001
                    ):
                        vectors[segments_dictionary[j][0]][segments_dictionary[j][2] + 2] = lines[i].Direction
                        # vectors[segments_dictionary[j][0]][segments_dictionary[j][2]+2].Unitize()

        for i in range(len(lines)):
            data_by_reference = []
            if rtree.Search(Sphere(lines[i].To, 0), search_callback, data_by_reference):
                for j in data_by_reference:
                    if lines[i].To.DistanceToSquared(segments_dictionary[j][4].ClosestPoint(lines[i].To, True)) < 0.001:
                        vectors[segments_dictionary[j][0]][segments_dictionary[j][2] + 2] = -lines[i].Direction
                        # vectors[segments_dictionary[j][0]][segments_dictionary[j][2]+2].Unitize()

        ###############################################################################
        # Output
        ###############################################################################
        _polylines_out = polylines_out
        _vectors = th.list_to_tree(vectors)

        # return outputs if you have them; here I try it for you:
        return (_polylines_out, _vectors)
# ---------- end closest_lines ----------
panel_2 = Panel(closest_lines.vectors)
assembly = Assembly()  # inputs dir: list of Line, n: Int32, t: Double
#   port data: collection of inputs that represent the elements, insertion vectors, joint types and adjacency, use input_set commonent to group these inputs
#   port dir: a list of lines that represent the direction of the assembly sequence per element or a group, depending on the inpout N
#   port n: number of plates that are group e.g. one box contains 4 plates, then N = 4
#   port t: slider from 0.00 to number of groups, that helps to animate the assembly sequence
# ---------- assembly: Python ----------
"""display assembly sequence"""
from ghpythonlib.componentbase import executingcomponent as component
import System
import Rhino
from Rhino.Geometry import BoundingBox
from Rhino.Geometry import Point3d
from Rhino.Geometry import Plane
from Rhino.Geometry import Vector3d
from Rhino.Geometry import Line
from Rhino.Geometry import TextEntity
from Rhino.Geometry import Transform
from System.Drawing import Color
import math


class MyComponent(component):

    bbox = BoundingBox.Unset
    lines = []
    insertion_vectors_current = []
    joint_per_face_current_text_entity = []
    polylines = []

    def DrawViewportWires(self, args):

        plane = Plane.WorldXY
        for line in self.lines:
            args.Display.DrawLineArrow(line, Color.FromArgb(207, 0, 90), 2, 100)
        for polyline in self.polylines:
            args.Display.DrawPolyline(polyline, Color.FromArgb(207, 0, 90), 2)
        for insertionVectorsCurrent in self.insertion_vectors_current:
            if insertionVectorsCurrent.Length < 0.05:
                continue
            args.Display.DrawLine(insertionVectorsCurrent, Color.FromArgb(0, 0, 0), 5)
        for jointPerFaceCurrent in self.joint_per_face_current_text_entity:
            result, plane = Rhino.RhinoDoc.ActiveDoc.Views.ActiveView.ActiveViewport.GetCameraFrame()
            plane.Origin = jointPerFaceCurrent.Plane.Origin
            args.Display.Draw3dText(
                jointPerFaceCurrent.PlainText,
                jointPerFaceCurrent.MaskColor,
                plane,
                jointPerFaceCurrent.TextHeight,
                "Arial",
                False,
                False,
                Rhino.DocObjects.TextHorizontalAlignment.Center,
                Rhino.DocObjects.TextVerticalAlignment.BottomOfTop,
            )

    def get_ClippingBox(self):
        return self.bbox

    def display_insertion_sequence(self, _data, _lines, _n, _t):

        # ==============================================================================
        # clear input
        # ==============================================================================
        self.bbox = Rhino.Geometry.BoundingBox.Unset
        self.lines = []
        self.insertion_vectors_current = []
        self.joint_per_face_current_text_entity = []
        self.polylines = []

        text_size = 50
        line_scale = 300

        ###############################################################################
        # input
        ###############################################################################
        self.bbox = BoundingBox.Unset
        self.lines = _lines if len(_lines) > 0 else [Line(Point3d(0, 0, 0), Point3d(0, 0, 1))]
        self.insertion_vectors_current = []
        self.joint_per_face_current_text_entity = []
        self.polylines = []

        group_count = _n if _n is not None else 4
        t = _t if _t is not None else 0.0
        item = self.lines[0]
        self.bbox = self.lines[0].BoundingBox

        ###############################################################################
        # process
        ###############################################################################
        for i in range(1, len(self.lines)):
            self.bbox.Union(self.lines[i].BoundingBox)

        for i in range(0, int(math.floor(t))):
            for j in range(group_count):
                self.polylines.append(_data.plines[(i * group_count + j) * 2])
                self.polylines.append(_data.plines[(i * group_count + j) * 2 + 1])

        if t % 1 > 0:

            id2 = int(math.floor(t))
            polylines_current = []

            for i in range(group_count):
                polylines_current.append(_data.plines[(id2 * group_count + i) * 2])
                polylines_current.append(_data.plines[(id2 * group_count + i) * 2 + 1])

            for m in range(len(polylines_current)):

                item = self.lines[id2]
                line_from = item.From
                item = self.lines[id2]
                to = line_from - item.To

                polyline = polylines_current[m].Duplicate()
                polyline.Transform(Transform.Translation(to * (1 - t % 1)))
                polylines_current[m] = polyline

            for i in polylines_current:
                self.polylines.append(i)

            for n in range(0, len(polylines_current), 2):

                point3ds = [polylines_current[n].CenterPoint(), polylines_current[n + 1].CenterPoint()]

                for o in range(0, polylines_current[n].Count - 1):
                    p0 = (polylines_current[n][o] + polylines_current[n][o + 1]) * 0.5
                    p1 = (polylines_current[n + 1][o] + polylines_current[n + 1][o + 1]) * 0.5
                    pmid = (p0 + p1) * 0.5
                    point3ds.append(pmid)

                for p in range(len(point3ds)):

                    face_vectors = _data.insertion_vectors[id2 * 4 + int(n * 0.5)][p]

                    if face_vectors == Vector3d.Zero:
                        face_vectors = Vector3d(0, 0, 0.0001)

                    self.insertion_vectors_current.append(
                        Line(
                            point3ds[p] + (face_vectors * line_scale * 0.25), point3ds[p] + (face_vectors * line_scale)
                        )
                    )
                    text = str(_data.joints_per_face[int(n * 0.5)][p])
                    textEntity = TextEntity()
                    textEntity.Plane = Plane(point3ds[p], Vector3d.ZAxis)
                    textEntity.PlainText = text

                    if _data.joints_per_face[int(n * 0.5)][p] > 0:
                        textEntity.MaskColor = Color.FromArgb(0, 0, 0)
                        textEntity.TextHeight = (float)(text_size)
                    else:
                        textEntity.MaskColor = Color.FromArgb(100, 100, 100)
                        textEntity.TextHeight = (float)(text_size * 0.5)
                    self.joint_per_face_current_text_entity.append(textEntity)

        # return outputs if you have them here I try it for you:
        return

    def RunScript(self,
            _data,
            _dir: System.Collections.Generic.List[Rhino.Geometry.Line],
            _n: int,
            _t: float):

        if not _data:
            return

        directions = []
        if not _dir:
            number_of_directions = len(_data.plines_with_joints)
            directions = [Rhino.Geometry.Line(Point3d(0, 0, 0), Point3d(0, 0, 1000))] * number_of_directions
        else:
            directions = _dir

        if not _t:
            return

        self.display_insertion_sequence(_data, directions, _n, _t)
# ---------- end assembly ----------
assembly_solids = Assembly()  # inputs geos: list of GeometryBase, dir: list of Line, t: Double
#   port geos: collection of breps
#   port dir: a list of lines that represent the direction of the assembly sequence per element or a group, depending on the inpout N
#   port t: slider from 0.00 to number of groups, that helps to animate the assembly sequence
# ---------- assembly_solids: Python ----------
"""display assembly sequence"""
from ghpythonlib.componentbase import executingcomponent as component
import System
import Rhino
from Rhino.Geometry import BoundingBox
from Rhino.Geometry import Point3d
from Rhino.Geometry import Line
from Rhino.Geometry import Transform
from System.Drawing import Color
import math


class MyComponent(component):

    bbox = BoundingBox.Unset
    lines = []
    insertion_vectors_current = []
    joint_per_face_current_text_entity = []
    meshes = []
    breps = []
    material = Rhino.Display.DisplayMaterial(Color.FromArgb(200, 200, 200))

    def DrawViewportWires(self, args):

        for o in self.breps:
            for i in o.Curves3D:
                args.Display.DrawCurve(i, Color.FromArgb(0, 0, 0))
            args.Display.DrawBrepShaded(o, self.material)
        for o in self.meshes:
            args.Display.DrawMeshShaded(o, self.material)
            args.Display.DrawMeshWires(o, Color.Black, 1)

    def get_ClippingBox(self):
        return self.bbox

    def display_insersion_sequence(self, _geos, _lines, _t):

        ###############################################################################
        # input
        ###############################################################################
        self.bbox = BoundingBox.Unset
        self.lines = _lines if len(_lines) > 0 else [Line(Point3d(0, 0, 0), Point3d(0, 0, 1))]
        self.insertion_vectors_current = []
        self.joint_per_face_current_text_entity = []
        self.breps = []
        self.meshes = []

        if len(_geos) == 0:
            return

        _n = 1
        group_count = _n if _n is not None else 1
        t = _t if _t is not None else 0.0
        item = self.lines[0]
        self.bbox = _geos[0].GetBoundingBox(False)

        ###############################################################################
        # process
        ###############################################################################
        for i in range(1, len(self.lines)):
            self.bbox.Union(_geos[i].GetBoundingBox(False))

        for i in range(0, int(math.floor(t))):
            if isinstance(_geos[i], Rhino.Geometry.Mesh):
                self.meshes.append(_geos[i])
            elif isinstance(_geos[i], Rhino.Geometry.Brep):
                self.breps.append(_geos[i])

        if t % 1 > 0:

            id2 = int(math.floor(t))
            geos_current = []

            for i in range(group_count):
                geos_current.append(_geos[id2])

            for m in range(len(geos_current)):
                item = self.lines[id2]
                line_from = item.From
                item = self.lines[id2]
                to = line_from - item.To

                geo = geos_current[m].Duplicate()
                geo.Transform(Transform.Translation(to * (1 - t % 1)))
                geos_current[m] = geo

            for i in geos_current:
                if isinstance(i, Rhino.Geometry.Mesh):
                    self.meshes.append(i)
                elif isinstance(i, Rhino.Geometry.Brep):
                    self.breps.append(i)

        return

    def RunScript(self,
            _geos: System.Collections.Generic.List[Rhino.Geometry.GeometryBase],
            _dir: System.Collections.Generic.List[Rhino.Geometry.Line],
            _t: float):

        if not _geos:
            return

        lines = _dir
        if not _dir:
            first_geo_bbox = _geos[0].GetBoundingBox(False)
            pmin = Rhino.Geometry.Point3d(0, 0, first_geo_bbox.Min.Z)
            pmax = Rhino.Geometry.Point3d(0, 0, first_geo_bbox.Max.Z)
            line = Rhino.Geometry.Line(pmin, pmax)
            lines = [line] * len(_geos)

        self.display_insersion_sequence(_geos, lines, _t)
# ---------- end assembly_solids ----------
input_set = Input_set(polylines=closest_lines.polylines_out, vectors=closest_lines.vectors)  # -> data; inputs polylines: tree of Polyline, vectors: tree of Vector3d, joint_types: tree of Int32, three_valence: tree of Int32, adjacency: tree of Int32
#   port polylines: a data-tree of polyline pairs
#   port vectors: insertion direction
#   port joint_types: joint type per side, top, bottom, and sides
#   port three_valence: three valance joinery that starts 0 - Vidy, 1 - Annen, and 4 indices current, next, current-neighbor, next-neighbor
#   port adjacency: joint parameters
#   port data: user input_get component to ungroup all the data to the individual data-trees
# ---------- input_set: Python ----------
"""combine different data sets into one list for a faster data transder between grasshopper wires"""

from ghpythonlib.componentbase import executingcomponent as component
import Grasshopper
import Rhino
import ghpythonlib.treehelpers as th
from Rhino.Geometry import Vector3d
from Rhino.Geometry import Plane
from compas_wood.datastructures import WoodData
import System


class MyComponent(component):
    def get_plane(self, _polyline, _orientation_point):

        len = _polyline.Count - 1
        normal = Vector3d(0, 0, 0)

        for i in range((_polyline.Count - 1)):
            num = ((i - 1) + len) % len
            item1 = ((i + 1) + len) % len
            point3d = _polyline[num]
            point3d1 = _polyline[item1]
            item2 = _polyline[i]
            normal = normal + Vector3d.CrossProduct(Vector3d(item2 - point3d), Vector3d(point3d1 - item2))

        normal.Unitize()
        plane = Plane(_polyline.CenterPoint(), normal)
        if plane.DistanceTo(_orientation_point) < 0:
            plane.Flip()

        return plane

    def RunScript(self,
            _polylines: Grasshopper.DataTree[Rhino.Geometry.Polyline],
            _vectors: Grasshopper.DataTree[Rhino.Geometry.Vector3d],
            _joint_types: Grasshopper.DataTree[int],
            _three_valence: Grasshopper.DataTree[int],
            _adjacency: Grasshopper.DataTree[int]):

        plines = []
        planes = []
        if _polylines.DataCount > 0:
            for i in range(_polylines.BranchCount):
                plines.extend(list(_polylines.Branch(i)))
                planes.append(self.get_plane(_polylines.Branch(i)[0], _polylines.Branch(i)[1][0]))

        insertion_vectors = th.tree_to_list(_vectors) if _vectors.DataCount > 0 else []
        joints_per_face = th.tree_to_list(_joint_types) if _joint_types.DataCount > 0 else []
        three_valence = th.tree_to_list(_three_valence) if _three_valence.DataCount > 0 else []
        adjacency = th.tree_to_list(_adjacency) if _adjacency.DataCount > 0 else []

        # output
        _data = WoodData(plines, insertion_vectors, joints_per_face, three_valence, adjacency, planes)

        # return outputs if you have them; here I try it for you:
        return _data
# ---------- end input_set ----------
joint_parameters = Joint_parameters(ss_e_op=panel)  # -> p; inputs ss_e_ip: list of Double, ss_e_op: list of Double, ts_e_p: list of Double, cr_c_ip: list of Double, tt_e_p: list of Double, ss_e_r: list of Double, b: list of Double
#   port ss_e_ip: side-to-side in-plane joint parameters
#   port ss_e_op: side-to-side out-of-plane joint parameters
#   port ts_e_p: top-to-side joint parameters
#   port cr_c_ip: cross joint parameters
#   port tt_e_p: top-to-top joint parameters
#   port ss_e_r: side-to-side rotated joint parameters
#   port b: boundary joint parameters
# ---------- joint_parameters: Python ----------
"""Create a list of joint parameters"""

import System
import Rhino
from ghpythonlib.componentbase import executingcomponent as component


class joint_parameters_component(component):
    def RunScript(self,
            _ss_e_ip: System.Collections.Generic.List[float],
            _ss_e_op: System.Collections.Generic.List[float],
            _ts_e_p: System.Collections.Generic.List[float],
            _cr_c_ip: System.Collections.Generic.List[float],
            _tt_e_p: System.Collections.Generic.List[float],
            _ss_e_r: System.Collections.Generic.List[float],
            _b: System.Collections.Generic.List[float]):

        joint_parameters = [
            300,
            0.5,
            3,  # 1-9 ss_e_ip (side-to-side edge in-plane)
            50,
            0.64,
            15,  # 10-19 ss_e_op (side-to-side edge out-of-plane)
            450,
            0.5,
            20,  # 20-29 ts_e_p (top-to-side edge plane)
            300,
            0.5,
            30,  # 30-39 cr_c_ip (cross cutting in-plane)
            6,
            0.95,
            40,  # 40-49 tt_e_p  (top-to-top edge plane)
            300,
            0.5,
            58,  # 50-59 ss_e_r (side-to-side edge rotated)
            300,
            1.0,
            60,  # 60-69 b (boundary)
        ]

        if _ss_e_ip:
            for i in range(len(_ss_e_ip)):
                joint_parameters[0 * 3 + i] = _ss_e_ip[i]

        if _ss_e_op:
            for i in range(len(_ss_e_op)):
                joint_parameters[1 * 3 + i] = _ss_e_op[i]

        if _ts_e_p:
            for i in range(len(_ts_e_p)):
                joint_parameters[2 * 3 + i] = _ts_e_p[i]

        if _cr_c_ip:
            for i in range(len(_cr_c_ip)):
                joint_parameters[3 * 3 + i] = _cr_c_ip[i]

        if _tt_e_p:
            for i in range(len(_tt_e_p)):
                joint_parameters[4 * 3 + i] = _tt_e_p[i]

        if _ss_e_r:
            for i in range(len(_ss_e_r)):
                joint_parameters[5 * 3 + i] = _ss_e_r[i]

        if _b:
            for i in range(len(_b)):
                joint_parameters[6 * 3 + i] = _b[i]

        _joint_p = joint_parameters

        return _joint_p
# ---------- end joint_parameters ----------
install = Install()
# ---------- install: Python ----------
"""install compas_wood"""
import System
import Rhino

# r: wood-nano==0.1.1, compas-wood==2.1.0, compas==2.1.1

from wood_nano import test as wood_nano_test
wood_nano_test()
# ---------- end install ----------
solver = Solver(data=input_set, joint_p=joint_parameters)  # -> data; inputs joint_p: list of Double, scale: list of Double, extension: list of Double, find: Int32, get: Int32
#   port data: collection of inputs that represent the elements, insertion vectors, joint types and adjacency, use input_set commonent to group these inputs
#   port joint_p: joint parameters
#   port scale: scale of joint, default is [1,1,1]
#   port extension: extension by distance, plates often has [0,0,10], whereas beams [10,10,10], default is [0,0,0]
#   port find: search_type search type 0 - side-to-side, 1 - cross, 2 - both
#   port get: output_type 0 - outlines | 1 - lines | 2 - areas | 3 - volumes | 4 - merged geometry of joints
#   port data: user input_get component to ungroup all the data to the individual data-trees
# ---------- solver: Python ----------
"""generate joints between elements"""

from ghpythonlib.componentbase import executingcomponent as component
import Rhino
import System
from wood_nano import get_connection_zones as wood_nano_get_connection_zones
from wood_nano import cut_type2 as wood_nano_cut_type2
from wood_nano import point3 as wood_nano_point3
from wood_nano.conversions_python import to_int2
from wood_nano.conversions_python import to_int1
from wood_nano.conversions_python import to_double1
from wood_nano.conversions_python import from_cut_type2
from compas_wood.conversions_rhino import to_point2
from compas_wood.conversions_rhino import to_vector2
from compas_wood.conversions_rhino import from_point3
from compas_wood.binding import wood_globals
from compas_wood.datastructures import WoodData
from math import floor


class connections_zones(component):
    def __init__(self):
        self.bbox = Rhino.Geometry.BoundingBox.Unset
        self.lines = []
        self.insertion_vectors_current = []
        self.joint_per_face_current_text_entity = []
        self.polylines = []

    def DrawViewportWires(self, args):
        col = args.WireColour
        line_weight = args.DefaultCurveThickness
        for polylines_list in self.polylines:
            for polyline in polylines_list:
                args.Display.DrawPolyline(polyline, col, line_weight)

    def get_ClippingBox(self):
        return self.bbox

    def RunScript(self,
            _data,
            _joint_p: System.Collections.Generic.List[float],
            _scale: System.Collections.Generic.List[float],
            _extension: System.Collections.Generic.List[float],
            _find: int,
            _get: int):

        # ==============================================================================
        # clear input
        # ==============================================================================
        self.bbox = Rhino.Geometry.BoundingBox.Unset
        self.lines = []
        self.insertion_vectors_current = []
        self.joint_per_face_current_text_entity = []
        self.polylines = []

        # ==============================================================================
        # input
        # ==============================================================================
        if _data is None:
            return

        input_polyline_pairs = _data.plines
        if input_polyline_pairs:
            if len(input_polyline_pairs) > 0:
                self.bbox = input_polyline_pairs[0].BoundingBox
                for pline in input_polyline_pairs:
                    self.bbox.Union(pline.BoundingBox)

        input_insertion_vectors = _data.insertion_vectors
        input_joint_types = _data.joints_per_face
        input_three_valence_element_indices_and_instruction = _data.three_valence

        input_search_type = max(min(2, _find), 0) if _find else 0

        input_scale = [1, 1, 1]
        if _scale:
            for i in range(0, len(_scale)):
                input_scale[i] = _scale[i]

        input_output_type = _get if _get is not None else 4

        input_joint_volume_parameters = [0, 0, 0]

        if _extension:
            if len(_extension) > 2:
                input_joint_volume_parameters = []
                for i in _extension:
                    input_joint_volume_parameters.append(i * 10)

        input_adjacency = _data.adjacency
        joint_parameters = wood_globals.joints_parameters_and_types


        if _joint_p:
            for i in range(0, len(_joint_p), 3):
                insertion_id = floor(_joint_p[i + 2] / 10)
                joint_parameters[insertion_id * 3 + 0] = _joint_p[i + 0]
                joint_parameters[insertion_id * 3 + 1] = _joint_p[i + 1]
                joint_parameters[insertion_id * 3 + 2] = _joint_p[i + 2]

        w_output_plines = wood_nano_point3()
        w_output_types = wood_nano_cut_type2()

        wood_nano_get_connection_zones(
            to_point2(input_polyline_pairs),
            to_vector2(input_insertion_vectors),
            to_int2(input_joint_types),
            to_int2(input_three_valence_element_indices_and_instruction),
            to_int1(input_adjacency),
            to_double1(joint_parameters),
            int(input_search_type),
            to_double1(input_scale),
            int(input_output_type),
            w_output_plines,
            w_output_types,
            to_double1(input_joint_volume_parameters),
        )

        self.polylines = from_point3(w_output_plines)
        return WoodData(
            plines=_data.plines,
            insertion_vectors=_data.insertion_vectors,
            joints_per_face=_data.joints_per_face,
            three_valence=_data.three_valence,
            adjacency=_data.adjacency,
            planes=_data.planes,
            plines_with_joints=self.polylines,
            cut_types=from_cut_type2(w_output_types),
        )
# ---------- end solver ----------
input_get = Input_get(data=solver)  # -> plines_0, plines_1, lines, insertion_vectors, joints_per_face, three_valence, adjacency, cut_types; inputs split: Boolean
#   port data: collection of inputs that represent the elements, insertion vectors, joint types and adjacency, use input_set commonent to group these inputs
#   port split: split output into closed outlines and lines
#   port plines_0: polyline pairs
#   port plines_1: polyline pairs
#   port lines: polyline pairs
#   port insertion_vectors: insertion vectors per element top bottom and side faces
#   port joints_per_face: joinery types per element top bottom and side faces
#   port three_valence: three valence indices for special cases where one element is connected with two others
#   port adjacency: connectivity between elements and their faces
#   port cut_types: fabrication type
# ---------- input_get: Python ----------
"""unwrap element data to polylines, insertion vectors, joint types and etc"""

from ghpythonlib.componentbase import executingcomponent as component
import Grasshopper
import ghpythonlib.treehelpers as th
import Rhino
import System


class MyComponent(component):
    def RunScript(self, _data, _split: bool):

        if _data is None:
            return

        split = True if _split is None else _split

        _plines_0 = Grasshopper.DataTree[Rhino.Geometry.Curve]()
        _plines_1 = Grasshopper.DataTree[Rhino.Geometry.Curve]()
        _lines = Grasshopper.DataTree[Rhino.Geometry.Curve]()
        if split is False:
            for i in range(len(_data.plines_with_joints)):
                for j in range(len(_data.plines_with_joints[i])):
                    _plines_0.Add(_data.plines_with_joints[i][j].ToNurbsCurve(), Grasshopper.Kernel.Data.GH_Path(i))
        else:
            for i in range(len(_data.plines_with_joints)):
                for j in range(len(_data.plines_with_joints[i])):
                    if _data.plines_with_joints[i][j].Count == 2:
                        _lines.Add(_data.plines_with_joints[i][j].ToNurbsCurve(), Grasshopper.Kernel.Data.GH_Path(i))
                    else:
                        if j % 2 == 0:
                            print(_data.plines_with_joints[i][j])
                            _plines_0.Add(
                                _data.plines_with_joints[i][j].ToNurbsCurve(), Grasshopper.Kernel.Data.GH_Path(i)
                            )
                        else:
                            _plines_1.Add(
                                _data.plines_with_joints[i][j].ToNurbsCurve(), Grasshopper.Kernel.Data.GH_Path(i)
                            )

        _insertion_vectors = th.list_to_tree(_data.insertion_vectors)
        _joints_per_face = th.list_to_tree(_data.joints_per_face)
        _three_valence = th.list_to_tree(_data.three_valence)
        _adjacency = th.list_to_tree(_data.adjacency)
        _cut_types = th.list_to_tree(_data.cut_types)

        # return outputs if you have them; here I try it for you:
        return (
            _plines_0,
            _plines_1,
            _lines,
            _insertion_vectors,
            _joints_per_face,
            _three_valence,
            _adjacency,
            _cut_types,
        )
# ---------- end input_get ----------
loft_b = Loft_brep(p0=input_get.plines_0, p1=input_get.plines_1)  # -> brep; inputs p0: list of Curve, p1: list of Curve, c: Color; disabled
#   port p0: polylines with holes, bottom
#   port p1: polylines with holes, top
#   port c: color, if given all the brep is colorized else only the sides, this is useful for boolean difference
#   port brep: lofted and capped brep with holes
# ---------- loft_b: Python ----------
from ghpythonlib.componentbase import executingcomponent as component
import Rhino
from System.Drawing import Color
import System


class connections_zones(component):
    def project_curves_to_plane(self, curves):
        points = []
        for curve in curves:
            for point in curve.ToNurbsCurve().Points:
                points.append(point.Location)

        result, plane = Rhino.Geometry.Plane.FitPlaneToPoints(points)

        xform = Rhino.Geometry.Transform.PlanarProjection(plane)
        curves_projected = []
        for curve in curves:
            curve_projected = curve.DuplicateCurve()
            curve_projected.Transform(xform)
            curves_projected.append(curve_projected)
        return curves_projected

    def loft_polylines_with_holes(self, curves0, curves1, color):
        """Loft polylines with holes

        Parameters
        ----------
        curves0 : list[rg.Polyline]
        curves1 : list[rg.Polyline]

        Returns
        -------
        rg.Brep
            brep as lofted polylines and cap them
        """

        ###############################################################################
        # user input
        ###############################################################################

        if curves0 == [None]:
            return
        if curves1 == [None]:
            return

        if len(curves0) == 0:
            return
        if len(curves1) == 0:
            return

        flag = len(curves0) != 0 if True else len(curves1) != 0
        if flag:
            curves = []
            curves2 = []

            flag0 = len(curves1) == 0
            flag1 = len(curves0) == 0 and len(curves1) != 0
            flag2 = len(curves0) and len(curves1)

            if flag0:
                for i in range(len(curves0)):
                    if float(i) >= float(len(curves0)) * 0.5:
                        curves2.Add(curves0[i])
                    else:
                        curves.Add(curves0[i])
            elif flag1:
                for i in range(0, len(curves1), 2):
                    curves.Add(curves1[i])
                    curves2.Add(curves1[i + 1])
            elif flag2:
                curves = curves0
                curves2 = curves1

            curves0 = curves
            curves1 = curves2

        ###############################################################################
        # Create mesh of the bottom face
        ###############################################################################

        curves0 = self.project_curves_to_plane(curves0)
        brep_0 = Rhino.Geometry.Brep.CreatePlanarBreps(curves0, Rhino.RhinoDoc.ActiveDoc.ModelAbsoluteTolerance)[0]

        curves1 = self.project_curves_to_plane(curves1)
        brep_1 = Rhino.Geometry.Brep.CreatePlanarBreps(curves1, Rhino.RhinoDoc.ActiveDoc.ModelAbsoluteTolerance)[0]

        ###############################################################################
        # Create lofts
        ###############################################################################
        breps_to_join = [brep_0, brep_1]
        for i in range(len(curves0)):
            wall = Rhino.Geometry.Brep.CreateFromLoft(
                [curves0[i], curves1[i]],
                Rhino.Geometry.Point3d.Unset,
                Rhino.Geometry.Point3d.Unset,
                Rhino.Geometry.LoftType.Normal,
                False,
            )[0]
            breps_to_join.append(wall)

        ###############################################################################
        # Join Brep
        ###############################################################################

        solid = Rhino.Geometry.Brep.JoinBreps(breps_to_join, Rhino.RhinoDoc.ActiveDoc.ModelAbsoluteTolerance)[0]

        faces = []
        for i in range(solid.Faces.Count):
            faces.append(solid.Faces[i].DuplicateFace(False))

        solid = Rhino.Geometry.Brep.JoinBreps(faces, Rhino.RhinoDoc.ActiveDoc.ModelAbsoluteTolerance)[0]

        if solid:
            solid.Faces.SplitKinkyFaces(Rhino.RhinoMath.DefaultAngleTolerance, True)

            if Rhino.Geometry.BrepSolidOrientation.Inward is solid.SolidOrientation:
                solid.Flip()

        if color is not None:
            for i in range(solid.Faces.Count):
                solid.Faces[i].PerFaceColor = color
        else:
            for i in range(solid.Faces.Count):
                if i < 2:
                    solid.Faces[i].PerFaceColor = Color.LightGray  # Color.LightGray
                else:
                    solid.Faces[i].PerFaceColor = Color.DeepPink

        return solid

    def RunScript(self,
            _p0: System.Collections.Generic.List[Rhino.Geometry.Curve],
            _p1: System.Collections.Generic.List[Rhino.Geometry.Curve],
            _c: System.Drawing.Color):
        if _p0 and _p1:
            return self.loft_polylines_with_holes(_p0, _p1, _c)
# ---------- end loft_b ----------
