# Grasshopper definition 14_beams_simple_joint.gh (Grasshopper 1.0.8)
# plug-ins: RhinoCodePluginGH

# ---- group: Create Pipe Geometry
beam_axis = Curve([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])
line_volume = Line_volume(crv=beam_axis, radius="0.5", circ_rect=Toggle(True))  # -> brep, plines; inputs crv: Curve, align_vec: Vector3d, radius: Double, circ_rect: Boolean
#   port crv: axis, can be a line or a curve
#   port align_vec: vector that is used to align the rectangles
#   port radius: radius of a pipe
#   port circ_rect: circle or rectangle
#   port brep: lofted and capped brep with holes
#   port plines: a list of rectangles around the curve divisions
# ---------- line_volume: Python ----------
from ghpythonlib.componentbase import executingcomponent as component
import Grasshopper, GhPython
import System
import Rhino
from Rhino.Geometry import (
    Brep,
    Curve,
    Polyline,
    Plane,
    Vector3d,
    Point3d,
    Rectangle3d,
    Interval,
    LoftType,
    BrepSolidOrientation,
)
import math


class MyComponent(component):
    def RunScript(self,
            _crv: Rhino.Geometry.Curve,
            _align_vec: Rhino.Geometry.Vector3d,
            _radius: float,
            _circ_rect: bool):

        if _crv is None:
            return
        if _radius is None:
            _radius = 0.5
        if _circ_rect is None:
            _circ_rect = False

        """
        static Brep[] CreatePipe(
        Curve rail,
        Double radius,
        Boolean localBlending,
        PipeCapMode cap,
        Boolean fitRail,
        Double absoluteTolerance,
        Double angleToleranceRadians
        )
        """

        def align_plane(plane, v):

            p = Plane(plane)

            result, parameterAlongXDirection, parameterAlongYDirection = p.ClosestParameter(p.Origin + v)
            angle = math.atan2(parameterAlongXDirection, parameterAlongYDirection)
            p.Rotate(-angle + 1.5707963267949, p.ZAxis, p.Origin)

            return p

        def create_rectangles(rail_curve, radius, vector, divisions=10):
            rects = []
            divisions_refined = 1 if _crv.IsLinear(Rhino.RhinoDoc.ActiveDoc.ModelAbsoluteTolerance) else divisions
            for i in range(divisions_refined + 1):
                t = (1.0 / divisions_refined) * i
                result, plane = rail_curve.PerpendicularFrameAt(rail_curve.Domain.ParameterAt(t))
                scale = 1
                if vector:
                    plane = align_plane(plane, vector)
                rect = Rectangle3d(
                    plane, Interval(-radius * scale, radius * scale), Interval(-radius * scale, radius * scale)
                )
                rects.append(rect.ToPolyline())

            if len(rects) == 2:
                pline0 = Polyline([rects[0][0], rects[0][1], rects[1][1], rects[1][0]])
                pline0.Add(pline0[0])
                pline1 = Polyline([rects[0][3], rects[0][2], rects[1][2], rects[1][3]])
                pline1.Add(pline1[0])
                rects = [pline0, pline1]
            return rects

        def create_pipe_from_curve(rail_curve, radius, vector, divisions=10):

            rects = create_rectangles(rail_curve, radius, vector, divisions)

            localblending = False
            cap = Rhino.Geometry.PipeCapMode.Flat
            fitrail = True
            abstol = 0.1
            angtol = math.radians(15)
            brep = list(
                Rhino.Geometry.Brep.CreatePipe(rail_curve, radius, localblending, cap, fitrail, abstol, angtol)
            )[0]

            return rects, brep

        def create_rect_pipe_from_curve(rail_curve, radius, vector, divisions=10):

            # if the curve is not linear then divide the line into segments
            rects = create_rectangles(rail_curve, radius, vector, divisions)

            curves = []
            for c in rects:
                curves.append(c.ToNurbsCurve())
            brep = Brep.CreateFromLoft(curves, Point3d.Unset, Point3d.Unset, LoftType.Normal, False)[0]

            if brep:
                brep.Faces.SplitKinkyFaces()
                brep = brep.CapPlanarHoles(Rhino.RhinoDoc.ActiveDoc.ModelAbsoluteTolerance)
                if brep:
                    if brep.SolidOrientation == BrepSolidOrientation.Inward:
                        brep.Flip()

            return rects, brep

        """
        if(_circ_rect):
            _brep = create_pipe_from_curve(_crv,_radius)
            pass
        else:
            pass
        """
        if _circ_rect:
            rects, brep = create_pipe_from_curve(_crv, _radius, _align_vec)
            _brep = brep
            _plines = rects
        else:
            rects, brep = create_rect_pipe_from_curve(_crv, _radius, _align_vec)
            _brep = brep
            _plines = rects

        # _brep = Rhino.Geometry.Brep.CreatePipe(_crv, [_radius], False, Rhino.Geometry.PipeCapMode.Flat, False, 0, 0.01)
        # print(_brep)

        # return outputs if you have them; here I try it for you:
        return (_brep, _plines)
# ---------- end line_volume ----------

# ---- group: Define Cuts
cuts0 = Curve([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])
cuts1 = Curve([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])
partition = PartitionList(List=cuts0, Size=2)
partition_2 = PartitionList(List=cuts1, Size=2)
dispatch = Dispatch(List=partition, DispatchPattern=[True, False])  # -> simplify(graft(ListA)), simplify(graft(ListB))
dispatch_2 = Dispatch(List=partition_2, DispatchPattern=[True, False])  # -> simplify(graft(ListA)), simplify(graft(ListB))
swatch = ColourSwatch(SwatchColor=RGB(0, 212, 255))
swatch_2 = ColourSwatch(SwatchColor=RGB(255, 0, 149))
loft_b = Loft_brep(p0=dispatch.ListA, p1=dispatch.ListB, c=swatch_2)  # -> brep; inputs p0: list of Curve, p1: list of Curve, c: Color
#   port p0: polylines with holes, bottom
#   port p1: polylines with holes, top
#   port c: color, if given all the brep is colorized else only the sides, this is useful for boolean difference
#   port brep: lofted and capped brep with holes
# ---------- loft_b: Python ----------
"""get joints ids and connections areas between elements"""

__author__ = "petras vestartas"
__version__ = "2023.03.31"


from ghpythonlib.componentbase import executingcomponent as component
import Rhino
from System.Drawing import Color
import System


class connections_zones(component):
    def project_curves_to_plane(self, curves):
        points = []
        for curve in curves:
            for point in curve.ToNurbsCurve().Points:
                points.append(point.Location)

        result, plane = Rhino.Geometry.Plane.FitPlaneToPoints(points)

        xform = Rhino.Geometry.Transform.PlanarProjection(plane)
        curves_projected = []
        for curve in curves:
            curve_projected = curve.DuplicateCurve()
            curve_projected.Transform(xform)
            curves_projected.append(curve_projected)
        return curves_projected

    def loft_polylines_with_holes(self, curves0, curves1, color):
        """Loft polylines with holes

        Parameters
        ----------
        curves0 : list[rg.Polyline]
        curves1 : list[rg.Polyline]

        Returns
        -------
        rg.Brep
            brep as lofted polylines and cap them
        """

        ###############################################################################
        # user input
        ###############################################################################

        if curves0 == [None]:
            return
        if curves1 == [None]:
            return

        if len(curves0) == 0:
            return
        if len(curves1) == 0:
            return

        flag = len(curves0) is not 0 if True else len(curves1) != 0
        if flag:
            curves = []
            curves2 = []

            flag0 = len(curves1) == 0
            flag1 = len(curves0) == 0 and len(curves1) != 0
            flag2 = len(curves0) and len(curves1)

            if flag0:
                for i in range(len(curves0)):
                    if float(i) >= float(len(curves0)) * 0.5:
                        curves2.Add(curves0[i])
                    else:
                        curves.Add(curves0[i])
            elif flag1:
                for i in range(0, len(curves1), 2):
                    curves.Add(curves1[i])
                    curves2.Add(curves1[i + 1])
            elif flag2:
                curves = curves0
                curves2 = curves1

            curves0 = curves
            curves1 = curves2

        ###############################################################################
        # Create mesh of the bottom face
        ###############################################################################

        curves0 = self.project_curves_to_plane(curves0)
        brep_0 = Rhino.Geometry.Brep.CreatePlanarBreps(curves0, Rhino.RhinoDoc.ActiveDoc.ModelAbsoluteTolerance)[0]


        curves1 = self.project_curves_to_plane(curves1)
        brep_1 = Rhino.Geometry.Brep.CreatePlanarBreps(curves1, Rhino.RhinoDoc.ActiveDoc.ModelAbsoluteTolerance)[0]


        ###############################################################################
        # Create lofts
        ###############################################################################
        breps_to_join = [brep_0, brep_1]
        for i in range(len(curves0)):
            wall = Rhino.Geometry.Brep.CreateFromLoft(
                [curves0[i], curves1[i]],
                Rhino.Geometry.Point3d.Unset,
                Rhino.Geometry.Point3d.Unset,
                Rhino.Geometry.LoftType.Normal,
                False,
            )[0]
            breps_to_join.append(wall)

        ###############################################################################
        # Join Brep
        ###############################################################################

        solid = Rhino.Geometry.Brep.JoinBreps(breps_to_join, Rhino.RhinoDoc.ActiveDoc.ModelAbsoluteTolerance)[0]

        faces = []
        for i in range(solid.Faces.Count):
            faces.append(solid.Faces[i].DuplicateFace(False))

        solid = Rhino.Geometry.Brep.JoinBreps(faces, Rhino.RhinoDoc.ActiveDoc.ModelAbsoluteTolerance)[0]

        if solid:
            solid.Faces.SplitKinkyFaces(Rhino.RhinoMath.DefaultAngleTolerance, True)

            if Rhino.Geometry.BrepSolidOrientation.Inward is solid.SolidOrientation:
                solid.Flip()

        if color is not None:
            for i in range(solid.Faces.Count):
                solid.Faces[i].PerFaceColor = color
        else:
            for i in range(solid.Faces.Count):
                if i < 2:
                    solid.Faces[i].PerFaceColor = Color.LightGray  # Color.LightGray
                else:
                    solid.Faces[i].PerFaceColor = Color.DeepPink

        return solid

    def RunScript(self,
            _p0: System.Collections.Generic.List[Rhino.Geometry.Curve],
            _p1: System.Collections.Generic.List[Rhino.Geometry.Curve],
            _c: System.Drawing.Color):
        if _p0 and _p1:
            return self.loft_polylines_with_holes(_p0, _p1, _c)
# ---------- end loft_b ----------
loft_b_2 = Loft_brep(p0=dispatch_2.ListA, p1=dispatch_2.ListB, c=swatch_2)  # -> brep; inputs p0: list of Curve, p1: list of Curve, c: Color; same code as loft_b

# ----
# JOINT
entwine = Entwine(Branch00=loft_b, Branch01=loft_b_2, FlattenInputs=True)
sdiff = SolidDifference(BrepsA=graft(line_volume.brep), BrepsB=simplify(entwine))  # -> flatten(Result)

# ---- group: Assembly
Z = UnitZ(Factor=1)
Z_2 = UnitZ(Factor=1)
line = LineSDL(Start=[Z, Z_2], Direction=Vector(0, 0, 1), Length="-1")  # -> simplify(flatten(Line))
assembly_solids = Assembly(geos=sdiff, dir=line, t=Slider(1.99999, range=1e-05..1.99999))  # inputs geos: list of GeometryBase, dir: list of Line, t: Double
#   port geos: collection of breps
#   port dir: a list of lines that represent the direction of the assembly sequence per element or a group, depending on the inpout N
#   port t: slider from 0.00 to number of groups, that helps to animate the assembly sequence
# ---------- assembly_solids: Python ----------
"""display assembly sequence"""
__author__ = "petras"
__version__ = "2023.04.13"

from ghpythonlib.componentbase import executingcomponent as component
import Grasshopper, GhPython
import System
import Rhino
import rhinoscriptsyntax as rs


import rhinoscriptsyntax as rs
import Rhino.Geometry as rg
from Rhino.Geometry import BoundingBox
from Rhino.Geometry import Point3d
from Rhino.Geometry import Plane
from Rhino.Geometry import Polyline
from Rhino.Geometry import Vector3d
from Rhino.Geometry import Line
from Rhino.Geometry import TextEntity
from Rhino.Geometry import Transform
from System.Drawing import Color
import math


class MyComponent(component):

    bbox = BoundingBox.Unset
    lines = []
    insertion_vectors_current = []
    joint_per_face_current_text_entity = []
    meshes = []
    breps = []
    material = Rhino.Display.DisplayMaterial(Color.FromArgb(200, 200, 200))

    def DrawViewportWires(self, args):

        for o in self.breps:
            for i in o.Curves3D:
                args.Display.DrawCurve(i, Color.FromArgb(0, 0, 0))
            args.Display.DrawBrepShaded(o, self.material)
        for o in self.meshes:
            args.Display.DrawMeshShaded(o, self.material)
            args.Display.DrawMeshWires(o, Color.Black, 1)

    def get_ClippingBox(self):
        return self.bbox

    def display_insersion_sequence(self, _geos, _lines, _t):

        text_size = 50
        line_scale = 300

        ###############################################################################
        # input
        ###############################################################################
        self.bbox = BoundingBox.Unset
        self.lines = _lines if len(_lines) > 0 else [Line(Point3d(0, 0, 0), Point3d(0, 0, 1))]
        self.insertion_vectors_current = []
        self.joint_per_face_current_text_entity = []
        self.breps = []
        self.meshes = []

        if len(_geos) == 0:
            return

        _n = 1
        group_count = _n if _n is not None else 1
        t = _t if _t is not None else 0.0
        item = self.lines[0]
        self.bbox = _geos[0].GetBoundingBox(False)

        ###############################################################################
        # process
        ###############################################################################
        for i in range(1, len(self.lines)):
            self.bbox.Union(_geos[i].GetBoundingBox(False))

        for i in range(0, int(math.floor(t))):
            if isinstance(_geos[i], Rhino.Geometry.Mesh):
                self.meshes.append(_geos[i])
            elif isinstance(_geos[i], Rhino.Geometry.Brep):
                self.breps.append(_geos[i])

        if t % 1 > 0:

            id2 = int(math.floor(t))
            geos_current = []

            for i in range(group_count):
                geos_current.append(_geos[id2])

            for m in range(len(geos_current)):
                item = self.lines[id2]
                line_from = item.From
                item = self.lines[id2]
                to = line_from - item.To

                geo = geos_current[m].Duplicate()
                geo.Transform(Transform.Translation(to * (1 - t % 1)))
                geos_current[m] = geo

            for i in geos_current:
                if isinstance(i, Rhino.Geometry.Mesh):
                    self.meshes.append(i)
                elif isinstance(i, Rhino.Geometry.Brep):
                    self.breps.append(i)

        return

    def RunScript(self,
            _geos: System.Collections.Generic.List[Rhino.Geometry.GeometryBase],
            _dir: System.Collections.Generic.List[Rhino.Geometry.Line],
            _t: float):

        if not _geos:
            return

        lines = _dir
        if not _dir:
            first_geo_bbox = _geos[0].GetBoundingBox(False)
            pmin = Rhino.Geometry.Point3d(0, 0, first_geo_bbox.Min.Z)
            pmax = Rhino.Geometry.Point3d(0, 0, first_geo_bbox.Max.Z)
            line = Rhino.Geometry.Line(pmin, pmax)
            lines = [line] * len(_geos)

        self.display_insersion_sequence(_geos, lines, _t)
# ---------- end assembly_solids ----------
