# Grasshopper definition 16_beams_nearest_curve.gh (Grasshopper 1.0.8)
# plug-ins: RhinoCodePluginGH

# ---- group: Input
number_slider = Slider(1, range=0..1)
crv = Curve(Tree({0}: [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], {1}: [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], {2}: [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], {3}: [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], {4}: [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], {5}: [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]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))
ext = ExtendCurve(Curve=crv, Type=0, Start=number_slider, End=number_slider)
line = Line(ext)
pframes = PerpFrames(Curve=line, Count=Slider(3, range=0..10), Align=True)  # -> simplify(Frames), Parameters
cir = Circle(Plane=pframes.Frames, Radius=Slider(0.2, range=0..1))  # -> simplify(Circle)
beam_volume = Beam_volume(
    circles=cir,
    length_of_box=Slider(1.642, range=0..2),
    distance_tolerance=Slider(0.663, range=0..10),
    cross_or_toptoside=Slider(1, range=0..1.01),
    create_pipes=Toggle(True))  # -> index_polylines, index_polylines_segment, distance, point_pairs, volume_pairs, joints_areas, joints_types, pipes; inputs circles: tree, length_of_box: Double, distance_tolerance: Double, cross_or_toptoside: Double, create_pipes: Boolean
#   port circles: circles around curves that represntes the radius along the axes
#   port length_of_box: the length of the joint volumes
#   port distance_tolerance: closest distance between two curves
#   port cross_or_toptoside: switch between half lap or top-to-side joint volume generation
#   port create_pipes: generate lofted solids from the curves
#   port index_polylines: indices of polylines axes
#   port index_polylines_segment: indices of polylines segements
#   port distance: distance between points
#   port point_pairs: closest point pairs
#   port volume_pairs: rectangle pairs representing elements
#   port joints_areas: joint areas between volumes
#   port joints_types: joints types from interface condition
#   port pipes: if _create_pipes input is set to True the circles are lofted and outputted here
# ---------- beam_volume: Python ----------
"""generate beam nodes around curves given circles are an input"""
# r: compas_wood, compas, wood_nano
import Rhino
import Grasshopper
import ghpythonlib.treehelpers as th
from ghpythonlib.componentbase import executingcomponent as component
from wood_nano import beam_volumes as wood_nano_beam_volumes
from compas_wood.conversions_rhino import to_point2
from compas_wood.conversions_rhino import to_vector2
from compas_wood.conversions_rhino import from_point2
from compas_wood.conversions_rhino import from_point3
from wood_nano.conversions_python import to_double2
from wood_nano.conversions_python import to_int1
from wood_nano.conversions_python import from_int1
from wood_nano.conversions_python import from_int2
from wood_nano.conversions_python import from_double2
from wood_nano import int1
from wood_nano import int2
from wood_nano import double2
from wood_nano import point2
from wood_nano import point3
from wood_nano import cut_type2

class BeamVolume(component):
    def beam_volumes(self,
        input_polyline_axes,
        input_polylines_segment_radii,
        input_polylines_segment_direction,
        input_allowed_types_per_polyline=[1],
        input_min_distance=50,
        input_volume_length=500,
        input_cross_or_side_to_end=0.91,
        input_flip_male=1,
        input_compute_joints=False,
        input_division_distance=150,
        input_shift=0.5,
        input_output_geometry_type=0,
        input_use_eccentricities_to_scale_joints=True,
    ):

        index_polylines = int2()
        index_polylines_segment = int2()
        distance = double2()
        point_pairs = point2()
        volume_pairs = point3()
        joints_areas = point2()
        joints_types = int1()
        w_output_plines = point3()
        w_output_types = cut_type2()

        wood_nano_beam_volumes(
            to_point2(input_polyline_axes),
            to_double2(input_polylines_segment_radii),
            to_vector2(input_polylines_segment_direction),
            to_int1(input_allowed_types_per_polyline),
            float(input_min_distance),
            float(input_volume_length),
            float(input_cross_or_side_to_end),
            int(input_flip_male),
            index_polylines,  # out
            index_polylines_segment,  # out
            distance,  # out
            point_pairs,  # out
            volume_pairs,  # out
            joints_areas,  # out
            joints_types,  # out
            w_output_plines,  # from_point3(w_output_plines)
            w_output_types,  # from_cut_type2(w_output_types))
            input_compute_joints,
            input_division_distance,
            input_shift,
            input_output_geometry_type,
            input_use_eccentricities_to_scale_joints,
        )

        return (
            from_int2(index_polylines),
            from_int2(index_polylines_segment),
            from_double2(distance),
            from_point2(point_pairs),
            from_point3(volume_pairs),
            from_point2(joints_areas),
            from_int1(joints_types),
        )

    def RunScript(self,
            _circles: Grasshopper.DataTree[Rhino.Geometry.Circle],
            _length_of_box: float,
            _distance_tolerance: float,
            _cross_or_toptoside: float,
            _create_pipes: bool):

        if _circles is None: return
        length_of_box = _length_of_box if _length_of_box else 1
        distance_tolerance = _distance_tolerance if _distance_tolerance else 10
        cross_or_top_to_side= _cross_or_toptoside if _cross_or_toptoside else 0.91
        create_pipes = _create_pipes if _create_pipes else False
        
        # Initialize outputs
        input_polylines = []
        input_polylines_segment_radii = []
        input_polylines_segment_direction = []
        _pipes = []

        # Processing each branch which represents a polyline
        for i in range(_circles.BranchCount):
            points = []
            radii= []
            normals = []
            parameters = []
            for index, circle in enumerate(_circles.Branch(i)):
                points.append(circle.Center)
                radii.append(circle.Radius)
                normals.append(circle.Plane.YAxis)
                parameters.append(index)
            # radii.pop()
            # normals.pop()

            input_polylines.append(Rhino.Geometry.Polyline(points))
            input_polylines_segment_radii.append(radii)
            # input_polylines_segment_direction.append(normals)

            if(create_pipes):
                curves = []
                for j in range (_circles.Branch(i).Count):
                    curves.append(_circles.Branch(i)[j].ToNurbsCurve())

                brep = Rhino.Geometry.Brep.CreateFromLoft(curves, Rhino.Geometry.Point3d.Unset, Rhino.Geometry.Point3d.Unset, Rhino.Geometry.LoftType.Loose, False)[0]
                brep = brep.CapPlanarHoles(Rhino.RhinoDoc.ActiveDoc.ModelAbsoluteTolerance)
                
                faces = []
                for j in range(brep.Faces.Count):
                    faces.append(brep.Faces[j].DuplicateFace(False))
                
                brep = Rhino.Geometry.Brep.JoinBreps(
                    faces, Rhino.RhinoDoc.ActiveDoc.ModelAbsoluteTolerance*10
                )[0]
                
                if brep:
                    brep.Faces.SplitKinkyFaces(Rhino.RhinoMath.DefaultAngleTolerance, True)
                    
                    if (Rhino.Geometry.BrepSolidOrientation.Inward is  brep.SolidOrientation):
                        brep.Flip();
                _pipes.append(brep)

        
        _index_polylines, _index_polylines_segment, _distance, _point_pairs, _volume_pairs, _joints_areas, _joints_types = self.beam_volumes(
                input_polylines,
                input_polylines_segment_radii,
                input_polylines_segment_direction,
                input_allowed_types_per_polyline=[1],
                input_min_distance=distance_tolerance,
                input_volume_length=length_of_box,
                input_cross_or_side_to_end=cross_or_top_to_side,
        )

        return  th.list_to_tree(_index_polylines), th.list_to_tree( _index_polylines_segment), th.list_to_tree(_distance), th.list_to_tree(_point_pairs), th.list_to_tree( _volume_pairs), th.list_to_tree( _joints_areas), th.list_to_tree( _joints_types), th.list_to_tree( _pipes)
# ---------- end beam_volume ----------

# ---- group: Solver
panel = Panel("""83
0.4
31""")
number_slider_2 = Slider(1, range=0..1)
number_slider_3 = Slider(3, range=0..10)
joint_parameters = Joint_parameters(cr_c_ip=panel)  # -> p; inputs ss_e_ip: list of Double, ss_e_op: list of Double, ts_e_p: list of Double, cr_c_ip: list of Double, tt_e_p: list of Double, ss_e_r: list of Double, b: list of Double
#   port ss_e_ip: side-to-side in-plane joint parameters
#   port ss_e_op: side-to-side out-of-plane joint parameters
#   port ts_e_p: top-to-side joint parameters
#   port cr_c_ip: cross joint parameters
#   port tt_e_p: top-to-top joint parameters
#   port ss_e_r: side-to-side rotated joint parameters
#   port b: boundary joint parameters
#   port p: a list of joint parameters
# ---------- joint_parameters: Python ----------
"""
Do something silly in python3.

This component does nothing useful, it's only a kitchen sink (but in python3) example showing most available options.

    Args:
        x: X value
        y: Y value
        z: Z value
    Returns:
        result: The sum of all three values.
"""
from ghpythonlib.componentbase import executingcomponent as component

import System
import math


class joint_parameters_component(component):
    def RunScript(self,
            _ss_e_ip: System.Collections.Generic.List[float],
            _ss_e_op: System.Collections.Generic.List[float],
            _ts_e_p: System.Collections.Generic.List[float],
            _cr_c_ip: System.Collections.Generic.List[float],
            _tt_e_p: System.Collections.Generic.List[float],
            _ss_e_r: System.Collections.Generic.List[float],
            _b: System.Collections.Generic.List[float]):

        joint_parameters = [
            300,
            0.5,
            3,  # 1-9 ss_e_ip (side-to-side edge in-plane)
            50,
            0.64,
            15,  # 10-19 ss_e_op (side-to-side edge out-of-plane)
            450,
            0.5,
            20,  # 20-29 ts_e_p (top-to-side edge plane)
            300,
            0.5,
            30,  # 30-39 cr_c_ip (cross cutting in-plane)
            6,
            0.95,
            40,  # 40-49 tt_e_p  (top-to-top edge plane)
            300,
            0.5,
            58,  # 50-59 ss_e_r (side-to-side edge rotated)
            300,
            1.0,
            60,  # 60-69 b (boundary)
        ]

        if _ss_e_ip:
            for i in range(len(_ss_e_ip)):
                joint_parameters[0 * 3 + i] = _ss_e_ip[i]

        if _ss_e_op:
            for i in range(len(_ss_e_op)):
                joint_parameters[1 * 3 + i] = _ss_e_op[i]

        if _ts_e_p:
            for i in range(len(_ts_e_p)):
                joint_parameters[2 * 3 + i] = _ts_e_p[i]

        if _cr_c_ip:
            for i in range(len(_cr_c_ip)):
                joint_parameters[3 * 3 + i] = _cr_c_ip[i]

        if _tt_e_p:
            for i in range(len(_tt_e_p)):
                joint_parameters[4 * 3 + i] = _tt_e_p[i]

        if _ss_e_r:
            for i in range(len(_ss_e_r)):
                joint_parameters[5 * 3 + i] = _ss_e_r[i]

        if _b:
            for i in range(len(_b)):
                joint_parameters[6 * 3 + i] = _b[i]

        _joint_p = joint_parameters

        return _joint_p
# ---------- end joint_parameters ----------
input_set = Input_set(polylines=flatten(beam_volume.volume_pairs))  # -> data; inputs polylines: tree of Polyline, vectors: tree of Vector3d, joint_types: tree of Int32, three_valence: tree of Int32, adjacency: tree of Int32
#   port polylines: a data-tree of polyline pairs
#   port vectors: insertion direction
#   port joint_types: joint type per side, top, bottom, and sides
#   port three_valence: three valance joinery that starts 0 - Vidy, 1 - Annen, and 4 indices current, next, current-neighbor, next-neighbor
#   port adjacency: joint parameters
#   port data: user input_get component to ungroup all the data to the individual data-trees
# ---------- input_set: Python ----------
"""combine different data sets into one list for a faster data transder between grasshopper wires"""
from ghpythonlib.componentbase import executingcomponent as component
import Grasshopper, GhPython

__author__ = "petras"
__version__ = "2023.04.02"


import System
import Rhino
import rhinoscriptsyntax as rs
import ghpythonlib.treehelpers as th
from Rhino.Geometry import Polyline
from Rhino.Geometry import Vector3d
from Rhino.Geometry import Plane
import compas_wood
from compas_wood.binding import test
from compas_wood.datastructures import WoodData

# r: compas


class MyComponent(component):
    def get_plane(self, _polyline, _orientation_point):

        len = _polyline.Count - 1
        normal = Vector3d(0, 0, 0)

        for i in range((_polyline.Count - 1)):
            num = ((i - 1) + len) % len
            item1 = ((i + 1) + len) % len
            point3d = _polyline[num]
            point3d1 = _polyline[item1]
            item2 = _polyline[i]
            normal = normal + Vector3d.CrossProduct(Vector3d(item2 - point3d), Vector3d(point3d1 - item2))

        normal.Unitize()
        plane = Plane(_polyline.CenterPoint(), normal)
        if plane.DistanceTo(_orientation_point) < 0:
            plane.Flip()

        return plane

    def RunScript(self,
            _polylines: Grasshopper.DataTree[Rhino.Geometry.Polyline],
            _vectors: Grasshopper.DataTree[Rhino.Geometry.Vector3d],
            _joint_types: Grasshopper.DataTree[int],
            _three_valence: Grasshopper.DataTree[int],
            _adjacency: Grasshopper.DataTree[int]):

        plines = []
        planes = []
        if _polylines.DataCount > 0:
            for i in range(_polylines.BranchCount):
                plines.extend(list(_polylines.Branch(i)))
                planes.append(self.get_plane(_polylines.Branch(i)[0], _polylines.Branch(i)[1][0]))

        insertion_vectors = th.tree_to_list(_vectors) if _vectors.DataCount > 0 else []
        joints_per_face = th.tree_to_list(_joint_types) if _joint_types.DataCount > 0 else []
        three_valence = th.tree_to_list(_three_valence) if _three_valence.DataCount > 0 else []
        adjacency = th.tree_to_list(_adjacency) if _adjacency.DataCount > 0 else []

        # output
        _data = WoodData(plines, insertion_vectors, joints_per_face, three_valence, adjacency, planes)

        # return outputs if you have them; here I try it for you:
        return _data
# ---------- end input_set ----------
panel_2 = Panel("""1.1
1.1
1.1""")

# ----
solver = Solver(data=input_set, joint_p=joint_parameters, scale=panel_2, find=number_slider_2, get=number_slider_3)  # -> data; inputs joint_p: list of Double, scale: list of Double, extension: list of Double, find: Int32, get: Int32
#   port data: collection of inputs that represent the elements, insertion vectors, joint types and adjacency, use input_set commonent to group these inputs
#   port joint_p: joint parameters
#   port scale: scale of joint, default is [1,1,1]
#   port extension: extension by distance, plates often has [0,0,10], whereas beams [10,10,10], default is [0,0,0]
#   port find: search_type search type 0 - side-to-side, 1 - cross, 2 - both
#   port get: output_type 0 - outlines | 1 - lines | 2 - areas | 3 - volumes | 4 - merged geometry of joints
#   port data: user input_get component to ungroup all the data to the individual data-trees
# ---------- solver: Python ----------
"""generate joints between elements"""
from ghpythonlib.componentbase import executingcomponent as component
import Rhino
import System
from wood_nano import get_connection_zones as wood_nano_get_connection_zones
from wood_nano import cut_type2 as wood_nano_cut_type2
from wood_nano import point3 as wood_nano_point3
from wood_nano.conversions_python import to_int2
from wood_nano.conversions_python import to_int1
from wood_nano.conversions_python import to_double1
from wood_nano.conversions_python import from_cut_type2
from compas_wood.conversions_rhino import to_point2
from compas_wood.conversions_rhino import to_vector2
from compas_wood.conversions_rhino import from_point3
from compas_wood.binding import wood_globals
from compas_wood.datastructures import WoodData
from math import floor


class connections_zones(component):
    def __init__(self):
        self.bbox = Rhino.Geometry.BoundingBox.Unset
        self.lines = []
        self.insertion_vectors_current = []
        self.joint_per_face_current_text_entity = []
        self.polylines = []

    def DrawViewportWires(self, args):
        col = args.WireColour
        line_weight = args.DefaultCurveThickness
        for polylines_list in self.polylines:
            for polyline in polylines_list:
                args.Display.DrawPolyline(polyline, col, line_weight)

    def get_ClippingBox(self):
        return self.bbox

    def RunScript(self,
            _data,
            _joint_p: System.Collections.Generic.List[float],
            _scale: System.Collections.Generic.List[float],
            _extension: System.Collections.Generic.List[float],
            _find: int,
            _get: int):

        # ==============================================================================
        # clear input
        # ==============================================================================
        self.bbox = Rhino.Geometry.BoundingBox.Unset
        self.lines = []
        self.insertion_vectors_current = []
        self.joint_per_face_current_text_entity = []
        self.polylines = []

        # ==============================================================================
        # input
        # ==============================================================================
        if _data is None:
            return

        input_polyline_pairs = _data.plines
        if input_polyline_pairs:
            if len(input_polyline_pairs) > 0:
                self.bbox = input_polyline_pairs[0].BoundingBox
                for pline in input_polyline_pairs:
                    self.bbox.Union(pline.BoundingBox)

        input_insertion_vectors = _data.insertion_vectors
        input_joint_types = _data.joints_per_face
        input_three_valence_element_indices_and_instruction = _data.three_valence

        input_search_type = max(min(2, _find), 0) if _find else 0

        input_scale = [1, 1, 1]
        if _scale:
            for i in range(0, len(_scale)):
                input_scale[i] = _scale[i]

        input_output_type = _get if _get is not None else 4

        input_joint_volume_parameters = [0, 0, 0]

        if _extension:
            if len(_extension) > 2:
                input_joint_volume_parameters = []
                for i in _extension:
                    input_joint_volume_parameters.append(i * 10)

        input_adjacency = _data.adjacency
        joint_parameters = wood_globals.joints_parameters_and_types
        wood_globals.face_to_face_side_to_side_joints_rotated_joint_as_average = False
        wood_globals.face_to_face_side_to_side_joints_all_treated_as_rotated =  False


        if _joint_p:
            for i in range(0, len(_joint_p), 3):
                insertion_id = floor(_joint_p[i + 2] / 10)
                joint_parameters[insertion_id * 3 + 0] = _joint_p[i + 0]
                joint_parameters[insertion_id * 3 + 1] = _joint_p[i + 1]
                joint_parameters[insertion_id * 3 + 2] = _joint_p[i + 2]

        w_output_plines = wood_nano_point3()
        w_output_types = wood_nano_cut_type2()

        wood_nano_get_connection_zones(
            to_point2(input_polyline_pairs),
            to_vector2(input_insertion_vectors),
            to_int2(input_joint_types),
            to_int2(input_three_valence_element_indices_and_instruction),
            to_int1(input_adjacency),
            to_double1(joint_parameters),
            int(input_search_type),
            to_double1(input_scale),
            int(input_output_type),
            w_output_plines,
            w_output_types,
            to_double1(input_joint_volume_parameters),
        )

        self.polylines = from_point3(w_output_plines)
        return WoodData(
            plines=_data.plines,
            insertion_vectors=_data.insertion_vectors,
            joints_per_face=_data.joints_per_face,
            three_valence=_data.three_valence,
            adjacency=_data.adjacency,
            planes=_data.planes,
            plines_with_joints=self.polylines,
            cut_types=from_cut_type2(w_output_types),
        )
# ---------- end solver ----------

# ---- group: Solver (continued)
input_get = Input_get(data=solver)  # -> graft(plines_0), graft(plines_1), lines, insertion_vectors, joints_per_face, three_valence, adjacency, cut_types; inputs split: Boolean
#   port data: collection of inputs that represent the elements, insertion vectors, joint types and adjacency, use input_set commonent to group these inputs
#   port split: split output into closed outlines and lines
#   port plines_0: polyline pairs
#   port plines_1: polyline pairs
#   port lines: polyline pairs
#   port insertion_vectors: insertion vectors per element top bottom and side faces
#   port joints_per_face: joinery types per element top bottom and side faces
#   port three_valence: three valence indices for special cases where one element is connected with two others
#   port adjacency: connectivity between elements and their faces
#   port cut_types: fabrication type
# ---------- input_get: Python ----------
"""unwrap element data to polylines, insertion vectors, joint types and etc"""
from ghpythonlib.componentbase import executingcomponent as component
import Grasshopper, GhPython
import System

__author__ = "petras"
__version__ = "2023.04.02"

import ghpythonlib.treehelpers as th
from Rhino.Geometry import Polyline
import Rhino
import rhinoscriptsyntax as rs


class MyComponent(component):
    def RunScript(self, _data, _split: bool):

        if _data is None:
            return

        split = True if _split is None else _split

        _plines_0 = Grasshopper.DataTree[Rhino.Geometry.Curve]()
        _plines_1 = Grasshopper.DataTree[Rhino.Geometry.Curve]()
        _lines = Grasshopper.DataTree[Rhino.Geometry.Curve]()
        if split == False:
            for i in range(len(_data.plines_with_joints)):
                for j in range(len(_data.plines_with_joints[i])):
                    _plines_0.Add(_data.plines_with_joints[i][j].ToNurbsCurve(), Grasshopper.Kernel.Data.GH_Path(i))
        else:
            for i in range(len(_data.plines_with_joints)):
                for j in range(len(_data.plines_with_joints[i])):
                    if _data.plines_with_joints[i][j].Count == 2:
                        _lines.Add(_data.plines_with_joints[i][j].ToNurbsCurve(), Grasshopper.Kernel.Data.GH_Path(i))
                    else:
                        if j % 2 == 0:
                            print(_data.plines_with_joints[i][j])
                            _plines_0.Add(
                                _data.plines_with_joints[i][j].ToNurbsCurve(), Grasshopper.Kernel.Data.GH_Path(i)
                            )
                        else:
                            _plines_1.Add(
                                _data.plines_with_joints[i][j].ToNurbsCurve(), Grasshopper.Kernel.Data.GH_Path(i)
                            )

        _insertion_vectors = th.list_to_tree(_data.insertion_vectors)
        _joints_per_face = th.list_to_tree(_data.joints_per_face)
        _three_valence = th.list_to_tree(_data.three_valence)
        _adjacency = th.list_to_tree(_data.adjacency)
        _cut_types = th.list_to_tree(_data.cut_types)

        # return outputs if you have them; here I try it for you:
        return (
            _plines_0,
            _plines_1,
            _lines,
            _insertion_vectors,
            _joints_per_face,
            _three_valence,
            _adjacency,
            _cut_types,
        )
# ---------- end input_get ----------
loft_b = Loft_brep(p0=input_get.plines_0, p1=input_get.plines_1)  # -> simplify(brep); inputs p0: list of Curve, p1: list of Curve, c: Color
#   port p0: polylines with holes, bottom
#   port p1: polylines with holes, top
#   port c: color, if given all the brep is colorized else only the sides, this is useful for boolean difference
#   port brep: lofted and capped brep with holes
# ---------- loft_b: Python ----------
from ghpythonlib.componentbase import executingcomponent as component
import Rhino
from System.Drawing import Color
import System


class connections_zones(component):
    def project_curves_to_plane(self, curves):
        points = []
        for curve in curves:
            for point in curve.ToNurbsCurve().Points:
                points.append(point.Location)

        result, plane = Rhino.Geometry.Plane.FitPlaneToPoints(points)

        xform = Rhino.Geometry.Transform.PlanarProjection(plane)
        curves_projected = []
        for curve in curves:
            curve_projected = curve.DuplicateCurve()
            curve_projected.Transform(xform)
            curves_projected.append(curve_projected)
        return curves_projected

    def loft_polylines_with_holes(self, curves0, curves1, color):
        """Loft polylines with holes

        Parameters
        ----------
        curves0 : list[rg.Polyline]
        curves1 : list[rg.Polyline]

        Returns
        -------
        rg.Brep
            brep as lofted polylines and cap them
        """

        ###############################################################################
        # user input
        ###############################################################################

        if curves0 == [None]:
            return
        if curves1 == [None]:
            return

        if len(curves0) == 0:
            return
        if len(curves1) == 0:
            return

        flag = len(curves0) is not 0 if True else len(curves1) != 0
        if flag:
            curves = []
            curves2 = []

            flag0 = len(curves1) == 0
            flag1 = len(curves0) == 0 and len(curves1) != 0
            flag2 = len(curves0) and len(curves1)

            if flag0:
                for i in range(len(curves0)):
                    if float(i) >= float(len(curves0)) * 0.5:
                        curves2.Add(curves0[i])
                    else:
                        curves.Add(curves0[i])
            elif flag1:
                for i in range(0, len(curves1), 2):
                    curves.Add(curves1[i])
                    curves2.Add(curves1[i + 1])
            elif flag2:
                curves = curves0
                curves2 = curves1

            curves0 = curves
            curves1 = curves2

        ###############################################################################
        # Create mesh of the bottom face
        ###############################################################################

        curves0 = self.project_curves_to_plane(curves0)
        brep_0 = Rhino.Geometry.Brep.CreatePlanarBreps(curves0, Rhino.RhinoDoc.ActiveDoc.ModelAbsoluteTolerance)[0]

        curves1 = self.project_curves_to_plane(curves1)
        brep_1 = Rhino.Geometry.Brep.CreatePlanarBreps(curves1, Rhino.RhinoDoc.ActiveDoc.ModelAbsoluteTolerance)[0]

        ###############################################################################
        # Create lofts
        ###############################################################################
        breps_to_join = [brep_0, brep_1]
        for i in range(len(curves0)):
            wall = Rhino.Geometry.Brep.CreateFromLoft(
                [curves0[i], curves1[i]],
                Rhino.Geometry.Point3d.Unset,
                Rhino.Geometry.Point3d.Unset,
                Rhino.Geometry.LoftType.Normal,
                False,
            )[0]
            breps_to_join.append(wall)

        ###############################################################################
        # Join Brep
        ###############################################################################

        solid = Rhino.Geometry.Brep.JoinBreps(breps_to_join, Rhino.RhinoDoc.ActiveDoc.ModelAbsoluteTolerance)[0]

        faces = []
        for i in range(solid.Faces.Count):
            faces.append(solid.Faces[i].DuplicateFace(False))

        solid = Rhino.Geometry.Brep.JoinBreps(faces, Rhino.RhinoDoc.ActiveDoc.ModelAbsoluteTolerance)[0]

        if solid:
            solid.Faces.SplitKinkyFaces(Rhino.RhinoMath.DefaultAngleTolerance, True)

            if Rhino.Geometry.BrepSolidOrientation.Inward is solid.SolidOrientation:
                solid.Flip()

        if color is not None:
            for i in range(solid.Faces.Count):
                solid.Faces[i].PerFaceColor = color
        else:
            for i in range(solid.Faces.Count):
                if i < 2:
                    solid.Faces[i].PerFaceColor = Color.LightGray  # Color.LightGray
                else:
                    solid.Faces[i].PerFaceColor = Color.DeepPink

        return solid

    def RunScript(self,
            _p0: System.Collections.Generic.List[Rhino.Geometry.Curve],
            _p1: System.Collections.Generic.List[Rhino.Geometry.Curve],
            _c: System.Drawing.Color):
        if _p0 and _p1:
            return self.loft_polylines_with_holes(_p0, _p1, _c)
# ---------- end loft_b ----------
group_cuts = Group_cuts(geometry=loft_b, group_id=flatten(beam_volume.index_polylines))  # -> result; inputs geometry: tree of GeometryBase, group_id: tree of Int32
#   port group_id: group indices from the beam nodes component
#   port result: geometry ready for boolean difference
# ---------- group_cuts: Python ----------
"""match data tree of beam-nodes component with the output of the solver"""
from ghpythonlib.componentbase import executingcomponent as component
import Grasshopper, GhPython
import System
import Rhino


class MyComponent(component):
    def RunScript(self,
            _geometry: Grasshopper.DataTree[Rhino.Geometry.GeometryBase],
            _group_id: Grasshopper.DataTree[int]):

        tree_temp = Grasshopper.DataTree[Rhino.Geometry.GeometryBase]()

        # flatten to the first index to bring lofted cuts to a single joint
        for i in range(_geometry.BranchCount):
            path = _geometry.Paths[i]
            tree_temp.AddRange(_geometry.Branch(i), Grasshopper.Kernel.Data.GH_Path(path.Indices[0]))

        # group
        tree = Grasshopper.DataTree[Rhino.Geometry.GeometryBase]()
        all_indices = _group_id.AllData()

        for i, element_idx in enumerate(all_indices):
            path = Grasshopper.Kernel.Data.GH_Path(element_idx)
            tree.AddRange(tree_temp.Branch(i), path)

        return tree
# ---------- end group_cuts ----------

# ---- group: Boolean Difference
number_slider_4 = Slider(10, range=0..10)
item = ListItem(List=beam_volume.pipes, Index=number_slider_4, Wrap=True)
branch = TreeBranch(Tree=group_cuts, Path=number_slider_4, MaintainPaths=True)
sdiff = SolidDifference(BrepsA=item, BrepsB=branch)
area = Area(Geometry=sdiff)  # -> Area, Centroid
sort = SortList(Keys=area.Area, ValuesA=sdiff)  # -> Keys, reverse(ValuesA)
item_2 = ListItem(List=sort.ValuesA, Index=0, Wrap=True)

# ----
sdiff_2 = SolidDifference(BrepsA=graft(beam_volume.pipes), BrepsB=group_cuts)
