# Grasshopper definition 17_beam_custom_joints.gh (Grasshopper 1.0.8)
# plug-ins: RhinoCodePluginGH

cuts1 = Curve([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])
cuts0 = Curve([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])

cuts0_2 = Curve([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])
cuts1_2 = Curve([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])

cuts0_3 = Curve([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])
cuts1_3 = Curve([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])

solver = Solver(cuts0=cuts0_3, cuts1=cuts1_3, type=Slider(39, range=0..100))  # -> custom_joints, custom_types; inputs cuts0: list of Curve, cuts1: list of Curve, type: Int32
#   port cuts0: cuts for removal from the first beam
#   port cuts1: cuts for removal from the second beam
#   port type: custom type that the geometry is assigned to
#   port custom_joints: geometry for all the cuts
#   port custom_types: types for all the cuts
# ---------- solver: Python ----------
"""generate joints between elements"""
from ghpythonlib.componentbase import executingcomponent as component
import Grasshopper, GhPython
import System
import Rhino
import rhinoscriptsyntax as rs
from Rhino.Geometry import Polyline, Point3d


class MyComponent(component):
    def RunScript(self,
            _cuts0: System.Collections.Generic.List[Rhino.Geometry.Curve],
            _cuts1: System.Collections.Generic.List[Rhino.Geometry.Curve],
            _type: int):

        if not _cuts0:
            return

        if not _cuts1:
            return

        if not _type:
            return

        _custom_joints = []
        _custom_types = []
        type = 39 if _type is None else _type

        for i in range(len(_cuts0)):
            _custom_joints.append(_cuts0[i])
            _custom_types.append(type)

        for i in range(len(_cuts1)):
            _custom_joints.append(_cuts1[i])
            _custom_types.append(-type)

        # return outputs if you have them; here I try it for you:
        return (_custom_joints, _custom_types)
# ---------- end solver ----------
solver_2 = Solver(cuts0=cuts0_2, cuts1=cuts1_2, type=Slider(29, range=0..100))  # -> custom_joints, custom_types; inputs cuts0: list of Curve, cuts1: list of Curve, type: Int32; same code as solver
solver_3 = Solver(cuts0=cuts0, cuts1=cuts1, type=Slider(9, range=0..100))  # -> custom_joints, custom_types; inputs cuts0: list of Curve, cuts1: list of Curve, type: Int32; same code as solver
merge = Merge(Data1=solver_3.custom_types, Data2=solver_2.custom_types, Data3=solver.custom_types)
merge_2 = Merge(Data1=solver_3.custom_joints, Data2=solver_2.custom_joints, Data3=solver.custom_joints)

panel = Panel("""100
0.5
29""")
panel_2 = Panel("""100
0.5
39""")
panel_3 = Panel("""100
0.5
9""")

joint_parameters = Joint_parameters(ss_e_ip=panel_3, ts_e_p=panel, cr_c_ip=panel_2)  # -> p; inputs ss_e_ip: list of Double, ss_e_op: list of Double, ts_e_p: list of Double, cr_c_ip: list of Double, tt_e_p: list of Double, ss_e_r: list of Double, b: list of Double
#   port ss_e_ip: side-to-side in-plane joint parameters
#   port ss_e_op: side-to-side out-of-plane joint parameters
#   port ts_e_p: top-to-side joint parameters
#   port cr_c_ip: cross joint parameters
#   port tt_e_p: top-to-top joint parameters
#   port ss_e_r: side-to-side rotated joint parameters
#   port b: boundary joint parameters
#   port p: a list of joint parameters
# ---------- joint_parameters: Python ----------
"""
Do something silly in python3.

This component does nothing useful, it's only a kitchen sink (but in python3) example showing most available options.

    Args:
        x: X value
        y: Y value
        z: Z value
    Returns:
        result: The sum of all three values.
"""
from ghpythonlib.componentbase import executingcomponent as component

import System
import math


class joint_parameters_component(component):
    def RunScript(self,
            _ss_e_ip: System.Collections.Generic.List[float],
            _ss_e_op: System.Collections.Generic.List[float],
            _ts_e_p: System.Collections.Generic.List[float],
            _cr_c_ip: System.Collections.Generic.List[float],
            _tt_e_p: System.Collections.Generic.List[float],
            _ss_e_r: System.Collections.Generic.List[float],
            _b: System.Collections.Generic.List[float]):

        joint_parameters = [
            300,
            0.5,
            3,  # 1-9 ss_e_ip (side-to-side edge in-plane)
            50,
            0.64,
            15,  # 10-19 ss_e_op (side-to-side edge out-of-plane)
            450,
            0.5,
            20,  # 20-29 ts_e_p (top-to-side edge plane)
            300,
            0.5,
            30,  # 30-39 cr_c_ip (cross cutting in-plane)
            6,
            0.95,
            40,  # 40-49 tt_e_p  (top-to-top edge plane)
            300,
            0.5,
            58,  # 50-59 ss_e_r (side-to-side edge rotated)
            300,
            1.0,
            60,  # 60-69 b (boundary)
        ]

        if _ss_e_ip:
            for i in range(len(_ss_e_ip)):
                joint_parameters[0 * 3 + i] = _ss_e_ip[i]

        if _ss_e_op:
            for i in range(len(_ss_e_op)):
                joint_parameters[1 * 3 + i] = _ss_e_op[i]

        if _ts_e_p:
            for i in range(len(_ts_e_p)):
                joint_parameters[2 * 3 + i] = _ts_e_p[i]

        if _cr_c_ip:
            for i in range(len(_cr_c_ip)):
                joint_parameters[3 * 3 + i] = _cr_c_ip[i]

        if _tt_e_p:
            for i in range(len(_tt_e_p)):
                joint_parameters[4 * 3 + i] = _tt_e_p[i]

        if _ss_e_r:
            for i in range(len(_ss_e_r)):
                joint_parameters[5 * 3 + i] = _ss_e_r[i]

        if _b:
            for i in range(len(_b)):
                joint_parameters[6 * 3 + i] = _b[i]

        _joint_p = joint_parameters

        return _joint_p
# ---------- end joint_parameters ----------
solver_4 = Solver(custom_joints=merge_2, custom_types=merge)  # -> data; inputs joint_p: list of Double, scale: list of Double, extension: list of Double, find: Int32, get: Int32, custom_joints: list of Curve, custom_types: list of Int32; disabled
#   port data: collection of inputs that represent the elements, insertion vectors, joint types and adjacency, use input_set commonent to group these inputs
#   port joint_p: joint parameters
#   port scale: scale of joint, default is [1,1,1]
#   port extension: extension by distance, plates often has [0,0,10], whereas beams [10,10,10], default is [0,0,0]
#   port find: search_type search type 0 - side-to-side, 1 - cross, 2 - both
#   port get: output_type 0 - outlines | 1 - lines | 2 - areas | 3 - volumes | 4 - merged geometry of joints
#   port custom_joints: geometry for the custom joints e.g. 9,19,29,39,49,59,69
#   port custom_types: integers that indicates the custom joint type e.g. 9,19,29,39,49,59,69
#   port data: user input_get component to ungroup all the data to the individual data-trees
# ---------- solver_4: Python ----------
from ghpythonlib.componentbase import executingcomponent as component
import Grasshopper, GhPython
import Rhino
from Rhino.Geometry import Polyline, Point3d
#from compas_rhino import conversions
import System

import time
from ctypes import *
#from compas_wood.ctypes_conversion import *

import os

app_data = os.getenv('APPDATA')
vers = Rhino.RhinoApp.Version.Major
plugin_name = 'compas_wood'
plugin_path = "{0}\McNeel\Rhinoceros\packages\{1}.0\{2}".format(app_data, vers, plugin_name)

for _path in os.walk(plugin_path):
    if os.path.isdir(_path[0]):
        plugin_path =  _path[0]

def list_polylines_coord(polylines, scale = 10):
    f = []
    v = []
    for polyline in polylines:
        f.append(len(polyline))
        for point in polyline:
            v.append(point[0]*scale)
            v.append(point[1]*scale)
            v.append(point[2]*scale)
            #v.extend(point)
    _f = (c_size_t * len(f))(*f)
    _v = (c_float * len(v))(*v)
    return _f, c_size_t(len(f)), _v, c_size_t(len(v))


def lists_vectors_coord(vectors):
    faces = [len(v) for v in vectors]
    f = (c_size_t * len(vectors))(*faces)
    v = [coord for vec in vectors for point in vec for coord in point]

    v_s = c_size_t(len(v))  # * sizeof(c_float)
    v = (c_float * len(v))(*v)
    return f, c_size_t(len(vectors)), v, v_s


def lists_numbers_coord(numbers):
    v_s = 0
    f_s = len(numbers)
    f = (c_size_t * len(numbers))()

    for i in range(len(numbers)):
        f[i] = len(numbers[i])
        v_s += len(numbers[i]) * 1

    v = (c_int * v_s)()

    count = 0
    for i in range(len(numbers)):
        for j in range(len(numbers[i])):
            v[count] = numbers[i][j]
            count += 1

    return f, c_size_t(f_s), v, c_size_t(v_s)


def list_ints_coord(numbers):
    f_s = len(numbers)
    f = [0.0] * f_s
    for i in range(f_s):
        f[i] = numbers[i]
    return (c_int * len(f))(*f), c_size_t(f_s)


def list_numbers_coord(numbers):
    f_s = len(numbers)
    f = [0.0] * f_s
    for i in range(f_s):
        f[i] = numbers[i]
    return (c_float * len(f))(*f), c_size_t(f_s)



def coord_polylines_lists(groups_f, groups_f_s, out_f, out_f_s, out_v, out_v_s):
    polylines = [
        [Polyline([]) for j in range(groups_f[i])] for i in range(groups_f_s.value)
    ]

    a = 0
    b = 0
    pline_count = 0
    num_points = 3
    num_groups = groups_f_s.value

    points = []
    for i in range(0, out_v_s.value, num_points):
        #points.append([out_v[i]*0.1, out_v[i + 1]*0.1, out_v[i + 2]*0.1])
        points.append(Point3d(out_v[i]*0.1, out_v[i + 1]*0.1, out_v[i + 2]*0.1))
        num_points_per_polyline = out_f[pline_count]

        if len(points) == num_points_per_polyline:
            for j in range(a, groups_f_s.value):
                if groups_f[j] > 0:
                    a = j
                    break

            polylines[a][b] = Polyline(points)
            points = []
            num_polylines_per_group = groups_f[a]
            if b == (num_polylines_per_group - 1):
                a += 1
                b = 0
            else:
                b += 1
            pline_count += 1

    return polylines


def coord_numbers_lists(out_f, out_f_s, out_v, out_v_s):

    # create Python objects
    ids = [[] for _ in range(out_f_s.value)]

    for i in range(out_f_s.value):
        ids[i] = [None] * out_f[i]
        if out_f[i] == 0:
            return

    # fill array with points
    a = 0
    b = 0
    for i in range(0, out_v_s.value):
        ids[a][b] = out_v[i]
        if b == (out_f[a] - 1):
            a += 1
            b = 0
        else:
            b += 1

    return ids



class connections_zones(component):
    
    bbox = Rhino.Geometry.BoundingBox.Unset
    lines = []
    insertion_vectors_current = []
    joint_per_face_current_text_entity = []
    polylines = []
    
    def DrawViewportWires(self, args):
        #GrasshopperDocument = Grasshopper.Instances.ActiveCanvas.Document
        #is_selected = False
        """
        for _ in GrasshopperDocument.Objects:
            is_selected = _.Attributes.Selected
        """
        #col = args.WireColour_Selected if is_selected else args.WireColour;
        col =  args.WireColour
        line_weight = args.DefaultCurveThickness;
        try:
            for polyline in self.polylines:
                args.Display.DrawPolyline(polyline,  col, line_weight)
            """
            plane = Plane.WorldXY
            for line in self.lines:
                args.Display.DrawLineArrow(line, Color.FromArgb(207, 0, 90), 2, 100)
            for insertionVectorsCurrent in self.insertion_vectors_current:
                if(insertionVectorsCurrent.Length<0.05):
                    continue
                args.Display.DrawLine(insertionVectorsCurrent, Color.FromArgb(0, 0, 0), 5)
            for jointPerFaceCurrent in self.joint_per_face_current_text_entity:
                result, plane = Rhino.RhinoDoc.ActiveDoc.Views.ActiveView.ActiveViewport.GetCameraFrame()
                plane.Origin=(jointPerFaceCurrent.Plane.Origin)
                args.Display.Draw3dText(jointPerFaceCurrent.PlainText, jointPerFaceCurrent.MaskColor, plane, jointPerFaceCurrent.TextHeight, "Arial", False, False,Rhino.DocObjects.TextHorizontalAlignment.Center, Rhino.DocObjects.TextVerticalAlignment.BottomOfTop)
            """
        except Exception, e:
            System.Windows.Forms.MessageBox.Show(str(e), "script error")
    
    def get_ClippingBox(self):
        return self.bbox
    
    def RunScript(self,
            _data,
            _joint_p: System.Collections.Generic.List[float],
            _scale: System.Collections.Generic.List[float],
            _extension: System.Collections.Generic.List[float],
            _find: int,
            _get: int,
            _custom_joints: System.Collections.Generic.List[Rhino.Geometry.Curve],
            _custom_types: System.Collections.Generic.List[int]):
        # ==============================================================================
        # clear input
        # ==============================================================================
        self.bbox = Rhino.Geometry.BoundingBox.Unset
        self.lines = []
        self.insertion_vectors_current = []
        self.joint_per_face_current_text_entity = []
        self.polylines = []
        # ==============================================================================
        # input
        # ==============================================================================
        if(_data is None):
            return
        
        input_polylines = []
        if( _data[0] != 0):
            #convert to compas polylines
            for i in _data[0]:
                for j in i:
                    input_polylines.append(j)#(conversions.polyline_to_compas(j))
        
        input_vectors = []
        if(_data[1] != None):
            for i in _data[1]:
                list = []
                for j in i:
                    list.append(j)#(conversions.vector_to_compas(j))
                input_vectors.append(list)
        
        joint_parameters = [
            300, 0.5, 3,   # 1-9 ss_e_ip (side-to-side edge in-plane)
            50, 0.64, 15,  # 10-19 ss_e_op (side-to-side edge out-of-plane)
            450, 0.5, 20,  # 20-29 ts_e_p (top-to-side edge plane)
            300, 0.5, 30,  # 30-39 cr_c_ip (cross cutting in-plane)
            6, 0.95, 40,   # 40-49 tt_e_p  (top-to-top edge plane)
            300, 0.5, 58,  # 50-59 ss_e_r (side-to-side edge rotated)
            300, 1.0, 60   # 60-69 b (boundary)
        ]
        
        for i in range(0, len(_join_p)):
            if(i%3==0):
                joint_parameters[i] = _join_p[i]*10
            else:
                joint_parameters[i] = _join_p[i]*1
            
        
        search = id = max(min(2, _find), 0)
        
        scale = [1,1,1]
        for i in range(0, len(_scale)):
            scale[i] = _scale[i]
        
        output_type = _get if _get != None else 4
        
        extension = [0,0,0]
        
        if(len(_extension)>2):
            extension = []
            for i in _extension:
                extension.append(i*10)
        
        
        
        input_adjacency = []
        if(len(_data[4])>0):
            for i in _data[4]:
                for j in i:
                    input_adjacency.append(j)
        
        ############################################################################################################
        # Load inputs and perform conversion
        ############################################################################################################
    
        # input geometry
        # input_polylines = data_set_plates.annen_small_polylines()
        # print(len(input_polylines))
        (
            in_polyline_pairs_f,
            in_polyline_pairs_f_s,
            in_polyline_pairs_v,
            in_polyline_pairs_v_s,
        ) = list_polylines_coord(input_polylines)
        
    
        #input_vectors = data_set_plates.annen_small_edge_directions()
    
        (
            in_vectors_f,
            in_vectors_f_s,
            in_vectors_v,
            in_vectors_v_s,
        ) = lists_vectors_coord(input_vectors)
        
        
        
        input_joints = _data[2]#data_set_plates.annen_small_edge_joints()
        # print(len(input_joints))
        (
            in_joints_f,
            in_joints_f_s,
            in_joints_v,
            in_joints_v_s,
        ) = lists_numbers_coord(input_joints)
    
        input_three_valence =_data[3]#(data_set_plates.annen_small_three_valance_element_indices_and_instruction()   )
        
        # print(len(input_three_valence))
    
        (
            in_three_valence_f,
            in_three_valence_f_s,
            in_three_valence_v,
            in_three_valence_v_s,
        ) = lists_numbers_coord(input_three_valence)
    
        #input_adjacency = []
        
        (
            in_adjancency_v,
            in_adjancency_v_s,
        ) = list_ints_coord(input_adjacency)
    
        # input parameters
        (
            in_joint_parameters_v,
            in_joint_parameters_v_s,
        ) = list_numbers_coord(joint_parameters)
    
        in_search_type = c_int(search)
        (
            in_scale_v,
            in_scale_v_s,
        ) = list_numbers_coord(scale)
        
        in_output_type = c_int(output_type)
        
        #############################################################################################################
        # custom joint types
        #############################################################################################################
        
        input_joint_polyline_pairs = []
        (
            in_joint_polyline_pairs_f,
            in_joint_polyline_pairs_f_s,
            in_joint_polyline_pairs_v,
            in_joint_polyline_pairs_v_s
        ) = list_polylines_coord(_custom_joints,1)
        
        
        input_joint_types = []
        (
            in_joint_types_v,
            in_joint_types_v_s
        ) = list_ints_coord(_custom_types)
        #############################################################################################################
        # output parameters
        #############################################################################################################
        
        
        # output
        
        # out polylines
        out_plines_groups_f = POINTER(c_size_t)()
        out_plines_groups_f_s = c_size_t()
        out_plines_out_f = POINTER(c_size_t)()
        out_plines_out_f_s = c_size_t()
        out_plines_out_v = POINTER(c_float)()
        out_plines_out_v_s = c_size_t()
    
        # out types
        out_types_f = POINTER(c_size_t)()
        out_types_f_s = c_size_t()
        out_types_v = POINTER(c_int)()
        out_types_v_s = c_size_t()
    
        # global_parameters
        (
            in_joint_volume_parameters_v,
            in_joint_volume_parameters_v_s,
        ) = list_numbers_coord(extension)
        
        face_to_face_side_to_side_joints_dihedral_angle = c_float(130.0)
        
        ############################################################################################################
        # Load library and declare function signature
        ############################################################################################################
        if System.Environment.OSVersion.Platform == System.PlatformID.Win32NT:
            #print("Windows")
            lib_ = cdll.LoadLibrary(plugin_path+"\libgmp-10.dll")
            lib = cdll.LoadLibrary(plugin_path+"\pinvoke_wood.dll")
        elif System.Environment.OSVersion.Platform == System.PlatformID.Unix:
            #print("macOS")
            lib = cdll.LoadLibrary("/Users/compas_wood/libpinvoke_wood.dylib")
        else:
            print("Unknown operating system")
   

        lib.ctypes_get_connection_zones_with_custom_joints.restype = None
        lib.ctypes_get_connection_zones_with_custom_joints.argtypes = [
            # input geometry
            # polylines
            POINTER(c_size_t),
            POINTER(c_size_t),  # if a value is passed by reference, it must be a pointer
            POINTER(c_float),
            POINTER(c_size_t),  # if a value is passed by reference, it must be a pointer
            # vectors
            POINTER(c_size_t),
            POINTER(c_size_t),
            POINTER(c_float),
            POINTER(c_size_t),
            # joints
            POINTER(c_size_t),
            POINTER(c_size_t),
            POINTER(c_int),
            POINTER(c_size_t),
            # three valence
            POINTER(c_size_t),
            POINTER(c_size_t),
            POINTER(c_int),
            POINTER(c_size_t),
            # adjacency
            POINTER(c_int),
            POINTER(c_size_t),
            #custom joints
            POINTER(c_size_t),
            POINTER(c_size_t),  # if a value is passed by reference, it must be a pointer
            POINTER(c_float),
            POINTER(c_size_t),  # if a value is passed by reference, it must be a pointer
            #custom joints types
            POINTER(c_int),
            POINTER(c_size_t),
            # input parameters
            POINTER(c_float),
            POINTER(c_size_t),
            # search_type
            POINTER(c_int),
            # scale
            POINTER(c_float),
            POINTER(c_size_t),
            # output_type
            POINTER(c_int),
            # output
            # polylines
            POINTER(POINTER(c_size_t)),
            POINTER(c_size_t),
            POINTER(POINTER(c_size_t)),
            POINTER(c_size_t),
            POINTER(POINTER(c_float)),
            POINTER(c_size_t),
            # types
            POINTER(POINTER(c_size_t)),
            POINTER(c_size_t),
            POINTER(POINTER(c_int)),
            POINTER(c_size_t),
            # global_parameters
            POINTER(c_float), # joint volume
            POINTER(c_size_t), # joint volume
            POINTER(c_float) # dihedral angle to switch between in-plane and out-of-plane jointery default is 150 degrees
        ]
    
        # generate joints
        start_time = time.time()
        ############################################################################################################
        # Call the function
        # https://stackoverflow.com/questions/4145775/how-do-i-convert-a-python-list-into-a-c-array-by-using-ctypes
        # https://stackoverflow.com/questions/53265216/python-ctypes-type-conversion
        ############################################################################################################
        
        
        lib.ctypes_get_connection_zones_with_custom_joints(
            # input geometry
            # polylines
            in_polyline_pairs_f,
            byref(in_polyline_pairs_f_s),
            in_polyline_pairs_v,
            byref(in_polyline_pairs_v_s),
            # vectors
            in_vectors_f,
            byref(in_vectors_f_s),
            in_vectors_v,
            byref(in_vectors_v_s),
            # joints
            in_joints_f,
            byref(in_joints_f_s),
            in_joints_v,
            byref(in_joints_v_s),
            # three_valence
            in_three_valence_f,
            byref(in_three_valence_f_s),
            in_three_valence_v,
            byref(in_three_valence_v_s),
            # adjacency
            in_adjancency_v,
            byref(in_adjancency_v_s),
            
            #custom joints
            in_joint_polyline_pairs_f,
            byref(in_joint_polyline_pairs_f_s),  # if a value is passed by reference, it must be a pointer
            in_joint_polyline_pairs_v,
            byref(in_joint_polyline_pairs_v_s),  # if a value is passed by reference, it must be a pointer
            #custom joints types
            in_joint_types_v,
            byref(in_joint_types_v_s),
            
            # input parameters
            # joint_parameters
            in_joint_parameters_v,
            byref(in_joint_parameters_v_s),
            # search_type
            byref(in_search_type),
            # scale
            in_scale_v,
            byref(in_scale_v_s),
            # output_type
            byref(in_output_type),
            
            
            # output
            # polylines
            byref(out_plines_groups_f),
            byref(out_plines_groups_f_s),
            byref(out_plines_out_f),
            byref(out_plines_out_f_s),
            byref(out_plines_out_v),
            byref(out_plines_out_v_s),
            # types
            byref(out_types_f),
            byref(out_types_f_s),
            byref(out_types_v),
            byref(out_types_v_s),
            # global_parameters
            in_joint_volume_parameters_v,
            byref(in_joint_volume_parameters_v_s),
            byref(face_to_face_side_to_side_joints_dihedral_angle),
        )
        """
    
        print(out_plines_groups_f[0])
        out_polylines = []
        """
        out_polylines = coord_polylines_lists(
            out_plines_groups_f,
            out_plines_groups_f_s,
            out_plines_out_f,
            out_plines_out_f_s,
            out_plines_out_v,
            out_plines_out_v_s,
        )
        
        
        def temp_coord_numbers_lists(out_f, out_f_s, out_v, out_v_s):
        
            # create Python objects
            ids = [[] for _ in range(out_f_s.value)]
            
            
            
            for i in range(out_f_s.value):
                #print(i, out_f_s.value)
                ids[i] = [None] * out_f[i]
                if out_f[i] == 0:
                    break
            
            #print( ids)
            # fill array with points
            a = 0
            b = 0
            #for i in range(0, out_v_s.value):
            #    print( out_v[i])
            """
            ids[a][b] = out_v[i]
            if b == (out_f[a] - 1):
                a += 1
                b = 0
            else:
                b += 1
            """
        
            return ids
        
        _cuts = coord_numbers_lists(
            out_types_f, out_types_f_s, out_types_v, out_types_v_s
        )
        """
        print _cuts
        print  out_types_f, out_types_f_s, out_types_v, out_types_v_s
        print out_types_v[0]
        print out_types_f[0]
        """
        print(
            "\n______________________________________ %s ms ______________________________________"
            % round((time.time() - start_time) * 1000.0, 2)
        )
        
    
    

        
        
        # ==============================================================================
        # output
        # ==============================================================================
        _plines = []
        self.bbox = Rhino.Geometry.BoundingBox.Unset 
        # nest two times the result and add to the tree
        for i in range(0, len(out_polylines)):
            list = []
            for j in range(0, len(out_polylines[i])):
                    list.append(out_polylines[i][j])#(conversions.polyline_to_rhino(out_polylines[i][j]))
                    self.polylines.append(list[-1])
                    self.bbox.Union(list[-1].BoundingBox)
            _plines.append(list)
        
        _data = [[_plines,_data[1],_data[2],_data[3],_data[4],_data[5],_cuts]]
        #print(_cuts)
        
        ############################################################################################################
        # release the memory
        ############################################################################################################
    
        # release output of polylines
        lib.release_size_t(byref(out_plines_groups_f), True)
        lib.release_size_t(byref(out_plines_out_f), True)
        lib.release_float(byref(out_plines_out_v), True)
    
        # release output of types
        lib.release_size_t(byref(out_types_f), True)
        lib.release_int(byref(out_types_v), True)
        
        
        return _data
# ---------- end solver_4 ----------

beams_outlines = Curve([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])
partition = PartitionList(List=beams_outlines, Size=2)
number_slider = Slider(1, range=0..10)

input_set = Input_set(polylines=beams_outlines)  # -> data; inputs polylines: tree of Polyline, vectors: tree of Vector3d, joint_types: tree of Int32, three_valence: tree of Int32, adjacency: tree of Int32
#   port polylines: a data-tree of polyline pairs
#   port vectors: insertion direction
#   port joint_types: joint type per side, top, bottom, and sides
#   port three_valence: three valance joinery that starts 0 - Vidy, 1 - Annen, and 4 indices current, next, current-neighbor, next-neighbor
#   port adjacency: joint parameters
#   port data: user input_get component to ungroup all the data to the individual data-trees
# ---------- input_set: Python ----------
"""combine different data sets into one list for a faster data transder between grasshopper wires"""
from ghpythonlib.componentbase import executingcomponent as component
import Grasshopper, GhPython

__author__ = "petras"
__version__ = "2023.04.02"


import System
import Rhino
import rhinoscriptsyntax as rs
import ghpythonlib.treehelpers as th
from Rhino.Geometry import Polyline
from Rhino.Geometry import Vector3d
from Rhino.Geometry import Plane
import compas_wood
from compas_wood.binding import test
from compas_wood.datastructures import WoodData

# r: compas


class MyComponent(component):
    def get_plane(self, _polyline, _orientation_point):

        len = _polyline.Count - 1
        normal = Vector3d(0, 0, 0)

        for i in range((_polyline.Count - 1)):
            num = ((i - 1) + len) % len
            item1 = ((i + 1) + len) % len
            point3d = _polyline[num]
            point3d1 = _polyline[item1]
            item2 = _polyline[i]
            normal = normal + Vector3d.CrossProduct(Vector3d(item2 - point3d), Vector3d(point3d1 - item2))

        normal.Unitize()
        plane = Plane(_polyline.CenterPoint(), normal)
        if plane.DistanceTo(_orientation_point) < 0:
            plane.Flip()

        return plane

    def RunScript(self,
            _polylines: Grasshopper.DataTree[Rhino.Geometry.Polyline],
            _vectors: Grasshopper.DataTree[Rhino.Geometry.Vector3d],
            _joint_types: Grasshopper.DataTree[int],
            _three_valence: Grasshopper.DataTree[int],
            _adjacency: Grasshopper.DataTree[int]):

        plines = []
        planes = []
        if _polylines.DataCount > 0:
            for i in range(_polylines.BranchCount):
                plines.extend(list(_polylines.Branch(i)))
                planes.append(self.get_plane(_polylines.Branch(i)[0], _polylines.Branch(i)[1][0]))

        insertion_vectors = th.tree_to_list(_vectors) if _vectors.DataCount > 0 else []
        joints_per_face = th.tree_to_list(_joint_types) if _joint_types.DataCount > 0 else []
        three_valence = th.tree_to_list(_three_valence) if _three_valence.DataCount > 0 else []
        adjacency = th.tree_to_list(_adjacency) if _adjacency.DataCount > 0 else []

        # output
        _data = WoodData(plines, insertion_vectors, joints_per_face, three_valence, adjacency, planes)

        # return outputs if you have them; here I try it for you:
        return _data
# ---------- end input_set ----------

item = ListItem(List=partition, Index=0, Wrap=True)  # -> Item, Item1
cp = ControlPoints(Curve=item.Item)  # -> Points, Weights, Knots
cp_2 = ControlPoints(Curve=item.Item1)  # -> Points, Weights, Knots
item_2 = ListItem(List=cp.Points, Index=0, Wrap=True)  # -> Item, Item1, Item2, Item3
item_3 = ListItem(List=cp_2.Points, Index=0, Wrap=True)  # -> Item, Item1, Item2, Item3
avr = Average(Input=[item_2.Item2, item_3.Item3])
avr_2 = Average(Input=[item_2.Item, item_3.Item1])
number_slider_2 = Slider(8, range=0..12)
ln = Line(StartPoint=avr_2, EndPoint=avr)  # -> simplify(Line)
ext = ExtendCurve(Curve=ln, Type=0, Start=number_slider_2, End=number_slider_2)
line = Line(ext)
axes = Curve(line)

solver_5 = Solver(
    data=input_set,
    joint_p=joint_parameters,
    find=Slider(2, range=0..2),
    get=Slider(3, range=0..10),
    custom_joints=merge_2,
    custom_types=merge)  # -> data; inputs joint_p: list of Double, scale: list of Double, extension: list of Double, find: Int32, get: Int32, custom_joints: list of Polyline, custom_types: list of Int32
#   port data: collection of inputs that represent the elements, insertion vectors, joint types and adjacency, use input_set commonent to group these inputs
#   port joint_p: joint parameters
#   port scale: scale of joint, default is [1,1,1]
#   port extension: extension by distance, plates often has [0,0,10], whereas beams [10,10,10], default is [0,0,0]
#   port find: search_type search type 0 - side-to-side, 1 - cross, 2 - both
#   port get: output_type 0 - outlines | 1 - lines | 2 - areas | 3 - volumes | 4 - merged geometry of joints
#   port data: user input_get component to ungroup all the data to the individual data-trees
# ---------- solver_5: Python ----------
"""generate joints between elements"""
# r: compas_wood

from ghpythonlib.componentbase import executingcomponent as component
import Rhino
import System
from wood_nano import get_connection_zones as wood_nano_get_connection_zones
from wood_nano import cut_type2 as wood_nano_cut_type2
from wood_nano import point3 as wood_nano_point3
from wood_nano.conversions_python import to_int2
from wood_nano.conversions_python import to_int1
from wood_nano.conversions_python import to_double1
from wood_nano.conversions_python import from_cut_type2
from compas_wood.conversions_rhino import to_point2
from compas_wood.conversions_rhino import from_point2
from compas_wood.conversions_rhino import to_vector2
from compas_wood.conversions_rhino import from_point3
from compas_wood.binding import wood_globals
from compas_wood.datastructures import WoodData
from math import floor


class connections_zones(component):
    def __init__(self):
        self.bbox = Rhino.Geometry.BoundingBox.Unset
        self.lines = []
        self.insertion_vectors_current = []
        self.joint_per_face_current_text_entity = []
        self.polylines = []

    def DrawViewportWires(self, args):
        col = args.WireColour
        line_weight = args.DefaultCurveThickness
        print(self.polylines)
        for polylines_list in self.polylines:
            for polyline in polylines_list:
                args.Display.DrawPolyline(polyline, col, line_weight)

    def get_ClippingBox(self):
        return self.bbox

    def RunScript(self,
            _data,
            _joint_p: System.Collections.Generic.List[float],
            _scale: System.Collections.Generic.List[float],
            _extension: System.Collections.Generic.List[float],
            _find: int,
            _get: int,
            _custom_joints: System.Collections.Generic.List[Rhino.Geometry.Polyline],
            _custom_types: System.Collections.Generic.List[int]):

        # ==============================================================================
        # clear input
        # ==============================================================================
        self.bbox = Rhino.Geometry.BoundingBox.Unset
        self.lines = []
        self.insertion_vectors_current = []
        self.joint_per_face_current_text_entity = []
        self.polylines = []

        # ==============================================================================
        # input
        # ==============================================================================
        if _data is None:
            return

        input_polyline_pairs = _data.plines
        if input_polyline_pairs:
            if len(input_polyline_pairs) > 0:
                self.bbox = input_polyline_pairs[0].BoundingBox
                for pline in input_polyline_pairs:
                    self.bbox.Union(pline.BoundingBox)

        input_insertion_vectors = _data.insertion_vectors

        input_joint_types = _data.joints_per_face
        input_three_valence_element_indices_and_instruction = _data.three_valence

        input_search_type = max(min(2, _find), 0) if _find else 0

        input_scale = [1, 1, 1]
        if _scale:
            for i in range(0, len(_scale)):
                input_scale[i] = _scale[i]

        input_output_type = _get if _get != None else 4

        input_joint_volume_parameters = [0, 0, 0]

        if _extension:
            if len(_extension) > 2:
                input_joint_volume_parameters = []
                for i in _extension:
                    input_joint_volume_parameters.append(i * 10)

        input_adjacency = _data.adjacency

        joint_parameters = wood_globals.joints_parameters_and_types

        if _joint_p:
            for i in range(0, len(_joint_p), 3):
                insertion_id = floor(_joint_p[i + 2] / 10)
                joint_parameters[insertion_id * 3 + 0] = _joint_p[i + 0]
                joint_parameters[insertion_id * 3 + 1] = _joint_p[i + 1]
                joint_parameters[insertion_id * 3 + 2] = _joint_p[i + 2]

        w_output_plines = wood_nano_point3()
        w_output_types = wood_nano_cut_type2()


        if _custom_joints and _custom_types:
            if len(_custom_joints) == len(_custom_types):
                custom_joints_dict = {
                    9: [],
                    -9: [],
                    -19: [],
                    19: [],
                    29: [],
                    -29: [],
                    39: [],
                    -39: [],
                    49: [],
                    -49: [],
                    59: [],
                    -59: [],
                    69: [],
                    -69: []
                }
                for i in range(len(_custom_joints)):
                    custom_joints_dict[_custom_types[i]].append(_custom_joints[i])

                for key, value in custom_joints_dict.items():
                    
                    if key== 9:
                        # print(to_point2.__module__)
                        # print(to_point2(value))
                        wood_globals.custom_joints_ss_e_ip_male=value

                        # print(wood_globals.custom_joints_ss_e_ip_male)
                    elif key== -9:
                        wood_globals.custom_joints_ss_e_ip_female=value
                    elif key== 19:
                        wood_globals.custom_joints_ss_e_op_male=value
                    elif key== -19:
                        wood_globals.custom_joints_ss_e_op_female=value
                    elif key== 29:
                        wood_globals.custom_joints_ts_e_p_male=value
                    elif key== -29:
                        wood_globals.custom_joints_ts_e_p_female=value
                    elif key== 39:
                        wood_globals.custom_joints_cr_c_ip_male=value
                    elif key== -39:
                        wood_globals.custom_joints_cr_c_ip_female=value
                    elif key== 49:
                        wood_globals.custom_joints_tt_e_p_male=value
                    elif key== -49:
                        wood_globals.custom_joints_tt_e_p_female=value
                    elif key== 59:
                        wood_globals.custom_joints_ss_e_r_male=value
                    elif key== -59:
                        wood_globals.custom_joints_ss_e_r_female=value
                    elif key== 69:
                        wood_globals.custom_joints_b_male=value
                    elif key== -69:
                        wood_globals.custom_joints_b_female=value

        # print(type(wood_globals.custom_joints_ss_e_ip_male[0]))
        from wood_nano import GLOBALS
        print(GLOBALS.CUSTOM_JOINTS_SS_E_IP_MALE[0][0][2])
        wood_nano_get_connection_zones(
            to_point2(input_polyline_pairs),
            to_vector2(input_insertion_vectors),
            to_int2(input_joint_types),
            to_int2(input_three_valence_element_indices_and_instruction),
            to_int1(input_adjacency),
            to_double1(joint_parameters),
            int(input_search_type),
            to_double1(input_scale),
            int(input_output_type),
            w_output_plines,
            w_output_types,
            to_double1(input_joint_volume_parameters),
            [],
            []
            # to_point2(input_custom_joints),
            # to_int1(input_custom_joints_types),
        )

        self.polylines = from_point3(w_output_plines)
        print(w_output_plines)
        print(w_output_types)

        return WoodData(
            plines=_data.plines,
            insertion_vectors=_data.insertion_vectors,
            joints_per_face=_data.joints_per_face,
            three_valence=_data.three_valence,
            adjacency=_data.adjacency,
            planes=_data.planes,
            plines_with_joints=self.polylines,
            cut_types=from_cut_type2(w_output_types),
        )
# ---------- end solver_5 ----------
input_get = Input_get(data=solver_5)  # -> graft(plines_0), graft(plines_1), graft(lines), insertion_vectors, joints_per_face, three_valence, adjacency, cut_types; inputs split: Boolean
#   port data: collection of inputs that represent the elements, insertion vectors, joint types and adjacency, use input_set commonent to group these inputs
#   port split: split output into closed outlines and lines
#   port plines_0: polyline pairs
#   port plines_1: polyline pairs
#   port lines: polyline pairs
#   port insertion_vectors: insertion vectors per element top bottom and side faces
#   port joints_per_face: joinery types per element top bottom and side faces
#   port three_valence: three valence indices for special cases where one element is connected with two others
#   port adjacency: connectivity between elements and their faces
#   port cut_types: fabrication type
# ---------- input_get: Python ----------
"""unwrap element data to polylines, insertion vectors, joint types and etc"""
from ghpythonlib.componentbase import executingcomponent as component
import Grasshopper, GhPython
import System

__author__ = "petras"
__version__ = "2023.04.02"

import ghpythonlib.treehelpers as th
from Rhino.Geometry import Polyline
import Rhino
import rhinoscriptsyntax as rs


class MyComponent(component):
    def RunScript(self, _data, _split: bool):

        if _data is None:
            return

        split = True if _split is None else _split

        _plines_0 = Grasshopper.DataTree[Rhino.Geometry.Curve]()
        _plines_1 = Grasshopper.DataTree[Rhino.Geometry.Curve]()
        _lines = Grasshopper.DataTree[Rhino.Geometry.Curve]()
        if split == False:
            for i in range(len(_data.plines_with_joints)):
                for j in range(len(_data.plines_with_joints[i])):
                    _plines_0.Add(_data.plines_with_joints[i][j].ToNurbsCurve(), Grasshopper.Kernel.Data.GH_Path(i))
        else:
            for i in range(len(_data.plines_with_joints)):
                for j in range(len(_data.plines_with_joints[i])):
                    if _data.plines_with_joints[i][j].Count == 2:
                        _lines.Add(_data.plines_with_joints[i][j].ToNurbsCurve(), Grasshopper.Kernel.Data.GH_Path(i))
                    else:
                        if j % 2 == 0:
                            print(_data.plines_with_joints[i][j])
                            _plines_0.Add(
                                _data.plines_with_joints[i][j].ToNurbsCurve(), Grasshopper.Kernel.Data.GH_Path(i)
                            )
                        else:
                            _plines_1.Add(
                                _data.plines_with_joints[i][j].ToNurbsCurve(), Grasshopper.Kernel.Data.GH_Path(i)
                            )

        _insertion_vectors = th.list_to_tree(_data.insertion_vectors)
        _joints_per_face = th.list_to_tree(_data.joints_per_face)
        _three_valence = th.list_to_tree(_data.three_valence)
        _adjacency = th.list_to_tree(_data.adjacency)
        _cut_types = th.list_to_tree(_data.cut_types)

        # return outputs if you have them; here I try it for you:
        return (
            _plines_0,
            _plines_1,
            _lines,
            _insertion_vectors,
            _joints_per_face,
            _three_valence,
            _adjacency,
            _cut_types,
        )
# ---------- end input_get ----------
panel_4 = Panel(input_get.plines_0)
loft_b = Loft_brep(p0=input_get.plines_0, p1=input_get.plines_1)  # -> brep; inputs p0: list of Curve, p1: list of Curve, c: Color
#   port p0: polylines with holes, bottom
#   port p1: polylines with holes, top
#   port c: color, if given all the brep is colorized else only the sides, this is useful for boolean difference
#   port brep: lofted and capped brep with holes
# ---------- loft_b: Python ----------
from ghpythonlib.componentbase import executingcomponent as component
import Rhino
from System.Drawing import Color
import System


class connections_zones(component):
    def project_curves_to_plane(self, curves):
        points = []
        for curve in curves:
            for point in curve.ToNurbsCurve().Points:
                points.append(point.Location)

        result, plane = Rhino.Geometry.Plane.FitPlaneToPoints(points)

        xform = Rhino.Geometry.Transform.PlanarProjection(plane)
        curves_projected = []
        for curve in curves:
            curve_projected = curve.DuplicateCurve()
            curve_projected.Transform(xform)
            curves_projected.append(curve_projected)
        return curves_projected

    def loft_polylines_with_holes(self, curves0, curves1, color):
        """Loft polylines with holes

        Parameters
        ----------
        curves0 : list[rg.Polyline]
        curves1 : list[rg.Polyline]

        Returns
        -------
        rg.Brep
            brep as lofted polylines and cap them
        """

        ###############################################################################
        # user input
        ###############################################################################

        if curves0 == [None]:
            return
        if curves1 == [None]:
            return

        if len(curves0) == 0:
            return
        if len(curves1) == 0:
            return

        flag = len(curves0) is not 0 if True else len(curves1) != 0
        if flag:
            curves = []
            curves2 = []

            flag0 = len(curves1) == 0
            flag1 = len(curves0) == 0 and len(curves1) != 0
            flag2 = len(curves0) and len(curves1)

            if flag0:
                for i in range(len(curves0)):
                    if float(i) >= float(len(curves0)) * 0.5:
                        curves2.Add(curves0[i])
                    else:
                        curves.Add(curves0[i])
            elif flag1:
                for i in range(0, len(curves1), 2):
                    curves.Add(curves1[i])
                    curves2.Add(curves1[i + 1])
            elif flag2:
                curves = curves0
                curves2 = curves1

            curves0 = curves
            curves1 = curves2

        ###############################################################################
        # Create mesh of the bottom face
        ###############################################################################

        curves0 = self.project_curves_to_plane(curves0)
        brep_0 = Rhino.Geometry.Brep.CreatePlanarBreps(curves0, Rhino.RhinoDoc.ActiveDoc.ModelAbsoluteTolerance)[0]


        curves1 = self.project_curves_to_plane(curves1)
        brep_1 = Rhino.Geometry.Brep.CreatePlanarBreps(curves1, Rhino.RhinoDoc.ActiveDoc.ModelAbsoluteTolerance)[0]


        ###############################################################################
        # Create lofts
        ###############################################################################
        breps_to_join = [brep_0, brep_1]
        for i in range(len(curves0)):
            wall = Rhino.Geometry.Brep.CreateFromLoft(
                [curves0[i], curves1[i]],
                Rhino.Geometry.Point3d.Unset,
                Rhino.Geometry.Point3d.Unset,
                Rhino.Geometry.LoftType.Normal,
                False,
            )[0]
            breps_to_join.append(wall)

        ###############################################################################
        # Join Brep
        ###############################################################################

        solid = Rhino.Geometry.Brep.JoinBreps(breps_to_join, Rhino.RhinoDoc.ActiveDoc.ModelAbsoluteTolerance)[0]

        faces = []
        for i in range(solid.Faces.Count):
            faces.append(solid.Faces[i].DuplicateFace(False))

        solid = Rhino.Geometry.Brep.JoinBreps(faces, Rhino.RhinoDoc.ActiveDoc.ModelAbsoluteTolerance)[0]

        if solid:
            solid.Faces.SplitKinkyFaces(Rhino.RhinoMath.DefaultAngleTolerance, True)

            if Rhino.Geometry.BrepSolidOrientation.Inward is solid.SolidOrientation:
                solid.Flip()

        if color is not None:
            for i in range(solid.Faces.Count):
                solid.Faces[i].PerFaceColor = color
        else:
            for i in range(solid.Faces.Count):
                if i < 2:
                    solid.Faces[i].PerFaceColor = Color.LightGray  # Color.LightGray
                else:
                    solid.Faces[i].PerFaceColor = Color.DeepPink

        return solid

    def RunScript(self,
            _p0: System.Collections.Generic.List[Rhino.Geometry.Curve],
            _p1: System.Collections.Generic.List[Rhino.Geometry.Curve],
            _c: System.Drawing.Color):
        if _p0 and _p1:
            return self.loft_polylines_with_holes(_p0, _p1, _c)
# ---------- end loft_b ----------

pipe = Pipe(Curve=axes, Radius=5, Caps=1)  # -> simplify(Pipe)
trim = TrimTree(Tree=loft_b, Depth=1)
branch = TreeBranch(Tree=pipe, Path=number_slider, MaintainPaths=True)
branch_2 = TreeBranch(Tree=trim, Path=number_slider, MaintainPaths=True)
sunion = SolidUnion(Breps=branch_2)
sdiff = SolidDifference(BrepsA=branch, BrepsB=sunion)
