# Grasshopper definition 7_assign_directions_and_joint_types.gh (Grasshopper 1.0.8)
# plug-ins: RhinoCodePluginGH

# ----
# DATA -> ASSIGN DIRECTIONS
# AND JOINT TYPES
# PER SIDES
crv = Curve([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])
crv_2 = Curve([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])
pt = Point(Point(66.54180289, -67.76869473, 25.90170739))
pt_2 = Point([Point(-12.48673366, -66.5369766, 91.98009472), Point(-15.95577545, -146.9068279, 47.36189679)])
type_a = Panel("0")
type_b = Panel("10")
type_c = Panel("20")
pt_3 = Point([Point(-23.20359916, -142.9068279, 90.14100906), Point(-78.55497782, -142.9068279, 57.21722225), Point(35.9403107, -116.8646479, 57.0608065), Point(-3.437238191, -100.4885806, 19.63133686), Point(-3.429887815, -35.47802532, 131.1152912), Point(-30.86663423, -18.51036677, 84.15627084), Point(-11.87968433, -49.29797263, 51.01550833), Point(12.69802542, -72.50533185, 102.0418385), Point(-2.720821949, -75.58486061, 111.711162), Point(-33.80333849, -52.18888495, 65.85015224)])
entwine = Entwine(Branch00=pt, Branch01=pt_2, Branch02=pt_3, FlattenInputs=True)
entwine_2 = Entwine(Branch00=type_a, Branch01=type_b, Branch02=type_c, FlattenInputs=True)
closest_indexed_points = ClosestIndexedPoints(polylines=crv, points=entwine, joint_types=entwine_2)  # -> polylines_out, joint_types_out; inputs polylines: tree of Curve, points: tree of Point3d, joint_types: tree of Int32
#   port polylines: polylines tree branch order does not matter it is flatenned inside the component
#   port points: a tree of points, the path id of the branch must match with _joint_types id, it is kind of a dictionary
#   port joint_types: a tree of integers, the path id of the branch must match with _points id, it is kind of a dictionary
#   port polylines_out: pairs of polylines, grouped two polylines per branch
#   port joint_types_out: a tree of int where each element contains top, bottom and side joint type assignments
# ---------- closest_indexed_points: Python ----------
from ghpythonlib.componentbase import executingcomponent as component
import Grasshopper, GhPython
import System
import Rhino
import rhinoscriptsyntax as rs

"""Provides a scripting component.
    Inputs:
        x: The x script variable
        y: The y script variable
    Output:
        a: The a output variable"""

__author__ = "petra"
__version__ = "2023.04.04"

import Rhino.Geometry
from Rhino.Geometry import RTree
from Rhino.Geometry import BoundingBox
from Rhino.Geometry import Sphere
from Rhino.Geometry import Vector3d
from Rhino.Geometry import Point3d
from Rhino.Geometry import Polyline
from Rhino.Geometry import Line
import Grasshopper
import ghpythonlib.treehelpers as th


class MyComponent(component):
    def RunScript(self,
            _polylines: Grasshopper.DataTree[Rhino.Geometry.Curve],
            _points: Grasshopper.DataTree[Rhino.Geometry.Point3d],
            _joint_types: Grasshopper.DataTree[int]):
        ###############################################################################
        # Input
        ###############################################################################
        polylines = []
        polylines_out = Grasshopper.DataTree[Polyline]()
        pts = []
        ids = []

        ###############################################################################
        # Conversion
        ###############################################################################
        count = 0
        for curve in _polylines.AllData():
            result, polyline = curve.TryGetPolyline()
            polylines_out.Add(
                polyline, Grasshopper.Kernel.Data.GH_Path(int(count * 0.5))
            )
            if count % 2 == 0:
                polylines.append([polyline])
            else:
                polylines[-1].append(polyline)
            count = count + 1

        if _points.DataCount > 0 and _joint_types.DataCount > 0:
            for i in range(_points.BranchCount):
                for j in range(_points.Branch(i).Count):
                    pts.append(_points.Branch(i)[j])
                    ids.append(_joint_types.Branch(i)[j % _joint_types.Branch(i).Count])
        # pts = _points.AllData()
        # ids = _joint_types.AllData()

        ###############################################################################
        # Run the closest point search
        ###############################################################################

        # convert element polylines to a flattened dictionary:
        segments_dictionary = {}
        # stores ids e.g. int , [element_int,bottom_or_top_polyline_int,edge,int, bounding_box, hit_count, point_id]
        joint_types = []
        count = 0
        for i in range(len(polylines)):
            joint_types.append([-1] * (polylines[i][0].SegmentCount + 2))
            for j in range(len(polylines[i])):
                for k in range(polylines[i][j].SegmentCount):
                    bbox = polylines[i][j].SegmentAt(k).BoundingBox
                    bbox.Inflate(0.02)
                    segments_dictionary[count] = [i, j, k, bbox, polylines[i][j].SegmentAt(k)]
                    count = count + 1

        # create a tree
        rtree = Rhino.Geometry.RTree()

        # fill the tree
        for i in segments_dictionary:
            rtree.Insert(segments_dictionary[i][3], i)

        # call_backs of rtree
        hit_count = 0

        def search_callback(sender, rtree_event_args):
            data_by_reference.append(rtree_event_args.Id)

        # perform search
        for i in range(len(pts)):
            data_by_reference = []
            if rtree.Search(Sphere(pts[i], 0), search_callback, data_by_reference):
                for j in data_by_reference:
                    if (
                        pts[i].DistanceToSquared(
                            segments_dictionary[j][4].ClosestPoint(pts[i], True)
                        )
                        < 0.001
                    ):
                        joint_types[segments_dictionary[j][0]][
                            segments_dictionary[j][2] + 2
                        ] = ids[i]

        ###############################################################################
        # Output
        ###############################################################################
        _polylines_out = polylines_out
        _joints_types_out = th.list_to_tree(joint_types)

        # return outputs if you have them; here I try it for you:
        return (_polylines_out, _joints_types_out)
# ---------- end closest_indexed_points ----------
closest_lines = ClosestLines(polylines=crv, lines=crv_2)  # -> polylines_out, vectors; inputs polylines: tree of Curve, lines: tree of Line
#   port polylines: polylines tree branch order does not matter it is flatenned inside the component
#   port lines: a tree of lines, the path id of the branch must match with _joint_types id, it is kind of a dictionary
#   port polylines_out: pairs of polylines, grouped two polylines per branch
#   port vectors: a tree of vectors where each element contains top, bottom and side vector assignments
# ---------- closest_lines: Python ----------
from ghpythonlib.componentbase import executingcomponent as component
import Grasshopper, GhPython
import System
import Rhino
import rhinoscriptsyntax as rs

__author__ = "petra"
__version__ = "2023.04.04"
import System
import Rhino.Geometry
from Rhino.Geometry import RTree
from Rhino.Geometry import BoundingBox
from Rhino.Geometry import Sphere
from Rhino.Geometry import Vector3d
from Rhino.Geometry import Point3d
from Rhino.Geometry import Polyline
from Rhino.Geometry import Line
import Grasshopper
import ghpythonlib.treehelpers as th


class MyComponent(component):
    def RunScript(self,
            _polylines: Grasshopper.DataTree[Rhino.Geometry.Curve],
            _lines: Grasshopper.DataTree[Rhino.Geometry.Line]):
        """Provides a scripting component.
        Inputs:
            x: The x script variable
            y: The y script variable
        Output:
            a: The a output variable"""

        ###############################################################################
        # Input
        ###############################################################################
        polylines = []
        polylines_out = Grasshopper.DataTree[Polyline]()
        lines = []

        ###############################################################################
        # Conversion
        ###############################################################################
        count = 0
        for curve in _polylines.AllData():
            result, polyline = curve.TryGetPolyline()
            polylines_out.Add(
                polyline, Grasshopper.Kernel.Data.GH_Path(int(count * 0.5))
            )
            if count % 2 == 0:
                polylines.append([polyline])
            else:
                polylines[-1].append(polyline)
            count = count + 1

        lines = _lines.AllData()

        ###############################################################################
        # Run the closest point search
        ###############################################################################

        # convert element polylines to a flattened dictionary:
        segments_dictionary = {}
        # stores ids e.g. int , [element_int,bottom_or_top_polyline_int,edge,int, bounding_box, hit_count, point_id]
        vectors = []
        count = 0
        for i in range(len(polylines)):
            vectors.append([Vector3d.Zero] * (polylines[i][0].SegmentCount + 2))
            for j in range(len(polylines[i])):
                for k in range(polylines[i][j].SegmentCount):
                    bbox = polylines[i][j].SegmentAt(k).BoundingBox
                    bbox.Inflate(0.02)
                    segments_dictionary[count]= [i, j, k, bbox, polylines[i][j].SegmentAt(k)]
                    
                    count = count + 1

        # create a tree
        rtree = Rhino.Geometry.RTree()

        # fill the tree
        for i in segments_dictionary:
            rtree.Insert(segments_dictionary[i][3], i)

        # call_backs of rtree
        hit_count = 0

        def search_callback(sender, rtree_event_args):
            data_by_reference.append(rtree_event_args.Id)

        # perform search, two times first for start points of a polyline, second for the end point
        for i in range(len(lines)):
            data_by_reference = []
            if rtree.Search(
                Sphere(lines[i].From, 0), search_callback, data_by_reference
            ):
                for j in data_by_reference:
                    if (
                        lines[i].From.DistanceToSquared(
                            segments_dictionary[j][4].ClosestPoint(lines[i].From, True)
                        )
                        < 0.001
                    ):
                        vectors[segments_dictionary[j][0]][
                            segments_dictionary[j][2] + 2
                        ] = lines[i].Direction
                        # vectors[segments_dictionary[j][0]][segments_dictionary[j][2]+2].Unitize()

        for i in range(len(lines)):
            data_by_reference = []
            if rtree.Search(Sphere(lines[i].To, 0), search_callback, data_by_reference):
                for j in data_by_reference:
                    if (
                        lines[i].To.DistanceToSquared(
                            segments_dictionary[j][4].ClosestPoint(lines[i].To, True)
                        )
                        < 0.001
                    ):
                        vectors[segments_dictionary[j][0]][
                            segments_dictionary[j][2] + 2
                        ] = -lines[i].Direction
                        # vectors[segments_dictionary[j][0]][segments_dictionary[j][2]+2].Unitize()

        ###############################################################################
        # Output
        ###############################################################################
        _polylines_out = polylines_out
        _vectors = th.list_to_tree(vectors)

        # return outputs if you have them; here I try it for you:
        return (_polylines_out, _vectors)
# ---------- end closest_lines ----------

panel = Panel(closest_lines.polylines_out)
input_set = Input_set(polylines=closest_lines.polylines_out, vectors=closest_lines.vectors, joint_types=closest_indexed_points.joint_types_out)  # -> data; inputs polylines: tree of Polyline, vectors: tree of Vector3d, joint_types: tree of Int32, three_valence: tree of Int32, adjacency: tree of Int32
#   port polylines: a data-tree of polyline pairs
#   port vectors: insertion direction
#   port joint_types: joint type per side, top, bottom, and sides
#   port three_valence: three valance joinery that starts 0 - Vidy, 1 - Annen, and 4 indices current, next, current-neighbor, next-neighbor
#   port adjacency: joint parameters
#   port data: user input_get component to ungroup all the data to the individual data-trees
# ---------- input_set: Python ----------
"""combine different data sets into one list for a faster data transder between grasshopper wires"""
from ghpythonlib.componentbase import executingcomponent as component
import Grasshopper, GhPython

__author__ = "petras"
__version__ = "2023.04.02"


import System
import Rhino
import rhinoscriptsyntax as rs
import ghpythonlib.treehelpers as th
from Rhino.Geometry import Polyline
from Rhino.Geometry import Vector3d
from Rhino.Geometry import Plane
import compas_wood
from compas_wood.binding import test
from compas_wood.datastructures import WoodData

# r: compas


class MyComponent(component):
    def get_plane(self, _polyline, _orientation_point):

        len = _polyline.Count - 1
        normal = Vector3d(0, 0, 0)

        for i in range((_polyline.Count - 1)):
            num = ((i - 1) + len) % len
            item1 = ((i + 1) + len) % len
            point3d = _polyline[num]
            point3d1 = _polyline[item1]
            item2 = _polyline[i]
            normal = normal + Vector3d.CrossProduct(Vector3d(item2 - point3d), Vector3d(point3d1 - item2))

        normal.Unitize()
        plane = Plane(_polyline.CenterPoint(), normal)
        if plane.DistanceTo(_orientation_point) < 0:
            plane.Flip()

        return plane

    def RunScript(self,
            _polylines: Grasshopper.DataTree[Rhino.Geometry.Polyline],
            _vectors: Grasshopper.DataTree[Rhino.Geometry.Vector3d],
            _joint_types: Grasshopper.DataTree[int],
            _three_valence: Grasshopper.DataTree[int],
            _adjacency: Grasshopper.DataTree[int]):

        plines = []
        planes = []
        if _polylines.DataCount > 0:
            for i in range(_polylines.BranchCount):
                plines.extend(list(_polylines.Branch(i)))
                planes.append(self.get_plane(_polylines.Branch(i)[0], _polylines.Branch(i)[1][0]))

        insertion_vectors = th.tree_to_list(_vectors) if _vectors.DataCount > 0 else []
        joints_per_face = th.tree_to_list(_joint_types) if _joint_types.DataCount > 0 else []
        three_valence = th.tree_to_list(_three_valence) if _three_valence.DataCount > 0 else []
        adjacency = th.tree_to_list(_adjacency) if _adjacency.DataCount > 0 else []

        # output
        _data = WoodData(plines, insertion_vectors, joints_per_face, three_valence, adjacency, planes)

        # return outputs if you have them; here I try it for you:
        return _data
# ---------- end input_set ----------
joint_parameters = Joint_parameters()  # -> p; inputs ss_e_ip: list of Double, ss_e_op: list of Double, ts_e_p: list of Double, cr_c_ip: list of Double, tt_e_p: list of Double, ss_e_r: list of Double, b: list of Double
#   port ss_e_ip: side-to-side in-plane joint parameters
#   port ss_e_op: side-to-side out-of-plane joint parameters
#   port ts_e_p: top-to-side joint parameters
#   port cr_c_ip: cross joint parameters
#   port tt_e_p: top-to-top joint parameters
#   port ss_e_r: side-to-side rotated joint parameters
#   port b: boundary joint parameters
#   port p: a list of joint parameters
# ---------- joint_parameters: Python ----------
"""
Do something silly in python3.

This component does nothing useful, it's only a kitchen sink (but in python3) example showing most available options.

    Args:
        x: X value
        y: Y value
        z: Z value
    Returns:
        result: The sum of all three values.
"""
from ghpythonlib.componentbase import executingcomponent as component

import System
import math

class joint_parameters_component(component):
    def RunScript(self,
            _ss_e_ip: System.Collections.Generic.IList[float],
            _ss_e_op: System.Collections.Generic.IList[float],
            _ts_e_p: System.Collections.Generic.IList[float],
            _cr_c_ip: System.Collections.Generic.IList[float],
            _tt_e_p: System.Collections.Generic.IList[float],
            _ss_e_r: System.Collections.Generic.IList[float],
            _b: System.Collections.Generic.IList[float]):
        
        joint_parameters = [
            300, 0.5, 3,   # 1-9 ss_e_ip (side-to-side edge in-plane)
            50, 0.64, 15,  # 10-19 ss_e_op (side-to-side edge out-of-plane)
            450, 0.5, 20,  # 20-29 ts_e_p (top-to-side edge plane)
            300, 0.5, 30,  # 30-39 cr_c_ip (cross cutting in-plane)
            6, 0.95, 40,   # 40-49 tt_e_p  (top-to-top edge plane)
            300, 0.5, 58,  # 50-59 ss_e_r (side-to-side edge rotated)
            300, 1.0, 60   # 60-69 b (boundary)
        ]
        
        if _ss_e_ip:
            for i in range(len(_ss_e_ip)):
                joint_parameters[0*3+i] = _ss_e_ip[i]

        if _ss_e_op:
            for i in range(len(_ss_e_op)):
                joint_parameters[1*3+i] = _ss_e_op[i]

        if _ts_e_p:
            for i in range(len(_ts_e_p)):
                joint_parameters[2*3+i] = _ts_e_p[i]

        if _cr_c_ip:
            for i in range(len(_cr_c_ip)):
                joint_parameters[3*3+i] = _cr_c_ip[i]
        
        if _tt_e_p:        
            for i in range(len(_tt_e_p)):
                joint_parameters[4*3+i] = _tt_e_p[i]

        if _ss_e_r:
            for i in range(len(_ss_e_r)):
                joint_parameters[5*3+i] = _ss_e_r[i]

        if _b:
            for i in range(len(_b)):
                joint_parameters[6*3+i] = _b[i]

        _joint_p = joint_parameters

        return _joint_p
# ---------- end joint_parameters ----------
solver = Solver(data=input_set, joint_p=joint_parameters)  # -> data; inputs joint_p: list of Double, scale: list of Double, extension: list of Double, find: Int32, get: Int32
#   port data: collection of inputs that represent the elements, insertion vectors, joint types and adjacency, use input_set commonent to group these inputs
#   port joint_p: joint parameters
#   port scale: scale of joint, default is [1,1,1]
#   port extension: extension by distance, plates often has [0,0,10], whereas beams [10,10,10], default is [0,0,0]
#   port find: search_type search type 0 - side-to-side, 1 - cross, 2 - both
#   port get: output_type 0 - outlines | 1 - lines | 2 - areas | 3 - volumes | 4 - merged geometry of joints
#   port data: user input_get component to ungroup all the data to the individual data-trees
# ---------- solver: Python ----------
"""generate joints between elements"""
# r: compas_wood, compas, wood_nano
from ghpythonlib.componentbase import executingcomponent as component
import Rhino
import System
from wood_nano import get_connection_zones as wood_nano_get_connection_zones
from wood_nano import cut_type2 as wood_nano_cut_type2
from wood_nano import point3 as wood_nano_point3
from wood_nano.conversions_python import to_int2
from wood_nano.conversions_python import to_int1
from wood_nano.conversions_python import to_double1
from wood_nano.conversions_python import from_cut_type2
from compas_wood.conversions_rhino import to_point2
from compas_wood.conversions_rhino import to_vector2
from compas_wood.conversions_rhino import from_point3
from compas_wood.binding import wood_globals
from compas_wood.datastructures import WoodData
from math import floor


class connections_zones(component):
    def __init__(self):
        self.bbox = Rhino.Geometry.BoundingBox.Unset
        self.lines = []
        self.insertion_vectors_current = []
        self.joint_per_face_current_text_entity = []
        self.polylines = []

    def DrawViewportWires(self, args):
        col = args.WireColour
        line_weight = args.DefaultCurveThickness
        for polylines_list in self.polylines:
            for polyline in polylines_list:
                args.Display.DrawPolyline(polyline, col, line_weight)

    def get_ClippingBox(self):
        return self.bbox

    def RunScript(self,
            _data,
            _joint_p: System.Collections.Generic.IList[float],
            _scale: System.Collections.Generic.IList[float],
            _extension: System.Collections.Generic.IList[float],
            _find: int,
            _get: int):

        # ==============================================================================
        # clear input
        # ==============================================================================
        self.bbox = Rhino.Geometry.BoundingBox.Unset
        self.lines = []
        self.insertion_vectors_current = []
        self.joint_per_face_current_text_entity = []
        self.polylines = []

        # ==============================================================================
        # input
        # ==============================================================================
        if _data is None:
            return

        input_polyline_pairs = _data.plines
        if input_polyline_pairs:
            if len(input_polyline_pairs) > 0:
                self.bbox = input_polyline_pairs[0].BoundingBox
                for pline in input_polyline_pairs:
                    self.bbox.Union(pline.BoundingBox)

        input_insertion_vectors = _data.insertion_vectors
        input_joint_types = _data.joints_per_face
        input_three_valence_element_indices_and_instruction = _data.three_valence

        input_search_type = max(min(2, _find), 0) if _find else 0

        input_scale = [1, 1, 1]
        if _scale:
            for i in range(0, len(_scale)):
                input_scale[i] = _scale[i]

        input_output_type = _get if _get is not None else 4

        input_joint_volume_parameters = [0, 0, 0]

        if _extension:
            if len(_extension) > 2:
                input_joint_volume_parameters = []
                for i in _extension:
                    input_joint_volume_parameters.append(i * 10)

        input_adjacency = _data.adjacency
        joint_parameters = wood_globals.joints_parameters_and_types
        wood_globals.face_to_face_side_to_side_joints_rotated_joint_as_average = False
        wood_globals.face_to_face_side_to_side_joints_all_treated_as_rotated =  False


        if _joint_p:
            for i in range(0, len(_joint_p), 3):
                insertion_id = floor(_joint_p[i + 2] / 10)
                joint_parameters[insertion_id * 3 + 0] = _joint_p[i + 0]
                joint_parameters[insertion_id * 3 + 1] = _joint_p[i + 1]
                joint_parameters[insertion_id * 3 + 2] = _joint_p[i + 2]

        w_output_plines = wood_nano_point3()
        w_output_types = wood_nano_cut_type2()

        wood_nano_get_connection_zones(
            to_point2(input_polyline_pairs),
            to_vector2(input_insertion_vectors),
            to_int2(input_joint_types),
            to_int2(input_three_valence_element_indices_and_instruction),
            to_int1(input_adjacency),
            to_double1(joint_parameters),
            int(input_search_type),
            to_double1(input_scale),
            int(input_output_type),
            w_output_plines,
            w_output_types,
            to_double1(input_joint_volume_parameters),
        )

        self.polylines = from_point3(w_output_plines)
        return WoodData(
            plines=_data.plines,
            insertion_vectors=_data.insertion_vectors,
            joints_per_face=_data.joints_per_face,
            three_valence=_data.three_valence,
            adjacency=_data.adjacency,
            planes=_data.planes,
            plines_with_joints=self.polylines,
            cut_types=from_cut_type2(w_output_types),
        )
# ---------- end solver ----------
input_get = Input_get(data=solver)  # -> plines_0, plines_1, lines, insertion_vectors, joints_per_face, three_valence, adjacency, cut_types; inputs split: Boolean
#   port data: collection of inputs that represent the elements, insertion vectors, joint types and adjacency, use input_set commonent to group these inputs
#   port split: split output into closed outlines and lines
#   port plines_0: polyline pairs
#   port plines_1: polyline pairs
#   port lines: polyline pairs
#   port insertion_vectors: insertion vectors per element top bottom and side faces
#   port joints_per_face: joinery types per element top bottom and side faces
#   port three_valence: three valence indices for special cases where one element is connected with two others
#   port adjacency: connectivity between elements and their faces
#   port cut_types: fabrication type
# ---------- input_get: Python ----------
"""unwrap element data to polylines, insertion vectors, joint types and etc"""
from ghpythonlib.componentbase import executingcomponent as component
import Grasshopper, GhPython
import System

__author__ = "petras"
__version__ = "2023.04.02"

import ghpythonlib.treehelpers as th
from Rhino.Geometry import Polyline
import Rhino
import rhinoscriptsyntax as rs


class MyComponent(component):
    def RunScript(self, _data, _split: bool):

        if _data is None:
            return

        split = True if _split is None else _split

        _plines_0 = Grasshopper.DataTree[Rhino.Geometry.Curve]()
        _plines_1 = Grasshopper.DataTree[Rhino.Geometry.Curve]()
        _lines = Grasshopper.DataTree[Rhino.Geometry.Curve]()
        if split == False:
            for i in range(len(_data.plines_with_joints)):
                for j in range(len(_data.plines_with_joints[i])):
                    _plines_0.Add(_data.plines_with_joints[i][j].ToNurbsCurve(), Grasshopper.Kernel.Data.GH_Path(i))
        else:
            for i in range(len(_data.plines_with_joints)):
                for j in range(len(_data.plines_with_joints[i])):
                    if _data.plines_with_joints[i][j].Count == 2:
                        _lines.Add(_data.plines_with_joints[i][j].ToNurbsCurve(), Grasshopper.Kernel.Data.GH_Path(i))
                    else:
                        if j % 2 == 0:
                            print(_data.plines_with_joints[i][j])
                            _plines_0.Add(
                                _data.plines_with_joints[i][j].ToNurbsCurve(), Grasshopper.Kernel.Data.GH_Path(i)
                            )
                        else:
                            _plines_1.Add(
                                _data.plines_with_joints[i][j].ToNurbsCurve(), Grasshopper.Kernel.Data.GH_Path(i)
                            )

        _insertion_vectors = th.list_to_tree(_data.insertion_vectors)
        _joints_per_face = th.list_to_tree(_data.joints_per_face)
        _three_valence = th.list_to_tree(_data.three_valence)
        _adjacency = th.list_to_tree(_data.adjacency)
        _cut_types = th.list_to_tree(_data.cut_types)

        # return outputs if you have them; here I try it for you:
        return (
            _plines_0,
            _plines_1,
            _lines,
            _insertion_vectors,
            _joints_per_face,
            _three_valence,
            _adjacency,
            _cut_types,
        )
# ---------- end input_get ----------
loft_b = Loft_brep(p0=input_get.plines_0, p1=input_get.plines_1)  # -> brep, npc; inputs p0: list of Curve, p1: list of Curve, c: Color
#   port p0: polylines with holes, bottom
#   port p1: polylines with holes, top
#   port c: color, if given all the brep is colorized else only the sides, this is useful for boolean difference
#   port brep: lofted and capped brep with holes
#   port npc: non planar curves, if not empty something is wrong with joinery algorithm
# ---------- loft_b: Python ----------
"""get joints ids and connections areas between elements"""

__author__ = "petras vestartas"
__version__ = "2023.03.31"


from ghpythonlib.componentbase import executingcomponent as component
import Rhino
from System.Drawing import Color
import System


class connections_zones(component):
    def project_curves_to_plane(self, curves):
        points = []
        for curve in curves:
            for point in curve.Points:
                points.append(point.Location)

        result, plane = Rhino.Geometry.Plane.FitPlaneToPoints(points)

        xform = Rhino.Geometry.Transform.PlanarProjection(plane)
        curves_projected = []
        for curve in curves:
            curve_projected = curve.DuplicateCurve()
            curve_projected.Transform(xform)
            curves_projected.append(curve_projected)
        return curves_projected

    def loft_polylines_with_holes(self, curves0, curves1, color):
        """Loft polylines with holes

        Parameters
        ----------
        curves0 : list[rg.Polyline]
        curves1 : list[rg.Polyline]

        Returns
        -------
        rg.Brep
            brep as lofted polylines and cap them
        """

        ###############################################################################
        # user input
        ###############################################################################

        if curves0 == [None]:
            return
        if curves1 == [None]:
            return

        if len(curves0) == 0:
            return
        if len(curves1) == 0:
            return

        flag = len(curves0) is not 0 if True else len(curves1) != 0
        if flag:
            curves = []
            curves2 = []

            flag0 = len(curves1) == 0
            flag1 = len(curves0) == 0 and len(curves1) != 0
            flag2 = len(curves0) and len(curves1)

            if flag0:
                for i in range(len(curves0)):
                    if float(i) >= float(len(curves0)) * 0.5:
                        curves2.Add(curves0[i])
                    else:
                        curves.Add(curves0[i])
            elif flag1:
                for i in range(0, len(curves1), 2):
                    curves.Add(curves1[i])
                    curves2.Add(curves1[i + 1])
            elif flag2:
                curves = curves0
                curves2 = curves1

            curves0 = curves
            curves1 = curves2

        ###############################################################################
        # Create mesh of the bottom face
        ###############################################################################
        non_planar_curves = []

        brep_0 = Rhino.Geometry.Brep.CreatePlanarBreps(curves0, Rhino.RhinoDoc.ActiveDoc.ModelAbsoluteTolerance)

        if brep_0 is None:
            for c in curves0:
                non_planar_curves.append(c.DuplicateCurve())
            curves0 = self.project_curves_to_plane(curves0)
            brep_0 = Rhino.Geometry.Brep.CreatePlanarBreps(curves0, Rhino.RhinoDoc.ActiveDoc.ModelAbsoluteTolerance)[0]
        else:
            brep_0 = brep_0[0]

        brep_1 = Rhino.Geometry.Brep.CreatePlanarBreps(curves1)

        if brep_1 is None:
            for c in curves1:
                non_planar_curves.append(c.DuplicateCurve())
            curves1 = self.project_curves_to_plane(curves1)
            brep_1 = Rhino.Geometry.Brep.CreatePlanarBreps(curves1, Rhino.RhinoDoc.ActiveDoc.ModelAbsoluteTolerance)[0]
        else:
            brep_1 = brep_1[0]

        ###############################################################################
        # Create lofts
        ###############################################################################
        breps_to_join = [brep_0, brep_1]
        for i in range(len(curves0)):
            wall = Rhino.Geometry.Brep.CreateFromLoft(
                [curves0[i], curves1[i]],
                Rhino.Geometry.Point3d.Unset,
                Rhino.Geometry.Point3d.Unset,
                Rhino.Geometry.LoftType.Normal,
                False,
            )[0]
            breps_to_join.append(wall)

        ###############################################################################
        # Join Brep
        ###############################################################################

        solid = Rhino.Geometry.Brep.JoinBreps(breps_to_join, Rhino.RhinoDoc.ActiveDoc.ModelAbsoluteTolerance)[0]

        faces = []
        for i in range(solid.Faces.Count):
            faces.append(solid.Faces[i].DuplicateFace(False))

        solid = Rhino.Geometry.Brep.JoinBreps(faces, Rhino.RhinoDoc.ActiveDoc.ModelAbsoluteTolerance)[0]

        if solid:
            solid.Faces.SplitKinkyFaces(Rhino.RhinoMath.DefaultAngleTolerance, True)

            if Rhino.Geometry.BrepSolidOrientation.Inward is solid.SolidOrientation:
                solid.Flip()

        if color is not None:
            for i in range(solid.Faces.Count):
                solid.Faces[i].PerFaceColor = color
        else:
            for i in range(solid.Faces.Count):
                if i < 2:
                    solid.Faces[i].PerFaceColor = Color.LightGray  # Color.LightGray
                else:
                    solid.Faces[i].PerFaceColor = Color.DeepPink

        return solid, non_planar_curves

    def RunScript(self,
            _p0: System.Collections.Generic.IList[Rhino.Geometry.Curve],
            _p1: System.Collections.Generic.IList[Rhino.Geometry.Curve],
            _c: System.Drawing.Color):
        if _p0 and _p1:
            return self.loft_polylines_with_holes(_p0, _p1, _c)
# ---------- end loft_b ----------
loft_m = Loft_mesh(p0=input_get.plines_0, p1=input_get.plines_1)  # -> mesh; inputs p0: list of Curve, p1: list of Curve
#   port p0: polylines with holes, bottom
#   port p1: polylines with holes, top
#   port mesh: lofted and capped mesh with holes
# ---------- loft_m: Python ----------
"""get joints ids and connections areas between elements"""

__author__ = "petras vestartas"
__version__ = "2024.04.25"

from ghpythonlib.componentbase import executingcomponent as component
import Rhino
import Rhino.Geometry
from System.Drawing import Color
import System


class connections_zones(component):
    def to_polyline_from_cp(self, curve):

        polyline = Rhino.Geometry.Polyline()
        result, polyline1 = curve.TryGetPolyline()

        if result == False:

            nurbsCurve = curve.ToNurbsCurve()
            point3dArray = []

            for i in range(len(nurbsCurve.Points)):
                result, pt = nurbsCurve.Points.GetPoint(i)
                point3dArray.append(pt)

            polyline1 = Rhino.Geometry.Polyline(point3dArray)
            nurbsCurve = polyline1.ToNurbsCurve()
            result, polyline1 = nurbsCurve.TryGetPolyline()

            polyline1.CollapseShortSegments(0.01)

            polyline1 = Rhino.Geometry.Polyline(polyline1)
            polyline = polyline1

        else:
            polyline1.CollapseShortSegments(0.01)
            polyline = polyline1

        return polyline

    def loft_polylines_with_holes(self, curves0, curves1):
        """Loft polylines with holes

        Parameters
        ----------
        curves0 : list[rg.Polyline]
        curves1 : list[rg.Polyline]

        Returns
        -------
        rg.Mesh
            mesh as lofted polylines and cap them
        """

        ###############################################################################
        # user input
        ###############################################################################

        flag = len(curves0) is not 0 if True else len(curves1) != 0
        if flag:

            curves = []
            curves2 = []

            flag0 = len(curves1) == 0
            flag1 = len(curves0) == 0 and len(curves1) != 0
            flag2 = len(curves0) and len(curves1)

            if flag0:
                for i in range(len(curves0)):
                    if float(i) >= float(len(curves0)) * 0.5:
                        curves2.append(curves0[i])
                    else:
                        curves.append(curves0[i])
            elif flag1:
                for i in range(0, len(curves1), 2):
                    curves.append(curves1[i])
                    curves2.append(curves1[i + 1])
            elif flag2:
                curves = curves0
                curves2 = curves1

            curves0 = curves
            curves1 = curves2

        ###############################################################################
        # sort curves which one is border and which ones are holes
        ###############################################################################
        length = -1.0
        border_id = -1
        count = 0
        numArray = []
        for curve in curves0:
            diagonal = curve.GetBoundingBox(True).Diagonal
            temp_length = diagonal.Length
            if temp_length > length:
                length = temp_length
                border_id = count
            count = count + 1

        border0 = self.to_polyline_from_cp(curves0[border_id])
        border1 = self.to_polyline_from_cp(curves1[border_id])
        holes0 = []
        holes1 = []
        for i in range(len(curves0)):
            if i != border_id:
                holes0.append(curves0[i])
                holes1.append(curves1[i])

        ###############################################################################
        # Create mesh of the bottom face
        ###############################################################################
        mesh_bottom = Rhino.Geometry.Mesh.CreatePatch(
            border0, Rhino.RhinoDoc.ActiveDoc.ModelAngleToleranceRadians, None, holes0, None, None, True, 1
        )

        ###############################################################################
        # Convert closed polylines to open ones
        ###############################################################################

        point_3d_array = []
        for i in range(len(mesh_bottom.Vertices)):
            point_3d_array.append(mesh_bottom.Vertices.Point3dAt(i))

        open_curve_points_0 = []
        open_curve_points_1 = []

        for i in range(len(border0) - 1):
            open_curve_points_0.append(border0[i])
            open_curve_points_1.append(border1[i])

        for i in range(len(holes0)):
            holes0_polyline = self.to_polyline_from_cp(holes0[i])
            holes1_polyline = self.to_polyline_from_cp(holes1[i])
            for j in range(len(holes0_polyline) - 1):
                open_curve_points_0.append(holes0_polyline[j])
                open_curve_points_1.append(holes1_polyline[j])

        ###############################################################################
        # Using the bottom mesh vertices create the top mesh f
        ###############################################################################
        points_to_sort_new = self.sort_set_of_points(open_curve_points_0, point_3d_array)
        mesh_top = mesh_bottom.DuplicateMesh()

        for i in range(len(points_to_sort_new)):
            mesh_top.Vertices.SetVertex(i, open_curve_points_1[points_to_sort_new[i]])

        ###############################################################################
        # Merge the top and bottom mesh into one and append sides
        ###############################################################################
        mesh = Rhino.Geometry.Mesh()
        mesh.Append(mesh_bottom)
        mesh.Append(mesh_top)

        count = len(mesh_bottom.Vertices)
        for p in range((mesh_bottom.TopologyEdges).Count):

            if mesh_bottom.TopologyEdges.GetConnectedFaces(p).Length == 1:
                topologyVertices = mesh_bottom.TopologyEdges.GetTopologyVertices(p)
                mesh.Faces.AddFace(
                    topologyVertices.I, topologyVertices.J, topologyVertices.J + count, topologyVertices.I + count
                )

        mesh.UnifyNormals()
        mesh.Ngons.AddPlanarNgons(Rhino.RhinoDoc.ActiveDoc.ModelAbsoluteTolerance * 1, 3, 1, True)

        ###############################################################################
        # Unweld ngons meshes
        ###############################################################################
        unwelded_ngon_mesh = Rhino.Geometry.Mesh()
        count = 0
        for ngonAndFacesEnumerable in mesh.GetNgonAndFacesEnumerable():

            faces = []
            for j in ngonAndFacesEnumerable.FaceIndexList():
                faces.append(System.Int32(j))

            temp_ngon_mesh = mesh.DuplicateMesh().Faces.ExtractFaces(faces)

            # append colors
            if count < 2:
                temp_ngon_mesh.VertexColors.CreateMonotoneMesh(Color.LightGray)
            else:
                temp_ngon_mesh.VertexColors.CreateMonotoneMesh(Color.DeepPink)

            unwelded_ngon_mesh.Append(temp_ngon_mesh)
            count = count + 1

        ###############################################################################
        # Output
        ###############################################################################
        unwelded_ngon_mesh.RebuildNormals()
        return unwelded_ngon_mesh

    def sort_set_of_points(self, points_to_sort, guide_points):
        """Sort one array of point by an another point array

        use it like this:
        #points_to_sort_new = []
        #for i in points_to_sort_ids:
        #    points_to_sort_new.append(points_to_sort[i])

        Parameters
        ----------
        points_to_sort : list[rg.Point3d]
        guide_points : list[rg.Point3d]

        Returns
        -------
        list[int]
            the list of indices of the sorted array
        """

        # create a copy
        points_to_sort_copy = []
        for i in points_to_sort:
            points_to_sort_copy.append(Rhino.Geometry.Point3d(i))

        guide_points_copy = []
        for i in guide_points:
            guide_points_copy.append(Rhino.Geometry.Point3d(i))

        # make indices of points
        points_to_sort_ids = list(range(0, len(points_to_sort_copy)))
        guide_points_ids = list(range(0, len(guide_points_copy)))

        # sort both lists by xyz coordinates together with indices
        points_to_sort_copy, points_to_sort_ids = zip(*sorted(zip(points_to_sort_copy, points_to_sort_ids)))
        guide_points_copy, guide_points_ids = zip(*sorted(zip(guide_points_copy, guide_points_ids)))

        # sort guide points indices and order the points to sort indec
        guide_points_ids, points_to_sort_ids = zip(*sorted(zip(guide_points_ids, points_to_sort_ids)))

        # can be used like this:
        # points_to_sort_new = []
        # for i in points_to_sort_ids:
        #    points_to_sort_new.append(points_to_sort[i])

        return points_to_sort_ids

    def RunScript(self,
            _p0: System.Collections.Generic.IList[Rhino.Geometry.Curve],
            _p1: System.Collections.Generic.IList[Rhino.Geometry.Curve]):
        if _p0 and _p1:
            return self.loft_polylines_with_holes(_p0, _p1)
# ---------- end loft_m ----------
crv_3 = Curve(loft_b.npc)
