# Grasshopper definition 7_assign_directions_and_joint_types3.gh (Grasshopper 1.0.8)
# plug-ins: RhinoCodePluginGH

crv = Curve([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])
crv_2 = Curve([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])
pt = Point(Point(66.54180289, -67.76869473, 25.90170739))
pt_2 = Point([Point(-12.48673366, -66.5369766, 91.98009472), Point(-15.95577545, -146.9068279, 47.36189679)])
type_a = Panel("0")
type_b = Panel("10")
type_c = Panel("20")
pt_3 = Point([Point(-23.20359916, -142.9068279, 90.14100906), Point(-78.55497782, -142.9068279, 57.21722225), Point(35.9403107, -116.8646479, 57.0608065), Point(-3.437238191, -100.4885806, 19.63133686), Point(-3.429887815, -35.47802532, 131.1152912), Point(-30.86663423, -18.51036677, 84.15627084), Point(-11.87968433, -49.29797263, 51.01550833), Point(12.69802542, -72.50533185, 102.0418385), Point(-2.720821949, -75.58486061, 111.711162), Point(-33.80333849, -52.18888495, 65.85015224)])
entwine = Entwine(Branch00=pt, Branch01=pt_2, Branch02=pt_3, FlattenInputs=True)
entwine_2 = Entwine(Branch00=type_a, Branch01=type_b, Branch02=type_c, FlattenInputs=True)
closest_lines = ClosestLines(polylines=crv, lines=crv_2)  # -> polylines_out, vectors; inputs polylines: tree of Curve, lines: tree of Line
#   port polylines: polylines tree branch order does not matter it is flatenned inside the component
#   port lines: a tree of lines, the path id of the branch must match with _joint_types id, it is kind of a dictionary
#   port polylines_out: pairs of polylines, grouped two polylines per branch
#   port vectors: a tree of vectors where each element contains top, bottom and side vector assignments
# ---------- closest_lines: Python ----------
from ghpythonlib.componentbase import executingcomponent as component
import Grasshopper, GhPython
import System
import Rhino
import rhinoscriptsyntax as rs

__author__ = "petra"
__version__ = "2023.04.04"
import System
import Rhino.Geometry
from Rhino.Geometry import RTree
from Rhino.Geometry import BoundingBox
from Rhino.Geometry import Sphere
from Rhino.Geometry import Vector3d
from Rhino.Geometry import Point3d
from Rhino.Geometry import Polyline
from Rhino.Geometry import Line
import Grasshopper
import ghpythonlib.treehelpers as th


class MyComponent(component):
    def RunScript(self,
            _polylines: Grasshopper.DataTree[Rhino.Geometry.Curve],
            _lines: Grasshopper.DataTree[Rhino.Geometry.Line]):
        """Provides a scripting component.
        Inputs:
            x: The x script variable
            y: The y script variable
        Output:
            a: The a output variable"""

        ###############################################################################
        # Input
        ###############################################################################
        polylines = []
        polylines_out = Grasshopper.DataTree[Polyline]()
        lines = []

        ###############################################################################
        # Conversion
        ###############################################################################
        count = 0
        for curve in _polylines.AllData():
            result, polyline = curve.TryGetPolyline()
            polylines_out.Add(
                polyline, Grasshopper.Kernel.Data.GH_Path(int(count * 0.5))
            )
            if count % 2 == 0:
                polylines.append([polyline])
            else:
                polylines[-1].append(polyline)
            count = count + 1

        lines = _lines.AllData()

        ###############################################################################
        # Run the closest point search
        ###############################################################################

        # convert element polylines to a flattened dictionary:
        segments_dictionary = {}
        # stores ids e.g. int , [element_int,bottom_or_top_polyline_int,edge,int, bounding_box, hit_count, point_id]
        vectors = []
        count = 0
        for i in range(len(polylines)):
            vectors.append([Vector3d.Zero] * (polylines[i][0].SegmentCount + 2))
            for j in range(len(polylines[i])):
                for k in range(polylines[i][j].SegmentCount):
                    bbox = polylines[i][j].SegmentAt(k).BoundingBox
                    bbox.Inflate(0.02)
                    segments_dictionary[count]= [i, j, k, bbox, polylines[i][j].SegmentAt(k)]
                    
                    count = count + 1

        # create a tree
        rtree = Rhino.Geometry.RTree()

        # fill the tree
        for i in segments_dictionary:
            rtree.Insert(segments_dictionary[i][3], i)

        # call_backs of rtree
        hit_count = 0

        def search_callback(sender, rtree_event_args):
            data_by_reference.append(rtree_event_args.Id)

        # perform search, two times first for start points of a polyline, second for the end point
        for i in range(len(lines)):
            data_by_reference = []
            if rtree.Search(
                Sphere(lines[i].From, 0), search_callback, data_by_reference
            ):
                for j in data_by_reference:
                    if (
                        lines[i].From.DistanceToSquared(
                            segments_dictionary[j][4].ClosestPoint(lines[i].From, True)
                        )
                        < 0.001
                    ):
                        vectors[segments_dictionary[j][0]][
                            segments_dictionary[j][2] + 2
                        ] = lines[i].Direction
                        # vectors[segments_dictionary[j][0]][segments_dictionary[j][2]+2].Unitize()

        for i in range(len(lines)):
            data_by_reference = []
            if rtree.Search(Sphere(lines[i].To, 0), search_callback, data_by_reference):
                for j in data_by_reference:
                    if (
                        lines[i].To.DistanceToSquared(
                            segments_dictionary[j][4].ClosestPoint(lines[i].To, True)
                        )
                        < 0.001
                    ):
                        vectors[segments_dictionary[j][0]][
                            segments_dictionary[j][2] + 2
                        ] = -lines[i].Direction
                        # vectors[segments_dictionary[j][0]][segments_dictionary[j][2]+2].Unitize()

        ###############################################################################
        # Output
        ###############################################################################
        _polylines_out = polylines_out
        _vectors = th.list_to_tree(vectors)

        # return outputs if you have them; here I try it for you:
        return (_polylines_out, _vectors)
# ---------- end closest_lines ----------

closest_indexed_points = ClosestIndexedPoints(polylines=crv, points=entwine, joint_types=entwine_2)  # -> polylines_out, joint_types_out; inputs polylines: tree of Curve, points: tree of Point3d, joint_types: tree of Int32
#   port polylines: polylines tree branch order does not matter it is flatenned inside the component
#   port points: a tree of points, the path id of the branch must match with _joint_types id, it is kind of a dictionary
#   port joint_types: a tree of integers, the path id of the branch must match with _points id, it is kind of a dictionary
#   port polylines_out: pairs of polylines, grouped two polylines per branch
#   port joint_types_out: a tree of int where each element contains top, bottom and side joint type assignments
# ---------- closest_indexed_points: Python ----------
from ghpythonlib.componentbase import executingcomponent as component
import Grasshopper, GhPython
import System
import Rhino
import rhinoscriptsyntax as rs

"""Provides a scripting component.
    Inputs:
        x: The x script variable
        y: The y script variable
    Output:
        a: The a output variable"""

__author__ = "petra"
__version__ = "2023.04.04"

import Rhino.Geometry
from Rhino.Geometry import RTree
from Rhino.Geometry import BoundingBox
from Rhino.Geometry import Sphere
from Rhino.Geometry import Vector3d
from Rhino.Geometry import Point3d
from Rhino.Geometry import Polyline
from Rhino.Geometry import Line
import Grasshopper
import ghpythonlib.treehelpers as th


class MyComponent(component):
    def RunScript(self,
            _polylines: Grasshopper.DataTree[Rhino.Geometry.Curve],
            _points: Grasshopper.DataTree[Rhino.Geometry.Point3d],
            _joint_types: Grasshopper.DataTree[int]):
        ###############################################################################
        # Input
        ###############################################################################
        polylines = []
        polylines_out = Grasshopper.DataTree[Polyline]()
        pts = []
        ids = []

        ###############################################################################
        # Conversion
        ###############################################################################
        count = 0
        for curve in _polylines.AllData():
            result, polyline = curve.TryGetPolyline()
            polylines_out.Add(
                polyline, Grasshopper.Kernel.Data.GH_Path(int(count * 0.5))
            )
            if count % 2 == 0:
                polylines.append([polyline])
            else:
                polylines[-1].append(polyline)
            count = count + 1

        if _points.DataCount > 0 and _joint_types.DataCount > 0:
            for i in range(_points.BranchCount):
                for j in range(_points.Branch(i).Count):
                    pts.append(_points.Branch(i)[j])
                    ids.append(_joint_types.Branch(i)[j % _joint_types.Branch(i).Count])
        # pts = _points.AllData()
        # ids = _joint_types.AllData()

        ###############################################################################
        # Run the closest point search
        ###############################################################################

        # convert element polylines to a flattened dictionary:
        segments_dictionary = {}
        # stores ids e.g. int , [element_int,bottom_or_top_polyline_int,edge,int, bounding_box, hit_count, point_id]
        joint_types = []
        count = 0
        for i in range(len(polylines)):
            joint_types.append([-1] * (polylines[i][0].SegmentCount + 2))
            for j in range(len(polylines[i])):
                for k in range(polylines[i][j].SegmentCount):
                    bbox = polylines[i][j].SegmentAt(k).BoundingBox
                    bbox.Inflate(0.02)
                    segments_dictionary[count] = [i, j, k, bbox, polylines[i][j].SegmentAt(k)]
                    count = count + 1

        # create a tree
        rtree = Rhino.Geometry.RTree()

        # fill the tree
        for i in segments_dictionary:
            rtree.Insert(segments_dictionary[i][3], i)

        # call_backs of rtree
        hit_count = 0

        def search_callback(sender, rtree_event_args):
            data_by_reference.append(rtree_event_args.Id)

        # perform search
        for i in range(len(pts)):
            data_by_reference = []
            if rtree.Search(Sphere(pts[i], 0), search_callback, data_by_reference):
                for j in data_by_reference:
                    if (
                        pts[i].DistanceToSquared(
                            segments_dictionary[j][4].ClosestPoint(pts[i], True)
                        )
                        < 0.001
                    ):
                        joint_types[segments_dictionary[j][0]][
                            segments_dictionary[j][2] + 2
                        ] = ids[i]

        ###############################################################################
        # Output
        ###############################################################################
        _polylines_out = polylines_out
        _joints_types_out = th.list_to_tree(joint_types)

        # return outputs if you have them; here I try it for you:
        return (_polylines_out, _joints_types_out)
# ---------- end closest_indexed_points ----------
panel = Panel(closest_lines.polylines_out)

# ----
# DATA -> ASSIGN DIRECTIONS
# AND JOINT TYPES
# PER SIDES
input_set = Input_set(polylines=closest_lines.polylines_out, vectors=closest_lines.vectors, joint_types=closest_indexed_points.joint_types_out)  # -> data; inputs polylines: tree of Polyline, vectors: tree of Vector3d, joint_types: tree of Int32, three_valence: tree of Int32, adjacency: tree of Int32
#   port polylines: a data-tree of polyline pairs
#   port vectors: insertion direction
#   port joint_types: joint type per side, top, bottom, and sides
#   port three_valence: three valance joinery that starts 0 - Vidy, 1 - Annen, and 4 indices current, next, current-neighbor, next-neighbor
#   port adjacency: joint parameters
#   port data: user input_get component to ungroup all the data to the individual data-trees
# ---------- input_set: Python ----------
"""combine different data sets into one list for a faster data transder between grasshopper wires"""
from ghpythonlib.componentbase import executingcomponent as component
import Grasshopper, GhPython
__author__ = "petras"
__version__ = "2023.04.02"


import System
import Rhino
import rhinoscriptsyntax as rs
import ghpythonlib.treehelpers as th
from Rhino.Geometry import Polyline
from Rhino.Geometry import Vector3d
from Rhino.Geometry import Plane

class MyComponent(component):
    
    def get_plane(self, _polyline, _orientation_point):
        
        len = _polyline.Count - 1
        normal = Vector3d(0,0,0)
        
        for i in range((_polyline.Count - 1)):
            num = ((i - 1) + len) % len
            item1 = ((i + 1) + len) % len
            point3d =_polyline[num]
            point3d1 =_polyline[item1]
            item2 = _polyline[i]
            normal = normal + Vector3d.CrossProduct(Vector3d(item2 - point3d), Vector3d(point3d1 - item2))
        
        normal.Unitize()
        plane = Plane(_polyline.CenterPoint(), normal)
        if(plane.DistanceTo(_orientation_point)<0):
            plane.Flip()
        
        return plane
    
    
    
    def RunScript(self,
            _polylines: Grasshopper.DataTree[Rhino.Geometry.Polyline],
            _vectors: Grasshopper.DataTree[Rhino.Geometry.Vector3d],
            _joint_types: Grasshopper.DataTree[int],
            _three_valence: Grasshopper.DataTree[int],
            _adjacency: Grasshopper.DataTree[int]):
        
        
        
        plines = []
        planes = []
        if( _polylines.DataCount > 0):
            for i in range(_polylines.BranchCount):
                plines.append(_polylines.Branch(i))
                planes.append(self.get_plane(_polylines.Branch(i)[0],_polylines.Branch(i)[1][0]))
        
        insertion_vectors =  th.tree_to_list(_vectors) if _vectors.DataCount > 0 else []
        joints_per_face =  th.tree_to_list(_joint_types) if _joint_types.DataCount > 0 else []
        three_valence =  th.tree_to_list(_three_valence) if _three_valence.DataCount > 0 else []
        adjacency = th.tree_to_list(_adjacency) if _adjacency.DataCount > 0 else []
        
        # output
        _data = [[plines,insertion_vectors,joints_per_face,three_valence,adjacency, planes]]
        
        # return outputs if you have them; here I try it for you:
        return _data
# ---------- end input_set ----------

panel_2 = Panel(input_set)
joint_parameters = Joint_parameters()  # -> p; inputs ss_e_ip: list of Double, ss_e_op: list of Double, ts_e_p: list of Double, cr_c_ip: list of Double, tt_e_p: list of Double, ss_e_r: list of Double, b: list of Double
#   port ss_e_ip: side-to-side in-plane joint parameters
#   port ss_e_op: side-to-side out-of-plane joint parameters
#   port ts_e_p: top-to-side joint parameters
#   port cr_c_ip: cross joint parameters
#   port tt_e_p: top-to-top joint parameters
#   port ss_e_r: side-to-side rotated joint parameters
#   port b: boundary joint parameters
#   port p: a list of joint parameters
# ---------- joint_parameters: Python ----------
"""
Do something silly in python3.

This component does nothing useful, it's only a kitchen sink (but in python3) example showing most available options.

    Args:
        x: X value
        y: Y value
        z: Z value
    Returns:
        result: The sum of all three values.
"""
from ghpythonlib.componentbase import executingcomponent as component

import System
import math

class joint_parameters_component(component):
    def RunScript(self,
            _ss_e_ip: System.Collections.Generic.IList[float],
            _ss_e_op: System.Collections.Generic.IList[float],
            _ts_e_p: System.Collections.Generic.IList[float],
            _cr_c_ip: System.Collections.Generic.IList[float],
            _tt_e_p: System.Collections.Generic.IList[float],
            _ss_e_r: System.Collections.Generic.IList[float],
            _b: System.Collections.Generic.IList[float]):
        
        joint_parameters = [
            300, 0.5, 3,   # 1-9 ss_e_ip (side-to-side edge in-plane)
            50, 0.64, 15,  # 10-19 ss_e_op (side-to-side edge out-of-plane)
            450, 0.5, 20,  # 20-29 ts_e_p (top-to-side edge plane)
            300, 0.5, 30,  # 30-39 cr_c_ip (cross cutting in-plane)
            6, 0.95, 40,   # 40-49 tt_e_p  (top-to-top edge plane)
            300, 0.5, 58,  # 50-59 ss_e_r (side-to-side edge rotated)
            300, 1.0, 60   # 60-69 b (boundary)
        ]
        
        if _ss_e_ip:
            for i in range(len(_ss_e_ip)):
                joint_parameters[0*3+i] = _ss_e_ip[i]

        if _ss_e_op:
            for i in range(len(_ss_e_op)):
                joint_parameters[1*3+i] = _ss_e_op[i]

        if _ts_e_p:
            for i in range(len(_ts_e_p)):
                joint_parameters[2*3+i] = _ts_e_p[i]

        if _cr_c_ip:
            for i in range(len(_cr_c_ip)):
                joint_parameters[3*3+i] = _cr_c_ip[i]
        
        if _tt_e_p:        
            for i in range(len(_tt_e_p)):
                joint_parameters[4*3+i] = _tt_e_p[i]

        if _ss_e_r:
            for i in range(len(_ss_e_r)):
                joint_parameters[5*3+i] = _ss_e_r[i]

        if _b:
            for i in range(len(_b)):
                joint_parameters[6*3+i] = _b[i]

        _joint_p = joint_parameters

        return _joint_p
# ---------- end joint_parameters ----------
solver = Solver(data=input_set, joint_p=joint_parameters)  # -> data; inputs joint_p: list of Double, scale: list of Double, extension: list of Double, find: Int32, get: Int32
#   port data: collection of inputs that represent the elements, insertion vectors, joint types and adjacency, use input_set commonent to group these inputs
#   port joint_p: joint parameters
#   port scale: scale of joint, default is [1,1,1]
#   port extension: extension by distance, plates often has [0,0,10], whereas beams [10,10,10], default is [0,0,0]
#   port find: search_type search type 0 - side-to-side, 1 - cross, 2 - both
#   port get: output_type 0 - outlines | 1 - lines | 2 - areas | 3 - volumes | 4 - merged geometry of joints
#   port data: user input_get component to ungroup all the data to the individual data-trees
# ---------- solver: Python ----------
__author__ = "petras"
__version__ = "2023.04.02"

# r: compas_wood

from ghpythonlib.componentbase import executingcomponent as component
import Grasshopper, GhPython
import Rhino
from Rhino.Geometry import Polyline, Point3d
import System
from wood_nano import get_connection_zones as wood_nano_get_connection_zones
from wood_nano import cut_type2 as wood_nano_cut_type2
from wood_nano import point3 as wood_nano_point3
from wood_nano.conversions_python import to_int2
from wood_nano.conversions_python import to_int1
from wood_nano.conversions_python import to_double1
from wood_nano.conversions_python import from_cut_type2
# from compas_wood.conversions_compas import to_point2
# from compas_wood.conversions_compas import to_vector2
# from compas_wood.conversions_compas import from_point3
from compas_wood.binding import wood_globals
from math import floor

from Rhino.Geometry import Polyline, Point3d, Vector3d, Mesh
import wood_nano as m


def to_point(vectors, depth):
    if depth == 1:  # Single polyline
        polyline = m.point1()
        for rhino_point in vectors:
            polyline.append(m.point([rhino_point.X, rhino_point.Y, rhino_point.Z]))
        return polyline
    else:  # Nested polyline
        polyline = getattr(m, f"point{depth}")()
        for vec in vectors:
            polyline.append(to_point(vec, depth - 1))
        return polyline


def to_point1(polylines):
    return to_point(polylines, 1)


def to_point2(polylines):
    return to_point(polylines, 2)


def to_point3(polylines):
    return to_point(polylines, 3)


def to_point4(polylines):
    return to_point(polylines, 4)


def from_point1(point1, type="Polyline"):
    points = []
    for i in range(len(point1)):
        point = point1[i]
        points.append(Point3d(point[0], point[1], point[2]))
    if type == "Polyline":
        return Polyline(points)
    elif type == "Box" and len(points) == 8:
        mesh = Mesh()
        for point in points:
            mesh.Vertices.Add(point)
        
        mesh.Faces.AddFace(3, 2, 1, 0)
        mesh.Faces.AddFace(4, 5, 6, 7)
        mesh.Faces.AddFace(0, 1, 5, 4)
        mesh.Faces.AddFace(1, 2, 6, 5)
        mesh.Faces.AddFace(2, 3, 7, 6)
        mesh.Faces.AddFace(3, 0, 4, 7)


def from_point2(point2, type="Polyline"):
    return [from_point1(p, type=type) for p in point2]


def from_point3(point3, type="Polyline"):
    return [from_point2(p, type=type) for p in point3]


def from_point4(point4, type="Polyline"):
    return [from_point3(p, type=type) for p in point4]


######################################################################################################
# Conversion functions for Vectors
######################################################################################################


def to_vector(vectors, depth):
    if depth == 1:  # Single vector_of_vectors
        vector_of_vectors = m.vector1()
        for rhino_vector in vectors:
            vector_of_vectors.append(m.vector([rhino_vector.X, rhino_vector.Y, rhino_vector.Z]))
        return vector_of_vectors
    else:  # Nested vector_of_vectors
        vector = getattr(m, f"vector{depth}")()
        for vec in vectors:
            vector.append(to_vector(vec, depth - 1))
        return vector


def to_vector1(vectors):
    return to_vector(vectors, 1)


def to_vector2(vectors):
    return to_vector(vectors, 2)


def to_vector3(vectors):
    return to_vector(vectors, 3)


def to_vector4(vectors):
    return to_vector(vectors, 4)


def from_vector1(vector1):
    vectors = []
    for i in range(len(vector1)):
        vec = vector1[i]
        vectors.append(Vector3d(vec[0], vec[1], vec[2]))
    return vectors


def from_vector2(vector2):
    return [from_vector1(v) for v in vector2]


def from_vector3(vector3):
    return [from_vector2(v) for v in vector3]


def from_vector4(vector4):
    return [from_vector3(v) for v in vector4]




class connections_zones(component):
    
    # bbox = Rhino.Geometry.BoundingBox.Unset
    # lines = []
    # insertion_vectors_current = []
    # joint_per_face_current_text_entity = []
    # polylines = []
    
    # def DrawViewportWires(self, args):
    #     col =  args.WireColour
    #     line_weight = args.DefaultCurveThickness;
    #     for polyline in self.polylines:
    #         args.Display.DrawPolyline(polyline,  col, line_weight)
    
    # def get_ClippingBox(self):
    #     return self.bbox
    
    def RunScript(self,
            _data,
            _joint_p: System.Collections.Generic.IList[float],
            _scale: System.Collections.Generic.IList[float],
            _extension: System.Collections.Generic.IList[float],
            _find: int,
            _get: int):

        # ==============================================================================
        # clear input
        # ==============================================================================
        self.bbox = Rhino.Geometry.BoundingBox.Unset
        self.lines = []
        self.insertion_vectors_current = []
        self.joint_per_face_current_text_entity = []
        self.polylines = []

        # ==============================================================================
        # input
        # ==============================================================================
        if(_data is None):
            return
        
        input_polyline_pairs = []
        if( _data[0] != 0):
            for i in _data[0]:
                for j in i:
                    input_polyline_pairs.append(j)
        print(input_polyline_pairs[0])
        return
        
        input_insertion_vectors = []
        if(_data[1] != None):
            for i in _data[1]:
                list = []
                for j in i:
                    list.append(j)
                input_insertion_vectors.append(list)

        input_joint_types = [item for item in _data[2]]
        input_three_valence_element_indices_and_instruction = [item for item in _data[3]]
        
        input_joint_parameters_and_types = [
            300, 0.5, 3,   # 1-9 ss_e_ip (side-to-side edge in-plane)
            50, 0.64, 15,  # 10-19 ss_e_op (side-to-side edge out-of-plane)
            450, 0.5, 20,  # 20-29 ts_e_p (top-to-side edge plane)
            300, 0.5, 30,  # 30-39 cr_c_ip (cross cutting in-plane)
            6, 0.95, 40,   # 40-49 tt_e_p  (top-to-top edge plane)
            300, 0.5, 58,  # 50-59 ss_e_r (side-to-side edge rotated)
            300, 1.0, 60   # 60-69 b (boundary)
        ]
        
        for i in range(0, len(_joint_p)):
            if(i%3==0):
                input_joint_parameters_and_types[i] = _joint_p[i]*10
            else:
                input_joint_parameters_and_types[i] = _joint_p[i]*1
        
        input_search_type = max(min(2, _find), 0) if _find else 0
        
        input_scale = [1,1,1]
        if _scale:
            for i in range(0, len(_scale)):
                input_scale[i] = _scale[i]
        
        input_output_type = _get if _get != None else 4
        
        input_joint_volume_parameters = [0,0,0]
        
        if (_extension):
            if(len(_extension)>2):
                input_joint_volume_parameters = []
                for i in _extension:
                    input_joint_volume_parameters.append(i*10)
        
        input_adjacency = []
        if(len(_data[4])>0):
            for i in _data[4]:
                for j in i:
                    input_adjacency.append(j)

        joint_parameters = wood_globals.joints_parameters_and_types
        for i in range(0, len(input_joint_parameters_and_types), 3):
            insertion_id = floor(input_joint_parameters_and_types[i + 2] / 10)
            joint_parameters[insertion_id * 3 + 0] = input_joint_parameters_and_types[i + 0]
            joint_parameters[insertion_id * 3 + 1] = input_joint_parameters_and_types[i + 1]
            joint_parameters[insertion_id * 3 + 2] = input_joint_parameters_and_types[i + 2]

        w_output_plines = wood_nano_point3()
        w_output_types = wood_nano_cut_type2()

        to_point2(input_polyline_pairs)
        return

        wood_nano_get_connection_zones(
            to_point2(input_polyline_pairs),
            to_vector2(input_insertion_vectors),
            to_int2(input_joint_types),
            to_int2(input_three_valence_element_indices_and_instruction),
            to_int1(input_adjacency),
            to_double1(joint_parameters),
            int(input_search_type),
            to_double1(input_scale),
            int(input_output_type),
            w_output_plines,
            w_output_types,
            to_double1(input_joint_volume_parameters),
            [], 
            []
            # to_point2(input_custom_joints),
            # to_int1(input_custom_joints_types),
        )

        # return from_point3(w_output_plines), from_cut_type2(w_output_types)

        return
            
        # _data = [[_plines,_data[1],_data[2],_data[3],_data[4],_data[5],_cuts]]
        # return _data
# ---------- end solver ----------
solver_2 = Solver()  # -> data; inputs joint_p: list of Double, scale: list of Double, extension: list of Double, find: Int32, get: Int32
#   port data: collection of inputs that represent the elements, insertion vectors, joint types and adjacency, use input_set commonent to group these inputs
#   port joint_p: joint parameters
#   port scale: scale of joint, default is [1,1,1]
#   port extension: extension by distance, plates often has [0,0,10], whereas beams [10,10,10], default is [0,0,0]
#   port find: search_type search type 0 - side-to-side, 1 - cross, 2 - both
#   port get: output_type 0 - outlines | 1 - lines | 2 - areas | 3 - volumes | 4 - merged geometry of joints
#   port data: user input_get component to ungroup all the data to the individual data-trees
# ---------- solver_2: Python ----------
__author__ = "petras"
__version__ = "2023.04.02"

from ghpythonlib.componentbase import executingcomponent as component
import Grasshopper, GhPython
import Rhino
from Rhino.Geometry import Polyline, Point3d
#from compas_rhino import conversions
import System
import time
from ctypes import *
#from compas_wood.ctypes_conversion import *

import os

app_data = os.getenv('APPDATA')
vers = Rhino.RhinoApp.Version.Major
plugin_name = 'compas_wood'
plugin_path = "{0}\McNeel\Rhinoceros\packages\{1}.0\{2}".format(app_data, vers, plugin_name)

for _path in os.walk(plugin_path):
    if os.path.isdir(_path[0]):
        plugin_path =  _path[0]




def list_polylines_coord(polylines):
    f = []
    v = []
    for polyline in polylines:
        f.append(len(polyline))
        for point in polyline:
            v.append(point[0]*10)
            v.append(point[1]*10)
            v.append(point[2]*10)
            #v.extend(point)
    _f = (c_size_t * len(f))(*f)
    _v = (c_float * len(v))(*v)
    return _f, c_size_t(len(f)), _v, c_size_t(len(v))


def lists_vectors_coord(vectors):
    faces = [len(v) for v in vectors]
    f = (c_size_t * len(vectors))(*faces)
    v = [coord for vec in vectors for point in vec for coord in point]

    v_s = c_size_t(len(v))  # * sizeof(c_float)
    v = (c_float * len(v))(*v)
    return f, c_size_t(len(vectors)), v, v_s


def lists_numbers_coord(numbers):
    v_s = 0
    f_s = len(numbers)
    f = (c_size_t * len(numbers))()

    for i in range(len(numbers)):
        f[i] = len(numbers[i])
        v_s += len(numbers[i]) * 1

    v = (c_int * v_s)()

    count = 0
    for i in range(len(numbers)):
        for j in range(len(numbers[i])):
            v[count] = numbers[i][j]
            count += 1

    return f, c_size_t(f_s), v, c_size_t(v_s)


def list_ints_coord(numbers):
    f_s = len(numbers)
    f = [0.0] * f_s
    for i in range(f_s):
        f[i] = numbers[i]
    return (c_int * len(f))(*f), c_size_t(f_s)


def list_numbers_coord(numbers):
    f_s = len(numbers)
    f = [0.0] * f_s
    for i in range(f_s):
        f[i] = numbers[i]
    return (c_float * len(f))(*f), c_size_t(f_s)



def coord_polylines_lists(groups_f, groups_f_s, out_f, out_f_s, out_v, out_v_s):
    polylines = [
        [Polyline([]) for j in range(groups_f[i])] for i in range(groups_f_s.value)
    ]

    a = 0
    b = 0
    pline_count = 0
    num_points = 3
    num_groups = groups_f_s.value

    points = []
    for i in range(0, out_v_s.value, num_points):
        #points.append([out_v[i]*0.1, out_v[i + 1]*0.1, out_v[i + 2]*0.1])
        points.append(Point3d(out_v[i]*0.1, out_v[i + 1]*0.1, out_v[i + 2]*0.1))
        num_points_per_polyline = out_f[pline_count]

        if len(points) == num_points_per_polyline:
            for j in range(a, groups_f_s.value):
                if groups_f[j] > 0:
                    a = j
                    break

            polylines[a][b] = Polyline(points)
            points = []
            num_polylines_per_group = groups_f[a]
            if b == (num_polylines_per_group - 1):
                a += 1
                b = 0
            else:
                b += 1
            pline_count += 1

    return polylines


def coord_numbers_lists(out_f, out_f_s, out_v, out_v_s):

    # create Python objects
    ids = [[] for _ in range(out_f_s.value)]

    for i in range(out_f_s.value):
        ids[i] = [None] * out_f[i]
        if out_f[i] == 0:
            return

    # fill array with points
    a = 0
    b = 0
    for i in range(0, out_v_s.value):
        ids[a][b] = out_v[i]
        if b == (out_f[a] - 1):
            a += 1
            b = 0
        else:
            b += 1

    return ids



class connections_zones(component):
    
    bbox = Rhino.Geometry.BoundingBox.Unset
    lines = []
    insertion_vectors_current = []
    joint_per_face_current_text_entity = []
    polylines = []
    
    def DrawViewportWires(self, args):
        #GrasshopperDocument = Grasshopper.Instances.ActiveCanvas.Document
        #is_selected = False
        """
        for _ in GrasshopperDocument.Objects:
            is_selected = _.Attributes.Selected
        """
        #col = args.WireColour_Selected if is_selected else args.WireColour;
        col =  args.WireColour
        line_weight = args.DefaultCurveThickness;
        try:
            for polyline in self.polylines:
                args.Display.DrawPolyline(polyline,  col, line_weight)
            """
            plane = Plane.WorldXY
            for line in self.lines:
                args.Display.DrawLineArrow(line, Color.FromArgb(207, 0, 90), 2, 100)
            for insertionVectorsCurrent in self.insertion_vectors_current:
                if(insertionVectorsCurrent.Length<0.05):
                    continue
                args.Display.DrawLine(insertionVectorsCurrent, Color.FromArgb(0, 0, 0), 5)
            for jointPerFaceCurrent in self.joint_per_face_current_text_entity:
                result, plane = Rhino.RhinoDoc.ActiveDoc.Views.ActiveView.ActiveViewport.GetCameraFrame()
                plane.Origin=(jointPerFaceCurrent.Plane.Origin)
                args.Display.Draw3dText(jointPerFaceCurrent.PlainText, jointPerFaceCurrent.MaskColor, plane, jointPerFaceCurrent.TextHeight, "Arial", False, False,Rhino.DocObjects.TextHorizontalAlignment.Center, Rhino.DocObjects.TextVerticalAlignment.BottomOfTop)
            """
        except Exception, e:
            System.Windows.Forms.MessageBox.Show(str(e), "script error")
    
    def get_ClippingBox(self):
        return self.bbox
    
    def RunScript(self,
            _data,
            _joint_p: System.Collections.Generic.IList[float],
            _scale: System.Collections.Generic.IList[float],
            _extension: System.Collections.Generic.IList[float],
            _find: int,
            _get: int):
        # ==============================================================================
        # clear input
        # ==============================================================================
        self.bbox = Rhino.Geometry.BoundingBox.Unset
        self.lines = []
        self.insertion_vectors_current = []
        self.joint_per_face_current_text_entity = []
        self.polylines = []
        # ==============================================================================
        # input
        # ==============================================================================
        if(_data is None):
            return
        
        input_polylines = []
        if( _data[0] != 0):
            #convert to compas polylines
            for i in _data[0]:
                for j in i:
                    input_polylines.append(j)#(conversions.polyline_to_compas(j))
        
        input_vectors = []
        if(_data[1] != None):
            for i in _data[1]:
                list = []
                for j in i:
                    list.append(j)#(conversions.vector_to_compas(j))
                input_vectors.append(list)
        
        joint_parameters = [
            300, 0.5, 3,   # 1-9 ss_e_ip (side-to-side edge in-plane)
            50, 0.64, 15,  # 10-19 ss_e_op (side-to-side edge out-of-plane)
            450, 0.5, 20,  # 20-29 ts_e_p (top-to-side edge plane)
            300, 0.5, 30,  # 30-39 cr_c_ip (cross cutting in-plane)
            6, 0.95, 40,   # 40-49 tt_e_p  (top-to-top edge plane)
            300, 0.5, 58,  # 50-59 ss_e_r (side-to-side edge rotated)
            300, 1.0, 60   # 60-69 b (boundary)
        ]
        
        for i in range(0, len(_join_p)):
            if(i%3==0):
                joint_parameters[i] = _join_p[i]*10
            else:
                joint_parameters[i] = _join_p[i]*1
            
        
        search = id = max(min(2, _find), 0)
        
        scale = [1,1,1]
        for i in range(0, len(_scale)):
            scale[i] = _scale[i]
        
        output_type = _get if _get != None else 4
        
        extension = [0,0,0]
        
        if(len(_extension)>2):
            extension = []
            for i in _extension:
                extension.append(i*10)
        
        
        
        input_adjacency = []
        if(len(_data[4])>0):
            for i in _data[4]:
                for j in i:
                    input_adjacency.append(j)
        
        ############################################################################################################
        # Load inputs and perform conversion
        ############################################################################################################
    
        # input geometry
        # input_polylines = data_set_plates.annen_small_polylines()
        # print(len(input_polylines))
        (
            in_polyline_pairs_f,
            in_polyline_pairs_f_s,
            in_polyline_pairs_v,
            in_polyline_pairs_v_s,
        ) = list_polylines_coord(input_polylines)
        
    
        #input_vectors = data_set_plates.annen_small_edge_directions()
    
        (
            in_vectors_f,
            in_vectors_f_s,
            in_vectors_v,
            in_vectors_v_s,
        ) = lists_vectors_coord(input_vectors)
        
        
        
        input_joints = _data[2]#data_set_plates.annen_small_edge_joints()
        # print(len(input_joints))
        (
            in_joints_f,
            in_joints_f_s,
            in_joints_v,
            in_joints_v_s,
        ) = lists_numbers_coord(input_joints)
    
        input_three_valence =_data[3]#(data_set_plates.annen_small_three_valance_element_indices_and_instruction()   )
        
        # print(len(input_three_valence))
    
        (
            in_three_valence_f,
            in_three_valence_f_s,
            in_three_valence_v,
            in_three_valence_v_s,
        ) = lists_numbers_coord(input_three_valence)
    
        #input_adjacency = []
        #print(input_adjacency)
        (
            in_adjancency_v,
            in_adjancency_v_s,
        ) = list_ints_coord(input_adjacency)
    
        # input parameters
        (
            in_joint_parameters_v,
            in_joint_parameters_v_s,
        ) = list_numbers_coord(joint_parameters)
    
        in_search_type = c_int(search)
        (
            in_scale_v,
            in_scale_v_s,
        ) = list_numbers_coord(scale)
    
        in_output_type = c_int(output_type)
    
        # output
    
        # out polylines
        out_plines_groups_f = POINTER(c_size_t)()
        out_plines_groups_f_s = c_size_t()
        out_plines_out_f = POINTER(c_size_t)()
        out_plines_out_f_s = c_size_t()
        out_plines_out_v = POINTER(c_float)()
        out_plines_out_v_s = c_size_t()
    
        # out types
        out_types_f = POINTER(c_size_t)()
        out_types_f_s = c_size_t()
        out_types_v = POINTER(c_int)()
        out_types_v_s = c_size_t()
    
        # global_parameters
        (
            in_joint_volume_parameters_v,
            in_joint_volume_parameters_v_s,
        ) = list_numbers_coord(extension)
        
        face_to_face_side_to_side_joints_dihedral_angle = c_float(130.0)
        
        ############################################################################################################
        # Load library and declare function signature
        ############################################################################################################
        

        if System.Environment.OSVersion.Platform == System.PlatformID.Win32NT:
            #print("Windows")
            lib_ = cdll.LoadLibrary(plugin_path+"\libgmp-10.dll")
            lib = cdll.LoadLibrary(plugin_path+"\pinvoke_wood.dll")
        elif System.Environment.OSVersion.Platform == System.PlatformID.Unix:
            #print("macOS")
            lib = cdll.LoadLibrary("/Users/compas_wood/libpinvoke_wood.dylib")
        else:
            print("Unknown operating system")
                

        lib.ctypes_get_connection_zones.restype = None
        lib.ctypes_get_connection_zones.argtypes = [
            # input geometry
            # polylines
            POINTER(c_size_t),
            POINTER(c_size_t),  # if a value is passed by reference, it must be a pointer
            POINTER(c_float),
            POINTER(c_size_t),  # if a value is passed by reference, it must be a pointer
            # vectors
            POINTER(c_size_t),
            POINTER(c_size_t),
            POINTER(c_float),
            POINTER(c_size_t),
            # joints
            POINTER(c_size_t),
            POINTER(c_size_t),
            POINTER(c_int),
            POINTER(c_size_t),
            # three valence
            POINTER(c_size_t),
            POINTER(c_size_t),
            POINTER(c_int),
            POINTER(c_size_t),
            # adjacency
            POINTER(c_int),
            POINTER(c_size_t),
            # input parameters
            POINTER(c_float),
            POINTER(c_size_t),
            # search_type
            POINTER(c_int),
            # scale
            POINTER(c_float),
            POINTER(c_size_t),
            # output_type
            POINTER(c_int),
            # output
            # polylines
            POINTER(POINTER(c_size_t)),
            POINTER(c_size_t),
            POINTER(POINTER(c_size_t)),
            POINTER(c_size_t),
            POINTER(POINTER(c_float)),
            POINTER(c_size_t),
            # types
            POINTER(POINTER(c_size_t)),
            POINTER(c_size_t),
            POINTER(POINTER(c_int)),
            POINTER(c_size_t),
            # global_parameters
            POINTER(c_float), # joint volume
            POINTER(c_size_t), # joint volume
            POINTER(c_float) # dihedral angle to switch between in-plane and out-of-plane jointery default is 150 degrees
        ]
    
        # generate joints
        start_time = time.time()
        ############################################################################################################
        # Call the function
        # https://stackoverflow.com/questions/4145775/how-do-i-convert-a-python-list-into-a-c-array-by-using-ctypes
        # https://stackoverflow.com/questions/53265216/python-ctypes-type-conversion
        ############################################################################################################
        
        lib.ctypes_get_connection_zones(
            # input geometry
            # polylines
            in_polyline_pairs_f,
            byref(in_polyline_pairs_f_s),
            in_polyline_pairs_v,
            byref(in_polyline_pairs_v_s),
            # vectors
            in_vectors_f,
            byref(in_vectors_f_s),
            in_vectors_v,
            byref(in_vectors_v_s),
            # joints
            in_joints_f,
            byref(in_joints_f_s),
            in_joints_v,
            byref(in_joints_v_s),
            # three_valence
            in_three_valence_f,
            byref(in_three_valence_f_s),
            in_three_valence_v,
            byref(in_three_valence_v_s),
            # adjacency
            in_adjancency_v,
            byref(in_adjancency_v_s),
            # input parameters
            # joint_parameters
            in_joint_parameters_v,
            byref(in_joint_parameters_v_s),
            # search_type
            byref(in_search_type),
            # scale
            in_scale_v,
            byref(in_scale_v_s),
            # output_type
            byref(in_output_type),
            # output
            # polylines
            byref(out_plines_groups_f),
            byref(out_plines_groups_f_s),
            byref(out_plines_out_f),
            byref(out_plines_out_f_s),
            byref(out_plines_out_v),
            byref(out_plines_out_v_s),
            # types
            byref(out_types_f),
            byref(out_types_f_s),
            byref(out_types_v),
            byref(out_types_v_s),
            # global_parameters
            in_joint_volume_parameters_v,
            byref(in_joint_volume_parameters_v_s),
            byref(face_to_face_side_to_side_joints_dihedral_angle),
        )
    
        """
    
        print(out_plines_groups_f[0])
        out_polylines = []
        """
        out_polylines = coord_polylines_lists(
            out_plines_groups_f,
            out_plines_groups_f_s,
            out_plines_out_f,
            out_plines_out_f_s,
            out_plines_out_v,
            out_plines_out_v_s,
        )
        
        
        def temp_coord_numbers_lists(out_f, out_f_s, out_v, out_v_s):
        
            # create Python objects
            ids = [[] for _ in range(out_f_s.value)]
            
            
            
            for i in range(out_f_s.value):
                #print(i, out_f_s.value)
                ids[i] = [None] * out_f[i]
                if out_f[i] == 0:
                    break
            
            #print( ids)
            # fill array with points
            a = 0
            b = 0
            #for i in range(0, out_v_s.value):
            #    print( out_v[i])
            """
            ids[a][b] = out_v[i]
            if b == (out_f[a] - 1):
                a += 1
                b = 0
            else:
                b += 1
            """
        
            return ids
        
        _cuts = coord_numbers_lists(
            out_types_f, out_types_f_s, out_types_v, out_types_v_s
        )
        """
        print _cuts
        print  out_types_f, out_types_f_s, out_types_v, out_types_v_s
        print out_types_v[0]
        print out_types_f[0]
        
        print(
            "\n______________________________________ %s ms ______________________________________"
            % round((time.time() - start_time) * 1000.0, 2)
        )
        
        """
    
    

        
        
        # ==============================================================================
        # output
        # ==============================================================================
        _plines = []
        self.bbox = Rhino.Geometry.BoundingBox.Unset
        # nest two times the result and add to the tree
        for i in range(0, len(out_polylines)):
            list = []
            for j in range(0, len(out_polylines[i])):
                    list.append(out_polylines[i][j])#(conversions.polyline_to_rhino(out_polylines[i][j]))
                    self.polylines.append(list[-1])
                    self.bbox.Union(list[-1].BoundingBox)
            _plines.append(list)
        
        _data = [[_plines,_data[1],_data[2],_data[3],_data[4],_data[5],_cuts]]
        #print(_cuts)
        
        ############################################################################################################
        # release the memory
        ############################################################################################################
    
        # release output of polylines
        
        
        lib.release_size_t(byref(out_plines_groups_f), True)
        lib.release_size_t(byref(out_plines_out_f), True)
        lib.release_float(byref(out_plines_out_v), True)
    
        # release output of types
        lib.release_size_t(byref(out_types_f), True)
        lib.release_int(byref(out_types_v), True)
        
        
        return _data
# ---------- end solver_2 ----------
