# Grasshopper definition 8_cases_chevron_input_surfaces.gh (Grasshopper 1.0.8)
# plug-ins: RhinoCodePluginGH

# ----
# JOINT PARAMETERS
ss_e_ip = Panel("""300
0.5
3""")
ss_e_op = Panel("""150
0.64
15""")
ts_e_p = Panel("""450
0.5
20""")
cr_c_ip = Panel("""300
0.5
30""")
tt_e_p = Panel("""6
0.95
40""")
ss_e_r = Panel("""300
0.5
58""")
b = Panel("""300
1.0
60""")
joint_parameters = Joint_parameters(ss_e_ip=ss_e_ip, ss_e_op=ss_e_op, ts_e_p=ts_e_p, cr_c_ip=cr_c_ip, tt_e_p=tt_e_p, ss_e_r=ss_e_r, b=b)  # -> p; inputs ss_e_ip: list of Double, ss_e_op: list of Double, ts_e_p: list of Double, cr_c_ip: list of Double, tt_e_p: list of Double, ss_e_r: list of Double, b: list of Double
#   port ss_e_ip: side-to-side in-plane joint parameters
#   port ss_e_op: side-to-side out-of-plane joint parameters
#   port ts_e_p: top-to-side joint parameters
#   port cr_c_ip: cross joint parameters
#   port tt_e_p: top-to-top joint parameters
#   port ss_e_r: side-to-side rotated joint parameters
#   port b: boundary joint parameters
#   port p: a list of joint parameters
# ---------- joint_parameters: Python ----------
"""
Do something silly in python3.

This component does nothing useful, it's only a kitchen sink (but in python3) example showing most available options.

    Args:
        x: X value
        y: Y value
        z: Z value
    Returns:
        result: The sum of all three values.
"""
from ghpythonlib.componentbase import executingcomponent as component

import System
import math


class joint_parameters_component(component):
    def RunScript(self,
            _ss_e_ip: System.Collections.Generic.List[float],
            _ss_e_op: System.Collections.Generic.List[float],
            _ts_e_p: System.Collections.Generic.List[float],
            _cr_c_ip: System.Collections.Generic.List[float],
            _tt_e_p: System.Collections.Generic.List[float],
            _ss_e_r: System.Collections.Generic.List[float],
            _b: System.Collections.Generic.List[float]):

        joint_parameters = [
            300,
            0.5,
            3,  # 1-9 ss_e_ip (side-to-side edge in-plane)
            50,
            0.64,
            15,  # 10-19 ss_e_op (side-to-side edge out-of-plane)
            450,
            0.5,
            20,  # 20-29 ts_e_p (top-to-side edge plane)
            300,
            0.5,
            30,  # 30-39 cr_c_ip (cross cutting in-plane)
            6,
            0.95,
            40,  # 40-49 tt_e_p  (top-to-top edge plane)
            300,
            0.5,
            58,  # 50-59 ss_e_r (side-to-side edge rotated)
            300,
            1.0,
            60,  # 60-69 b (boundary)
        ]

        if _ss_e_ip:
            for i in range(len(_ss_e_ip)):
                joint_parameters[0 * 3 + i] = _ss_e_ip[i]

        if _ss_e_op:
            for i in range(len(_ss_e_op)):
                joint_parameters[1 * 3 + i] = _ss_e_op[i]

        if _ts_e_p:
            for i in range(len(_ts_e_p)):
                joint_parameters[2 * 3 + i] = _ts_e_p[i]

        if _cr_c_ip:
            for i in range(len(_cr_c_ip)):
                joint_parameters[3 * 3 + i] = _cr_c_ip[i]

        if _tt_e_p:
            for i in range(len(_tt_e_p)):
                joint_parameters[4 * 3 + i] = _tt_e_p[i]

        if _ss_e_r:
            for i in range(len(_ss_e_r)):
                joint_parameters[5 * 3 + i] = _ss_e_r[i]

        if _b:
            for i in range(len(_b)):
                joint_parameters[6 * 3 + i] = _b[i]

        _joint_p = joint_parameters

        return _joint_p
# ---------- end joint_parameters ----------
panel = Panel(joint_parameters)

# ----
# CASES -> INTERNALIZED DATA
number_slider = Slider(-1, range=-1..0)
chevron_surfaces = Chevron_surfaces([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])
item = ListItem(List=chevron_surfaces, Index=number_slider, Wrap=True)
recenter = Recenter(geo=item)  # -> output; inputs geo: tree of GeometryBase, scale: Double
#   port geo: geometry to recenter
#   port scale: scale around center
#   port output: transformed geometry
# ---------- recenter: Python ----------
__author__ = "petras vestartas"
__version__ = "2023.03.22"

"""
Move curves to to the origin
"""

from ghpythonlib.componentbase import executingcomponent as component
import Rhino
import Grasshopper


class xml_recenter_component(component):
    def RunScript(self,
            _geo: Grasshopper.DataTree[Rhino.Geometry.GeometryBase],
            _scale: float):

        scale = _scale if _scale != None else 1

        if _geo.AllData().Count == 0:
            return

        # get bounding box
        bbox = _geo.AllData()[0].GetBoundingBox(True)
        for g in _geo.AllData():
            bbox.Union(g.GetBoundingBox(True))

        # Transformation matrix
        translation = -Rhino.Geometry.Vector3d(bbox.Center)
        move_to_center = Rhino.Geometry.Transform.Translation(translation)
        scale_xform = Rhino.Geometry.Transform.Scale(Rhino.Geometry.Point3d.Origin, scale)
        combined = scale_xform * move_to_center

        # Apply transformation
        geo_transformed = Grasshopper.DataTree[Rhino.Geometry.GeometryBase]()
        for i in range(_geo.BranchCount):
            for j in range(_geo.Branch(i).Count):
                geo_copy = _geo.Branch(i)[j].Duplicate()
                geo_copy.Transform(combined)
                geo_transformed.Add(geo_copy, _geo.Paths[i])

        # Output
        return geo_transformed
# ---------- end recenter ----------
chevron_mesh = Chevron_mesh(surface=recenter)  # -> mesh; inputs surface: Surface, u_divisions: Double, v_division_dist: Double, shift: Double, scale: Double
#   port surface: NURBS surfaces - use component -chevron-surfaces-
#   port u_divisions: number of divisions in u direction
#   port v_division_dist: division distance in v direction
#   port shift: value to change the central part of the subdivision
#   port scale: scale value to reduce quad size on the ends, where originally the curvature was bigger
# ---------- chevron_mesh: Python ----------
"""create a quad mesh by subdividing surface from two ends"""
from ghpythonlib.componentbase import executingcomponent as component
import Grasshopper, GhPython
import System
import rhinoscriptsyntax as rs
import Rhino
import Rhino.Geometry
from Rhino.Geometry import Surface, Mesh, MeshFace, Point3d, Point3f, Vector3d


class Chevron:
    # User inputs
    mesh = None
    edge_rotation = 0.0
    edge_offset = 0.0
    box_height = 0.0
    top_plate_inlet = 0.0
    plate_thickness = 0.0
    ortho = False

    # Class generated properties
    f_e = {}
    f_rotation_flip = {}
    bi_planes = []
    e_planes = []
    f_planes = []

    # Output
    f_v = []
    f_me = []
    plines = []  # pair of outlines
    insertion_vectors = []  # v0,v1,v2,v3,v4,v5
    adjacency = []  # v0,v1, f0, f1
    joints_per_face = []  # 0,0,1,1,2,2
    three_valence = []  # 43, 41, 45, 41

    # Display
    box_insertion_vectors = []  # v0,v1,v2,v3,v4,v5
    box_insertion_lines = []  # v0,v1,v2,v3,v4,v5

    def __init__(
        self, mesh, edge_rotation=1, edge_offset=0.5, box_height=760, top_plate_inlet=80, plate_thickness=40, ortho=True
    ):
        if mesh == None:
            return
        self.mesh = mesh.DuplicateMesh()  # assuming DuplicateMesh() is a method in Rhino or some other external library
        self.mesh.Flip(True, True, True)

        self.edge_rotation = max(min(edge_rotation, 30), -30)  # constrain edge_rotation to -30 to 30
        self.edge_offset = max(min(edge_offset, 2), -2)  # constrain edge_offset to -2 to 2

        self.box_height = max(min(box_height, math.inf), 1)  # constrain box_height to 1 to infinity
        self.top_plate_inlet = max(
            min(top_plate_inlet, box_height * 0.333), 1
        )  # constrain top_plate_inlet to 1 to box_height * 0.333
        self.plate_thickness = max(
            min(plate_thickness, box_height * 0.333), 1
        )  # constrain plate_thickness to 1 to box_height * 0.333
        self.ortho = ortho

        # output
        self.plines = []  # list of Polyline objects
        self.insertion_vectors = [[] for _ in range(mesh.Faces.Count * 4)]  # list of Vector3d arrays
        self.adjacency = []  # list of int arrays
        self.joints_per_face = [[] for _ in range(mesh.Faces.Count * 4)]  # list of int arrays
        self.three_valence = []  # list of int arrays
        self.f_v = [[] for _ in range(mesh.Faces.Count)]  # list of int arrays
        self.f_me = [[] for _ in range(mesh.Faces.Count)]  # list of int arrays

        # display
        self.box_insertion_vectors = [None] * mesh.Faces.Count  # list of Vector3d objects
        self.box_insertion_lines = [None] * mesh.Faces.Count  # list of Line objects

    def chevron_grid(self, s, u_divisions=4, v_division_dist=900, shift=0.5, scale=0.05799):
        if s is None:
            return
        # Python code
        # Inputs to construct mesh
        f = []
        v = []

        # Get Surface Interval, divisionStep, baseStep, maxStep, and Delta parameters
        DomU = s.Domain(0)
        DomV = s.Domain(1)
        half_v = DomV.T1 * 0.5
        StepU = (DomU.T1 - DomU.T0) / u_divisions
        baseStepV = v_division_dist
        maxStepV = 2500
        Delta = maxStepV - baseStepV

        totalV = DomV[1] - DomV[0]
        rem = (totalV / 2) - ((maxStepV / 2) + baseStepV + Delta)
        stepV = rem / baseStepV

        # Iterate number strips of the NURBS
        ctU = 0
        #        print(s.Domain(0))
        #        print(s.Domain(1))
        #        print(u_divisions)
        for j in range(u_divisions):
            #            print(j)
            ctV = 0
            thresh = totalV / 2
            StepV1 = baseStepV
            b = True
            ListV = []

            p0, p1, p2, p6, p7, p8 = None, None, None, None, None, None
            savept6 = Point3f.Unset
            savept7 = Point3f.Unset
            savept8 = Point3f.Unset
            iterations = 0

            while b and iterations < 1000:
                iterations += 1
                ListV.append(StepV1)

                # Get First Half of a Quads
                if ctV == 0:

                    p0 = s.PointAt(ctU, ctV)

                    p1 = s.PointAt(ctU + StepU * 0.5, ctV)
                    p2 = s.PointAt(ctU + StepU, ctV)
                    p6 = s.PointAt(ctU, ctV + StepV1 * (1 - shift / 2))
                    p7 = s.PointAt(ctU + StepU * 0.5, ctV + StepV1 * (1 + shift / 2))
                    p8 = s.PointAt(ctU + StepU, ctV + StepV1 * (1 - shift / 2))
                    savept6 = p6
                    savept7 = p7
                    savept8 = p8
                else:
                    p0 = savept6
                    p1 = savept7
                    p2 = savept8
                    p6 = s.PointAt(ctU, ctV + StepV1 * (1 - shift / 2))
                    p7 = s.PointAt(ctU + StepU * 0.5, ctV + StepV1 * (1 + shift / 2))
                    p8 = s.PointAt(ctU + StepU, ctV + StepV1 * (1 - shift / 2))
                    savept6 = p6
                    savept7 = p7
                    savept8 = p8

                # Add mesh faces
                f.append(MeshFace(len(v), len(v) + 1, len(v) + 2, len(v) + 3))
                v.extend([p0, p6, p7, p1])
                f.append(MeshFace(len(v), len(v) + 1, len(v) + 2, len(v) + 3))
                v.extend([p1, p7, p8, p2])

                # Increment V Parameter, and multiply by scale due to curvature change
                ctV += StepV1
                thresh -= StepV1
                StepV1 += StepV1 * scale

                # mirror side
                if ctV + StepV1 > half_v:
                    ListV.append(thresh)
                    ListV.reverse()
                    revCt = totalV / 2  # rev counter

                    for i in range(len(ListV) - 1):
                        revCt += ListV[i]

                        if i == 0:
                            p0 = s.PointAt(ctU, revCt - ListV[i + 1] * shift / 2)
                            # print(ctU, revCt - ListV[i + 1] * shift / 2)
                            p1 = s.PointAt(ctU + StepU * 0.5, revCt + ListV[i + 1] * shift / 2)
                            p2 = s.PointAt(ctU + StepU, revCt - ListV[i + 1] * shift / 2)

                            f.append(MeshFace(len(v), len(v) + 1, len(v) + 2, len(v) + 3))
                            v.extend([p6, p0, p1, p7])

                            f.append(MeshFace(len(v), len(v) + 1, len(v) + 2, len(v) + 3))
                            v.extend([p7, p1, p2, p8])

                            p6 = s.PointAt(ctU, revCt + ListV[i + 1] * (1 - shift / 2))
                            p7 = s.PointAt(ctU + StepU * 0.5, revCt + ListV[i + 1] * (1 + shift / 2))
                            p8 = s.PointAt(ctU + StepU, revCt + ListV[i + 1] * (1 - shift / 2))
                            savept6 = p6
                            savept7 = p7
                            savept8 = p8
                        elif i == (len(ListV) - 2):
                            p0 = savept6
                            p1 = savept7
                            p2 = savept8
                            p6 = s.PointAt(ctU, revCt + ListV[i + 1])
                            p7 = s.PointAt(ctU + StepU * 0.5, revCt + ListV[i + 1])
                            p8 = s.PointAt(ctU + StepU, revCt + ListV[i + 1])
                        else:
                            p0 = savept6
                            p1 = savept7
                            p2 = savept8
                            p6 = s.PointAt(ctU, revCt + ListV[i + 1] * (1 - shift / 2))
                            p7 = s.PointAt(ctU + StepU * 0.5, revCt + ListV[i + 1] * (1 + shift / 2))
                            p8 = s.PointAt(ctU + StepU, revCt + ListV[i + 1] * (1 - shift / 2))
                            savept6 = p6
                            savept7 = p7
                            savept8 = p8

                        f.append(MeshFace(len(v), len(v) + 1, len(v) + 2, len(v) + 3))
                        v.extend([p1, p7, p8, p2])
                        f.append(MeshFace(len(v), len(v) + 1, len(v) + 2, len(v) + 3))
                        v.extend([p0, p6, p7, p1])

                    b = False

            ctU += StepU

        # Create Mesh
        # print(v)
        mesh = Mesh()
        for point in v:
            mesh.Vertices.Add(point)
        mesh.Faces.AddFaces(f)
        mesh.Weld(100)
        mesh.RebuildNormals()

        return mesh


class MyComponent(component):
    def RunScript(self,
            _surface: Rhino.Geometry.Surface,
            _u_divisions: float,
            _v_division_dist: float,
            _shift: float,
            _scale: float):

        chevron = Chevron(None)
        _mesh = chevron.chevron_grid(_surface)

        # return outputs if you have them; here I try it for you:
        return _mesh
# ---------- end chevron_mesh ----------
chevron_plates = Chevron_plates(mesh=chevron_mesh)  # -> data, dir; inputs mesh: Mesh, edge_rotation: Double, edge_offset: Double, box_height: Double, top_plate_inlet: Double, plate_thickness: Double, ortho: Boolean
#   port mesh: mesh coming from chevron component
#   port edge_rotation: rotate mesh edges in one direction
#   port edge_offset: slide edges instead of rotation
#   port box_height: the height of the box (mesh offset)
#   port top_plate_inlet: to accomodate joints the plates have to be move inwards e.g. by thickness of a plate
#   port plate_thickness: thickness of the timber plate
#   port ortho: project sides of the surface
#   port data: a list of data: [plines, insertion_vectors, joint_per_face, three_valence, adjacency]
#   port dir: insertion directions
# ---------- chevron_plates: Python ----------
from ghpythonlib.componentbase import executingcomponent as component
import Grasshopper, GhPython
import System
import Rhino
import rhinoscriptsyntax as rs
import Rhino
import Rhino.Geometry
from Rhino.Geometry import Surface, Mesh, MeshFace, Point3d, Point3f, Vector3d, Plane, Line, BoundingBox
import math
import System
from collections import OrderedDict
import Grasshopper
from System.Drawing import Color
from compas_wood.datastructures import WoodData

class Chevron:
    # User inputs
    mesh = None
    edge_rotation = 0.0
    edge_offset = 0.0
    box_height = 0.0
    top_plate_inlet = 0.0
    plate_thickness = 0.0
    ortho = False

    # Class generated properties
    f_e = OrderedDict()
    f_rotation_flip = OrderedDict()
    bi_planes = []
    e_planes = []
    f_planes = []

    # Output
    f_v = []
    f_me = []
    plines = [] # pair of outlines
    insertion_vectors = [] # v0,v1,v2,v3,v4,v5
    adjacency = [] # v0,v1, f0, f1
    joints_per_face = [] # 0,0,1,1,2,2
    three_valence = [] # 43, 41, 45, 41

    # Display
    box_insertion_vectors = [] # v0,v1,v2,v3,v4,v5
    box_insertion_lines = [] # v0,v1,v2,v3,v4,v5
    
    def __init__(self, mesh, edge_rotation=1, edge_offset=0.5, box_height=760, top_plate_inlet=80, plate_thickness=40, ortho=True):

        if mesh == None:
            return
        self.mesh = mesh # assuming DuplicateMesh() is a method in Rhino or some other external library
        self.mesh.Flip(True, True, True)
        self.edge_rotation =  max(min(edge_rotation, 30), -30) if edge_rotation is not None else 1 # constrain self.edge_rotation to -30 to 
        self.edge_offset = max(min(edge_offset, 2), -2) if edge_offset is not None else 0.5 # constrain self.edge_offset to -2 to 2

        self.box_height = max(min(box_height, 100000000), 1) if box_height is not None else 760  # constrain box_height to 1 to infinity
        
        self.top_plate_inlet = max(min(top_plate_inlet, self.box_height * 0.333), 1) if top_plate_inlet is not None else 80 # constrain top_plate_inlet to 1 to box_height * 0.333
        #print(self.top_plate_inlet)
        self.plate_thickness = max(min(plate_thickness, self.box_height * 0.333), 1) if plate_thickness is not None else 40 # constrain self.plate_thickness to 1 to box_height * 0.333
        #print(self.plate_thickness)
        self.ortho = ortho if ortho is not None else True

        # output
        self.plines = [] # list of Polyline objects
        self.insertion_vectors = [[] for _ in range(self.mesh.Faces.Count * 4)] # list of Vector3d arrays
        self.adjacency = [] # list of int arrays
        self.joints_per_face = [[] for _ in range(self.mesh.Faces.Count * 4)] # list of int arrays
        self.three_valence = [] # list of int arrays
        self.f_v = [[] for _ in range(self.mesh.Faces.Count)] # list of int arrays
        self.f_me = [[] for _ in range(self.mesh.Faces.Count)] # list of int arrays

        # display
        self.box_insertion_vectors = [None] * self.mesh.Faces.Count # list of Vector3d objects
        self.box_insertion_lines = [None] * self.mesh.Faces.Count # list of Line objects
    
    def chevron_grid(self, s, u_divisions=4, v_division_dist=900, shift=0.5, scale=0.05799):
        
        # Python code
        # Inputs to construct self.mesh
        f = []
        v = []
        
        # Get Surface Interval, divisionStep, baseStep, maxStep, and Delta parameters
        DomU = s.Domain(0)
        DomV = s.Domain(1)
        half_v = DomV.T1 * 0.5
        StepU = (DomU.T1 - DomU.T0) / u_divisions
        baseStepV = v_division_dist
        maxStepV = 2500
        Delta = maxStepV - baseStepV
        
        totalV = DomV[1] - DomV[0]
        rem = (totalV / 2) - ((maxStepV / 2) + baseStepV + Delta)
        stepV = rem / baseStepV
        
        # Iterate number strips of the NURBS
        ctU = 0
        for j in range(u_divisions):
            ctV = 0
            thresh = totalV / 2
            StepV1 = baseStepV
            b = True
            ListV = []
        
            p0, p1, p2, p6, p7, p8 = None,None,None,None,None,None
            savept6 = Point3f.Unset
            savept7 = Point3f.Unset
            savept8 = Point3f.Unset
            iterations = 0

            while b and iterations < 1000:
                iterations += 1
                ListV.append(StepV1)
        
                # Get First Half of a Quads
                if ctV == 0:
                    
                    p0 = s.PointAt(ctU, ctV)
                    
                    p1 = s.PointAt(ctU + StepU * 0.5, ctV)
                    p2 = s.PointAt(ctU + StepU, ctV)
                    p6 = s.PointAt(ctU, ctV + StepV1 * (1 - shift / 2))
                    p7 = s.PointAt(ctU + StepU * 0.5, ctV + StepV1 * (1 + shift / 2))
                    p8 = s.PointAt(ctU + StepU, ctV + StepV1 * (1 - shift / 2))
                    savept6 = p6
                    savept7 = p7
                    savept8 = p8
                else:
                    p0 = savept6
                    p1 = savept7
                    p2 = savept8
                    p6 = s.PointAt(ctU, ctV + StepV1 * (1 - shift / 2))
                    p7 = s.PointAt(ctU + StepU * 0.5, ctV + StepV1 * (1 + shift / 2))
                    p8 = s.PointAt(ctU + StepU, ctV + StepV1 * (1 - shift / 2))
                    savept6 = p6
                    savept7 = p7
                    savept8 = p8
        
                # Add self.mesh faces
                f.append(MeshFace(len(v), len(v)+ 1, len(v) + 2, len(v) + 3))
                v.extend([p0, p6, p7, p1])
                f.append(MeshFace(len(v), len(v) + 1, len(v)+ 2, len(v) + 3))
                v.extend([p1, p7, p8, p2])
        
                # Increment V Parameter, and multiply by scale due to curvature change
                ctV += StepV1
                thresh -= StepV1
                StepV1 += StepV1 * scale
                
                # mirror side
                if ctV + StepV1 > half_v:
                    ListV.append(thresh)
                    ListV.reverse()
                    revCt = totalV / 2  # rev counter
                
                    for i in range(len(ListV) - 1):
                        revCt += ListV[i]
                
                        if i == 0:
                            p0 = s.PointAt(ctU, revCt - ListV[i + 1] * shift / 2)
                            #print(ctU, revCt - ListV[i + 1] * shift / 2)
                            p1 = s.PointAt(ctU + StepU * 0.5, revCt + ListV[i + 1] * shift / 2)
                            p2 = s.PointAt(ctU + StepU, revCt - ListV[i + 1] * shift / 2)
                
                            f.append(MeshFace(len(v), len(v) + 1, len(v) + 2, len(v) + 3))
                            v.extend([p6, p0, p1, p7])
                
                            f.append(MeshFace(len(v), len(v) + 1, len(v) + 2, len(v) + 3))
                            v.extend([p7, p1, p2, p8])
                
                            p6 = s.PointAt(ctU, revCt + ListV[i + 1] * (1 - shift / 2))
                            p7 = s.PointAt(ctU + StepU * 0.5, revCt + ListV[i + 1] * (1 + shift / 2))
                            p8 = s.PointAt(ctU + StepU, revCt + ListV[i + 1] * (1 - shift / 2))
                            savept6 = p6
                            savept7 = p7
                            savept8 = p8
                        elif i == (len(ListV) - 2):
                            p0 = savept6
                            p1 = savept7
                            p2 = savept8
                            p6 = s.PointAt(ctU, revCt + ListV[i + 1])
                            p7 = s.PointAt(ctU + StepU * 0.5, revCt + ListV[i + 1])
                            p8 = s.PointAt(ctU + StepU, revCt + ListV[i + 1])
                        else:
                            p0 = savept6
                            p1 = savept7
                            p2 = savept8
                            p6 = s.PointAt(ctU, revCt + ListV[i + 1] * (1 - shift / 2))
                            p7 = s.PointAt(ctU + StepU * 0.5, revCt + ListV[i + 1] * (1 + shift / 2))
                            p8 = s.PointAt(ctU + StepU, revCt + ListV[i + 1] * (1 - shift / 2))
                            savept6 = p6
                            savept7 = p7
                            savept8 = p8
                        
                        f.append(MeshFace(len(v), len(v) + 1, len(v) + 2, len(v) + 3))
                        v.extend([p1, p7, p8, p2])
                        f.append(MeshFace(len(v), len(v) + 1, len(v) + 2, len(v) + 3))
                        v.extend([p0, p6, p7, p1])
                        
                    b = False
                    
            ctU += StepU
            
        # Create Mesh
        #print(v)
        self.mesh = Mesh()
        for point in v:
            self.mesh.Vertices.Add(point)
        self.mesh.Faces.AddFaces(f)
        self.mesh.Weld(100)
        self.mesh.RebuildNormals()

        return self.mesh
        
    def get_mesh_face_edges(self, f, flag):
        edge_id = self.mesh.TopologyEdges.GetEdgesForFace(f)
        ids = [0, 1] if flag else [1, 2]
        return ids
    
    def stripper(self):
        self.f_e = OrderedDict()
        self.f_rotation_flip = OrderedDict()
        f_e_temp = OrderedDict()
        f_rotation_flip_temp = OrderedDict()
        flagArray = [False] * self.mesh.Faces.Count
        num = 0
    
        for i in range(self.mesh.Faces.Count):
            if(num>=self.mesh.Faces.Count):
                break
            
            face_1 = 0
            num2 = 0
            while num2 < self.mesh.Faces.Count:
                if flagArray[num2]:
                    num2 += 1
                else:
                    face_1 = num2
                    break
    
            self.mesh1 = Rhino.Geometry.Mesh()
            self.mesh1.Vertices.AddVertices(self.mesh.Vertices)
            self.mesh1.Faces.AddFace(self.mesh.Faces[face_1])
    
            f_e_temp[face_1] = self.get_mesh_face_edges( face_1, i % 2 == 0)
            f_rotation_flip_temp[face_1] = i % 2 == 0
    
            nums = [face_1]
            flagArray[face_1] = True
            num += 1
            flags = [False]
            flag = False
    
            while not flag:
                flag1 = False
                for j in range(self.mesh1.Faces.Count):
                    if not flags[j]:
                        f_n = self.mesh.Faces.AdjacentFaces(nums[j])
                        for k in range(len(f_n)):
                            if not flagArray[f_n[k]]:
                                f = self.mesh1.Faces[j]
                                a = f.A
                                b = f.B
                                c = f.C
                                d = f.D
                                f = self.mesh.Faces[f_n[k]]
                                a1 = f.A
                                b1 = f.B
                                c1 = f.C
                                d1 = f.D
                                if (a == b1 and b == a1) or (c == d1 and d == c1) or (c == b1 and d == a1) or (b == c1 and a == d1):
                                    f_e_temp[f_n[k]] = self.get_mesh_face_edges( f_n[k], i % 2 == 0)
                                    f_rotation_flip_temp[f_n[k]] = i % 2 == 0
    
                                    self.mesh1.Faces.AddFace(self.mesh.Faces[f_n[k]])
                                    nums.append(f_n[k])
                                    flags.append(False)
                                    flagArray[f_n[k]] = True
                                    num += 1
                                    flag1 = True
                        flags[j] = True
    
                if flag1:
                    continue
    
                flag = True
                self.mesh1.Vertices.CullUnused()
                # Rhino.RhinoDoc.ActiveDoc.Objects.AddMesh(self.mesh1)
    
            f_e_temp_keys = list(f_e_temp.keys())
            if i % 2 == 0:
                f_e_temp_keys.reverse()
            
            #print(len(f_e_temp_keys))
            for j in range(len(f_e_temp_keys)):
                
                self.f_e[f_e_temp_keys[j]] = f_e_temp[f_e_temp_keys[j]]
                
                self.f_rotation_flip[f_e_temp_keys[j]] = f_rotation_flip_temp[f_e_temp_keys[j]]
                #print(self.f_rotation_flip)
                
                #if(f_e_temp_keys == 10):
                    
                    #print(f_rotation_flip_temp[f_e_temp_keys[j]])
    
            f_e_temp = OrderedDict()
            f_rotation_flip_temp = OrderedDict()
        
        #print(self.f_rotation_flip )
        #print(self.f_rotation_flip)
#        for val in self.f_e:
#            print(val, self.f_e[val])
    
    def update_neighbour_plane(self, update_plane, curr_face, curr_edge):
        
        
        face_neighbors = self.mesh.TopologyEdges.GetConnectedFaces(curr_edge)
        if len(face_neighbors) == 1:
            return
        
        
        if face_neighbors[0] == curr_face:
            face_neighbors = [face_neighbors[1],face_neighbors[0]]
    
        neighbor_edges = [0, 0, 0, 0]
        for i in range(4):
            neighbor_edges[i] = self.mesh.TopologyEdges.GetEdgeIndex(
                self.f_v[face_neighbors[0]][i],
                self.f_v[face_neighbors[0]][(i + 1) % 4]
            )
    
        neighbor_edge = neighbor_edges.index( curr_edge )
        """
        if(curr_face == 139):
            print("Hi", face_neighbors, curr_edge, neighbor_edges)
            print(face_neighbors[0])
            print(curr_face)
            print(self.e_planes[face_neighbors[0]][neighbor_edge])
            Rhino.RhinoDoc.ActiveDoc.Objects.AddLine(self.mesh.TopologyEdges.EdgeLine(curr_edge))
        """
        self.e_planes[face_neighbors[0]][neighbor_edge] = Plane(
            update_plane.Origin,
            -update_plane.XAxis,
            update_plane.YAxis
        )
        
    
    def get_edge_planes(self):
        try:
            for i in range(len(self.mesh.Faces)):
                self.f_v[i] = [self.mesh.Faces[i][0], self.mesh.Faces[i][1], self.mesh.Faces[i][2], self.mesh.Faces[i][3]]
    
            self.e_planes = [None] * len(self.f_v)
            self.f_planes = [None] * len(self.f_v)
            self.f_me = [None] * len(self.f_v)
    
            for i in range(len(self.f_v)):
                n = len(self.f_v[i])
                self.e_planes[i] = [None] * n
                self.f_planes[i] = Plane(self.mesh.Faces.GetFaceCenter(i), Vector3d(self.mesh.FaceNormals[i]))
                self.f_me[i] = [None] * len(self.f_v[i])
    
                for j in range(len(self.f_v[i])):
                    v1 = self.f_v[i][(j + 0) % n]
                    v2 = self.f_v[i][(j + 1) % n]
    
                    e = self.mesh.TopologyEdges.GetEdgeIndex(v1, v2)
                    self.f_me[i][j] = e
                    cf = self.mesh.TopologyEdges.GetConnectedFaces(e)
    
                    sum = Vector3d.Zero
                    for k in range(len(cf)):
                        sum = sum + Vector3d(self.mesh.FaceNormals[cf[k]])
                    sum /= len(cf)
    
                    edgePlane = Plane(
                        (Point3d)(self.mesh.Vertices[v1] + self.mesh.Vertices[v2]) * 0.5,
                        self.mesh.Vertices[v1] - self.mesh.Vertices[v2], sum)
    
                    self.e_planes[i][j] = edgePlane
            
        except Exception as e:
            print(str(e))
    
    def orthogonalize_planes(self, plane):
        
        zaxis_coord_abs = [abs(plane.ZAxis.X), abs(plane.ZAxis.Y), abs(plane.ZAxis.Z)]
        zaxis_coord = [plane.ZAxis.X, plane.ZAxis.Y, plane.ZAxis.Z]
        id = [0, 1, 2]
    
        zaxis_coord_abs, id = (list(t) for t in zip(*sorted(zip(zaxis_coord_abs, id), key=lambda pair: pair[0])))
    
        coord = math.copysign(math.ceil(abs(zaxis_coord[id[2]])), zaxis_coord[id[2]])
    
        if id[2] == 0:
            plane0 = Plane(plane.Origin, Vector3d(coord, 0, 0))
            return plane0
        elif id[2] == 1:
            plane0 = Plane(plane.Origin, Vector3d(0, coord, 0))
            return plane0
        else:
            plane0 = Plane(plane.Origin, Vector3d(0, 0, coord))
            return plane0

    def move_plane_by_axis(self, plane, dist, axis=2):
        plane1 = Rhino.Geometry.Plane(plane)
        if axis == 0:
            plane1.Translate(plane1.XAxis * dist)
        elif axis == 1:
            plane1.Translate(plane1.YAxis * dist)
        else:
            plane1.Translate(plane1.Normal * dist)
        return plane1

    def rotate_planes(self):
        
        #print(self.f_e)
        
        for i in range(self.mesh.Faces.Count):
            for j in range(4):
                e = self.mesh.TopologyEdges.GetEdgeIndex(self.f_v[i][j], self.f_v[i][(j + 1) % 4])
                #print("___")

                if len(self.mesh.TopologyEdges.GetConnectedFaces(e)) == 2:
                    sign = -1 if self.f_rotation_flip[i] else 1
                    sign = sign * 1 if j % 2 == 0 else sign * -1
                    sign = 1
                    
                    #if(i == 162):
                        #print(j)
                    
                    if (j in self.f_e[i]):
                        
                        
                        if j % 2 == 0 and self.f_rotation_flip[i]:
                            self.e_planes[i][j] = self.move_plane_by_axis(self.e_planes[i][j], self.plate_thickness * self.edge_offset)
                            self.update_neighbour_plane(self.e_planes[i][j], i, e)
                        if j % 2 == 0 and not self.f_rotation_flip[i]: # this failing
                            
                            self.e_planes[i][j] = self.move_plane_by_axis(self.e_planes[i][j], self.plate_thickness * self.edge_offset)
                            self.update_neighbour_plane(self.e_planes[i][j], i, e)
                        if j % 2 == 1 and self.f_rotation_flip[i]:
                            self.e_planes[i][j].Rotate(math.radians(self.edge_rotation * sign * 1), self.e_planes[i][j].YAxis)
                            self.update_neighbour_plane(self.e_planes[i][j], i, e)
                            
                        if j % 2 == 1 and not self.f_rotation_flip[i]:
                            sign *= -1
                            self.e_planes[i][j].Rotate(math.radians(self.edge_rotation * sign * 1), self.e_planes[i][j].YAxis)
                            self.update_neighbour_plane(self.e_planes[i][j], i, e)
                            
                elif self.ortho:
                    self.e_planes[i][j] = self.orthogonalize_planes(self.e_planes[i][j])
    
    def to_line(self,  v, p, scale = 1):
        return Line(p, p + v * scale);
    
    def dihedral_plane(self, plane0, plane1):
         # Plane between two Planes
            result, l = Rhino.Geometry.Intersect.Intersection.PlanePlane(plane0, plane1)
            result, t = Rhino.Geometry.Intersect.Intersection.LinePlane(l, plane0)
            centerDihedral = l.PointAt(t)
        
            # Convert ZAxis to lines, cant it be done on origin
            angleLine0 = self.to_line(plane0.ZAxis,plane0.Origin) 
            angleLine1 = self.to_line(plane1.ZAxis,plane1.Origin) 
        
            # Plane cannot be anti/parallel and they must be apart from each other
            if not plane0.ZAxis.IsParallelTo(plane1.ZAxis, 0.01) and plane0.Origin.DistanceToSquared(plane1.Origin) > 0.001:
                # Intersect two lines to get center
                result, t0, t1 = Rhino.Geometry.Intersect.Intersection.LineLine(angleLine0, angleLine1,0.01,False)
                
                # Construct plane from LineLine center and plane origins
                center = angleLine0.PointAt(t0)
                v0 = (plane0.Origin - center)
                v1 = (plane1.Origin - center)
                v0.Unitize()
                v1.Unitize()
                
                # Compute Plane
                dihedralPlane = Rhino.Geometry.Plane(centerDihedral, l.Direction, v0 + v1)
        
                return dihedralPlane
            else:
                return Rhino.Geometry.Plane.Unset  # Axes are parallel or anti-parallel, or planes are at the same location
    
    def get_bisector_planes(self):
        self.bi_planes = []
    
        for i in range(self.mesh.Faces.Count):
            bi_planes_i = []
            for j in range(4):
                pl1 = self.e_planes[i][j]
                pl0 = self.e_planes[i][(j + 1) % 4]
                bi_planes_i.append(self.dihedral_plane(pl0, pl1))
            self.bi_planes.append(bi_planes_i)
    
    def polyline_from_planes(self, basePlane, sidePlanes, close=True):
        polyline = Rhino.Geometry.Polyline()
    
        for i in range(len(sidePlanes) - 1):
            result, pt = Rhino.Geometry.Intersect.Intersection.PlanePlanePlane(basePlane, sidePlanes[i], sidePlanes[i + 1])
            polyline.Add(pt)
    
        result, pt1 = Rhino.Geometry.Intersect.Intersection.PlanePlanePlane(basePlane, sidePlanes[len(sidePlanes) - 1], sidePlanes[0])
        polyline.Add(pt1)
    
        if close:
            polyline.Add(polyline[0])
    
        return polyline
    
    def get_plates(self):
        self.plines = []
        #print("________")
        for f, e in self.f_e.items():
            #print(f)
            # Offset Planes
            self.e_planes_local = []
            for j in range(4):
                pl = self.e_planes[f][j] if j not in e else self.move_plane_by_axis(self.e_planes[f][j], self.plate_thickness*1.0)
                self.e_planes_local.append(pl)
                #Rhino.RhinoDoc.ActiveDoc.Objects.AddPoint(self.e_planes[f][j].Origin)
    
            # Get Top Plates
            self.plines.append(self.polyline_from_planes(self.move_plane_by_axis(self.f_planes[f], self.box_height * 0.5 - self.top_plate_inlet - self.plate_thickness * 0.5), self.e_planes_local))
            self.plines.append(self.polyline_from_planes(self.move_plane_by_axis(self.f_planes[f], self.box_height * 0.5 - self.top_plate_inlet + self.plate_thickness * 0.5), self.e_planes_local))
            self.plines.append(self.polyline_from_planes(self.move_plane_by_axis(self.f_planes[f], -self.box_height * 0.5 + self.top_plate_inlet - self.plate_thickness * 0.5), self.e_planes_local))
            self.plines.append(self.polyline_from_planes(self.move_plane_by_axis(self.f_planes[f], -self.box_height * 0.5 + self.top_plate_inlet + self.plate_thickness * 0.5), self.e_planes_local))
    
            # Get Side Plates
            for j in range(len(e)):
                curr = e[j]
                prev = ((e[j] - 1)+4)%4# MathUtil.Wrap(e[j] - 1, 4)
                next = (e[j] + 1)%4
                # Side planes
                side_plane0 = self.move_plane_by_axis(self.f_planes[f], self.box_height * 0.5) # top plane
                side_plane1 = self.e_planes[f][prev] if j == 0 else self.bi_planes[f][prev]
                side_plane2 = self.move_plane_by_axis(self.f_planes[f], -self.box_height * 0.5) # bottom outline
                side_plane3 = self.e_planes[f][next] if j != 0 else self.bi_planes[f][curr]
                side_planes  = [side_plane0, side_plane1, side_plane2, side_plane3]
    
                # Top and bottom plane plane
                base_plane0 = self.e_planes[f][curr]
                base_plane1 = self.move_plane_by_axis(self.e_planes[f][curr], self.plate_thickness)
    
                self.plines.append(self.polyline_from_planes(base_plane0, side_planes))
                self.plines.append(self.polyline_from_planes(base_plane1, side_planes))

    
    def center_point(self, polyline):
        count = len(polyline)
    
        if count == 0:
            return Point3d.Unset
    
        if count == 1:
            return polyline[0]
    
        center = Point3d.Origin
        weight = 0.0
    
        stop = count - 1
        if polyline[0].DistanceToSquared(polyline[polyline.Count - 1]) > 0.001:
            stop += 1
    
        for i in range(stop):
            A = polyline[i]
            B = polyline[(i + 1) % count]
            d = A.DistanceTo(B)
            center += d * 0.5 * (A + B)
            weight += d
    
        center /= weight
    
        return center
    
    # output
    #    public List<Polyline> plines;//pair of outlines
    #    public Vector3d[][] insertion_vectors;//v0,v1,v2,v3,v4,v5
    #    public int[][] adjacency;//0,1
    #    public int[][] joints_per_face;//0,0,1,1,2,2
    #    public List<int[]> three_valence;//43, 41, 45, 41
    def get_joinery_solver_output(self):
        # Insertion vectors
        counter = 0
        
        for o in self.f_e.items():
            f = o[0]
            e = o[1]
            e.sort()
            if e[0] == 0 and e[1] == 3:
                e.reverse()
        
            # Get vertices to construct vectors
            v = [self.mesh.Faces[f].A, self.mesh.Faces[f].B, self.mesh.Faces[f].C, self.mesh.Faces[f].D]
            v0_0 = v[e[0]]
            v0_1 = v[(e[0] + 1) % 4]
            v1_0 = v[e[1]]
            v1_1 = v[(e[1] + 1) % 4]
        
            dir0 = self.mesh.Vertices[v0_1] - self.mesh.Vertices[v0_0]
            dir1 = self.mesh.Vertices[v0_1] - self.mesh.Vertices[v1_1]
            dir0.Unitize()
            dir1.Unitize()
            
            result, l0 = Rhino.Geometry.Intersect.Intersection.PlanePlane(self.f_planes[f], self.bi_planes[f][e[0]])
            bisector_dir0 = l0.To - l0.From
            bisector_dir0.Unitize()
            
            result, l1 = Rhino.Geometry.Intersect.Intersection.PlanePlane(self.f_planes[f], self.bi_planes[f][(e[1] + 1) % 4])
            bisector_dir1 = l1.To - l1.From
            bisector_dir1.Unitize()
        
            # Assign vectors per box
            self.box_insertion_vectors[counter] = bisector_dir1
            #print(self.box_insertion_lines)
            #print(counter)
            #print(self.plines)
            self.box_insertion_lines[counter] = Line(
                self.center_point(self.plines[counter * 8 + 1]),
                self.center_point(self.plines[counter * 8 + 1]) + bisector_dir1 * 300)
        
            # Assign vectors per face
        
            # Top and bottom plate
            insertions = [Vector3d.Zero, Vector3d.Zero, bisector_dir1, bisector_dir1, bisector_dir1, bisector_dir1]
            insertions[2 + ((e[1] + 2) % 4)] = bisector_dir0
            insertions[2 + ((e[1] + 3) % 4)] = bisector_dir0
            self.insertion_vectors[counter * 4 + 0] = insertions
            self.insertion_vectors[counter * 4 + 1] = insertions
        
            # Side plates
            self.insertion_vectors[counter * 4 + 2] = [Vector3d.Zero, Vector3d.Zero, Vector3d.Zero, Vector3d.Zero, Vector3d.Zero, Vector3d.Zero]
            self.insertion_vectors[counter * 4 + 3] = [Vector3d.Zero, Vector3d.Zero, Vector3d.Zero, Vector3d.Zero, Vector3d.Zero, Vector3d.Zero]
            counter += 1
        
        # Flatten ID Mapping
        counter = 0
        dict_plate_id_meshface_id = OrderedDict()
        for o in self.f_e.items():
            dict_plate_id_meshface_id[o[0]] = counter
            counter += 1
        
        ##############################################################################
        # Adjacency
        ##############################################################################
        unique_key = set()
        # Box adjacency
        counter = 0
        for o in self.f_e.items():
            f = o[0]
            e = o[1]
        
            # Current box
            self.adjacency.append([counter * 4 + 0, counter * 4 + 2, -1, -1])
            self.adjacency.append([counter * 4 + 0, counter * 4 + 3, -1, -1])
            self.adjacency.append([counter * 4 + 1, counter * 4 + 2, -1, -1])
            self.adjacency.append([counter * 4 + 1, counter * 4 + 3, -1, -1])
            self.adjacency.append([counter * 4 + 2, counter * 4 + 3, -1, -1])
            # Neighbors
            m_e_0 = self.f_me[f][e[0]]  # self.mesh.TopologyEdges.GetEdgeIndex(v[e[0]], v[(e[0] + 1) % 4])
            m_e_1 = self.f_me[f][e[1]]  # self.mesh.TopologyEdges.GetEdgeIndex(v[e[1]], v[(e[1] + 1) % 4])
        
            f0 = self.mesh.TopologyEdges.GetConnectedFaces(m_e_0)
            if len(f0) == 2:
                next_face = f0[0] if f0[0] != f else f0[1]
                self.adjacency.append([dict_plate_id_meshface_id[next_face] * 4 + 0, counter * 4 + 2, -1, -1])
                self.adjacency.append([dict_plate_id_meshface_id[next_face] * 4 + 1, counter * 4 + 2, -1, -1])
        
            f1 = self.mesh.TopologyEdges.GetConnectedFaces(m_e_1)
            if len(f1) == 2:
                next_face = f1[0] if f1[0] != f else f1[1]
                self.adjacency.append([dict_plate_id_meshface_id[next_face] * 4 + 0, counter * 4 + 3, -1, -1])
                self.adjacency.append([dict_plate_id_meshface_id[next_face] * 4 + 1, counter * 4 + 3, -1, -1])
        
            counter += 1
        
        ##############################################################################
        # Three valence
        ##############################################################################
        # Initialize counter variable
        counter = 0
        
        # Loop through key-value pairs
        for f, e in self.f_e.items():
            # Retrieve topology vertices of current face
            v = [self.mesh.Faces[f].A, self.mesh.Faces[f].B, self.mesh.Faces[f].C, self.mesh.Faces[f].D]
            
            # Retrieve topology edge indexes
            m_e_0 = self.f_me[f][e[0]]
            m_e_1 = self.f_me[f][e[1]]
            
            # Retrieve connected faces of topology edges
            e_f_0 = self.mesh.TopologyEdges.GetConnectedFaces(m_e_0)
            
            # Check if edge m_e_0 is shared by two faces
            if len(e_f_0) == 2:
                # Retrieve index of the other face connected to m_e_0
                
                f_0 = e_f_0[abs(System.Array.IndexOf(e_f_0, f) - 1)];
                
                
                # Retrieve index of neighboring face from dictionary
                nei0 = dict_plate_id_meshface_id[f_0]
                
                # Add connectivity information to three_valence list
                self.three_valence.append([counter * 4 + 0, counter * 4 + 2, nei0 * 4 + 0, counter * 4 + 2])
                self.three_valence.append([counter * 4 + 1, counter * 4 + 2, nei0 * 4 + 1, counter * 4 + 2])
            
            # Retrieve connected faces of topology edges
            e_f_1 = self.mesh.TopologyEdges.GetConnectedFaces(m_e_1)
            
            # Check if edge m_e_1 is shared by two faces
            if len(e_f_1) == 2:
                # Retrieve index of the other face connected to m_e_1
                f_1 = e_f_1[abs(System.Array.IndexOf(e_f_1, f) - 1)];
                
                # Retrieve index of neighboring face from dictionary
                nei1 = dict_plate_id_meshface_id[f_1]
                
                # Add connectivity information to three_valence list
                self.three_valence.append([counter * 4 + 0, counter * 4 + 3, nei1 * 4 + 0, counter * 4 + 3])
                self.three_valence.append([counter * 4 + 1, counter * 4 + 3, nei1 * 4 + 1, counter * 4 + 3])
            
            # Increment counter
            counter += 1
        
        ##############################################################################
        # Joints per face
        ##############################################################################
        # Initialize counter variable
        counter = 0
        
        # Loop through key-value pairs
        for f, e in self.f_e.items():
            # top-bottom
            self.joints_per_face[counter * 4 + 0] = [0, 0, 20, 20, 20, 20]
            self.joints_per_face[counter * 4 + 1] = [0, 0, 20, 20, 20, 20]
        
            # sides
            # set all to 0 except the dovetail
            a = 1 if e[0] == 3 and e[1] == 0 else 0
            b = 0 if e[0] == 3 and e[1] == 0 else 1
            self.joints_per_face[counter * 4 + 2 + a] = [0, 0, 0, 0, 10, 0]
            self.joints_per_face[counter * 4 + 2 + b] = [0, 0, 10, 0, 0, 0]
            counter += 1
        
    def run(self):
        if self.mesh == None:
            print("Mesh is not given")
            return
        self.stripper()
        self.get_edge_planes()
        self.rotate_planes()
        self.get_bisector_planes()
        self.get_plates()
        self.get_joinery_solver_output()

class MyComponent(component):
    
    
    bbox = BoundingBox.Unset
    lines = []
    insertion_vectors_current = []
    joint_per_face_current_text_entity = []
    polylines = []
    
    def DrawViewportWires(self, args):
        
        is_selected = False

        col = args.WireColour
        line_weight = args.DefaultCurveThickness

        for polyline in self.polylines:
            args.Display.DrawPolyline(polyline,  col, line_weight)

    
    def get_ClippingBox(self):
        return self.bbox
    
    def flatten_list(self, nested_list):
        flat_list = []
        for item in nested_list:
            if isinstance(item, list):
                flat_list.extend(self.flatten_list(item))
            else:
                flat_list.append(item)
        return flat_list    
    
    def RunScript(self,
            _mesh: Rhino.Geometry.Mesh,
            _edge_rotation: float,
            _edge_offset: float,
            _box_height: float,
            _top_plate_inlet: float,
            _plate_thickness: float,
            _ortho: bool):
        
        # ==============================================================================
        # clear input
        # ==============================================================================
        bbox = Rhino.Geometry.BoundingBox.Unset
        lines = []
        insertion_vectors_current = []
        joint_per_face_current_text_entity = []
        polylines = []
        if(_mesh == None):
            return
        ##############################################################################
        # Output
        ##############################################################################
        chevron = Chevron(_mesh, _edge_rotation, _edge_offset, _box_height, _top_plate_inlet, _plate_thickness, _ortho)
        chevron.run()
        
        self.polylines = chevron.plines
        planes = []
        _plines_partitioned =  [[] for _ in range(int(len(chevron.plines)*0.5))] # list of int arrays
        
        self.bbox = chevron.plines[0].BoundingBox
        
        for i in range(int(len(chevron.plines)*0.5)):
            _plines_partitioned[i] = [chevron.plines[i*2+0], chevron.plines[i*2+1]]
            self.bbox.Union(chevron.plines[i*2+0].BoundingBox)
            plane = Plane(chevron.plines[i*2+0][0],chevron.plines[i*2+0][1]-chevron.plines[i*2+0][0],chevron.plines[i*2+0][1]-chevron.plines[i*2+0][2]);
            planes.append(plane)
        
        _data = WoodData(chevron.plines, chevron.insertion_vectors, chevron.joints_per_face, chevron.three_valence, self.flatten_list(chevron.adjacency), planes)
        _dir = chevron.box_insertion_lines
        
        # return outputs if you have them; here I try it for you:
        return (_data, _dir)
# ---------- end chevron_plates ----------
number_slider_2 = Slider(0, range=0..100)
relay = Relay()

solver = Solver(data=chevron_plates.data, joint_p=panel, get=Slider(4, range=0..4))  # -> data; inputs joint_p: list of Double, scale: list of Double, extension: list of Double, find: Int32, get: Int32
#   port data: collection of inputs that represent the elements, insertion vectors, joint types and adjacency, use input_set commonent to group these inputs
#   port joint_p: joint parameters
#   port scale: scale of joint, default is [1,1,1]
#   port extension: extension by distance, plates often has [0,0,10], whereas beams [10,10,10], default is [0,0,0]
#   port find: search_type search type 0 - side-to-side, 1 - cross, 2 - both
#   port get: output_type 0 - outlines | 1 - lines | 2 - areas | 3 - volumes | 4 - merged geometry of joints
#   port data: user input_get component to ungroup all the data to the individual data-trees
# ---------- solver: Python ----------
"""generate joints between elements"""
# r: compas_wood, compas, wood_nano
from ghpythonlib.componentbase import executingcomponent as component
import Rhino
import System
from wood_nano import get_connection_zones as wood_nano_get_connection_zones
from wood_nano import cut_type2 as wood_nano_cut_type2
from wood_nano import point3 as wood_nano_point3
from wood_nano.conversions_python import to_int2
from wood_nano.conversions_python import to_int1
from wood_nano.conversions_python import to_double1
from wood_nano.conversions_python import from_cut_type2
from compas_wood.conversions_rhino import to_point2
from compas_wood.conversions_rhino import to_vector2
from compas_wood.conversions_rhino import from_point3
from compas_wood.binding import wood_globals
from compas_wood.datastructures import WoodData
from math import floor


class connections_zones(component):
    def __init__(self):
        self.bbox = Rhino.Geometry.BoundingBox.Unset
        self.lines = []
        self.insertion_vectors_current = []
        self.joint_per_face_current_text_entity = []
        self.polylines = []

    def DrawViewportWires(self, args):
        col = args.WireColour
        line_weight = args.DefaultCurveThickness
        for polylines_list in self.polylines:
            for polyline in polylines_list:
                args.Display.DrawPolyline(polyline, col, line_weight)

    def get_ClippingBox(self):
        return self.bbox

    def RunScript(self,
            _data,
            _joint_p: System.Collections.Generic.List[float],
            _scale: System.Collections.Generic.List[float],
            _extension: System.Collections.Generic.List[float],
            _find: int,
            _get: int):

        # ==============================================================================
        # clear input
        # ==============================================================================
        self.bbox = Rhino.Geometry.BoundingBox.Unset
        self.lines = []
        self.insertion_vectors_current = []
        self.joint_per_face_current_text_entity = []
        self.polylines = []

        # ==============================================================================
        # input
        # ==============================================================================
        if _data is None:
            return

        input_polyline_pairs = _data.plines
        if input_polyline_pairs:
            if len(input_polyline_pairs) > 0:
                self.bbox = input_polyline_pairs[0].BoundingBox
                for pline in input_polyline_pairs:
                    self.bbox.Union(pline.BoundingBox)

        input_insertion_vectors = _data.insertion_vectors
        input_joint_types = _data.joints_per_face
        input_three_valence_element_indices_and_instruction = _data.three_valence

        input_search_type = max(min(2, _find), 0) if _find else 0

        input_scale = [1, 1, 1]
        if _scale:
            for i in range(0, len(_scale)):
                input_scale[i] = _scale[i]

        input_output_type = _get if _get is not None else 4

        input_joint_volume_parameters = [0, 0, 0]

        if _extension:
            if len(_extension) > 2:
                input_joint_volume_parameters = []
                for i in _extension:
                    input_joint_volume_parameters.append(i * 10)

        input_adjacency = _data.adjacency
        joint_parameters = wood_globals.joints_parameters_and_types
        wood_globals.face_to_face_side_to_side_joints_rotated_joint_as_average = False
        wood_globals.face_to_face_side_to_side_joints_all_treated_as_rotated =  False


        if _joint_p:
            for i in range(0, len(_joint_p), 3):
                insertion_id = floor(_joint_p[i + 2] / 10)
                joint_parameters[insertion_id * 3 + 0] = _joint_p[i + 0]
                joint_parameters[insertion_id * 3 + 1] = _joint_p[i + 1]
                joint_parameters[insertion_id * 3 + 2] = _joint_p[i + 2]

        w_output_plines = wood_nano_point3()
        w_output_types = wood_nano_cut_type2()

        wood_nano_get_connection_zones(
            to_point2(input_polyline_pairs),
            to_vector2(input_insertion_vectors),
            to_int2(input_joint_types),
            to_int2(input_three_valence_element_indices_and_instruction),
            to_int1(input_adjacency),
            to_double1(joint_parameters),
            int(input_search_type),
            to_double1(input_scale),
            int(input_output_type),
            w_output_plines,
            w_output_types,
            to_double1(input_joint_volume_parameters),
        )

        self.polylines = from_point3(w_output_plines)
        return WoodData(
            plines=_data.plines,
            insertion_vectors=_data.insertion_vectors,
            joints_per_face=_data.joints_per_face,
            three_valence=_data.three_valence,
            adjacency=_data.adjacency,
            planes=_data.planes,
            plines_with_joints=self.polylines,
            cut_types=from_cut_type2(w_output_types),
        )
# ---------- end solver ----------

# ---- group: This component groups 4 plates into one box (n input)
assembly = Assembly(data=chevron_plates.data, dir=chevron_plates.dir, t=Slider(84.469, range=0..184))  # inputs dir: list of Line, n: Int32, t: Double
#   port data: collection of inputs that represent the elements, insertion vectors, joint types and adjacency, use input_set commonent to group these inputs
#   port dir: a list of lines that represent the direction of the assembly sequence per element or a group, depending on the inpout N
#   port n: number of plates that are group e.g. one box contains 4 plates, then N = 4
#   port t: slider from 0.00 to number of groups, that helps to animate the assembly sequence
# ---------- assembly: Python ----------
"""display assembly sequence"""
__author__ = "petras"
__version__ = "2023.04.02"

from ghpythonlib.componentbase import executingcomponent as component
import System
import Rhino
from Rhino.Geometry import BoundingBox
from Rhino.Geometry import Point3d
from Rhino.Geometry import Plane
from Rhino.Geometry import Vector3d
from Rhino.Geometry import Line
from Rhino.Geometry import TextEntity
from Rhino.Geometry import Transform
from System.Drawing import Color
import math

class MyComponent(component):
    
    bbox = BoundingBox.Unset
    lines = []
    insertion_vectors_current = []
    joint_per_face_current_text_entity = []
    polylines = []
    
    def DrawViewportWires(self, args):

        plane = Plane.WorldXY
        for line in self.lines:
            args.Display.DrawLineArrow(line, Color.FromArgb(207, 0, 90), 2, 100)
        for polyline in self.polylines:
            args.Display.DrawPolyline(polyline, Color.FromArgb(207, 0, 90), 2)
        for insertionVectorsCurrent in self.insertion_vectors_current:
            if(insertionVectorsCurrent.Length<0.05):
                continue
            args.Display.DrawLine(insertionVectorsCurrent, Color.FromArgb(0, 0, 0), 5)
        for jointPerFaceCurrent in self.joint_per_face_current_text_entity:
            result, plane = Rhino.RhinoDoc.ActiveDoc.Views.ActiveView.ActiveViewport.GetCameraFrame()
            plane.Origin=(jointPerFaceCurrent.Plane.Origin)
            args.Display.Draw3dText(jointPerFaceCurrent.PlainText, jointPerFaceCurrent.MaskColor, plane, jointPerFaceCurrent.TextHeight, "Arial", False, False,Rhino.DocObjects.TextHorizontalAlignment.Center, Rhino.DocObjects.TextVerticalAlignment.BottomOfTop)

    
    def get_ClippingBox(self):
        return self.bbox
    
    
            
    def display_insertion_sequence(self, _data, _lines, _n, _t):
        
        # ==============================================================================
        # clear input
        # ==============================================================================
        self.bbox = Rhino.Geometry.BoundingBox.Unset
        self.lines = []
        self.insertion_vectors_current = []
        self.joint_per_face_current_text_entity = []
        self.polylines = []

        text_size = 50
        line_scale = 300
        
        ###############################################################################
        # input
        ###############################################################################
        self.bbox = BoundingBox.Unset
        self.lines = _lines if len(_lines) > 0 else [Line(Point3d(0,0,0),Point3d(0,0,1))]
        self.insertion_vectors_current =  []
        self.joint_per_face_current_text_entity = []
        self.polylines =  []
        
        group_count = _n if _n is not None else 4
        t = _t if _t is not None else 0.0
        item = self.lines[0]
        self.bbox = self.lines[0].BoundingBox
        
        ###############################################################################
        # process
        ###############################################################################
        for i in range(1,len(self.lines)) :
            self.bbox.Union(self.lines[i].BoundingBox)
        
        for i in range(0,int(math.floor(t)))  :
            for j in range(group_count) :
                self.polylines.append(_data.plines[(i * group_count + j)*2]) 
                self.polylines.append(_data.plines[(i * group_count + j)*2+1]) 
        
        if (t % 1 > 0):
            
            id2 = int(math.floor(t))
            polylines_current = []
            
            for i in range(group_count):
                polylines_current.append(_data.plines[(id2 * group_count + i)*2]) 
                polylines_current.append(_data.plines[(id2 * group_count + i)*2+1]) 

            for m in range(len(polylines_current)) :
                
                item = self.lines[id2]
                line_from = item.From
                item = self.lines[id2]
                to = line_from - item.To
                
                polyline = polylines_current[m].Duplicate()
                polyline.Transform(Transform.Translation(to * (1 - t % 1)))
                polylines_current[m] = polyline
                
            
            for i in polylines_current:
                self.polylines.append(i)
            
            for n in range(0,len(polylines_current),2) :
                
                point3ds =  [polylines_current[n].CenterPoint(),  polylines_current[n + 1].CenterPoint()]
                
                for o in range(0, polylines_current[n].Count - 1):
                    p0 = (polylines_current[n][o] + polylines_current[n][o + 1]) * 0.5
                    p1 = (polylines_current[n + 1][o] + polylines_current[n + 1][o + 1]) * 0.5
                    pmid = (p0+p1)*0.5
                    point3ds.append(pmid)
                
                for p in range(len(point3ds)):
                    
                    face_vectors = _data.insertion_vectors[id2 * 4 + int(n * 0.5)][p]
                    
                    if (face_vectors == Vector3d.Zero)  :
                        face_vectors =  Vector3d(0, 0, 0.0001)
                    
                    self.insertion_vectors_current.append( Line(point3ds[p]+ (face_vectors * line_scale*0.25), point3ds[p] + (face_vectors * line_scale)))
                    text = str(_data.joints_per_face[int(n * 0.5)][p])
                    textEntity = TextEntity()
                    textEntity.Plane=( Plane(point3ds[p], Vector3d.ZAxis))
                    textEntity.PlainText=(text)
                    
                    
                    if(_data.joints_per_face[int(n * 0.5)][p] > 0):
                        textEntity.MaskColor=(Color.FromArgb( 0,0,0))
                        textEntity.TextHeight=((float)(text_size))
                    else:
                        textEntity.MaskColor=(Color.FromArgb( 100,100,100))
                        textEntity.TextHeight=((float)(text_size*0.5))
                    self.joint_per_face_current_text_entity.append(textEntity)


        # return outputs if you have them here I try it for you:
        return 
    
    def RunScript(self,
            _data,
            _dir: System.Collections.Generic.List[Rhino.Geometry.Line],
            _n: int,
            _t: float):

        if not _data:
            return

        directions = []
        if not _dir:
            number_of_directions = len(_data.plines_with_joints)
            directions = [Rhino.Geometry.Line(Point3d(0,0,0),Point3d(0,0,1000))]*number_of_directions
        else:
            directions =_dir


        if not _t:
            return

        
        self.display_insertion_sequence(_data, directions, _n, _t)
# ---------- end assembly ----------

# ----
input_get = Input_get(data=solver)  # -> plines_0, plines_1, lines, insertion_vectors, joints_per_face, three_valence, adjacency, cut_types; inputs split: Boolean; disabled
#   port data: collection of inputs that represent the elements, insertion vectors, joint types and adjacency, use input_set commonent to group these inputs
#   port split: split output into closed outlines and lines
#   port plines_0: polyline pairs
#   port plines_1: polyline pairs
#   port lines: polyline pairs
#   port insertion_vectors: insertion vectors per element top bottom and side faces
#   port joints_per_face: joinery types per element top bottom and side faces
#   port three_valence: three valence indices for special cases where one element is connected with two others
#   port adjacency: connectivity between elements and their faces
#   port cut_types: fabrication type
# ---------- input_get: Python ----------
"""unwrap element data to polylines, insertion vectors, joint types and etc"""
from ghpythonlib.componentbase import executingcomponent as component
import Grasshopper, GhPython
import System

__author__ = "petras"
__version__ = "2023.04.02"

import ghpythonlib.treehelpers as th
from Rhino.Geometry import Polyline
import Rhino
import rhinoscriptsyntax as rs


class MyComponent(component):
    def RunScript(self, _data, _split: bool):

        if _data is None:
            return

        split = True if _split is None else _split

        _plines_0 = Grasshopper.DataTree[Rhino.Geometry.Curve]()
        _plines_1 = Grasshopper.DataTree[Rhino.Geometry.Curve]()
        _lines = Grasshopper.DataTree[Rhino.Geometry.Curve]()
        if split == False:
            for i in range(len(_data.plines_with_joints)):
                for j in range(len(_data.plines_with_joints[i])):
                    _plines_0.Add(_data.plines_with_joints[i][j].ToNurbsCurve(), Grasshopper.Kernel.Data.GH_Path(i))
        else:
            for i in range(len(_data.plines_with_joints)):
                for j in range(len(_data.plines_with_joints[i])):
                    if _data.plines_with_joints[i][j].Count == 2:
                        _lines.Add(_data.plines_with_joints[i][j].ToNurbsCurve(), Grasshopper.Kernel.Data.GH_Path(i))
                    else:
                        if j % 2 == 0:
                            print(_data.plines_with_joints[i][j])
                            _plines_0.Add(
                                _data.plines_with_joints[i][j].ToNurbsCurve(), Grasshopper.Kernel.Data.GH_Path(i)
                            )
                        else:
                            _plines_1.Add(
                                _data.plines_with_joints[i][j].ToNurbsCurve(), Grasshopper.Kernel.Data.GH_Path(i)
                            )

        _insertion_vectors = th.list_to_tree(_data.insertion_vectors)
        _joints_per_face = th.list_to_tree(_data.joints_per_face)
        _three_valence = th.list_to_tree(_data.three_valence)
        _adjacency = th.list_to_tree(_data.adjacency)
        _cut_types = th.list_to_tree(_data.cut_types)

        # return outputs if you have them; here I try it for you:
        return (
            _plines_0,
            _plines_1,
            _lines,
            _insertion_vectors,
            _joints_per_face,
            _three_valence,
            _adjacency,
            _cut_types,
        )
# ---------- end input_get ----------
loft_b = Loft_brep(p0=input_get.plines_0, p1=input_get.plines_1)  # -> brep, npc; inputs p0: list of Curve, p1: list of Curve, c: Color; disabled
#   port p0: polylines with holes, bottom
#   port p1: polylines with holes, top
#   port c: color, if given all the brep is colorized else only the sides, this is useful for boolean difference
#   port brep: lofted and capped brep with holes
#   port npc: non planar curves, if not empty something is wrong with joinery algorithm
# ---------- loft_b: Python ----------
"""get joints ids and connections areas between elements"""

__author__ = "petras vestartas"
__version__ = "2023.03.31"


from ghpythonlib.componentbase import executingcomponent as component
import Rhino
from System.Drawing import Color
import System


class connections_zones(component):
    def project_curves_to_plane(self, curves):
        points = []
        for curve in curves:
            for point in curve.Points:
                points.append(point.Location)

        result, plane = Rhino.Geometry.Plane.FitPlaneToPoints(points)

        xform = Rhino.Geometry.Transform.PlanarProjection(plane)
        curves_projected = []
        for curve in curves:
            curve_projected = curve.DuplicateCurve()
            curve_projected.Transform(xform)
            curves_projected.append(curve_projected)
        return curves_projected

    def loft_polylines_with_holes(self, curves0, curves1, color):
        """Loft polylines with holes

        Parameters
        ----------
        curves0 : list[rg.Polyline]
        curves1 : list[rg.Polyline]

        Returns
        -------
        rg.Brep
            brep as lofted polylines and cap them
        """

        ###############################################################################
        # user input
        ###############################################################################

        if curves0 == [None]:
            return
        if curves1 == [None]:
            return

        if len(curves0) == 0:
            return
        if len(curves1) == 0:
            return

        flag = len(curves0) is not 0 if True else len(curves1) != 0
        if flag:
            curves = []
            curves2 = []

            flag0 = len(curves1) == 0
            flag1 = len(curves0) == 0 and len(curves1) != 0
            flag2 = len(curves0) and len(curves1)

            if flag0:
                for i in range(len(curves0)):
                    if float(i) >= float(len(curves0)) * 0.5:
                        curves2.Add(curves0[i])
                    else:
                        curves.Add(curves0[i])
            elif flag1:
                for i in range(0, len(curves1), 2):
                    curves.Add(curves1[i])
                    curves2.Add(curves1[i + 1])
            elif flag2:
                curves = curves0
                curves2 = curves1

            curves0 = curves
            curves1 = curves2

        ###############################################################################
        # Create mesh of the bottom face
        ###############################################################################
        non_planar_curves = []

        brep_0 = Rhino.Geometry.Brep.CreatePlanarBreps(curves0, Rhino.RhinoDoc.ActiveDoc.ModelAbsoluteTolerance)

        if brep_0 is None:
            for c in curves0:
                non_planar_curves.append(c.DuplicateCurve())
            curves0 = self.project_curves_to_plane(curves0)
            brep_0 = Rhino.Geometry.Brep.CreatePlanarBreps(curves0, Rhino.RhinoDoc.ActiveDoc.ModelAbsoluteTolerance)[0]
        else:
            brep_0 = brep_0[0]

        brep_1 = Rhino.Geometry.Brep.CreatePlanarBreps(curves1)

        if brep_1 is None:
            for c in curves1:
                non_planar_curves.append(c.DuplicateCurve())
            curves1 = self.project_curves_to_plane(curves1)
            brep_1 = Rhino.Geometry.Brep.CreatePlanarBreps(curves1, Rhino.RhinoDoc.ActiveDoc.ModelAbsoluteTolerance)[0]
        else:
            brep_1 = brep_1[0]

        ###############################################################################
        # Create lofts
        ###############################################################################
        breps_to_join = [brep_0, brep_1]
        for i in range(len(curves0)):
            wall = Rhino.Geometry.Brep.CreateFromLoft(
                [curves0[i], curves1[i]],
                Rhino.Geometry.Point3d.Unset,
                Rhino.Geometry.Point3d.Unset,
                Rhino.Geometry.LoftType.Normal,
                False,
            )[0]
            breps_to_join.append(wall)

        ###############################################################################
        # Join Brep
        ###############################################################################

        solid = Rhino.Geometry.Brep.JoinBreps(breps_to_join, Rhino.RhinoDoc.ActiveDoc.ModelAbsoluteTolerance)[0]

        faces = []
        for i in range(solid.Faces.Count):
            faces.append(solid.Faces[i].DuplicateFace(False))

        solid = Rhino.Geometry.Brep.JoinBreps(faces, Rhino.RhinoDoc.ActiveDoc.ModelAbsoluteTolerance)[0]

        if solid:
            solid.Faces.SplitKinkyFaces(Rhino.RhinoMath.DefaultAngleTolerance, True)

            if Rhino.Geometry.BrepSolidOrientation.Inward is solid.SolidOrientation:
                solid.Flip()

        if color is not None:
            for i in range(solid.Faces.Count):
                solid.Faces[i].PerFaceColor = color
        else:
            for i in range(solid.Faces.Count):
                if i < 2:
                    solid.Faces[i].PerFaceColor = Color.LightGray  # Color.LightGray
                else:
                    solid.Faces[i].PerFaceColor = Color.DeepPink

        return solid, non_planar_curves

    def RunScript(self,
            _p0: System.Collections.Generic.List[Rhino.Geometry.Curve],
            _p1: System.Collections.Generic.List[Rhino.Geometry.Curve],
            _c: System.Drawing.Color):
        if _p0 and _p1:
            return self.loft_polylines_with_holes(_p0, _p1, _c)
# ---------- end loft_b ----------
item_2 = ListItem(List=flatten(input_get.plines_0), Index=number_slider_2, Wrap=True)
item_3 = ListItem(List=flatten(input_get.plines_1), Index=number_slider_2, Wrap=True)
loft_m = Loft_mesh(p0=item_2, p1=item_3)  # -> mesh; inputs p0: list of Curve, p1: list of Curve
#   port p0: polylines with holes, bottom
#   port p1: polylines with holes, top
#   port mesh: lofted and capped mesh with holes
# ---------- loft_m: Python ----------
"""get joints ids and connections areas between elements"""

__author__ = "petras vestartas"
__version__ = "2024.04.25"

from ghpythonlib.componentbase import executingcomponent as component
import Rhino
import Rhino.Geometry
from System.Drawing import Color
import System


class connections_zones(component):
    def to_polyline_from_cp(self, curve):

        polyline = Rhino.Geometry.Polyline()
        result, polyline1 = curve.TryGetPolyline()

        if result == False:

            nurbsCurve = curve.ToNurbsCurve()
            point3dArray = []

            for i in range(len(nurbsCurve.Points)):
                result, pt = nurbsCurve.Points.GetPoint(i)
                point3dArray.append(pt)

            polyline1 = Rhino.Geometry.Polyline(point3dArray)
            nurbsCurve = polyline1.ToNurbsCurve()
            result, polyline1 = nurbsCurve.TryGetPolyline()

            polyline1.CollapseShortSegments(0.01)

            polyline1 = Rhino.Geometry.Polyline(polyline1)
            polyline = polyline1

        else:
            polyline1.CollapseShortSegments(0.01)
            polyline = polyline1

        return polyline

    def loft_polylines_with_holes(self, curves0, curves1):
        """Loft polylines with holes

        Parameters
        ----------
        curves0 : list[rg.Polyline]
        curves1 : list[rg.Polyline]

        Returns
        -------
        rg.Mesh
            mesh as lofted polylines and cap them
        """

        ###############################################################################
        # user input
        ###############################################################################

        flag = len(curves0) is not 0 if True else len(curves1) != 0
        if flag:

            curves = []
            curves2 = []

            flag0 = len(curves1) == 0
            flag1 = len(curves0) == 0 and len(curves1) != 0
            flag2 = len(curves0) and len(curves1)

            if flag0:
                for i in range(len(curves0)):
                    if float(i) >= float(len(curves0)) * 0.5:
                        curves2.append(curves0[i])
                    else:
                        curves.append(curves0[i])
            elif flag1:
                for i in range(0, len(curves1), 2):
                    curves.append(curves1[i])
                    curves2.append(curves1[i + 1])
            elif flag2:
                curves = curves0
                curves2 = curves1

            curves0 = curves
            curves1 = curves2

        ###############################################################################
        # sort curves which one is border and which ones are holes
        ###############################################################################
        length = -1.0
        border_id = -1
        count = 0
        numArray = []
        for curve in curves0:
            diagonal = curve.GetBoundingBox(True).Diagonal
            temp_length = diagonal.Length
            if temp_length > length:
                length = temp_length
                border_id = count
            count = count + 1

        border0 = self.to_polyline_from_cp(curves0[border_id])
        border1 = self.to_polyline_from_cp(curves1[border_id])
        holes0 = []
        holes1 = []
        for i in range(len(curves0)):
            if i != border_id:
                holes0.append(curves0[i])
                holes1.append(curves1[i])

        ###############################################################################
        # Create mesh of the bottom face
        ###############################################################################
        mesh_bottom = Rhino.Geometry.Mesh.CreatePatch(
            border0, Rhino.RhinoDoc.ActiveDoc.ModelAngleToleranceRadians, None, holes0, None, None, True, 1
        )

        ###############################################################################
        # Convert closed polylines to open ones
        ###############################################################################

        point_3d_array = []
        for i in range(len(mesh_bottom.Vertices)):
            point_3d_array.append(mesh_bottom.Vertices.Point3dAt(i))

        open_curve_points_0 = []
        open_curve_points_1 = []

        for i in range(len(border0) - 1):
            open_curve_points_0.append(border0[i])
            open_curve_points_1.append(border1[i])

        for i in range(len(holes0)):
            holes0_polyline = self.to_polyline_from_cp(holes0[i])
            holes1_polyline = self.to_polyline_from_cp(holes1[i])
            for j in range(len(holes0_polyline) - 1):
                open_curve_points_0.append(holes0_polyline[j])
                open_curve_points_1.append(holes1_polyline[j])

        ###############################################################################
        # Using the bottom mesh vertices create the top mesh f
        ###############################################################################
        points_to_sort_new = self.sort_set_of_points(open_curve_points_0, point_3d_array)
        mesh_top = mesh_bottom.DuplicateMesh()

        for i in range(len(points_to_sort_new)):
            mesh_top.Vertices.SetVertex(i, open_curve_points_1[points_to_sort_new[i]])

        ###############################################################################
        # Merge the top and bottom mesh into one and append sides
        ###############################################################################
        mesh = Rhino.Geometry.Mesh()
        mesh.Append(mesh_bottom)
        mesh.Append(mesh_top)

        count = len(mesh_bottom.Vertices)
        for p in range((mesh_bottom.TopologyEdges).Count):

            if mesh_bottom.TopologyEdges.GetConnectedFaces(p).Length == 1:
                topologyVertices = mesh_bottom.TopologyEdges.GetTopologyVertices(p)
                mesh.Faces.AddFace(
                    topologyVertices.I, topologyVertices.J, topologyVertices.J + count, topologyVertices.I + count
                )

        mesh.UnifyNormals()
        mesh.Ngons.AddPlanarNgons(Rhino.RhinoDoc.ActiveDoc.ModelAbsoluteTolerance * 1, 3, 1, True)
        # return mesh
        ###############################################################################
        # Unweld ngons meshes
        ###############################################################################
        return mesh
        unwelded_ngon_mesh = Rhino.Geometry.Mesh()
        
        count = 0
        for ngonAndFacesEnumerable in mesh.GetNgonAndFacesEnumerable():

            faces = []
            for j in ngonAndFacesEnumerable.FaceIndexList():
                faces.append(System.Int32(j))

            temp_ngon_mesh = mesh.DuplicateMesh().Faces.ExtractFaces(faces)
            temp_ngon_mesh.Ngons.Clear()


            # append colors
            if count < 2:
                temp_ngon_mesh.VertexColors.CreateMonotoneMesh(Color.LightGray)
            else:
                temp_ngon_mesh.VertexColors.CreateMonotoneMesh(Color.DeepPink)

            unwelded_ngon_mesh.Append(temp_ngon_mesh)
            count = count + 1

        ###############################################################################
        # Output
        ###############################################################################
        
        unwelded_ngon_mesh.RebuildNormals()
        # unwelded_ngon_mesh.Ngons.Clear()
        return unwelded_ngon_mesh

    def sort_set_of_points(self, points_to_sort, guide_points):
        """Sort one array of point by an another point array

        use it like this:
        #points_to_sort_new = []
        #for i in points_to_sort_ids:
        #    points_to_sort_new.append(points_to_sort[i])

        Parameters
        ----------
        points_to_sort : list[rg.Point3d]
        guide_points : list[rg.Point3d]

        Returns
        -------
        list[int]
            the list of indices of the sorted array
        """

        # create a copy
        points_to_sort_copy = []
        for i in points_to_sort:
            points_to_sort_copy.append(Rhino.Geometry.Point3d(i))

        guide_points_copy = []
        for i in guide_points:
            guide_points_copy.append(Rhino.Geometry.Point3d(i))

        # make indices of points
        points_to_sort_ids = list(range(0, len(points_to_sort_copy)))
        guide_points_ids = list(range(0, len(guide_points_copy)))

        # sort both lists by xyz coordinates together with indices
        points_to_sort_copy, points_to_sort_ids = zip(*sorted(zip(points_to_sort_copy, points_to_sort_ids)))
        guide_points_copy, guide_points_ids = zip(*sorted(zip(guide_points_copy, guide_points_ids)))

        # sort guide points indices and order the points to sort indec
        guide_points_ids, points_to_sort_ids = zip(*sorted(zip(guide_points_ids, points_to_sort_ids)))

        # can be used like this:
        # points_to_sort_new = []
        # for i in points_to_sort_ids:
        #    points_to_sort_new.append(points_to_sort[i])

        return points_to_sort_ids

    def RunScript(self,
            _p0: System.Collections.Generic.List[Rhino.Geometry.Curve],
            _p1: System.Collections.Generic.List[Rhino.Geometry.Curve]):
        if _p0 and _p1:
            return self.loft_polylines_with_holes(_p0, _p1)
# ---------- end loft_m ----------
panel_2 = Panel(loft_m)
