# Grasshopper definition 0_install.gh (Grasshopper 1.0.8)
# plug-ins: RhinoCodePluginGH

# Just open this file. If there are no errors, all good!
# Else contact petrasvestartas@gmail.com
install = Install()
# ---------- install: Python ----------
"""install compas_wood"""
import System
import Rhino

# r: wood-nano==0.1.1, compas-wood==2.1.0, compas==2.1.1

from wood_nano import test as wood_nano_test
wood_nano_test()
# ---------- end install ----------
