# Grasshopper definition 1_interfaces.gh (Grasshopper 1.0.8)
# plug-ins: RhinoCodePluginGH

# ----
# SOLVER -> JOINTS
crv = Curve([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])

joints = Joints(polylines=crv, id=Slider(22, range=0..100), scale=Slider(1, range=0..1))  # -> polylines_out, element_pairs, joint_areas, joint_areas_mesh, joint_types, element_neighbors; inputs polylines: list of Polyline, id: Int32, scale: Double
#   port polylines: a data-tree of polyline pairs
#   port id: index of xml file, if _polylines are not given
#   port scale: scale polylines
#   port polylines_out: polyline input
#   port joint_areas: polylines that define the connection zones
#   port joint_areas_mesh: mesh that define the connection zones
#   port joint_types: type of connection zone
#   port element_neighbors: ids of neighbors connected to a current element
# ---------- joints: Python ----------
"""get connection zones from polylines and indices of neighboring elements"""
# r: compas_wood, compas, wood_nano
from ghpythonlib.componentbase import executingcomponent as component
import System
from ghpythonlib import treehelpers
import Grasshopper
import Rhino
import os
from wood_nano import read_xml_polylines as wood_nano_read_xml_polylines
from wood_nano import double2
from wood_nano import joints as wood_nano_joints
from wood_nano import int2
from wood_nano import point2
from wood_nano import int1
import compas_wood
from compas_wood.conversions_rhino import to_point2
from compas_wood.conversions_rhino import from_point2
from wood_nano.conversions_python import from_int2
from wood_nano.conversions_python import from_int1


class joints(component):
    def RunScript(self,
            _polylines: System.Collections.Generic.List[Rhino.Geometry.Polyline],
            _id: int,
            _scale: float):

        # ==============================================================================
        # input
        # ==============================================================================
        dataset_index = _id if _id else 0
        module_path = os.path.dirname(compas_wood.__file__)
        foldername = os.path.join(module_path, "datasets")
        foldername = os.path.join(module_path, "datasets") + os.sep
        files = os.listdir(foldername)

        file_names_without_extensions = [os.path.splitext(file)[0] for file in files]
        filename = file_names_without_extensions[dataset_index % len(file_names_without_extensions)]

        scale = _scale if _scale else 1
        xform = Rhino.Geometry.Transform.Scale(Rhino.Geometry.Point3d(0, 0, 0), scale)

        # ==============================================================================
        # xml
        # ==============================================================================

        input_polyline_pairs = []

        if _polylines:
            for polyline in _polylines:
                copy = Rhino.Geometry.Polyline(polyline)
                copy.Transform(xform)
                input_polyline_pairs.append(copy)
        else:
            polylines_coordinates = double2()
            wood_nano_read_xml_polylines(
                foldername,
                filename,
                polylines_coordinates,
            )

            for polyline_coord in polylines_coordinates:
                polyline = Rhino.Geometry.Polyline()
                for i in range(0, len(polyline_coord), 3):
                    polyline.Add(
                        Rhino.Geometry.Point3d(polyline_coord[i], polyline_coord[i + 1], polyline_coord[i + 2])
                    )
                polyline.Transform(xform)
                input_polyline_pairs.append(polyline)

        # ==============================================================================
        # interface detection
        # ==============================================================================
        wood_nano_input_polyline_pairs = to_point2(input_polyline_pairs)
        element_pairs = int2()
        joint_areas = point2()
        joint_types = int1()

        wood_nano_joints(wood_nano_input_polyline_pairs, 2, element_pairs, joint_areas, joint_types)

        tree_element_pairs = treehelpers.list_to_tree(from_int2(element_pairs))
        tree_joint_areas = treehelpers.list_to_tree(from_point2(joint_areas))
        tree_joint_types = treehelpers.list_to_tree(from_int1(joint_types))

        # iterate joints add neighbors to individual elements element
        tree_element_neighbors = Grasshopper.DataTree[int]()
        for i in element_pairs:
            tree_element_neighbors.Add(i[1], Grasshopper.Kernel.Data.GH_Path(i[0]))
            tree_element_neighbors.Add(i[0], Grasshopper.Kernel.Data.GH_Path(i[1]))

        list_joint_areas_mesh = []
        for polyline in tree_joint_areas.AllData():
            polyline.MergeColinearSegments(0.02, True)
            polyline.CollapseShortSegments(0.02)
            list_joint_areas_mesh.append(Rhino.Geometry.Mesh.CreateFromClosedPolyline(polyline))

        return (
            input_polyline_pairs,
            tree_element_pairs,
            tree_joint_areas,
            list_joint_areas_mesh,
            tree_joint_types,
            tree_element_neighbors,
        )
# ---------- end joints ----------

crv_2 = Curve(joints.polylines_out)
int = Integer(joints.element_pairs)
mesh = Mesh(joints.joint_areas_mesh)
crv_3 = Curve(joints.joint_areas)
int_2 = Integer(joints.joint_types)
int_3 = Integer(joints.element_neighbors)
partition = PartitionList(List=crv_2, Size=2)  # -> simplify(Chunks)

# ---- group: Display Joint Types
ss_e_ip = ColourSwatch(SwatchColor=RGB(237, 213, 0))
ss_e_op = ColourSwatch(SwatchColor=RGB(255, 98, 0))
ts_e_p = ColourSwatch(SwatchColor=RGB(0, 191, 255))
cr_c_ip = ColourSwatch(SwatchColor=RGB(27, 209, 151))
tt_e_p = ColourSwatch(SwatchColor=RGB(207, 0, 114))
ss_e_r = ColourSwatch(SwatchColor=RGB(94, 15, 219))
b = ColourSwatch(SwatchColor=RGB(0, 0, 0))
merge = Merge(Data1=ss_e_ip, Data2=ss_e_op, Data3=ts_e_p, Data4=cr_c_ip, Data5=tt_e_p, Data6=ss_e_r, Data7=b)
item = ListItem(List=merge, Index=int_2, Wrap=True)
mcol = MeshColours(Mesh=graft(mesh), Colours=graft(item))

# ---- group: Element Neighbors
number_slider = Slider(1, range=0..8)
branch = TreeBranch(Tree=partition, Path=number_slider, MaintainPaths=True)
branch_2 = TreeBranch(Tree=int_3, Path=number_slider, MaintainPaths=True)
branch_3 = TreeBranch(Tree=partition, Path=branch_2, MaintainPaths=True)
boundary = BoundarySurfaces(Edges=branch)
boundary_2 = BoundarySurfaces(Edges=branch_3)
mcol_2 = MeshColours(Mesh=boundary_2, Colours=ColourSwatch(SwatchColor=RGB(0, 170, 255)))
mcol_3 = MeshColours(Mesh=boundary, Colours=ColourSwatch(SwatchColor=RGB(255, 0, 161)))

# ---- group: Element Pairs
branch_4 = TreeBranch(Tree=simplify(int), Path=Slider(5, range=0..8), MaintainPaths=True)
item_2 = ListItem(List=branch_4, Index=[0, 1], Wrap=True)
branch_5 = TreeBranch(Tree=partition, Path=item_2, MaintainPaths=True)
bang = ExplodeTree(Data=branch_5)  # -> Branch0, Branch1
boundary_3 = BoundarySurfaces(Edges=bang.Branch0)
boundary_4 = BoundarySurfaces(Edges=bang.Branch1)
mcol_4 = MeshColours(Mesh=boundary_3, Colours=ColourSwatch(SwatchColor=RGB(255, 0, 161)))
mcol_5 = MeshColours(Mesh=boundary_4, Colours=ColourSwatch(SwatchColor=RGB(0, 170, 255)))
