# Grasshopper definition hexagonal_shell.gh (Grasshopper 1.0.7)
# plug-ins: NGon

brep = Brep(<brep referenced from the Rhino model>)
hexdivide = HexDivide(
    Surface=brep,
    U=Slider(10, range=0..10),
    V=Slider(10, range=0..10),
    Parameter=Slider(0.4, range=0..1),
    Boundary=-1,
    Swap=True,
    Rebuild=-1,
    Quadrangulate=False,
    Divisions=True,
    Explode=False)  # -> Mesh, DistA, DistB
top = GetPolylines(Mesh=hexdivide.Mesh)
fromp = FromPolylines(Curves=top, Min_Triangulation=False)
planar = PlanarFaces(Mesh=hexdivide.Mesh)  # -> Polylines, Lines
extrude_edges = ExtrudeEdges(Mesh=fromp, Dist=Slider(8, range=0..1000), Cap=invert(False), Merge=False, BothSides=invert(False))
boundary = BoundarySurfaces(Edges=planar.Polylines)
X = UnitX(Factor=1)
number_slider = Slider(100, range=0..100)
number_slider_2 = Slider(-2, range=-10..-2)
display = CurvePreview()

brep_2 = Brep(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)
hexdivide_2 = HexDivide(
    Surface=brep_2,
    U=Slider(20, range=0..20),
    V=Slider(11, range=0..20),
    Parameter=0.25,
    Boundary=0,
    Swap=True,
    Rebuild=9,
    Quadrangulate=False,
    Divisions=False,
    Explode=True)  # -> Mesh, DistA, DistB
number_slider_3 = Slider(8, range=0..18)
top_2 = GetPolylines(Mesh=hexdivide.Mesh)

# ---- group: Use min triangulation
fromp_2 = FromPolylines(Curves=top_2, Min_Triangulation=False)

# ---- group: Keep Track of merged extruded mesh and offset mesh
offsetmesh = OffsetMesh(Mesh=fromp_2, Dist=expr("-1", number_slider_3), Solid=False)
extrude_edges_2 = ExtrudeEdges(Mesh=fromp_2, Dist=number_slider_3, Cap=False, Merge=invert(False), BothSides=invert(False))
mjoin = MeshJoin(Meshes=[fromp_2, offsetmesh])

# ----
planarize2 = Planarize2(
    Mesh=extrude_edges_2,
    Tangential=0.0001,
    Iterations=Slider(1000, range=0..1000),
    StaticSolver=invert(False),
    Run=invert(False),
    Reset=False)
panel = Panel(mjoin)
panel_2 = Panel(planarize2)

# ---- group: Adjust vertex positions
matchmesh = AdjustMeshVertices(MeshA=mjoin, MeshB=planarize2)

# ----
projectpairs = ProjectPairs(Mesh=matchmesh, Scale=Slider(3, range=0..3))  # -> Mesh, Plines

# ---- group: Check if planar
getpolylines = GetPolylines(Mesh=planarize2)
boundary_2 = BoundarySurfaces(Edges=graft(projectpairs.Plines))

# ----
crv = Curve(projectpairs.Plines)

# ---- group: Display
weldmesh = WeldMesh(Mesh=projectpairs.Mesh, Radius=Slider(-3, range=-10..-3), Align=False, Use_RTree=False)

# ----
planar_2 = IsPlanar(Surface=boundary_2, Interior=True)  # -> Planar, Plane
top_3 = GetPolylines(Mesh=weldmesh)
item = ListItem(List=projectpairs.Plines, Index=0, Wrap=True)  # -> Item, Item1
align = AlignPlane(Plane=planar_2.Plane, Direction=X)  # -> Plane, Angle
loft = LoftPolylines(Curve0=projectpairs.Plines, Fast=invert(True))
top_4 = GetPolylines(Mesh=loft)
pcen = PolygonCenter(Polyline=projectpairs.Plines)  # -> CenterV, CenterE, CenterA
pdecon = Deconstruct(Point=pcen.CenterV)  # -> XComponent, YComponent, ZComponent
pt = Point(pcen.CenterV)
sort = SortList(Keys=pdecon.ZComponent, ValuesA=projectpairs.Plines)  # -> Keys, ValuesA
split = SplitList(List=sort.ValuesA, Index=Slider(1, range=0..1))  # -> ListA, ListB
loft_2 = Loft(
    Curves=projectpairs.Plines,
    Options={Adjust=False, Closed=False, LoftEnds=0, LoftSimp=0, LoftType=0, Rebuild=10, Refit=0.01})  # -> simplify(Loft)
boundary_3 = BoundarySurfaces(Edges=graft(item.Item1))  # -> simplify(Surfaces)
join = BrepJoin(Breps=[loft_2, boundary_3])  # -> Breps, Closed
