# Grasshopper definition joint_to_xml.gh (Grasshopper 1.0.7)

# ---- group: Butterfly Key Plates
crv = Curve([<curve referenced from the Rhino model> x2])
crv_2 = Curve(crv)
end = EndPoints(Curve=crv)  # -> Start, End
end_2 = EndPoints(Curve=crv_2)  # -> Start, End
ln = Line(StartPoint=end.Start, EndPoint=end.End)
ln_2 = Line(StartPoint=end_2.Start, EndPoint=end_2.End)
crv_3 = Curve([crv, ln])
crv_4 = Curve([crv_2, ln_2])
cp = ControlPoints(Curve=crv_3)  # -> Points, Weights, Knots
cp_2 = ControlPoints(Curve=crv_4)  # -> Points, Weights, Knots
pline = PolyLine(Vertices=cp.Points, Closed=False)  # -> flatten(Polyline)
pline_2 = PolyLine(Vertices=cp_2.Points, Closed=False)  # -> flatten(Polyline)
panel = Panel("""1
1""")
panel_2 = Panel("""1
1""")
c_script = CSharpScript(type="1", plines0=pline, plines1=pline_2, bool0=panel_2, bool1=panel, unit_scale=Toggle(True))  # -> out, joint; inputs type: Int32, plines0: list, plines1: list, bool0: list of Int32, bool1: list of Int32, unit_scale: Int32
# ---------- c_script: C# ----------
    joint = new Grasshopper.Kernel.Types.GH_ObjectWrapper (new List < object > {type, plines0, plines1, bool0, bool1,unit_scale});
    this.Component.Message = " Plines order \n Top,Bottom,Top,Bottom ";
# ---------- end c_script ----------

crv_5 = Curve([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])
crv_6 = Curve([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])
end_3 = EndPoints(Curve=crv_5)  # -> Start, End
end_4 = EndPoints(Curve=crv_6)  # -> Start, End
ln_3 = Line(StartPoint=end_3.Start, EndPoint=end_3.End)
ln_4 = Line(StartPoint=end_4.Start, EndPoint=end_4.End)
crv_7 = Curve([crv_5, ln_3])
crv_8 = Curve([crv_6, ln_4])
cp_3 = ControlPoints(Curve=crv_7)  # -> Points, Weights, Knots
cp_4 = ControlPoints(Curve=crv_8)  # -> Points, Weights, Knots
pline_3 = PolyLine(Vertices=cp_3.Points, Closed=False)  # -> flatten(Polyline)
pline_4 = PolyLine(Vertices=cp_4.Points, Closed=False)  # -> flatten(Polyline)
panel_3 = Panel("""1
1""")
panel_4 = Panel("""1
1""")
c_script_2 = CSharpScript(type="0", plines0=pline_3, plines1=pline_4, bool0=panel_4, bool1=panel_3, unit_scale=Toggle(True))  # -> out, joint; inputs type: Int32, plines0: list, plines1: list, bool0: list of Int32, bool1: list of Int32, unit_scale: Int32; same code as c_script

# ----
panel_5 = Panel("""0
0""")
panel_6 = Panel("""0
0""")
crv_9 = Curve([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])
panel_7 = Panel("""2
1""")
entwine = Entwine(Branch00=crv_9, Branch01=crv_9, FlattenInputs=True)
entwine_2 = Entwine(Branch00=panel_5, Branch01=panel_5, FlattenInputs=True)
entwine_3 = Entwine(Branch00=panel_6, Branch01=panel_6, FlattenInputs=True)
c_script_3 = CSharpScript(type=panel_7, plines0=entwine, plines1=entwine, bool0=entwine_2, bool1=entwine_3)  # -> out, A; inputs type: list of Int32, plines0: tree of Polyline, plines1: tree of Polyline, bool0: tree of Int32, bool1: tree of Int32
# ---------- c_script_3: C# ----------
    XmlWriter xmlWriter = XmlWriter.Create("C:\\Users\\petra\\Desktop\\New folder\\joint_library.xml");
    xmlWriter.WriteStartDocument();


    /////////////////////////////////////////////////////////////////////////////////////////////////////////////////////////////////////////////
    //Start document
    /////////////////////////////////////////////////////////////////////////////////////////////////////////////////////////////////////////////
    xmlWriter.WriteStartElement("custom_joints");
    for(int i = 0; i < type.Count;i++){
      write_joint(ref xmlWriter, type[i], plines0.Branch(i), plines1.Branch(i), bool0.Branch(i), bool1.Branch(i));
      Print("hi");
    }

    /////////////////////////////////////////////////////////////////////////////////////////////////////////////////////////////////////////////
    //End document
    /////////////////////////////////////////////////////////////////////////////////////////////////////////////////////////////////////////////
    xmlWriter.WriteEndDocument();
    xmlWriter.Close();
# ---------- c_script_3: C# additional code ----------
  public void write_joint(ref XmlWriter xmlWriter, int type, List<Polyline> plines0, List<Polyline> plines1, List<int> bool0, List<int> bool1){

    string joint_name = "";
    switch (type) {
      case(0):
      case(12):
        joint_name = "ss_e_ip_9";
        break;
      case(1):
      case(11):
        joint_name = "ss_e_op_9";
        break;
      case(2):
      case(20):
        joint_name = "ts_e_p_9";
        break;
      case(3):
      case(30):
        joint_name = "cr_c_ip_9";
        break;
      case(4):
      case(40):
        joint_name = "tt_e_p_9";
        break;
      case(5):
      case(50):
        joint_name = "ss_e_r_9";
        break;
    }

    /////////////////////////////////////////////////////////////////////////////////////////////////////////////////////////////////////////////
    //Start document
    /////////////////////////////////////////////////////////////////////////////////////////////////////////////////////////////////////////////
    xmlWriter.WriteStartElement(joint_name);

    for(int i = 0; i < plines0.Count; i++){
      string name = i % 2 == 0 ? "f0" : "f1";
      xml_polyline(ref xmlWriter, plines0[i], name);
    }

    for(int i = 0; i < plines1.Count; i++){
      string name = i % 2 == 0 ? "m0" : "m1";
      xml_polyline(ref xmlWriter, plines0[i], name);
    }

    xml_int_list(ref xmlWriter, bool0, "f_boolean_type");
    xml_int_list(ref xmlWriter, bool1, "m_boolean_type");

    xmlWriter.WriteEndElement();
    /////////////////////////////////////////////////////////////////////////////////////////////////////////////////////////////////////////////
    //End document
    /////////////////////////////////////////////////////////////////////////////////////////////////////////////////////////////////////////////


  }

  public void xml_int_list(ref XmlWriter xmlWriter, List<int> numbers, string name){
    xmlWriter.WriteStartElement(name);
    foreach(int n in numbers){

      xmlWriter.WriteStartElement("char");
      xmlWriter.WriteString(n.ToString());
      xmlWriter.WriteEndElement();

    }
    xmlWriter.WriteEndElement();
  }

  public void xml_polyline(ref XmlWriter xmlWriter, Polyline pline, string name){
    xmlWriter.WriteStartElement(name);
    foreach(Point3d p in pline){

      xmlWriter.WriteStartElement("point");

      xmlWriter.WriteStartElement("x");
      xmlWriter.WriteString(p.X.ToString());
      xmlWriter.WriteEndElement();

      xmlWriter.WriteStartElement("y");
      xmlWriter.WriteString(p.Y.ToString());
      xmlWriter.WriteEndElement();

      xmlWriter.WriteStartElement("z");
      xmlWriter.WriteString(p.Z.ToString());
      xmlWriter.WriteEndElement();

      xmlWriter.WriteEndElement();
    }
    xmlWriter.WriteEndElement();
  }
# ---------- end c_script_3 ----------

crv_10 = Curve([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])
crv_11 = Curve([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])
crv_12 = Curve([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])
crv_13 = Curve([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])
crv_14 = Curve([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])
crv_15 = Curve([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])
crv_16 = Curve([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])
crv_17 = Curve([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])
merge = Merge(Data1=crv_13, Data2=crv_14, Data3=crv_15, Data4=crv_16)
merge_2 = Merge(Data1=crv_10, Data2=crv_11, Data3=crv_12, Data4=crv_17)
panel_8 = Panel("""6
6
6
6""")
Z = UnitZ(Factor=-1)
move = Move(Geometry=merge_2, Motion=Z)  # -> Geometry, Transform
move_2 = Move(Geometry=merge, Motion=Z)  # -> Geometry, Transform
xz = XZPlane(Origin=Point(0, 0, 0))
panel_9 = Panel("""1
1""")
rotate = Rotate(Geometry=move.Geometry, Angle=degrees(180), Plane=xz)  # -> Geometry, Transform
rotate_2 = Rotate(Geometry=move_2.Geometry, Angle=degrees(180), Plane=xz)  # -> Geometry, Transform
yz = YZPlane(Origin=Point(0, 0, 0))
xz_2 = XZPlane(Origin=Point(0, 0, 0))
rotate_3 = Rotate(Geometry=rotate.Geometry, Angle=degrees(90), Plane=yz)  # -> Geometry, Transform
rotate_4 = Rotate(Geometry=rotate_2.Geometry, Angle=degrees(90), Plane=yz)  # -> Geometry, Transform
c_script_4 = CSharpScript(type="2", plines0=rotate_4.Geometry, plines1=rotate_3.Geometry, bool0=panel_8, bool1=panel_8, unit_scale=Toggle(True))  # -> out, joint; inputs type: Int32, plines0: list, plines1: list, bool0: list of Int32, bool1: list of Int32, unit_scale: Int32; same code as c_script

# ---- group: write_xml
merge_3 = Merge(Data1=c_script_2.joint, Data2=c_script.joint, Data3=c_script_4.joint)
path = FilePath("C:\Users\petra\AppData\Roaming\Grasshopper\Libraries\compas_wood\joinery_library.xml")
c_script_5 = CSharpScript(path=path, tiles=merge_3)  # -> out, A; inputs path: String, tiles: list
# ---------- c_script_5: C# ----------
    try{
      //Print(joint.GetType().ToString());
      //Tuple<int,List<Polyline>,List<Polyline>,List<int>,List<int>> joint_params = (Tuple<int,List<Polyline>,List<Polyline>,List<int>,List<int>> )joint;

      XmlWriter xmlWriter = XmlWriter.Create(path);
      xmlWriter.WriteStartDocument();

      /////////////////////////////////////////////////////////////////////////////////////////////////////////////////////////////////////////////
      //Start document
      /////////////////////////////////////////////////////////////////////////////////////////////////////////////////////////////////////////////
      xmlWriter.WriteStartElement("custom_joints");
      for(int i = 0; i < tiles.Count;i++){
        var list = ((List < object >) tiles[i]);

        var type = (int) (Object) list[0];
        Print(type.ToString());
        var plines0 = new List<Polyline>();
        var plines1 = new List<Polyline>();
        var bool0 = (List<int>) list[3];
        var bool1 = (List<int>) list[4];
        var unit_scale = (int) (Object) list[5];

        foreach(var o in (List<Object>) list[1]){
          PolylineCurve pcurve = (PolylineCurve) o;
          Polyline pline;
          pcurve.TryGetPolyline(out pline);
          plines0.Add(pline);
        }


        foreach(var o in (List<Object>) list[2]){
          PolylineCurve pcurve = (PolylineCurve) o;
          Polyline pline;
          pcurve.TryGetPolyline(out pline);
          plines1.Add(pline);
        }



        if(plines0.Count == bool0.Count * 2 && plines1.Count == bool1.Count * 2)
          write_joint(ref xmlWriter, type, plines0, plines1, bool0, bool1, unit_scale);
        else{
          this.Component.AddRuntimeMessage(GH_RuntimeMessageLevel.Error,
            String.Format("Number of polylines must be equal to (number of booleans)*2 \n plines0 - {0}, bool0 - {1}, plines1 - {2}, bool1 - {3}", plines0.Count, bool0.Count, plines1.Count, bool1.Count));
        }

      }

      /////////////////////////////////////////////////////////////////////////////////////////////////////////////////////////////////////////////
      //End document
      /////////////////////////////////////////////////////////////////////////////////////////////////////////////////////////////////////////////
      xmlWriter.WriteEndDocument();
      xmlWriter.Close();
    }catch(Exception e){
      Rhino.RhinoApp.WriteLine(e.ToString());
    }
# ---------- c_script_5: C# additional code ----------
  public void write_joint(ref XmlWriter xmlWriter, int type, List<Polyline> plines0, List<Polyline> plines1, List<int> bool0, List<int> bool1, int unit_scale){

    string joint_name = "";
    switch (type) {
      case(0):
      case(12):
        joint_name = "ss_e_ip_9";
        break;
      case(1):
      case(11):
        joint_name = "ss_e_op_9";
        break;
      case(2):
      case(20):
        joint_name = "ts_e_p_9";
        break;
      case(3):
      case(30):
        joint_name = "cr_c_ip_9";
        break;
      case(4):
      case(40):
        joint_name = "tt_e_p_9";
        break;
      case(5):
      case(50):
        joint_name = "ss_e_r_9";
        break;
    }

    /////////////////////////////////////////////////////////////////////////////////////////////////////////////////////////////////////////////
    //Start document
    /////////////////////////////////////////////////////////////////////////////////////////////////////////////////////////////////////////////
    xmlWriter.WriteStartElement(joint_name);

    for(int i = 0; i < plines0.Count; i++){
      string name = i % 2 == 0 ? "f0" : "f1";
      xml_polyline(ref xmlWriter, plines0[i], name);
    }

    for(int i = 0; i < plines1.Count; i++){
      string name = i % 2 == 0 ? "m0" : "m1";
      xml_polyline(ref xmlWriter, plines1[i], name);
    }

    xml_int_list(ref xmlWriter, bool0, "f_boolean_type");
    xml_int_list(ref xmlWriter, bool1, "m_boolean_type");
    xml_int_list(ref xmlWriter, new List<int>{unit_scale}, "properties");

    xmlWriter.WriteEndElement();
    /////////////////////////////////////////////////////////////////////////////////////////////////////////////////////////////////////////////
    //End document
    /////////////////////////////////////////////////////////////////////////////////////////////////////////////////////////////////////////////


  }

  public void xml_int_list(ref XmlWriter xmlWriter, List<int> numbers, string name){
    xmlWriter.WriteStartElement(name);
    foreach(int n in numbers){

      xmlWriter.WriteStartElement("id");
      xmlWriter.WriteString(n.ToString());
      xmlWriter.WriteEndElement();

    }
    xmlWriter.WriteEndElement();
  }

  public void xml_polyline(ref XmlWriter xmlWriter, Polyline pline, string name){
    xmlWriter.WriteStartElement(name);
    foreach(Point3d p in pline){

      xmlWriter.WriteStartElement("point");

      xmlWriter.WriteStartElement("x");
      xmlWriter.WriteString(Math.Round(p.X,10).ToString());
      xmlWriter.WriteEndElement();

      xmlWriter.WriteStartElement("y");
      xmlWriter.WriteString(Math.Round(p.Y,10).ToString());
      xmlWriter.WriteEndElement();

      xmlWriter.WriteStartElement("z");
      xmlWriter.WriteString(Math.Round(p.Z,10).ToString());
      xmlWriter.WriteEndElement();

      xmlWriter.WriteEndElement();
    }
    xmlWriter.WriteEndElement();
  }
# ---------- end c_script_5 ----------

# ----
xml_tree = Xml_tree()
panel_10 = Panel(merge_3)
panel_11 = Panel(c_script_5.out)
panel_12 = Panel(path)

# ==== cluster Xml_tree: xml_tree

panel = Panel("""0
0""")
panel_2 = Panel("""0
0""")
crv = Curve([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])
panel_3 = Panel("""2
1""")
entwine = Entwine(Branch00=crv, Branch01=crv, FlattenInputs=True)
entwine_2 = Entwine(Branch00=panel, Branch01=panel, FlattenInputs=True)
entwine_3 = Entwine(Branch00=panel_2, Branch01=panel_2, FlattenInputs=True)
c_script = CSharpScript(type=panel_3, plines0=entwine, plines1=entwine, bool0=entwine_2, bool1=entwine_3)  # -> out, A; inputs type: list of Int32, plines0: tree of Polyline, plines1: tree of Polyline, bool0: tree of Int32, bool1: tree of Int32
# ---------- c_script: C# usings ----------
using System.Xml;
# ---------- c_script: C# ----------
    XmlWriter xmlWriter = XmlWriter.Create("C:\\Users\\petra\\Desktop\\New folder\\joint_library.xml");
    xmlWriter.WriteStartDocument();


    /////////////////////////////////////////////////////////////////////////////////////////////////////////////////////////////////////////////
    //Start document
    /////////////////////////////////////////////////////////////////////////////////////////////////////////////////////////////////////////////
    xmlWriter.WriteStartElement("custom_joints");
    for(int i = 0; i < type.Count;i++){
      write_joint(ref xmlWriter, type[i], plines0.Branch(i), plines1.Branch(i), bool0.Branch(i), bool1.Branch(i));
      Print("hi");
    }

    /////////////////////////////////////////////////////////////////////////////////////////////////////////////////////////////////////////////
    //End document
    /////////////////////////////////////////////////////////////////////////////////////////////////////////////////////////////////////////////
    xmlWriter.WriteEndDocument();
    xmlWriter.Close();
# ---------- c_script: C# additional code ----------
  public void write_joint(ref XmlWriter xmlWriter, int type, List<Polyline> plines0, List<Polyline> plines1, List<int> bool0, List<int> bool1){

    string joint_name = "";
    switch (type) {
      case(0):
      case(12):
        joint_name = "ss_e_ip_9";
        break;
      case(1):
      case(11):
        joint_name = "ss_e_op_9";
        break;
      case(2):
      case(20):
        joint_name = "ts_e_p_9";
        break;
      case(3):
      case(30):
        joint_name = "cr_c_ip_9";
        break;
      case(4):
      case(40):
        joint_name = "tt_e_p_9";
        break;
      case(5):
      case(50):
        joint_name = "ss_e_r_9";
        break;
    }

    /////////////////////////////////////////////////////////////////////////////////////////////////////////////////////////////////////////////
    //Start document
    /////////////////////////////////////////////////////////////////////////////////////////////////////////////////////////////////////////////
    xmlWriter.WriteStartElement(joint_name);

    for(int i = 0; i < plines0.Count; i++){
      string name = i % 2 == 0 ? "f0" : "f1";
      xml_polyline(ref xmlWriter, plines0[i], name);
    }

    for(int i = 0; i < plines1.Count; i++){
      string name = i % 2 == 0 ? "m0" : "m1";
      xml_polyline(ref xmlWriter, plines0[i], name);
    }

    xml_int_list(ref xmlWriter, bool0, "f_boolean_type");
    xml_int_list(ref xmlWriter, bool1, "m_boolean_type");

xmlWriter.WriteEndElement();
    /////////////////////////////////////////////////////////////////////////////////////////////////////////////////////////////////////////////
    //End document
    /////////////////////////////////////////////////////////////////////////////////////////////////////////////////////////////////////////////


  }

  public void xml_int_list(ref XmlWriter xmlWriter, List<int> numbers, string name){
    xmlWriter.WriteStartElement(name);
    foreach(int n in numbers){

      xmlWriter.WriteStartElement("char");
      xmlWriter.WriteString(n.ToString());
      xmlWriter.WriteEndElement();

    }
    xmlWriter.WriteEndElement();
  }

  public void xml_polyline(ref XmlWriter xmlWriter, Polyline pline, string name){
    xmlWriter.WriteStartElement(name);
    foreach(Point3d p in pline){

      xmlWriter.WriteStartElement("point");

      xmlWriter.WriteStartElement("x");
      xmlWriter.WriteString(p.X.ToString());
      xmlWriter.WriteEndElement();

      xmlWriter.WriteStartElement("y");
      xmlWriter.WriteString(p.Y.ToString());
      xmlWriter.WriteEndElement();

      xmlWriter.WriteStartElement("z");
      xmlWriter.WriteString(p.Z.ToString());
      xmlWriter.WriteEndElement();

      xmlWriter.WriteEndElement();
    }
    xmlWriter.WriteEndElement();
  }
# ---------- end c_script ----------

out = ClusterOutput(c_script.out)
