# Grasshopper definition parametric_joints.gh (Grasshopper 1.0.7)
# plug-ins: ghgl, NGon

crv = Curve([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])
c_script = CSharpScript(rect_pair=crv)  # -> out, A, B, C; inputs rect_pair: list of Polyline
# ---------- c_script: C# ----------
   
        this.Component.Message = " ss_e_op_1 Nejiri Arigata";
    ////////////////////////////////////////////////////////////////////
    //Number of divisions
    //Input joint line (its lengths)
    //Input distance for division
    ////////////////////////////////////////////////////////////////////
    double joint_length = Math.Abs(500);
    double division_distance = Math.Abs(60);
    int divisions = (int) Math.Ceiling(joint_length / division_distance);
    divisions = (int) Math.Max(2, Math.Min(20, divisions));
    divisions += divisions % 2;
    ////////////////////////////////////////////////////////////////////
    //Interpolate points
    ////////////////////////////////////////////////////////////////////
    Point3d[][] arrays = new Point3d[4][];
    for(int i = 0; i < 4; i++)
      arrays[i] = InterpolatePoints(rect_pair[0][i], rect_pair[1][i], divisions, false);

    ////////////////////////////////////////////////////////////////////
    //Move segments
    ////////////////////////////////////////////////////////////////////
    int start = 0;
    double t = 0.25;
    Vector3d v = t == 0 ? Vector3d.Zero : new Vector3d(0, 0, t / (divisions + 2));
    for(int i = start; i < 4; i++){

      int mid = (int) (arrays[i].Length * 0.5);

      for(int j = 0; j < arrays[i].Length; j++){

        int flip = (j < arrays[i].Length * 0.5) ? 1 : -1;

        if( i == 1 ){
          if( j < (mid - 1) || j > mid )
            arrays[i][j] -= 4 * v * flip;
        }else if(i == 0 || i == 2 ){
          if( j < (mid - 1) || j > mid )
            arrays[i][j] -= 2 * v * flip;
        }

        //        if(j < (mid - 1))
        //          arrays[i][j] -= v * 3;
        //        else if()

      }
    }

    ////////////////////////////////////////////////////////////////////
    //Create Polylines
    ////////////////////////////////////////////////////////////////////
    Polyline[] m_0 = new Polyline[2];
    Polyline[] m_1 = new Polyline[2];
    Polyline[] f_0 = new Polyline[2];
    Polyline[] f_1 = new Polyline[2];


    for(int i = 0; i < 4;i += 2){
      Polyline pline = new Polyline();
      for(int j = 0; j < arrays[0].Length; j++){

        bool flip = j % 2 < 1;
        flip = i < 2 ? flip : !flip;

        if(flip){
          pline.Add(arrays[i + 0][j]);
          pline.Add(arrays[i + 1][j]);
        } else{
          pline.Add(arrays[i + 1][j]);
          pline.Add(arrays[i + 0][j]);
        }

      }

      if(i < 2){
        m_1[0] = pline;
        m_1[1] = new Polyline(){pline[0],pline[pline.Count - 1]};
      }else{
        m_0[0] = pline;
        m_0[1] = new Polyline(){pline[0],pline[pline.Count - 1]};
      }
    }

    for(int i = 1; i < 4;i += 2){
      Polyline pline = new Polyline();
      for(int j = 0; j < arrays[0].Length; j++){

        bool flip = j % 2 == 0;
        flip = i < 2 ? flip : !flip;

        if(flip){
          pline.Add(arrays[i + 0][j]);
          pline.Add(arrays[(i + 1) % 4][j]);
        } else{
          pline.Add(arrays[(i + 1) % 4][j]);
          pline.Add(arrays[i + 0][j]);
        }

      }

      if(i < 2){
        f_0[0] = pline;
        f_0[1] = new Polyline(){pline[0],pline[pline.Count - 1]};
      }else{
        f_1[0] = pline;
        f_1[1] = new Polyline(){pline[0],pline[pline.Count - 1]};
      }
    }



    ////////////////////////////////////////////////////////////////////
    //Output
    ////////////////////////////////////////////////////////////////////

    var dt = new DataTree<Polyline>();
    dt.AddRange(m_0, new GH_Path(0));
    dt.AddRange(m_1, new GH_Path(0));
    dt.AddRange(f_0, new GH_Path(0));
    dt.AddRange(f_1, new GH_Path(0));
    A = dt;
    B = arrays;
    C = "ss_e_op_0_" + divisions.ToString();
# ---------- c_script: C# additional code ----------
  public  Point3d[] InterpolatePoints(Point3d from, Point3d to, int Steps, bool includeEnds = true) {
    Point3d[] point3DArray;

    if (includeEnds) {
      point3DArray = new Point3d[Steps + 2];
      point3DArray[0] = from;

      for (int i = 1; i < Steps + 1; i++) {
        double num = i / (double) (1 + Steps);

        point3DArray[i] = new Point3d(
          Lerp(from.X, to.X, num),
          Lerp(from.Y, to.Y, num),
          Lerp(from.Z, to.Z, num)
          );
      }

      point3DArray[point3DArray.Length - 1] = to;
    } else {

      point3DArray = new Point3d[Steps];

      for (int i = 1; i < Steps + 1; i++) {
        double num = i / (double) (1 + Steps);

        point3DArray[i - 1] = new Point3d(
          Lerp(from.X, to.X, num),
          Lerp(from.Y, to.Y, num),
          Lerp(from.Z, to.Z, num)
          );
      }
    }

    return point3DArray;


  }

  public double Lerp(double value1, double value2, double amount) {
    return value1 + (value2 - value1) * amount;
  }

  /// <summary>
  /// This method will be called once every solution, before any calls to RunScript.
  /// </summary>
  public override void BeforeRunScript()
  { }
  /// <summary>
  /// This method will be called once every solution, after any calls to RunScript.
  /// </summary>
  public override void AfterRunScript()
  { }
# ---------- end c_script ----------
clean = CleanTree(RemoveNulls=True, RemoveInvalid=True, RemoveEmpty=invert(False), Tree=c_script.A)
item = ListItem(List=clean, Index=0, Wrap=True)  # -> Item, Item1, Item2, Item3, Item4, Item5, Item6, Item7
crv_2 = Curve([item.Item4, item.Item6])
crv_3 = Curve([item.Item, item.Item2])
loft = Loft(Curves=crv_2, Options={Adjust=False, Closed=False, LoftEnds=0, LoftSimp=0, LoftType=0, Rebuild=10, Refit=0.01})
loft_2 = Loft(Curves=crv_3, Options={Adjust=False, Closed=False, LoftEnds=0, LoftSimp=0, LoftType=0, Rebuild=10, Refit=0.01})

crv_4 = Curve([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])
c_script_2 = CSharpScript(rect_pair=crv_4)  # -> out, A, B, C; inputs rect_pair: list of Polyline
# ---------- c_script_2: C# ----------
    this.Component.Message = "ss_e_op_2 Dovetail";
    ////////////////////////////////////////////////////////////////////
    //Number of divisions
    //Input joint line (its lengths)
    //Input distance for division
    ////////////////////////////////////////////////////////////////////
    double joint_length = Math.Abs(500);
    double division_distance = Math.Abs(60);
    int divisions = (int) Math.Ceiling(joint_length / division_distance);
    divisions = (int) Math.Max(2, Math.Min(20, divisions));
    divisions += divisions % 2;
    ////////////////////////////////////////////////////////////////////
    //Interpolate points
    ////////////////////////////////////////////////////////////////////
    Point3d[][] arrays = new Point3d[4][];
    for(int i = 0; i < 4; i++)
      arrays[i] = InterpolatePoints(rect_pair[0][i], rect_pair[1][i], divisions, false);

    ////////////////////////////////////////////////////////////////////
    //Move segments
    ////////////////////////////////////////////////////////////////////
    int start = 0;
    double t = 0.1;
    Vector3d v = t == 0 ? Vector3d.Zero : new Vector3d(0, 0, t / (divisions + 2));
    for(int i = start; i < 4; i++){

      int mid = (int) (arrays[i].Length * 0.5);

      for(int j = 0; j < arrays[i].Length; j++){

        int flip = (j % 2 == 0) ? 1 : -1;
        flip = i < 2 ? flip : flip * -1;

        arrays[i][j] += v * flip;



      }
    }

    ////////////////////////////////////////////////////////////////////
    //Create Polylines
    ////////////////////////////////////////////////////////////////////
    Polyline[] m_0 = new Polyline[2];
    Polyline[] m_1 = new Polyline[2];
    Polyline[] f_0 = new Polyline[2];
    Polyline[] f_1 = new Polyline[2];


    for(int i = 0; i < 4;i += 2){
      Polyline pline = new Polyline();
      for(int j = 0; j < arrays[0].Length; j++){

        bool flip = j % 2 < 1;
        flip = i < 2 ? flip : !flip;

        if(flip){
          pline.Add(arrays[i + 0][j]);
          pline.Add(arrays[i + 1][j]);
        } else{
          pline.Add(arrays[i + 1][j]);
          pline.Add(arrays[i + 0][j]);
        }

      }

      if(i < 2){
        m_1[0] = pline;
        m_1[1] = new Polyline(){pline[0],pline[pline.Count - 1]};
      }else{
        m_0[0] = pline;
        m_0[1] = new Polyline(){pline[0],pline[pline.Count - 1]};
      }
    }

    for(int i = 1; i < 4;i += 2){
      Polyline pline = new Polyline();
      for(int j = 0; j < arrays[0].Length; j++){

        bool flip = j % 2 == 0;
        flip = i < 2 ? flip : !flip;

        if(flip){
          pline.Add(arrays[i + 0][j]);
          pline.Add(arrays[(i + 1) % 4][j]);
        } else{
          pline.Add(arrays[(i + 1) % 4][j]);
          pline.Add(arrays[i + 0][j]);
        }

      }

      if(i < 2){
        f_0[0] = pline;
        f_0[1] = new Polyline(){pline[0],pline[pline.Count - 1]};
      }else{
        f_1[0] = pline;
        f_1[1] = new Polyline(){pline[0],pline[pline.Count - 1]};
      }
    }



    ////////////////////////////////////////////////////////////////////
    //Output
    ////////////////////////////////////////////////////////////////////

    var dt = new DataTree<Polyline>();
    dt.AddRange(m_0, new GH_Path(0));
    dt.AddRange(m_1, new GH_Path(0));
    dt.AddRange(f_0, new GH_Path(0));
    dt.AddRange(f_1, new GH_Path(0));
    A = dt;
    B = arrays;
    C = "ss_e_op_0_" + divisions.ToString();
# ---------- c_script_2: C# additional code ----------
  public  Point3d[] InterpolatePoints(Point3d from, Point3d to, int Steps, bool includeEnds = true) {
    Point3d[] point3DArray;

    if (includeEnds) {
      point3DArray = new Point3d[Steps + 2];
      point3DArray[0] = from;

      for (int i = 1; i < Steps + 1; i++) {
        double num = i / (double) (1 + Steps);

        point3DArray[i] = new Point3d(
          Lerp(from.X, to.X, num),
          Lerp(from.Y, to.Y, num),
          Lerp(from.Z, to.Z, num)
          );
      }

      point3DArray[point3DArray.Length - 1] = to;
    } else {

      point3DArray = new Point3d[Steps];

      for (int i = 1; i < Steps + 1; i++) {
        double num = i / (double) (1 + Steps);

        point3DArray[i - 1] = new Point3d(
          Lerp(from.X, to.X, num),
          Lerp(from.Y, to.Y, num),
          Lerp(from.Z, to.Z, num)
          );
      }
    }

    return point3DArray;


  }

  public double Lerp(double value1, double value2, double amount) {
    return value1 + (value2 - value1) * amount;
  }

  /// <summary>
  /// This method will be called once every solution, before any calls to RunScript.
  /// </summary>
  public override void BeforeRunScript()
  { }
  /// <summary>
  /// This method will be called once every solution, after any calls to RunScript.
  /// </summary>
  public override void AfterRunScript()
  { }
# ---------- end c_script_2 ----------
clean_2 = CleanTree(RemoveNulls=True, RemoveInvalid=True, RemoveEmpty=invert(False), Tree=c_script_2.A)
item_2 = ListItem(List=clean_2, Index=0, Wrap=True)  # -> Item, Item1, Item2, Item3, Item4, Item5, Item6, Item7
crv_5 = Curve([item_2.Item4, item_2.Item6])
crv_6 = Curve([item_2.Item, item_2.Item2])
loft_3 = Loft(Curves=crv_5, Options={Adjust=False, Closed=False, LoftEnds=0, LoftSimp=0, LoftType=0, Rebuild=10, Refit=0.01})
loft_4 = Loft(Curves=crv_6, Options={Adjust=False, Closed=False, LoftEnds=0, LoftSimp=0, LoftType=0, Rebuild=10, Refit=0.01})

crv_7 = Curve(flatten(Tree({0;0;0}: [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], {0;1;0}: [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])))
c_script_3 = CSharpScript(rect_pair=crv_7)  # -> out, A, B, C; inputs rect_pair: list of Polyline
# ---------- c_script_3: C# ----------
    this.Component.Message = "tenon mortise ts_e_p_2 ";
    ////////////////////////////////////////////////////////////////////
    //Number of divisions
    //Input joint line (its lengths)
    //Input distance for division
    ////////////////////////////////////////////////////////////////////
    double joint_length = Math.Abs(500);
    double division_distance = Math.Abs(60);
    int divisions = (int) Math.Ceiling(joint_length / division_distance);
    divisions = (int) Math.Max(2, Math.Min(20, divisions));
    divisions += divisions % 2;
    ////////////////////////////////////////////////////////////////////
    //Interpolate points
    ////////////////////////////////////////////////////////////////////
    Point3d[][] arrays = new Point3d[4][];
    for(int i = 0; i < 4; i++)
      arrays[i] = InterpolatePoints(rect_pair[0][i], rect_pair[1][i], divisions, false);

    ////////////////////////////////////////////////////////////////////
    //Move segments
    ////////////////////////////////////////////////////////////////////
    int start = 0;
    double t = 0.0;
    Vector3d v = t == 0 ? Vector3d.Zero : new Vector3d(0, 0, t / (divisions + 2));
    for(int i = start; i < 4; i++){

      int mid = (int) (arrays[i].Length * 0.5);

      for(int j = 0; j < arrays[i].Length; j++){

        int flip = (j % 2 == 0) ? 1 : -1;
        flip = i < 2 ? flip : flip * -1;

        arrays[i][j] += v * flip;



      }
    }

    ////////////////////////////////////////////////////////////////////
    //Create Polylines
    ////////////////////////////////////////////////////////////////////
    Polyline[] m_0 = new Polyline[2];
    Polyline[] m_1 = new Polyline[2];



    for(int i = 0; i < 4;i += 2){
      Polyline pline = new Polyline();
      for(int j = 0; j < arrays[0].Length; j++){

        bool flip = j % 2 < 1;
        flip = i < 2 ? flip : !flip;

        if(flip){
          pline.Add(arrays[i + 0][j]);
          pline.Add(arrays[i + 1][j]);
        } else{
          pline.Add(arrays[i + 1][j]);
          pline.Add(arrays[i + 0][j]);
        }

      }

      if(i < 2){
        m_1[0] = pline;
        m_1[1] = new Polyline(){pline[0],pline[pline.Count - 1]};
      }else{
        m_0[0] = pline;
        m_0[1] = new Polyline(){pline[0],pline[pline.Count - 1]};
      }
    }

    int size = (int) (divisions * 0.5 ) + 1;
    Polyline[] f_0 = new Polyline[size];
    Polyline[] f_1 = new Polyline[size];


    for(int i = 0; i < m_1[0].Count ;i += 4){

      int id = (int) (i * 0.25);
      f_0[id] = new Polyline(5){m_0[0][i + 0],m_0[0][i + 3],m_1[0][i + 3],m_1[0][i + 0],m_0[0][i + 0]};
      f_1[id] = new Polyline(5){m_0[0][i + 1],m_0[0][i + 2],m_1[0][i + 2],m_1[0][i + 1],m_0[0][i + 1]};

    }
    f_0[size - 1] = new Polyline(){f_0[0][0],f_0[0][3],f_0[size - 2][3],f_0[size - 2][0],f_0[0][0]};
    f_1[size - 1] = new Polyline(){f_1[0][0],f_1[0][3],f_1[size - 2][3],f_1[size - 2][0],f_1[0][0]};




    ////////////////////////////////////////////////////////////////////
    //Output
    ////////////////////////////////////////////////////////////////////

    var dt = new DataTree<Polyline>();
    dt.AddRange(m_0, new GH_Path(0));
    dt.AddRange(m_1, new GH_Path(0));
    dt.AddRange(f_0, new GH_Path(0));
    dt.AddRange(f_1, new GH_Path(0));
    A = dt;
    B = arrays;
    C = "ts_e_p_2" + divisions.ToString();
# ---------- c_script_3: C# additional code ----------
  public  Point3d[] InterpolatePoints(Point3d from, Point3d to, int Steps, bool includeEnds = true) {
    Point3d[] point3DArray;

    if (includeEnds) {
      point3DArray = new Point3d[Steps + 2];
      point3DArray[0] = from;

      for (int i = 1; i < Steps + 1; i++) {
        double num = i / (double) (1 + Steps);

        point3DArray[i] = new Point3d(
          Lerp(from.X, to.X, num),
          Lerp(from.Y, to.Y, num),
          Lerp(from.Z, to.Z, num)
          );
      }

      point3DArray[point3DArray.Length - 1] = to;
    } else {

      point3DArray = new Point3d[Steps];

      for (int i = 1; i < Steps + 1; i++) {
        double num = i / (double) (1 + Steps);

        point3DArray[i - 1] = new Point3d(
          Lerp(from.X, to.X, num),
          Lerp(from.Y, to.Y, num),
          Lerp(from.Z, to.Z, num)
          );
      }
    }

    return point3DArray;


  }

  public double Lerp(double value1, double value2, double amount) {
    return value1 + (value2 - value1) * amount;
  }

  /// <summary>
  /// This method will be called once every solution, before any calls to RunScript.
  /// </summary>
  public override void BeforeRunScript()
  { }
  /// <summary>
  /// This method will be called once every solution, after any calls to RunScript.
  /// </summary>
  public override void AfterRunScript()
  { }
# ---------- end c_script_3 ----------
clean_3 = CleanTree(RemoveNulls=True, RemoveInvalid=True, RemoveEmpty=invert(False), Tree=c_script_3.A)
item_3 = ListItem(List=clean_3, Index=0, Wrap=True)  # -> Item, Item1, Item2, Item3, Item4, Item5, Item6, Item7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
loft_5 = Loft(
    Curves=[item_3.Item4, item_3.Item10],
    Options={Adjust=False, Closed=False, LoftEnds=0, LoftSimp=0, LoftType=0, Rebuild=10, Refit=0.01})
loft_6 = Loft(
    Curves=[item_3.Item8, item_3.Item14],
    Options={Adjust=False, Closed=False, LoftEnds=0, LoftSimp=0, LoftType=0, Rebuild=10, Refit=0.01})
loft_7 = Loft(
    Curves=[item_3.Item7, item_3.Item13],
    Options={Adjust=False, Closed=False, LoftEnds=0, LoftSimp=0, LoftType=0, Rebuild=10, Refit=0.01})
loft_8 = Loft(
    Curves=[item_3.Item5, item_3.Item11],
    Options={Adjust=False, Closed=False, LoftEnds=0, LoftSimp=0, LoftType=0, Rebuild=10, Refit=0.01})
loft_9 = Loft(
    Curves=[item_3.Item6, item_3.Item12],
    Options={Adjust=False, Closed=False, LoftEnds=0, LoftSimp=0, LoftType=0, Rebuild=10, Refit=0.01})
loft_10 = Loft(
    Curves=[item_3.Item, item_3.Item2],
    Options={Adjust=False, Closed=False, LoftEnds=0, LoftSimp=0, LoftType=0, Rebuild=10, Refit=0.01})

crv_8 = Curve([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])
c_script_4 = CSharpScript(rect_pair=crv_8)  # -> out, A, B, C; inputs rect_pair: list of Polyline
# ---------- c_script_4: C# ----------
    this.Component.Message = "ss_e_ip_2 Japanese Dovetail";
    ////////////////////////////////////////////////////////////////////
    //Number of divisions
    //Input joint line (its lengths)
    //Input distance for division
    ////////////////////////////////////////////////////////////////////
    double joint_length = Math.Abs(500);
    double division_distance = Math.Abs(60);
    int divisions = (int) Math.Ceiling(joint_length / division_distance);
    divisions = (int) Math.Max(2, Math.Min(20, divisions));
    divisions += divisions % 2;
    ////////////////////////////////////////////////////////////////////
    //Interpolate points
    ////////////////////////////////////////////////////////////////////
    Point3d[][] arrays = new Point3d[4][];
    for(int i = 0; i < 4; i++)
      arrays[i] = InterpolatePoints(rect_pair[0][i], rect_pair[1][i], divisions, false);

    ////////////////////////////////////////////////////////////////////
    //Move segments
    ////////////////////////////////////////////////////////////////////
    int start = 0;
    double t = 0.1;
    Vector3d v = t == 0 ? Vector3d.Zero : new Vector3d(0, 0, t / (divisions + 2));
    
    Vector3d translation = new Vector3d(0, 0, t);
    for(int i = start; i < 4; i++){

      int mid = (int) (arrays[i].Length * 0.5);

      for(int j = 0; j < arrays[i].Length; j++){

        int flip = (j % 2 == 0) ? 1 : -1;
        flip = i < 2 ? flip : flip * -1;

        arrays[i][j] += v * flip;
        
        
        
        if(i==0 || i == 3){
          int flip_t = (j >=  mid) ? 1 : -1;
          arrays[i][j] += translation*flip_t*0.125;
        }
        
      }
    }


    ////////////////////////////////////////////////////////////////////
    //Create Polylines
    ////////////////////////////////////////////////////////////////////
    Polyline[] m_0 = new Polyline[2];
    Polyline[] m_1 = new Polyline[2];
    Polyline[] f_0 = new Polyline[2];
    Polyline[] f_1 = new Polyline[2];


    for(int i = 0; i < 4;i += 2){
      Polyline pline = new Polyline();
      for(int j = 0; j < arrays[0].Length; j++){

        bool flip = j % 2 < 1;
        flip = i < 2 ? flip : !flip;

        if(flip){
          pline.Add(arrays[i + 0][j]);
          pline.Add(arrays[i + 1][j]);
        } else{
          pline.Add(arrays[i + 1][j]);
          pline.Add(arrays[i + 0][j]);
        }

      }
      

      

      if(i < 2){
        m_1[0] = pline;
   
        m_1[1] = new Polyline(){pline[0],pline[pline.Count - 1]};
      }else{
        m_0[0] = pline;
        m_0[1] = new Polyline(){pline[0],pline[pline.Count - 1]};
      }
    }
    


    for(int i = 1; i < 4;i += 2){
      Polyline pline = new Polyline();
      for(int j = 0; j < arrays[0].Length; j++){

        bool flip = j % 2 == 0;
        flip = i < 2 ? flip : !flip;

        if(flip){
          pline.Add(arrays[i + 0][j]);
          pline.Add(arrays[(i + 1) % 4][j]);
        } else{
          pline.Add(arrays[(i + 1) % 4][j]);
          pline.Add(arrays[i + 0][j]);
        }

      }

      if(i < 2){
        f_0[0] = pline;
        f_0[1] = new Polyline(){pline[0],pline[pline.Count - 1]};
      }else{
        f_1[0] = pline;
        f_1[1] = new Polyline(){pline[0],pline[pline.Count - 1]};
      }
    }

    ////////////////////////////////////////////////////////////////////
    //Create bisectors by mobing end point to corners
    ////////////////////////////////////////////////////////////////////
    f_0[0][0] = f_0[0][1];
    f_0[0][1] += new Vector3d(0.005, 0, 0); 
    
    f_0[0][f_0[0].Count - 1] = f_0[0][f_0[0].Count - 2];
    f_0[0][f_0[0].Count - 2] += new Vector3d(0.005, 0, 0); 
    
    //Line
    f_0[1] = new Polyline(){f_0[0][0],f_0[0][f_0[0].Count - 1]};
    
    m_0[0][0] = m_0[0][1];
    m_0[0][1] += new Vector3d(0.005, 0, 0); 
    
    m_0[0][m_0[0].Count - 1] = m_0[0][m_0[0].Count - 2];
    m_0[0][m_0[0].Count - 2] += new Vector3d(0.005, 0, 0); 
    
    //Line
    m_1[1] = new Polyline(){m_0[0][0],m_0[0][m_0[0].Count - 1]};
    
    
    ////////////////////////////////////////////////////////////////////
    //Output
    ////////////////////////////////////////////////////////////////////

    var dt = new DataTree<Polyline>();
    dt.AddRange(m_0, new GH_Path(0));
    dt.AddRange(m_1, new GH_Path(0));
    dt.AddRange(f_0, new GH_Path(0));
    dt.AddRange(f_1, new GH_Path(0));
    A = dt;
    B = arrays;
    C = "ss_e_op_0_" + divisions.ToString();
# ---------- c_script_4: C# additional code ----------
  public  Point3d[] InterpolatePoints(Point3d from, Point3d to, int Steps, bool includeEnds = true) {
    Point3d[] point3DArray;

    if (includeEnds) {
      point3DArray = new Point3d[Steps + 2];
      point3DArray[0] = from;

      for (int i = 1; i < Steps + 1; i++) {
        double num = i / (double) (1 + Steps);

        point3DArray[i] = new Point3d(
          Lerp(from.X, to.X, num),
          Lerp(from.Y, to.Y, num),
          Lerp(from.Z, to.Z, num)
          );
      }

      point3DArray[point3DArray.Length - 1] = to;
    } else {

      point3DArray = new Point3d[Steps];

      for (int i = 1; i < Steps + 1; i++) {
        double num = i / (double) (1 + Steps);

        point3DArray[i - 1] = new Point3d(
          Lerp(from.X, to.X, num),
          Lerp(from.Y, to.Y, num),
          Lerp(from.Z, to.Z, num)
          );
      }
    }

    return point3DArray;


  }

  public double Lerp(double value1, double value2, double amount) {
    return value1 + (value2 - value1) * amount;
  }

  /// <summary>
  /// This method will be called once every solution, before any calls to RunScript.
  /// </summary>
  public override void BeforeRunScript()
  { }
  /// <summary>
  /// This method will be called once every solution, after any calls to RunScript.
  /// </summary>
  public override void AfterRunScript()
  { }
# ---------- end c_script_4 ----------
clean_4 = CleanTree(RemoveNulls=True, RemoveInvalid=True, RemoveEmpty=invert(False), Tree=c_script_4.A)
item_4 = ListItem(List=clean_4, Index=0, Wrap=True)  # -> Item, Item1, Item2, Item3, Item4, Item5, Item6, Item7
crv_9 = Curve([item_4.Item4, item_4.Item6])
crv_10 = Curve([item_4.Item, item_4.Item2])
loft_11 = Loft(Curves=crv_9, Options={Adjust=False, Closed=False, LoftEnds=0, LoftSimp=0, LoftType=0, Rebuild=10, Refit=0.01})
loft_12 = Loft(Curves=crv_10, Options={Adjust=False, Closed=False, LoftEnds=0, LoftSimp=0, LoftType=0, Rebuild=10, Refit=0.01})

crv_11 = Curve(flatten(Tree({0;0;0}: [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], {0;1;0}: [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])))
c_script_5 = CSharpScript(rect_pair=crv_11)  # -> out, A, B, C; inputs rect_pair: list of Polyline
# ---------- c_script_5: C# ----------
    ////////////////////////////////////////////////////////////////////
    //Number of divisions
    //Input joint line (its lengths)
    //Input distance for division
    ////////////////////////////////////////////////////////////////////
    double joint_length = Math.Abs(500);
    double division_distance = Math.Abs(60);
    int divisions = (int) Math.Ceiling(joint_length / division_distance);
    divisions = (int) Math.Max(4, Math.Min(20, divisions));
    divisions -= (divisions % 4);
    ////////////////////////////////////////////////////////////////////
    //Interpolate points
    ////////////////////////////////////////////////////////////////////
    Point3d[][] arrays = new Point3d[4][];
    for(int i = 0; i < 4; i++)
      arrays[i] = InterpolatePoints(rect_pair[0][i], rect_pair[1][i], divisions, false);

    Print(arrays[0].Length.ToString());

    ////////////////////////////////////////////////////////////////////
    //Move segments
    ////////////////////////////////////////////////////////////////////
    int start = 0;
    double t = 0.0;
    Vector3d v = t == 0 ? Vector3d.Zero : new Vector3d(0, 0, t / (divisions + 2));
    for(int i = start; i < 4; i++){

      int mid = (int) (arrays[i].Length * 0.5);

      for(int j = 0; j < arrays[i].Length; j++){

        int flip = (j % 2 == 0) ? 1 : -1;
        flip = i < 2 ? flip : flip * -1;

        arrays[i][j] += v * flip;



      }
    }

    ////////////////////////////////////////////////////////////////////
    //Create Polylines
    ////////////////////////////////////////////////////////////////////
    Polyline[] m_0 = new Polyline[2];
    Polyline[] m_1 = new Polyline[2];



    for(int i = 0; i < 4;i += 2){


      Polyline pline = new Polyline();

      for(int j = 0; j < arrays[0].Length; j++){
        if(j % 4 > 1 ) continue;

        bool flip = j % 2 < 1;
        flip = i < 2 ? flip : !flip;

        if(flip){
          pline.Add(arrays[i + 0][j]);
          pline.Add(arrays[i + 1][j]);
        } else{
          pline.Add(arrays[i + 1][j]);
          pline.Add(arrays[i + 0][j]);
        }

      }



      if(i < 2){
        pline.Add(arrays[i + 0][arrays[0].Length - 1]);
        m_1[0] = pline;
        m_1[1] = new Polyline(){pline[0],pline[pline.Count - 1]};
      }else{
        pline.Add(arrays[i + 1][arrays[0].Length - 1]);
        m_0[0] = pline;
        m_0[1] = new Polyline(){pline[0],pline[pline.Count - 1]};
      }
    }





    int size = (int) (divisions * 0.25 ) + 1;
    //Print(size.ToString());
    //Print(m_0[0].Count.ToString());
    Polyline[] f_0 = new Polyline[size];
    Polyline[] f_1 = new Polyline[size];


    for(int i = 0; i < m_0[0].Count - m_0[0].Count % 4; i += 4){


      int id = (int) (i * 0.25);
      f_0[id] = new Polyline(5){m_0[0][i + 0],m_0[0][i + 3],m_1[0][i + 3],m_1[0][i + 0],m_0[0][i + 0]};
      f_1[id] = new Polyline(5){m_0[0][i + 1],m_0[0][i + 2],m_1[0][i + 2],m_1[0][i + 1],m_0[0][i + 1]};

    }
    f_0[size - 1] = new Polyline(){f_0[0][0],f_0[0][3],f_0[size - 2][3],f_0[size - 2][0],f_0[0][0]};
    f_1[size - 1] = new Polyline(){f_1[0][0],f_1[0][3],f_1[size - 2][3],f_1[size - 2][0],f_1[0][0]};




    ////////////////////////////////////////////////////////////////////
    //Output
    ////////////////////////////////////////////////////////////////////

    var dt = new DataTree<Polyline>();
    dt.AddRange(m_0, new GH_Path(0));
    dt.AddRange(m_1, new GH_Path(0));
    dt.AddRange(f_0, new GH_Path(0));
    dt.AddRange(f_1, new GH_Path(0));
    A = dt;
    B = arrays;
    C = "ts_e_p_2" + divisions.ToString();
# ---------- c_script_5: C# additional code ----------
  public  Point3d[] InterpolatePoints(Point3d from, Point3d to, int Steps, bool includeEnds = true) {
    Point3d[] point3DArray;

    if (includeEnds) {
      point3DArray = new Point3d[Steps + 2];
      point3DArray[0] = from;

      for (int i = 1; i < Steps + 1; i++) {
        double num = i / (double) (1 + Steps);

        point3DArray[i] = new Point3d(
          Lerp(from.X, to.X, num),
          Lerp(from.Y, to.Y, num),
          Lerp(from.Z, to.Z, num)
          );
      }

      point3DArray[point3DArray.Length - 1] = to;
    } else {

      point3DArray = new Point3d[Steps];

      for (int i = 1; i < Steps + 1; i++) {
        double num = i / (double) (1 + Steps);

        point3DArray[i - 1] = new Point3d(
          Lerp(from.X, to.X, num),
          Lerp(from.Y, to.Y, num),
          Lerp(from.Z, to.Z, num)
          );
      }
    }

    return point3DArray;


  }

  public double Lerp(double value1, double value2, double amount) {
    return value1 + (value2 - value1) * amount;
  }

  /// <summary>
  /// This method will be called once every solution, before any calls to RunScript.
  /// </summary>
  public override void BeforeRunScript()
  { }
  /// <summary>
  /// This method will be called once every solution, after any calls to RunScript.
  /// </summary>
  public override void AfterRunScript()
  { }
# ---------- end c_script_5 ----------
clean_5 = CleanTree(RemoveNulls=True, RemoveInvalid=True, RemoveEmpty=invert(False), Tree=c_script_5.A)
item_5 = ListItem(List=clean_5, Index=0, Wrap=True)  # -> Item, Item1, Item2, Item3, Item4, Item5, Item6, Item7, Item8, Item9
loft_13 = Loft(
    Curves=[item_5.Item4, item_5.Item7],
    Options={Adjust=False, Closed=False, LoftEnds=0, LoftSimp=0, LoftType=0, Rebuild=10, Refit=0.01})
loft_14 = Loft(
    Curves=[item_5.Item5, item_5.Item8],
    Options={Adjust=False, Closed=False, LoftEnds=0, LoftSimp=0, LoftType=0, Rebuild=10, Refit=0.01})
loft_15 = Loft(
    Curves=[item_5.Item, item_5.Item2],
    Options={Adjust=False, Closed=False, LoftEnds=0, LoftSimp=0, LoftType=0, Rebuild=10, Refit=0.01})

panel = Panel(c_script_5.out)
# Convert Rhino Polylines to XML
c_script_6 = CSharpScript()  # -> out, A, B, C, D
# ---------- c_script_6: C# ----------
    A = new Polyline(new Point3d  []
      { new Point3d(0, -0.5, 0.357142857142857), new Point3d(-0.5, -0.5, 0.357142857142857), new Point3d(-0.5, -0.5, 0.214285714285714),
      new Point3d(0.5, -0.5, 0.214285714285714), new Point3d(0.5, -0.5, 0.0714285714285714), new Point3d(-0.5, -0.5, 0.0714285714285714),
      new Point3d(-0.5, -0.5, -0.0714285714285714), new Point3d(0.5, -0.5, -0.0714285714285714), new Point3d(0.5, -0.5, -0.214285714285714),
      new Point3d(-0.5, -0.5, -0.214285714285714), new Point3d(-0.5, -0.5, -0.357142857142857), new Point3d(0, -0.5, -0.357142857142857) });

    B = new Polyline(new Point3d  []
      { new Point3d(0, 0.5, 0.357142857142857), new Point3d(-0.5, 0.5, 0.357142857142857), new Point3d(-0.5, 0.5, 0.214285714285714),
      new Point3d(0.5, 0.5, 0.214285714285714), new Point3d(0.5, 0.5, 0.0714285714285714), new Point3d(-0.5, 0.5, 0.0714285714285714),
      new Point3d(-0.5, 0.5, -0.0714285714285714), new Point3d(0.5, 0.5, -0.0714285714285714), new Point3d(0.5, 0.5, -0.214285714285714),
      new Point3d(-0.5, 0.5, -0.214285714285714), new Point3d(-0.5, 0.5, -0.357142857142857), new Point3d(0, 0.5, -0.357142857142857) });

    ////////////////////////////////////////////////////////////////////
    //Number of divisions
    //Input joint line (its lengths)
    //Input distance for division
    ////////////////////////////////////////////////////////////////////
    double joint_length = Math.Abs(500);
    double division_distance = Math.Abs(60);
    int divisions = (int) Math.Ceiling(joint_length / division_distance);
    divisions = (int) Math.Max(2, Math.Min(20, divisions));
    divisions += divisions % 2;
    double t = 0.25;

    //////////////////////////////////////////////////////////////////////////////////////////
    //Interpolate points
    //////////////////////////////////////////////////////////////////////////////////////////
    Point3d[] pts0 = InterpolatePoints(new Point3d(0, -0.5, 0.5), new Point3d(0, -0.5, -0.5), divisions, false);
    Vector3d v = new Vector3d(0.5, 0, 0);
    Vector3d v_d = new Vector3d(0, 0, -(1.0 / ((divisions + 1) * 2)) * t);

    int count = pts0.Length * 2;

    //1st polyline
    Polyline pline0 = new Polyline();
    pline0.Add(pts0[0]);
    pline0.Add(pts0[0] - v - v_d);

    for(int i = 1; i < pts0.Length - 1;i++){
      if(i % 2 == 1){
        pline0.Add(pts0[i] - v + v_d);
        pline0.Add(pts0[i] + v - v_d);
      }else{
        pline0.Add(pts0[i] + v + v_d);
        pline0.Add(pts0[i] - v - v_d);
      }
    }

    pline0.Add(pts0[pts0.Length - 1] - v + v_d);
    pline0.Add(pts0[pts0.Length - 1]);

    //2nd polyline
    Vector3d v_o = new Vector3d(0, 1, 0);
    Polyline pline1 = new Polyline();
    for (int i = 0; i < pline0.Count;i++){
      pline1.Add(pline0[i] + v_o);
    }


    //////////////////////////////////////////////////////////////////////////////////////////
    //Move points
    //////////////////////////////////////////////////////////////////////////////////////////

    // A = p0;
    // B = p1;
    C = pline0;
    D = pline1;
# ---------- c_script_6: C# additional code ----------
  public  Point3d[] InterpolatePoints(Point3d from, Point3d to, int Steps, bool includeEnds = true) {
    Point3d[] point3DArray;

    if (includeEnds) {
      point3DArray = new Point3d[Steps + 2];
      point3DArray[0] = from;

      for (int i = 1; i < Steps + 1; i++) {
        double num = i / (double) (1 + Steps);

        point3DArray[i] = new Point3d(
          Lerp(from.X, to.X, num),
          Lerp(from.Y, to.Y, num),
          Lerp(from.Z, to.Z, num)
          );
      }

      point3DArray[point3DArray.Length - 1] = to;
    } else {

      point3DArray = new Point3d[Steps];

      for (int i = 1; i < Steps + 1; i++) {
        double num = i / (double) (1 + Steps);

        point3DArray[i - 1] = new Point3d(
          Lerp(from.X, to.X, num),
          Lerp(from.Y, to.Y, num),
          Lerp(from.Z, to.Z, num)
          );
      }
    }

    return point3DArray;


  }

  public double Lerp(double value1, double value2, double amount) {
    return value1 + (value2 - value1) * amount;
  }
# ---------- end c_script_6 ----------
c_script_7 = CSharpScript()  # -> out, Polylines, A
# ---------- c_script_7: C# ----------
    string[] x = System.IO.File.ReadAllLines(@"C:\IBOIS57\_Code\Software\Python\Pybind11Example\vsstudio\Release\output.txt");
    var dt = new DataTree<Polyline>();

    int c = 0;
    Polyline pline = new Polyline();
    for(int i = 0; i < x.Length;i++){

      if(x[i] == ""){
        dt.Add(new Polyline(pline), new GH_Path(c));
        pline.Clear();
        c++;
      }else{

        string[] txt = x[i].Split(' ');
        Point3d p = new Point3d(Convert.ToDouble(txt[0]), Convert.ToDouble(txt[1]), Convert.ToDouble(txt[2]));
        pline.Add(p);

      }


    }

    Polylines = dt;
# ---------- end c_script_7 ----------
gl_shader = GLShader(
    Vertex=[Point(-1, -1, -1), Point(1, -1, -1), Point(1, 1, -1), Point(-1, 1, -1)],
    Color=RGB(0, 0, 0),
    Thickness=Slider(5, range=0..10),
    Res=15,
    DepthTestingEnabled=False,
    DepthWritingEnabled=False,
    DrawMode=6,
    FragmentShader="""#version 330 core
uniform sampler2D _depthBuffer;
uniform sampler2D _colorBuffer;

uniform vec2 _viewportSize;
uniform vec4 color;
uniform float thickness;
uniform float res;

void main() 
{
  vec2 uv = gl_FragCoord.xy / _viewportSize;

  vec4 buffer = texture(_depthBuffer, uv);
  float val = step(0.9999, buffer.x);
  float col = 1.0;
  float div = res;
  float stepang = 360.0 / div;
  for(float i = 0; i<div; i++){
    vec4 bufferP = texture(_depthBuffer, (gl_FragCoord.xy + vec2(cos(radians(stepang*i)), sin(radians(stepang*i)))*thickness) / _viewportSize);
    float valP = step(0.9999, bufferP.x);
    if(val - valP > 0.0){
      col *= 0.0;
    }
  }
  
  vec3 col3 = mix(color.xyz, texture(_colorBuffer, uv).xyz, col);
  
  gl_FragColor = vec4(vec3(col3), 1.0);
 
}""",
    GLShader=(0, 1, 0),
    PreviewSortOrder=5,
    VertexShader="""#version 330

layout(location = 0) in vec3 vertex;



out vec3 normal;

void main() {
  gl_Position = vec4(vertex,1.0);
}""",
    glLineWidth=1,
    glPointSize=8)
crv_12 = Curve([c_script_6.C, c_script_6.D])
crv_13 = Curve(c_script_7.Polylines)
crv_14 = Curve([<curve referenced from the Rhino model> x2])
crv_15 = Curve([<curve referenced from the Rhino model> x2])
loft_16 = Loft(Curves=crv_12, Options={Adjust=False, Closed=False, LoftEnds=0, LoftSimp=0, LoftType=0, Rebuild=10, Refit=0.01})
loftholes = LoftHoles(Polylines0=crv_15, Polylines1=crv_14)  # -> Mesh, Mesh_2
textfiletopolylines = TextFileToPolylines()  # -> out, Polylines; same code as c_script_7
mesh = Mesh(loftholes.Mesh_2)
crv_16 = Curve(item_5.Item2)
crv_17 = Curve(item_5.Item4)
pt = Point([<point referenced from the Rhino model> x2])
crv_18 = Curve(<curve referenced from the Rhino model>)
Y = UnitY(Factor=1)
tan = TangentLines(Point=pt, Circle=crv_18)  # -> Tangent1, Tangent2
X = UnitX(Factor=1)
pl = ConstructPlane(Origin=Point(0, 0, 0), XAxis=Y, YAxis=X)
pl_2 = ConstructPlane(Origin=Point(0, 0, 0), XAxis=Vector(1, 0, 0), YAxis=Vector(0, 1, 0))
c_script_8 = CSharpScript()  # -> out, A, graft(B), graft(C), D, E, F, AA
# ---------- c_script_8: C# ----------
    double shift = 0.4;//
    double s = Math.Max(Math.Min(shift, 1), 0);
    s = 0.05 + (s - 0.0) * (0.4 - 0.05) / (1.0 - 0.0);
    //Print(s.ToString());
    this.Component.Message = "cr_c_ip_0";

    double a = 0.5 - s;
    double b = 0.5;
    double c = 2 * (b - a);
    double z = 0.5;

    Point3d[] p = new Point3d[]{
      new Point3d(a, -a, 0),new Point3d(-a, -a, 0),new Point3d(-a, a, 0),new Point3d(a, a, 0),//Center
      new Point3d(a + c, -a - c, 0),new Point3d(-a - c, -a - c, 0),new Point3d(-a - c, a + c, 0),new Point3d(a + c, a + c, 0),//CenterOffset
      new Point3d(b, -b, z),new Point3d(-b, -b, z),new Point3d(-b, b, z),new Point3d(b, b, z),//Top
      new Point3d(b, -b, -z),new Point3d(-b, -b, -z),new Point3d(-b, b, -z),new Point3d(b, b, -z),//Bottom
      };


    //Print(a.ToString());
    Print((a * 2).ToString());
    //Construct polylines from points
    Print((p[0] - p[1]).Length.ToString());
    Vector3d v0 = ((p[0] - p[1]) * (1 / (a * 2))) * (0.5 - a);
    Print((1 / (a * 2)).ToString());
    //v0.Unitize();
    var plines0_0 = new Polyline[]{

      new Polyline{ p[0] + v0, p[1] - v0, p[2] - v0, p[3] + v0, p[0] + v0 },//Center

      new Polyline{ p[1] - v0, p[0] + v0,p[0 + 8] + v0,p[1 + 8] - v0,p[1] - v0 },//TopSide0
      new Polyline{ p[3] + v0, p[2] - v0,p[2 + 8] - v0,p[3 + 8] + v0,p[3] + v0 },//TopSide1


      new Polyline{ p[2], p[1],p[1 + 12],p[2 + 12],p[2] },//BotSide0
      new Polyline{ p[0], p[3],p[3 + 12],p[0 + 12],p[0] },//BotSide1

      new Polyline{ p[0], p[0 + 12],p[0 + 4],p[0 + 8],p[0] },//Corner0
      new Polyline{ p[1 + 12],p[1],p[1 + 8],p[1 + 4],p[1 + 12]  },//Corner1
      new Polyline{ p[2], p[2 + 12],p[2 + 4],p[2 + 8],p[2] },//Corner2
      new Polyline{ p[3 + 12],p[3],p[3 + 8],p[3 + 4],p[3 + 12]  },//Corner3

      //            new Polyline{ p[0 + 12],p[3 + 12],p[3 + 4],p[0 + 4],p[0 + 12]  },//Mesh Faces
      //            new Polyline{ p[0 + 4],p[3 + 4],p[3 + 8],p[4 + 4],p[0 + 4]  },//Mesh Faces
      //            new Polyline{ p[4 + 4],p[3 + 8],p[2 + 8],p[1 + 8],p[4 + 4]  },//Mesh Faces
      //            new Polyline{ p[1 + 8],p[2 + 8],p[2 + 4],p[1 + 4],p[1 + 8]  },//Mesh Faces
      //            new Polyline{ p[1 + 4],p[2 + 4],p[2 + 12],p[1 + 12],p[1 + 4]  },//Mesh Faces

      };


    //Offset and
    //flip polylines
    var plines0_1 = new Polyline[9];
    var plines1_0 = new Polyline[9];
    var plines1_1 = new Polyline[9];
    Transform xform = Transform.PlaneToPlane(Plane.WorldXY, new Plane(Point3d.Origin, Vector3d.YAxis, Vector3d.XAxis));
    var lenghts = new double[9]{0.5,0.4,0.4, 0.4,0.4,  0.1,0.1,0.1,0.1};
    for(int i = 0; i < 9;i++){

      plines0_1[i] = plines0_0[i].Duplicate();
      Vector3d cross = Vector3d.CrossProduct(plines0_1[i][1] - plines0_1[i][0], plines0_1[i][1] - plines0_1[i][2]);
      cross.Unitize();
      for(int j = 0; j < plines0_1[i].Count;j++)
        plines0_1[i][j] += cross * lenghts[i];

      plines1_0[i] = plines0_0[i].Duplicate();
      plines1_0[i].Transform(xform);
      plines1_1[i] = plines0_1[i].Duplicate();
      plines1_1[i].Transform(xform);

    }




    //Construct closed mesh
    //Construct Mesh
    Mesh mesh0 = new Mesh();
    mesh0.Vertices.AddVertices(p);

    mesh0.Faces.AddFace(0, 1, 2);
    mesh0.Faces.AddFace(2, 3, 0);

    mesh0.Faces.AddFace(1, 0, 0 + 8);
    mesh0.Faces.AddFace(0 + 8, 1 + 8, 1);

    mesh0.Faces.AddFace(3, 2, 2 + 8);
    mesh0.Faces.AddFace(2 + 8, 3 + 8, 3);

    mesh0.Faces.AddFace(2, 1, 1 + 12);
    mesh0.Faces.AddFace(1 + 12, 2 + 12, 2);

    mesh0.Faces.AddFace(0, 3, 3 + 12);
    mesh0.Faces.AddFace(3 + 12, 0 + 12, 0);

    mesh0.Faces.AddFace(0, 0 + 12, 0 + 4);
    mesh0.Faces.AddFace(0 + 4, 0 + 8, 0);

    mesh0.Faces.AddFace(1 + 12, 1, 1 + 8);
    mesh0.Faces.AddFace(1 + 8, 1 + 4, 1 + 12);

    mesh0.Faces.AddFace(2, 2 + 12, 2 + 4);
    mesh0.Faces.AddFace(2 + 4, 2 + 8, 2);

    mesh0.Faces.AddFace(3 + 12, 3, 3 + 8);
    mesh0.Faces.AddFace(3 + 8, 3 + 4, 3 + 12);

    mesh0.Faces.AddFace(0 + 12, 3 + 12, 3 + 4);
    mesh0.Faces.AddFace(3 + 4, 0 + 4, 0 + 12);

    mesh0.Faces.AddFace(0 + 4, 3 + 4, 3 + 8);
    mesh0.Faces.AddFace(3 + 8, 4 + 4, 0 + 4);

    mesh0.Faces.AddFace(4 + 4, 3 + 8, 2 + 8);
    mesh0.Faces.AddFace(2 + 8, 1 + 8, 4 + 4);

    mesh0.Faces.AddFace(1 + 8, 2 + 8, 2 + 4);
    mesh0.Faces.AddFace(2 + 4, 1 + 4, 1 + 8);

    mesh0.Faces.AddFace(1 + 4, 2 + 4, 2 + 12);
    mesh0.Faces.AddFace(2 + 12, 1 + 12, 1 + 4);

    Mesh mesh1 = mesh0.DuplicateMesh();
    mesh1.Transform(xform);







    A = p;
    B = plines0_0;
    C = plines0_1;
    E = plines1_0;
    F = plines1_1;

    D = xform;
    AA = new Mesh[]{mesh0,mesh1};
# ---------- end c_script_8 ----------
mesh_2 = Mesh(c_script_8.AA)
boundary = BoundarySurfaces(Edges=flatten(c_script_8.B))
crv_19 = Curve(graft(c_script_8.C))
crv_20 = Curve(c_script_8.C)
crv_21 = Curve(graft(c_script_8.B))
loft_17 = Loft(
    Curves=[crv_21, crv_19],
    Options={Adjust=False, Closed=False, LoftEnds=0, LoftSimp=0, LoftType=0, Rebuild=10, Refit=0.01})
crv_22 = Curve(c_script_8.B)
join = BrepJoin(Breps=boundary)  # -> Breps, Closed
cap = CapHoles(Brep=loft_17)
brep = Brep(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)
loft_18 = Loft(
    Curves=[c_script_8.B, c_script_8.C],
    Options={Adjust=False, Closed=False, LoftEnds=0, LoftSimp=0, LoftType=0, Rebuild=10, Refit=0.01})
pcenter = PolylineCenter(Polyline=c_script_8.B)  # -> Centers, Normals, Planes
points = PointList(Points=c_script_8.A, Size=0.1)
transform = Transform(Geometry=join.Breps, Transform=c_script_8.D)
cap_2 = CapHoles(Brep=loft_18)  # -> flatten(Brep)
sunion = SolidUnion(Breps=cap_2)
sdiff = SolidDifference(BrepsA=brep, BrepsB=sunion)
panel_3 = Panel(c_script_8.out)
panel_4 = Panel(c_script_8.out)
pt_2 = Point(c_script_8.A)
division = Division(A=Slider(0.55, range=0..1))
multiplication = Multiplication(A=panel_4, B=Slider(2, range=0..10))
points_2 = PointList(Points=pt_2, Size=Slider(0.178, range=0..10))
panel_5 = Panel(multiplication)
