# Grasshopper definition 4_exercise.gh (Grasshopper 1.0.7)
# plug-ins: compas_wood

# ---- group: Input Data-Set
# For the full solution please follow the documentation page: https://ibois-epfl.github.io/compas_wood/latest/
# author: Petras Vestartas
# petrasvestartas@gmail.com
number_slider = Slider(7, range=-10..20)
neg = Negative(Value=number_slider)
mesh = Mesh(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)
crv = Curve([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])
connectors = Connectors(
    Mesh=mesh,
    Face_positions=[neg, number_slider],
    Face_thickness=Slider(4, range=0..10),
    Divisions=Slider(2, range=1..10),
    Division_len=Slider(15, range=1..100),
    Rect_width=Slider(12, range=-20..20),
    Rect_height=Slider(12, range=-20..20),
    Rect_thickness=Slider(1, range=1..2),
    Chamfer=Slider(25, range=0..100),
    Cut=crv)  # -> flatten(F), F_pl, F_id, E, E_pl, E_id

# ----
split = SplitList(List=connectors.F, Index="36")  # -> ListA, ListB
partition = PartitionList(List=connectors.F, Size=2)
crv_2 = Curve(partition)
partition_2 = PartitionList(List=split.ListA, Size=2)  # -> simplify(Chunks)
crv_3 = Curve(partition_2)
